# Grasshopper definition 3d-printing-square.gh (Grasshopper 1.0.7)

# ---- group: Square
# Geometry
number_slider = Slider(10, range=0..10)
rectangle = Rectangle(Plane=PlaneXY(0, 0, 0), XSize=number_slider, YSize=number_slider, Radius=0)  # -> Rectangle, Length
curve = Curve(rectangle.Rectangle)

# ----
panel = Panel("""; -- END GCODE --
G92 E0.0000
G1 E-4.0000 F6000
G28
; --- end of END GCODE --""")
panel_2 = Panel("""; -- START GCODE --
G90
M82
G28
G92 E0.0000
G1 E-4.0000 F6000
; --- end of START GCODE --""")

# ---- group: generate g-code for 3D printing
# Generate G-code
control_points = ControlPoints(Curve=curve)  # -> Points, Weights, Knots
polyline = PolyLine(Vertices=control_points.Points, Closed=False)
explode = Explode(Curve=polyline, Recursive=True)  # -> Segments, Vertices
length = Length(Curve=explode.Segments)
expression = Expression(x=length, Expression="Round(x,3)")
deconstruct = Deconstruct(Point=control_points.Points)  # -> XComponent, YComponent, ZComponent
insert_items = InsertItems(List=expression, Item="0", Indices="0", Wrap=True)
expression_2 = Expression(x=deconstruct.XComponent, Expression="Round(x,2)")
expression_3 = Expression(y=deconstruct.YComponent, Expression="Round(y,2)")
expression_4 = Expression(z=deconstruct.ZComponent, Expression="Round(z,2)")
mass_addition = MassAddition(Input=insert_items)  # -> Result, PartialResults
concatenate = Concatenate(
    G="G1",
    F=" F1800 ",
    X="X",
    x=expression_2,
    Y=" Y",
    y=expression_3,
    Z=" Z",
    z=expression_4,
    E=" E",
    A=mass_addition.PartialResults)

# ----
merge = Merge(Data1=flatten(panel_2), Data2=flatten(concatenate), Data3=flatten(panel))

# ---- group: generate g-code for 3D printing (continued)
panel_3 = Panel(merge)
