# Grasshopper definition 3d-printing-prusa.gh (Grasshopper 1.0.7)

# ---- group: Input geometry
geometry = Geometry()

# ---- group: generate a continuous path for 3D printing
mm = Panel("0.15")
count = Slider(250, range=0..360)
# 3D printing path
contour = Contour(Shape=geometry, Point=Point(0, 0, 0), Direction=Vector(0, 0, 1), Distance=mm)
divide_curve = DivideCurve(Curve=contour, Count=count, Kinks=False)  # -> Points, Tangents, Parameters
flip_matrix = FlipMatrix(Data=divide_curve.Points)
polyline = PolyLine(Vertices=flip_matrix, Closed=False)
explode = Explode(Curve=polyline, Recursive=True)  # -> Segments, Vertices
end_points = EndPoints(Curve=explode.Segments)  # -> Start, End
range = Range(Domain=Domain(0, 1), Steps=expr("x-1", count))
vector_2pt = Vector2Pt(PointA=end_points.Start, PointB=end_points.End, Unitize=False)  # -> Vector, Length
flip_matrix_2 = FlipMatrix(Data=vector_2pt.Vector)
multiplication = Multiplication(A=flip_matrix_2, B=range)
move = Move(Geometry=divide_curve.Points, Motion=multiplication)  # -> Geometry, Transform
polyline_2 = PolyLine(Vertices=flatten(move.Geometry), Closed=False)

# ---- group: Input polyline
curve = Curve(polyline_2)

# ---- group: generate g-code for 3D printing
# Generate G-code
control_points = ControlPoints(Curve=curve)  # -> Points, Weights, Knots
polyline_3 = PolyLine(Vertices=control_points.Points, Closed=False)
explode_2 = Explode(Curve=polyline_3, Recursive=True)  # -> Segments, Vertices
length = Length(Curve=explode_2.Segments)
expression = Expression(x=length, Expression="Round(x,3)")
insert_items = InsertItems(List=expression, Item="0", Indices="0", Wrap=True)
deconstruct = Deconstruct(Point=control_points.Points)  # -> XComponent, YComponent, ZComponent
multiplication_2 = Multiplication(A=insert_items, B="10")
expression_2 = Expression(x=deconstruct.XComponent, Expression="Round(x,2)")
expression_3 = Expression(y=deconstruct.YComponent, Expression="Round(y,2)")
expression_4 = Expression(z=deconstruct.ZComponent, Expression="Round(z,2)")
mass_addition = MassAddition(Input=multiplication_2)  # -> Result, PartialResults
concatenate = Concatenate(
    G="G1",
    F=" F1800 ",
    X="X",
    x=expression_2,
    Y=" Y",
    y=expression_3,
    Z=" Z",
    z=expression_4,
    E=" E",
    A=mass_addition.PartialResults)
panel = Panel("""; -- START GCODE --
G21
G90
M82
M104 S215
M140 S60
M190 S60
M109 S215
G28
G80
G92 E0.0000
G1 F2100 E-0.8
; --- end of START GCODE --""")
panel_2 = Panel("""; -- END GCODE --
M104 S0
M140 S0
M107
G92 E0.0000
G1 F2100 E-0.8
G28
M84
; --- end of END GCODE --""")
merge = Merge(Data1=flatten(panel), Data2=flatten(concatenate), Data3=flatten(panel_2))
panel_3 = Panel(merge)
