# Grasshopper definition 3d-printing-snowflake.gh (Grasshopper 1.0.7)
# plug-ins: FractureHopper

# Koch snowflake
panel = Panel("0,0,0")

# ---- group: koch snowflake curve
# using fracturehopper
number_slider = Slider(2, range=0..10)
point = Point(panel)
point_2 = Point("0,100,0")
point_3 = Point("100,50,0")
kochsnowflake = KochSnowflake(FirstPoint=point, SecondPoint=point_2, ThirdPoint=point_3, Iterations=number_slider)
join_curves = JoinCurves(Curves=kochsnowflake, Preserve=False)

# ----
panel_2 = Panel("""; -- START GCODE --
G90
M82
G28
G92 E0.0000
G1 E-4.0000 F6000
; --- end of START GCODE --""")
panel_3 = Panel("""; -- END GCODE --
G92 E0.0000
G1 E-4.0000 F6000
G28
; --- end of END GCODE --""")

# ---- group: generate g-code for 3D printing
# Generate G-code
control_points = ControlPoints(Curve=join_curves)  # -> Points, Weights, Knots
polyline = PolyLine(Vertices=control_points.Points, Closed=False)
explode = Explode(Curve=polyline, Recursive=True)  # -> Segments, Vertices
length = Length(Curve=explode.Segments)
expression = Expression(x=length, Expression="Round(x,2)")
insert_items = InsertItems(List=expression, Item="0", Indices="0", Wrap=True)
deconstruct = Deconstruct(Point=control_points.Points)  # -> XComponent, YComponent, ZComponent
expression_2 = Expression(x=deconstruct.XComponent, Expression="Round(x,2)")
expression_3 = Expression(y=deconstruct.YComponent, Expression="Round(y,2)")
expression_4 = Expression(z=deconstruct.ZComponent, Expression="Round(z,2)")

# ----
multiplication = Multiplication(A=insert_items, B="4")

# ---- group: generate g-code for 3D printing (continued)
mass_addition = MassAddition(Input=multiplication)  # -> Result, PartialResults
concatenate = Concatenate(
    G="G1",
    F=" F1800 ",
    X="X",
    x=expression_2,
    Y=" Y",
    y=expression_3,
    Z=" Z",
    z=expression_4,
    E=" E",
    A=mass_addition.PartialResults)

# ----
merge = Merge(Data1=flatten(panel_2), Data2=flatten(concatenate), Data3=flatten(panel_3))

# ---- group: generate g-code for 3D printing (continued)
panel_4 = Panel(merge)
