# Grasshopper definition contour-attractor.gh (Grasshopper 1.0.7)
# Copyright: GNU General Public License 3.0

# ---- group: contour attractor
# attractor toolpath
X = Slider(10, range=0..10)
Y = Slider(10, range=0..10)
point = Point([Point(2.494314837, 2.406014843, 0), Point(5.158044591, 8.384824566, 0), Point(7.797745487, 5.406700478, 0)])
interval = Slider(0.5, range=0..1)
square = Square(Plane=PlaneXY(0, 0, 0), Size=1, ExtentX=X, ExtentY=Y)  # -> Cells, flatten(Points)
closest_point = ClosestPoint(Point=square.Points, Cloud=point)  # -> ClosestPoint, CPIndex, Distance
bounds = Bounds(Numbers=closest_point.Distance)
remap_numbers = RemapNumbers(Value=closest_point.Distance, Source=bounds, Target="-2 To 2")  # -> Mapped, Clipped
unit_z = UnitZ(Factor=remap_numbers.Mapped)
move = Move(Geometry=square.Points, Motion=unit_z)  # -> Geometry, Transform
patch = Patch(Points=move.Geometry, Spans=20, Flexibility=1, Trim=True)
contour = Contour(Shape=patch, Point=Point(0, 0, 0), Direction=Vector(0, 0, 1), Distance=interval)

# ---- group: continuous planar path
project = Project(Geometry=contour, Plane=PlaneXY(0, 0, 0))  # -> Geometry, Transform
explode = Explode(Curve=project.Geometry, Recursive=True)  # -> Segments, Vertices
interpolate = Interpolate(Vertices=flatten(explode.Vertices), Degree=3, Periodic=False, KnotStyle=1)  # -> Curve, Length, Domain
