# Grasshopper definition curve-vase.gh (Grasshopper 1.0.7)

# ---- group: construct vase from curves / internalized points
# vase
point = Point([Point(0, -2.01307633, 0), Point(0, -3.862277421, 5.824822564), Point(0, -3.589692141, 8.363923157), Point(0, -2.176387902, 10.32092172)])
point_2 = Point([Point(0, -2.01307633, 0), Point(0, -4.385598196, 4.603518542), Point(0, -2.817090273, 8), Point(0, -2.114707097, 10.32092172)])
point_3 = Point([Point(0, -2.01307633, 0), Point(0, -2.726422794, 3.36130881), Point(0, -4.633739041, 7.294434129), Point(0, -3.764170971, 10.32092172)])
point_4 = Point([Point(0, -2.01307633, 0), Point(0, -4.178738697, 5.159696548), Point(0, -3.512010037, 7.718812905), Point(0, -1.814170434, 10.32092172)])

# ---- group: construct vase from curves
# in the display menu
# turn on the gumball
# to edit these points
scale_z = Slider(1.5, range=0..2)
steps = Slider(3, range=0..10)
range = Range(Domain="0 To 1.5*PI", Steps=steps)
entwine = Entwine(Branch00=point, Branch01=point_2, Branch02=point_3, Branch03=point_4, FlattenInputs=True)
interpolate = Interpolate(Vertices=entwine, Degree=3, Periodic=False, KnotStyle=1)  # -> Curve, Length, Domain
rotate = Rotate(Geometry=flatten(interpolate.Curve), Angle=range, Plane=PlaneXY(0, 0, 0))  # -> Geometry, Transform
loft_options = LoftOptions(Closed=Toggle(True), Adjust=False, Rebuild=0, Refit=0, Type=0)
scale_nu = ScaleNU(Geometry=rotate.Geometry, Plane=PlaneXY(0, 0, 0), ScaleX=1, ScaleY=1, ScaleZ=scale_z)  # -> Geometry, Transform
loft = Loft(Curves=scale_nu.Geometry, Options=loft_options)
custom_preview = CustomPreview(Geometry=loft, Material=ColourSwatch(SwatchColor=RGB(230, 230, 230)))
