# Grasshopper definition ceramic-vases.gh (Grasshopper 1.0.7)
# Copyright: GNU General Public License 3.0
# plug-ins: Heteroptera, Pufferfish

Z = Slider(24, range=0..100)
segments = Slider(10, range=0..10)
line_sdl = LineSDL(Start="0,0,0", Direction=Vector(0, 0, 1), Length=Z)
divide_curve = DivideCurve(Curve=line_sdl, Count=segments, Kinks=False)  # -> Points, Tangents, Parameters
range = Range(Domain=Domain(0, 1), Steps=segments)
graph_mapper = GraphMapper(
    range,
    x0=0,
    x1=1,
    y0=0,
    y1=1,
    container_name="Bezier",
    cpx=[0, 0.6317207813, 0.6424732804, 1],
    cpy=[0, 1, 1, 0.4822126627])
bounds = Bounds(Numbers=graph_mapper)
remap_numbers = RemapNumbers(Value=graph_mapper, Source=bounds, Target="4 To 10")  # -> Mapped, Clipped
circle = Circle(Plane=divide_curve.Points, Radius=remap_numbers.Mapped)

Z_2 = Slider(24, range=0..100)
segments_2 = Slider(10, range=0..10)
line_sdl_2 = LineSDL(Start="0,0,0", Direction=Vector(0, 0, 1), Length=Z_2)
divide_curve_2 = DivideCurve(Curve=line_sdl_2, Count=segments_2, Kinks=False)  # -> Points, Tangents, Parameters
range_2 = Range(Domain=Domain(0, 1), Steps=segments_2)
graph_mapper_2 = GraphMapper(
    range_2,
    x0=0,
    x1=1,
    y0=0,
    y1=1,
    container_name="Bezier",
    cpx=[0, 0.6317207813, 0.6424732804, 1],
    cpy=[0, 1, 1, 0.4822126627])
bounds_2 = Bounds(Numbers=graph_mapper_2)
remap_numbers_2 = RemapNumbers(Value=graph_mapper_2, Source=bounds_2, Target="4 To 10")  # -> Mapped, Clipped
circle_2 = Circle(Plane=divide_curve_2.Points, Radius=remap_numbers_2.Mapped)

Z_3 = Slider(24, range=0..100)
segments_3 = Slider(10, range=0..10)
line_sdl_3 = LineSDL(Start="0,0,0", Direction=Vector(0, 0, 1), Length=Z_3)
divide_curve_3 = DivideCurve(Curve=line_sdl_3, Count=segments_3, Kinks=False)  # -> Points, Tangents, Parameters
range_3 = Range(Domain=Domain(0, 1), Steps=segments_3)
graph_mapper_3 = GraphMapper(
    range_3,
    x0=0,
    x1=1,
    y0=0,
    y1=1,
    container_name="Bezier",
    cpx=[0, 0.6317207813, 0.6424732804, 1],
    cpy=[0, 1, 1, 0.4822126627])
bounds_3 = Bounds(Numbers=graph_mapper_3)
remap_numbers_3 = RemapNumbers(Value=graph_mapper_3, Source=bounds_3, Target="4 To 10")  # -> Mapped, Clipped
circle_3 = Circle(Plane=divide_curve_3.Points, Radius=remap_numbers_3.Mapped)

Z_4 = Slider(24, range=0..100)
segments_4 = Slider(10, range=0..10)
line_sdl_4 = LineSDL(Start="0,0,0", Direction=Vector(0, 0, 1), Length=Z_4)
divide_curve_4 = DivideCurve(Curve=line_sdl_4, Count=segments_4, Kinks=False)  # -> Points, Tangents, Parameters
range_4 = Range(Domain=Domain(0, 1), Steps=segments_4)
graph_mapper_4 = GraphMapper(
    range_4,
    x0=0,
    x1=1,
    y0=0,
    y1=1,
    container_name="Bezier",
    cpx=[0, 0.6317207813, 0.6424732804, 1],
    cpy=[0, 1, 1, 0.4822126627])
bounds_4 = Bounds(Numbers=graph_mapper_4)
remap_numbers_4 = RemapNumbers(Value=graph_mapper_4, Source=bounds_4, Target="4 To 10")  # -> Mapped, Clipped
circle_4 = Circle(Plane=divide_curve_4.Points, Radius=remap_numbers_4.Mapped)

Z_5 = Slider(24, range=0..100)
segments_5 = Slider(10, range=0..10)
line_sdl_5 = LineSDL(Start="0,0,0", Direction=Vector(0, 0, 1), Length=Z_5)
divide_curve_5 = DivideCurve(Curve=line_sdl_5, Count=segments_5, Kinks=False)  # -> Points, Tangents, Parameters
range_5 = Range(Domain=Domain(0, 1), Steps=segments_5)
graph_mapper_5 = GraphMapper(
    range_5,
    x0=0,
    x1=1,
    y0=0,
    y1=1,
    container_name="Bezier",
    cpx=[0, 0.6317207813, 0.6424732804, 1],
    cpy=[0, 1, 1, 0.4822126627])
bounds_5 = Bounds(Numbers=graph_mapper_5)
remap_numbers_5 = RemapNumbers(Value=graph_mapper_5, Source=bounds_5, Target="4 To 10")  # -> Mapped, Clipped
circle_5 = Circle(Plane=divide_curve_5.Points, Radius=remap_numbers_5.Mapped)

Z_6 = Slider(24, range=0..100)
segments_6 = Slider(10, range=0..10)
line_sdl_6 = LineSDL(Start="0,0,0", Direction=Vector(0, 0, 1), Length=Z_6)
divide_curve_6 = DivideCurve(Curve=line_sdl_6, Count=segments_6, Kinks=False)  # -> Points, Tangents, Parameters
range_6 = Range(Domain=Domain(0, 1), Steps=segments_6)
graph_mapper_6 = GraphMapper(
    range_6,
    x0=0,
    x1=1,
    y0=0,
    y1=1,
    container_name="Bezier",
    cpx=[0, 0.6317207813, 0.7112908959, 1],
    cpy=[0, 1, 0.9318829775, 0.4822126627])
bounds_6 = Bounds(Numbers=graph_mapper_6)
remap_numbers_6 = RemapNumbers(Value=graph_mapper_6, Source=bounds_6, Target="4 To 10")  # -> Mapped, Clipped
circle_6 = Circle(Plane=divide_curve_6.Points, Radius=remap_numbers_6.Mapped)

Z_7 = Slider(24, range=0..100)
segments_7 = Slider(11, range=0..24)
factor = Slider(20, range=0..100)
line_sdl_7 = LineSDL(Start="0,0,0", Direction=Vector(0, 0, 1), Length=Z_7)
divide_curve_7 = DivideCurve(Curve=line_sdl_7, Count=segments_7, Kinks=False)  # -> Points, Tangents, Parameters
range_7 = Range(Domain=Domain(0, 1), Steps=segments_7)
graph_mapper_7 = GraphMapper(
    range_7,
    x0=0,
    x1=1,
    y0=0,
    y1=1,
    container_name="Bezier",
    cpx=[0, 0.4067935646, 0.6404356956, 1],
    cpy=[0.1710143089, 0.358941555, 0.6954717636, 0.1429655552])
multiplication = Multiplication(A=graph_mapper_7, B=factor)
circle_7 = Circle(Plane=divide_curve_7.Points, Radius=multiplication)
point = Point(divide_curve_7.Points)

# ---- group: transformation
# 3D Printed Ceramics
# Basic Transformations
curve = Curve(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)
Z_8 = Slider(20, range=0..100)
angle = Slider(123, range=0..1000)
scale = Slider(0.41, range=0..1)
unit_z = UnitZ(Factor=Z_8)
move = Move(Geometry=curve, Motion=unit_z)  # -> Geometry, Transform
rotate = Rotate(Geometry=move.Geometry, Angle=degrees(angle), Plane=PlaneXY(0, 0, 0))  # -> Geometry, Transform
scale_2 = Scale(Geometry=rotate.Geometry, Center=unit_z, Factor=scale)  # -> Geometry, Transform
loft = Loft(
    Curves=[curve, scale_2.Geometry],
    Options={Adjust=False, Closed=False, LoftEnds=0, LoftSimp=0, LoftType=0, Rebuild=10, Refit=0.01})

# ---- group: series
curve_2 = Curve(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)
steps = Slider(9, range=0..10)
range_8 = Range(Domain="0 To 20", Steps=steps)
range_9 = Range(Domain="0 To 180", Steps=steps)
range_10 = Range(Domain="0.5 To 1.0", Steps=steps)
unit_z_2 = UnitZ(Factor=range_8)
move_2 = Move(Geometry=curve_2, Motion=unit_z_2)  # -> Geometry, Transform
rotate_2 = Rotate(Geometry=move_2.Geometry, Angle=degrees(range_9), Plane=PlaneXY(0, 0, 0))  # -> Geometry, Transform
scale_3 = Scale(Geometry=rotate_2.Geometry, Center=unit_z_2, Factor=range_10)  # -> Geometry, Transform
loft_2 = Loft(
    Curves=scale_3.Geometry,
    Options={Adjust=False, Closed=False, LoftEnds=0, LoftSimp=0, LoftType=0, Rebuild=10, Refit=0.01})

# ---- group: sine wave
curve_3 = Curve(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)
z_domain = Slider(31, range=0..100)
steps_2 = Slider(9, range=0..10)
frequency = Slider(3, range=0..10)
steps_3 = Slider(8, range=0..10)
amplitude = Slider(0.5, range=0..1)
pi = Pi(Factor=frequency)
range_11 = Range(Domain=z_domain, Steps=steps_2)
range_12 = Range(Domain="0 To 180", Steps=steps_2)
range_13 = Range(Domain=pi, Steps=steps_3)
unit_z_3 = UnitZ(Factor=range_11)
multiplication_2 = Multiplication(A=range_13, B=amplitude)
move_3 = Move(Geometry=curve_3, Motion=unit_z_3)  # -> Geometry, Transform
sine = Sine(Value=multiplication_2)
bounds_7 = Bounds(Numbers=sine)
rotate_3 = Rotate(Geometry=move_3.Geometry, Angle=degrees(range_12), Plane=PlaneXY(0, 0, 0))  # -> Geometry, Transform
remap_numbers_7 = RemapNumbers(Value=sine, Source=bounds_7, Target="0.8 To 1.2")  # -> Mapped, Clipped
scale_4 = Scale(Geometry=rotate_3.Geometry, Center=unit_z_3, Factor=remap_numbers_7.Mapped)  # -> Geometry, Transform
loft_3 = Loft(
    Curves=scale_4.Geometry,
    Options={Adjust=False, Closed=False, LoftEnds=0, LoftSimp=0, LoftType=0, Rebuild=10, Refit=0.01})

# ----
# Flipped Matrices
panel = Panel("0,0,0")
Z_9 = Slider(24, range=0..100)
segments_8 = Slider(10, range=0..10)
line_sdl_8 = LineSDL(Start=panel, Direction=Vector(0, 0, 1), Length=Z_9)
divide_curve_8 = DivideCurve(Curve=line_sdl_8, Count=segments_8, Kinks=False)  # -> Points, Tangents, Parameters
range_14 = Range(Domain=Domain(0, 1), Steps=segments_8)
graph_mapper_8 = GraphMapper(
    range_14,
    x0=0,
    x1=1,
    y0=0,
    y1=1,
    container_name="Bezier",
    cpx=[0, 0.7469221354, 0.5449331999, 1],
    cpy=[0, 1, 1, 0.362487793])
bounds_8 = Bounds(Numbers=graph_mapper_8)
remap_numbers_8 = RemapNumbers(Value=graph_mapper_8, Source=bounds_8, Target="4 To 10")  # -> Mapped, Clipped
circle_8 = Circle(Plane=divide_curve_8.Points, Radius=remap_numbers_8.Mapped)
loft_4 = Loft(Curves=circle_8, Options={Adjust=False, Closed=False, LoftEnds=0, LoftSimp=0, LoftType=0, Rebuild=10, Refit=0.01})

count = Slider(36, range=0..64)
rotation = Slider(180, range=0..1000)
segments_9 = Number(segments_2)
divide_curve_9 = DivideCurve(Curve=circle_2, Count=count, Kinks=False)  # -> Points, Tangents, Parameters
range_15 = Range(Domain=rotation, Steps=segments_9)
rotate_4 = Rotate(Geometry=divide_curve_9.Points, Angle=graft(degrees(range_15)), Plane=PlaneXY(0, 0, 0))  # -> Geometry, Transform
flip_matrix = FlipMatrix(Data=rotate_4.Geometry)
interpolate = Interpolate(Vertices=flip_matrix, Degree=3, Periodic=False, KnotStyle=1)  # -> Curve, Length, Domain

count_2 = Slider(36, range=0..64)
center = Point(divide_curve.Points)
rotation_2 = Slider(12, range=0..36)
divide_curve_10 = DivideCurve(Curve=circle, Count=count_2, Kinks=False)  # -> Points, Tangents, Parameters
distance = Distance(PointA=divide_curve_10.Points, PointB=graft(center))
multiplication_3 = Multiplication(A=distance, B=rotation_2)
rotate_5 = Rotate(Geometry=divide_curve_10.Points, Angle=degrees(multiplication_3), Plane=PlaneXY(0, 0, 0))  # -> Geometry, Transform
flip_matrix_2 = FlipMatrix(Data=rotate_5.Geometry)
interpolate_2 = Interpolate(Vertices=flip_matrix_2, Degree=3, Periodic=False, KnotStyle=1)  # -> Curve, Length, Domain

count_3 = Slider(36, range=0..64)
center_2 = Point(divide_curve_3.Points)
rotation_3 = Slider(12, range=0..36)
divide_curve_11 = DivideCurve(Curve=circle_3, Count=count_3, Kinks=False)  # -> Points, Tangents, Parameters
distance_2 = Distance(PointA=divide_curve_11.Points, PointB=graft(center_2))
multiplication_4 = Multiplication(A=distance_2, B=rotation_3)
rotate_6 = Rotate(Geometry=divide_curve_11.Points, Angle=degrees(multiplication_4), Plane=PlaneXY(0, 0, 0))  # -> Geometry, Transform
flip_matrix_3 = FlipMatrix(Data=rotate_6.Geometry)
interpolate_3 = Interpolate(Vertices=flip_matrix_3, Degree=3, Periodic=False, KnotStyle=1)  # -> Curve, Length, Domain

count_4 = Slider(8, range=0..64)
center_3 = Point(divide_curve_4.Points)
rotation_4 = Slider(12, range=0..36)
divide_curve_12 = DivideCurve(Curve=circle_4, Count=count_4, Kinks=False)  # -> Points, Tangents, Parameters
distance_3 = Distance(PointA=divide_curve_12.Points, PointB=graft(center_3))
multiplication_5 = Multiplication(A=distance_3, B=rotation_4)
rotate_7 = Rotate(Geometry=divide_curve_12.Points, Angle=degrees(multiplication_5), Plane=PlaneXY(0, 0, 0))  # -> Geometry, Transform
flip_matrix_4 = FlipMatrix(Data=rotate_7.Geometry)
interpolate_4 = Interpolate(Vertices=flip_matrix_4, Degree=3, Periodic=False, KnotStyle=1)  # -> Curve, Length, Domain

count_5 = Slider(8, range=0..64)
rotation_5 = Slider(12, range=0..36)
divide_curve_13 = DivideCurve(Curve=circle_5, Count=count_5, Kinks=False)  # -> Points, Tangents, Parameters
distance_4 = Distance(PointA=divide_curve_13.Points, PointB=graft("0,0,0"))
multiplication_6 = Multiplication(A=distance_4, B=rotation_5)
rotate_8 = Rotate(Geometry=divide_curve_13.Points, Angle=degrees(multiplication_6), Plane=PlaneXY(0, 0, 0))  # -> Geometry, Transform
flip_matrix_5 = FlipMatrix(Data=rotate_8.Geometry)
interpolate_5 = Interpolate(Vertices=flip_matrix_5, Degree=3, Periodic=False, KnotStyle=1)  # -> Curve, Length, Domain

count_6 = Slider(8, range=0..64)
rotation_6 = Slider(9, range=0..36)
divide_curve_14 = DivideCurve(Curve=circle_6, Count=count_6, Kinks=False)  # -> Points, Tangents, Parameters
distance_5 = Distance(PointA=divide_curve_14.Points, PointB=graft("0,0,0"))
multiplication_7 = Multiplication(A=distance_5, B=rotation_6)
rotate_9 = Rotate(Geometry=divide_curve_14.Points, Angle=degrees(multiplication_7), Plane=PlaneXY(0, 0, 0))  # -> Geometry, Transform
flip_matrix_6 = FlipMatrix(Data=rotate_9.Geometry)
interpolate_6 = Interpolate(Vertices=flip_matrix_6, Degree=3, Periodic=False, KnotStyle=1)  # -> Curve, Length, Domain

number = Number(graph_mapper_7)
count_7 = Slider(9, range=0..24)
point_2 = Point(point)
scaling = Slider(0.05, range=0..0.25)
seam = Seam(Curve=reparameterize(circle_7), Seam=number)
divide_curve_15 = DivideCurve(Curve=seam, Count=count_7, Kinks=False)  # -> Points, Tangents, Parameters
vector_2pt = Vector2Pt(PointA=divide_curve_15.Points, PointB=graft(point_2), Unitize=False)  # -> Vector, Length
multiplication_8 = Multiplication(A=vector_2pt.Vector, B=scaling)
move_4 = Move(Geometry=divide_curve_15.Points, Motion=multiplication_8)  # -> Geometry, Transform
flip_matrix_7 = FlipMatrix(Data=divide_curve_15.Points)
flip_matrix_8 = FlipMatrix(Data=move_4.Geometry)
interpolate_7 = Interpolate(Vertices=flip_matrix_7, Degree=3, Periodic=False, KnotStyle=1)  # -> Curve, Length, Domain
interpolate_8 = Interpolate(Vertices=flip_matrix_8, Degree=3, Periodic=False, KnotStyle=1)  # -> Curve, Length, Domain
loft_options = LoftOptions(Closed=Toggle(True), Adjust=False, Rebuild=0, Refit=0, Type=0)
curve_4 = Curve(flatten([interpolate_7.Curve, interpolate_8.Curve]))
loft_5 = Loft(Curves=curve_4, Options=loft_options)
custom_preview = CustomPreview(Geometry=loft_5, Material=ColourSwatch(SwatchColor=RGB(209, 209, 209)))

segments_10 = Slider(10, range=0..10)
range_16 = Range(Domain=Domain(0, 1), Steps=segments_10)
graph_mapper_9 = GraphMapper(
    range_16,
    x0=0,
    x1=1,
    y0=0,
    y1=1,
    container_name="Bezier",
    cpx=[0, 0.6373308897, 1, 1],
    cpy=[0, 0.3776811361, 0.5269323587, 1])
graph_mapper_10 = GraphMapper(
    range_16,
    x0=0,
    x1=1,
    y0=0,
    y1=1,
    container_name="Bezier",
    cpx=[0, 0.7469221354, 0.5449331999, 1],
    cpy=[0, 1, 1, 0.362487793])
bounds_9 = Bounds(Numbers=graph_mapper_9)
bounds_10 = Bounds(Numbers=graph_mapper_10)
remap_numbers_9 = RemapNumbers(Value=graph_mapper_9, Source=bounds_9, Target="0 To 12")  # -> Mapped, Clipped
remap_numbers_10 = RemapNumbers(Value=graph_mapper_10, Source=bounds_10, Target="4 To 10")  # -> Mapped, Clipped
unit_z_4 = UnitZ(Factor=remap_numbers_9.Mapped)
move_5 = Move(Geometry="0,0,0", Motion=unit_z_4)  # -> Geometry, Transform
circle_9 = Circle(Plane=move_5.Geometry, Radius=remap_numbers_10.Mapped)
loft_6 = Loft(Curves=circle_9, Options={Adjust=False, Closed=False, LoftEnds=0, LoftSimp=0, LoftType=0, Rebuild=10, Refit=0.01})

perp_frames = PerpFrames(Curve=interpolate.Curve, Count=10, Align=True)  # -> Frames, Parameters
size = Slider(1.2, range=0..10)
angle_2 = Slider(36, range=0..100)
rectangle = Rectangle(Plane=perp_frames.Frames, XSize=size, YSize=size, Radius=0)  # -> Rectangle, Length
center_4 = Center(Geometrical=rectangle.Rectangle)  # -> Center, Dimension
rotate_10 = Rotate(Geometry=rectangle.Rectangle, Angle=degrees(angle_2), Plane=center_4.Center)  # -> Geometry, Transform
loft_7 = Loft(
    Curves=rotate_10.Geometry,
    Options={Adjust=False, Closed=False, LoftEnds=0, LoftSimp=0, LoftType=0, Rebuild=10, Refit=0.01})
mirror = Mirror(Geometry=loft_7, Plane=PlaneYZ(0, 0, 0))  # -> Geometry, Transform
custom_preview_2 = CustomPreview(Geometry=[loft_7, mirror.Geometry], Material=ColourSwatch(SwatchColor=RGB(219, 219, 219)))

curve_5 = Curve(interpolate_5.Curve)
scale_5 = Slider(0.9, range=0..1)
angle_3 = Slider(58, range=0..100)
scale_nu = ScaleNU(Geometry=curve_5, Plane=PlaneXY(0, 0, 0), ScaleX=scale_5, ScaleY=scale_5, ScaleZ=1)  # -> Geometry, Transform
rotate_11 = Rotate(Geometry=scale_nu.Geometry, Angle=degrees(angle_3), Plane=PlaneXY(0, 0, 0))  # -> Geometry, Transform
weave = Weave(Pattern=[0, 1], Stream0=curve_5, Stream1=rotate_11.Geometry, NullGaps=False)
loft_8 = Loft(Curves=weave, Options={Adjust=False, Closed=False, LoftEnds=0, LoftSimp=0, LoftType=0, Rebuild=10, Refit=0.01})
offset_surface = OffsetSurface(Surface=loft_8, Distance=1, BothSides=False, CreateSolid=True)
custom_preview_3 = CustomPreview(Geometry=offset_surface, Material=ColourSwatch(SwatchColor=RGB(219, 219, 219)))

curve_6 = Curve(interpolate_6.Curve)
scale_6 = Slider(0.8, range=0..1)
angle_4 = Slider(36, range=0..100)
scale_nu_2 = ScaleNU(Geometry=curve_6, Plane=PlaneXY(0, 0, 0), ScaleX=scale_6, ScaleY=scale_6, ScaleZ=1)  # -> Geometry, Transform
rotate_12 = Rotate(Geometry=scale_nu_2.Geometry, Angle=degrees(angle_4), Plane=PlaneXY(0, 0, 0))  # -> Geometry, Transform
loft_options_2 = LoftOptions(Closed=Toggle(True), Adjust=False, Rebuild=0, Refit=0, Type=0)
curve_7 = Curve(flatten([curve_6, rotate_12.Geometry]))
loft_9 = Loft(Curves=curve_7, Options=loft_options_2)
offset_surface_2 = OffsetSurface(Surface=loft_9, Distance=1, BothSides=False, CreateSolid=True)
custom_preview_4 = CustomPreview(Geometry=offset_surface_2, Material=ColourSwatch(SwatchColor=RGB(219, 219, 219)))

curve_8 = Curve(interpolate_3.Curve)
scale_7 = Slider(0.9, range=0..1)
offset = Slider(0.7, range=0..10)
scale_nu_3 = ScaleNU(Geometry=curve_8, Plane=PlaneXY(0, 0, 0), ScaleX=scale_7, ScaleY=scale_7, ScaleZ=1)  # -> Geometry, Transform
weave_2 = Weave(Pattern=[0, 1], Stream0=curve_8, Stream1=scale_nu_3.Geometry, NullGaps=False)
loft_10 = Loft(Curves=weave_2, Options={Adjust=False, Closed=False, LoftEnds=0, LoftSimp=0, LoftType=0, Rebuild=10, Refit=0.01})
offset_surface_3 = OffsetSurface(Surface=loft_10, Distance=offset, BothSides=False, CreateSolid=True)
mirror_2 = Mirror(Geometry=offset_surface_3, Plane=PlaneYZ(0, 0, 0))  # -> Geometry, Transform
custom_preview_5 = CustomPreview(Geometry=[offset_surface_3, mirror_2.Geometry], Material=ColourSwatch(SwatchColor=RGB(219, 219, 219)))

curve_9 = Curve(interpolate_4.Curve)
scale_8 = Slider(0.9, range=0..1)
angle_5 = Slider(58, range=0..100)
scale_nu_4 = ScaleNU(Geometry=curve_9, Plane=PlaneXY(0, 0, 0), ScaleX=scale_8, ScaleY=scale_8, ScaleZ=1)  # -> Geometry, Transform
rotate_13 = Rotate(Geometry=scale_nu_4.Geometry, Angle=degrees(angle_5), Plane=PlaneXY(0, 0, 0))  # -> Geometry, Transform
weave_3 = Weave(Pattern=[0, 1], Stream0=curve_9, Stream1=rotate_13.Geometry, NullGaps=False)
loft_11 = Loft(Curves=weave_3, Options={Adjust=False, Closed=False, LoftEnds=0, LoftSimp=0, LoftType=0, Rebuild=10, Refit=0.01})
offset_surface_4 = OffsetSurface(Surface=loft_11, Distance=1, BothSides=False, CreateSolid=True)
custom_preview_6 = CustomPreview(Geometry=offset_surface_4, Material=ColourSwatch(SwatchColor=RGB(219, 219, 219)))

perp_frames_2 = PerpFrames(Curve=interpolate_2.Curve, Count=10, Align=True)  # -> Frames, Parameters
size_2 = Slider(2, range=0..10)
angle_6 = Slider(70, range=0..100)
rectangle_2 = Rectangle(Plane=perp_frames_2.Frames, XSize=size_2, YSize=size_2, Radius=0)  # -> Rectangle, Length
center_5 = Center(Geometrical=rectangle_2.Rectangle)  # -> Center, Dimension
rotate_14 = Rotate(Geometry=rectangle_2.Rectangle, Angle=degrees(angle_6), Plane=center_5.Center)  # -> Geometry, Transform
loft_12 = Loft(
    Curves=rotate_14.Geometry,
    Options={Adjust=False, Closed=False, LoftEnds=0, LoftSimp=0, LoftType=0, Rebuild=10, Refit=0.01})
mirror_3 = Mirror(Geometry=loft_12, Plane=PlaneYZ(0, 0, 0))  # -> Geometry, Transform
custom_preview_7 = CustomPreview(Geometry=[loft_12, mirror_3.Geometry], Material=ColourSwatch(SwatchColor=RGB(219, 219, 219)))
