# Grasshopper definition ceramic-vessels.gh (Grasshopper 1.0.7)
# Copyright: GNU General Public License 3.0

# ---- group: loft multiple curves
# Ceramic Vessels
curve = Curve([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])
list_length = ListLength(List=curve)
range = Range(Domain="0 To 50", Steps=expr("x-1", list_length))
unit_z = UnitZ(Factor=range)
move = Move(Geometry=curve, Motion=unit_z)  # -> Geometry, Transform
loft = Loft(Curves=move.Geometry, Options={Adjust=False, Closed=False, LoftEnds=0, LoftSimp=0, LoftType=0, Rebuild=10, Refit=0.01})

# ---- group: random closed curve
radius = Slider(24, range=0..100)
count = Slider(12, range=0..100)
range_2 = Slider(12, range=0..100)
seed = Slider(99, range=0..100)
seed_2 = Slider(100, range=0..100)
count_2 = Number(count)
random = Random(Range=range_2, Number=count_2, Seed=seed)
random_2 = Random(Range=range_2, Number=count_2, Seed=seed_2)
circle = Circle(Plane=PlaneXY(0, 0, 0), Radius=radius)
vector_xyz = VectorXYZ(XComponent=random, YComponent=random_2, ZComponent=0)  # -> Vector, Length
divide_curve = DivideCurve(Curve=circle, Count=count, Kinks=False)  # -> Points, Tangents, Parameters
move_2 = Move(Geometry=divide_curve.Points, Motion=vector_xyz.Vector)  # -> Geometry, Transform
boolean = Boolean(True)
interpolate = Interpolate(Vertices=move_2.Geometry, Degree=3, Periodic=boolean, KnotStyle=1)  # -> Curve, Length, Domain
curve_2 = Curve(interpolate.Curve)

# ---- group: series of random curves
radius_2 = Slider(24, range=0..100)
count_3 = Slider(12, range=0..100)
range_3 = Slider(4, range=0..32)
curves = Slider(12, range=0..100)
seed_3 = Slider(95, range=0..100)
seed_4 = Slider(100, range=0..100)
random_3 = Random(Range="1000000", Number=curves, Seed=seed_3)
random_4 = Random(Range="1000000", Number=curves, Seed=seed_4)
random_5 = Random(Range=range_3, Number=count_3, Seed=random_3)
random_6 = Random(Range=range_3, Number=count_3, Seed=random_4)
circle_2 = Circle(Plane=PlaneXY(0, 0, 0), Radius=radius_2)
vector_xyz_2 = VectorXYZ(XComponent=random_5, YComponent=random_6, ZComponent=0)  # -> Vector, Length
divide_curve_2 = DivideCurve(Curve=circle_2, Count=count_3, Kinks=False)  # -> Points, Tangents, Parameters
move_3 = Move(Geometry=divide_curve_2.Points, Motion=vector_xyz_2.Vector)  # -> Geometry, Transform
boolean_2 = Boolean(True)
interpolate_2 = Interpolate(Vertices=move_3.Geometry, Degree=3, Periodic=boolean_2, KnotStyle=1)  # -> Curve, Length, Domain
curve_3 = Curve(flatten([circle_2, interpolate_2.Curve]))

# ---- group: random ellipses
radius_3 = Slider(24, range=0..100)
lower = Slider(1, range=0..2)
upper = Slider(1.5, range=0..2)
count_4 = Slider(6, range=0..36)
seed_5 = Slider(43, range=0..100)
angle = Slider(360, range=0..1000)
Z = Slider(10, range=0..100)
construct_domain = ConstructDomain(DomainStart=lower, DomainEnd=upper)
circle_3 = Circle(Plane=PlaneXY(0, 0, 0), Radius=radius_3)
random_7 = Random(Range=construct_domain, Number=count_4, Seed=seed_5)
random_8 = Random(Range=angle, Number=count_4, Seed=seed_5)
series = Series(Start=0, Step=Z, Count=count_4)  # -> flatten(Series)
scale_nu = ScaleNU(Geometry=circle_3, Plane=PlaneXY(0, 0, 0), ScaleX=random_7, ScaleY=1, ScaleZ=1)  # -> Geometry, Transform
unit_z_2 = UnitZ(Factor=series)
rotate = Rotate(Geometry=scale_nu.Geometry, Angle=random_8, Plane=PlaneXY(0, 0, 0))  # -> Geometry, Transform
boolean_3 = Boolean(True)
move_4 = Move(Geometry=rotate.Geometry, Motion=unit_z_2)  # -> Geometry, Transform
loft_options = LoftOptions(Closed=False, Adjust=boolean_3, Rebuild=0, Refit=0, Type=0)
loft_2 = Loft(Curves=move_4.Geometry, Options=loft_options)

# ---- group: translate and loft curves
curve_4 = Curve(flatten(curve_3))
step = Slider(5, range=0..10)
curves_2 = Number(curves)
series_2 = Series(Start=0, Step=step, Count=expr("x+1", curves_2))
unit_z_3 = UnitZ(Factor=series_2)
move_5 = Move(Geometry=curve_4, Motion=unit_z_3)  # -> Geometry, Transform
loft_3 = Loft(Curves=move_5.Geometry, Options={Adjust=False, Closed=False, LoftEnds=0, LoftSimp=0, LoftType=0, Rebuild=10, Refit=0.01})
