# Grasshopper definition koch-snowflake-bowl.gh (Grasshopper 1.0.7)
# plug-ins: EdiTree, FractureHopper

# ---- group: koch snowflake curve
# using fracturehopper
panel = Panel("0,1,0")
# koch snowflake
panel_2 = Panel("0,0,0")
point = Point(panel_2)
point_2 = Point(panel)
point_3 = Point("1,0.5,0")
kochsnowflake = KochSnowflake(FirstPoint=point, SecondPoint=point_2, ThirdPoint=point_3, Iterations=Slider(3, range=0..10))
join_curves = JoinCurves(Curves=kochsnowflake, Preserve=False)

# ---- group: triangular snowflake
# using editree
# using fracturehopper
number_slider = Slider(2, range=0..10)
# koch snowflake bowl
panel_3 = Panel("75")
polygon = Polygon(Plane=PlaneXY(0, 0, 0), Radius=panel_3, Segments="3", FilletRadius=0)  # -> Polygon, Length
discontinuity = Discontinuity(Curve=polygon.Polygon, Level=1)  # -> Points, Parameters
divide_list = DivideList(List=discontinuity.Points, Number="3")  # -> Chunk, Remainder
explode_tree = ExplodeTree(Data=divide_list.Chunk)  # -> Branch0, Branch1, Branch2
kochsnowflake_2 = KochSnowflake(
    FirstPoint=explode_tree.Branch0,
    SecondPoint=explode_tree.Branch2,
    ThirdPoint=explode_tree.Branch1,
    Iterations=number_slider)
join_curves_2 = JoinCurves(Curves=kochsnowflake_2, Preserve=False)

# ----
number_slider_2 = Slider(4, range=0..10)
number_slider_3 = Slider(62, range=0..100)
fillet = Fillet(Curve=join_curves_2, Radius=Slider(5, range=0..10))
division = Division(A=number_slider_3, B=number_slider_2)
construct_domain = ConstructDomain(DomainStart=division, DomainEnd=number_slider_3)
construct_domain_2 = ConstructDomain(DomainStart=Slider(0.8, range=0..3), DomainEnd=Slider(1.3, range=0..3))
range = Range(Domain=construct_domain_2, Steps=number_slider_2)  # -> reverse(Range)
range_2 = Range(Domain=construct_domain, Steps=number_slider_2)
range_3 = Range(Domain=Slider(45, range=0..90), Steps=number_slider_2)
unit_z = UnitZ(Factor=range_2)
move = Move(Geometry=fillet, Motion=unit_z)  # -> Geometry, Transform
scale_nu = ScaleNU(Geometry=move.Geometry, Plane=PlaneXY(0, 0, 0), ScaleX=range, ScaleY=range, ScaleZ=1)  # -> Geometry, Transform
rotate = Rotate(Geometry=scale_nu.Geometry, Angle=degrees(range_3), Plane=PlaneXY(0, 0, 0))  # -> Geometry, Transform
boundary_surfaces = BoundarySurfaces(Edges=fillet)
loft = Loft(
    Curves=[fillet, rotate.Geometry],
    Options={Adjust=False, Closed=False, LoftEnds=0, LoftSimp=0, LoftType=1, Rebuild=10, Refit=0.01})
custom_preview = CustomPreview(Geometry=[boundary_surfaces, loft], Material=ColourSwatch(SwatchColor=RGB(230, 230, 230)))  # disabled
