# Grasshopper definition living-vase.gh (Grasshopper 1.0.7)
# Copyright: GNU General Public License 3.0

# ----
# Continuous Curve
radius = Slider(200, range=0..1000)
scale = Slider(0.7, range=0..1)
divisions = Slider(16, range=0..100)
circle = Circle(Plane=PlaneXY(0, 0, 0), Radius=radius)
scale_2 = Scale(Geometry=circle, Center=Point(0, 0, 0), Factor=scale)  # -> Geometry, Transform
divide_curve = DivideCurve(Curve=circle, Count=divisions, Kinks=False)  # -> Points, Tangents, Parameters
divide_curve_2 = DivideCurve(Curve=scale_2.Geometry, Count=divisions, Kinks=False)  # -> Points, Tangents, Parameters
dispatch = Dispatch(List=divide_curve.Points, DispatchPattern=[True, False])  # -> ListA, ListB
dispatch_2 = Dispatch(List=divide_curve_2.Points, DispatchPattern=[True, False])  # -> ListA, ListB
weave = Weave(Pattern=[0, 1], Stream0=dispatch.ListA, Stream1=dispatch_2.ListB, NullGaps=False)
point = Point(weave)

point_2 = Point(point)
scale_3 = Slider(0.8, range=0..1)
divisions_2 = Integer(divisions)
division = Division(A="360", B=divisions_2)
scale_4 = Scale(Geometry=point_2, Center=Point(0, 0, 0), Factor=scale_3)  # -> Geometry, Transform
rotate = Rotate(Geometry=scale_4.Geometry, Angle=degrees(division), Plane=PlaneXY(0, 0, 0))  # -> Geometry, Transform
point_3 = Point(rotate.Geometry)

point_4 = Point(point)
point_5 = Point(point_3)
shift_list = ShiftList(List=point_4, Shift=1, Wrap=True)
split_list = SplitList(List=point_5, Index="1")  # -> ListA, ListB
split_list_2 = SplitList(List=shift_list, Index="1")  # -> ListA, ListB
merge = Merge(Data1=split_list_2.ListA, Data2=split_list.ListB)  # -> flatten(Result)
merge_2 = Merge(Data1=split_list_2.ListA, Data2=split_list_2.ListB)
merge_3 = Merge(Data1=merge_2, Data3=merge)  # -> flatten(Result)
point_6 = Point(merge_3)

point_7 = Point(point_6)
step = Slider(9, range=0..100)
count = Slider(12, range=0..100)
rotation = Slider(1, range=0..90)
series = Series(Start=0, Step=step, Count=count)
series_2 = Series(Start=0, Step=rotation, Count=count)
unit_z = UnitZ(Factor=series)
move = Move(Geometry=point_7, Motion=graft(unit_z))  # -> Geometry, Transform
rotate_2 = Rotate(Geometry=move.Geometry, Angle=graft(degrees(series_2)), Plane=PlaneXY(0, 0, 0))  # -> Geometry, Transform
point_8 = Point(rotate_2.Geometry)

point_9 = Point(flatten(point_8))
list_item = ListItem(List=merge_2, Index=0, Wrap=True)
scale_5 = Scale(Geometry=list_item, Center=Point(0, 0, 0), Factor="0.9")  # -> Geometry, Transform
insert_items = InsertItems(List=point_9, Item=scale_5.Geometry, Indices=0, Wrap=True)
list_length = ListLength(List=insert_items)
split_list_3 = SplitList(List=insert_items, Index=expr("x-1", list_length))  # -> ListA, ListB
boolean = Boolean(False)
nurbs_curve = NurbsCurve(Vertices=split_list_3.ListA, Degree="2", Periodic=boolean)  # -> Curve, Length, Domain
curve = Curve(nurbs_curve.Curve)

boolean_2 = Boolean(True)

# ----
# Living Vase
# Surfaces
radius_2 = Slider(200, range=0..1000)
scale_6 = Slider(0.7, range=0..1)
divisions_3 = Slider(16, range=0..100)
circle_2 = Circle(Plane=PlaneXY(0, 0, 0), Radius=radius_2)
scale_7 = Scale(Geometry=circle_2, Center=Point(0, 0, 0), Factor=scale_6)  # -> Geometry, Transform
divide_curve_3 = DivideCurve(Curve=circle_2, Count=divisions_3, Kinks=False)  # -> Points, Tangents, Parameters
divide_curve_4 = DivideCurve(Curve=scale_7.Geometry, Count=divisions_3, Kinks=False)  # -> Points, Tangents, Parameters
dispatch_3 = Dispatch(List=divide_curve_3.Points, DispatchPattern=[True, False])  # -> ListA, ListB
dispatch_4 = Dispatch(List=divide_curve_4.Points, DispatchPattern=[True, False])  # -> ListA, ListB
weave_2 = Weave(Pattern=[0, 1], Stream0=dispatch_3.ListA, Stream1=dispatch_4.ListB, NullGaps=False)

nurbs_curve_2 = NurbsCurve(Vertices=weave_2, Degree="2", Periodic=boolean_2)  # -> Curve, Length, Domain

curve_2 = Curve(nurbs_curve_2.Curve)

curve_3 = Curve(curve_2)
scale_8 = Slider(0.8, range=0..1)
divisions_4 = Integer(divisions_3)
division_2 = Division(A="360", B=divisions_4)
scale_9 = Scale(Geometry=curve_3, Center=Point(0, 0, 0), Factor=scale_8)  # -> Geometry, Transform
rotate_3 = Rotate(Geometry=scale_9.Geometry, Angle=degrees(division_2), Plane=PlaneXY(0, 0, 0))  # -> Geometry, Transform
curve_4 = Curve(rotate_3.Geometry)

curve_5 = Curve([curve_2, curve_4])
step_2 = Slider(20, range=0..100)
count_2 = Slider(12, range=0..100)
rotation_2 = Slider(6, range=0..90)
series_3 = Series(Start=0, Step=step_2, Count=count_2)
series_4 = Series(Start=0, Step=rotation_2, Count=count_2)
unit_z_2 = UnitZ(Factor=series_3)
move_2 = Move(Geometry=curve_5, Motion=graft(unit_z_2))  # -> Geometry, Transform
rotate_4 = Rotate(Geometry=move_2.Geometry, Angle=graft(degrees(series_4)), Plane=PlaneXY(0, 0, 0))  # -> Geometry, Transform
dispatch_5 = Dispatch(List=rotate_4.Geometry, DispatchPattern=[True, False])  # -> flatten(ListA), flatten(ListB)
loft = Loft(
    Curves=dispatch_5.ListA,
    Options={Adjust=False, Closed=False, LoftEnds=0, LoftSimp=0, LoftType=0, Rebuild=10, Refit=0.01})
loft_2 = Loft(
    Curves=dispatch_5.ListB,
    Options={Adjust=False, Closed=False, LoftEnds=0, LoftSimp=0, LoftType=0, Rebuild=10, Refit=0.01})
custom_preview = CustomPreview(Geometry=loft, Material=ColourSwatch(SwatchColor=RGB(204, 204, 204)))
custom_preview_2 = CustomPreview(Geometry=loft_2, Material=ColourSwatch(SwatchColor=RGB(92, 92, 92)))

# ---- group: translate and rotate
curve_6 = Curve([curve_2, curve_4])
step_3 = Slider(20, range=0..100)
count_3 = Slider(12, range=0..100)
rotation_3 = Slider(6, range=0..90)
series_5 = Series(Start=0, Step=step_3, Count=count_3)
series_6 = Series(Start=0, Step=rotation_3, Count=count_3)
unit_z_3 = UnitZ(Factor=series_5)
move_3 = Move(Geometry=curve_6, Motion=graft(unit_z_3))  # -> Geometry, Transform
rotate_5 = Rotate(Geometry=move_3.Geometry, Angle=graft(degrees(series_6)), Plane=PlaneXY(0, 0, 0))  # -> Geometry, Transform
curve_7 = Curve(rotate_5.Geometry)

# ---- group: scale
count_4 = Integer(count_3)
min_scale = Slider(0.6, range=0..1)
max_scale = Slider(1, range=0..1)
curve_8 = Curve(curve_7)
range = Range(Domain=Domain(0, 1), Steps=expr("x-1", count_4))
graph_mapper = GraphMapper(range, x0=0, x1=1, y0=0, y1=1, container_name="Sine", Equation_px=[0, 1], Equation_py=[0, 1])
construct_domain = ConstructDomain(DomainStart=min_scale, DomainEnd=max_scale)
bounds = Bounds(Numbers=graph_mapper)
remap_numbers = RemapNumbers(Value=graph_mapper, Source=bounds, Target=construct_domain)  # -> Mapped, Clipped
scale_nu = ScaleNU(
    Geometry=curve_8,
    Plane=PlaneXY(0, 0, 0),
    ScaleX=graft(remap_numbers.Mapped),
    ScaleY=graft(remap_numbers.Mapped),
    ScaleZ=1)  # -> Geometry, Transform
curve_9 = Curve(scale_nu.Geometry)

# ---- group: loft
curve_10 = Curve(curve_9)
dispatch_6 = Dispatch(List=curve_10, DispatchPattern=[True, False])  # -> flatten(ListA), flatten(ListB)
loft_3 = Loft(
    Curves=dispatch_6.ListA,
    Options={Adjust=False, Closed=False, LoftEnds=0, LoftSimp=0, LoftType=0, Rebuild=10, Refit=0.01})
loft_4 = Loft(
    Curves=dispatch_6.ListB,
    Options={Adjust=False, Closed=False, LoftEnds=0, LoftSimp=0, LoftType=0, Rebuild=10, Refit=0.01})
custom_preview_3 = CustomPreview(Geometry=loft_3, Material=ColourSwatch(SwatchColor=RGB(204, 204, 204)))
custom_preview_4 = CustomPreview(Geometry=loft_4, Material=ColourSwatch(SwatchColor=RGB(92, 92, 92)))
