# Grasshopper definition paneling.gh (Grasshopper 1.0.7)
# plug-ins: Parakeet, LunchBox

# 3D printing path
xy_plane = XYPlane(Origin="10,0,0")
rectangle = Rectangle(Plane=xy_plane, XSize=Domain(-1, 1), YSize=Domain(-2, 2), Radius=0)  # -> Rectangle, Length
rectangle_2 = Rectangle(Plane=PlaneXY(0, 0, 0), XSize=Domain(-1, 1), YSize=Domain(-2, 2), Radius=0)  # -> Rectangle, Length
# using parakeet
brick_type_a = BrickTypeA(BaseSurface=rectangle.Rectangle, UCount=15, VCount=15, OffsetDistance=0)
random_quad_panels = RandomQuadPanels(Surface=rectangle_2.Rectangle, UDivisions=10, VDivisions=10, RandomSeed=10)
