# Grasshopper definition rotated-voronoi-wall.gh (Grasshopper 1.0.7)
# plug-ins: Pufferfish

xz_plane = XZPlane(Origin=Point(0, 0, 0))
circle = Circle(Plane=xz_plane, Radius=Slider(36, range=0..100))
boundary_surfaces = BoundarySurfaces(Edges=circle)
bounding_rectangle = BoundingRectangle(Geometry=boundary_surfaces, Plane=xz_plane, Axis=0, Slide=0, Union=True)  # -> Bounding, DimensionX, DimensionY
populate_geometry = PopulateGeometry(Geometry=boundary_surfaces, Count=100, Seed=1)
voronoi = Voronoi(Points=populate_geometry, Boundary=bounding_rectangle.Bounding, BruteForceOverride=False)
polygon_center = PolygonCenter(Polyline=voronoi)  # -> CenterV, CenterE, CenterA
scale = Scale(Geometry=voronoi, Center=polygon_center.CenterA, Factor=Slider(0.85, range=0..1))  # -> Geometry, Transform
fillet = Fillet(Curve=scale.Geometry, Radius=Slider(4, range=0..10))
negative = Negative(Value=Slider(6, range=0..10))
unit_y = UnitY(Factor=negative)
extrude = Extrude(Base=fillet, Direction=unit_y)
scale_nu = ScaleNU(
    Geometry=fillet,
    Plane=flatten(polygon_center.CenterA),
    ScaleX=Slider(0.64, range=0..1),
    ScaleY=1,
    ScaleZ=Slider(0.36, range=0..1))  # -> Geometry, Transform
unit_y_2 = UnitY(Factor=Slider(3, range=0..10))
move = Move(Geometry=scale_nu.Geometry, Motion=unit_y_2)  # -> Geometry, Transform
ruled_surface = RuledSurface(CurveA=move.Geometry, CurveB=fillet)
yz_plane = YZPlane(Origin=polygon_center.CenterA)
brep_join = BrepJoin(Breps=[ruled_surface, extrude])  # -> Breps, Closed
rotate = Rotate(Geometry=brep_join.Breps, Angle=degrees(Slider(30, range=0..100)), Plane=yz_plane)  # -> Geometry, Transform
custom_preview = CustomPreview(Geometry=rotate.Geometry, Material=ColourSwatch(SwatchColor=RGB(230, 230, 230)))
