# Grasshopper definition simple-vase.gh (Grasshopper 1.0.7)

# ---- group: internalized points
# in the display menu
# turn on the gumball
# to edit these points
point = Point([Point(0, -2.01307633, 0), Point(0, -5.838882451, 6.95925488), Point(0, -2, 8), Point(0, -3.764170971, 10.32092172)])

# ---- group: create a vase
interpolate = Interpolate(Vertices=point, Degree=3, Periodic=False, KnotStyle=1)  # -> Curve, Length, Domain
line = Line(StartPoint="0,0,0", EndPoint="0,0,1")
revolution = Revolution(Curve=interpolate.Curve, Axis=line, Domain=Domain(0, 6.283185307))
