# Grasshopper definition sine-vase.gh (Grasshopper 1.0.7)

# ---- group: model a vase from a sine wave
y = Slider(3, range=0..10)
steps = Slider(36, range=0..100)
# sine vase
x = Slider(0.8, range=0..2)
pi = Pi(Factor=y)
construct_domain = ConstructDomain(DomainStart=0, DomainEnd=pi)
range = Range(Domain=construct_domain, Steps=steps)
expression = Expression(x=x, y=range, Expression="sin(x*y)")
construct_point = ConstructPoint(XCoordinate=0, YCoordinate=expression, ZCoordinate=range)
interpolate = Interpolate(Vertices=construct_point, Degree=3, Periodic=False, KnotStyle=1)  # -> Curve, Length, Domain
line = Line(StartPoint="0,2,0", EndPoint="0,2,1")
revolution = Revolution(Curve=interpolate.Curve, Axis=line, Domain=Domain(0, 6.283185307))
custom_preview = CustomPreview(Geometry=revolution, Material=ColourSwatch(SwatchColor=RGB(219, 219, 219)))

# ---- group: vase from multiple sine waves
y_2 = Slider(3, range=0..10)
steps_2 = Slider(36, range=0..100)
pi_2 = Pi(Factor=y_2)
construct_domain_2 = ConstructDomain(DomainStart=0, DomainEnd=pi_2)
x_2 = Slider(0.57, range=0..2)
x_3 = Slider(0.42, range=0..2)
x_4 = Slider(0.68, range=0..2)
x_5 = Slider(0.64, range=0..2)
range_2 = Range(Domain=construct_domain_2, Steps=steps_2)
multiplication = Multiplication(A=graft([x_5, x_2, x_3, x_4]), B=range_2)
sine = Sine(Value=multiplication)
construct_point_2 = ConstructPoint(XCoordinate=0, YCoordinate=sine, ZCoordinate=range_2)
interpolate_2 = Interpolate(Vertices=construct_point_2, Degree=3, Periodic=False, KnotStyle=1)  # -> Curve, Length, Domain
unit_y = UnitY(Factor=Slider(2, range=0..10))
pi_3 = Pi(Factor=Slider(1.5, range=0..10))
move = Move(Geometry=interpolate_2.Curve, Motion=unit_y)  # -> Geometry, Transform
construct_domain_3 = ConstructDomain(DomainStart=0, DomainEnd=pi_3)
range_3 = Range(Domain=construct_domain_3, Steps=Slider(3, range=0..10))
rotate = Rotate(Geometry=flatten(move.Geometry), Angle=range_3, Plane=PlaneXY(0, 0, 0))  # -> Geometry, Transform
loft_options = LoftOptions(Closed=Toggle(True), Adjust=False, Rebuild=0, Refit=0, Type=0)
loft = Loft(Curves=rotate.Geometry, Options=loft_options)
scale = Scale(Geometry=loft, Center=Point(0, 0, 0), Factor=Slider(20, range=0..100))  # -> Geometry, Transform

# ----
x_6 = Slider(0.8, range=0..2)
steps_3 = Slider(36, range=0..100)
y_3 = Slider(3, range=0..10)
pi_4 = Pi(Factor=y_3)
construct_domain_4 = ConstructDomain(DomainStart=0, DomainEnd=pi_4)
range_4 = Range(Domain=construct_domain_4, Steps=steps_3)
multiplication_2 = Multiplication(A=x_6, B=range_4)
sine_2 = Sine(Value=multiplication_2)
construct_point_3 = ConstructPoint(XCoordinate=0, YCoordinate=sine_2, ZCoordinate=range_4)
interpolate_3 = Interpolate(Vertices=construct_point_3, Degree=3, Periodic=False, KnotStyle=1)  # -> Curve, Length, Domain
line_2 = Line(StartPoint="0,2,0", EndPoint="0,2,1")
revolution_2 = Revolution(Curve=interpolate_3.Curve, Axis=line_2, Domain=Domain(0, 6.283185307))
custom_preview_2 = CustomPreview(Geometry=revolution_2, Material=ColourSwatch(SwatchColor=RGB(219, 219, 219)))
