# Grasshopper definition sound-vase.gh (Grasshopper 1.0.7)
# plug-ins: Pufferfish, MosquitoAudio2, EdiTree

# ---- group: soundscape
# mosquito plugin
toggle = BooleanToggle(False)
skip = Slider(250, range=0..5000)
divisions = Slider(6, range=0..36)
x_offset = Slider(0.5, range=0..1)
stop = Slider(1500, range=0..10000)
start = Slider(500, range=0..10000)
z_factor = Slider(2, range=0..12)
# audio waveform
path = FilePath("D:\generative-design\digital-fabrication\data\Neon Drip.mp3")
# vase
y_factor = Slider(2, range=0..3)
audiowave = AudioWave(AudioFile=path, XOffset=x_offset, Skip=skip)  # -> Peak, Points, Length
play = AudioPlay(AudioFile=path, Boolean=toggle)
split_list = SplitList(List=audiowave.Points, Index=stop)  # -> ListA, ListB
split_list_2 = SplitList(List=split_list.ListA, Index=start)  # -> ListA, ListB
divide_list = DivideList(List=split_list_2.ListB, Number=divisions)  # -> Chunk, Remainder
series = Series(Start=0, Step=y_factor, Count=divisions)
interpolate = Interpolate(Vertices=divide_list.Chunk, Degree=3, Periodic=False, KnotStyle=1)  # -> Curve, Length, Domain
scale_nu = ScaleNU(Geometry=interpolate.Curve, Plane=PlaneXY(0, 0, 0), ScaleX=1, ScaleY=1, ScaleZ=z_factor)  # -> Geometry, Transform
unit_y = UnitY(Factor=graft(series))
loft_type = ValueList({"Normal": 0, "Loose": 1, "Tight": 2, "Straight": 3, "Uniform": 5}, selected="Normal")
end_points = EndPoints(Curve=scale_nu.Geometry)  # -> Start, End
move_to_point = MoveToPoint(Geometry=scale_nu.Geometry, PointA=end_points.Start, PointB=unit_y)  # -> flatten(Moved), Vector, Transform
loft_options = LoftOptions(Closed=Toggle(False), Adjust=False, Rebuild=0, Refit=0, Type=loft_type)
loft = Loft(Curves=move_to_point.Moved, Options=loft_options)
custom_preview = CustomPreview(Geometry=loft, Material=ColourSwatch(SwatchColor=RGB(230, 230, 230)))
surface = Surface(loft)

# ---- group: construct vase from curves / internalized points
point = Point([Point(0, -2.01307633, 0), Point(0, -3.862277421, 5.824822564), Point(0, -3.589692141, 8.363923157), Point(0, -2.176387902, 10.32092172)])
point_2 = Point([Point(0, -2.01307633, 0), Point(0, -4.385598196, 4.603518542), Point(0, -2.817090273, 8), Point(0, -2.114707097, 10.32092172)])
point_3 = Point([Point(0, -2.01307633, 0), Point(0, -2.726422794, 3.36130881), Point(0, -4.633739041, 7.294434129), Point(0, -3.764170971, 10.32092172)])
point_4 = Point([Point(0, -2.01307633, 0), Point(0, -4.178738697, 5.159696548), Point(0, -3.512010037, 7.718812905), Point(0, -1.814170434, 10.32092172)])

# ---- group: construct vase from curves
# in the display menu
# turn on the gumball
# to edit these points
scale_z = Slider(1.5, range=0..2)
steps = Slider(3, range=0..10)
range = Range(Domain="0 To 1.5*PI", Steps=steps)
entwine = Entwine(Branch00=point, Branch01=point_2, Branch02=point_3, Branch03=point_4, FlattenInputs=True)
interpolate_2 = Interpolate(Vertices=entwine, Degree=3, Periodic=False, KnotStyle=1)  # -> Curve, Length, Domain
rotate = Rotate(Geometry=flatten(interpolate_2.Curve), Angle=range, Plane=PlaneXY(0, 0, 0))  # -> Geometry, Transform
loft_options_2 = LoftOptions(Closed=Toggle(True), Adjust=False, Rebuild=0, Refit=0, Type=0)
scale_nu_2 = ScaleNU(Geometry=rotate.Geometry, Plane=PlaneXY(0, 0, 0), ScaleX=1, ScaleY=1, ScaleZ=scale_z)  # -> Geometry, Transform
loft_2 = Loft(Curves=scale_nu_2.Geometry, Options=loft_options_2)
surface_2 = Surface(loft_2)

# ---- group: morph waveform surface around vase
# waveform vase
surface_3 = Surface(surface)
surface_4 = Surface(surface_2)
bounding_box = BoundingBox(Content=surface_3, Plane=PlaneXY(0, 0, 0))  # -> Box, Box_2
surface_morph = SurfaceMorph(
    Geometry=surface_3,
    Reference=bounding_box.Box,
    Surface=surface_4,
    UDomain="16.25*PI",
    VDomain=Slider(18, range=0..100),
    WDomain=Slider(1, range=0..10))
brep_edges = BrepEdges(Brep=surface_morph)  # -> Naked, Interior, NonManifold
dispatch = Dispatch(List=brep_edges.Naked, DispatchPattern=[True, False])  # -> ListA, ListB
loft_options_3 = LoftOptions(Closed=False, Adjust=Toggle(True), Rebuild=0, Refit=0, Type=0)
loft_3 = Loft(Curves=dispatch.ListA, Options=loft_options_3)
brep_join = BrepJoin(Breps=flatten([surface_morph, loft_3]))  # -> Breps, Closed
custom_preview_2 = CustomPreview(Geometry=brep_join.Breps, Material=ColourSwatch(SwatchColor=RGB(230, 230, 230)))
