# Grasshopper definition space-filling-vase.gh (Grasshopper 1.0.7)
# plug-ins: Pufferfish

# ---- group: space filling curve
# space filling vase
radius = Slider(36, range=0..100)
scale_factor = Slider(0.7, range=0..1)
count = Slider(3, range=0..10)
seed = Slider(475, range=0..1000)
offset = Slider(3, range=0..10)
point_spacing = Slider(1, range=0..1)
amplitude = Slider(0.15, range=0..1)
seed_2 = Slider(2, range=0..10)
space_filling_curve = SpaceFillingCurve(
    radius=radius,
    factor=scale_factor,
    count=count,
    seed=seed,
    range="3 To 15",
    number=count,
    seed_2=seed,
    value=offset,
    length=point_spacing,
    amplitude=amplitude,
    relay=seed_2)
curve = Curve(space_filling_curve)

# ---- group: circle
Z = Slider(25, range=0..100)
radius_2 = Slider(15, range=0..100)
construct_point = ConstructPoint(XCoordinate=0, YCoordinate=0, ZCoordinate=Z)
circle = Circle(Plane=construct_point, Radius=radius_2)
curve_2 = Curve(circle)

# ----
curve_3 = Curve(curve)
curve_4 = Curve(curve_2)
range = Range(Domain=Domain(0, 1), Steps=10)
tween_two_curves = TweenTwoCurves(CurveA=curve_3, CurveB=curve_4, Factor=range, Refit=0, PointSample=0)
loft = Loft(
    Curves=tween_two_curves,
    Options={Adjust=False, Closed=False, LoftEnds=0, LoftSimp=0, LoftType=0, Rebuild=10, Refit=0.01})
custom_preview = CustomPreview(Geometry=loft, Material=ColourSwatch(SwatchColor=RGB(230, 230, 230)))

curve_5 = Curve(curve)
curve_6 = Curve(curve_2)
range_2 = Range(Domain=Domain(0, 1), Steps=10)
tween_two_curves_2 = TweenTwoCurves(CurveA=curve_5, CurveB=curve_6, Factor=range_2, Refit=0, PointSample=0)
range_3 = Range(Domain="1 To 1.5", Steps=10)
graph_mapper = GraphMapper(
    range_3,
    x0=0.5,
    x1=1.5,
    y0=0.5,
    y1=1.5,
    container_name="Bezier",
    cpx=[0, 0.9988624454, 0.3793688715, 1],
    cpy=[0, 0, 1, 1])
scale_nu = ScaleNU(Geometry=tween_two_curves_2, Plane=PlaneXY(0, 0, 0), ScaleX=graph_mapper, ScaleY=graph_mapper, ScaleZ=1)  # -> Geometry, Transform
loft_2 = Loft(
    Curves=scale_nu.Geometry,
    Options={Adjust=False, Closed=False, LoftEnds=0, LoftSimp=0, LoftType=0, Rebuild=10, Refit=0.01})
custom_preview_2 = CustomPreview(Geometry=loft_2, Material=ColourSwatch(SwatchColor=RGB(230, 230, 230)))

curve_7 = Curve(curve)
curve_8 = Curve(curve_2)
range_4 = Range(Domain=Domain(0, 1), Steps=10)
tween_two_curves_3 = TweenTwoCurves(CurveA=curve_7, CurveB=curve_8, Factor=range_4, Refit=0, PointSample=0)
range_5 = Range(Domain="0 To 1", Steps=10)
graph_mapper_2 = GraphMapper(
    range_5,
    x0=0,
    x1=1,
    y0=0,
    y1=1,
    container_name="Bezier",
    cpx=[0, 0.7053142786, 0.4541068673, 1],
    cpy=[0.1956521869, 0.4903378487, 1, 1])
scale_nu_2 = ScaleNU(Geometry=tween_two_curves_3, Plane=PlaneXY(0, 0, 0), ScaleX=graph_mapper_2, ScaleY=graph_mapper_2, ScaleZ=1)  # -> Geometry, Transform
loft_3 = Loft(
    Curves=scale_nu_2.Geometry,
    Options={Adjust=False, Closed=False, LoftEnds=0, LoftSimp=0, LoftType=0, Rebuild=10, Refit=0.01})
custom_preview_3 = CustomPreview(Geometry=loft_3, Material=ColourSwatch(SwatchColor=RGB(230, 230, 230)))

curve_9 = Curve(curve)
curve_10 = Curve(curve_2)
range_6 = Range(Domain=Domain(0, 1), Steps=10)
tween_two_curves_4 = TweenTwoCurves(CurveA=curve_9, CurveB=curve_10, Factor=range_6, Refit=0, PointSample=0)
range_7 = Range(Domain="0.5 To 1.5", Steps=10)
graph_mapper_3 = GraphMapper(
    range_7,
    x0=0,
    x1=1,
    y0=0,
    y1=1,
    container_name="Bezier",
    cpx=[0, 0.7053142786, 0.4541068673, 1],
    cpy=[0.1956521869, 0.4903378487, 1, 1])
scale_nu_3 = ScaleNU(Geometry=tween_two_curves_4, Plane=PlaneXY(0, 0, 0), ScaleX=graph_mapper_3, ScaleY=graph_mapper_3, ScaleZ=1)  # -> Geometry, Transform
loft_4 = Loft(
    Curves=scale_nu_3.Geometry,
    Options={Adjust=False, Closed=False, LoftEnds=0, LoftSimp=0, LoftType=0, Rebuild=10, Refit=0.01})
custom_preview_4 = CustomPreview(Geometry=loft_4, Material=ColourSwatch(SwatchColor=RGB(230, 230, 230)))

curve_11 = Curve(curve)
curve_12 = Curve(curve_2)
range_8 = Range(Domain=Domain(0, 1), Steps=10)
tween_two_curves_5 = TweenTwoCurves(CurveA=curve_11, CurveB=curve_12, Factor=range_8, Refit=0, PointSample=0)
range_9 = Range(Domain="0 to 1", Steps=10)
graph_mapper_4 = GraphMapper(
    range_9,
    x0=0,
    x1=1,
    y0=0,
    y1=1,
    container_name="Bezier",
    cpx=[0, 0.1967534572, 0.441113472, 1],
    cpy=[1, 0.6295458078, 0.6874203682, 0.8117436767])
scale_nu_4 = ScaleNU(Geometry=tween_two_curves_5, Plane=PlaneXY(0, 0, 0), ScaleX=graph_mapper_4, ScaleY=graph_mapper_4, ScaleZ=1)  # -> Geometry, Transform
loft_5 = Loft(
    Curves=scale_nu_4.Geometry,
    Options={Adjust=False, Closed=False, LoftEnds=0, LoftSimp=0, LoftType=0, Rebuild=10, Refit=0.01})
custom_preview_5 = CustomPreview(Geometry=loft_5, Material=ColourSwatch(SwatchColor=RGB(230, 230, 230)))

# ==== cluster SpaceFillingCurve
value = ClusterInput()
radius = ClusterInput()
negative = Negative(Value=value)
circle = Circle(Plane=PlaneXY(0, 0, 0), Radius=radius)
boundary_surfaces = BoundarySurfaces(Edges=circle)
factor = ClusterInput()
scale = Scale(Geometry=boundary_surfaces, Center=Point(0, 0, 0), Factor=factor)  # -> Geometry, Transform
offset_curve = OffsetCurve(Curve=circle, Distance=negative, Plane=PlaneXY(0, 0, 0), Corners=1)
count = ClusterInput()
seed = ClusterInput()
range = ClusterInput()
number = ClusterInput()
seed_2 = ClusterInput()
length = ClusterInput()
populate_geometry = PopulateGeometry(Geometry=scale.Geometry, Count=count, Seed=seed)
random = Random(Range=range, Number=number, Seed=seed_2)
divide_length = DivideLength(Curve=offset_curve, Length=length)  # -> simplify(Points), Tangents, Parameters
amplitude = ClusterInput()
circle_2 = Circle(Plane=populate_geometry, Radius=random)
amplitude_2 = Amplitude(Vector=divide_length.Points, Amplitude=amplitude)
boundary_surfaces_2 = BoundarySurfaces(Edges=circle_2)
list_length = ListLength(List=amplitude_2)
relay = ClusterInput()
solid_difference = SolidDifference(BrepsA=boundary_surfaces, BrepsB=boundary_surfaces_2)
random_2 = Random(Range="0 To 2*PI", Number=list_length, Seed=relay)
mesh_surface = MeshSurface(Surface=solid_difference, UCount="100", VCount="100", Overhang=True, Equalize=False)
rotate = Rotate(Geometry=amplitude_2, Angle=random_2, Plane=PlaneXY(0, 0, 0))  # -> simplify(Geometry), Transform
move = Move(Geometry=divide_length.Points, Motion=rotate.Geometry)  # -> Geometry, Transform
pt = Point(move.Geometry)
pt_2 = Point(flatten(pt))
polyline = PolyLine(Vertices=move.Geometry, Closed="True")  # -> flatten(Polyline)
lng = ListLength(List=pt_2)
lng_2 = ListLength(List=pt)  # -> flatten(Length)
series = Series(Start=0, Step=1, Count=lng)
explode = Explode(Curve=polyline, Recursive=True)  # -> Segments, Vertices
line = Line(explode.Segments)
line_2 = Line(flatten(line))
lng_3 = ListLength(List=line_2)
lng_4 = ListLength(List=line)  # -> flatten(Length)
series_2 = Series(Start=0, Step=1, Count=lng_3)
partition = PartitionList(List=series, Size=lng_2)
partition_2 = PartitionList(List=series_2, Size=lng_4)
shift = ShiftList(List=partition, Shift=1, Wrap=True)
shift_2 = ShiftList(List=partition_2, Shift=1, Wrap=True)
int = Integer(flatten(partition))
int_2 = Integer(flatten(shift))
line_3 = Line(flatten(line_2))
point = Point(flatten(pt_2))
int_3 = Integer(flatten(partition_2))
int_4 = Integer(flatten(shift_2))
shift_list = ShiftList(List=explode.Segments, Shift=1, Wrap=True)
length_line = LengthLine(Line=flatten(explode.Segments), Length="6", Strength="10")
show = Show(G=polyline)
angle = Angle(LineA=explode.Segments, LineB=shift_list, RestAngle="0", Strength="1000")
collider = Collider(Objects=point, Radii="2", IgnoreA=int, IgnoreB=int_2, Strength="100")
collider_2 = Collider(Objects=line_3, Radii="0.2", IgnoreA=int_3, IgnoreB=int_4, Strength="100")
onmesh = OnMesh(Points=move.Geometry, Mesh=mesh_surface, Strength="1000")
entwine = Entwine(
    Branch00=show,
    Branch01=onmesh,
    Branch02=length_line,
    Branch03=angle,
    Branch04=collider,
    Branch05=collider_2,
    FlattenInputs=True)
zombiesolver = ZombieSolver(GoalObjects=entwine, Threshold=1e-10, Tolerance=0.01, MaxIterations=50000)  # -> I, V, O
fillet = Fillet(Curve=zombiesolver.O, Radius="20")  # -> flatten(Curve)
join_curves = JoinCurves(Curves=fillet, Preserve=False)
curves = ClusterOutput(join_curves)
