# Grasshopper definition tweened-vases.gh (Grasshopper 1.0.7)
# Copyright: GNU General Public License 3.0
# plug-ins: Pufferfish

# ---- group: tween two polygons
# Tweened Vases
# using pufferfish
radius = Slider(10, range=0..100)
segments = Slider(3, range=0..10)
radius_2 = Slider(10, range=0..100)
segments_2 = Slider(6, range=0..10)
Z = Slider(20, range=0..100)
steps = Slider(10, range=0..100)
polygon = Polygon(Plane=PlaneXY(0, 0, 0), Radius=radius, Segments=segments, FilletRadius=0)  # -> Polygon, Length
polygon_2 = Polygon(Plane=PlaneXY(0, 0, 0), Radius=radius_2, Segments=segments_2, FilletRadius=0)  # -> Polygon, Length
unit_z = UnitZ(Factor=Z)
range = Range(Domain=Domain(0, 1), Steps=steps)
curve = Curve(polygon.Polygon)
curve_2 = Curve(polygon_2.Polygon)
move = Move(Geometry=curve_2, Motion=unit_z)  # -> Geometry, Transform
tween_curve = TweenCurve(CurveA=curve, CurveB=move.Geometry, Factor=range, BlendType=0)
loft = Loft(Curves=tween_curve, Options={Adjust=False, Closed=False, LoftEnds=0, LoftSimp=0, LoftType=0, Rebuild=10, Refit=0.01})

# ---- group: tween multiple polygons
# using pufferfish
radius_3 = Slider(10, range=0..100)
segments_3 = Slider(8, range=0..10)
radius_4 = Slider(10, range=0..100)
segments_4 = Slider(4, range=0..10)
Z_2 = Slider(20, range=0..100)
radius_5 = Slider(10, range=0..100)
segments_5 = Slider(6, range=0..10)
Z_3 = Slider(30, range=0..100)
steps_2 = Slider(10, range=0..100)
polygon_3 = Polygon(Plane=PlaneXY(0, 0, 0), Radius=radius_3, Segments=segments_3, FilletRadius=0)  # -> Polygon, Length
polygon_4 = Polygon(Plane=PlaneXY(0, 0, 0), Radius=radius_4, Segments=segments_4, FilletRadius=0)  # -> Polygon, Length
polygon_5 = Polygon(Plane=PlaneXY(0, 0, 0), Radius=radius_5, Segments=segments_5, FilletRadius=0)  # -> Polygon, Length
unit_z_2 = UnitZ(Factor=Z_2)
unit_z_3 = UnitZ(Factor=Z_3)
range_2 = Range(Domain=Domain(0, 1), Steps=steps_2)
curve_3 = Curve(polygon_4.Polygon)
curve_4 = Curve(polygon_5.Polygon)
curve_5 = Curve(polygon_3.Polygon)
move_2 = Move(Geometry=curve_3, Motion=unit_z_2)  # -> Geometry, Transform
move_3 = Move(Geometry=curve_4, Motion=unit_z_3)  # -> Geometry, Transform
relay = Relay([curve_5, move_2.Geometry, move_3.Geometry])
tween_through_curves = TweenThroughCurves(Curves=relay, Factor=range_2, Normalized=True, Equalized=False, InterpolationType="1", Refit=0, PointSample=0)
loft_2 = Loft(
    Curves=tween_through_curves,
    Options={Adjust=False, Closed=False, LoftEnds=0, LoftSimp=0, LoftType=0, Rebuild=10, Refit=0.01})

# ---- group: tween random polygons
# using pufferfish
radius_6 = Slider(10, range=0..100)
intervals = Slider(9, range=0..10)
steps_3 = Slider(36, range=0..100)
random = Random(Range="3 To 16", Number=intervals, Seed=2, Integers=True)
range_3 = Range(Domain="0 To 50", Steps=intervals)
polygon_6 = Polygon(Plane=PlaneXY(0, 0, 0), Radius=radius_6, Segments=random, FilletRadius=0)  # -> Polygon, Length
unit_z_4 = UnitZ(Factor=range_3)
range_4 = Range(Domain=Domain(0, 1), Steps=steps_3)
curve_6 = Curve(polygon_6.Polygon)
move_4 = Move(Geometry=curve_6, Motion=unit_z_4)  # -> Geometry, Transform
tween_through_curves_2 = TweenThroughCurves(Curves=move_4.Geometry, Factor=range_4, Normalized=True, Equalized=False, InterpolationType="1", Refit=0, PointSample=0)
loft_3 = Loft(
    Curves=tween_through_curves_2,
    Options={Adjust=False, Closed=False, LoftEnds=0, LoftSimp=0, LoftType=0, Rebuild=10, Refit=0.01})

# ---- group: tween multiple curves
# using pufferfish
curve_7 = Curve(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)
curve_8 = Curve(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)
Z_4 = Slider(20, range=0..100)
curve_9 = Curve(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)
Z_5 = Slider(40, range=0..100)
steps_4 = Slider(10, range=0..100)
unit_z_5 = UnitZ(Factor=Z_4)
unit_z_6 = UnitZ(Factor=Z_5)
range_5 = Range(Domain=Domain(0, 1), Steps=steps_4)
move_5 = Move(Geometry=curve_8, Motion=unit_z_5)  # -> Geometry, Transform
move_6 = Move(Geometry=curve_9, Motion=unit_z_6)  # -> Geometry, Transform
relay_2 = Relay([curve_7, move_5.Geometry, move_6.Geometry])
tween_through_curves_3 = TweenThroughCurves(Curves=relay_2, Factor=range_5, Normalized=True, Equalized=False, InterpolationType="1", Refit=0, PointSample=0)
loft_4 = Loft(
    Curves=tween_through_curves_3,
    Options={Adjust=False, Closed=False, LoftEnds=0, LoftSimp=0, LoftType=0, Rebuild=10, Refit=0.01})

# ---- group: loft multiple curves
curve_10 = Curve([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])
list_length = ListLength(List=curve_10)
range_6 = Range(Domain="0 To 50", Steps=expr("x-1", list_length))
unit_z_7 = UnitZ(Factor=range_6)
move_7 = Move(Geometry=curve_10, Motion=unit_z_7)  # -> Geometry, Transform
loft_5 = Loft(Curves=move_7.Geometry, Options={Adjust=False, Closed=False, LoftEnds=0, LoftSimp=0, LoftType=0, Rebuild=10, Refit=0.01})

# ----
# using pufferfish
curve_11 = Curve([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])
steps_5 = Slider(20, range=0..100)
list_length_2 = ListLength(List=curve_11)
range_7 = Range(Domain="0 To 50", Steps=expr("x-1", list_length_2))
range_8 = Range(Domain=Domain(0, 1), Steps=steps_5)
unit_z_8 = UnitZ(Factor=range_7)
move_8 = Move(Geometry=curve_11, Motion=unit_z_8)  # -> Geometry, Transform
tween_through_curves_4 = TweenThroughCurves(Curves=move_8.Geometry, Factor=range_8, Normalized=True, Equalized=False, InterpolationType="1", Refit=0, PointSample=0)
loft_6 = Loft(
    Curves=tween_through_curves_4,
    Options={Adjust=False, Closed=False, LoftEnds=0, LoftSimp=0, LoftType=0, Rebuild=10, Refit=0.01})
