# Grasshopper definition voxelate-oak-base.gh (Grasshopper 1.0.7)
# Copyright: GNU General Public License 3.0
# plug-ins: VoxelTools

# ---- group: input
# voxelate tree
# using voxel tools
# input
point = Point()  # disabled

# ---- group: voxelate
# voxelate
point_2 = Point(point)
box = Box({Plane=PlaneXY(-7422.170569, -7009.229034, 0), X=Domain(0, 13296.13904), Y=Domain(0, 13148.13007), Z=Domain(0, 5963.57804)})
grid = Slider(36, range=0..100)
# base
distance = Slider(72, range=0..100)
create_voxelgrid = CreateVoxelGrid(BoundingBox=box, SizeX=grid, SizeY=grid, SizeZ=grid)
voxelategeometry = VoxelateGeometry(Geometry=point_2, VoxelGrid=create_voxelgrid, Distance=distance)
voxelgrid = VoxelGrid(voxelategeometry)

# ---- group: base
radius = Slider(1200, range=0..5000)
length = Slider(36, range=-500..500)
voxelgrid_2 = VoxelGrid(create_voxelgrid)
# union
number = Number(distance)
cylinder = Cylinder(Base=PlaneXY(0, 0, 0), Radius=radius, Length=length)
cap_holes = CapHoles(Brep=cylinder)
voxelategeometry_2 = VoxelateGeometry(Geometry=cap_holes, VoxelGrid=voxelgrid_2, Distance=number)  # disabled
voxelgrid_3 = VoxelGrid(voxelategeometry_2)

# ---- group: union
# marching cubes
voxelgrid_4 = VoxelGrid(voxelgrid_3)
voxelgrid_5 = VoxelGrid(voxelgrid)
voxelgrid_boolean_union = VoxelGridBooleanUnion(Grids=[voxelgrid_5, voxelgrid_4])
voxelgrid_6 = VoxelGrid(voxelgrid_boolean_union)

# ---- group: marching cubes
voxelgrid_7 = VoxelGrid(voxelgrid_6)
isolevel = Slider(0.5, range=0..1)
hull_from_marching_cubes = HullFromMarchingCubes(Grids=voxelgrid_7, Isolevel=isolevel)
mesh = Mesh(hull_from_marching_cubes)

# ---- group: culling
mesh_2 = Mesh(mesh)
threshold = Slider(10000, range=0..10000)
# culling
disjoint_mesh = DisjointMesh(Mesh=mesh_2)
deconstruct_mesh = DeconstructMesh(Mesh=disjoint_mesh)  # -> Vertices, Faces, Colours, Normals
list_length = ListLength(List=deconstruct_mesh.Faces)  # -> flatten(Length)
larger_than = LargerThan(FirstNumber=list_length, SecondNumber=threshold)  # -> LargerThan, OrEqualTo
cull_pattern = CullPattern(List=disjoint_mesh, CullPattern=larger_than.LargerThan)
mesh_3 = Mesh(cull_pattern)

# ---- group: rendering
# rendering
mesh_4 = Mesh(mesh_3)
custom_preview = CustomPreview(Geometry=mesh_4, Material=ColourSwatch(SwatchColor=RGB(209, 209, 209)))
