# Grasshopper definition voxelate-oak.gh (Grasshopper 1.0.7)
# Copyright: GNU General Public License 3.0
# plug-ins: VoxelTools

# ---- group: input
# voxelate point cloud
# using voxel tools
# input
point = Point()

# ---- group: voxelate
# voxelate
point_2 = Point(point)
box = Box({Plane=PlaneXY(-7422.170569, -7009.229034, 0), X=Domain(0, 13296.13904), Y=Domain(0, 13148.13007), Z=Domain(0, 5963.57804)})
grid = Slider(36, range=0..100)
# marching cubes
distance = Slider(72, range=0..100)
create_voxelgrid = CreateVoxelGrid(BoundingBox=box, SizeX=grid, SizeY=grid, SizeZ=grid)
voxelategeometry = VoxelateGeometry(Geometry=point_2, VoxelGrid=create_voxelgrid, Distance=distance)
voxelgrid = VoxelGrid(voxelategeometry)

# ---- group: marching cubes
voxelgrid_2 = VoxelGrid(voxelgrid)
isolevel = Slider(0.5, range=0..1)
hull_from_marching_cubes = HullFromMarchingCubes(Grids=voxelgrid_2, Isolevel=isolevel)
mesh = Mesh(hull_from_marching_cubes)

# ---- group: culling
mesh_2 = Mesh(mesh)
threshold = Slider(10000, range=0..10000)
# culling
disjoint_mesh = DisjointMesh(Mesh=mesh_2)
deconstruct_mesh = DeconstructMesh(Mesh=disjoint_mesh)  # -> Vertices, Faces, Colours, Normals
list_length = ListLength(List=deconstruct_mesh.Faces)  # -> flatten(Length)
larger_than = LargerThan(FirstNumber=list_length, SecondNumber=threshold)  # -> LargerThan, OrEqualTo
cull_pattern = CullPattern(List=disjoint_mesh, CullPattern=larger_than.LargerThan)
mesh_3 = Mesh(cull_pattern)

# ---- group: rendering
# rendering
mesh_4 = Mesh(mesh_3)
custom_preview = CustomPreview(Geometry=mesh_4, Material=ColourSwatch(SwatchColor=RGB(209, 209, 209)))
