# Grasshopper definition voxelate-tree.gh (Grasshopper 1.0.7)
# Copyright: GNU General Public License 3.0
# plug-ins: VoxelTools

# ---- group: input
# voxelate tree
# using voxel tools
# input
point = Point()

# ---- group: voxelate
# voxelate
point_2 = Point(point)
box = Box({Plane=PlaneXY(-1978, -2516, 0), X=Domain(0, 4673), Y=Domain(0, 4884), Z=Domain(0, 4103)})
grid = Slider(25, range=0..100)
# base
distance = Slider(50, range=0..100)
create_voxelgrid = CreateVoxelGrid(BoundingBox=box, SizeX=grid, SizeY=grid, SizeZ=grid)
voxelategeometry = VoxelateGeometry(Geometry=point_2, VoxelGrid=create_voxelgrid, Distance=distance)
voxelgrid = VoxelGrid(voxelategeometry)

# ---- group: base
radius = Slider(1000, range=0..5000)
length = Slider(25, range=-500..500)
voxelgrid_2 = VoxelGrid(create_voxelgrid)
# union
number = Number(distance)
cylinder = Cylinder(Base=PlaneXY(0, 0, 0), Radius=radius, Length=length)
cap_holes = CapHoles(Brep=cylinder)
voxelategeometry_2 = VoxelateGeometry(Geometry=cap_holes, VoxelGrid=voxelgrid_2, Distance=number)
voxelgrid_3 = VoxelGrid(voxelategeometry_2)

# ---- group: union
voxelgrid_4 = VoxelGrid(voxelgrid)
voxelgrid_5 = VoxelGrid(voxelgrid_3)
voxelgrid_boolean_union = VoxelGridBooleanUnion(Grids=[voxelgrid_4, voxelgrid_5])
voxelgrid_6 = VoxelGrid(voxelgrid_boolean_union)

# ---- group: mesh
# mesh
voxelgrid_7 = VoxelGrid(voxelgrid_6)
# marching cubes
boolean_toggle = BooleanToggle(True)
voxelgrid_to_mesh_hull = VoxelGridToMeshHull(VoxelGrid=voxelgrid_7, FakeShadow=boolean_toggle)  # -> Mesh, X, X_2, Y, Y_2, Z, Z_2
mesh = Mesh(voxelgrid_to_mesh_hull.Mesh)

# ---- group: marching cubes
voxelgrid_8 = VoxelGrid(voxelgrid_6)
isolevel = Slider(0.5, range=0..1)
hull_from_marching_cubes = HullFromMarchingCubes(Grids=voxelgrid_8, Isolevel=isolevel)
mesh_2 = Mesh(hull_from_marching_cubes)

# ---- group: culling
mesh_3 = Mesh(mesh_2)
threshold = Slider(10000, range=0..10000)
# culling
disjoint_mesh = DisjointMesh(Mesh=mesh_3)
deconstruct_mesh = DeconstructMesh(Mesh=disjoint_mesh)  # -> Vertices, Faces, Colours, Normals
list_length = ListLength(List=deconstruct_mesh.Faces)  # -> flatten(Length)
larger_than = LargerThan(FirstNumber=list_length, SecondNumber=threshold)  # -> LargerThan, OrEqualTo
cull_pattern = CullPattern(List=disjoint_mesh, CullPattern=larger_than.LargerThan)
mesh_4 = Mesh(cull_pattern)

# ---- group: rendering
# rendering
mesh_5 = Mesh(mesh_4)
custom_preview = CustomPreview(Geometry=mesh_5, Material=ColourSwatch(SwatchColor=RGB(209, 209, 209)))
