# Grasshopper definition voxelate.gh (Grasshopper 1.0.7)
# Copyright: GNU General Public License 3.0
# plug-ins: VoxelTools

# ---- group: input
# voxelate point cloud
# using voxel tools
# input
point = Point()

# ---- group: voxelate
# voxelate
point_2 = Point(point)
box = Box({Plane=PlaneXY(-1978, -2516, 0), X=Domain(0, 4673), Y=Domain(0, 4884), Z=Domain(0, 4103)})
grid = Slider(25, range=0..100)
# mesh
distance = Slider(50, range=0..100)
create_voxelgrid = CreateVoxelGrid(BoundingBox=box, SizeX=grid, SizeY=grid, SizeZ=grid)
voxelategeometry = VoxelateGeometry(Geometry=point_2, VoxelGrid=create_voxelgrid, Distance=distance)
voxelgrid = VoxelGrid(voxelategeometry)

# ---- group: mesh
voxelgrid_2 = VoxelGrid(voxelgrid)
# marching cubes
boolean_toggle = BooleanToggle(True)
voxelgrid_to_mesh_hull = VoxelGridToMeshHull(VoxelGrid=voxelgrid_2, FakeShadow=boolean_toggle)  # -> Mesh, X, X_2, Y, Y_2, Z, Z_2
mesh = Mesh(voxelgrid_to_mesh_hull.Mesh)

# ---- group: marching cubes
voxelgrid_3 = VoxelGrid(voxelgrid)
isolevel = Slider(0.5, range=0..1)
hull_from_marching_cubes = HullFromMarchingCubes(Grids=voxelgrid_3, Isolevel=isolevel)
mesh_2 = Mesh(hull_from_marching_cubes)

# ---- group: culling
mesh_3 = Mesh(mesh_2)
threshold = Slider(10000, range=0..10000)
# culling
disjoint_mesh = DisjointMesh(Mesh=mesh_3)
deconstruct_mesh = DeconstructMesh(Mesh=disjoint_mesh)  # -> Vertices, Faces, Colours, Normals
list_length = ListLength(List=deconstruct_mesh.Faces)  # -> flatten(Length)
larger_than = LargerThan(FirstNumber=list_length, SecondNumber=threshold)  # -> LargerThan, OrEqualTo
cull_pattern = CullPattern(List=disjoint_mesh, CullPattern=larger_than.LargerThan)
mesh_4 = Mesh(cull_pattern)

# ---- group: rendering
# rendering
mesh_5 = Mesh(mesh_4)
custom_preview = CustomPreview(Geometry=mesh_5, Material=ColourSwatch(SwatchColor=RGB(209, 209, 209)))
