# Grasshopper definition voxelize-tree.gh (Grasshopper 1.0.7)
# Copyright: GNU General Public License 3.0
# plug-ins: DendroGH

# ---- group: settings
# settings
size = Slider(20, range=0..100)
isovalue = Slider(0.002, range=0..0.01)
# volume
adaptivity = Slider(0.2, range=0..1)
create_settings = CreateSettings(VoxelSize=size, Bandwidth=1, Isovalue=isovalue, Adaptivity=adaptivity)
volume_settings = VolumeSettings(create_settings)

# ---- group: base
radius = Slider(1000, range=0..5000)
length = Slider(-100, range=-500..500)
cylinder = Cylinder(Base=PlaneXY(0, 0, 0), Radius=radius, Length=length)
cap_holes = CapHoles(Brep=cylinder)
mesh_brep = MeshBrep(
    Brep=cap_holes,
    Settings={GridMaxCount=0, GridMinCount=16, JaggedSeams=False, MaxEdgeLength=0, MinEdgeLength=0.0001, MinTolerance=0, Refine=True, RefineAngle=0, RelativeTolerance=0.65, SimplePlanes=True, Tolerance=0})
mesh = Mesh(mesh_brep)

# ---- group: input
# voxelize tree
# using dendro
# input
point = Point()

# ---- group: volume
point_2 = Point(point)
radius_2 = Slider(60, range=0..100)
# base
volume_settings_2 = VolumeSettings(create_settings)
points_to_volume = PointsToVolume(Points=point_2, PointRadius=radius_2, Settings=volume_settings_2)
volume = Volume(points_to_volume)

# ---- group: union
# union
mesh_2 = Mesh(mesh)
volume_settings_3 = VolumeSettings(create_settings)
volume_2 = Volume(volume)
mesh_to_volume = MeshToVolume(Mesh=mesh_2, Settings=volume_settings_3)
volume_union = VolumeUnion(Volumes=[mesh_to_volume, volume_2])
volume_3 = Volume(volume_union)

# ---- group: smoothing
# smoothing
volume_4 = Volume(volume_3)
width = Slider(5, range=0..10)
type = Slider(1, range=0..3)
# meshing
iterations = Slider(1, range=0..10)
smooth_volume = SmoothVolume(Volume=volume_4, Width=width, Type=type, Iterations=iterations)
volume_5 = Volume(smooth_volume)

# ---- group: meshing
volume_6 = Volume(volume_3)
# culling
volume_settings_4 = VolumeSettings(create_settings)
volume_to_mesh = VolumeToMesh(Volume=volume_6, VolumeSettings=volume_settings_4)
mesh_3 = Mesh(volume_to_mesh)

# ---- group: culling
mesh_4 = Mesh(mesh_3)
# rendering
threshold = Slider(16000, range=0..20000)
disjoint_mesh = DisjointMesh(Mesh=mesh_4)
deconstruct_mesh = DeconstructMesh(Mesh=disjoint_mesh)  # -> Vertices, Faces, Colours, Normals
list_length = ListLength(List=deconstruct_mesh.Faces)  # -> flatten(Length)
larger_than = LargerThan(FirstNumber=list_length, SecondNumber=threshold)  # -> LargerThan, OrEqualTo
cull_pattern = CullPattern(List=disjoint_mesh, CullPattern=larger_than.LargerThan)
mesh_5 = Mesh(cull_pattern)

# ---- group: rendering
mesh_6 = Mesh(mesh_5)
custom_preview = CustomPreview(Geometry=mesh_6, Material=ColourSwatch(SwatchColor=RGB(209, 209, 209)))
