# Grasshopper definition voxelize-with-dendro.gh (Grasshopper 1.0.7)
# Copyright: GNU General Public License 3.0
# plug-ins: DendroGH

# ---- group: settings
# voxelize point cloud
# using dendro
size = Slider(8, range=0..100)
adaptivity = Slider(0.5, range=0..1)
create_settings = CreateSettings(VoxelSize=size, Bandwidth=1, Isovalue=0, Adaptivity=adaptivity)
volume_settings = VolumeSettings(create_settings)

# ---- group: volume
point = Point()
radius = Slider(20, range=0..100)
volume_settings_2 = VolumeSettings(create_settings)
points_to_volume = PointsToVolume(Points=point, PointRadius=radius, Settings=volume_settings_2)
volume = Volume(points_to_volume)

# ---- group: smoothing
volume_2 = Volume(points_to_volume)
width = Slider(4, range=0..10)
type = Slider(1, range=0..3)
iterations = Slider(2, range=0..10)
smooth_volume = SmoothVolume(Volume=volume_2, Width=width, Type=type, Iterations=iterations)
volume_3 = Volume(smooth_volume)

# ---- group: meshing
volume_4 = Volume(points_to_volume)
volume_settings_3 = VolumeSettings(create_settings)
volume_to_mesh = VolumeToMesh(Volume=volume_4, VolumeSettings=volume_settings_3)
mesh = Mesh(volume_to_mesh)

# ---- group: culling
mesh_2 = Mesh(mesh)
threshold = Slider(4000, range=0..10000)
disjoint_mesh = DisjointMesh(Mesh=mesh_2)
deconstruct_mesh = DeconstructMesh(Mesh=disjoint_mesh)  # -> Vertices, Faces, Colours, Normals
list_length = ListLength(List=deconstruct_mesh.Faces)  # -> flatten(Length)
larger_than = LargerThan(FirstNumber=list_length, SecondNumber=threshold)  # -> LargerThan, OrEqualTo
cull_pattern = CullPattern(List=disjoint_mesh, CullPattern=larger_than.LargerThan)
mesh_3 = Mesh(cull_pattern)
