# Grasshopper definition voxelize-with-volvox.gh (Grasshopper 1.0.7)
# Copyright: GNU General Public License 3.0
# plug-ins: Volvox

# ---- group: generate voxels
# voxelize point cloud
# using volvox
# using volvox
cloud = Cloud()
size = Slider(22, range=0..100)
voxel_colored = VoxelColored(Cloud=cloud, VoxelSize=size)
mesh = Mesh(voxel_colored)

# ---- group: cull small parts
mesh_2 = Mesh(mesh)
threshold = Slider(4000, range=0..10000)
disjoint_mesh = DisjointMesh(Mesh=mesh_2)
deconstruct_mesh = DeconstructMesh(Mesh=disjoint_mesh)  # -> Vertices, Faces, Colours, Normals
list_length = ListLength(List=deconstruct_mesh.Vertices)  # -> flatten(Length)
larger_than = LargerThan(FirstNumber=list_length, SecondNumber=threshold)  # -> LargerThan, OrEqualTo
cull_pattern = CullPattern(List=disjoint_mesh, CullPattern=larger_than.LargerThan)
mesh_3 = Mesh(cull_pattern)

# ---- group: smooth mesh
mesh_4 = Mesh(mesh_3)
strength = Slider(0.3, range=0..1)
iterations = Slider(2, range=0..10)
smooth_mesh = SmoothMesh(Mesh=mesh_4, Strength=strength, SkipNaked=True, Iterations=iterations)
mesh_5 = Mesh(smooth_mesh)
