# Grasshopper definition voxelize-with-voxeltools.gh (Grasshopper 1.0.7)
# Copyright: GNU General Public License 3.0
# plug-ins: VoxelTools

# ---- group: voxelate
# voxelize point cloud
# using voxel tools
point = Point()
box = Box({Plane=PlaneXY(-1335, -1384, 0), X=Domain(0, 3542), Y=Domain(0, 3197), Z=Domain(0, 3439)})
grid = Slider(20, range=0..100)
distance = Slider(36, range=0..100)
create_voxelgrid = CreateVoxelGrid(BoundingBox=box, SizeX=grid, SizeY=grid, SizeZ=grid)
voxelategeometry = VoxelateGeometry(Geometry=point, VoxelGrid=create_voxelgrid, Distance=distance)
voxelgrid = VoxelGrid(voxelategeometry)

# ---- group: mesh
voxelgrid_2 = VoxelGrid(voxelgrid)
voxelgrid_to_mesh_hull = VoxelGridToMeshHull(VoxelGrid=voxelgrid_2, FakeShadow=Toggle(False))  # -> Mesh, X, X_2, Y, Y_2, Z, Z_2
mesh = Mesh(voxelgrid_to_mesh_hull.Mesh)

# ---- group: marching cubes
voxelgrid_3 = VoxelGrid(voxelgrid)
isolevel = Slider(0.5, range=0..1)
hull_from_marching_cubes = HullFromMarchingCubes(Grids=voxelgrid_3, Isolevel=isolevel)
mesh_2 = Mesh(hull_from_marching_cubes)
