# Grasshopper definition voxelize.gh (Grasshopper 1.0.7)
# Copyright: GNU General Public License 3.0
# plug-ins: DendroGH

# ---- group: settings
# settings
size = Slider(10, range=0..100)
isovalue = Slider(0.002, range=0..0.01)
# volume
adaptivity = Slider(0.2, range=0..1)
create_settings = CreateSettings(VoxelSize=size, Bandwidth=1, Isovalue=isovalue, Adaptivity=adaptivity)
volume_settings = VolumeSettings(create_settings)

# ---- group: input
# voxelize point cloud
# using dendro
# input
point = Point()

# ---- group: volume
point_2 = Point(point)
radius = Slider(60, range=0..100)
# smoothing
volume_settings_2 = VolumeSettings(create_settings)
points_to_volume = PointsToVolume(Points=point_2, PointRadius=radius, Settings=volume_settings_2)
volume = Volume(points_to_volume)

# ---- group: smoothing
volume_2 = Volume(points_to_volume)
width = Slider(2, range=0..10)
type = Slider(1, range=0..3)
# meshing
iterations = Slider(2, range=0..10)
smooth_volume = SmoothVolume(Volume=volume_2, Width=width, Type=type, Iterations=iterations)
volume_3 = Volume(smooth_volume)

# ---- group: meshing
volume_4 = Volume(volume_3)
# culling
volume_settings_3 = VolumeSettings(create_settings)
volume_to_mesh = VolumeToMesh(Volume=volume_4, VolumeSettings=volume_settings_3)
mesh = Mesh(volume_to_mesh)

# ---- group: culling
mesh_2 = Mesh(mesh)
# rendering
threshold = Slider(10000, range=0..10000)
disjoint_mesh = DisjointMesh(Mesh=mesh_2)
deconstruct_mesh = DeconstructMesh(Mesh=disjoint_mesh)  # -> Vertices, Faces, Colours, Normals
list_length = ListLength(List=deconstruct_mesh.Faces)  # -> flatten(Length)
larger_than = LargerThan(FirstNumber=list_length, SecondNumber=threshold)  # -> LargerThan, OrEqualTo
cull_pattern = CullPattern(List=disjoint_mesh, CullPattern=larger_than.LargerThan)
mesh_3 = Mesh(cull_pattern)

# ---- group: rendering
mesh_4 = Mesh(mesh_3)
custom_preview = CustomPreview(Geometry=mesh_4, Material=ColourSwatch(SwatchColor=RGB(209, 209, 209)))
