# Grasshopper definition wearables.gh (Grasshopper 1.0.7)
# Copyright: GNU General Public License
# plug-ins: Heteroptera, Pufferfish, EleFront, Kangaroo2 Components

# ---- group: generate grid
# wearables
# voronoi attractor
cell_size = Slider(10, range=0..100)
X = Slider(200, range=0..1000)
Y = Slider(50, range=0..1000)
rectangle = Rectangle(Plane=PlaneXY(0, 0, 0), XSize=X, YSize=Y, Radius=0)  # -> Rectangle, Length
division = Division(A=X, B=cell_size)
division_2 = Division(A=Y, B=cell_size)
square = Square(Plane=PlaneXY(0, 0, 0), Size=cell_size, ExtentX=division, ExtentY=division_2)  # -> Cells, Points
grid = Point(flatten(square.Points))
region = Rectangle(rectangle.Rectangle)

# ---- group: set multiple attractors
point = Point([Point(18, 6, 0), Point(31, 18, 0), Point(76, 42, 0), Point(97, 6, 0), Point(110, 21, 0), Point(130, 8, 0), Point(169, 45, 0), Point(195, 17, 0)])

# ----
grid_2 = Point(grid)
domain = Slider(30, range=0..100)
closest_point = ClosestPoint(Point=grid_2, Cloud=point)  # -> ClosestPoint, CPIndex, Distance
bounds = Bounds(Numbers=closest_point.Distance)
negative = Negative(Value=domain)
remap_numbers = RemapNumbers(Value=closest_point.Distance, Source=bounds, Target=[negative, domain])  # -> Mapped, Clipped
unit_x = UnitX(Factor=remap_numbers.Mapped)
unit_y = UnitY(Factor=remap_numbers.Mapped)
move = Move(Geometry=grid_2, Motion=unit_x)  # -> Geometry, Transform
move_2 = Move(Geometry=move.Geometry, Motion=unit_y)  # -> Geometry, Transform
points = Point(move_2.Geometry)

# ---- group: create cell boundaries
points_2 = Point(points)
region_2 = Rectangle(region)
scaling = Slider(0.7, range=0..1)
voronoi = Voronoi(Points=points_2, Boundary=region_2, BruteForceOverride=False)
polygon_center = PolygonCenter(Polyline=voronoi)  # -> CenterV, CenterE, CenterA
scale = Scale(Geometry=voronoi, Center=polygon_center.CenterA, Factor=scaling)  # -> Geometry, Transform
boundary_surfaces = BoundarySurfaces(Edges=[voronoi, scale.Geometry])
surface = Surface(boundary_surfaces)

# ---- group: bake to layer
# using elefront
surface_2 = Surface(surface)
layer = Panel("voronoi-")
iteration = Slider(1, range=0..10)
concatenate = Concatenate(FragmentA=layer, FragmentB=iteration)
define_layer = DefineLayer(Name=concatenate)
define_object_attributes = DefineObjectAttributes(Layer=define_layer)
bake_objects = BakeObjects(Geometry=surface_2, Attributes=define_object_attributes, Bake=False)

# ---- group: set region / set multiple attractors
point_2 = Point(Point(130, 21, 0))

# ---- group: space filling curve / run & reset
boolean_toggle = BooleanToggle(False)
boolean_toggle_2 = BooleanToggle(False)

# ----
# transform
surface_3 = Surface(flatten(surface))
Z = Slider(3, range=0..10)
brep_join = BrepJoin(Breps=surface_3)  # -> Breps, Closed
unit_z = UnitZ(Factor=Z)
extrude = Extrude(Base=brep_join.Breps, Direction=unit_z)
rotate = Rotate(Geometry=extrude, Angle=1.570796327, Plane=PlaneXY(0, 0, 0))  # -> Geometry, Transform
brep = Brep(rotate.Geometry)

# ----
# voronoi bracelet
# basic shape
radius = Slider(25, range=0..100)
middle = Slider(25, range=0..100)
scale_2 = Slider(0.8, range=0..10)
top = Slider(25, range=0..100)
scale_3 = Slider(1.25, range=0..10)
unit_z_2 = UnitZ(Factor=middle)
unit_z_3 = UnitZ(Factor=top)
circle = Circle(Plane=PlaneXY(0, 0, 0), Radius=radius)
move_3 = Move(Geometry=circle, Motion=unit_z_2)  # -> Geometry, Transform
scale_4 = Scale(Geometry=move_3.Geometry, Center=move_3.Geometry, Factor=scale_2)  # -> Geometry, Transform
move_4 = Move(Geometry=scale_4.Geometry, Motion=unit_z_3)  # -> Geometry, Transform
scale_5 = Scale(Geometry=move_4.Geometry, Center=move_4.Geometry, Factor=scale_3)  # -> Geometry, Transform
loft = Loft(
    Curves=[circle, scale_4.Geometry, scale_5.Geometry],
    Options={Adjust=False, Closed=False, LoftEnds=0, LoftSimp=0, LoftType=0, Rebuild=10, Refit=0.01})
surface_4 = Surface(loft)

# ---- group: morph waveform surface around vase
# morph
brep_2 = Brep(rotate.Geometry)
surface_5 = Surface(surface_4)
U = Slider(54, range=0..100)
W = Slider(1, range=0..10)
bounding_box = BoundingBox(Content=brep_2, Plane=PlaneXY(0, 0, 0))  # -> Box, Box_2
surface_morph = SurfaceMorph(Geometry=brep_2, Reference=bounding_box.Box, Surface=surface_5, UDomain=U, VDomain="-200 To 0", WDomain=W)
custom_preview = CustomPreview(Geometry=surface_morph, Material=ColourSwatch(SwatchColor=RGB(230, 230, 230)))
brep_3 = Brep(surface_morph)

# ---- group: generate grid
# voronoi bracelet
# voronoi bracelet
cell_size_2 = Slider(10, range=0..100)
X_2 = Slider(100, range=0..1000)
Y_2 = Slider(100, range=0..1000)
rectangle_2 = Rectangle(Plane=PlaneXY(0, 0, 0), XSize=X_2, YSize=Y_2, Radius=0)  # -> Rectangle, Length
division_3 = Division(A=X_2, B=cell_size_2)
division_4 = Division(A=Y_2, B=cell_size_2)
square_2 = Square(Plane=PlaneXY(0, 0, 0), Size=cell_size_2, ExtentX=division_3, ExtentY=division_4)  # -> Cells, Points
grid_3 = Point(flatten(square_2.Points))
region_3 = Rectangle(rectangle_2.Rectangle)

# ---- group: basic bracelet
radius_2 = Slider(25, range=0..100)
middle_2 = Slider(25, range=0..100)
scale_6 = Slider(0.8, range=0..10)
top_2 = Slider(25, range=0..100)
scale_7 = Slider(1.25, range=0..10)
unit_z_4 = UnitZ(Factor=middle_2)
unit_z_5 = UnitZ(Factor=top_2)
circle_2 = Circle(Plane=PlaneXY(0, 0, 0), Radius=radius_2)
move_5 = Move(Geometry=circle_2, Motion=unit_z_4)  # -> Geometry, Transform
scale_8 = Scale(Geometry=move_5.Geometry, Center=move_5.Geometry, Factor=scale_6)  # -> Geometry, Transform
move_6 = Move(Geometry=scale_8.Geometry, Motion=unit_z_5)  # -> Geometry, Transform
scale_9 = Scale(Geometry=move_6.Geometry, Center=move_6.Geometry, Factor=scale_7)  # -> Geometry, Transform
loft_2 = Loft(
    Curves=[circle_2, scale_8.Geometry, scale_9.Geometry],
    Options={Adjust=False, Closed=False, LoftEnds=0, LoftSimp=0, LoftType=0, Rebuild=10, Refit=0.01})
surface_6 = Surface(loft_2)

# ---- group: generate random attractors
region_4 = Rectangle(region_3)
count = Slider(7, range=0..10)
seed = Slider(67, range=0..100)
populate_2d = Populate2D(Region=region_4, Count=count, Seed=seed)

# ---- group: set multiple attractors
point_3 = Point(populate_2d)

# ----
grid_4 = Point(grid_3)
domain_2 = Slider(30, range=0..100)
closest_point_2 = ClosestPoint(Point=grid_4, Cloud=point_3)  # -> ClosestPoint, CPIndex, Distance
bounds_2 = Bounds(Numbers=closest_point_2.Distance)
negative_2 = Negative(Value=domain_2)
remap_numbers_2 = RemapNumbers(Value=closest_point_2.Distance, Source=bounds_2, Target=[negative_2, domain_2])  # -> Mapped, Clipped
unit_x_2 = UnitX(Factor=remap_numbers_2.Mapped)
unit_y_2 = UnitY(Factor=remap_numbers_2.Mapped)
move_7 = Move(Geometry=grid_4, Motion=unit_x_2)  # -> Geometry, Transform
move_8 = Move(Geometry=move_7.Geometry, Motion=unit_y_2)  # -> Geometry, Transform
points_3 = Point(move_8.Geometry)

# ---- group: create cell boundaries
points_4 = Point(points_3)
region_5 = Rectangle(region_3)
scaling_2 = Slider(0.7, range=0..1)
voronoi_2 = Voronoi(Points=points_4, Boundary=region_5, BruteForceOverride=False)
polygon_center_2 = PolygonCenter(Polyline=voronoi_2)  # -> CenterV, CenterE, CenterA
scale_10 = Scale(Geometry=voronoi_2, Center=polygon_center_2.CenterA, Factor=scaling_2)  # -> Geometry, Transform
boundary_surfaces_2 = BoundarySurfaces(Edges=[voronoi_2, scale_10.Geometry])
surface_7 = Surface(boundary_surfaces_2)

# ----
curve = Curve(voronoi_2)
surface_8 = Surface(region_3)
surface_9 = Surface(surface_6)
scale_11 = Slider(0.7, range=0..1)
rebuild_curve = RebuildCurve(Curve=curve, Count="36", Degree="3", EndTangents=False)
map_to_surface = MapToSurface(Curve=rebuild_curve, Source=surface_8, Target=surface_9)
null_item = NullItem(Item=map_to_surface)  # -> NullFlags, InvalidFlags, Description
dispatch = Dispatch(List=map_to_surface, DispatchPattern=null_item.NullFlags)  # -> ListA, ListB
curve_2 = Curve(dispatch.ListB)
center = Center(Geometry=curve_2)  # -> Center, Dimension
scale_12 = Scale(Geometry=curve_2, Center=center.Center, Factor=scale_11)  # -> Geometry, Transform
ruled_surface = RuledSurface(CurveA=curve_2, CurveB=scale_12.Geometry)

# ---- group: populate boundary
point_spacing = Slider(0.5, range=0..1)
amplitude = Slider(0.15, range=0..1)
seed_2 = Slider(2, range=0..10)

# ---- group: inset
offset = Slider(2, range=0..10)  # disabled
negative_3 = Negative(Value=offset)  # disabled

# ---- group: set region
# space filling curve
X_3 = Slider(200, range=0..1000)
Y_3 = Slider(50, range=0..1000)
offset_2 = Slider(5, range=0..10)
list_length = ListLength(List=point_2)
rectangle_3 = Rectangle(Plane=PlaneXY(0, 0, 0), XSize=X_3, YSize=Y_3, Radius=0)  # -> Rectangle, Length
negative_4 = Negative(Value=offset_2)
random = Random(Range="3 To 6", Number=list_length, Seed=2)
offset_curve = OffsetCurve(Curve=rectangle_3.Rectangle, Distance=negative_4, Plane=PlaneXY(0, 0, 0), Corners=1)
circle_3 = Circle(Plane=point_2, Radius=random)
region_difference = RegionDifference(CurvesA=offset_curve, CurvesB=circle_3)
boundary_surfaces_3 = BoundarySurfaces(Edges=region_difference)
curve_3 = Curve(rectangle_3.Rectangle)
curve_4 = Curve(offset_curve)
surface_10 = Surface(boundary_surfaces_3)

# ---- group: populate boundary (continued)
curve_5 = Curve(offset_curve)
divide_length = DivideLength(Curve=curve_5, Length=point_spacing)  # -> simplify(Points), Tangents, Parameters
amplitude_2 = Amplitude(Vector=divide_length.Points, Amplitude=amplitude)
list_length_2 = ListLength(List=amplitude_2)
random_2 = Random(Range="0 To 2*PI", Number=list_length_2, Seed=seed_2)
rotate_2 = Rotate(Geometry=amplitude_2, Angle=random_2, Plane=PlaneXY(0, 0, 0))  # -> simplify(Geometry), Transform
move_9 = Move(Geometry=divide_length.Points, Motion=rotate_2.Geometry)  # -> Geometry, Transform
point_4 = Point(move_9.Geometry)

# ----
X_4 = Number(X_3)
Y_4 = Number(Y_3)

# ---- group: set region (continued)
mesh_surface = MeshSurface(Surface=boundary_surfaces_3, UCount=X_4, VCount=Y_4, Overhang=True, Equalize=False)
mesh = Mesh(mesh_surface)

# ---- group: space filling curve
mesh_2 = Mesh(mesh)
point_5 = Point(point_4)
point_6 = Point(point_4)
point_7 = Point(point_4)
list_length_3 = ListLength(List=point_7)
polyline = PolyLine(Vertices=point_6, Closed="True")  # -> flatten(Polyline)
series = Series(Start=0, Step=1, Count=list_length_3)
partition_list = PartitionList(List=series, Size=list_length_3)
explode = Explode(Curve=polyline, Recursive=True)  # -> Segments, Vertices
line = Line(explode.Segments)
list_length_4 = ListLength(List=line)
series_2 = Series(Start=0, Step=1, Count=list_length_4)
partition_list_2 = PartitionList(List=series_2, Size=list_length_4)
shift_list = ShiftList(List=partition_list_2, Shift=1, Wrap=True)
shift_list_2 = ShiftList(List=partition_list, Shift=1, Wrap=True)
shift_list_3 = ShiftList(List=explode.Segments, Shift=1, Wrap=True)
integer = Integer(partition_list_2)
integer_2 = Integer(partition_list)
integer_3 = Integer(shift_list_2)
integer_4 = Integer(shift_list)
length_line = LengthLine(Line=flatten(explode.Segments), Length="6", Strength="10")
show = Show(G=polyline)
angle = Angle(LineA=explode.Segments, LineB=shift_list_3, RestAngle="0", Strength="1000")
collider = Collider(Objects=point_7, Radii="2", IgnoreA=integer_2, IgnoreB=integer_3, Strength="100")
onmesh = OnMesh(Points=point_5, Mesh=mesh_2, Strength="1000")
collider_2 = Collider(Objects=line, Radii="2", IgnoreA=integer, IgnoreB=integer_4, Strength="100")
entwine = Entwine(
    Branch00=show,
    Branch01=onmesh,
    Branch02=length_line,
    Branch03=angle,
    Branch04=collider,
    Branch05=collider_2,
    FlattenInputs=True)
solver = Solver(GoalObjects=entwine, Reset=boolean_toggle_2, Threshold=0, Tolerance=0.01, On=boolean_toggle)  # -> I, V, O
fillet = Fillet(Curve=solver.O, Radius="10")  # -> flatten(Curve)
join_curves = JoinCurves(Curves=fillet, Preserve=False)
curve_6 = Curve(join_curves)

# ---- group: cutout
surface_11 = Surface(curve_3)  # disabled
curve_7 = Curve(curve_6)  # disabled
boundary_surfaces_4 = BoundarySurfaces(Edges=curve_7)  # disabled
solid_difference = SolidDifference(BrepsA=surface_11, BrepsB=boundary_surfaces_4)  # disabled

# ---- group: inset (continued)
curve_8 = Curve(curve_6)  # disabled
curve_9 = Curve(curve_3)  # disabled
curve_10 = Curve(curve_4)  # disabled
offset_curve_2 = OffsetCurve(Curve=curve_10, Distance=negative_3, Plane=PlaneXY(0, 0, 0), Corners=1)  # disabled
boundary_surfaces_5 = BoundarySurfaces(Edges=flatten([curve_9, offset_curve_2]))  # disabled
boundary_surfaces_6 = BoundarySurfaces(Edges=curve_8)  # disabled
solid_intersection = SolidIntersection(BrepsA=boundary_surfaces_5, BrepsB=boundary_surfaces_6)  # disabled
merge_faces = MergeFaces(Brep=solid_intersection)  # -> Breps, Before, After; disabled

# ---- group: bake to layer
# using elefront
surface_12 = Surface(solid_difference)  # disabled
layer_2 = Panel("space-filling-")  # disabled
iteration_2 = Slider(1, range=0..10)  # disabled
concatenate_2 = Concatenate(FragmentA=layer_2, FragmentB=iteration_2)  # disabled
define_layer_2 = DefineLayer(Name=concatenate_2)  # disabled
define_object_attributes_2 = DefineObjectAttributes(Layer=define_layer_2)  # disabled
bake_objects_2 = BakeObjects(Geometry=surface_12, Attributes=define_object_attributes_2, Bake=False)  # disabled

# using elefront
surface_13 = Surface(merge_faces.Breps)  # disabled
layer_3 = Panel("space-filling-")  # disabled
iteration_3 = Slider(2, range=0..10)  # disabled
concatenate_3 = Concatenate(FragmentA=layer_3, FragmentB=iteration_3)  # disabled
define_layer_3 = DefineLayer(Name=concatenate_3)  # disabled
define_object_attributes_3 = DefineObjectAttributes(Layer=define_layer_3)  # disabled
bake_objects_3 = BakeObjects(Geometry=surface_13, Attributes=define_object_attributes_3, Bake=False)  # disabled
