# Grasshopper definition 3d-plants.gh (Grasshopper 1.0.7)
# Copyright: GNU General Public License 3.0
# plug-ins: EleFront

# ---- group: tree
# 3D plants
# distribute 3D plants from the xfrog plant library for rendering with thea
# trees
# using elefront
# right click and select
# one extended geometry
# to pick a block with a
# 3D tree in rhino
extended_geometry = ExtendedGeometry(<elefrontblock referenced from the Rhino model>)

# ---- group: region
# landscape
radius = Slider(4, range=0..25)
depth = Slider(0.5, range=0..2)
circle = Circle(Plane=PlaneXY(0, 0, 0), Radius=radius)
negative = Negative(Value=depth)
unit_z = UnitZ(Factor=negative)
boundary_surfaces = BoundarySurfaces(Edges=circle)
extrude = Extrude(Base=boundary_surfaces, Direction=unit_z)
region = Surface(boundary_surfaces)
ground = Brep(extrude)

# ---- group: populate trees
extended_geometry_2 = ExtendedGeometry(extended_geometry)
region_2 = Surface(region)
count = Slider(1, range=0..10)
seed = Slider(57, range=0..100)
populate_geometry = PopulateGeometry(Geometry=region_2, Count=count, Seed=seed)
origin = Panel("0,0,0")
vector_2pt = Vector2Pt(PointA=origin, PointB=populate_geometry, Unitize=False)  # -> Vector, Length
move = Move(Geometry=extended_geometry_2, Motion=vector_2pt.Vector)  # -> Geometry, Transform
extended_geometry_3 = ExtendedGeometry(move.Geometry)

# ---- group: grass
# grasses
# using elefront
# right click and select
# one extended geometry
# to pick a block with a
# 3D grass in rhino
extended_geometry_4 = ExtendedGeometry(<elefrontblock referenced from the Rhino model>)

# ---- group: populate grass
count_2 = Slider(1000, range=0..1000)
extended_geometry_5 = ExtendedGeometry(extended_geometry_4)
region_3 = Surface(region)
seed_2 = Slider(0, range=0..100)
populate_geometry_2 = PopulateGeometry(Geometry=region_3, Count=count_2, Seed=seed_2)
origin_2 = Panel("0,0,0")
vector_2pt_2 = Vector2Pt(PointA=origin_2, PointB=populate_geometry_2, Unitize=False)  # -> Vector, Length
move_2 = Move(Geometry=extended_geometry_5, Motion=vector_2pt_2.Vector)  # -> Geometry, Transform
vector = Vector(vector_2pt_2.Vector)

# ----
extended_geometry_6 = ExtendedGeometry(move_2.Geometry)

# ---- group: transform grass
extended_geometry_7 = ExtendedGeometry(extended_geometry_6)
vector_2 = Vector(vector)
count_3 = Number(count_2)
seed_3 = Number(seed_2)
scale = Scale(Geometry=extended_geometry_7, Center=vector_2, Factor=0.5)  # -> Geometry, Transform
random = Random(Range="0 To 360", Number=count_3, Seed=seed_3)
count_4 = Number(count_2)
seed_4 = Number(seed_2)
rotate = Rotate(Geometry=scale.Geometry, Angle=degrees(random), Plane=vector_2)  # -> Geometry, Transform
random_2 = Random(Range="0.5 To 1.5", Number=count_4, Seed=seed_4)
scale_2 = Scale(Geometry=rotate.Geometry, Center=vector_2, Factor=random_2)  # -> Geometry, Transform
extended_geometry_8 = ExtendedGeometry(scale_2.Geometry)

# ---- group: bake ground to layer
# baking
# using elefront
ground_2 = Brep(extrude)
define_layer = DefineLayer(Name="Ground", Color=ColourSwatch(SwatchColor=RGB(184, 168, 143)))
define_object_attributes = DefineObjectAttributes(Layer=define_layer)
bake_objects = BakeObjects(Geometry=ground_2, Attributes=define_object_attributes, Bake=False)

# ---- group: bake trees to layer
# using elefront
extended_geometry_9 = ExtendedGeometry(extended_geometry_3)
define_layer_2 = DefineLayer(Name="Trees")
define_object_attributes_2 = DefineObjectAttributes(Layer=define_layer_2)
bake_objects_2 = BakeObjects(Geometry=extended_geometry_9, Attributes=define_object_attributes_2, Bake=False)

# ---- group: bake grass to layer
# using elefront
extended_geometry_10 = ExtendedGeometry(extended_geometry_8)
define_layer_3 = DefineLayer(Name="Grass")
define_object_attributes_3 = DefineObjectAttributes(Layer=define_layer_3)
bake_objects_3 = BakeObjects(Geometry=extended_geometry_10, Attributes=define_object_attributes_3, Bake=False)
