# Grasshopper definition algorithm.gh (Grasshopper 1.0.7)
# Copyright: GNU General Public License 3.0

# ---- group: algorithm
# algorithm
count = Slider(100, range=0..100)
seed = Slider(0, range=0..100)
populate_3d = Populate3D(Region={Plane=PlaneXY(0, 0, 0), X=Domain(0, 10), Y=Domain(0, 10), Z=Domain(0, 2)}, Count=count, Seed=seed)
point = Point(populate_3d)

# ---- group: voronoi diagram
X = Slider(10, range=0..100)
Y = Slider(10, range=0..100)
# modularization
count_2 = Slider(10, range=0..100)
seed_2 = Slider(0, range=0..1000)
rectangle = Rectangle(Plane=PlaneXY(0, 0, 0), XSize=X, YSize=Y, Radius=0)  # -> Rectangle, Length
populate_2d = Populate2D(Region=rectangle.Rectangle, Count=count_2, Seed=seed_2)
voronoi = Voronoi(Points=populate_2d, Boundary=rectangle.Rectangle, BruteForceOverride=False)
curve = Curve(voronoi)

# ---- group: region
# vs
X_2 = Slider(10, range=0..100)
Y_2 = Slider(10, range=0..100)
rectangle_2 = Rectangle(Plane=PlaneXY(0, 0, 0), XSize=X_2, YSize=Y_2, Radius=0)  # -> Rectangle, Length

# ---- group: input parameters
count_3 = Slider(100, range=0..100)
# interface
seed_3 = Slider(0, range=0..100)

# ---- group: working
# color coding
populate_3d_2 = Populate3D(Region={Plane=PlaneXY(0, 0, 0), X=Domain(0, 10), Y=Domain(0, 10), Z=Domain(0, 2)}, Count=100, Seed=1)

# ---- group: default wire display
# hidden wires
count_4 = Slider(100, range=0..100)
populate_3d_3 = Populate3D(Region={Plane=PlaneXY(0, 0, 0), X=Domain(0, 10), Y=Domain(0, 10), Z=Domain(0, 2)}, Count=count_4, Seed=1)

# ---- group: preview disabled
populate_3d_4 = Populate3D(Region={Plane=PlaneXY(0, 0, 0), X=Domain(0, 10), Y=Domain(0, 10), Z=Domain(0, 2)}, Count=100, Seed=1)

# ---- group: component
populate_3d_5 = Populate3D(Region={Plane=PlaneXY(0, 0, 0), X=Domain(0, 10), Y=Domain(0, 10), Z=Domain(0, 2)}, Count=count_3, Seed=seed_3)

# ---- group: region / output parameter
rectangle_3 = Rectangle(rectangle_2.Rectangle)

# ---- group: voronoi diagram / passed parameter
rectangle_4 = Rectangle(rectangle_3)

# ---- group: voronoi diagram
# hidden wire
# relay
count_5 = Slider(10, range=0..100)
seed_4 = Slider(0, range=0..1000)
populate_2d_2 = Populate2D(Region=rectangle_4, Count=count_5, Seed=seed_4)
voronoi_2 = Voronoi(Points=populate_2d_2, Boundary=rectangle_4, BruteForceOverride=False)
curve_2 = Curve(voronoi_2)

# ---- group: disabled
populate_3d_6 = Populate3D(Region={Plane=PlaneXY(0, 0, 0), X=Domain(0, 10), Y=Domain(0, 10), Z=Domain(0, 2)}, Count=100, Seed=1)  # disabled

# ---- group: hidden wire display
count_6 = Slider(100, range=0..100)
populate_3d_7 = Populate3D(Region={Plane=PlaneXY(0, 0, 0), X=Domain(0, 10), Y=Domain(0, 10), Z=Domain(0, 2)}, Count=count_6, Seed=1)

# ---- group: output parameter
point_2 = Point(populate_3d_5)

# ----
point_3 = Point(point)
size = Slider(0.25, range=0..1)
cloud_display = CloudDisplay(Points=point_3, Colours=ColourSwatch(SwatchColor=RGB(38, 38, 38)), Size=size, SpriteType=1)

# ---- group: warning
populate_3d_8 = Populate3D(Count=100, Seed=1)

# ----
invalid_input = Text("x")

# ---- group: error
populate_3d_9 = Populate3D(Region={Plane=PlaneXY(0, 0, 0), X=Domain(0, 10), Y=Domain(0, 10), Z=Domain(0, 2)}, Seed=1, Points=invalid_input)
