# Grasshopper definition advanced-trigonometry.gh (Grasshopper 1.0.7)
# Copyright: GNU General Public License 3.0

# ---- group: modulated & spiralling curve
# advanced trigonometry
# modulation & spiralling
u = Slider(2, range=0..10)
A = Slider(4, range=0..10)
pi = Pi(Factor=u)
range = Range(Domain=pi, Steps=1000)
expression = Expression(u=range, A=A, Expression="u*sin(A*u)")
expression_2 = Expression(u=range, A=A, Expression="u*cos(u)")
construct_point = ConstructPoint(XCoordinate=expression_2, YCoordinate=expression, ZCoordinate=0)
interpolate = Interpolate(Vertices=construct_point, Degree=3, Periodic=False, KnotStyle=1)  # -> Curve, Length, Domain
curve = Curve(interpolate.Curve)

# ---- group: trigonometric cylinder
# combinations
u_2 = Slider(1, range=0..1)
v = Slider(2, range=0..10)
pi_2 = Pi(Factor=u_2)
pi_3 = Pi(Factor=v)
negative = Negative(Value=pi_2)
construct_domain = ConstructDomain(DomainStart=negative, DomainEnd=pi_2)
range_2 = Range(Domain=construct_domain, Steps="100")
range_3 = Range(Domain=pi_3, Steps="100")  # -> graft(Range)
cosine = Cosine(Value=range_2)
sine = Sine(Value=range_2)
cy = Number(sine)
cx = Number(cosine)
cz = Number(range_3)
construct_point_2 = ConstructPoint(XCoordinate=cx, YCoordinate=cy, ZCoordinate=cz)

# ---- group: dome
cx_2 = Number(cx)
cy_2 = Number(cx)
cz_2 = Number(cz)
expression_3 = Expression(cx=cx_2, cy=cy_2, cz=cz_2, Expression="sin(cz)*cx")
expression_4 = Expression(cx=cx_2, cy=cy_2, cz=cz_2, Expression="sin(cz)*cy")
expression_5 = Expression(cx=cx_2, cy=cy_2, cz=cz_2, Expression="cos(cz)")
sx = Number(expression_3)
sy = Number(expression_4)
sz = Number(expression_5)
construct_point_3 = ConstructPoint(XCoordinate=sx, YCoordinate=sy, ZCoordinate=sz)

# ---- group: combined surface
cx_3 = Number(cx)
cy_3 = Number(cx)
cz_3 = Number(cz)
sy_2 = Number(sy)
sx_2 = Number(sx)
sz_2 = Number(sz)
expression_6 = Expression(cx=cx_3, cy=cy_3, cz=cz_3, sx=sx_2, sy=sy_2, sz=sz_2, Expression="cz")
expression_7 = Expression(cx=cx_3, cy=cy_3, cz=cz_3, sx=sx_2, sy=sy_2, sz=sz_2, Expression="cy+sz")
expression_8 = Expression(cx=cx_3, cy=cy_3, cz=cz_3, sx=sx_2, sy=sy_2, sz=sz_2, Expression="sx")
x = Number(expression_6)
y = Number(expression_7)
z = Number(expression_8)
construct_point_4 = ConstructPoint(XCoordinate=x, YCoordinate=y, ZCoordinate=z)
interpolate_2 = Interpolate(Vertices=construct_point_4, Degree=3, Periodic=False, KnotStyle=1)  # -> flatten(Curve), Length, Domain
loft = Loft(
    Curves=interpolate_2.Curve,
    Options={Adjust=False, Closed=False, LoftEnds=0, LoftSimp=0, LoftType=0, Rebuild=10, Refit=0.01})
surface = Surface(loft)

# ---- group: dome
cx_4 = Number(cx)
cy_4 = Number(cx)
cz_4 = Number(cz)
expression_9 = Expression(cx=cx_4, cy=cy_4, cz=cz_4, Expression="sin(cz)*cx")
expression_10 = Expression(cx=cx_4, cy=cy_4, cz=cz_4, Expression="sin(cz)*cy")
expression_11 = Expression(cx=cx_4, cy=cy_4, cz=cz_4, Expression="cos(cz)")
sx_3 = Number(expression_9)
sy_3 = Number(expression_10)
sz_3 = Number(expression_11)

# ---- group: combined surface
cx_5 = Number(cx)
cy_5 = Number(cx)
cz_5 = Number(cz)
sy_4 = Number(sy_3)
sx_4 = Number(sx_3)
sz_4 = Number(sz_3)
expression_12 = Expression(cx=cx_5, cy=cy_5, cz=cz_5, sx=sx_4, sy=sy_4, sz=sz_4, Expression="cz")
expression_13 = Expression(cx=cx_5, cy=cy_5, cz=cz_5, sx=sx_4, sy=sy_4, sz=sz_4, Expression="cy")
expression_14 = Expression(cx=cx_5, cy=cy_5, cz=cz_5, sx=sx_4, sy=sy_4, sz=sz_4, Expression="sx")
x_2 = Number(expression_12)
y_2 = Number(expression_13)
z_2 = Number(expression_14)
construct_point_5 = ConstructPoint(XCoordinate=x_2, YCoordinate=y_2, ZCoordinate=z_2)
interpolate_3 = Interpolate(Vertices=construct_point_5, Degree=3, Periodic=False, KnotStyle=1)  # -> flatten(Curve), Length, Domain
loft_2 = Loft(
    Curves=interpolate_3.Curve,
    Options={Adjust=False, Closed=False, LoftEnds=0, LoftSimp=0, LoftType=0, Rebuild=10, Refit=0.01})
surface_2 = Surface(loft_2)

# ---- group: mirror
surface_3 = Surface(surface_2)
xz_plane = XZPlane(Origin="0,1,0")
mirror = Mirror(Geometry=surface_3, Plane=xz_plane)  # -> Geometry, Transform
merge = Merge(Data1=surface_3, Data2=mirror.Geometry)
surface_4 = Surface(merge)
