# Grasshopper definition blob-sculpture.gh (Grasshopper 1.0.7)
# Copyright: GNU General Public License 3.0
# plug-ins: Weaverbird

# ---- group: sculpture from randomly scaled cloud of spheres
# blob sculpture
radius = Slider(8, range=0..100)
X = Slider(1.2, range=0..10)
Y = Slider(0.6, range=0..1)
Z = Slider(0.9, range=0..10)
count = Slider(12, range=0..20)
min = Slider(4, range=0..10)
max = Slider(6, range=0..20)
seed = Slider(0, range=0..100)
sphere = Sphere(Base=PlaneXY(0, 0, 0), Radius=radius)
construct_domain = ConstructDomain(DomainStart=min, DomainEnd=max)
scale_nu = ScaleNU(Geometry=sphere, Plane=PlaneXY(0, 0, 0), ScaleX=X, ScaleY=Y, ScaleZ=Z)  # -> Geometry, Transform
count_2 = Number(count)
populate_geometry = PopulateGeometry(Geometry=scale_nu.Geometry, Count=count, Seed=1)
seed_2 = Slider(1, range=0..100)
seed_3 = Slider(2, range=0..100)
seed_4 = Slider(3, range=0..100)
random = Random(Range=construct_domain, Number=count, Seed=seed)
random_2 = Random(Range="0.6 To 1.4", Number=count_2, Seed=seed_2)
random_3 = Random(Range="0.6 To 1.4", Number=count_2, Seed=seed_3)
random_4 = Random(Range="0.6 To 1.4", Number=count_2, Seed=seed_4)
sphere_2 = Sphere(Base=populate_geometry, Radius=random)
scale_nu_2 = ScaleNU(Geometry=sphere_2, Plane=PlaneXY(0, 0, 0), ScaleX=random_2, ScaleY=random_3, ScaleZ=random_4)  # -> Geometry, Transform
solid_union = SolidUnion(Breps=scale_nu_2.Geometry)

# ---- group: set on plinth
brep = Brep(solid_union)
Z_2 = Slider(15, range=0..100)
base_xy = Slider(8, range=0..20)
unit_z = UnitZ(Factor=Z_2)
center_box = CenterBox(Base=PlaneXY(0, 0, 0), X=base_xy, Y=base_xy, Z=1)
move = Move(Geometry=brep, Motion=unit_z)  # -> Geometry, Transform
solid_difference = SolidDifference(BrepsA=move.Geometry, BrepsB=center_box)
custom_preview = CustomPreview(Geometry=solid_difference, Material=ColourSwatch(SwatchColor=RGB(76, 76, 76)))
custom_preview_2 = CustomPreview(Geometry=center_box, Material=ColourSwatch(SwatchColor=RGB(219, 219, 219)))

# ----
# bake for 3D printing
solid_union_2 = SolidUnion(Breps=flatten([move.Geometry, center_box]))

# ---- group: smoothing
brep_2 = Brep(move.Geometry)
mesh_brep = MeshBrep(
    Brep=brep_2,
    Settings={GridMaxCount=0, GridMinCount=16, JaggedSeams=False, MaxEdgeLength=0, MinEdgeLength=0.0001, MinTolerance=0, Refine=True, RefineAngle=0, RelativeTolerance=0.65, SimplePlanes=True, Tolerance=0})
weaverbird_s_laplacian_smoothing = WeaverbirdsLaplacianSmoothing(MeshCurves=mesh_brep, Level=Slider(20, range=0..100), SmoothNakedEdges=1, Thin=1)  # -> flatten(OutputMeshCurves)
custom_preview_3 = CustomPreview(Geometry=weaverbird_s_laplacian_smoothing, Material=ColourSwatch(SwatchColor=RGB(76, 76, 76)))
