# Grasshopper definition curving-voronoi-wall.gh (Grasshopper 1.0.7)
# plug-ins: Heteroptera

number_slider = Slider(36, range=0..100)
xz_plane = XZPlane(Origin=Point(0, 0, 0))
multiplication = Multiplication(A=number_slider, B="2")
circle = Circle(Plane=xz_plane, Radius=number_slider)
point = Point(Point(-38.82390034, 1.90641734, -36))
point_2 = Point(Point(8.644440837, 10.97070991, -36))
point_3 = Point(Point(-15.39534636, 2.028365595, -36))
point_4 = Point(Point(39.97720792, -3.438600432, -36))
unit_z = UnitZ(Factor=multiplication)
interpolate = Interpolate(Vertices=[point_4, point_2, point_3, point], Degree=3, Periodic=False, KnotStyle=1)  # -> Curve, Length, Domain
boundary_surfaces = BoundarySurfaces(Edges=circle)
populate_geometry = PopulateGeometry(Geometry=boundary_surfaces, Count=100, Seed=1)
extrude = Extrude(Base=interpolate.Curve, Direction=unit_z)
voronoize = Voronoize(points=populate_geometry, boundary=extrude, tolerance=0, voronoi_output=False)  # -> breps, cells
curve_to_polyline = CurveToPolyline(Curve=voronoize.cells, ToleranceDistance=0, ToleranceAngle=0)  # -> Polyline, Segments
# using heteroptera
center = Center(Geometrical=curve_to_polyline.Polyline)  # -> Center, Dimension
xz_plane_2 = XZPlane(Origin=center.Center)
project = Project(Geometry=curve_to_polyline.Polyline, Plane=xz_plane_2)  # -> Geometry, Transform
scale = Scale(Geometry=project.Geometry, Center=center.Center, Factor=Slider(0.85, range=0..1))  # -> Geometry, Transform
fillet = Fillet(Curve=scale.Geometry, Radius=Slider(4, range=0..10))
negative = Negative(Value=Slider(3, range=0..10))
unit_y = UnitY(Factor=negative)
extrude_2 = Extrude(Base=fillet, Direction=unit_y)
scale_nu = ScaleNU(
    Geometry=fillet,
    Plane=flatten(center.Center),
    ScaleX=Slider(0.64, range=0..1),
    ScaleY=1,
    ScaleZ=Slider(0.36, range=0..1))  # -> Geometry, Transform
unit_y_2 = UnitY(Factor=Slider(4, range=0..10))
move = Move(Geometry=scale_nu.Geometry, Motion=unit_y_2)  # -> Geometry, Transform
ruled_surface = RuledSurface(CurveA=move.Geometry, CurveB=fillet)
yz_plane = YZPlane(Origin=center.Center)
brep_join = BrepJoin(Breps=[ruled_surface, extrude_2])  # -> Breps, Closed
rotate = Rotate(Geometry=brep_join.Breps, Angle=degrees(Slider(30, range=0..100)), Plane=yz_plane)  # -> Geometry, Transform
deconstruct_brep = DeconstructBrep(Brep=rotate.Geometry)  # -> Faces, Edges, Vertices
list_item = ListItem(List=deconstruct_brep.Edges, Index=Slider(4, range=0..10), Wrap=True)
boundary_surfaces_2 = BoundarySurfaces(Edges=list_item)
brep_join_2 = BrepJoin(Breps=[rotate.Geometry, boundary_surfaces_2])  # -> Breps, Closed
custom_preview = CustomPreview(Geometry=brep_join_2.Breps, Material=ColourSwatch(SwatchColor=RGB(230, 230, 230)))

# ==== cluster Voronoize: Voronoize Any Planar/Non-Planar Surface ,PolySurface, Brep or Mesh. Icon Adopted From VoronaxGH By Milos Dimcic. __Version 1.7__
# Voronoize Algorithm_Grasshopper
points = ClusterInput()  # Points For Voronoize.
boundary = ClusterInput()  # Planar/Non-Planar Surface ,PolySurface, Brep or Mesh.
tolerance = ClusterInput()  # For Certain Case Only, Adjust With Number (double) Between X > 0 And X < 1 (Default is 0.0). Better to Leave As Default In Many Cases.
voronoi_output = ClusterInput()  # Convert Cells to Fragments? (Non-Meshes Only).
# ~ Adia Robbie
pt = Point(points)
data = Data(0)
geo = Geometry(boundary)
merge = Merge(Data1=data, Data2=geo)  # -> flatten(Result)
graft = GraftTree(Tree=geo, IncludeEmptyLists=True, IncludeNullItems=True)
merge_2 = Merge(Data1=data, Data2=pt)  # -> flatten(Result)
tstat = TreeStatistics(Tree=merge)  # -> Paths, Length, Count
tstat_2 = TreeStatistics(Tree=merge_2)  # -> Paths, Length, Count
expression = Expression(x=tstat_2.Length, y=tstat.Length, Expression="IF((x > 1) and (y > 1), 1,0)")
bool = Boolean(voronoi_output)
num = Number(tolerance)
filter = StreamFilter(Gate=expression, Stream1=graft)
filter_2 = StreamFilter(Gate=expression, Stream1=pt)
c_script = CSharpScript(G=filter)  # -> A, B, x; inputs G: list of GeometryBase
# ---------- c_script: C# ----------
    if(G.Count > 0){
      foreach(GeometryBase M in G){
        Type T = M.GetType();
        if(T.ToString() == "Rhino.Geometry.Mesh"){
          B = M;
          x = false;
        }else{
          A = M;
          x = true;
        }
      }
    }
# ---------- end c_script ----------
dispatch = Dispatch(List=filter_2, DispatchPattern=c_script.x)  # -> ListA, ListB
clean = CleanTree(RemoveNulls=True, RemoveInvalid=True, RemoveEmpty=invert(False), Tree=dispatch.ListA)
clean_2 = CleanTree(RemoveNulls=True, RemoveInvalid=True, RemoveEmpty=invert(False), Tree=c_script.B)
clean_3 = CleanTree(RemoveNulls=True, RemoveInvalid=True, RemoveEmpty=invert(False), Tree=c_script.A)
bbox = BoundingBox(Content=clean_2, Plane=PlaneXY(0, 0, 0))  # -> Box, Box_2
data_2 = Data(1)
filter_3 = StreamFilter(Gate=bool, Stream1=clean)
c_script_2 = CSharpScript(P=clean, B=clean_3, X=num)  # -> F, C, N; inputs P: list of Point3d, B: list of Brep, X: Double, V: Boolean
# ---------- c_script_2: C# ----------
    //© 2020 Adia Robbie

    if((P.Count > 0) && (B.Count > 0)){
      if((X >= 1) | (X <= 0)){
        X = 0.0;
      }
      double agl = 0.1;
      double agl1 = -0.1;
      if((B.Count > 0) && (P.Count > 0)){
        foreach(Brep Br in B){
          Vector3d vec = new Vector3d(1.0, 1.0, 1.0);
          Point3d cntr = Rhino.Geometry.AreaMassProperties.Compute(Br).Centroid;
          Br.Transform(Transform.Rotation(Rhino.RhinoMath.ToRadians(agl), vec, cntr));
          List<Brep> brp_Vr3d = new List<Brep>();
          Box boX = new Box(Br.GetBoundingBox(true));
          System.Threading.Tasks.Parallel.For(0, P.Count, i =>
            {
            Grasshopper.Kernel.Geometry.Voronoi.Cell3 cell = new Grasshopper.Kernel.Geometry.Voronoi.Cell3(P[i], boX);
            List<Point3d> slcr_V = new List<Point3d>();
            for (int j = 0; j <= P.Count - 1; j++){
              if(i != j){
                slcr_V.Add(P[j]);
              }
            }
            cell.Slice(slcr_V);
            var brp_c = cell.ToBrep();
            if(X > 0){
              brp_c.Transform(Transform.Scale(cntr, 1 + X));
            }
            brp_Vr3d.Add(brp_c);
            slcr_V.Clear();
            }
            );
          List<Brep> brp_Vrn = new List<Brep>();
          if(V){
            int pC = Environment.ProcessorCount;
            if(pC >= 16){
              pC = 16 - 1;
            }else{
              pC = Environment.ProcessorCount - 1;
            }
            var sb = new System.Collections.Concurrent.ConcurrentDictionary<int,Brep[]>(pC, brp_Vr3d.Count);
            System.Threading.Tasks.Parallel.For(0, brp_Vr3d.Count, i =>
              {
              sb[i] = Br.Split(brp_Vr3d[i], RhinoDocument.ModelAbsoluteTolerance);
              }
              );
            foreach(Brep[] frg in sb.Values){
              brp_Vrn.AddRange(frg);
            }
            List<double> dbl_Are = new List<double>();
            var d_are = new System.Collections.Concurrent.ConcurrentDictionary<int,double>(pC, brp_Vr3d.Count);
            System.Threading.Tasks.Parallel.For(0, brp_Vrn.Count, i =>
              {
              d_are[i] = brp_Vrn[i].GetArea();
              brp_Vr3d.Clear();
              }
              );
            foreach(double d in d_are.Values){
              dbl_Are.Add(d);
            }
            double s_Are = 0.0;
            for(int i = 0; i < dbl_Are.Count; i++){
              s_Are = s_Are + dbl_Are[i];
            }
            double avr = s_Are / dbl_Are.Count;
            for(int i = 0; i < dbl_Are.Count; i++){
              if(dbl_Are[i] < avr){
                brp_Vrn[i].Transform(Transform.Rotation(Rhino.RhinoMath.ToRadians(agl1), vec, cntr));
                brp_Vr3d.Add(brp_Vrn[i]);
              }
            }
            F = brp_Vr3d;
          }else{
            List<Curve> crvrs = new List<Curve>();
            DataTree<Curve> crv_dt = new DataTree<Curve>();
            for(int i = 0; i < brp_Vr3d.Count; i++){
              Curve[] crvr;
              Point3d[] pts;
              if(X > 0){
                brp_Vr3d[i].Transform(Transform.Scale(cntr, 1 + X));
              }
              GH_Path p = new GH_Path(0, i);
              Rhino.Geometry.Intersect.Intersection.BrepBrep(Br, brp_Vr3d[i], RhinoDocument.ModelAbsoluteTolerance, out crvr, out pts);
              for(int j = 0; j < crvr.Length; j++){
                crvr[j].Transform(Transform.Rotation(Rhino.RhinoMath.ToRadians(agl1), vec, cntr));
                crv_dt.Add(crvr[j], p);
              }
            }
            if(Br.IsSolid){
              for(int i = 0; i < crv_dt.BranchCount; i++){
                Curve[] crvrj = Rhino.Geometry.Curve.JoinCurves(crv_dt.Branch(i));
                for(int j = 0; j < crvrj.Length; j++){
                  crvrs.Add(crvrj[j]);
                }
              }
              C = crvrs;
            }
            else if(!Br.IsSolid){
              List<Curve> crvrs_Un_C = new List<Curve>();
              List<Curve> crvrs_C = new List<Curve>();
              List<Curve> crvrs_Br_E = new List<Curve>();
              for(int i = 0; i < crv_dt.BranchCount; i++){
                Curve[] crvrj = Rhino.Geometry.Curve.JoinCurves(crv_dt.Branch(i));
                for(int j = 0; j < crvrj.Length; j++){
                  if(!crvrj[j].IsClosed){
                    crvrs_Un_C.Add(crvrj[j]);
                  }else{
                    crvrs_C.Add(crvrj[j]);
                  }
                }
              }
              Curve[] Br_NE = Br.DuplicateNakedEdgeCurves(true, false);
              Curve[] Br_NEJ = Rhino.Geometry.Curve.JoinCurves(Br_NE);
              foreach(Curve Br_NEJ_R in Br_NEJ){
                Br_NEJ_R.Transform(Transform.Rotation(Rhino.RhinoMath.ToRadians(agl1), vec, cntr));
                crvrs_Br_E.Add(Br_NEJ_R);
              }
              DataTree<double> prm_C = new DataTree<double>();
              for (int i = 0; i < crvrs_Un_C.Count; i++){
                for (int j = 0; j < crvrs_Br_E.Count; j++){
                  GH_Path p = new GH_Path(0, i);
                  var crv_crv_events = Rhino.Geometry.Intersect.Intersection.CurveCurve(crvrs_Br_E[j], crvrs_Un_C[i], RhinoDocument.ModelAbsoluteTolerance, RhinoDocument.ModelAbsoluteTolerance);
                  for (int k = 0; k < crv_crv_events.Count; k++){
                    var crv_crv_event = crv_crv_events[k];
                    prm_C.Add(crv_crv_event.ParameterA, p);
                  }
                }
              }
              List<Curve> crvrs_UnC_Shtr = new List<Curve>();
              for (int i = 0; i < crvrs_Br_E.Count; i++){
                for (int j = 0; j < prm_C.BranchCount; j++){
                  crvrs_UnC_Shtr.AddRange(crvrs_Br_E[i].Split(prm_C.Branch(j)));
                }
              }
              List<double> Br_EsL = new List<double>();
              crvrs_Br_E.Clear();
              for(int i = 0; i < crvrs_UnC_Shtr.Count; i++){
                Br_EsL.Add(crvrs_UnC_Shtr[i].GetLength());
                prm_C.ClearData();
              }
              double EsL = 0.0;
              foreach(double i in Br_EsL){
                EsL = EsL + i;
              }
              double EsL_avr = EsL / Br_EsL.Count;
              for(int i = 0; i < Br_EsL.Count; i++){
                if(Br_EsL[i] < EsL_avr){
                  crvrs_Br_E.Add(crvrs_UnC_Shtr[i]);
                }
              }
              DataTree<Curve> crvrs_Br_E_tr = new DataTree<Curve>();
              for (int i = 0; i < crvrs_Br_E.Count; i++){
                GH_Path p = new GH_Path(0, i);
                crvrs_Br_E_tr.Add(crvrs_Br_E[i], p);
                crvrs_UnC_Shtr.Clear();
                Br_EsL.Clear();
              }
              for (int i = 0; i < crvrs_Un_C.Count; i++){
                GH_Path p = new GH_Path(0, i);
                crvrs_Br_E_tr.Insert(crvrs_Un_C[i], p, 1);
                crvrs_Br_E.Clear();
              }
              for (int i = 0; i < crvrs_Br_E_tr.BranchCount; i++){
                crvrs_C.AddRange(Rhino.Geometry.Curve.JoinCurves(crvrs_Br_E_tr.Branch(i), RhinoDocument.ModelAbsoluteTolerance));
                crvrs_Un_C.Clear();
              }
              crvrs_Br_E_tr.ClearData();
              if(P.Count == crvrs_C.Count){
                C = crvrs_C;
                N = false;
              }else{
                C = crvrs_C;
                N = true;
              }
            }
          }
        }
      }
    }
# ---------- end c_script_2 ----------
vec = VectorXYZ(XComponent=data_2, YComponent=data_2, ZComponent=data_2)  # -> Vector, Length
data_3 = Data(0.1)
tmatch = MatchText(Text=bbox.Box, Pattern="Box", Case=True)
tstat_3 = TreeStatistics(Tree=c_script_2.C)  # -> Paths, Length, Count
cull = CullPattern(List=clean_3, CullPattern=c_script_2.N)
c_script_3 = CSharpScript(P=filter_3, B=clean_3, X=num, V=bool)  # -> F, C; inputs P: list of Point3d, B: list of Brep, X: Double, V: Boolean
# ---------- c_script_3: C# ----------
    //© 2020 Adia Robbie

    if((P.Count > 0) && (B.Count > 0)){
      if((X >= 1) | (X <= 0)){
        X = 0.0;
      }
      double agl = 0.1;
      double agl1 = -0.1;
      if((B.Count > 0) && (P.Count > 0)){
        foreach(Brep Br in B){
          Vector3d vec = new Vector3d(1.0, 1.0, 1.0);
          Point3d cntr = Rhino.Geometry.AreaMassProperties.Compute(Br).Centroid;
          Br.Transform(Transform.Rotation(Rhino.RhinoMath.ToRadians(agl), vec, cntr));
          List<Brep> brp_Vr3d = new List<Brep>();
          Box boX = new Box(Br.GetBoundingBox(true));
          System.Threading.Tasks.Parallel.For(0, P.Count, i =>
            {
            Grasshopper.Kernel.Geometry.Voronoi.Cell3 cell = new Grasshopper.Kernel.Geometry.Voronoi.Cell3(P[i], boX);
            List<Point3d> slcr_V = new List<Point3d>();
            for (int j = 0; j <= P.Count - 1; j++){
              if(i != j){
                slcr_V.Add(P[j]);
              }
            }
            cell.Slice(slcr_V);
            var brp_c = cell.ToBrep();
            if(X > 0){
              brp_c.Transform(Transform.Scale(cntr, 1 + X));
            }
            brp_Vr3d.Add(brp_c);
            slcr_V.Clear();
            }
            );
          List<Brep> brp_Vrn = new List<Brep>();
          if(V){
            int pC = Environment.ProcessorCount;
            if(pC >= 16){
              pC = 16 - 1;
            }else{
              pC = Environment.ProcessorCount - 1;
            }
            var sb = new System.Collections.Concurrent.ConcurrentDictionary<int,Brep[]>(pC, brp_Vr3d.Count);
            System.Threading.Tasks.Parallel.For(0, brp_Vr3d.Count, i =>
              {
              sb[i] = Br.Split(brp_Vr3d[i], RhinoDocument.ModelAbsoluteTolerance);
              }
              );
            foreach(Brep[] frg in sb.Values){
              brp_Vrn.AddRange(frg);
            }
            List<double> dbl_Are = new List<double>();
            var d_are = new System.Collections.Concurrent.ConcurrentDictionary<int,double>(pC, brp_Vr3d.Count);
            System.Threading.Tasks.Parallel.For(0, brp_Vrn.Count, i =>
              {
              d_are[i] = brp_Vrn[i].GetArea();
              brp_Vr3d.Clear();
              }
              );
            foreach(double d in d_are.Values){
              dbl_Are.Add(d);
            }
            double s_Are = 0.0;
            for(int i = 0; i < dbl_Are.Count; i++){
              s_Are = s_Are + dbl_Are[i];
            }
            double avr = s_Are / dbl_Are.Count;
            for(int i = 0; i < dbl_Are.Count; i++){
              if(dbl_Are[i] < avr){
                brp_Vrn[i].Transform(Transform.Rotation(Rhino.RhinoMath.ToRadians(agl1), vec, cntr));
                brp_Vr3d.Add(brp_Vrn[i]);
              }
            }
            F = brp_Vr3d;
          }else{
            List<Curve> crvrs = new List<Curve>();
            DataTree<Curve> crv_dt = new DataTree<Curve>();
            for(int i = 0; i < brp_Vr3d.Count; i++){
              Curve[] crvr;
              Point3d[] pts;
              if(X > 0){
                brp_Vr3d[i].Transform(Transform.Scale(cntr, 1 + X));
              }
              GH_Path p = new GH_Path(0, i);
              Rhino.Geometry.Intersect.Intersection.BrepBrep(Br, brp_Vr3d[i], RhinoDocument.ModelAbsoluteTolerance, out crvr, out pts);
              for(int j = 0; j < crvr.Length; j++){
                crvr[j].Transform(Transform.Rotation(Rhino.RhinoMath.ToRadians(agl1), vec, cntr));
                crv_dt.Add(crvr[j], p);
              }
            }
            if(Br.IsSolid){
              for(int i = 0; i < crv_dt.BranchCount; i++){
                Curve[] crvrj = Rhino.Geometry.Curve.JoinCurves(crv_dt.Branch(i));
                for(int j = 0; j < crvrj.Length; j++){
                  crvrs.Add(crvrj[j]);
                }
              }
              C = crvrs;
            }
            else if(!Br.IsSolid){
              List<Curve> crvrs_Un_C = new List<Curve>();
              List<Curve> crvrs_C = new List<Curve>();
              List<Curve> crvrs_Br_E = new List<Curve>();
              for(int i = 0; i < crv_dt.BranchCount; i++){
                Curve[] crvrj = Rhino.Geometry.Curve.JoinCurves(crv_dt.Branch(i));
                for(int j = 0; j < crvrj.Length; j++){
                  if(!crvrj[j].IsClosed){
                    crvrs_Un_C.Add(crvrj[j]);
                  }else{
                    crvrs_C.Add(crvrj[j]);
                  }
                }
              }
              Curve[] Br_NE = Br.DuplicateNakedEdgeCurves(true, false);
              Curve[] Br_NEJ = Rhino.Geometry.Curve.JoinCurves(Br_NE);
              foreach(Curve Br_NEJ_R in Br_NEJ){
                Br_NEJ_R.Transform(Transform.Rotation(Rhino.RhinoMath.ToRadians(agl1), vec, cntr));
                crvrs_Br_E.Add(Br_NEJ_R);
              }
              DataTree<double> prm_C = new DataTree<double>();
              for (int i = 0; i < crvrs_Un_C.Count; i++){
                for (int j = 0; j < crvrs_Br_E.Count; j++){
                  GH_Path p = new GH_Path(0, i);
                  var crv_crv_events = Rhino.Geometry.Intersect.Intersection.CurveCurve(crvrs_Br_E[j], crvrs_Un_C[i], RhinoDocument.ModelAbsoluteTolerance, RhinoDocument.ModelAbsoluteTolerance);
                  for (int k = 0; k < crv_crv_events.Count; k++){
                    var crv_crv_event = crv_crv_events[k];
                    prm_C.Add(crv_crv_event.ParameterA, p);
                  }
                }
              }
              List<Curve> crvrs_UnC_Shtr = new List<Curve>();
              for (int i = 0; i < crvrs_Br_E.Count; i++){
                for (int j = 0; j < prm_C.BranchCount; j++){
                  crvrs_UnC_Shtr.AddRange(crvrs_Br_E[i].Split(prm_C.Branch(j)));
                }
              }
              List<double> Br_EsL = new List<double>();
              crvrs_Br_E.Clear();
              for(int i = 0; i < crvrs_UnC_Shtr.Count; i++){
                Br_EsL.Add(crvrs_UnC_Shtr[i].GetLength());
                prm_C.ClearData();
              }
              double EsL = 0.0;
              foreach(double i in Br_EsL){
                EsL = EsL + i;
              }
              double EsL_avr = EsL / Br_EsL.Count;
              for(int i = 0; i < Br_EsL.Count; i++){
                if(Br_EsL[i] < EsL_avr){
                  crvrs_Br_E.Add(crvrs_UnC_Shtr[i]);
                }
              }
              DataTree<Curve> crvrs_Br_E_tr = new DataTree<Curve>();
              for (int i = 0; i < crvrs_Br_E.Count; i++){
                GH_Path p = new GH_Path(0, i);
                crvrs_Br_E_tr.Add(crvrs_Br_E[i], p);
                crvrs_UnC_Shtr.Clear();
                Br_EsL.Clear();
              }
              for (int i = 0; i < crvrs_Un_C.Count; i++){
                GH_Path p = new GH_Path(0, i);
                crvrs_Br_E_tr.Insert(crvrs_Un_C[i], p, 1);
                crvrs_Br_E.Clear();
              }
              for (int i = 0; i < crvrs_Br_E_tr.BranchCount; i++){
                crvrs_C.AddRange(Rhino.Geometry.Curve.JoinCurves(crvrs_Br_E_tr.Branch(i), RhinoDocument.ModelAbsoluteTolerance));
                crvrs_Un_C.Clear();
              }
              crvrs_Br_E_tr.ClearData();
              C = crvrs_C;
            }
          }
        }
      }
    }
# ---------- end c_script_3 ----------
line = LineSDL(Start=vec.Vector, Direction=vec.Vector, Length=1)
sift = SiftPattern(List=clean_2, SiftPattern=tmatch)  # -> Output0, Output1
graft_2 = GraftTree(Tree=tstat_3.Paths, IncludeEmptyLists=True, IncludeNullItems=True)
clean_4 = CleanTree(RemoveNulls=True, RemoveInvalid=True, RemoveEmpty=invert(False), Tree=c_script_3.F)
dispatch_2 = Dispatch(List=graft_2, DispatchPattern=c_script_2.N)  # -> ListA, ListB
dispatch_3 = Dispatch(List=graft_2, DispatchPattern=c_script_2.N)  # -> ListA, ListB
rotax = RotateAxis(Geometry=sift.Output0, Angle=degrees(data_3), Axis=line)  # -> Geometry, Transform
combine = CombineData(Input0=sift.Output1, Input1=rotax.Geometry)  # -> Result, Index
branch = TreeBranch(Tree=c_script_2.C, Path=dispatch_2.ListA, MaintainPaths=True)
clean_5 = CleanTree(RemoveNulls=True, RemoveInvalid=True, RemoveEmpty=invert(False), Tree=rotax.Geometry)
branch_2 = TreeBranch(Tree=clean_4, Path=dispatch_3.ListB, MaintainPaths=True)  # -> simplify(Branch)
branch_3 = TreeBranch(Tree=c_script_2.C, Path=dispatch_2.ListB, MaintainPaths=True)  # -> simplify(Branch)
c_script_4 = CSharpScript(M=combine.Result)  # -> A; inputs M: list of Mesh
# ---------- c_script_4: C# ----------
    if(M.Count > 0){
      foreach(Mesh Mc in M){
        if(!Mc.IsClosed){
          A = M;
        }
      }
    }
# ---------- end c_script_4 ----------
clean_6 = CleanTree(RemoveNulls=True, RemoveInvalid=True, RemoveEmpty=invert(False), Tree=dispatch.ListB)
area = MeshArea(Mesh=clean_5)  # -> Area, Centroid
explode = Explode(Curve=branch, Recursive=True)  # -> Segments, Vertices
clean_7 = CleanTree(RemoveNulls=True, RemoveInvalid=True, RemoveEmpty=invert(False), Tree=c_script_4)
meshcp = MeshClosestPoint(Point=area.Centroid, Mesh=clean_5)  # -> Point, Index, Parameter
medges = MeshEdges(Mesh=clean_7)  # -> NakedEdges, InteriorEdges, NonManifoldEdges
trim = TrimTree(Tree=explode.Segments, Depth=1)
meval = MeshEval(Mesh=clean_5, Parameter=meshcp.Parameter)  # -> Point, Normal, Colour
pull = PullPoint(Point=clean_6, Geometry=combine.Result, ClosestOnly=True)  # -> ClosestPoint, Distance
curvepoint = PointOnCurve(trim, parameter=0.5)
join = JoinCurves(Curves=medges.NakedEdges, Preserve=False)
pl = PlaneNormal(Origin=meval.Point, ZAxis=meval.Normal)
bbox_2 = BoundingBox(Content=clean_5, Plane=pl)  # -> Box, Box_2
deplane = DeconstructPlane(Plane=pl)  # -> Origin, XAxis, YAxis, ZAxis
cset = CreateSet(List=curvepoint)  # -> Set, Map
clean_8 = CleanTree(RemoveNulls=True, RemoveInvalid=True, RemoveEmpty=invert(False), Tree=cull)
data_4 = Data(1)
data_5 = Data(2)
amp = Amplitude(Vector=deplane.ZAxis, Amplitude=data_4)
neg = Negative(Value=data_5)
edges = BrepEdges(Brep=clean_8)  # -> Naked, Interior, NonManifold
keysearch = KeyValueSearch(Keys=curvepoint, Values=trim, Search=cset.Set)
move = Move(Geometry=bbox_2.Box, Motion=amp)  # -> Geometry, Transform
amp_2 = Amplitude(Vector=deplane.ZAxis, Amplitude=neg)
curvepoint_2 = PointOnCurve(keysearch, parameter=0.5)
join_2 = JoinCurves(Curves=edges.Naked, Preserve=False)
edges_2 = BrepEdges(Brep=move.Geometry)  # -> Naked, Interior, NonManifold
pull_2 = PullPoint(Point=curvepoint_2, Geometry=join_2, ClosestOnly=True)  # -> ClosestPoint, Distance
join_3 = JoinCurves(Curves=edges_2.Interior, Preserve=False)
bool_2 = Boolean(pull_2.Distance)
graft_3 = GraftTree(Tree=amp_2, IncludeEmptyLists=True, IncludeNullItems=True)
clean_9 = CleanTree(RemoveNulls=True, RemoveInvalid=True, RemoveEmpty=invert(False), Tree=cull)
cull_2 = CullPattern(List=keysearch, CullPattern=bool_2)
item = ListItem(List=join_3, Index=0, Wrap=True)
srfsplit = SurfaceSplit(Surface=clean_9, Curves=cull_2)
move_2 = Move(Geometry=item, Motion=graft_3)  # -> Geometry, Transform
edges_3 = BrepEdges(Brep=srfsplit)  # -> Naked, Interior, NonManifold
filter_4 = StreamFilter(Gate=bool, Stream1=srfsplit)
entwine = Entwine(Branch00=item, Branch01=move_2.Geometry, FlattenInputs=True)
join_4 = JoinCurves(Curves=edges_3.Naked, Preserve=False)
entwine_2 = Entwine(Branch0X=branch_2, Branch1X=filter_4, FlattenInputs=False)
cls = Closed(Curve=join_4)  # -> Closed, Periodic
curvepoint_3 = PointOnCurve(entwine, parameter=0.5)
cull_3 = CullPattern(List=join_4, CullPattern=cls.Closed)
match = MatchTree(Tree=entwine_2, Guide=clean)
cset_2 = CreateSet(List=curvepoint_3)  # -> Set, Map
flip = FlipMatrix(Data=cull_3)
brep = Brep(match)
keysearch_2 = KeyValueSearch(Keys=curvepoint_3, Values=entwine, Search=cset_2.Set)
breps = ClusterOutput(brep)  # Voronoi Fragments.
entwine_3 = Entwine(Branch0X=branch_3, Branch1X=flip, FlattenInputs=False)
flip_2 = FlipMatrix(Data=keysearch_2)
filter_5 = StreamFilter(Gate=bool, Stream0=entwine_3)
loft = Loft(Curves=flip_2, Options={Adjust=False, Closed=False, LoftEnds=0, LoftSimp=0, LoftType=0, Rebuild=10, Refit=0.01})
cull_4 = CullPattern(List=bbox.Box, CullPattern=tmatch)
match_2 = MatchTree(Tree=filter_5, Guide=clean)
data_6 = Data(1.0001)
combine_2 = CombineData(Input0=cull_4, Input1=loft)  # -> Result, Index
area_2 = MeshArea(Mesh=clean_2)  # -> Area, Centroid
addition = Addition(A=data_6, B=num)
c_script_5 = CSharpScript(P=pull.ClosestPoint, B=combine_2.Result)  # -> C; inputs P: list of Point3d, B: list of Brep
# ---------- c_script_5: C# ----------
    //© 2020 Adia Robbie

    if((B.Count > 0) && (P.Count > 0)){
      double agl = 1;
      foreach(Brep Br in B){
        Vector3d vec = new Vector3d(1.0, 1.0, 1.0);
        Point3d cntr = Rhino.Geometry.AreaMassProperties.Compute(Br).Centroid;
        Br.Transform(Transform.Rotation(Rhino.RhinoMath.ToRadians(agl), vec, cntr));
        List<Brep> brp_Vr3d = new List<Brep>();
        Box boX = new Box(Br.GetBoundingBox(true));
        System.Threading.Tasks.Parallel.For(0, P.Count, i =>
          {
          Grasshopper.Kernel.Geometry.Voronoi.Cell3 cell = new Grasshopper.Kernel.Geometry.Voronoi.Cell3(P[i], boX);
          List<Point3d> slcr_V = new List<Point3d>();
          for (int j = 0; j <= P.Count - 1; j++){
            if(i != j){
              slcr_V.Add(P[j]);
            }
          }
          cell.Slice(slcr_V);
          var brp_c = cell.ToBrep();
          brp_Vr3d.Add(brp_c);
          slcr_V.Clear();
          }
          );
        C = brp_Vr3d;
      }
    }
# ---------- end c_script_5 ----------
scale = Scale(Geometry=c_script_5, Center=area_2.Centroid, Factor=addition)  # -> Geometry, Transform
mesh = MeshBrep(
    Brep=scale.Geometry,
    Settings={GridMaxCount=0, GridMinCount=16, JaggedSeams=False, MaxEdgeLength=0, MinEdgeLength=0.0001, MinTolerance=0, Refine=True, RefineAngle=0, RelativeTolerance=0.65, SimplePlanes=True, Tolerance=0})
mmx = MeshMesh(MeshA=combine.Result, MeshB=mesh)
trim_2 = TrimTree(Tree=mmx, Depth=1)
cls_2 = Closed(Curve=trim_2)  # -> Closed, Periodic
not = GateNot(A=cls_2.Closed)
dispatch_4 = Dispatch(List=trim_2, DispatchPattern=not)  # -> ListA, ListB
c_script_6 = CSharpScript(crvrs_Br_E=join, crvrs_Un_C=dispatch_4.ListA)  # -> A; inputs crvrs_Br_E: list of Curve, crvrs_Un_C: list of Curve
# ---------- c_script_6: C# ----------
    //© 2020 Adia Robbie

    if((crvrs_Br_E.Count > 0) && (crvrs_Un_C.Count > 0)){
      List < Curve > crvrs_C = new List<Curve>();
      DataTree<double> prm_C = new DataTree<double>();
      for (int i = 0; i < crvrs_Un_C.Count; i++){
        for (int j = 0; j < crvrs_Br_E.Count; j++){
          GH_Path p = new GH_Path(0, i);
          var crv_crv_events = Rhino.Geometry.Intersect.Intersection.CurveCurve(crvrs_Br_E[j], crvrs_Un_C[i], RhinoDocument.ModelAbsoluteTolerance, RhinoDocument.ModelAbsoluteTolerance);
          for (int k = 0; k < crv_crv_events.Count; k++){
            var crv_crv_event = crv_crv_events[k];
            prm_C.Add(crv_crv_event.ParameterA, p);
          }
        }
      }
      List<Curve> crvrs_UnC_Shtr = new List<Curve>();
      for (int i = 0; i < crvrs_Br_E.Count; i++){
        for (int j = 0; j < prm_C.BranchCount; j++){
          crvrs_UnC_Shtr.AddRange(crvrs_Br_E[i].Split(prm_C.Branch(j)));
        }
      }
      List<double> Br_EsL = new List<double>();
      crvrs_Br_E.Clear();
      for(int i = 0; i < crvrs_UnC_Shtr.Count; i++){
        Br_EsL.Add(crvrs_UnC_Shtr[i].GetLength());
      }
      double EsL = 0.0;
      foreach(double i in Br_EsL){
        EsL = EsL + i;
      }
      double EsL_avr = EsL / Br_EsL.Count;
      for(int i = 0; i < Br_EsL.Count; i++){
        if(Br_EsL[i] < EsL_avr){
          crvrs_Br_E.Add(crvrs_UnC_Shtr[i]);
        }
      }
      DataTree<Curve> crvrs_Br_E_tr = new DataTree<Curve>();
      for (int i = 0; i < crvrs_Br_E.Count; i++){
        GH_Path p = new GH_Path(0, i);
        crvrs_Br_E_tr.Add(crvrs_Br_E[i], p);
      }
      for (int i = 0; i < crvrs_Un_C.Count; i++){
        GH_Path p = new GH_Path(0, i);
        crvrs_Br_E_tr.Insert(crvrs_Un_C[i], p, 1);
      }
      for (int i = 0; i < crvrs_Br_E_tr.BranchCount; i++){
        crvrs_C.AddRange(Rhino.Geometry.Curve.JoinCurves(crvrs_Br_E_tr.Branch(i), RhinoDocument.ModelAbsoluteTolerance));
      }
      A = crvrs_C;
    }
# ---------- end c_script_6 ----------
match_3 = MatchTree(Tree=c_script_6, Guide=dispatch_4.ListB)
merge_3 = Merge(Data1=match_3, Data2=dispatch_4.ListB)
tstat_4 = TreeStatistics(Tree=merge_3)  # -> graft(Paths), Length, Count
dispatch_5 = Dispatch(List=tstat_4.Paths, DispatchPattern=tmatch)  # -> ListA, ListB
branch_4 = TreeBranch(Tree=merge_3, Path=dispatch_5.ListB, MaintainPaths=True)
neg_2 = Negative(Value=data_3)
rotax_2 = RotateAxis(Geometry=branch_4, Angle=degrees(neg_2), Axis=line)  # -> Geometry, Transform
branch_5 = TreeBranch(Tree=merge_3, Path=dispatch_5.ListA, MaintainPaths=True)
entwine_4 = Entwine(Branch0X=rotax_2.Geometry, Branch1X=branch_5, FlattenInputs=False)
clean_10 = CleanTree(RemoveNulls=True, RemoveInvalid=True, RemoveEmpty=invert(False), Tree=entwine_4)
match_4 = MatchTree(Tree=clean_10, Guide=pull.ClosestPoint)
entwine_5 = Entwine(Branch0X=match_2, Branch1X=match_4, FlattenInputs=False)
gate = StreamGate(Stream=entwine_5, Gate=bool)  # -> Target0, Target1
match_5 = MatchTree(Tree=gate.Target0, Guide=pt)
filter_6 = StreamFilter(Gate=bool, Stream0=match_5, Stream1=gate.Target1)
crv = Curve(filter_6)
cells = ClusterOutput(crv)  # Voronoi Cells.
