# Grasshopper definition ellipsoidal-tree.gh (Grasshopper 1.0.7)

# ---- group: ellispoidal tree
# diameter at breast height (DBH)
crown_height = Slider(30, range=0..75)
canopy_diameter = Slider(8, range=0..100)
# parametric tree
trunk_diameter = Slider(0.5, range=0..2)
trunk_height = Slider(10, range=0..100)
construct_point = ConstructPoint(XCoordinate=0, YCoordinate=0, ZCoordinate=0)
unit_z = UnitZ(Factor=trunk_height)
unit_z_2 = UnitZ(Factor=crown_height)
division = Division(A=trunk_diameter, B="2.0")
division_2 = Division(A=canopy_diameter, B="2.0")
move = Move(Geometry=construct_point, Motion=unit_z_2)  # -> Geometry, Transform
division_3 = Division(A=trunk_height, B=division_2)
move_2 = Move(Geometry=construct_point, Motion=unit_z)  # -> Geometry, Transform
line = Line(StartPoint=construct_point, EndPoint=move_2.Geometry)
line_2 = Line(StartPoint=move_2.Geometry, EndPoint=move.Geometry)
curve_middle = CurveMiddle(Curve=line_2)
construct_plane = ConstructPlane(Origin=curve_middle, XAxis=Vector(1, 0, 0), YAxis=Vector(0, 1, 0))
sphere = Sphere(Base=construct_plane, Radius=division_2)
scale_nu = ScaleNU(Geometry=sphere, Plane=construct_plane, ScaleX=1, ScaleY=1, ScaleZ=division_3)  # -> Geometry, Transform
pipe = Pipe(Curve=line, Radius=division, Caps=0)
trunk_color = ColourSwatch(SwatchColor=RGB(139, 76, 57))
canopy_color = ColourSwatch(SwatchColor=RGBA(101, 150, 102, 232))
custom_preview = CustomPreview(Geometry=pipe, Material=trunk_color)
custom_preview_2 = CustomPreview(Geometry=scale_nu.Geometry, Material=canopy_color)
