# Grasshopper definition flow-field.gh (Grasshopper 1.0.7)
# plug-ins: Pufferfish

# ---- group: vector flow field
# flows
count = Slider(4, range=0..100)
seed = Slider(34, range=0..100)
decay = Slider(0.6, range=0.1..5)
cell_size = Slider(1, range=0..10)
extent_x = Slider(10, range=0..100)
extent_y = Slider(10, range=0..100)
hexagonal = Hexagonal(Plane=PlaneXY(0, 0, 0), Size=cell_size, ExtentX=extent_x, ExtentY=extent_y)  # -> Cells, Points
bounding_rectangle = BoundingRectangle(Geometry=flatten(hexagonal.Cells), Plane=PlaneXY(0, 0, 0), Axis=0, Slide=0, Union=True)  # -> Bounding, DimensionX, DimensionY
populate_2d = Populate2D(Region=bounding_rectangle.Bounding, Count=count, Seed=seed)
point_charge = PointCharge(Point=populate_2d, Charge=1, Decay=decay, Bounds=bounding_rectangle.Bounding)
merge_fields = MergeFields(Fields=point_charge)
field_line = FieldLine(Field=merge_fields, Point=hexagonal.Points, Steps=1000, Accuracy=0.1, Method=3)
custom_preview = CustomPreview(Geometry=field_line, Material=ColourSwatch(SwatchColor=RGB(0, 0, 0)))

# ----
point = Point(hexagonal.Points)
scale = Slider(0.9, range=0..1)
depth = Slider(0.3, range=0..1)
curve = Curve(field_line)
radius = Slider(0.05, range=0..0.1)
curve_2 = Curve(hexagonal.Cells)
boundary_surfaces = BoundarySurfaces(Edges=curve_2)
negative = Negative(Value=depth)
pipe = Pipe(Curve=curve, Radius=radius, Caps="2")
scale_nu = ScaleNU(Geometry=boundary_surfaces, Plane=point, ScaleX=scale, ScaleY=scale, ScaleZ=1)  # -> Geometry, Transform
unit_z = UnitZ(Factor=negative)
extrude = Extrude(Base=scale_nu.Geometry, Direction=unit_z)

brep = Brep(extrude)
brep_2 = Brep(pipe)
solid_difference = SolidDifference()
custom_preview_2 = CustomPreview(Geometry=solid_difference, Material=ColourSwatch(SwatchColor=RGB(204, 204, 204)))
