# Grasshopper definition flume.gh (Grasshopper 1.0.7)
# Copyright: GNU General Public License 3.0
# plug-ins: Noise 4D

# ---- group: perlin noise with decay function
# terrain from noise with decay function
X = Slider(20, range=0..100)
Y = Slider(100, range=0..100)
time = Slider(0, range=0..100)
scale = Slider(0.5, range=0..1)
domain = Slider(6, range=0..100)
wavelength = Slider(5, range=0..10)
amplitude = Slider(1.5, range=0..10)
halflife = Slider(1, range=0..10)
z_factor = Slider(4, range=0..10)
square = Square(Plane=PlaneXY(0, 0, 0), Size=1, ExtentX=X, ExtentY=Y)  # -> Cells, Points
flip_matrix = FlipMatrix(Data=square.Points)  # -> flatten(Data)
point = Point(flip_matrix)
list_length = ListLength(List=point)  # -> expr("x-1", Length)
range = Range(Domain=domain, Steps=list_length)
expression = Expression(x=range, w=wavelength, a=amplitude, h=halflife, Expression="1/2^(x/h)*a*sin(2*π*x/w)")
perlinnoise = PerlinNoise(Values=flip_matrix, Time=time, Scale=scale)
bounds = Bounds(Numbers=perlinnoise)
remap_numbers = RemapNumbers(Value=perlinnoise, Source=bounds, Target="-1 To 1")  # -> Mapped, Clipped
multiplication = Multiplication(A=remap_numbers.Mapped, B=expression)
multiplication_2 = Multiplication(A=multiplication, B=z_factor)
unit_z = UnitZ(Factor=multiplication_2)
move = Move(Geometry=flip_matrix, Motion=unit_z)  # -> Geometry, Transform
Y_2 = Number(Y)
surface_from_points = SurfaceFromPoints(Points=move.Geometry, UCount=expr("x+1", Y_2), Interpolate=False)
custom_preview = CustomPreview(Geometry=surface_from_points, Material=ColourSwatch(SwatchColor=RGB(204, 204, 204)))
surface = Surface(surface_from_points)

# ---- group: Attractors
# terrain attractor
point_2 = Point([Point(18, 49, 0), Point(2, 70, 0), Point(17, 82, 0), Point(2, 89, 0), Point(13, 92, 0), Point(18, 95, 0), Point(8, 98, 0), Point(5, 94, 0)])

# ---- group: perlin noise
# flume
# terrain from noise
X_2 = Slider(20, range=0..100)
Y_3 = Slider(100, range=0..100)
z_max = Slider(2, range=0..10)
time_2 = Slider(0, range=0..100)
scale_2 = Slider(0.5, range=0..1)
z_min = Slider(-2, range=-10..0)
square_2 = Square(Plane=PlaneXY(0, 0, 0), Size=1, ExtentX=X_2, ExtentY=Y_3)  # -> Cells, flatten(Points)
perlinnoise_2 = PerlinNoise(Values=square_2.Points, Time=time_2, Scale=scale_2)
construct_domain = ConstructDomain(DomainStart=z_min, DomainEnd=z_max)
bounds_2 = Bounds(Numbers=perlinnoise_2)
remap_numbers_2 = RemapNumbers(Value=perlinnoise_2, Source=bounds_2, Target=construct_domain)  # -> Mapped, Clipped
unit_z_2 = UnitZ(Factor=remap_numbers_2.Mapped)
move_2 = Move(Geometry=square_2.Points, Motion=unit_z_2)  # -> Geometry, Transform

# ----
X_3 = Slider(20, range=0..100)
Y_4 = Slider(100, range=0..100)
attractors = Point(point_2)
z_min_2 = Slider(-6, range=-10..0)
z_max_2 = Slider(6, range=0..10)
construct_domain_2 = ConstructDomain(DomainStart=z_min_2, DomainEnd=z_max_2)
square_3 = Square(Plane=PlaneXY(0, 0, 0), Size=1, ExtentX=X_3, ExtentY=Y_4)  # -> Cells, flatten(Points)
closest_point = ClosestPoint(Point=square_3.Points, Cloud=attractors)  # -> ClosestPoint, CPIndex, Distance
bounds_3 = Bounds(Numbers=closest_point.Distance)
remap_numbers_3 = RemapNumbers(Value=closest_point.Distance, Source=bounds_3, Target=construct_domain_2)  # -> Mapped, Clipped
unit_z_3 = UnitZ(Factor=remap_numbers_3.Mapped)
move_3 = Move(Geometry=square_3.Points, Motion=unit_z_3)  # -> Geometry, Transform
X_4 = Number(X_2)
surface_from_points_2 = SurfaceFromPoints(Points=move_3.Geometry, UCount=expr("x+1", X_4), Interpolate=False)
custom_preview_2 = CustomPreview(Geometry=surface_from_points_2, Material=ColourSwatch(SwatchColor=RGB(204, 204, 204)))
surface_2 = Surface(surface_from_points_2)

X_5 = Number(X_2)

# ---- group: perlin noise (continued)
surface_from_points_3 = SurfaceFromPoints(Points=move_2.Geometry, UCount=expr("x+1", X_5), Interpolate=False)
custom_preview_3 = CustomPreview(Geometry=surface_from_points_3, Material=ColourSwatch(SwatchColor=RGB(204, 204, 204)))
surface_3 = Surface(surface_from_points_3)
