# Grasshopper definition fractal-terrain.gh (Grasshopper 1.0.7)
# Copyright: GNU General Public License 3.0
# plug-ins: Multifold Henon Map

# ---- group: terrain from multifold henon map
# fractal terrain
A = Slider(4, range=0..10)
B = Slider(0.9, range=0..1)
iterations = Slider(600, range=0..10000)
X = Slider(11, range=0..100)
Y = Slider(10, range=0..100)
xy = Slider(20, range=0..100)
rectangle = Rectangle(Plane=PlaneXY(0, 0, 0), XSize=xy, YSize=xy, Radius=0)  # -> Rectangle, Length
multifold_henon_map = MultifoldHenonMap(A=A, B=B, Iterations=iterations, X=X, Y=Y)
voronoi = Voronoi(Points=multifold_henon_map, Boundary=rectangle.Rectangle, BruteForceOverride=False)
length = Length(Curve=voronoi)
bounds = Bounds(Numbers=length)
remap_numbers = RemapNumbers(Value=length, Source=bounds, Target="2 To 0")  # -> Mapped, Clipped
unit_z = UnitZ(Factor=remap_numbers.Mapped)
move = Move(Geometry=multifold_henon_map, Motion=unit_z)  # -> Geometry, Transform
rectangle_2 = Rectangle(rectangle.Rectangle)
patch = Patch(Curves=rectangle_2, Points=move.Geometry, Spans="50", Flexibility="4", Trim=True)
custom_preview = CustomPreview(Geometry=patch, Material=ColourSwatch(SwatchColor=RGB(214, 214, 214)))

# ---- group: rockery from multifold henon map
A_2 = Slider(4, range=0..10)
B_2 = Slider(0.9, range=0..1)
iterations_2 = Slider(360, range=0..10000)
X_2 = Slider(10, range=0..100)
Y_2 = Slider(10, range=0..100)
xy_2 = Slider(20, range=0..100)
rectangle_3 = Rectangle(Plane=PlaneXY(0, 0, 0), XSize=xy_2, YSize=xy_2, Radius=0)  # -> Rectangle, Length
multifold_henon_map_2 = MultifoldHenonMap(A=A_2, B=B_2, Iterations=iterations_2, X=X_2, Y=Y_2)
voronoi_2 = Voronoi(Points=multifold_henon_map_2, Boundary=rectangle_3.Rectangle, BruteForceOverride=False)
boundary_surfaces = BoundarySurfaces(Edges=voronoi_2)
length_2 = Length(Curve=boundary_surfaces)
bounds_2 = Bounds(Numbers=length_2)
remap_numbers_2 = RemapNumbers(Value=length_2, Source=bounds_2, Target="1 To 4")  # -> Mapped, Clipped
unit_z_2 = UnitZ(Factor=remap_numbers_2.Mapped)
gradient = Gradient(LowerLimit=0, UpperLimit=bounds_2, Parameter=length_2, stops=[0: RGB(224, 224, 224), 1: RGB(64, 64, 64)])
extrude = Extrude(Base=boundary_surfaces, Direction=unit_z_2)
custom_preview_2 = CustomPreview(Geometry=extrude, Material=gradient)

# ---- group: contours
surface = Surface(patch)
interval = Slider(0.1, range=0..2)
contour = Contour(Shape=surface, Point=Point(0, 0, 0), Direction=Vector(0, 0, 1), Distance=interval)
custom_preview_3 = CustomPreview(Geometry=contour, Material=ColourSwatch(SwatchColor=RGB(38, 38, 38)))

# ---- group: cutting plane
rectangle_4 = Rectangle(rectangle_3.Rectangle)
water_depth = Slider(1.7, range=0..10)
unit_z_3 = UnitZ(Factor=water_depth)
boundary_surfaces_2 = BoundarySurfaces(Edges=rectangle_4)
move_2 = Move(Geometry=boundary_surfaces_2, Motion=unit_z_3)  # -> Geometry, Transform
custom_preview_4 = CustomPreview(Geometry=move_2.Geometry, Material=ColourSwatch(SwatchColor=RGB(0, 0, 0)))

rectangle_5 = Rectangle(rectangle.Rectangle)
water_depth_2 = Slider(0.4, range=0..10)
unit_z_4 = UnitZ(Factor=water_depth_2)
boundary_surfaces_3 = BoundarySurfaces(Edges=rectangle_5)
move_3 = Move(Geometry=boundary_surfaces_3, Motion=unit_z_4)  # -> Geometry, Transform
custom_preview_5 = CustomPreview(Geometry=move_3.Geometry, Material=ColourSwatch(SwatchColor=RGB(0, 0, 0)))
