# Grasshopper definition grading.gh (Grasshopper 1.0.7)
# Copyright: GNU General Public License 3.0
# plug-ins: Volvox, Docofossor

# ---- group: import xyz
# Grading
# using docofossor
file_path = FilePath("D:\generative-design\grasshopper\data\governors-island-landform.xyz")
import_xyz = ImportXYZ(F=file_path, N="5")
grid_shift = GridShift(Df=import_xyz)
grid_mesh = GridMesh(Df=grid_shift)
custom_preview = CustomPreview(Geometry=grid_mesh, Material=ColourSwatch(SwatchColor=RGB(128, 128, 128)))
data = Data(grid_shift)

# ---- group: grade landform
data_2 = Data(data)
point = Point([Point(1485.3238, 152.1039728, 15.74056578), Point(1547.35924, 167.6852316, 26.77288237), Point(1574.054732, 207.3600732, 33.86314959), Point(1567.946732, 313.4118229, 37.70734105), Point(1538.396033, 386.8406912, 29.4634738), Point(1486.808057, 462.154482, 18.47563274), Point(1422.860005, 504.081831, 12.24131305)])
width = Slider(0.1, range=0..0.1)
slope_l = Slider(36, range=0..100)
slope_r = Slider(30, range=0..100)
distance = Slider(100, range=0..100)
interpolate = Interpolate(Vertices=point, Degree=3, Periodic=False, KnotStyle=1)  # -> Curve, Length, Domain
fill_in_path = FillInPath(Df=data_2, Crv=interpolate.Curve, Wt=width, Sa=slope_l, Sa2=slope_r, D=distance)  # -> Df, Vol
grid_mesh_2 = GridMesh(Df=fill_in_path.Df)
custom_preview_2 = CustomPreview(Geometry=grid_mesh_2, Material=ColourSwatch(SwatchColor=RGB(204, 204, 204)))
data_3 = Data(fill_in_path.Df)

data_4 = Data(data_3)
point_2 = Point([Point(1417.944694, 465.5816722, 13.47167844), Point(1447.139991, 338.3464859, -0.1522494552), Point(1479.274863, 179.642808, 16.04462973)])
width_2 = Slider(0.1, range=0..0.1)
slope_r_2 = Slider(20, range=0..100)
slope_l_2 = Slider(15, range=0..100)
distance_2 = Slider(100, range=0..100)
interpolate_2 = Interpolate(Vertices=point_2, Degree=3, Periodic=False, KnotStyle=1)  # -> Curve, Length, Domain

# ----
cut_in_path = CutInPath(Df=data_4, Crv=interpolate_2.Curve, Wb=width_2, Sa=slope_l_2, Sa2=slope_r_2, D=distance_2)  # -> Df, Vol

# ---- group: grade landform (continued)
grid_mesh_3 = GridMesh(Df=cut_in_path.Df)
custom_preview_3 = CustomPreview(Geometry=grid_mesh_3, Material=ColourSwatch(SwatchColor=RGB(204, 204, 204)))
data_5 = Data(cut_in_path.Df)

# ---- group: calculate cut and fill
data_6 = Data(data)
data_7 = Data(data_5)
grid_compare = GridCompare(Df1=data_6, Df2=data_7)  # -> Cut, Fill, Balance, Df
grid_mesh_4 = GridMesh(Df=grid_compare.Df)
panel = Panel(grid_compare.Cut)
panel_2 = Panel(grid_compare.Fill)
custom_preview_4 = CustomPreview(Geometry=grid_mesh_4, Material=ColourSwatch(SwatchColor=RGB(204, 204, 204)))

# ---- group: transform
data_8 = Data(data_5)
grid_global = GridGlobal(Df=data_8)
grid_mesh_5 = GridMesh(Df=grid_global)

# ----
area = Area(Geometry=grid_mesh_5)  # -> Area, Centroid

# ---- group: transform (continued)
xz_plane = XZPlane(Origin=area.Centroid)
mirror = Mirror(Geometry=grid_mesh_5, Plane=xz_plane)  # -> Geometry, Transform
mesh = Mesh(mirror.Geometry)

# ---- group: export xyz
# using volvox
mesh_2 = Mesh(mesh)
face_normals = FaceNormals(Mesh=mesh_2)  # -> Centers, Normals
construct_cloud = ConstructCloud(Points=face_normals.Centers)
file_path_2 = FilePath("C:\Users\baharmon\Downloads\govenors-island-grading.xyz")
save_xyz = SaveXyz(
    Cloud=construct_cloud,
    FilePath=file_path_2,
    Mask="x y z",
    Precision="0.01",
    DoubleQuotes=False,
    Run=Toggle(False),
    Abort=False)
