# Grasshopper definition image-sampler.gh (Grasshopper 1.0.7)
# plug-ins: GhPotrace [ShapeDiver Compatible Version]

# ----
# image sampler
square = Square(Plane=PlaneXY(0, 0, 0), Size=1, ExtentX="200", ExtentY="200")  # -> Cells, Points
image_sampler = ImageSampler(
    square.Points,
    FilePath="D:\generative-design\grasshopper\data\sage.jpg",
    Filter="Value",
    Interpolate=True,
    Umax=200,
    Umin=1,
    Vmax=200,
    Vmin=1,
    Wrap=0)
circle = Circle(Plane=square.Points, Radius=image_sampler)

square_2 = Square(Plane=PlaneXY(0, 0, 0), Size=1, ExtentX="200", ExtentY="200")  # -> Cells, Points
image_sampler_2 = ImageSampler(
    square_2.Points,
    FilePath="D:\generative-design\grasshopper\data\sage.jpg",
    Filter="Value",
    Interpolate=True,
    Umax=200,
    Umin=1,
    Vmax=200,
    Vmin=1,
    Wrap=0)
remap_numbers = RemapNumbers(Value=image_sampler_2, Source=Domain(0, 1), Target="0.5 To 0")  # -> Mapped, Clipped
circle_2 = Circle(Plane=square_2.Points, Radius=remap_numbers.Mapped)

square_3 = Square(Plane=PlaneXY(0, 0, 0), Size=1, ExtentX="200", ExtentY="200")  # -> Cells, Points
image_sampler_3 = ImageSampler(
    square_3.Points,
    FilePath="D:\generative-design\grasshopper\data\sage.jpg",
    Filter="Value",
    Interpolate=True,
    Umax=200,
    Umin=1,
    Vmax=200,
    Vmin=1,
    Wrap=0)
unit_z = UnitZ(Factor=image_sampler_3)
negative = Negative(Value=unit_z)
move = Move(Geometry=square_3.Points, Motion=negative)  # -> Geometry, Transform
delaunay_mesh = DelaunayMesh(Points=flatten(move.Geometry), Plane=PlaneXY(0, 0, 0))

# ----
# using rooster
threshold = Slider(50, range=0..100)
corner = Slider(1, range=0..1)
area = Slider(15, range=0..100)
optimize = Slider(1, range=0..1)
tolerance = Slider(1, range=0..1)
colors = Slider(2, range=1..256)
rooster = Rooster(
    ImageBitmap=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,
    Threshold=threshold,
    CornerThreshold=corner,
    MaxTurdArea=area,
    Optimize=optimize,
    Tolerance=tolerance,
    Invert=Toggle(False),
    ColorCount=colors,
    RoosterOutputMode=True,
    RoosterTurnPolicy=0)  # -> Curves, Boundary, Colors

rectangle = Rectangle(rooster.Boundary)
curve = Curve(rooster.Curves)
curve_2 = Curve([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])
boundary_surfaces = BoundarySurfaces(Edges=rectangle)
loft = Loft(Curves=curve_2, Options={Adjust=False, Closed=False, LoftEnds=0, LoftSimp=0, LoftType=0, Rebuild=10, Refit=0.01})
map_to_surface = MapToSurface(Curve=curve, Source=boundary_surfaces, Target=loft)
custom_preview = CustomPreview(Geometry=map_to_surface, Material=ColourSwatch(SwatchColor=RGB(26, 26, 26)))
