# Grasshopper definition landscape-evolution.gh (Grasshopper 1.0.7)
# Copyright: GNU General Public License
# plug-ins: Pufferfish, Docofossor, Section To XY

# ---- group: water flow reshapes terrain
# landscape evolution
# using docofossor
# using bison
size = Slider(2, range=0..100)
X = Slider(150, range=0..1000)
Y = Slider(150, range=0..1000)
grid = Slider(10, range=0..50)
steps = Slider(30, range=0..100)
cut_width = Slider(5, range=0..100)
distance = Slider(25, range=0..100)
surface = Surface(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)
radius = Slider(5, range=0..10)
square = Square(Plane=PlaneXY(0, 0, 0), Size=size, ExtentX=X, ExtentY=Y)  # -> Cells, flatten(Points)
import_points = ImportPoints(Pts=square.Points)
cut_fill_in_surface = CutFillInSurface(Df=import_points, Srf=surface)  # -> Df, Vol
grid_mesh = GridMesh(Df=cut_fill_in_surface.Df)
bounding_rectangle = BoundingRectangle(Geometry=grid_mesh, Plane=PlaneXY(0, 0, 0), Axis=0, Slide=0, Union=True)  # -> Bounding, DimensionX, DimensionY
flow = Flow(Boundary=bounding_rectangle.Bounding, Mesh=grid_mesh, Grid=grid, Steps=steps, Length="1")
cut_fill_in_path = CutFillInPath(Df=import_points, Crv=flow, W=cut_width, D=distance)  # -> Df, Vol
grid_smooth = GridSmooth(Df=cut_fill_in_path.Df, Rad=radius)
grid_mesh_2 = GridMesh(Df=grid_smooth)
custom_preview = CustomPreview(Geometry=grid_mesh_2, Material=ColourSwatch(SwatchColor=RGB(230, 230, 230)))

# ---- group: calculate cut and fill
data = Data(cut_fill_in_surface.Df)
data_2 = Data(grid_smooth)
grid_compare = GridCompare(Df1=data, Df2=data_2)  # -> Cut, Fill, Balance, Df
cut = Panel(grid_compare.Cut)
fill = Panel(grid_compare.Fill)
grid_mesh_3 = GridMesh(Df=grid_compare.Df)
custom_preview_2 = CustomPreview(Geometry=grid_mesh_3, Material=ColourSwatch(SwatchColor=RGB(128, 128, 128)))
