# Grasshopper definition noise-vessel.gh (Grasshopper 1.0.7)
# plug-ins: Pufferfish, LunchBox, Noise 4D

# ---- group: perlin noise vessel
radius = Slider(10, range=0..100)
length = Slider(64, range=0..100)
u_number = Slider(20, range=0..100)
v_number = Slider(20, range=0..100)
cylinder = Cylinder(Base=PlaneXY(0, 0, 0), Radius=radius, Length=length)
rebuild_surface = RebuildSurface(Surface=cylinder, UDegree=3, VDegree=3, UNumber=u_number, VNumber=v_number)
deconstruct_mesh = DeconstructMesh(Mesh=rebuild_surface)  # -> Vertices, Faces, Colours, Normals
time = Slider(25, range=0..100)
scale = Slider(0.1, range=0..1)
amplitude = Slider(12, range=0..100)
perlinnoise = PerlinNoise(Values=deconstruct_mesh.Vertices, Time=time, Scale=scale)
multiplication = Multiplication(A=perlinnoise, B=amplitude)
multiplication_2 = Multiplication(A=deconstruct_mesh.Normals, B=multiplication)
move = Move(Geometry=deconstruct_mesh.Vertices, Motion=multiplication_2)  # -> Geometry, Transform
construct_mesh = ConstructMesh(Vertices=move.Geometry, Faces=deconstruct_mesh.Faces)
rebuild_mesh = RebuildMesh(
    Mesh=construct_mesh,
    RebuildNormals=False,
    CullUnused=False,
    UnifyNormals=False,
    FlipNormals=False,
    IdenticalCombine=Toggle(True),
    WeldVertices=0)

# ----
contour = Contour(Shape=rebuild_mesh, Point=Point(0, 0, 0), Direction=Vector(0, 0, 1), Distance=Slider(7, range=0..10))  # -> flatten(Contours)
rebuild_curve = RebuildCurve(Curve=contour, EndTangents=False)
loft = Loft(Curves=rebuild_curve, Options={Adjust=False, Closed=False, LoftEnds=0, LoftSimp=0, LoftType=0, Rebuild=10, Refit=0.01})

brep_edges = BrepEdges(Brep=loft)  # -> Naked, Interior, NonManifold
boundary_surfaces = BoundarySurfaces(Edges=brep_edges.Naked)
dispatch = Dispatch(List=boundary_surfaces, DispatchPattern=[False, True])  # -> ListA, ListB
surface = Surface(dispatch.ListA)
unit_z = UnitZ(Factor=Slider(1, range=0..10))
extrude = Extrude(Base=surface, Direction=unit_z)
offset_surface = OffsetSurface(Surface=loft, Distance=Slider(-1, range=-6..6), BothSides=False, CreateSolid=True)
