# Grasshopper definition parametric-landscape-2.gh (Grasshopper 1.0.7)

# ---- group: generate a conical tree
trunk_diameter = Slider(1, range=0..2)
trunk_height = Slider(4, range=0..100)
crown_height = Slider(15, range=0..75)
canopy_layers = Slider(3, range=0..10)
canopy_diameter = Slider(5, range=0..100)
conical_tree = ConicalTree(A=trunk_diameter, factor=trunk_height, factor_2=crown_height, B=canopy_layers, A_2=canopy_diameter)  # -> trunk, result
canopy_color = ColourSwatch(SwatchColor=RGBA(58, 94, 84, 232))
trunk_color = ColourSwatch(SwatchColor=RGB(139, 76, 57))
custom_preview = CustomPreview(Geometry=conical_tree.trunk, Material=trunk_color)
custom_preview_2 = CustomPreview(Geometry=conical_tree.result, Material=canopy_color)

# ----
# terrain from random points
radius = Slider(100, range=0..100)
count = Slider(200, range=0..1000)
seed = Slider(100, range=0..100)
spans = Slider(50, range=0..100)
# terrain visualization
flexibility = Slider(1, range=0..1)
circle = Circle(Plane=PlaneXY(0, 0, 0), Radius=radius)
boundary_surfaces = BoundarySurfaces(Edges=circle)
populate_geometry = PopulateGeometry(Geometry=boundary_surfaces, Count=count, Seed=seed)
random = Random(Range="-10 To 10", Number=count, Seed=seed)
unit_z = UnitZ(Factor=random)
move = Move(Geometry=populate_geometry, Motion=unit_z)  # -> Geometry, Transform
patch = Patch(Curves=circle, Points=move.Geometry, Spans=spans, Flexibility=flexibility, Trim=True)
custom_preview_3 = CustomPreview(Geometry=patch, Material=ColourSwatch(SwatchColor=RGB(204, 204, 204)))

# ---- group: contours
brep = Brep(patch)
distance = Slider(1, range=0..1)
contour = Contour(Shape=brep, Point=Point(0, 0, 0), Direction=Vector(0, 0, 1), Distance=distance)
custom_preview_4 = CustomPreview(Geometry=contour, Material=ColourSwatch(SwatchColor=RGB(0, 0, 0)))

# ---- group: cutting plane
circle_2 = Circle(circle)
# parametric tree
depth = Slider(-1, range=-2..2)
unit_z_2 = UnitZ(Factor=depth)
boundary_surfaces_2 = BoundarySurfaces(Edges=circle_2)
move_2 = Move(Geometry=boundary_surfaces_2, Motion=unit_z_2)  # -> Geometry, Transform
custom_preview_5 = CustomPreview(Geometry=move_2.Geometry, Material=ColourSwatch(SwatchColor=RGB(173, 195, 255)))

# ----
# random population of trees
trunk = Brep(conical_tree.trunk)
count_2 = Slider(360, range=0..1000)
seed_2 = Slider(100, range=0..100)
canopy = Brep(conical_tree.result)
terrain = Brep(patch)
water = Brep(move_2.Geometry)
scale_nu = ScaleNU(Geometry=water, Plane=PlaneXY(0, 0, 0), ScaleX="2", ScaleY="2", ScaleZ=1)  # -> Geometry, Transform
split_brep = SplitBrep(Brep=terrain, Cutter=scale_nu.Geometry)
list_item = ListItem(List=split_brep, Index="0", Wrap=True)
populate_geometry_2 = PopulateGeometry(Geometry=list_item, Count=count_2, Seed=seed_2)
closest_points = ClosestPoints(Point="0,0,0", Cloud=populate_geometry_2, Count=count_2)  # -> ClosestPoint, CPIndex, Distance
range = Range(Domain=Domain(0, 1), Steps=count_2)
vector_2pt = Vector2Pt(PointA="0,0,0", PointB=closest_points.ClosestPoint, Unitize=False)  # -> Vector, Length
random_2 = Random(Range="0.5 To 1.0", Number=count_2, Seed=2)
move_3 = Move(Geometry=trunk, Motion=vector_2pt.Vector)  # -> Geometry, Transform
move_4 = Move(Geometry=canopy, Motion=vector_2pt.Vector)  # -> Geometry, Transform
canopy_color_2 = ColourSwatch(SwatchColor=RGBA(58, 94, 58, 232))
canopy_color_3 = ColourSwatch(SwatchColor=RGBA(64, 128, 117, 232))
canopy_color_4 = ColourSwatch(SwatchColor=RGBA(123, 128, 64, 232))
scale = Scale(Geometry=move_3.Geometry, Center=vector_2pt.Vector, Factor=random_2)  # -> Geometry, Transform
scale_2 = Scale(Geometry=move_4.Geometry, Center=vector_2pt.Vector, Factor=random_2)  # -> Geometry, Transform
interpolate_data = InterpolateData(Data=[canopy_color_2, canopy_color_3, canopy_color_4], Parameter=range, Interpolation=2)
canopy_color_5 = ColourSwatch(SwatchColor=RGBA(63, 115, 98, 232))
trunk_color_2 = ColourSwatch(SwatchColor=RGB(139, 76, 57))
custom_preview_6 = CustomPreview(Geometry=scale.Geometry, Material=trunk_color_2)
custom_preview_7 = CustomPreview(Geometry=scale_2.Geometry, Material=interpolate_data)

# ==== cluster ConicalTree
factor = ClusterInput()
factor_2 = ClusterInput()
A = ClusterInput()
A_2 = ClusterInput()

# ---- group: conical tree
construct_point = ConstructPoint(XCoordinate=0, YCoordinate=0, ZCoordinate=0)
unit_z = UnitZ(Factor=factor)
unit_z_2 = UnitZ(Factor=factor_2)
division = Division(A=A, B="2.0")
division_2 = Division(A=A_2, B="2.0")
B = ClusterInput()
move = Move(Geometry=construct_point, Motion=unit_z_2)  # -> Geometry, Transform
move_2 = Move(Geometry=construct_point, Motion=unit_z)  # -> Geometry, Transform
division_3 = Division(A=unit_z_2, B=B)
line = Line(StartPoint=construct_point, EndPoint=move_2.Geometry)
line_2 = Line(StartPoint=move_2.Geometry, EndPoint=move.Geometry)
divide_distance = DivideDistance(Curve=line_2, Distance=division_3)  # -> Points, Tangents, Parameters
construct_plane = ConstructPlane(Origin=divide_distance.Points, XAxis=Vector(1, 0, 0), YAxis=Vector(0, 1, 0))
construct_domain = ConstructDomain(DomainStart="0.5", DomainEnd="1.75")
cone = Cone(Base=construct_plane, Radius=division_2, Length=division_3)  # -> Cone, Tip
list_length = ListLength(List=construct_plane)
range = Range(Domain=construct_domain, Steps=list_length)  # -> reverse(Range)
scale = Scale(Geometry=cone.Cone, Center=construct_plane, Factor=range)  # -> Geometry, Transform
pipe = Pipe(Curve=line, Radius=division, Caps=0)
cap_holes = CapHoles(Brep=scale.Geometry)
solid_union = SolidUnion(Breps=cap_holes)

# ----
trunk = ClusterOutput(pipe)
result = ClusterOutput(solid_union)
