# Grasshopper definition parametric-patterns.gh (Grasshopper 1.0.7)

# ---- group: conical tree
# parametric tree
trunk_diameter = Slider(0.75, range=0..2)
trunk_color = ColourSwatch(SwatchColor=RGB(139, 76, 57))
canopy_color = ColourSwatch(SwatchColor=RGBA(58, 94, 58, 232))
trunk_height = Slider(8, range=0..100)
crown_height = Slider(30, range=0..75)
canopy_layers = Slider(3, range=0..10)
canopy_diameter = Slider(10, range=0..100)
construct_point = ConstructPoint(XCoordinate=0, YCoordinate=0, ZCoordinate=0)
unit_z = UnitZ(Factor=trunk_height)
unit_z_2 = UnitZ(Factor=crown_height)
division = Division(A=trunk_diameter, B="2.0")
division_2 = Division(A=canopy_diameter, B="2.0")
move = Move(Geometry=construct_point, Motion=unit_z_2)  # -> Geometry, Transform
move_2 = Move(Geometry=construct_point, Motion=unit_z)  # -> Geometry, Transform
division_3 = Division(A=unit_z_2, B=canopy_layers)
line = Line(StartPoint=construct_point, EndPoint=move_2.Geometry)
line_2 = Line(StartPoint=move_2.Geometry, EndPoint=move.Geometry)
divide_distance = DivideDistance(Curve=line_2, Distance=division_3)  # -> Points, Tangents, Parameters
construct_plane = ConstructPlane(Origin=divide_distance.Points, XAxis=Vector(1, 0, 0), YAxis=Vector(0, 1, 0))
construct_domain = ConstructDomain(DomainStart="0.5", DomainEnd="1.75")
cone = Cone(Base=construct_plane, Radius=division_2, Length=division_3)  # -> Cone, Tip
list_length = ListLength(List=construct_plane)
range = Range(Domain=construct_domain, Steps=list_length)  # -> reverse(Range)
scale = Scale(Geometry=cone.Cone, Center=construct_plane, Factor=range)  # -> Geometry, Transform
pipe = Pipe(Curve=line, Radius=division, Caps=0)
cap_holes = CapHoles(Brep=scale.Geometry)
group = Group(Objects=[cap_holes, pipe])  # -> flatten(Group)
custom_preview = CustomPreview(Geometry=pipe, Material=trunk_color)
custom_preview_2 = CustomPreview(Geometry=cap_holes, Material=canopy_color)

# ---- group: sine wave
# curve functions
number_slider = Slider(1, range=0..2)
pi = Pi(Factor=Slider(2, range=0..12))
dom = ConstructDomain(DomainStart=0, DomainEnd=pi)
range_2 = Range(Domain=dom, Steps=Slider(22, range=0..360))
multiplication = Multiplication(A=number_slider, B=range_2)
sin = Sine(Value=multiplication)
pt = ConstructPoint(XCoordinate=multiplication, YCoordinate=sin, ZCoordinate=0)
intcrv = Interpolate(Vertices=pt, Degree=3, Periodic=False, KnotStyle=1)  # -> Curve, Length, Domain
scale_2 = Scale(Geometry=intcrv.Curve, Center=Point(0, 0, 0), Factor=1000)  # -> Geometry, Transform

# ---- group: sine wave with variable amplitude
pi_2 = Pi(Factor=Slider(2, range=0..12))
dom_2 = ConstructDomain(DomainStart=0, DomainEnd=pi_2)
range_3 = Range(Domain=dom_2, Steps=Slider(22, range=0..360))
expression = Expression(w=Slider(2, range=0..2), t=range_3, Expression="sin(w*t)")
pt_2 = ConstructPoint(XCoordinate=range_3, YCoordinate=expression, ZCoordinate=0)
intcrv_2 = Interpolate(Vertices=pt_2, Degree=3, Periodic=False, KnotStyle=1)  # -> Curve, Length, Domain
scale_3 = Scale(Geometry=intcrv_2.Curve, Center=Point(0, 0, 0), Factor=1000)  # -> Geometry, Transform

# ---- group: sine waves with variable amplitudes
pi_3 = Pi(Factor=Slider(2, range=0..12))
dom_3 = ConstructDomain(DomainStart=0, DomainEnd=pi_3)
range_4 = Range(Domain=dom_3, Steps=Slider(360, range=0..360))
expression_2 = Expression(w=graft([Slider(2, range=0..2), Slider(1, range=0..2), Slider(0.5, range=0..2)]), t=range_4, Expression="sin(w*t)")
pt_3 = ConstructPoint(XCoordinate=range_4, YCoordinate=expression_2, ZCoordinate=0)
intcrv_3 = Interpolate(Vertices=pt_3, Degree=3, Periodic=False, KnotStyle=1)  # -> Curve, Length, Domain
scale_4 = Scale(Geometry=intcrv_3.Curve, Center=Point(0, 0, 0), Factor=1000)  # -> Geometry, Transform

# ---- group: array trees along a line
geo = Geometry(group)
unit_x = UnitX(Factor=Slider(500, range=0..10000))
linear_array = LinearArray(Geometry=geo, Direction=unit_x, Count=Slider(12, range=0..100))  # -> Geometry, Transform

# ---- group: array trees in a fibonacci sequence
geo_2 = Geometry(group)
fibonacci = Fibonacci(SeedA=0, SeedB=1, Number=Slider(6, range=0..100))
multiplication_2 = Multiplication(A=fibonacci, B=Slider(500, range=0..10000))
unit_x_2 = UnitX(Factor=multiplication_2)
move_3 = Move(Geometry=geo_2, Motion=unit_x_2)  # -> Geometry, Transform

# ---- group: array boxes along a line
number_slider_2 = Slider(250, range=0..1000)
# arrays
unit_z_3 = UnitZ(Factor=number_slider_2)
construct_plane_2 = ConstructPlane(Origin=unit_z_3, XAxis=Vector(1, 0, 0), YAxis=Vector(0, 1, 0))
unit_x_3 = UnitX(Factor=Slider(750, range=0..10000))
center_box = CenterBox(Base=construct_plane_2, X=number_slider_2, Y=number_slider_2, Z=number_slider_2)
linear_array_2 = LinearArray(Geometry=center_box, Direction=unit_x_3, Count=Slider(12, range=0..100))  # -> Geometry, Transform

# ---- group: array along sine wave
# arrays
number_slider_3 = Slider(50, range=0..100)
geo_3 = Geometry(group)
curve_array = CurveArray(Geometry=geo_3, Curve=scale_2.Geometry, Count=number_slider_3)  # -> Geometry, Transform
divide = DivideCurve(Curve=scale_2.Geometry, Count=expr("x-1", number_slider_3), Kinks=False)  # -> Points, Tangents, Parameters
scale_5 = Scale(Geometry=curve_array.Geometry, Center=divide.Points, Factor=Slider(8, range=0..100))  # -> Geometry, Transform

# ---- group: array along sine wave and randomly scale
number_slider_4 = Slider(50, range=0..100)
geo_4 = Geometry(group)
dom_4 = ConstructDomain(DomainStart=Slider(10, range=0..100), DomainEnd=Slider(15, range=0..100))
random = Random(Range=dom_4, Number=number_slider_4, Seed=2)
divide_curve = DivideCurve(Curve=scale_3.Geometry, Count=expr("x-1", number_slider_4), Kinks=False)  # -> Points, Tangents, Parameters
curve_array_2 = CurveArray(Geometry=geo_4, Curve=scale_3.Geometry, Count=number_slider_4)  # -> Geometry, Transform
scale_6 = Scale(Geometry=curve_array_2.Geometry, Center=divide_curve.Points, Factor=random)  # -> Geometry, Transform
