# Grasshopper definition parametric-tree.gh (Grasshopper 1.0.7)
# Copyright: GNU General Public License 3.0

# ---- group: generate a conical tree
# diameter at breast height (DBH)
trunk_diameter = Slider(1, range=0..2)
trunk_height = Slider(8, range=0..100)
crown_height = Slider(30, range=0..75)
canopy_layers = Slider(3, range=0..10)
canopy_diameter = Slider(10, range=0..100)
conical_tree = ConicalTree(A=trunk_diameter, factor=trunk_height, factor_2=crown_height, B=canopy_layers, A_2=canopy_diameter)  # -> trunk, result
trunk_color = ColourSwatch(SwatchColor=RGB(139, 76, 57))
canopy_color = ColourSwatch(SwatchColor=RGBA(58, 94, 84, 232))
custom_preview = CustomPreview(Geometry=conical_tree.trunk, Material=trunk_color)
custom_preview_2 = CustomPreview(Geometry=conical_tree.result, Material=canopy_color)

# ---- group: trunk
# parametric tree
trunk_height_2 = Slider(8, range=0..25)
trunk_diameter_2 = Slider(1, range=0..10)
cap = ValueList({"None": 0, "Flat": 1, "Round": 2}, selected="Flat")
line_sdl = LineSDL(Start="0,0,0", Direction=Vector(0, 0, 1), Length=trunk_height_2)
pipe = Pipe(Curve=line_sdl, Radius=expr("x/2", trunk_diameter_2), Caps=cap)
trunk_color_2 = ColourSwatch(SwatchColor=RGB(139, 76, 57))
custom_preview_3 = CustomPreview(Geometry=pipe, Material=trunk_color_2)

# ---- group: tree cluster
# cluster
trunk_height_3 = Slider(8, range=0..25)
trunk_diameter_3 = Slider(1, range=0..10)
canopy_height = Slider(36, range=0..100)
canopy_diameter_2 = Slider(24, range=0..100)
canopy_divisions = Slider(3, range=0..10)
conical_tree_2 = ConicalTree_2(
    trunk_height=trunk_height_3,
    trunk_diameter=trunk_diameter_3,
    canopy_height=canopy_height,
    canopy_diameter=canopy_diameter_2,
    canopy_divisions=canopy_divisions)  # -> trunk_2, canopy_2
trunk_color_3 = ColourSwatch(SwatchColor=RGB(139, 76, 57))
canopy_color_2 = ColourSwatch(SwatchColor=RGBA(58, 94, 84, 232))
custom_preview_4 = CustomPreview(Geometry=conical_tree_2.trunk_2, Material=trunk_color_3)
custom_preview_5 = CustomPreview(Geometry=conical_tree_2.canopy_2, Material=canopy_color_2)

# ---- group: conical conifer
# parametric tree
trunk_diameter_4 = Slider(1.5, range=0..3)
trunk_height_4 = Slider(8, range=0..36)
tree_height = Slider(30, range=0..36)
canopy_diameter_3 = Slider(10, range=0..36)
# cluster
canopy_divisions_2 = Slider(3, range=0..36)
unit_z = UnitZ(Factor=trunk_height_4)
unit_z_2 = UnitZ(Factor=tree_height)
division = Division(A=canopy_diameter_3, B="2")
division_2 = Division(A=tree_height, B=canopy_divisions_2)
origin = Panel("0,0,0")
move = Move(Geometry=origin, Motion=unit_z)  # -> Geometry, Transform
move_2 = Move(Geometry=origin, Motion=unit_z_2)  # -> Geometry, Transform
line = Line(StartPoint=move.Geometry, EndPoint=move_2.Geometry)
line_2 = Line(StartPoint=origin, EndPoint=move.Geometry)
range = Range(Domain="0.75 To 2", Steps=expr("x-1", canopy_divisions_2))  # -> reverse(Range)
divide_distance = DivideDistance(Curve=line, Distance=division_2)  # -> Points, Tangents, Parameters
pipe_2 = Pipe(Curve=line_2, Radius=expr("x/2", trunk_diameter_4), Caps=1)
cone = Cone(Base=divide_distance.Points, Radius=division, Length=division_2)  # -> Cone, Tip
scale = Scale(Geometry=cone.Cone, Center=divide_distance.Points, Factor=range)  # -> Geometry, Transform
cap_holes = CapHoles(Brep=scale.Geometry)
trunk_color_4 = ColourSwatch(SwatchColor=RGB(139, 76, 57))
canopy_color_3 = ColourSwatch(SwatchColor=RGBA(58, 94, 84, 232))
solid_union = SolidUnion(Breps=cap_holes)
custom_preview_6 = CustomPreview(Geometry=pipe_2, Material=trunk_color_4)
custom_preview_7 = CustomPreview(Geometry=solid_union, Material=canopy_color_3)

# ---- group: canopy
canopy_height_2 = Slider(36, range=0..100)
canopy_diameter_4 = Slider(24, range=0..100)
canopy_divisions_3 = Slider(3, range=0..10)
range_2 = Range(Domain=canopy_height_2, Steps=canopy_divisions_3)
construct_point = ConstructPoint(XCoordinate=0, YCoordinate=0, ZCoordinate=range_2)
multiplication = Multiplication(A=range_2, B="0.75")
mass_addition = MassAddition(Input=multiplication)  # -> Result, PartialResults
canopy_height_3 = Number(canopy_height_2)
remap_numbers = RemapNumbers(Value=range_2, Source=mass_addition.Result, Target=canopy_height_3)  # -> Mapped, Clipped
trunk_vector = Vector(line_sdl)
canopy_color_4 = ColourSwatch(SwatchColor=RGBA(58, 94, 84, 232))

# ----
division_3 = Division(A=canopy_diameter_4, B="2")

# ---- group: canopy (continued)
division_4 = Division(A=division_3, B="2")
construct_domain = ConstructDomain(DomainStart=division_3, DomainEnd=division_4)
range_3 = Range(Domain=construct_domain, Steps=expr("x-1", canopy_divisions_3))
cone_2 = Cone(Base=construct_point, Radius=range_3, Length=reverse(remap_numbers.Mapped))  # -> Cone, Tip
move_3 = Move(Geometry=cone_2.Cone, Motion=trunk_vector)  # -> Geometry, Transform
cap_holes_2 = CapHoles(Brep=move_3.Geometry)
solid_union_2 = SolidUnion(Breps=cap_holes_2)
custom_preview_8 = CustomPreview(Geometry=solid_union_2, Material=canopy_color_4)

# ==== cluster ConicalTree
factor = ClusterInput()
factor_2 = ClusterInput()
A = ClusterInput()
A_2 = ClusterInput()

# ---- group: conical tree
construct_point = ConstructPoint(XCoordinate=0, YCoordinate=0, ZCoordinate=0)
unit_z = UnitZ(Factor=factor)
unit_z_2 = UnitZ(Factor=factor_2)
division = Division(A=A, B="2.0")
division_2 = Division(A=A_2, B="2.0")
B = ClusterInput()
move = Move(Geometry=construct_point, Motion=unit_z_2)  # -> Geometry, Transform
move_2 = Move(Geometry=construct_point, Motion=unit_z)  # -> Geometry, Transform
division_3 = Division(A=unit_z_2, B=B)
line = Line(StartPoint=construct_point, EndPoint=move_2.Geometry)
line_2 = Line(StartPoint=move_2.Geometry, EndPoint=move.Geometry)
divide_distance = DivideDistance(Curve=line_2, Distance=division_3)  # -> Points, Tangents, Parameters
construct_plane = ConstructPlane(Origin=divide_distance.Points, XAxis=Vector(1, 0, 0), YAxis=Vector(0, 1, 0))
construct_domain = ConstructDomain(DomainStart="0.5", DomainEnd="1.75")
cone = Cone(Base=construct_plane, Radius=division_2, Length=division_3)  # -> Cone, Tip
list_length = ListLength(List=construct_plane)
range = Range(Domain=construct_domain, Steps=list_length)  # -> reverse(Range)
scale = Scale(Geometry=cone.Cone, Center=construct_plane, Factor=range)  # -> Geometry, Transform
pipe = Pipe(Curve=line, Radius=division, Caps=0)
cap_holes = CapHoles(Brep=scale.Geometry)
solid_union = SolidUnion(Breps=cap_holes)

# ----
trunk = ClusterOutput(pipe)
result = ClusterOutput(solid_union)

# ==== cluster ConicalTree_2
trunk_height = ClusterInput()
trunk_diameter = ClusterInput()
canopy_height = ClusterInput()
canopy_diameter = ClusterInput()
canopy_divisions = ClusterInput()
trunk_height_2 = Number(trunk_height)
trunk_diameter_2 = Number(trunk_diameter)
canopy_height_2 = Number(canopy_height)
canopy_diameter_2 = Number(canopy_diameter)
canopy_divisions_2 = Number(canopy_divisions)
division = Division(A=canopy_diameter_2, B="2")
cap = ValueList({"None": 0, "Flat": 1, "Round": 2}, selected="Flat")
line_sdl = LineSDL(Start="0,0,0", Direction=Vector(0, 0, 1), Length=trunk_height_2)
division_2 = Division(A=division, B="2")
pipe = Pipe(Curve=line_sdl, Radius=expr("x/2", trunk_diameter_2), Caps=cap)
construct_domain = ConstructDomain(DomainStart=division, DomainEnd=division_2)
trunk = Brep(pipe)
trunk_2 = ClusterOutput(trunk)
range = Range(Domain=construct_domain, Steps=expr("x-1", canopy_divisions_2))
range_2 = Range(Domain=canopy_height_2, Steps=canopy_divisions_2)
construct_point = ConstructPoint(XCoordinate=0, YCoordinate=0, ZCoordinate=range_2)
multiplication = Multiplication(A=range_2, B="0.75")
mass_addition = MassAddition(Input=multiplication)  # -> Result, PartialResults
canopy_height_3 = Number(canopy_height_2)
remap_numbers = RemapNumbers(Value=range_2, Source=mass_addition.Result, Target=canopy_height_3)  # -> Mapped, Clipped
cone = Cone(Base=construct_point, Radius=range, Length=reverse(remap_numbers.Mapped))  # -> Cone, Tip
trunk_vector = Vector(line_sdl)
move = Move(Geometry=cone.Cone, Motion=trunk_vector)  # -> Geometry, Transform
cap_holes = CapHoles(Brep=move.Geometry)
solid_union = SolidUnion(Breps=cap_holes)
canopy = Brep(solid_union)
canopy_2 = ClusterOutput(canopy)
