# Grasshopper definition recursive-tree.gh (Grasshopper 1.0.7)
# plug-ins: Anemone

# ---- group: draw trunk
# recursive tree
xy_plane = XYPlane(Origin=Point(0, 0, 0))
length = Slider(10, range=0..10)
unit_z = UnitZ(Factor=length)
move = Move(Geometry=xy_plane, Motion=unit_z)  # -> Geometry, Transform
line = Line(StartPoint=xy_plane, EndPoint=move.Geometry)

# ----
scaling = Slider(0.75, range=0..1)
angle = Slider(25, range=0..100)

# ---- group: begin loop
iterations = Slider(6, range=0..10)
timer = Slider(250, range=0..1000)
curve = Curve(line)
loop_start = LoopStart(Repeat=iterations, Trigger=Toggle(True), Data_1=curve)  # -> port, Counter, Data1, Data2
time_buffer = TimeBuffer(Data=loop_start.Data1, Ms=timer, UseThread=True)

# ---- group: recursion
# or unit y
curve_2 = Curve(graft(time_buffer))
angle_2 = Slider(0.2, range=0..1)
scaling_2 = Slider(0.75, range=0..1)
evaluate_curve = EvaluateCurve(Curve=curve_2, Parameter="1")  # -> Point, Tangent, Angle
pi = Pi(Factor=angle_2)
length_2 = Length(Curve=curve_2)
negative = Negative(Value=pi)
multiplication = Multiplication(A=length_2, B=scaling_2)
relay = Relay([pi, negative])
yz_plane = YZPlane(Origin=Point(0, 0, 0))
rotate = Rotate(Geometry=evaluate_curve.Tangent, Angle=relay, Plane=yz_plane)  # -> Geometry, Transform
line_sdl = LineSDL(Start=evaluate_curve.Point, Direction=rotate.Geometry, Length=multiplication)
param_viewer = ParamViewer(line_sdl)
curve_3 = Curve([curve_2, loop_start.Data2])
curve_4 = Curve(line_sdl)

# ----
curve_5 = Curve(line)
scaling_3 = Slider(0.75, range=0..1)
angle_3 = Slider(35, range=0..100)
length_3 = Length(Curve=curve_5)
negative_2 = Negative(Value=angle_3)
end_points = EndPoints(Curve=curve_5)  # -> Start, End
multiplication_2 = Multiplication(A=length_3, B=scaling_3)
relay_2 = Relay([angle_3, negative_2])
vector_2pt = Vector2Pt(PointA=end_points.Start, PointB=end_points.End, Unitize=False)  # -> Vector, Length
yz_plane_2 = YZPlane(Origin=Point(0, 0, 0))
rotate_2 = Rotate(Geometry=vector_2pt.Vector, Angle=degrees(relay_2), Plane=yz_plane_2)  # -> Geometry, Transform
line_sdl_2 = LineSDL(Start=end_points.End, Direction=rotate_2.Geometry, Length=multiplication_2)
curve_6 = Curve(graft(line_sdl_2))

# ---- group: end loop
loop_end = LoopEnd(port=loop_start.port, Exit=False, Data1=curve_4, Data2=curve_3, TimeOutVal=0, pausedState=False, state="Output last")  # -> Data_1, Data_2
curve_7 = Curve(flatten([loop_end.Data_1, loop_end.Data_2]))

# ---- group: visualization
radius = Slider(0.2, range=0..1)
pipe = Pipe(Curve=curve_7, Radius=radius, Caps="2")
custom_preview = CustomPreview(Geometry=pipe, Material=ColourSwatch(SwatchColor=RGB(76, 76, 76)))
