# Grasshopper definition spheroid.gh (Grasshopper 1.0.7)
# Copyright: GNU General Public License 3.0
# plug-ins: Weaverbird

# ---- group: sculpture from cloud of random spheres
# cloud sculpture
radius = Slider(8, range=0..100)
count = Slider(12, range=0..20)
min = Slider(4, range=0..10)
max = Slider(6, range=0..20)
sphere = Sphere(Base=PlaneXY(0, 0, 0), Radius=radius)
construct_domain = ConstructDomain(DomainStart=min, DomainEnd=max)
populate_geometry = PopulateGeometry(Geometry=sphere, Count=count, Seed=1)
random = Random(Range=construct_domain, Number=count, Seed=2)
sphere_2 = Sphere(Base=populate_geometry, Radius=random)
solid_union = SolidUnion(Breps=sphere_2)
custom_preview = CustomPreview(Geometry=solid_union, Material=ColourSwatch(SwatchColor=RGB(219, 219, 219)))

# ---- group: sculpture from randomly scaled cloud of spheres
# blob sculpture
radius_2 = Slider(8, range=0..100)
Z = Slider(0.9, range=0..10)
count_2 = Slider(12, range=0..20)
min_2 = Slider(4, range=0..10)
seed = Slider(0, range=0..100)
X = Slider(1.2, range=0..10)
Y = Slider(0.6, range=0..1)
max_2 = Slider(6, range=0..20)
sphere_3 = Sphere(Base=PlaneXY(0, 0, 0), Radius=radius_2)
construct_domain_2 = ConstructDomain(DomainStart=min_2, DomainEnd=max_2)
scale_nu = ScaleNU(Geometry=sphere_3, Plane=PlaneXY(0, 0, 0), ScaleX=X, ScaleY=Y, ScaleZ=Z)  # -> Geometry, Transform
count_3 = Number(count_2)
populate_geometry_2 = PopulateGeometry(Geometry=scale_nu.Geometry, Count=count_2, Seed=1)
seed_2 = Slider(1, range=0..100)
seed_3 = Slider(2, range=0..100)
seed_4 = Slider(3, range=0..100)
random_2 = Random(Range=construct_domain_2, Number=count_2, Seed=seed)
random_3 = Random(Range="0.6 To 1.4", Number=count_3, Seed=seed_2)
random_4 = Random(Range="0.6 To 1.4", Number=count_3, Seed=seed_3)
random_5 = Random(Range="0.6 To 1.4", Number=count_3, Seed=seed_4)
sphere_4 = Sphere(Base=populate_geometry_2, Radius=random_2)
scale_nu_2 = ScaleNU(Geometry=sphere_4, Plane=PlaneXY(0, 0, 0), ScaleX=random_3, ScaleY=random_4, ScaleZ=random_5)  # -> Geometry, Transform
solid_union_2 = SolidUnion(Breps=scale_nu_2.Geometry)

# ---- group: set on plinth
base_xy = Slider(8, range=0..20)
brep = Brep(solid_union_2)
Z_2 = Slider(15, range=0..100)
unit_z = UnitZ(Factor=Z_2)
center_box = CenterBox(Base=PlaneXY(0, 0, 0), X=base_xy, Y=base_xy, Z=1)
move = Move(Geometry=brep, Motion=unit_z)  # -> Geometry, Transform
solid_difference = SolidDifference(BrepsA=move.Geometry, BrepsB=center_box)
custom_preview_2 = CustomPreview(Geometry=solid_difference, Material=ColourSwatch(SwatchColor=RGB(76, 76, 76)))
custom_preview_3 = CustomPreview(Geometry=center_box, Material=ColourSwatch(SwatchColor=RGB(219, 219, 219)))

# ----
# bake for 3D printing
solid_union_3 = SolidUnion(Breps=flatten([move.Geometry, center_box]))

# ---- group: smoothing
brep_2 = Brep(move.Geometry)
mesh_brep = MeshBrep(
    Brep=brep_2,
    Settings={GridMaxCount=0, GridMinCount=16, JaggedSeams=False, MaxEdgeLength=0, MinEdgeLength=0.0001, MinTolerance=0, Refine=True, RefineAngle=0, RelativeTolerance=0.65, SimplePlanes=True, Tolerance=0})
weaverbird_s_laplacian_smoothing = WeaverbirdsLaplacianSmoothing(MeshCurves=mesh_brep, Level=Slider(20, range=0..100), SmoothNakedEdges=1, Thin=1)  # -> flatten(OutputMeshCurves)
custom_preview_4 = CustomPreview(Geometry=weaverbird_s_laplacian_smoothing, Material=ColourSwatch(SwatchColor=RGB(76, 76, 76)))
