# Grasshopper definition terrain-analysis.gh (Grasshopper 1.0.7)
# plug-ins: Pufferfish, NudiBranch, Docofossor, Groundhog, Section To XY

# ---- group: import xyz data as grid
# import terrain
# using docofossor
file_path = FilePath("D:\rhino\grasshopper\elevation.xyz")
import_xyz = ImportXYZ(F=file_path)
grid_shift = GridShift(Df=import_xyz)
grid_mesh = GridMesh(Df=grid_shift)
custom_preview = CustomPreview(Geometry=grid_mesh, Material=ColourSwatch(SwatchColor=RGB(230, 230, 230)))

# ---- group: vector flow field
# flow
grid_filter = GridFilter(Df=grid_shift, N="10")
grid_smooth = GridSmooth(Df=grid_filter, Rad="2")
grid_points = GridPoints(Df=grid_smooth)
slope_vectors = SlopeVectors(Df=grid_smooth)
reverse = Reverse(Vector=slope_vectors)
vector_display = VectorDisplay(Anchor=grid_points, Vector=reverse)

# ---- group: model flowlines using bison
# using bison
resolution = Slider(10, range=1..10)  # disabled
grid_filter_2 = GridFilter(Df=grid_shift, N=resolution)  # disabled
grid_mesh_2 = GridMesh(Df=grid_filter_2)  # disabled
bounding_rectangle = BoundingRectangle(Geometry=grid_mesh_2, Plane=PlaneXY(0, 0, 0), Axis=0, Slide=0, Union=True)  # -> Bounding, DimensionX, DimensionY; disabled
panel = Panel("1")  # disabled
panel_2 = Panel("20")  # disabled
panel_3 = Panel("0.5")  # disabled
flow = Flow(Boundary=bounding_rectangle.Bounding, Mesh=grid_mesh_2, Grid=panel, Steps=panel_2, Length=panel_3)  # disabled
colour_swatch = ColourSwatch(SwatchColor=RGB(0, 0, 0))  # disabled
custom_preview_2 = CustomPreview(Geometry=flow, Material=colour_swatch)  # disabled

# ---- group: model flowlines using nudibranch
# using nudibranch
panel_4 = Panel("15")  # disabled
panel_5 = Panel("10")  # disabled
number_slider = Slider(0, range=0..1)  # disabled
number_slider_2 = Slider(100, range=0..100)  # disabled
number_slider_3 = Slider(1, range=0..1)  # disabled
grid_filter_3 = GridFilter(Df=grid_shift, N=panel_5)  # disabled
grid_filter_4 = GridFilter(Df=grid_shift, N=panel_4)  # disabled
grid_points_2 = GridPoints(Df=grid_filter_4)  # disabled
grid_mesh_3 = GridMesh(Df=grid_filter_3)  # disabled
meshclimber = MeshClimber(
    MeshTerrain=grid_mesh_3,
    Points=grid_points_2,
    Force=number_slider_3,
    Incremental=number_slider,
    Iterations=number_slider_2)  # -> NewPoints, NewVectors, Paths; disabled
vdis = VectorDisplay(Anchor=meshclimber.NewPoints, Vector=meshclimber.NewVectors)  # disabled

# ---- group: model flowlines using groundhog
# using groundhog
panel_6 = Panel("10")  # disabled
panel_7 = Panel("15")  # disabled
grid_filter_5 = GridFilter(Df=grid_shift, N=panel_6)  # disabled
grid_filter_6 = GridFilter(Df=grid_shift, N=panel_7)  # disabled
grid_points_3 = GridPoints(Df=grid_filter_6)  # disabled
grid_mesh_4 = GridMesh(Df=grid_filter_5)  # disabled
flow_projection_mesh = FlowProjectionMesh(Mesh=grid_mesh_4, Points=grid_points_3, Fidelity=0, Steps=0, Thread=True)  # -> FlowPoints, FlowPaths; disabled
curve = Curve(flow_projection_mesh.FlowPaths)  # disabled

# ---- group: compute aspect
# using bison
control_knob = ControlKnob(Decimals=0, Limit=True, Maximum=360, Minimum=0, Range=360, Value=270)
# aspect
geometry = Geometry(grid_mesh)
aspect = Aspect(Mesh=geometry, Angle=control_knob)  # -> Mesh, Colors, Tags, Aspect
legend = Legend(Colour=aspect.Colors, Tags=aspect.Tags, LegendType=1)
