# Grasshopper definition terrain-simulation.gh (Grasshopper 1.0.7)
# Copyright: GNU General Public License 3.0
# plug-ins: Docofossor

# ----
# terrain simulation
# grid
rows = Slider(50, range=0..250)
columns = Slider(250, range=0..1000)
# grid
resolution = Slider(1, range=0..10)
empty_grid = EmptyGrid(Nr=expr("x+1", rows), Nc=expr("x+1", columns), Cx=resolution, Cy=resolution)

data = Data(empty_grid)
point = Point([Point(186, 12.15599626, 0), Point(153, 24, 3.157789779), Point(185, 35.68432572, 0)])
width = Slider(1, range=0..10)
outer_slope = Slider(20, range=0..90)
inner_slope = Slider(18, range=0..90)
distance = Slider(100, range=0..100)
interpolate = Interpolate(Vertices=point, Degree=3, Periodic=False, KnotStyle=1)  # -> Curve, Length, Domain
cut_fill_in_path = CutFillInPath(Df=data, Crv=interpolate.Curve, W=width, Sa=outer_slope, Sa2=inner_slope, D=distance)  # -> Df, Vol
grid_mesh = GridMesh(Df=cut_fill_in_path.Df)
custom_preview = CustomPreview(Geometry=grid_mesh, Material=ColourSwatch(SwatchColor=RGB(204, 204, 204)))
data_2 = Data(cut_fill_in_path.Df)

# ----
# export terrain
data_3 = Data(data_2)

export_xyz = ExportXYZ(Df=data_3, F="landform", W=Toggle(False))
