# Grasshopper definition topographic-export.gh (Grasshopper 1.0.7)
# Copyright: GNU General Public License 3.0
# plug-ins: Docofossor

# terrain modeling
# terrain
file_path = FilePath("D:\generative-design\grasshopper\data\governors-island-landform.xyz")
resolution = Slider(5, range=0..10)
# using docofossor
import_xyz = ImportXYZ(F=file_path, N=resolution)
grid_shift = GridShift(Df=import_xyz)
grid_points = GridPoints(Df=grid_shift)
grid_mesh = GridMesh(Df=grid_shift)
area = Area(Geometry=grid_mesh)  # -> Area, Centroid
xz_plane = XZPlane(Origin=area.Centroid)
mirror = Mirror(Geometry=grid_points, Plane=xz_plane)  # -> Geometry, Transform
import_points = ImportPoints(Pts=mirror.Geometry)
grid_mesh_2 = GridMesh(Df=import_points)
custom_preview = CustomPreview(Geometry=grid_mesh_2, Material=ColourSwatch(SwatchColor=RGB(227, 227, 227)))
data = Data(import_points)
