# Grasshopper definition voronoi-wall.gh (Grasshopper 1.0.7)
# plug-ins: Pufferfish

xz_plane = XZPlane(Origin=Point(0, 0, 0))
circle = Circle(Plane=xz_plane, Radius=Slider(36, range=0..100))
boundary_surfaces = BoundarySurfaces(Edges=circle)
bounding_rectangle = BoundingRectangle(Geometry=boundary_surfaces, Plane=xz_plane, Axis=0, Slide=0, Union=True)  # -> Bounding, DimensionX, DimensionY
populate_geometry = PopulateGeometry(Geometry=boundary_surfaces, Count=100, Seed=1)
voronoi = Voronoi(Points=populate_geometry, Boundary=bounding_rectangle.Bounding, BruteForceOverride=False)
negative = Negative(Value=Slider(6, range=0..10))
polygon_center = PolygonCenter(Polyline=voronoi)  # -> CenterV, CenterE, CenterA
unit_y = UnitY(Factor=negative)
extrude = Extrude(Base=voronoi, Direction=unit_y)
scale_nu = ScaleNU(
    Geometry=voronoi,
    Plane=flatten(polygon_center.CenterA),
    ScaleX=Slider(0.8, range=0..1),
    ScaleY=1,
    ScaleZ=Slider(0.36, range=0..1))  # -> Geometry, Transform
unit_y_2 = UnitY(Factor=Slider(3, range=0..10))
move = Move(Geometry=scale_nu.Geometry, Motion=unit_y_2)  # -> Geometry, Transform
ruled_surface = RuledSurface(CurveA=move.Geometry, CurveB=voronoi)
custom_preview = CustomPreview(Geometry=[extrude, ruled_surface], Material=ColourSwatch(SwatchColor=RGB(230, 230, 230)))
