# Grasshopper definition attractor.gh (Grasshopper 1.0.7)
# plug-ins: MeshEdit Components

# ---- group: point attractor by remapping
# point attractor by remapping
number_slider = Slider(9, range=0..100)
# point attractor by vectors
number_slider_2 = Slider(2, range=0..100)
square = Square(Plane=PlaneXY(0, 0, 0), Size=1, ExtentX=number_slider, ExtentY=number_slider)  # -> Cells, flatten(Points)
construct_point = ConstructPoint(XCoordinate=Slider(5, range=0..100), YCoordinate=number_slider_2, ZCoordinate=0)
number_slider_3 = Slider(0.25, range=0..1)
number_slider_4 = Slider(0.5, range=0..1)
distance = Distance(PointA=square.Points, PointB=construct_point)
construct_domain = ConstructDomain(DomainStart=number_slider_3, DomainEnd=number_slider_4)
bounds = Bounds(Numbers=distance)
remap_numbers = RemapNumbers(Value=distance, Source=bounds, Target=construct_domain)  # -> Mapped, Clipped
graph_mapper = GraphMapper(
    remap_numbers.Mapped,
    x0=0,
    x1=1,
    y0=0,
    y1=1,
    container_name="Bezier",
    cpx=[0, 0.4012804925, 0.5025006533, 1],
    cpy=[0, 0, 1, 1])
circle = Circle(Plane=square.Points, Radius=graph_mapper)
gradient = Gradient(
    LowerLimit=number_slider_3,
    UpperLimit=number_slider_4,
    Parameter=graph_mapper,
    stops=[0: RGB(255, 255, 255), 1: RGB(0, 0, 0)])
mesh_frompoints = MeshFromPoints(Points=square.Points, UDirection=expr("x+1", number_slider), VDirection=expr("x+1", number_slider), Colour=gradient)

# ----
# point attractor by field
vector_2pt = Vector2Pt(Unitize=False)  # -> Vector, Length
