# Grasshopper definition attractors.gh (Grasshopper 1.0.7)
# Copyright: GNU General Public License 3.0

# ----
# attractor
# vector
# point attractor
cellsize = Slider(1, range=0..10)
extent_xy = Slider(20, range=0..100)
point = Point([Point(6.996659506, 11.73443181, 2.364918205), Point(21.66867103, 26.20195538, 1.861744119), Point(22.79335484, 11.32545588, 1.610157076)])
radius = Slider(0.8, range=0..1)
hexagonal = Hexagonal(Plane=PlaneXY(0, 0, 0), Size=cellsize, ExtentX=extent_xy, ExtentY=extent_xy)  # -> Cells, flatten(Points)
closest_point = ClosestPoint(Point=hexagonal.Points, Cloud=point)  # -> ClosestPoint, CPIndex, Distance
vector_2pt = Vector2Pt(PointA=hexagonal.Points, PointB=closest_point.ClosestPoint, Unitize=False)  # -> Vector, Length
circle_cnr = CircleCNR(Center=hexagonal.Points, Normal=vector_2pt.Vector, Radius=radius)
project = Project(Geometry=circle_cnr, Plane=PlaneXY(0, 0, 0))  # -> Geometry, Transform
boundary_surfaces = BoundarySurfaces(Edges=project.Geometry)
custom_preview = CustomPreview(Geometry=boundary_surfaces, Material=ColourSwatch(SwatchColor=RGB(0, 0, 0)))
surface = Surface(boundary_surfaces)

# ----
# curve attractor
cellsize_2 = Slider(1, range=0..10)
extent_xy_2 = Slider(20, range=0..100)
curve = Curve([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])
# transformation
radius_2 = Slider(0.8, range=0..1)
hexagonal_2 = Hexagonal(Plane=PlaneXY(0, 0, 0), Size=cellsize_2, ExtentX=extent_xy_2, ExtentY=extent_xy_2)  # -> Cells, flatten(Points)
pull_point = PullPoint(Point=hexagonal_2.Points, Geometry=curve, ClosestOnly=True)  # -> ClosestPoint, Distance
vector_2pt_2 = Vector2Pt(PointA=hexagonal_2.Points, PointB=pull_point.ClosestPoint, Unitize=False)  # -> Vector, Length
circle_cnr_2 = CircleCNR(Center=hexagonal_2.Points, Normal=vector_2pt_2.Vector, Radius=radius_2)
project_2 = Project(Geometry=circle_cnr_2, Plane=PlaneXY(0, 0, 0))  # -> Geometry, Transform
boundary_surfaces_2 = BoundarySurfaces(Edges=project_2.Geometry)
custom_preview_2 = CustomPreview(Geometry=boundary_surfaces_2, Material=ColourSwatch(SwatchColor=RGB(0, 0, 0)))
surface_2 = Surface(boundary_surfaces_2)

# ----
# point attractor
cellsize_3 = Slider(1, range=0..10)
extent_xy_3 = Slider(20, range=0..100)
point_2 = Point([Point(8, 5, 0), Point(10, 25, 0), Point(23, 18, 0)])
domain = Slider(8, range=0..10)
hexagonal_3 = Hexagonal(Plane=PlaneXY(0, 0, 0), Size=cellsize_3, ExtentX=extent_xy_3, ExtentY=extent_xy_3)  # -> flatten(Cells), flatten(Points)
closest_point_2 = ClosestPoint(Point=hexagonal_3.Points, Cloud=point_2)  # -> ClosestPoint, CPIndex, Distance
bounds = Bounds(Numbers=closest_point_2.Distance)
boundary_surfaces_3 = BoundarySurfaces(Edges=hexagonal_3.Cells)
remap_numbers = RemapNumbers(Value=closest_point_2.Distance, Source=bounds, Target=domain)  # -> Mapped, Clipped
unit_z = UnitZ(Factor=remap_numbers.Mapped)
extrude = Extrude(Base=boundary_surfaces_3, Direction=unit_z)
custom_preview_3 = CustomPreview(Geometry=extrude, Material=ColourSwatch(SwatchColor=RGB(204, 204, 204)))
brep = Brep(extrude)

cellsize_4 = Slider(1, range=0..10)
extent_xy_4 = Slider(20, range=0..100)
count = Slider(12, range=0..100)
seed = Slider(0, range=0..100)
domain_2 = Slider(0.5, range=0..1)
square = Square(Plane=PlaneXY(0, 0, 0), Size=cellsize_4, ExtentX=extent_xy_4, ExtentY=extent_xy_4)  # -> flatten(Cells), Points
brep_join = BrepJoin(Breps=square.Cells)  # -> Breps, Closed
area = Area(Geometry=square.Cells)  # -> Area, Centroid
populate_2d = Populate2D(Region=brep_join.Breps, Count=count, Seed=seed)
closest_point_3 = ClosestPoint(Point=area.Centroid, Cloud=populate_2d)  # -> ClosestPoint, CPIndex, Distance
bounds_2 = Bounds(Numbers=closest_point_3.Distance)
remap_numbers_2 = RemapNumbers(Value=closest_point_3.Distance, Source=bounds_2, Target=domain_2)  # -> Mapped, Clipped
circle = Circle(Plane=area.Centroid, Radius=remap_numbers_2.Mapped)
boundary_surfaces_4 = BoundarySurfaces(Edges=circle)
custom_preview_4 = CustomPreview(Geometry=boundary_surfaces_4, Material=ColourSwatch(SwatchColor=RGB(0, 0, 0)))
surface_3 = Surface(boundary_surfaces_4)

distance = Number(closest_point_3.Distance)
# color attractor
brep_2 = Brep(brep)
bounds_3 = Bounds(Numbers=distance)
remap_numbers_3 = RemapNumbers(Value=distance, Source=bounds_3, Target=Domain(0, 1))  # -> Mapped, Clipped
gradient = Gradient(
    LowerLimit=0,
    UpperLimit=1,
    Parameter=remap_numbers_3.Mapped,
    stops=[0: RGB(0, 0, 4), 0.167: RGB(50, 10, 94), 0.334: RGB(120, 28, 109), 0.501: RGB(205, 55, 84), 0.668: RGB(237, 105, 37), 0.835: RGB(251, 182, 26), 1: RGB(252, 255, 164)])
custom_preview_5 = CustomPreview(Geometry=brep_2, Material=gradient)

surface_4 = Surface(surface_3)
distance_2 = Number(closest_point_3.Distance)
bounds_4 = Bounds(Numbers=distance_2)
remap_numbers_4 = RemapNumbers(Value=distance_2, Source=bounds_4, Target=Domain(0, 1))  # -> Mapped, Clipped
gradient_2 = Gradient(
    LowerLimit=0,
    UpperLimit=1,
    Parameter=reverse(remap_numbers_4.Mapped),
    stops=[0: RGB(68, 1, 84), 0.167: RGB(68, 57, 131), 0.334: RGB(49, 104, 142), 0.501: RGB(33, 145, 140), 0.668: RGB(53, 183, 121), 0.835: RGB(144, 215, 67), 1: RGB(253, 231, 37)])
custom_preview_6 = CustomPreview(Geometry=surface_4, Material=gradient_2)
