# Grasshopper definition basics.gh (Grasshopper 1.0.7)
# Copyright: GNU General Public License 3.0

# ---- group: line from constructed points
X = Slider(10, range=0..10)
# line
X_2 = Slider(0, range=0..10)
Y = Slider(0, range=0..10)
Z = Slider(0, range=0..10)
Y_2 = Slider(10, range=0..10)
Z_2 = Slider(0, range=0..10)
construct_point = ConstructPoint(XCoordinate=X_2, YCoordinate=Y, ZCoordinate=Z)
construct_point_2 = ConstructPoint(XCoordinate=X, YCoordinate=Y_2, ZCoordinate=Z_2)
line = Line(StartPoint=construct_point, EndPoint=construct_point_2)

# ---- group: line from points defined in panels
line_2 = Line(StartPoint="0,0,0", EndPoint="10,10,0")

# ---- group: line from referenced points
# in the display menu turn on gumballs
# to edit these points in grasshopper
# right click on each point parameter
# to draw the points in rhino
point = Point(Point(10, 10, 0))
point_2 = Point(Point(0, 0, 0))
line_3 = Line(StartPoint=point_2, EndPoint=point)

# ---- group: line from rhino
# right click on the line parameter
# to draw a line in rhino
line_4 = Line(Line((0, 0, 0), (0, 10, 0)))

# ---- group: line from start, tangent, and length
length = Slider(10, range=0..10)
unit_z = UnitZ(Factor=1)
line_sdl = LineSDL(Start="0,0,0", Direction=unit_z, Length=length)

# ---- group: line from translated endpoint
X_3 = Slider(10, range=0..100)
X_4 = Slider(10, range=0..100)
unit_x = UnitX(Factor=X_3)
unit_y = UnitY(Factor=X_4)
move = Move(Geometry="0,0,0", Motion=unit_x)  # -> Geometry, Transform
move_2 = Move(Geometry=move.Geometry, Motion=unit_y)  # -> Geometry, Transform
line_5 = Line(StartPoint="0,0,0", EndPoint=move_2.Geometry)

# ---- group: point from xyz coordinates
# basics
# point
X_5 = Slider(0, range=0..10)
Y_3 = Slider(0, range=0..10)
Z_3 = Slider(0, range=0..10)
construct_point_3 = ConstructPoint(XCoordinate=X_5, YCoordinate=Y_3, ZCoordinate=Z_3)

# ---- group: point from text panel
point_3 = Point("0,0,0")

# ---- group: point from rhino
# right click on the point parameter
# to set the point position in rhino
point_4 = Point(Point(0, 0, 0))

# ---- group: curve from basic sine wave
range = Range(Domain="0 To 10", Steps=10)
sine = Sine(Value=range)
construct_point_4 = ConstructPoint(XCoordinate=range, YCoordinate=0, ZCoordinate=sine)
interpolate = Interpolate(Vertices=construct_point_4, Degree=3, Periodic=False, KnotStyle=1)  # -> Curve, Length, Domain

# ---- group: curve from sine wave
frequency = Slider(3, range=0..10)
amplitude = Slider(1.5, range=0..10)
range_2 = Range(Domain="0 To 10", Steps=10)
multiplication = Multiplication(A=range_2, B=frequency)
sine_2 = Sine(Value=multiplication)
multiplication_2 = Multiplication(A=sine_2, B=amplitude)
construct_point_5 = ConstructPoint(XCoordinate=range_2, YCoordinate=0, ZCoordinate=multiplication_2)
interpolate_2 = Interpolate(Vertices=construct_point_5, Degree=3, Periodic=False, KnotStyle=1)  # -> Curve, Length, Domain

# ---- group: polyline from referenced points
# polyline
# hold shift and drag
# to add multiple inputs
point_5 = Point(Point(0, 0, 0))
point_6 = Point(Point(0, 10, 0))
point_7 = Point(Point(10, 10, 0))
point_8 = Point(Point(0, 0, 0))
polyline = PolyLine(Vertices=[point_5, point_6, point_7, point_8], Closed=Toggle(True))

# ---- group: interpolate curve from referenced points
# curve
point_9 = Point(Point(0, 0, 0))
point_10 = Point(Point(4.433419722, 2.438250348, 0))
point_11 = Point(Point(14.80031398, -3.338300232, 0))
point_12 = Point(Point(18.92370416, -1.679907994, 0))
interpolate_3 = Interpolate(Vertices=[point_9, point_10, point_11, point_12], Degree=3, Periodic=False, KnotStyle=1)  # -> Curve, Length, Domain

# ---- group: rectangular surface
# planar surface
X_6 = Slider(5, range=0..10)
Y_4 = Slider(5, range=0..10)
rectangle = Rectangle(Plane=PlaneXY(0, 0, 0), XSize=X_6, YSize=Y_4, Radius=0)  # -> Rectangle, Length
boundary_surfaces = BoundarySurfaces(Edges=rectangle.Rectangle)

# ---- group: planar surface
X_7 = Slider(5, range=0..10)
Y_5 = Slider(5, range=0..10)
xy_plane = XYPlane(Origin="5,5,0")
plane_surface = PlaneSurface(Plane=xy_plane, XSize=X_7, YSize=Y_5)

# ---- group: circular surface
radius = Slider(5, range=0..10)
circle = Circle(Plane=PlaneXY(0, 0, 0), Radius=radius)
boundary_surfaces_2 = BoundarySurfaces(Edges=circle)

# ---- group: circular surface from reference
# right click on the circle parameter
# to draw a circle in rhino
circle_2 = Circle({Plane=Plane(origin=(0, 0, 0), x=(0, 1, 0), y=(-1, 0, 0)), Radius=10})
boundary_surfaces_3 = BoundarySurfaces(Edges=circle_2)

# ---- group: box
X_8 = Slider(5, range=0..10)
Y_6 = Slider(5, range=0..10)
Z_4 = Slider(5, range=0..10)
center_box = CenterBox(Base="5,5,5", X=X_8, Y=Y_6, Z=Z_4)

# ---- group: box from points
point_13 = Point(Point(0, 0, 0))
point_14 = Point(Point(2.94434859, 13.29909206, 3.771013062))
box_2pt = Box2Pt(PointA=point_13, PointB=point_14, Plane=PlaneXY(0, 0, 0))

# ---- group: surface from extruded curve
point_15 = Point(Point(0, 0, 0))
point_16 = Point(Point(0, 4.192741558, 2.409613435))
point_17 = Point(Point(0, 10.08962694, -1.082757608))
point_18 = Point(Point(0, 14.32175673, 0))
X_9 = Slider(10, range=0..10)
interpolate_4 = Interpolate(Vertices=[point_15, point_16, point_17, point_18], Degree=3, Periodic=False, KnotStyle=1)  # -> Curve, Length, Domain
unit_x_2 = UnitX(Factor=X_9)
extrude = Extrude(Base=interpolate_4.Curve, Direction=unit_x_2)

# ---- group: surface from two curves
point_19 = Point(Point(0, 0, 0))
point_20 = Point(Point(0, 4.192741558, 2.409613435))
point_21 = Point(Point(0, 10.08962694, -1.082757608))
point_22 = Point(Point(0, 14.32175673, 0))
point_23 = Point(Point(2.624243035, 0, 0))
point_24 = Point(Point(5.092306532, 4.192741558, 1.559650881))
point_25 = Point(Point(7.080326938, 11.21579694, 3.745747236))
point_26 = Point(Point(2.943325062, 14.32175673, 0))
interpolate_5 = Interpolate(Vertices=[point_19, point_20, point_21, point_22], Degree=3, Periodic=False, KnotStyle=1)  # -> Curve, Length, Domain
interpolate_6 = Interpolate(Vertices=[point_23, point_24, point_25, point_26], Degree=3, Periodic=False, KnotStyle=1)  # -> Curve, Length, Domain
ruled_surface = RuledSurface(CurveA=interpolate_5.Curve, CurveB=interpolate_6.Curve)

# ---- group: surface from mirrored curve
point_27 = Point(Point(0, 0, 0))
point_28 = Point(Point(0, 4.192741558, 2.409613435))
point_29 = Point(Point(0, 10.08962694, -1.082757608))
point_30 = Point(Point(0, 14.32175673, 0))
X_10 = Slider(10, range=0..10)
interpolate_7 = Interpolate(Vertices=[point_27, point_28, point_29, point_30], Degree=3, Periodic=False, KnotStyle=1)  # -> Curve, Length, Domain
xy_plane_2 = XYPlane(Origin=Point(0, 0, 0))
mirror = Mirror(Geometry=interpolate_7.Curve, Plane=xy_plane_2)  # -> Geometry, Transform
unit_x_3 = UnitX(Factor=X_10)
move_3 = Move(Geometry=mirror.Geometry, Motion=unit_x_3)  # -> Geometry, Transform
loft = Loft(
    Curves=[interpolate_7.Curve, move_3.Geometry],
    Options={Adjust=False, Closed=False, LoftEnds=0, LoftSimp=0, LoftType=0, Rebuild=10, Refit=0.01})

# ---- group: solid box from extruded rectangle
# 3D surface
X_11 = Slider(5, range=0..10)
Y_7 = Slider(5, range=0..10)
Z_5 = Slider(5, range=0..10)
rectangle_2 = Rectangle(Plane=PlaneXY(0, 0, 0), XSize=X_11, YSize=Y_7, Radius=0)  # -> Rectangle, Length
unit_z_2 = UnitZ(Factor=Z_5)
boundary_surfaces_4 = BoundarySurfaces(Edges=rectangle_2.Rectangle)
extrude_2 = Extrude(Base=boundary_surfaces_4, Direction=unit_z_2)
