# Grasshopper definition bitmap-sampler.gh (Grasshopper 1.0.7)
# Copyright: GNU General Public License 3.0

# ---- group: image sampler
# image sampler
xy = Slider(100, range=0..100)
start = Slider(0.5, range=0..1)
end = Slider(0.1, range=0..1)
square = Square(Plane=PlaneXY(0, 0, 0), Size=1, ExtentX=xy, ExtentY=xy)  # -> Cells, flatten(Points)
construct_domain = ConstructDomain(DomainStart=start, DomainEnd=end)
image_sampler = ImageSampler(
    square.Points,
    FilePath="C:\Users\baharmon\Downloads\robot-script-01.png",
    Filter="Value",
    Interpolate=False,
    Umax=100,
    Umin=0,
    Vmax=100,
    Vmin=0,
    Wrap=1)
remap_numbers = RemapNumbers(Value=image_sampler, Source=Domain(0, 1), Target=construct_domain)  # -> Mapped, Clipped
circle = Circle(Plane=square.Points, Radius=remap_numbers.Mapped)

xy_2 = Slider(50, range=0..100)
square_2 = Square(Plane=PlaneXY(0, 0, 0), Size=1, ExtentX=xy_2, ExtentY=xy_2)  # -> Cells, flatten(Points)
image_sampler_2 = ImageSampler(
    square_2.Points,
    FilePath="C:\Users\baharmon\Downloads\robot-script-01.png",
    Filter="Value",
    Interpolate=False,
    Umax=50,
    Umin=0,
    Vmax=50,
    Vmin=0,
    Wrap=1)
smaller_than = SmallerThan(FirstNumber=image_sampler_2, SecondNumber="1")  # -> SmallerThan, OrEqualTo
dispatch = Dispatch(List=square_2.Points, DispatchPattern=smaller_than.SmallerThan)  # -> ListA, ListB
dispatch_2 = Dispatch(List=image_sampler_2, DispatchPattern=smaller_than.SmallerThan)  # -> ListA, ListB
number = Number(dispatch_2.ListA)
point = Point(dispatch.ListA)

xy_3 = Slider(50, range=0..100)
square_3 = Square(Plane=PlaneXY(0, 0, 0), Size=1, ExtentX=xy_3, ExtentY=xy_3)  # -> flatten(Cells), flatten(Points)
area = Area(Geometry=square_3.Cells)  # -> Area, Centroid
image_sampler_3 = ImageSampler(
    area.Centroid,
    FilePath="C:\Users\baharmon\Downloads\robot-script-01.png",
    Filter="Value",
    Interpolate=False,
    Umax=50,
    Umin=0,
    Vmax=50,
    Vmin=0,
    Wrap=1)
smaller_than_2 = SmallerThan(FirstNumber=image_sampler_3, SecondNumber="1")  # -> SmallerThan, OrEqualTo
dispatch_3 = Dispatch(List=square_3.Cells, DispatchPattern=smaller_than_2.SmallerThan)  # -> ListA, ListB
dispatch_4 = Dispatch(List=image_sampler_3, DispatchPattern=smaller_than_2.SmallerThan)  # -> ListA, ListB
geometry = Geometry(dispatch_3.ListA)
number_2 = Number(dispatch_4.ListA)

# ---- group: extrude pattern
point_2 = Point(point)
number_3 = Number(number)
remap_numbers_2 = RemapNumbers(Value=number_3, Source=Domain(0, 1), Target="0.6 To 0.3")  # -> Mapped, Clipped
unit_z = UnitZ(Factor=remap_numbers_2.Mapped)
circle_2 = Circle(Plane=point_2, Radius=remap_numbers_2.Mapped)
extrude = Extrude(Base=circle_2, Direction=unit_z)
cap_holes = CapHoles(Brep=extrude)

geometry_2 = Geometry(geometry)
number_4 = Number(number_2)
remap_numbers_3 = RemapNumbers(Value=number_4, Source=Domain(0, 1), Target="0.6 To 0.3")  # -> Mapped, Clipped
unit_z_2 = UnitZ(Factor=remap_numbers_3.Mapped)
extrude_2 = Extrude(Base=geometry_2, Direction=unit_z_2)
cap_holes_2 = CapHoles(Brep=extrude_2)
