# Grasshopper definition brick_tiling.gh (Grasshopper 1.0.7)
# plug-ins: Parakeet

# ---- group: interlocking bricks
# using parakeet
number_slider = Slider(26, range=0..100)
number_slider_2 = Slider(10, range=0..10)
plane_surface = PlaneSurface(Plane=PlaneXY(0, 0, 0), XSize=Domain(0, 15), YSize=Domain(0, 15))
brick_type_h = BrickTypeH(BaseSurface=plane_surface, UCount=number_slider_2, VCount=number_slider_2, OffsetDistance=0)
list_length = ListLength(List=brick_type_h)
series = Series(Start="0.25", Step="0.005", Count=list_length)
jitter = Jitter(List=series, Jitter=0.2, Seed=number_slider)  # -> Values, Indices
unit_z = UnitZ(Factor=jitter.Values)
extrude = Extrude(Base=brick_type_h, Direction=unit_z)
cap_holes = CapHoles(Brep=extrude)
custom_preview = CustomPreview(Geometry=cap_holes, Material=ColourSwatch(SwatchColor=RGB(230, 230, 230)))

# ---- group: simple bricks
# using parakeet
number_slider_3 = Slider(26, range=0..100)
# bricks tiling patterns
plane_surface_2 = PlaneSurface(Plane=PlaneXY(0, 0, 0), XSize=Domain(0, 15), YSize=Domain(0, 15))
number_slider_4 = Slider(15, range=0..100)
brick_type_a = BrickTypeA(BaseSurface=plane_surface_2, UCount=number_slider_4, VCount=number_slider_4, OffsetDistance=0)
list_length_2 = ListLength(List=brick_type_a)
series_2 = Series(Start="0.1", Step="0.01", Count=list_length_2)
jitter_2 = Jitter(List=series_2, Jitter=0.2, Seed=number_slider_3)  # -> Values, Indices
unit_z_2 = UnitZ(Factor=jitter_2.Values)
line = Line(StartPoint=Point(0, 0, 0), EndPoint=unit_z_2)
extrude_linear = ExtrudeLinear(Profile=brick_type_a, OrientationP=PlaneXY(0, 0, 0), Axis=line)
cap_holes_2 = CapHoles(Brep=extrude_linear)
custom_preview_2 = CustomPreview(Geometry=cap_holes_2, Material=ColourSwatch(SwatchColor=RGB(230, 230, 230)))
