# Grasshopper definition cover-2.gh (Grasshopper 1.0.7)
# Copyright: GNU General Public License 3.0
# plug-ins: BitmapPlus, GraphicPlus

# ----
# fast noise
# with
# bitmap+
# procedural noise
seed = Slider(0, range=0..100)
width = Slider(85, range=0..200)
height = Slider(110, range=0..200)
depth = Slider(5000, range=0..10000)
list = ValueList({"Value": 0, "Perlin": 1, "Cubic": 2, "Simplex": 3, "WhiteNoise": 4}, selected="Perlin")
list_2 = ValueList({"Linear": 0, "Hermite": 1, "Quintic": 2}, selected="Hermite")
frequency = Slider(0.094, range=0..0.1)
procedural_noise = ProceduralNoise(Seed=seed, Width=width, Height=height, Depth=depth, Mode=list, Interpolation=list_2, Frequency=frequency)  # -> Image, Noise
prev_image = PrevImage(SmartBitmap=procedural_noise.Image)
image = Data(procedural_noise.Image)

# ----
# color
# gradient
colour_swatch = ColourSwatch(SwatchColor=RGB(0, 0, 0))
colour = Colour(colour_swatch)

# ----
# cellular noise
seed_2 = Slider(4, range=0..100)
width_2 = Slider(85, range=0..200)
height_2 = Slider(110, range=0..200)
depth_2 = Slider(36, range=0..500)
list_3 = ValueList({"Euclidean": 0, "Manhattan": 1, "Natural": 2}, selected="Euclidean")
list_4 = ValueList({"Value": 0, "Distance2": 2, "Dist2Add": 3, "Dist2Sub": 4, "Dist2Mul": 5, "Dist2Div": 6}, selected="Dist2Div")
procedural_cellular = ProceduralCellular(
    Seed=seed_2,
    Width=width_2,
    Height=height_2,
    Depth=depth_2,
    BoundaryMode=list_3,
    InterpolationMode=list_4,
    Jitter=Slider(0.5, range=0..1),
    Frequency=Slider(0.12, range=0..1))
prev_image_2 = PrevImage(SmartBitmap=procedural_cellular)
image_2 = Data(procedural_cellular)

image_3 = Data(image_2)
# construct grid
bitmap_properties = BitmapProperties(Image=image_3)  # -> Boundary, Width, Height, HorizontalResolution, VerticalResolution, Format
mesh_plane = MeshPlane(
    Boundary=bitmap_properties.Boundary,
    WidthCount=expr("x-1", bitmap_properties.Width),
    HeightCount=expr("x-1", bitmap_properties.Height))  # -> Mesh, Area
deconstruct_mesh = DeconstructMesh(Mesh=mesh_plane.Mesh)  # -> Vertices, Faces, Colours, Normals
point = Point(deconstruct_mesh.Vertices)

image_4 = Data(image_3)
# extract noise
deconstruct_bitmap = DeconstructBitmap(Image=image_4)
split_ahsv = SplitAHSV(Colour=deconstruct_bitmap)  # -> Alpha, Hue, Saturation, Value
noise = Number(split_ahsv.Value)

# ----
# circle
point_2 = Point(point)
noise_2 = Number(noise)
threshold = Slider(0.06, range=0..0.1)
remap_numbers = RemapNumbers(Value=noise_2, Source=Domain(0, 1), Target="0.05 To 0.5")  # -> Mapped, Clipped
larger_than = LargerThan(FirstNumber=remap_numbers.Mapped, SecondNumber=threshold)  # -> LargerThan, OrEqualTo
cull_pattern = CullPattern(List=point_2, CullPattern=larger_than.LargerThan)
cull_pattern_2 = CullPattern(List=remap_numbers.Mapped, CullPattern=larger_than.LargerThan)
circle = Circle(Plane=cull_pattern, Radius=cull_pattern_2)
bounds = Bounds(Numbers=cull_pattern_2)
remap_numbers_2 = RemapNumbers(Value=cull_pattern_2, Source=bounds, Target=Domain(0, 1))  # -> Mapped, Clipped
circle_2 = Circle(circle)
noise_3 = Number(remap_numbers_2.Mapped)

# ----
# export
noise_4 = Number(noise_3)
gradient = Gradient(
    LowerLimit=0,
    UpperLimit=1,
    Parameter=noise_4,
    stops=[0: RGB(68, 1, 84), 0.167: RGB(68, 57, 131), 0.334: RGB(49, 104, 142), 0.501: RGB(33, 145, 140), 0.668: RGB(53, 183, 121), 0.835: RGB(144, 215, 67), 1: RGB(253, 231, 37)])
colour_2 = Colour(gradient)

# ----
# graphic+ plugin
circle_3 = Circle(circle_2)
colour_3 = Colour(colour_2)
rectangle = Rectangle(bitmap_properties.Boundary)
width_3 = Number(expr("x*10", width))
height_3 = Number(expr("x*10", height))
resolution = Slider(300, range=0..1000)
solid_fill = SolidFill(ShapeGeometry=circle_3, Color=colour_3)
stroke = Stroke(ShapeGeometry=solid_fill, Color=RGB(0, 0, 0), Weight="0", EndCap=0)
construct_drawing = ConstructDrawing(ShapesGeometry=flatten(stroke), Boundary=rectangle, Width=width_3, Height=height_3, Color=RGBA(255, 255, 255, 0))  # -> Drawing, Boundary

noise_5 = Number(noise_3)
gradient_2 = Gradient(
    LowerLimit=0,
    UpperLimit=1,
    Parameter=noise_5,
    stops=[0: RGB(0, 0, 4), 0.167: RGB(44, 17, 95), 0.334: RGB(114, 31, 129), 0.501: RGB(183, 55, 121), 0.668: RGB(241, 96, 93), 0.835: RGB(254, 176, 120), 1: RGB(252, 253, 191)])
colour_4 = Colour(gradient_2)

drawing_viewer = DrawingViewer(Drawing=construct_drawing.Drawing, Resolution=resolution)

noise_6 = Number(noise_3)
gradient_3 = Gradient(
    LowerLimit=0,
    UpperLimit=1,
    Parameter=noise_6,
    stops=[0: RGB(11, 3, 5), 0.1: RGB(36, 22, 41), 0.2: RGB(56, 42, 84), 0.3: RGB(64, 63, 128), 0.4: RGB(57, 93, 155), 0.5: RGB(52, 122, 162), 0.6: RGB(52, 150, 169), 0.7: RGB(61, 179, 172), 0.8: RGB(95, 206, 172), 0.9: RGB(168, 225, 189), 1: RGB(222, 244, 228)])
colour_5 = Colour(gradient_3)

# ----
# fractal noise
seed_3 = Slider(0, range=0..100)
width_4 = Slider(85, range=0..200)
height_4 = Slider(110, range=0..200)
depth_3 = Slider(5000, range=0..10000)
list_5 = ValueList({"Value": 0, "Perlin": 1, "Cubic": 2, "Simplex": 3, "WhiteNoise": 4}, selected="Perlin")
list_6 = ValueList({"Linear": 0, "Hermite": 1, "Quintic": 2}, selected="Hermite")
frequency_2 = Slider(0.094, range=0..0.1)
list_7 = ValueList({"FBM": 0, "Billow": 1, "Rigid": 2}, selected="Rigid")
octaves = Slider(4, range=0..10)
lacunarity = Slider(2.1, range=0..5)
gain = Slider(0.45, range=0..1)
procedural_noise_2 = ProceduralNoise(Seed=seed_3, Width=width_4, Height=height_4, Depth=depth_3, Mode=list_5, Interpolation=list_6, Frequency=frequency_2)  # -> Image, Noise
procedural_fractal_pass = ProceduralFractalPass(Noise=procedural_noise_2.Noise, Mode=list_7, Octaves=octaves, Lacunity=lacunarity, Gain=gain)
prev_image_3 = PrevImage(SmartBitmap=procedural_fractal_pass)
image_5 = Data(procedural_fractal_pass)

noise_7 = Number(noise_3)
gradient_4 = Gradient(
    LowerLimit=0,
    UpperLimit=1,
    Parameter=noise_7,
    stops=[0: RGB(225, 216, 226), 0.1: RGB(165, 191, 202), 0.2: RGB(109, 144, 191), 0.3: RGB(94, 87, 176), 0.4: RGB(83, 29, 124), 0.5: RGB(47, 20, 54), 0.6: RGB(99, 24, 75), 0.7: RGB(158, 59, 79), 0.8: RGB(192, 116, 93), 0.9: RGB(208, 178, 158), 1: RGB(225, 216, 225)])
colour_6 = Colour(gradient_4)

noise_8 = Number(noise_3)
gradient_5 = Gradient(LowerLimit=0, UpperLimit=1, Parameter=noise_8, stops=[0: RGB(220, 220, 220), 1: RGB(169, 169, 169)])
colour_7 = Colour(gradient_5)
