# Grasshopper definition curve-array-v2.gh (Grasshopper 1.0.7)
# Copyright: GNU General Public License 3.0

# ---- group: tree cluster
# curve array
trunk_height = Slider(5, range=0..100)
trunk_radius = Slider(0.5, range=0..1)
tree_height = Slider(20, range=0..100)
divisions = Slider(3, range=0..10)
canopy_radius = Slider(5, range=0..10)
conical_tree = ConicalTree(trunk_height=trunk_height, relay=trunk_radius, A=tree_height, relay_2=divisions, relay_3=canopy_radius)  # -> pipe_2, result

# ---- group: curve
point = Point([Point(0, 0, 0), Point(10, 10, 0.008295480726), Point(30, -10, 0), Point(60, 30, 0), Point(90, -21.85896853, 0), Point(111.1573209, 0, 0)])
spacing = Slider(12, range=0..100)
interpolate = Interpolate(Vertices=point, Degree=3, Periodic=False, KnotStyle=1)  # -> Curve, Length, Domain
divide_distance = DivideDistance(Curve=interpolate.Curve, Distance=spacing)  # -> Points, Tangents, Parameters
point_2 = Point(divide_distance.Points)

# ---- group: tree cluster
# tree of trees
trunk_height_2 = Slider(5, range=0..100)
trunk_radius_2 = Slider(0.5, range=0..1)
tree_height_2 = Slider(20, range=0..100)
divisions_2 = Slider(3, range=0..10)
canopy_radius_2 = Slider(5, range=0..10)
conical_tree_2 = ConicalTree(trunk_height=trunk_height_2, relay=trunk_radius_2, A=tree_height_2, relay_2=divisions_2, relay_3=canopy_radius_2)  # -> pipe_2, result

# ---- group: curve
point_3 = Point([Point(0, 0, 0), Point(10, 10, 0.03807217425), Point(30, -10, 0), Point(60, 30, 0), Point(90, -21.85896853, 0), Point(111.1573209, 0, 0)])
# random scaling
spacing_2 = Slider(12, range=0..100)
interpolate_2 = Interpolate(Vertices=point_3, Degree=3, Periodic=False, KnotStyle=1)  # -> Curve, Length, Domain
divide_distance_2 = DivideDistance(Curve=interpolate_2.Curve, Distance=spacing_2)  # -> Points, Tangents, Parameters
point_4 = Point(divide_distance_2.Points)

# ---- group: tree cluster
trunk_height_3 = Slider(5, range=0..100)
trunk_radius_3 = Slider(0.5, range=0..1)
tree_height_3 = Slider(20, range=0..100)
divisions_3 = Slider(3, range=0..10)
canopy_radius_3 = Slider(5, range=0..10)
conical_tree_3 = ConicalTree(trunk_height=trunk_height_3, relay=trunk_radius_3, A=tree_height_3, relay_2=divisions_3, relay_3=canopy_radius_3)  # -> pipe_2, result

# ---- group: curve
point_5 = Point([Point(0, 0, 0), Point(10, 10, 0.03807217425), Point(30, -10, 0), Point(60, 30, 0), Point(90, -21.85896853, 0), Point(111.1573209, 0, 0)])
spacing_3 = Slider(12, range=0..100)
interpolate_3 = Interpolate(Vertices=point_5, Degree=3, Periodic=False, KnotStyle=1)  # -> Curve, Length, Domain
divide_distance_3 = DivideDistance(Curve=interpolate_3.Curve, Distance=spacing_3)  # -> Points, Tangents, Parameters
point_6 = Point(divide_distance_3.Points)

# ----
seed = Slider(0, range=0..100)
merge = Merge(Data1=conical_tree_2.pipe_2, Data2=conical_tree_2.result)
merge_2 = Merge(Data1=conical_tree_3.pipe_2, Data2=conical_tree_3.result)

# ---- group: translate trees
vector_2pt = Vector2Pt(PointA="0,0,0", PointB=point_2, Unitize=False)  # -> Vector, Length
move = Move(Geometry=conical_tree.pipe_2, Motion=vector_2pt.Vector)  # -> Geometry, Transform
move_2 = Move(Geometry=conical_tree.result, Motion=vector_2pt.Vector)  # -> Geometry, Transform
canopy_color = ColourSwatch(SwatchColor=RGBA(58, 94, 84, 232))
trunk_color = ColourSwatch(SwatchColor=RGB(139, 76, 57))
custom_preview = CustomPreview(Geometry=move.Geometry, Material=trunk_color)
custom_preview_2 = CustomPreview(Geometry=move_2.Geometry, Material=canopy_color)

# ----
vector_2pt_2 = Vector2Pt(PointA="0,0,0", PointB=point_4, Unitize=False)  # -> Vector, Length
vector_2pt_3 = Vector2Pt(PointA="0,0,0", PointB=point_6, Unitize=False)  # -> Vector, Length
list_length = ListLength(List=point_6)
move_3 = Move(Geometry=merge, Motion=vector_2pt_2.Vector)  # -> Geometry, Transform
move_4 = Move(Geometry=merge_2, Motion=vector_2pt_3.Vector)  # -> Geometry, Transform
random = Random(Range="0.75 To 1", Number=list_length, Seed=seed)
explode_tree = ExplodeTree(Data=move_3.Geometry)  # -> Branch0, Branch1
scale = Scale(Geometry=move_4.Geometry, Center=point_6, Factor=random)  # -> Geometry, Transform
canopy_color_2 = ColourSwatch(SwatchColor=RGBA(58, 94, 84, 232))
trunk_color_2 = ColourSwatch(SwatchColor=RGB(139, 76, 57))
custom_preview_3 = CustomPreview(Geometry=explode_tree.Branch0, Material=trunk_color_2)
custom_preview_4 = CustomPreview(Geometry=explode_tree.Branch1, Material=canopy_color_2)
explode_tree_2 = ExplodeTree(Data=scale.Geometry)  # -> Branch0, Branch1
canopy_color_3 = ColourSwatch(SwatchColor=RGBA(58, 94, 84, 232))
trunk_color_3 = ColourSwatch(SwatchColor=RGB(139, 76, 57))
custom_preview_5 = CustomPreview(Geometry=explode_tree_2.Branch0, Material=trunk_color_3)
custom_preview_6 = CustomPreview(Geometry=explode_tree_2.Branch1, Material=canopy_color_3)

# ==== cluster ConicalTree
trunk_height = ClusterInput()
relay = ClusterInput()
A = ClusterInput()
relay_2 = ClusterInput()
relay_3 = ClusterInput()
unit_z = UnitZ(Factor=trunk_height)
subtraction = Subtraction(A=A, B=trunk_height)
move = Move(Geometry="0,0,0", Motion=unit_z)  # -> Geometry, Transform
top_of_trunk = Point(move.Geometry)
unit_z_2 = UnitZ(Factor=subtraction)
division = Division(A=subtraction, B=relay_2)
move_2 = Move(Geometry=top_of_trunk, Motion=unit_z_2)  # -> Geometry, Transform
line = Line(StartPoint="0,0,0", EndPoint=move.Geometry)
line_2 = Line(StartPoint=top_of_trunk, EndPoint=move_2.Geometry)
pipe = Pipe(Curve=line, Radius=relay, Caps="1")
divide_curve = DivideCurve(Curve=line_2, Count=relay_2, Kinks=False)  # -> Points, Tangents, Parameters
pipe_2 = ClusterOutput(pipe)
split_list = SplitList(List=divide_curve.Points, Index=relay_2)  # -> ListA, ListB
range = Range(Domain="1 To 0.5", Steps=expr("x-1", relay_2))
cone = Cone(Base=split_list.ListA, Radius=relay_3, Length=division)  # -> Cone, Tip
multiplication = Multiplication(A=range, B="2")
scale_nu = ScaleNU(Geometry=cone.Cone, Plane=split_list.ListA, ScaleX=range, ScaleY=range, ScaleZ=multiplication)  # -> Geometry, Transform
cap_holes = CapHoles(Brep=scale_nu.Geometry)
solid_union = SolidUnion(Breps=cap_holes)
result = ClusterOutput(solid_union)
