# Grasshopper definition delaunay-triangulation.gh (Grasshopper 1.0.7)
# Copyright: GNU General Public License 3.0
# plug-ins: GraphicPlus

# ---- group: generate voronoi diagram
# voronoi diagram
count = Slider(6, range=0..10)
seed = Slider(8, range=0..10)
X = Slider(10, range=0..100)
Y = Slider(10, range=0..100)
rectangle = Rectangle(Plane=PlaneXY(0, 0, 0), XSize=X, YSize=Y, Radius=0)  # -> Rectangle, Length
populate_2d = Populate2D(Region=rectangle.Rectangle, Count=count, Seed=seed)
voronoi = Voronoi(Points=populate_2d, Boundary=rectangle.Rectangle, BruteForceOverride=False)
point = Point(populate_2d)
curve = Curve(voronoi)

# ---- group: generate delaunay mesh
# delaunay triangulation
point_2 = Point(point)
delaunay_mesh = DelaunayMesh(Points=point_2, Plane=PlaneXY(0, 0, 0))
mesh_edges = MeshEdges(Mesh=delaunay_mesh)  # -> NakedEdges, InteriorEdges, NonManifoldEdges
face_circles = FaceCircles(Mesh=delaunay_mesh)  # -> Centers, Ratio
curve_2 = Curve([mesh_edges.NakedEdges, mesh_edges.InteriorEdges])
circle = Circle(face_circles.Centers)
point_3 = Point(face_circles.Centers)

# ---- group: delaunay mesh
# export
# graphic+ plugin
delaunay_mesh_2 = Curve(curve_2)
weight = Slider(2, range=0..10)
stroke = Stroke(ShapeGeometry=delaunay_mesh_2, Color=ColourSwatch(SwatchColor=RGB(0, 0, 0)), Weight=weight, EndCap=2)

# ---- group: voronoi diagram
voronoi_diagram = Curve(curve)
weight_2 = Slider(2, range=0..10)
stroke_2 = Stroke(ShapeGeometry=voronoi_diagram, Color=ColourSwatch(SwatchColor=RGB(92, 92, 92)), Weight=weight_2, EndCap=2)

# ---- group: circumcircles
circumcircles = Curve(circle)
weight_3 = Slider(1, range=0..10)
panel = Panel("""3
1""")
stroke_3 = Stroke(
    ShapeGeometry=circumcircles,
    Color=ColourSwatch(SwatchColor=RGB(204, 204, 204)),
    Weight=weight_3,
    Pattern=panel,
    EndCap=2)

# ---- group: points
points = Point(point)
circle_2 = Circle(Plane=points, Radius="0.2")
weight_4 = Slider(0, range=0..10)
solid_fill = SolidFill(ShapeGeometry=circle_2, Color=ColourSwatch(SwatchColor=RGB(0, 0, 0)))
stroke_4 = Stroke(ShapeGeometry=solid_fill, Color=ColourSwatch(SwatchColor=RGB(204, 204, 204)), Weight=weight_4, EndCap=2)

# ---- group: centroids
centroids = Point(point_3)
circle_3 = Circle(Plane=centroids, Radius="0.2")
weight_5 = Slider(0, range=0..10)
solid_fill_2 = SolidFill(ShapeGeometry=circle_3, Color=ColourSwatch(SwatchColor=RGB(178, 178, 178)))
stroke_5 = Stroke(ShapeGeometry=solid_fill_2, Color=ColourSwatch(SwatchColor=RGB(176, 176, 176)), Weight=weight_5, EndCap=2)

# ---- group: drawing
data = Data(flatten([stroke, stroke_3, stroke_5]))
xy = Slider(250, range=0..1000)
resolution = Slider(300, range=0..1000)
construct_drawing = ConstructDrawing(ShapesGeometry=data, Width=xy, Height=xy, Color=RGBA(255, 255, 255, 0))  # -> Drawing, Boundary

# ----
drawing_viewer = DrawingViewer(Drawing=construct_drawing.Drawing, Resolution=resolution)
