# Grasshopper definition docofossor.gh (Grasshopper 1.0.7)
# plug-ins: Pufferfish, Docofossor, Section To XY

# ---- group: import xyz data with docofossor
path = FilePath("C:\Users\baharmon\AppData\Roaming\Grasshopper\Libraries\docofossor\example_DTM.xyz")
dfimportxyz = ImportXYZ(F=path)
dfgridmesh = GridMesh(Df=dfimportxyz)
bounding_rectangle = BoundingRectangle(Geometry=dfgridmesh, Plane=PlaneXY(0, 0, 0), Axis=0, Slide=0, Union=True)  # -> Bounding, DimensionX, DimensionY

# ---- group: define circular regions
radius = Slider(4, range=0..10)
md_slider = MDSlider(
    SliderMode=0,
    slider_value=Point(0.2739534378, 0.2309875488, 0.5),
    x_domain=Domain(0, 1),
    y_domain=Domain(0, 1),
    z_domain=Domain(0, 1))
radius_2 = Slider(8, range=0..10)
md_slider_2 = MDSlider(
    SliderMode=0,
    slider_value=Point(0.3172764662, 0.5148374976, 0.5),
    x_domain=Domain(0, 1),
    y_domain=Domain(0, 1),
    z_domain=Domain(0, 1))
multiplication = Multiplication(A=bounding_rectangle.DimensionX, B=[md_slider_2, md_slider])
relay = Relay([radius_2, radius])
circle = Circle(Plane=multiplication, Radius=relay)

# ---- group: import xyz data with docofossor
# Docofossor
path_2 = FilePath("C:\Users\baharmon\AppData\Roaming\Grasshopper\Libraries\docofossor\example_DTM.xyz")
dfimportxyz_2 = ImportXYZ(F=path_2)
dfgridmesh_2 = GridMesh(Df=dfimportxyz_2)

# ---- group: grade path along curve
point = Point([Point(0, 40, 0), Point(10, 28.36286679, 0), Point(25, 24, 0), Point(40, 18, 0), Point(50, 10, 0)])
interpolate = Interpolate(Vertices=point, Degree=3, Periodic=False, KnotStyle=1)  # -> Curve, Length, Domain
dfcutfillinpath = CutFillInPath(Df=dfimportxyz_2, Crv=interpolate.Curve, W=Slider(2, range=0..10), Sa=Slider(30, range=0..90))  # -> Df, Vol
dfgridmesh_3 = GridMesh(Df=dfcutfillinpath.Df)

# ---- group: vector field
dfgridpoints = GridPoints(Df=dfimportxyz_2)
dfslopevectors = SlopeVectors(Df=dfimportxyz_2)
reverse = Reverse(Vector=dfslopevectors)
vdis = VectorDisplay(Anchor=dfgridpoints, Vector=reverse)

# ---- group: analysis with bison
bounding_rectangle_2 = BoundingRectangle(Geometry=dfgridmesh_2, Plane=PlaneXY(0, 0, 0), Axis=0, Slide=0, Union=True)  # -> Bounding, DimensionX, DimensionY
number_slider = Slider(1, range=0..1)
aspect = Aspect(Mesh=dfgridmesh_2, Angle="270")  # -> Mesh, Colors, Tags, Aspect
scale_nu = ScaleNU(
    Geometry=bounding_rectangle_2.Bounding,
    Plane=bounding_rectangle_2.Bounding,
    ScaleX=number_slider,
    ScaleY=number_slider,
    ScaleZ=1)  # -> Geometry, Transform
legend = Legend(Colour=aspect.Colors, Tags=aspect.Tags, LegendType=1)
flow = Flow(Boundary=scale_nu.Geometry, Mesh=dfgridmesh_2, Grid="1", Steps="50", Length="0.5")
custom_preview = CustomPreview(Geometry=flow, Material=ColourSwatch(SwatchColor=RGB(255, 255, 255)))

# ---- group: noise with docofossor
smoothing = Slider(4, range=0..16)
curve = Curve(circle)
wavelength = Slider(2, range=0..16)
amplitude = Slider(0.1, range=0..1)
wavelength_2 = Slider(4, range=0..16)
amplitude_2 = Slider(4, range=0..16)
smoothing_2 = Slider(0, range=0..16)
pi = Pi(Factor=amplitude)
noise = Noise(Df=dfimportxyz, Crv=curve, Wl=wavelength_2, A=amplitude_2, S=smoothing_2)
sine_wave = SineWave(Df=dfimportxyz, Crv=curve, Wl=wavelength, A=pi, S=smoothing)
grid_mesh = GridMesh(Df=noise)
grid_mesh_2 = GridMesh(Df=sine_wave)
custom_preview_2 = CustomPreview(Geometry=grid_mesh, Material=ColourSwatch(SwatchColor=RGB(230, 230, 230)))
custom_preview_3 = CustomPreview(Geometry=grid_mesh_2, Material=ColourSwatch(SwatchColor=RGB(230, 230, 230)))

# ---- group: difference
grid_compare = GridCompare(Df1=dfimportxyz, Df2=noise)  # -> Cut, Fill, Balance, Df
grid_mesh_3 = GridMesh(Df=grid_compare.Df)

# ---- group: aspect with bison
control_knob = ControlKnob(Decimals=0, Limit=True, Maximum=360, Minimum=0, Range=360, Value=270)
control_knob_2 = ControlKnob(Decimals=0, Limit=True, Maximum=360, Minimum=0, Range=360, Value=270)
aspect_2 = Aspect(Mesh=grid_mesh, Angle=control_knob_2)  # -> Mesh, Colors, Tags, Aspect
aspect_3 = Aspect(Mesh=grid_mesh_2, Angle=control_knob)  # -> Mesh, Colors, Tags, Aspect
legend_2 = Legend(Colour=aspect_2.Colors, Tags=aspect_2.Tags, LegendType=1)
legend_3 = Legend(Colour=aspect_3.Colors, Tags=aspect_3.Tags, LegendType=1)

# ---- group: flowlines with bison
flow_2 = Flow(Boundary=bounding_rectangle.Bounding, Mesh=grid_mesh_2, Grid="1", Steps="20", Length="0.5")  # disabled
custom_preview_4 = CustomPreview(Geometry=flow_2, Material=ColourSwatch(SwatchColor=RGB(255, 255, 255)))

# ---- group: vector field
dfgridpoints_2 = GridPoints(Df=noise)
dfslopevectors_2 = SlopeVectors(Df=noise)
reverse_2 = Reverse(Vector=dfslopevectors_2)
vdis_2 = VectorDisplay(Anchor=dfgridpoints_2, Vector=reverse_2)
