# Grasshopper definition drifting-meadow.gh (Grasshopper 1.0.7)
# plug-ins: Heteroptera, Pufferfish, EleFront, EdiTree, Noise 4D

# ---- group: field from simplex noise
# using 4D noise
plants_per_cell = Slider(64, range=1..100)
extent = Slider(1, range=0..360)
time = Slider(36, range=0..100)
scale = Slider(5, range=0..10)
amplitude = Slider(0.1, range=0..10)
division = Division(A=1, B=plants_per_cell)
multiplication = Multiplication(A=extent, B=plants_per_cell)
square = Square(Plane=PlaneXY(0, 0, 0), Size=division, ExtentX=multiplication, ExtentY=multiplication)  # -> Cells, flatten(Points)
simplexnoise = SimplexNoise(Values=square.Points, Time=time, Scale=scale)
multiplication_2 = Multiplication(A=simplexnoise, B=amplitude)
vector_xyz = VectorXYZ(XComponent=multiplication_2, YComponent=multiplication_2, ZComponent=0)  # -> Vector, Length
move = Move(Geometry=square.Points, Motion=vector_xyz.Vector)  # -> Geometry, Transform

# ---- group: ground
# noise field
depth = Slider(-0.025, range=-1..0)
unit_z = UnitZ(Factor=depth)
rectangle = Rectangle(Plane=PlaneXY(0, 0, 0), XSize=extent, YSize=extent, Radius=0)  # -> Rectangle, Length
boundary_surfaces = BoundarySurfaces(Edges=rectangle.Rectangle)
extrude = Extrude(Base=boundary_surfaces, Direction=unit_z)
define_object_attributes = DefineObjectAttributes(Layer="ground")
bake_objects = BakeObjects(Geometry=extrude, Attributes=define_object_attributes, Bake=False)

# ----
noise_factor = Number(multiplication_2)
point = Point(move.Geometry)
larger_than = LargerThan(FirstNumber=noise_factor, SecondNumber="0.0")  # -> LargerThan, OrEqualTo
dispatch = Dispatch(List=point, DispatchPattern=larger_than.OrEqualTo)  # -> ListA, ListB
dispatch_2 = Dispatch(List=noise_factor, DispatchPattern=larger_than.OrEqualTo)  # -> ListA, ListB

# ---- group: import thea plant(s)
# using elefront
extended_geometry = ExtendedGeometry([<elefrontblock referenced from the Rhino model> x6])

# using elefront
extended_geometry_2 = ExtendedGeometry([<elefrontblock referenced from the Rhino model> x5])

# ----
surface = Surface(boundary_surfaces)

# ---- group: distribute plants by noise map
# meadow drifts
# using pufferfish
# using heteroptera
list_length = ListLength(List=extended_geometry_2)
point_2 = Point(dispatch.ListA)
number = Number(dispatch_2.ListA)
jitter = Jitter(List=point_2, Jitter="1", Seed=2)  # -> Values, Indices
divide_list = DivideList(List=jitter.Values, Number=list_length)  # -> Chunk, Remainder
divide_list_2 = DivideList(List=extended_geometry_2, Number=list_length)  # -> Chunk, Remainder
min_max = MinMax(Number=number)  # -> Minimum, Maximum
move_to_point = MoveToPoint(Geometry=divide_list_2.Chunk, PointA=Point(0, 0, 0), PointB=divide_list.Chunk)  # -> flatten(Moved), flatten(Vector), Transform
construct_domain = ConstructDomain(DomainStart=min_max.Minimum, DomainEnd=min_max.Maximum)
domain = Panel("0.5 To 1.0")
remap_numbers = RemapNumbers(Value=number, Source=construct_domain, Target=domain)  # -> Mapped, Clipped
list_length_2 = ListLength(List=move_to_point.Moved)
random = Random(Range="0 To 360", Number=list_length_2, Seed=2)
rotate = Rotate(Geometry=move_to_point.Moved, Angle=degrees(random), Plane=move_to_point.Vector)  # -> Geometry, Transform
curve = Curve(surface)
polygon_center = PolygonCenter(Polyline=curve)  # -> CenterV, CenterE, CenterA
scale_2 = Scale(Geometry=rotate.Geometry, Center=move_to_point.Vector, Factor=remap_numbers.Mapped)  # -> Geometry, Transform
center = Center(Geometrical=scale_2.Geometry)  # -> Center, Dimension
scale_3 = Scale(Geometry=curve, Center=polygon_center.CenterA, Factor="0.98")  # -> Geometry, Transform
point_in_curve = PointInCurve(Point=center.Center, Curve=scale_3.Geometry)  # -> Relationship, Point
equality = Equality(FirstNumber=point_in_curve.Relationship, SecondNumber="0")  # -> Equality, Inequality
define_object_attributes_2 = DefineObjectAttributes(Layer="first-drift")
cull_pattern = CullPattern(List=scale_2.Geometry, CullPattern=equality.Inequality)
bake_objects_2 = BakeObjects(Geometry=cull_pattern, Attributes=define_object_attributes_2, Bake=False)

# ---- group: randomly distribute meadow plants / import thea plant(s)
# random grasses
# using elefront
extended_geometry_3 = ExtendedGeometry([<elefrontblock referenced from the Rhino model> x2])

# ---- group: distribute plants by noise map
# using pufferfish
# using heteroptera
list_length_3 = ListLength(List=extended_geometry)
point_3 = Point(dispatch.ListB)
number_2 = Number(dispatch_2.ListB)
jitter_2 = Jitter(List=point_3, Jitter="1", Seed=2)  # -> Values, Indices
divide_list_3 = DivideList(List=extended_geometry, Number=list_length_3)  # -> Chunk, Remainder
divide_list_4 = DivideList(List=jitter_2.Values, Number=list_length_3)  # -> Chunk, Remainder
min_max_2 = MinMax(Number=number_2)  # -> Minimum, Maximum
move_to_point_2 = MoveToPoint(Geometry=divide_list_3.Chunk, PointA=Point(0, 0, 0), PointB=divide_list_4.Chunk)  # -> flatten(Moved), flatten(Vector), Transform
construct_domain_2 = ConstructDomain(DomainStart=min_max_2.Minimum, DomainEnd=min_max_2.Maximum)
domain_2 = Panel("0.5 To 1.0")
remap_numbers_2 = RemapNumbers(Value=number_2, Source=construct_domain_2, Target=domain_2)  # -> Mapped, Clipped
list_length_4 = ListLength(List=move_to_point_2.Moved)
random_2 = Random(Range="0 To 360", Number=list_length_4, Seed=2)
rotate_2 = Rotate(Geometry=move_to_point_2.Moved, Angle=degrees(random_2), Plane=move_to_point_2.Vector)  # -> Geometry, Transform
curve_2 = Curve(surface)
polygon_center_2 = PolygonCenter(Polyline=curve_2)  # -> CenterV, CenterE, CenterA
scale_4 = Scale(Geometry=rotate_2.Geometry, Center=move_to_point_2.Vector, Factor=remap_numbers_2.Mapped)  # -> Geometry, Transform
center_2 = Center(Geometrical=scale_4.Geometry)  # -> Center, Dimension
scale_5 = Scale(Geometry=curve_2, Center=polygon_center_2.CenterA, Factor="0.98")  # -> Geometry, Transform
point_in_curve_2 = PointInCurve(Point=center_2.Center, Curve=scale_5.Geometry)  # -> Relationship, Point
equality_2 = Equality(FirstNumber=point_in_curve_2.Relationship, SecondNumber="0")  # -> Equality, Inequality
define_object_attributes_3 = DefineObjectAttributes(Layer="second-drift")
cull_pattern_2 = CullPattern(List=scale_4.Geometry, CullPattern=equality_2.Inequality)
bake_objects_3 = BakeObjects(Geometry=cull_pattern_2, Attributes=define_object_attributes_3, Bake=False)

# ----
polygon_center_3 = PolygonCenter(Polyline=surface)  # -> CenterV, CenterE, CenterA

# ---- group: randomly distribute meadow plants
# using pufferfish
# using editree
count = Slider(10000, range=0..10000)
list_length_5 = ListLength(List=extended_geometry_3)
populate_geometry = PopulateGeometry(Geometry=surface, Count=count, Seed=1)
divide_list_5 = DivideList(List=extended_geometry_3, Number=list_length_5)  # -> Chunk, Remainder
divide_list_6 = DivideList(List=populate_geometry, Number=list_length_5)  # -> Chunk, Remainder
move_to_point_3 = MoveToPoint(Geometry=divide_list_5.Chunk, PointA=Point(0, 0, 0), PointB=divide_list_6.Chunk)  # -> flatten(Moved), flatten(Vector), Transform
random_3 = Random(Range="0 To 360", Number=count, Seed=2)
random_4 = Random(Range="0.3 To 0.6", Number=count, Seed=2)
scale_6 = Scale(Geometry=move_to_point_3.Moved, Center=move_to_point_3.Vector, Factor=random_4)  # -> Geometry, Transform
rotate_3 = Rotate(Geometry=scale_6.Geometry, Angle=degrees(random_3), Plane=move_to_point_3.Vector)  # -> Geometry, Transform
scale_7 = Scale(Geometry=surface, Center=polygon_center_3.CenterA, Factor="0.98")  # -> Geometry, Transform
center_3 = Center(Geometrical=rotate_3.Geometry)  # -> Center, Dimension
point_in_curve_3 = PointInCurve(Point=center_3.Center, Curve=scale_7.Geometry)  # -> Relationship, Point
equality_3 = Equality(FirstNumber=point_in_curve_3.Relationship, SecondNumber="0")  # -> Equality, Inequality
define_object_attributes_4 = DefineObjectAttributes(Layer="groundcover")
cull_pattern_3 = CullPattern(List=rotate_3.Geometry, CullPattern=equality_3.Inequality)
bake_objects_4 = BakeObjects(Geometry=cull_pattern_3, Attributes=define_object_attributes_4, Bake=False)
