# Grasshopper definition ecological-attractors.gh (Grasshopper 1.0.7)

# ----
# region
radius = Slider(100, range=0..100)
circle = Circle(Plane=PlaneXY(0, 0, 0), Radius=radius)
boundary_surfaces = BoundarySurfaces(Edges=circle)
region = Surface(boundary_surfaces)

scaling = Slider(0.75, range=0..1)
# random attractors
region_2 = Surface(region)
count = Slider(9, range=0..12)
# terrain from attractors
seed = Slider(1, range=0..100)
scale_nu = ScaleNU(Geometry=region_2, Plane=PlaneXY(0, 0, 0), ScaleX=scaling, ScaleY=scaling, ScaleZ=1)  # -> Geometry, Transform
populate_geometry = PopulateGeometry(Geometry=scale_nu.Geometry, Count=count, Seed=seed)
attractors = Point(populate_geometry)

region_3 = Surface(region)
count_2 = Slider(100, range=0..360)
seed_2 = Slider(1, range=0..100)
attractors_2 = Point(attractors)
spans = Slider(50, range=0..100)
# terrain visualization
flexibility = Slider(1, range=0..1)
populate_geometry_2 = PopulateGeometry(Geometry=region_3, Count=count_2, Seed=seed_2)
closest_point = ClosestPoint(Point=populate_geometry_2, Cloud=attractors_2)  # -> ClosestPoint, CPIndex, Distance
bounds = Bounds(Numbers=closest_point.Distance)
remap_numbers = RemapNumbers(Value=closest_point.Distance, Source=bounds, Target="-20 To 20")  # -> Mapped, Clipped
unit_z = UnitZ(Factor=remap_numbers.Mapped)
move = Move(Geometry=populate_geometry_2, Motion=unit_z)  # -> Geometry, Transform
patch = Patch(Curves=region_3, Points=move.Geometry, Spans=spans, Flexibility=flexibility, Trim=True)
custom_preview = CustomPreview(Geometry=patch, Material=ColourSwatch(SwatchColor=RGB(230, 230, 230)))

# ---- group: ground
terrain = Surface(patch)
depth = Slider(15, range=0..100)
negative = Negative(Value=depth)
unit_z_2 = UnitZ(Factor=negative)
extrude = Extrude(Base=terrain, Direction=unit_z_2)
custom_preview_2 = CustomPreview(Geometry=extrude, Material=ColourSwatch(SwatchColor=RGB(230, 230, 230)))

# ---- group: contours
terrain_2 = Surface(patch)
distance = Slider(1, range=0..1)
contour = Contour(Shape=terrain_2, Point="0,0,-20", Direction=Vector(0, 0, 1), Distance=distance)
custom_preview_3 = CustomPreview(Geometry=contour, Material=ColourSwatch(SwatchColor=RGB(0, 0, 0)))

# ---- group: cutting plane
region_4 = Surface(region)
scaling_2 = Slider(0.9, range=0..1)
# parametric tree
depth_2 = Slider(-10, range=-20..20)
scale_nu_2 = ScaleNU(Geometry=region_4, Plane=PlaneXY(0, 0, 0), ScaleX=scaling_2, ScaleY=scaling_2, ScaleZ=1)  # -> Geometry, Transform
unit_z_3 = UnitZ(Factor=depth_2)
move_2 = Move(Geometry=scale_nu_2.Geometry, Motion=unit_z_3)  # -> Geometry, Transform
custom_preview_4 = CustomPreview(Geometry=move_2.Geometry, Material=ColourSwatch(SwatchColor=RGB(173, 195, 255)))

# ---- group: generate a conical tree
trunk_diameter = Slider(1, range=0..2)
trunk_height = Slider(4, range=0..100)
crown_height = Slider(15, range=0..75)
canopy_layers = Slider(3, range=0..10)
canopy_diameter = Slider(5, range=0..100)
conical_tree = ConicalTree(A=trunk_diameter, factor=trunk_height, factor_2=crown_height, B=canopy_layers, A_2=canopy_diameter)  # -> trunk, result
canopy_color = ColourSwatch(SwatchColor=RGBA(58, 94, 84, 232))
trunk_color = ColourSwatch(SwatchColor=RGB(139, 76, 57))
custom_preview_5 = CustomPreview(Geometry=conical_tree.trunk, Material=trunk_color)
custom_preview_6 = CustomPreview(Geometry=conical_tree.result, Material=canopy_color)

# ---- group: generate a random population of trees
# random trees
trunk = Brep(conical_tree.trunk)
canopy = Brep(conical_tree.result)
terrain_3 = Brep(patch)
water = Brep(move_2.Geometry)
count_3 = Slider(360, range=0..1000)
seed_3 = Slider(100, range=0..100)
scale_nu_3 = ScaleNU(Geometry=water, Plane=PlaneXY(0, 0, 0), ScaleX="2", ScaleY="2", ScaleZ=1)  # -> Geometry, Transform
split_brep = SplitBrep(Brep=terrain_3, Cutter=scale_nu_3.Geometry)
list_item = ListItem(List=split_brep, Index="0", Wrap=True)
populate_geometry_3 = PopulateGeometry(Geometry=list_item, Count=count_3, Seed=seed_3)
vector_2pt = Vector2Pt(PointA="0,0,0", PointB=populate_geometry_3, Unitize=False)  # -> Vector, Length
move_3 = Move(Geometry=trunk, Motion=vector_2pt.Vector)  # -> Geometry, Transform
move_4 = Move(Geometry=canopy, Motion=vector_2pt.Vector)  # -> Geometry, Transform
scale = Scale(Geometry=move_3.Geometry, Center=vector_2pt.Vector, Factor=0.5)  # -> Geometry, Transform
scale_2 = Scale(Geometry=move_4.Geometry, Center=vector_2pt.Vector, Factor=0.5)  # -> Geometry, Transform
point = Point(populate_geometry_3)

# ----
trunk_2 = Brep(scale.Geometry)
canopy_2 = Brep(scale_2.Geometry)

# ----
# tree attractors
trunk_3 = Brep(trunk_2)
canopy_3 = Brep(canopy_2)
trees = Point(point)
attractors_3 = Point(attractors)
closest_point_2 = ClosestPoint(Point=trees, Cloud=attractors_3)  # -> ClosestPoint, CPIndex, Distance
bounds_2 = Bounds(Numbers=closest_point_2.Distance)
bounds_3 = Bounds(Numbers=closest_point_2.Distance)
remap_numbers_2 = RemapNumbers(Value=closest_point_2.Distance, Source=bounds_2, Target="1 To 4")  # -> Mapped, Clipped
remap_numbers_3 = RemapNumbers(Value=closest_point_2.Distance, Source=bounds_3, Target="0 To 1")  # -> Mapped, Clipped
trees_2 = Point(trees)
trees_3 = Point(trees)
canopy_color_2 = ColourSwatch(SwatchColor=RGBA(177, 184, 118, 232))
canopy_color_3 = ColourSwatch(SwatchColor=RGBA(64, 128, 117, 232))
canopy_color_4 = ColourSwatch(SwatchColor=RGBA(35, 102, 53, 232))
scale_3 = Scale(Geometry=trunk_3, Center=trees_2, Factor=remap_numbers_2.Mapped)  # -> Geometry, Transform
scale_4 = Scale(Geometry=canopy_3, Center=trees_3, Factor=remap_numbers_2.Mapped)  # -> Geometry, Transform
interpolate_data = InterpolateData(Data=[canopy_color_2, canopy_color_3, canopy_color_4], Parameter=remap_numbers_3.Mapped, Interpolation=2)
trunk_color_2 = ColourSwatch(SwatchColor=RGB(139, 76, 57))
custom_preview_7 = CustomPreview(Geometry=scale_3.Geometry, Material=trunk_color_2)
custom_preview_8 = CustomPreview(Geometry=scale_4.Geometry, Material=interpolate_data)

# ==== cluster ConicalTree
factor = ClusterInput()
factor_2 = ClusterInput()
A = ClusterInput()
A_2 = ClusterInput()

# ---- group: conical tree
construct_point = ConstructPoint(XCoordinate=0, YCoordinate=0, ZCoordinate=0)
unit_z = UnitZ(Factor=factor)
unit_z_2 = UnitZ(Factor=factor_2)
division = Division(A=A, B="2.0")
division_2 = Division(A=A_2, B="2.0")
B = ClusterInput()
move = Move(Geometry=construct_point, Motion=unit_z_2)  # -> Geometry, Transform
move_2 = Move(Geometry=construct_point, Motion=unit_z)  # -> Geometry, Transform
division_3 = Division(A=unit_z_2, B=B)
line = Line(StartPoint=construct_point, EndPoint=move_2.Geometry)
line_2 = Line(StartPoint=move_2.Geometry, EndPoint=move.Geometry)
divide_distance = DivideDistance(Curve=line_2, Distance=division_3)  # -> Points, Tangents, Parameters
construct_plane = ConstructPlane(Origin=divide_distance.Points, XAxis=Vector(1, 0, 0), YAxis=Vector(0, 1, 0))
construct_domain = ConstructDomain(DomainStart="0.5", DomainEnd="1.75")
cone = Cone(Base=construct_plane, Radius=division_2, Length=division_3)  # -> Cone, Tip
list_length = ListLength(List=construct_plane)
range = Range(Domain=construct_domain, Steps=list_length)  # -> reverse(Range)
scale = Scale(Geometry=cone.Cone, Center=construct_plane, Factor=range)  # -> Geometry, Transform
pipe = Pipe(Curve=line, Radius=division, Caps=0)
cap_holes = CapHoles(Brep=scale.Geometry)
solid_union = SolidUnion(Breps=cap_holes)

# ----
trunk = ClusterOutput(pipe)
result = ClusterOutput(solid_union)
