# Grasshopper definition ecological-gradient.gh (Grasshopper 1.0.7)
# Copyright: GNU General Public License 3.0

# ----
# ecologial gradient
# parametric tree
trunk_height = Slider(5, range=0..100)
trunk_radius = Slider(0.5, range=0..1)
tree_height = Slider(20, range=0..100)
divisions = Slider(3, range=0..10)
# surface from waves
canopy_radius = Slider(5, range=0..10)
conical_tree = ConicalTree(trunk_height=trunk_height, relay=trunk_radius, A=tree_height, relay_2=divisions, relay_3=canopy_radius)  # -> pipe_2, result
canopy = Brep(conical_tree.result)
trunk = Brep(conical_tree.pipe_2)

step = Slider(10, range=0..10)
count = Slider(11, range=0..100)
a = Slider(2.5, range=0..10)
b = Slider(0.54, range=0..1)
c = Slider(2, range=0..10)
pi = Pi(Factor="0.5")
series = Series(Start=pi, Step=step, Count=count)
expression = Expression(x=graft(series), y=series, a=a, b=b, c=c, Expression="a*sin(b*x+c)*a*cos(b*y+c)")
construct_point = ConstructPoint(XCoordinate=graft(series), YCoordinate=series, ZCoordinate=expression)
surface_from_points = SurfaceFromPoints(Points=flatten(construct_point), UCount=count, Interpolate=Toggle(True))
point = Point(construct_point)
surface = Surface(surface_from_points)

# ----
# base
surface_2 = Surface(surface)
Z = Slider(-25, range=-25..25)
# terrain color
panel = Panel("-10 To -100")
unit_z = UnitZ(Factor=Z)
extrude = Extrude(Base=surface_2, Direction=unit_z)
domain_box = DomainBox(Base=PlaneXY(0, 0, 0), X="-25 To 125", Y="-25 To 125", Z=panel)
solid_difference = SolidDifference(BrepsA=extrude, BrepsB=domain_box)
deconstruct_brep = DeconstructBrep(Brep=solid_difference)  # -> Faces, Edges, Vertices
split_list = SplitList(List=deconstruct_brep.Faces, Index="1")  # -> ListA, ListB
custom_preview = CustomPreview(Geometry=split_list.ListB, Material=ColourSwatch(SwatchColor=RGB(140, 86, 48)))

# ----
# transform
trunk_2 = Brep(trunk)
canopy_2 = Brep(canopy)
point_2 = Point(point)
number = Number(expression)
vector_2pt = Vector2Pt(PointA="0,0,0", PointB=point_2, Unitize=False)  # -> Vector, Length
bounds = Bounds(Numbers=number)
remap_numbers = RemapNumbers(Value=number, Source=bounds, Target="0.75 To 1.25")  # -> Mapped, Clipped
move = Move(Geometry=trunk_2, Motion=vector_2pt.Vector)  # -> Geometry, Transform
move_2 = Move(Geometry=canopy_2, Motion=vector_2pt.Vector)  # -> Geometry, Transform
scale = Scale(Geometry=move_2.Geometry, Center=vector_2pt.Vector, Factor=remap_numbers.Mapped)  # -> Geometry, Transform
canopies = Brep(scale.Geometry)
trunks = Brep(move.Geometry)

# ----
# cull
number_2 = Number(expression)
trunks_2 = Brep(trunks)
threshold = Slider(-3, range=-4..4)
canopies_2 = Brep(canopies)
larger_than = LargerThan(FirstNumber=number_2, SecondNumber=threshold)  # -> LargerThan, OrEqualTo
cull_pattern = CullPattern(List=number_2, CullPattern=larger_than.LargerThan)
cull_pattern_2 = CullPattern(List=trunks_2, CullPattern=larger_than.LargerThan)
cull_pattern_3 = CullPattern(List=canopies_2, CullPattern=larger_than.LargerThan)
canopies_3 = Brep(cull_pattern_3)
number_3 = Number(cull_pattern)
trunks_3 = Brep(cull_pattern_2)

# ----
# tree colors
trunks_4 = Brep(trunks_3)
canopies_4 = Brep(canopies_3)
number_4 = Number(expression)
bounds_2 = Bounds(Numbers=number_4)
# water
panel_2 = Panel("0 To 1")
remap_numbers_2 = RemapNumbers(Value=number_4, Source=bounds_2, Target=panel_2)  # -> Mapped, Clipped
color_a = ColourSwatch(SwatchColor=RGBA(6, 105, 54, 232))
color_b = ColourSwatch(SwatchColor=RGBA(73, 140, 132, 232))
color_c = ColourSwatch(SwatchColor=RGBA(58, 94, 84, 232))
interpolate_data = InterpolateData(Data=[color_a, color_b, color_c], Parameter=remap_numbers_2.Mapped, Interpolation=2)
trunk_color = ColourSwatch(SwatchColor=RGB(139, 76, 57))
custom_preview_2 = CustomPreview(Geometry=trunks_4, Material=trunk_color)
custom_preview_3 = CustomPreview(Geometry=canopies_4, Material=interpolate_data)

surface_3 = Surface(surface)
mesh_brep = MeshBrep(
    Brep=surface_3,
    Settings={GridMaxCount=0, GridMinCount=16, JaggedSeams=False, MaxEdgeLength=0, MinEdgeLength=0.0001, MinTolerance=0, Refine=True, RefineAngle=0, RelativeTolerance=0.65, SimplePlanes=True, Tolerance=0})
deconstruct_mesh = DeconstructMesh(Mesh=mesh_brep)  # -> Vertices, Faces, Colours, Normals
deconstruct = Deconstruct(Point=deconstruct_mesh.Vertices)  # -> XComponent, YComponent, ZComponent
bounds_3 = Bounds(Numbers=deconstruct.ZComponent)
remap_numbers_3 = RemapNumbers(Value=deconstruct.ZComponent, Source=bounds_3, Target=Domain(0, 1))  # -> Mapped, Clipped

surface_4 = Surface(surface_3)
Z_2 = Slider(-2, range=-10..10)
xy_plane = XYPlane(Origin=Point(0, 0, 0))
unit_z_2 = UnitZ(Factor=Z_2)
plane_through_shape = PlaneThroughShape(Plane=xy_plane, Shape=surface_4, Inflate="0", SectionLogic=False)
move_3 = Move(Geometry=plane_through_shape, Motion=unit_z_2)  # -> Geometry, Transform
area = Area(Geometry=move_3.Geometry)  # -> Area, Centroid
scale_nu = ScaleNU(Geometry=move_3.Geometry, Plane=area.Centroid, ScaleX="0.995", ScaleY="0.995", ScaleZ=1)  # -> Geometry, Transform
unit_z_3 = UnitZ(Factor="-5")
extrude_2 = Extrude(Base=scale_nu.Geometry, Direction=unit_z_3)
custom_preview_4 = CustomPreview(Geometry=extrude_2, Material=ColourSwatch(SwatchColor=RGB(214, 221, 255)))

gradient = Gradient(
    LowerLimit=0,
    UpperLimit=1,
    Parameter=remap_numbers_3.Mapped,
    stops=[0: RGB(139, 69, 19), 1: RGB(250, 235, 215), 1: RGB(188, 143, 143)])

mesh_colours = MeshColours(Mesh=mesh_brep, Colours=gradient)
mesh = Mesh(mesh_colours)

# ==== cluster ConicalTree
trunk_height = ClusterInput()
relay = ClusterInput()
A = ClusterInput()
relay_2 = ClusterInput()
relay_3 = ClusterInput()
unit_z = UnitZ(Factor=trunk_height)
subtraction = Subtraction(A=A, B=trunk_height)
move = Move(Geometry="0,0,0", Motion=unit_z)  # -> Geometry, Transform
top_of_trunk = Point(move.Geometry)
unit_z_2 = UnitZ(Factor=subtraction)
division = Division(A=subtraction, B=relay_2)
move_2 = Move(Geometry=top_of_trunk, Motion=unit_z_2)  # -> Geometry, Transform
line = Line(StartPoint="0,0,0", EndPoint=move.Geometry)
line_2 = Line(StartPoint=top_of_trunk, EndPoint=move_2.Geometry)
pipe = Pipe(Curve=line, Radius=relay, Caps="1")
divide_curve = DivideCurve(Curve=line_2, Count=relay_2, Kinks=False)  # -> Points, Tangents, Parameters
pipe_2 = ClusterOutput(pipe)
split_list = SplitList(List=divide_curve.Points, Index=relay_2)  # -> ListA, ListB
range = Range(Domain="1 To 0.5", Steps=expr("x-1", relay_2))
cone = Cone(Base=split_list.ListA, Radius=relay_3, Length=division)  # -> Cone, Tip
multiplication = Multiplication(A=range, B="2")
scale_nu = ScaleNU(Geometry=cone.Cone, Plane=split_list.ListA, ScaleX=range, ScaleY=range, ScaleZ=multiplication)  # -> Geometry, Transform
cap_holes = CapHoles(Brep=scale_nu.Geometry)
solid_union = SolidUnion(Breps=cap_holes)
result = ClusterOutput(solid_union)
