# Grasshopper definition ecological-succession.gh (Grasshopper 1.0.8)
# Copyright: GNU General Public License 3.0

# ---- group: cluster
# grid
# lowpoly tree
trunk_height = Slider(6, range=0..100)
trunk_radius = Slider(0.5, range=0..1)
tree_height = Slider(20, range=0..100)
divisions = Slider(3, range=0..10)
# grid
canopy_radius = Slider(5, range=0..10)
lowpoly_tree = LowpolyTree(trunk_height=trunk_height, relay=trunk_radius, A=tree_height, relay_2=divisions, relay_3=canopy_radius)  # -> pipe_2, result
brep = Brep(lowpoly_tree.pipe_2)
brep_2 = Brep(lowpoly_tree.result)

# ----
trunk = Brep(lowpoly_tree.pipe_2)
canopy = Brep(lowpoly_tree.result)
size = Slider(10, range=0..100)
extent = Slider(10, range=0..100)
relay = Relay([trunk, canopy])
square = Square(Plane=PlaneXY(0, 0, 0), Size=size, ExtentX=extent, ExtentY=extent)  # -> Cells, flatten(Points)
move = Move(Geometry=relay, Motion=square.Points)  # -> Geometry, Transform
explode_tree = ExplodeTree(Data=move.Geometry)  # -> Branch0, Branch1
brep_3 = Brep(explode_tree.Branch0)
brep_4 = Brep(explode_tree.Branch1)
point = Point(square.Points)

# ----
# mortality
point_2 = Point(point)
brep_5 = Brep(brep_3)
brep_6 = Brep(brep_4)
percent = Slider(25, range=0..100)
# growth
seed = Slider(3, range=0..100)
list_length = ListLength(List=brep_6)
relay_2 = Relay([brep_6, brep_5, point_2])
expression = Expression(x=list_length, y=percent, Expression="x*(y/100)")
random_reduce = RandomReduce(List=relay_2, Reduction=expression, Seed=seed)
explode_tree_2 = ExplodeTree(Data=random_reduce)  # -> _0000, _0010, _0020
point_3 = Point(explode_tree_2._0000)
brep_7 = Brep(explode_tree_2._0010)
brep_8 = Brep(explode_tree_2._0020)

brep_9 = Brep(brep_8)
brep_10 = Brep(brep_7)
point_4 = Point(point_3)
relay_3 = Relay([brep_9, brep_10])
list_length_2 = ListLength(List=point_4)
seed_2 = Number(seed)
random = Random(Range="1 To 1.5", Number=list_length_2, Seed=seed_2)
scale = Scale(Geometry=relay_3, Center=point_4, Factor=random)  # -> Geometry, Transform
explode_tree_3 = ExplodeTree(Data=scale.Geometry)  # -> _00000, _00001
brep_11 = Brep(explode_tree_3._00000)
brep_12 = Brep(explode_tree_3._00001)

# ---- group: boundary
# pioneers
size_2 = Number(size)
extent_2 = Number(extent)
point_5 = Point(point_3)
radius = Number(canopy_radius)
multiplication = Multiplication(A=size_2, B=extent_2)
rectangle = Rectangle(Plane=PlaneXY(0, 0, 0), XSize=multiplication, YSize=multiplication, Radius=0)  # -> Rectangle, Length
circle = Circle(Plane=point_5, Radius=expr("x*1.5", radius))
region_difference = RegionDifference(CurvesA=rectangle.Rectangle, CurvesB=circle)
curve = Curve(region_difference)

# ---- group: region
curve_2 = Curve(curve)
boundary_surfaces = BoundarySurfaces(Edges=curve_2)
area = Area(Geometry=boundary_surfaces)  # -> Area, Centroid
sort_list = SortList(Keys=area.Area, ValuesValuesA=boundary_surfaces)  # -> Keys, ValuesValuesA
reverse_list = ReverseList(List=sort_list.ValuesValuesA)
list_item = ListItem(List=reverse_list, Index=0, Wrap=True)
surface = Surface(list_item)

# ---- group: random population
trunk_2 = Brep(lowpoly_tree.pipe_2)
canopy_2 = Brep(lowpoly_tree.result)
surface_2 = Surface(surface)
integer = Integer(expression)
seed_3 = Number(seed)
populate_geometry = PopulateGeometry(Geometry=surface_2, Count=integer, Seed=seed_3)
relay_4 = Relay([trunk_2, canopy_2])
move_2 = Move(Geometry=relay_4, Motion=populate_geometry)  # -> Geometry, Transform
explode_tree_4 = ExplodeTree(Data=move_2.Geometry)  # -> _000000, _000001
brep_13 = Brep(explode_tree_4._000000)
brep_14 = Brep(explode_tree_4._000001)

# ---- group: scaling
brep_15 = Brep(brep_13)
brep_16 = Brep(brep_14)
point_6 = Point(populate_geometry)
relay_5 = Relay([brep_15, brep_16])
list_length_3 = ListLength(List=point_6)
seed_4 = Number(seed)
random_2 = Random(Range="0.5 To 1.25", Number=list_length_3, Seed=seed_4)
scale_2 = Scale(Geometry=relay_5, Center=point_6, Factor=random_2)  # -> Geometry, Transform
explode_tree_5 = ExplodeTree(Data=scale_2.Geometry)  # -> _0000000, _0000001
brep_17 = Brep(explode_tree_5._0000000)
brep_18 = Brep(explode_tree_5._0000001)

# ----
# visualization
brep_19 = Brep(flatten([brep_11, brep_17]))
trunk_color = ColourSwatch(SwatchColor=RGB(139, 76, 57))
brep_20 = Brep(flatten([brep_12, brep_18]))
canopy_color = ColourSwatch(SwatchColor=RGBA(58, 94, 84, 232))
custom_preview = CustomPreview(Geometry=brep_19, Material=trunk_color)
custom_preview_2 = CustomPreview(Geometry=brep_20, Material=canopy_color)

# ----
# color gradient
canopy_3 = Brep(brep_20)
volume = Volume(Geometry=canopy_3)  # -> Volume, Centroid
bounds = Bounds(Numbers=volume.Volume)
remap_numbers = RemapNumbers(Value=volume.Volume, Source=bounds, Target=Domain(0, 1))  # -> Mapped, Clipped
gradient = Gradient(
    LowerLimit=0,
    UpperLimit=1,
    Parameter=remap_numbers.Mapped,
    stops=[0: RGB(80, 153, 114), 0: RGB(80, 153, 114), 1: RGB(50, 84, 84)])
custom_preview_3 = CustomPreview(Geometry=canopy_3, Material=gradient)

# ==== cluster LowpolyTree
trunk_height = ClusterInput()
relay = ClusterInput()
A = ClusterInput()
relay_2 = ClusterInput()
relay_3 = ClusterInput()
unit_z = UnitZ(Factor=trunk_height)
subtraction = Subtraction(A=A, B=trunk_height)
point = Point("0,0,0")
move = Move(Geometry=point, Motion=unit_z)  # -> Geometry, Transform
top_of_trunk = Point(move.Geometry)
unit_z_2 = UnitZ(Factor=subtraction)
division = Division(A=subtraction, B=relay_2)
move_2 = Move(Geometry=top_of_trunk, Motion=unit_z_2)  # -> Geometry, Transform
line = Line(StartPoint=point, EndPoint=move.Geometry)
line_2 = Line(StartPoint=top_of_trunk, EndPoint=move_2.Geometry)
pipe = Pipe(Curve=line, Radius=relay, Caps="1")
divide_curve = DivideCurve(Curve=line_2, Count=relay_2, Kinks=False)  # -> Points, Tangents, Parameters
pipe_2 = ClusterOutput(pipe)
split_list = SplitList(List=divide_curve.Points, Index=relay_2)  # -> ListA, ListB
range = Range(Domain="1 To 0.5", Steps=expr("x-1", relay_2))
cone = Cone(Base=split_list.ListA, Radius=relay_3, Length=division)  # -> Cone, Tip
multiplication = Multiplication(A=range, B="2")
scale_nu = ScaleNU(Geometry=cone.Cone, Plane=split_list.ListA, ScaleX=range, ScaleY=range, ScaleZ=multiplication)  # -> Geometry, Transform
cap_holes = CapHoles(Brep=scale_nu.Geometry)
solid_union = SolidUnion(Breps=cap_holes)
result = ClusterOutput(solid_union)
