# Grasshopper definition hello-world.gh (Grasshopper 1.0.7)
# Copyright: GNU General Public License 3.0

# ----
# Hello World
panel = Panel("Hello ")
name = GetString("Name", AtLeast=1, AtMost=1, Prompt="Input Name")
concatenate = Concatenate(A=panel, B=name, C="!")
panel_2 = Panel(concatenate)
context_print = ContextPrint(Message=panel_2)
