# Grasshopper definition linear-array.gh (Grasshopper 1.0.7)

# ---- group: generate a conical tree
# parametric tree
# diameter at breast height (DBH)
trunk_diameter = Slider(0.75, range=0..2)
crown_height = Slider(30, range=0..75)
canopy_layers = Slider(3, range=0..10)
trunk_height = Slider(8, range=0..100)
canopy_diameter = Slider(10, range=0..100)
conical_tree = ConicalTree(A=trunk_diameter, factor=trunk_height, factor_2=crown_height, B=canopy_layers, A_2=canopy_diameter)  # -> trunk, result
canopy_color = ColourSwatch(SwatchColor=RGBA(58, 94, 58, 232))
trunk_color = ColourSwatch(SwatchColor=RGB(139, 76, 57))
custom_preview = CustomPreview(Geometry=conical_tree.trunk, Material=trunk_color)
custom_preview_2 = CustomPreview(Geometry=conical_tree.result, Material=canopy_color)

# ---- group: array trunks along a line
number_slider = Slider(24, range=0..10000)
# linear array
trunks = Geometry(conical_tree.trunk)

# ----
unit_y = UnitY(Factor=number_slider)

# ---- group: array trunks along a line (continued)
linear_array = LinearArray(Geometry=trunks, Direction=unit_y, Count=Slider(12, range=0..100))  # -> Geometry, Transform

# ---- group: array canopy along a line
number_slider_2 = Slider(24, range=0..10000)
canopies = Geometry(conical_tree.result)
number_slider_3 = Slider(12, range=0..100)
construct_point = ConstructPoint(XCoordinate=0, YCoordinate=0, ZCoordinate=0)

# ----
unit_y_2 = UnitY(Factor=number_slider_2)

# ---- group: array canopy along a line (continued)
linear_array_2 = LinearArray(Geometry=canopies, Direction=unit_y_2, Count=number_slider_3)  # -> Geometry, Transform
linear_array_3 = LinearArray(Geometry=construct_point, Direction=unit_y_2, Count=number_slider_3)  # -> Geometry, Transform

# ---- group: scale trunks
# size
start = Slider(0.5, range=0..1)
end = Slider(1, range=0..1)
construct_domain = ConstructDomain(DomainStart=start, DomainEnd=end)
range = Range(Domain=construct_domain, Steps=expr("x-1", number_slider_3))
scale_nu = ScaleNU(Geometry=linear_array.Geometry, Plane=linear_array_3.Geometry, ScaleX=range, ScaleY=range, ScaleZ=1)  # -> Geometry, Transform

# ---- group: scale canopy
start_2 = Slider(0.5, range=0..1)
end_2 = Slider(1, range=0..1)
construct_domain_2 = ConstructDomain(DomainStart=start_2, DomainEnd=end_2)
range_2 = Range(Domain=construct_domain_2, Steps=expr("x-1", number_slider_3))
scale = Scale(Geometry=linear_array_2.Geometry, Center=linear_array_3.Geometry, Factor=range_2)  # -> Geometry, Transform

# ---- group: trunk color
trunk_color_2 = ColourSwatch(SwatchColor=RGB(139, 76, 57))
# color
custom_preview_3 = CustomPreview(Geometry=scale_nu.Geometry, Material=trunk_color_2)

# ---- group: canopy color gradient
canopy_color_2 = ColourSwatch(SwatchColor=RGBA(58, 94, 58, 232))
canopy_color_3 = ColourSwatch(SwatchColor=RGBA(191, 115, 48, 232))
canopy_color_4 = ColourSwatch(SwatchColor=RGBA(128, 64, 64, 232))
range_3 = Range(Domain=Domain(0, 1), Steps=number_slider_3)
colour = Colour([canopy_color_2, canopy_color_3, canopy_color_4])
interpolate_data = InterpolateData(Data=colour, Parameter=range_3, Interpolation=2)
custom_preview_4 = CustomPreview(Geometry=scale.Geometry, Material=interpolate_data)

# ==== cluster ConicalTree
factor = ClusterInput()
factor_2 = ClusterInput()
A = ClusterInput()
A_2 = ClusterInput()

# ---- group: conical tree
construct_point = ConstructPoint(XCoordinate=0, YCoordinate=0, ZCoordinate=0)
unit_z = UnitZ(Factor=factor)
unit_z_2 = UnitZ(Factor=factor_2)
division = Division(A=A, B="2.0")
division_2 = Division(A=A_2, B="2.0")
B = ClusterInput()
move = Move(Geometry=construct_point, Motion=unit_z_2)  # -> Geometry, Transform
move_2 = Move(Geometry=construct_point, Motion=unit_z)  # -> Geometry, Transform
division_3 = Division(A=unit_z_2, B=B)
line = Line(StartPoint=construct_point, EndPoint=move_2.Geometry)
line_2 = Line(StartPoint=move_2.Geometry, EndPoint=move.Geometry)
divide_distance = DivideDistance(Curve=line_2, Distance=division_3)  # -> Points, Tangents, Parameters
construct_plane = ConstructPlane(Origin=divide_distance.Points, XAxis=Vector(1, 0, 0), YAxis=Vector(0, 1, 0))
construct_domain = ConstructDomain(DomainStart="0.5", DomainEnd="1.75")
cone = Cone(Base=construct_plane, Radius=division_2, Length=division_3)  # -> Cone, Tip
list_length = ListLength(List=construct_plane)
range = Range(Domain=construct_domain, Steps=list_length)  # -> reverse(Range)
scale = Scale(Geometry=cone.Cone, Center=construct_plane, Factor=range)  # -> Geometry, Transform
pipe = Pipe(Curve=line, Radius=division, Caps=0)
cap_holes = CapHoles(Brep=scale.Geometry)
solid_union = SolidUnion(Breps=cap_holes)

# ----
trunk = ClusterOutput(pipe)
result = ClusterOutput(solid_union)
