# Grasshopper definition lungomare-bench.gh (Grasshopper 1.0.7)

# ----
# lungomare bench
# from trigonmetric functions
initial_frequency = Slider(1, range=0..10)
frequency = Slider(3, range=0..10)
steps = Slider(4, range=0..10)
start = Slider(0.6, range=0..1)
amplitude = Slider(0.36, range=0..1)
count = Slider(4, range=0..10)
distance = Slider(50, range=0..100)
scale_x = Slider(30, range=0..100)
scale_z = Slider(20, range=0..100)
depth = Slider(10, range=0..100)
pi = Pi(Factor=initial_frequency)
pi_2 = Pi(Factor=frequency)
series = Series(Start=start, Step=amplitude, Count=count)
construct_domain = ConstructDomain(DomainStart=pi, DomainEnd=pi_2)
range = Range(Domain=construct_domain, Steps=steps)
multiplication = Multiplication(A=range, B=graft(series))
sine = Sine(Value=multiplication)
construct_point = ConstructPoint(XCoordinate=range, YCoordinate=0, ZCoordinate=sine)
series_2 = Series(Start=0, Step=distance, Count=count)
interpolate = Interpolate(Vertices=construct_point, Degree=3, Periodic=False, KnotStyle=1)  # -> Curve, Length, Domain
scale_nu = ScaleNU(Geometry=interpolate.Curve, Plane=PlaneXY(0, 0, 0), ScaleX=scale_x, ScaleY=1, ScaleZ=scale_z)  # -> Geometry, Transform
unit_y = UnitY(Factor=series_2)
move = Move(Geometry=flatten(scale_nu.Geometry), Motion=unit_y)  # -> Geometry, Transform
unit_z = UnitZ(Factor=depth)
loft = Loft(Curves=move.Geometry, Options={Adjust=False, Closed=False, LoftEnds=0, LoftSimp=0, LoftType=0, Rebuild=10, Refit=0.01})
extrude = Extrude(Base=loft, Direction=unit_z)
custom_preview = CustomPreview(Geometry=extrude, Material=ColourSwatch(SwatchColor=RGB(204, 204, 204)))

# ----
# from randomized trigonmetric functions
initial_frequency_2 = Slider(1, range=0..10)
frequency_2 = Slider(3, range=0..10)
steps_2 = Slider(4, range=0..10)
count_2 = Slider(4, range=0..10)
seed = Slider(4, range=0..100)
distance_2 = Slider(50, range=0..100)
scale_x_2 = Slider(30, range=0..100)
scale_z_2 = Slider(20, range=0..100)
depth_2 = Slider(10, range=0..100)
pi_3 = Pi(Factor=initial_frequency_2)
pi_4 = Pi(Factor=frequency_2)
random = Random(Range="0.5 to 1.5", Number=count_2, Seed=seed)
construct_domain_2 = ConstructDomain(DomainStart=pi_3, DomainEnd=pi_4)
range_2 = Range(Domain=construct_domain_2, Steps=steps_2)
multiplication_2 = Multiplication(A=range_2, B=graft(random))
sine_2 = Sine(Value=multiplication_2)
construct_point_2 = ConstructPoint(XCoordinate=range_2, YCoordinate=0, ZCoordinate=sine_2)
series_3 = Series(Start=0, Step=distance_2, Count=count_2)
interpolate_2 = Interpolate(Vertices=construct_point_2, Degree=3, Periodic=False, KnotStyle=1)  # -> Curve, Length, Domain
scale_nu_2 = ScaleNU(Geometry=interpolate_2.Curve, Plane=PlaneXY(0, 0, 0), ScaleX=scale_x_2, ScaleY=1, ScaleZ=scale_z_2)  # -> Geometry, Transform
unit_y_2 = UnitY(Factor=series_3)
move_2 = Move(Geometry=flatten(scale_nu_2.Geometry), Motion=unit_y_2)  # -> Geometry, Transform
unit_z_2 = UnitZ(Factor=depth_2)
loft_2 = Loft(Curves=move_2.Geometry, Options={Adjust=False, Closed=False, LoftEnds=0, LoftSimp=0, LoftType=0, Rebuild=10, Refit=0.01})
extrude_2 = Extrude(Base=loft_2, Direction=unit_z_2)
custom_preview_2 = CustomPreview(Geometry=extrude_2, Material=ColourSwatch(SwatchColor=RGB(204, 204, 204)))

# ---- group: generate a family of forms
# design matrix
initial_frequency_3 = Slider(1, range=0..10)
frequency_3 = Slider(3, range=0..10)
steps_3 = Slider(4, range=0..10)
curves = Slider(4, range=0..10)
designs = Slider(24, range=0..100)
seed_2 = Slider(0, range=0..100)
distance_3 = Slider(50, range=0..100)
scale_x_3 = Slider(30, range=0..100)
scale_z_3 = Slider(20, range=0..100)
depth_3 = Slider(10, range=0..100)
spacing = Slider(225, range=0..1000)
random_2 = Random(Range="0 To 10000", Number=designs, Seed=seed_2)
random_3 = Random(Range="0.5 to 1.5", Number=curves, Seed=random_2)
pi_5 = Pi(Factor=initial_frequency_3)
pi_6 = Pi(Factor=frequency_3)
construct_domain_3 = ConstructDomain(DomainStart=pi_5, DomainEnd=pi_6)
range_3 = Range(Domain=construct_domain_3, Steps=steps_3)
multiplication_3 = Multiplication(A=range_3, B=graft(random_3))
sine_3 = Sine(Value=multiplication_3)
construct_point_3 = ConstructPoint(XCoordinate=range_3, YCoordinate=0, ZCoordinate=sine_3)
series_4 = Series(Start=0, Step=distance_3, Count=curves)
interpolate_3 = Interpolate(Vertices=construct_point_3, Degree=3, Periodic=False, KnotStyle=1)  # -> Curve, Length, Domain
scale_nu_3 = ScaleNU(Geometry=interpolate_3.Curve, Plane=PlaneXY(0, 0, 0), ScaleX=scale_x_3, ScaleY=1, ScaleZ=scale_z_3)  # -> Geometry, Transform
unit_y_3 = UnitY(Factor=series_4)
curves_2 = Number(curves)
unit_z_3 = UnitZ(Factor=depth_3)
partition_list = PartitionList(List=flatten(scale_nu_3.Geometry), Size=curves_2)
move_3 = Move(Geometry=partition_list, Motion=unit_y_3)  # -> Geometry, Transform
loft_3 = Loft(Curves=move_3.Geometry, Options={Adjust=False, Closed=False, LoftEnds=0, LoftSimp=0, LoftType=0, Rebuild=10, Refit=0.01})
extrude_3 = Extrude(Base=loft_3, Direction=unit_z_3)

# ---- group: arrange in a matrix
brep = Brep(extrude_3)
designs_2 = Number(designs)
square_root = SquareRoot(Value=designs_2)
division = Division(A=designs_2, B=square_root)
partition_list_2 = PartitionList(List=flatten(brep), Size=division)
series_5 = Series(Start=0, Step=spacing, Count=division)
unit_x = UnitX(Factor=series_5)
unit_y_4 = UnitY(Factor=series_5)
move_4 = Move(Geometry=partition_list_2, Motion=unit_x)  # -> Geometry, Transform
move_5 = Move(Geometry=move_4.Geometry, Motion=graft(unit_y_4))  # -> Geometry, Transform
custom_preview_3 = CustomPreview(Geometry=move_5.Geometry, Material=ColourSwatch(SwatchColor=RGB(204, 204, 204)))
