# Grasshopper definition mesh-attractors.gh (Grasshopper 1.0.7)
# Copyright: GNU General Public License 3.0

# ---- group: mesh from random points
# delaunay triangulation
# voronoi diagram
number_slider = Slider(10, range=0..10)
rectangle = Rectangle(Plane=PlaneXY(0, 0, 0), XSize=number_slider, YSize=number_slider, Radius=0)  # -> Rectangle, Length
populate_2d = Populate2D(Region=rectangle.Rectangle, Count=100, Seed=1)
delaunay_edges = DelaunayEdges(Points=populate_2d, Plane=PlaneXY(0, 0, 0))  # -> Connectivity, Edges

# ---- group: voronoi diagram from random points
number_slider_2 = Slider(10, range=0..10)
# mesh attractor
number_slider_3 = Slider(0.5, range=0..1)
rectangle_2 = Rectangle(Plane=PlaneXY(0, 0, 0), XSize=number_slider_2, YSize=number_slider_2, Radius=0)  # -> Rectangle, Length
populate_2d_2 = Populate2D(Region=rectangle_2.Rectangle, Count=100, Seed=1)
unit_z = UnitZ(Factor=number_slider_3)
voronoi = Voronoi(Points=populate_2d_2, Boundary=rectangle_2.Rectangle, BruteForceOverride=False)
extrude = Extrude(Base=voronoi, Direction=unit_z)

# ---- group: create grid
extents = Slider(10, range=0..10)
square = Square(Plane=PlaneXY(0, 0, 0), Size=1, ExtentX=extents, ExtentY=extents)  # -> Cells, Points
rectangle_3 = Rectangle(Plane=PlaneXY(0, 0, 0), XSize=extents, YSize=extents, Radius=0)  # -> Rectangle, Length
grid = Point(flatten(square.Points))
region = Rectangle(rectangle_3.Rectangle)

# ---- group: mesh shaped by attractors / set multiple attractors
# voronoi attractor
point = Point([Point(2.935578694, 8.472659962, 0), Point(2.770458601, 2.231120429, 0), Point(8.285469722, 8.269942564, 0)])

# ---- group: mesh shaped by attractors
extents_2 = Slider(10, range=0..10)
square_2 = Square(Plane=PlaneXY(0, 0, 0), Size=1, ExtentX=extents_2, ExtentY=extents_2)  # -> Cells, flatten(Points)
closest_point = ClosestPoint(Point=square_2.Points, Cloud=point)  # -> ClosestPoint, CPIndex, Distance
unit_z_2 = UnitZ(Factor=closest_point.Distance)
move = Move(Geometry=square_2.Points, Motion=unit_z_2)  # -> Geometry, Transform
delaunay_mesh = DelaunayMesh(Points=move.Geometry, Plane=PlaneXY(0, 0, 0))
mesh_edges = MeshEdges(Mesh=delaunay_mesh)  # -> NakedEdges, InteriorEdges, NonManifoldEdges

# ---- group: set multiple attractors
point_2 = Point([Point(7.882769214, 7.610649904, 0), Point(1.969347895, 7.917421259, 0), Point(3.068064969, 1.941892976, 0)])

# ----
grid_2 = Point(grid)
closest_point_2 = ClosestPoint(Point=grid_2, Cloud=point_2)  # -> ClosestPoint, CPIndex, Distance
bounds = Bounds(Numbers=closest_point_2.Distance)
remap_numbers = RemapNumbers(Value=closest_point_2.Distance, Source=bounds, Target="-2 To 2")  # -> Mapped, Clipped
unit_x = UnitX(Factor=remap_numbers.Mapped)
unit_y = UnitY(Factor=remap_numbers.Mapped)
move_2 = Move(Geometry=grid_2, Motion=unit_x)  # -> Geometry, Transform
move_3 = Move(Geometry=move_2.Geometry, Motion=unit_y)  # -> Geometry, Transform
points = Point(move_3.Geometry)

# ---- group: create cell boundaries
points_2 = Point(points)
region_2 = Rectangle(region)
scaling = Slider(0.8, range=0..1)
voronoi_2 = Voronoi(Points=points_2, Boundary=region_2, BruteForceOverride=False)
polygon_center = PolygonCenter(Polyline=voronoi_2)  # -> CenterV, CenterE, CenterA
scale = Scale(Geometry=voronoi_2, Center=polygon_center.CenterA, Factor=scaling)  # -> Geometry, Transform
boundary_surfaces = BoundarySurfaces(Edges=[voronoi_2, scale.Geometry])
surface = Surface(boundary_surfaces)

# ---- group: extrude cells
surface_2 = Surface(surface)
distance = Number(closest_point_2.Distance)
bounds_2 = Bounds(Numbers=distance)
remap_numbers_2 = RemapNumbers(Value=distance, Source=bounds_2, Target="0.25 To 1")  # -> Mapped, Clipped
unit_z_3 = UnitZ(Factor=remap_numbers_2.Mapped)
extrude_2 = Extrude(Base=surface_2, Direction=unit_z_3)
