# Grasshopper definition noise-forestry.gh (Grasshopper 1.0.7)
# plug-ins: Heteroptera, Pufferfish, EleFront, EdiTree, Noise 4D

# ----
# noise forest
depth = Slider(-0.5, range=-1..0)
extents = Slider(5, range=1..100)
scale = Slider(10, range=0..360)
square = Square(Plane=PlaneXY(0, 0, 0), Size=scale, ExtentX=extents, ExtentY=extents)  # -> Cells, flatten(Points)
polygon_center = PolygonCenter(Polyline=square.Cells)  # -> CenterV, CenterE, CenterA
scale_2 = Scale(Geometry=square.Cells, Center=polygon_center.CenterA, Factor=Slider(0.95, range=0..1))  # -> Geometry, Transform
unit_z = UnitZ(Factor=depth)
boundary_surfaces = BoundarySurfaces(Edges=scale_2.Geometry)
define_object_attributes = DefineObjectAttributes(Layer="Ground")
extrude = Extrude(Base=boundary_surfaces, Direction=unit_z)
bake_objects = BakeObjects(Geometry=extrude, Attributes=define_object_attributes, Bake=False)

# ----
# using 4D noise
scale_3 = Slider(1, range=0..10)
amplitude = Slider(2, range=0..10)
time = Slider(20, range=0..100)
size = Slider(2, range=0..360)
extents_2 = Slider(25, range=1..100)
square_2 = Square(Plane=PlaneXY(0, 0, 0), Size=size, ExtentX=extents_2, ExtentY=extents_2)  # -> Cells, flatten(Points)
simplexnoise = SimplexNoise(Values=square_2.Points, Time=time, Scale=scale_3)
multiplication = Multiplication(A=simplexnoise, B=amplitude)
vector_xyz = VectorXYZ(XComponent=multiplication, YComponent=multiplication, ZComponent=0)  # -> Vector, Length
move = Move(Geometry=square_2.Points, Motion=vector_xyz.Vector)  # -> Geometry, Transform

# ----
# using 4D noise
scale_4 = Slider(1, range=0..10)
amplitude_2 = Slider(2, range=0..10)
time_2 = Slider(20, range=0..100)
size_2 = Slider(0.5, range=0..10)
extents_3 = Slider(100, range=1..100)
square_3 = Square(Plane=PlaneXY(0, 0, 0), Size=size_2, ExtentX=extents_3, ExtentY=extents_3)  # -> Cells, flatten(Points)
simplexnoise_2 = SimplexNoise(Values=square_3.Points, Time=time_2, Scale=scale_4)
multiplication_2 = Multiplication(A=simplexnoise_2, B=amplitude_2)
vector_xyz_2 = VectorXYZ(XComponent=multiplication_2, YComponent=multiplication_2, ZComponent=0)  # -> Vector, Length
move_2 = Move(Geometry=square_3.Points, Motion=vector_xyz_2.Vector)  # -> Geometry, Transform

# ----
# using 4D noise
amplitude_3 = Slider(0.3, range=0..10)
scale_5 = Slider(9, range=0..10)
size_3 = Slider(0.125, range=0..10)
extents_4 = Slider(400, range=1..500)
time_3 = Slider(50, range=0..100)
square_4 = Square(Plane=PlaneXY(0, 0, 0), Size=size_3, ExtentX=extents_4, ExtentY=extents_4)  # -> Cells, flatten(Points)
simplexnoise_3 = SimplexNoise(Values=square_4.Points, Time=time_3, Scale=scale_5)
multiplication_3 = Multiplication(A=simplexnoise_3, B=amplitude_3)
vector_xyz_3 = VectorXYZ(XComponent=multiplication_3, YComponent=multiplication_3, ZComponent=0)  # -> Vector, Length
move_3 = Move(Geometry=square_4.Points, Motion=vector_xyz_3.Vector)  # -> Geometry, Transform

noise_factor = Number(multiplication)
point = Point(move.Geometry)
larger_than = LargerThan(FirstNumber=noise_factor, SecondNumber="0.0")  # -> LargerThan, OrEqualTo
dispatch = Dispatch(List=point, DispatchPattern=larger_than.OrEqualTo)  # -> ListA, ListB
dispatch_2 = Dispatch(List=noise_factor, DispatchPattern=larger_than.OrEqualTo)  # -> ListA, ListB

noise_factor_2 = Number(multiplication)
point_2 = Point(move_2.Geometry)
larger_than_2 = LargerThan(FirstNumber=noise_factor_2, SecondNumber="0.0")  # -> LargerThan, OrEqualTo
dispatch_3 = Dispatch(List=point_2, DispatchPattern=larger_than_2.OrEqualTo)  # -> ListA, ListB
dispatch_4 = Dispatch(List=noise_factor_2, DispatchPattern=larger_than_2.OrEqualTo)  # -> ListA, ListB

noise_factor_3 = Number(multiplication)
point_3 = Point(move_3.Geometry)
larger_than_3 = LargerThan(FirstNumber=noise_factor_3, SecondNumber="-0.3")  # -> LargerThan, OrEqualTo
dispatch_5 = Dispatch(List=noise_factor_3, DispatchPattern=larger_than_3.OrEqualTo)  # -> ListA, ListB
dispatch_6 = Dispatch(List=point_3, DispatchPattern=larger_than_3.OrEqualTo)  # -> ListA, ListB

# ---- group: import thea plant(s)
# using elefront
extended_geometry = ExtendedGeometry([<elefrontblock referenced from the Rhino model> x4])

# using elefront
extended_geometry_2 = ExtendedGeometry()

# using elefront
extended_geometry_3 = ExtendedGeometry([<elefrontblock referenced from the Rhino model> x5])

# ----
surface = Surface(boundary_surfaces)

# ---- group: distribute plants by noise map
# forest
# using pufferfish
# using heteroptera
list_length = ListLength(List=extended_geometry_3)
point_4 = Point(dispatch.ListA)
number = Number(dispatch_2.ListA)
jitter = Jitter(List=point_4, Jitter="1", Seed=2)  # -> Values, Indices
divide_list = DivideList(List=jitter.Values, Number=list_length)  # -> Chunk, Remainder
divide_list_2 = DivideList(List=extended_geometry_3, Number=list_length)  # -> Chunk, Remainder
min_max = MinMax(Number=number)  # -> Minimum, Maximum
move_to_point = MoveToPoint(Geometry=divide_list_2.Chunk, PointA=Point(0, 0, 0), PointB=divide_list.Chunk)  # -> flatten(Moved), flatten(Vector), Transform
construct_domain = ConstructDomain(DomainStart=min_max.Minimum, DomainEnd=min_max.Maximum)
domain = Panel("0.5 To 1.0")
remap_numbers = RemapNumbers(Value=number, Source=construct_domain, Target=domain)  # -> Mapped, Clipped
list_length_2 = ListLength(List=move_to_point.Moved)
random = Random(Range="0 To 360", Number=list_length_2, Seed=2)
rotate = Rotate(Geometry=move_to_point.Moved, Angle=degrees(random), Plane=move_to_point.Vector)  # -> Geometry, Transform
curve = Curve(surface)
polygon_center_2 = PolygonCenter(Polyline=curve)  # -> CenterV, CenterE, CenterA
scale_6 = Scale(Geometry=rotate.Geometry, Center=move_to_point.Vector, Factor=remap_numbers.Mapped)  # -> Geometry, Transform
center = Center(Geometrical=scale_6.Geometry)  # -> Center, Dimension
scale_7 = Scale(Geometry=curve, Center=polygon_center_2.CenterA, Factor="0.98")  # -> Geometry, Transform
point_in_curve = PointInCurve(Point=center.Center, Curve=graft(scale_7.Geometry))  # -> Relationship, Point
equality = Equality(FirstNumber=point_in_curve.Relationship, SecondNumber="0")  # -> Equality, Inequality
cull_pattern = CullPattern(List=scale_6.Geometry, CullPattern=equality.Inequality)
define_object_attributes_2 = DefineObjectAttributes(Layer="Trees")
flatten_tree = FlattenTree(Tree=cull_pattern, Path="{0}")
bake_objects_2 = BakeObjects(Geometry=flatten_tree, Attributes=define_object_attributes_2, Bake=False)

# ----
surface_2 = Surface(boundary_surfaces)

# ---- group: distribute plants by noise map
# shrubs
# using pufferfish
# using heteroptera
list_length_3 = ListLength(List=extended_geometry)
point_5 = Point(dispatch_3.ListB)
number_2 = Number(dispatch_4.ListB)
jitter_2 = Jitter(List=point_5, Jitter="1", Seed=2)  # -> Values, Indices
divide_list_3 = DivideList(List=extended_geometry, Number=list_length_3)  # -> Chunk, Remainder
divide_list_4 = DivideList(List=jitter_2.Values, Number=list_length_3)  # -> Chunk, Remainder
min_max_2 = MinMax(Number=number_2)  # -> Minimum, Maximum
move_to_point_2 = MoveToPoint(Geometry=divide_list_3.Chunk, PointA=Point(0, 0, 0), PointB=divide_list_4.Chunk)  # -> flatten(Moved), flatten(Vector), Transform
construct_domain_2 = ConstructDomain(DomainStart=min_max_2.Minimum, DomainEnd=min_max_2.Maximum)
domain_2 = Panel("0.5 To 1.0")
remap_numbers_2 = RemapNumbers(Value=number_2, Source=construct_domain_2, Target=domain_2)  # -> Mapped, Clipped
list_length_4 = ListLength(List=move_to_point_2.Moved)
random_2 = Random(Range="0 To 360", Number=list_length_4, Seed=2)
rotate_2 = Rotate(Geometry=move_to_point_2.Moved, Angle=degrees(random_2), Plane=move_to_point_2.Vector)  # -> Geometry, Transform
curve_2 = Curve(surface_2)
polygon_center_3 = PolygonCenter(Polyline=curve_2)  # -> CenterV, CenterE, CenterA
scale_8 = Scale(Geometry=rotate_2.Geometry, Center=move_to_point_2.Vector, Factor=remap_numbers_2.Mapped)  # -> Geometry, Transform
center_2 = Center(Geometrical=scale_8.Geometry)  # -> Center, Dimension
scale_9 = Scale(Geometry=curve_2, Center=polygon_center_3.CenterA, Factor="0.98")  # -> Geometry, Transform
point_in_curve_2 = PointInCurve(Point=center_2.Center, Curve=graft(scale_9.Geometry))  # -> Relationship, Point
equality_2 = Equality(FirstNumber=point_in_curve_2.Relationship, SecondNumber="0")  # -> Equality, Inequality
cull_pattern_2 = CullPattern(List=scale_8.Geometry, CullPattern=equality_2.Inequality)
define_object_attributes_3 = DefineObjectAttributes(Layer="Shrubs")
flatten_tree_2 = FlattenTree(Tree=cull_pattern_2, Path="{0}")
bake_objects_3 = BakeObjects(Geometry=flatten_tree_2, Attributes=define_object_attributes_3, Bake=False)

# ----
surface_3 = Surface(boundary_surfaces)

# ---- group: distribute plants by noise map
# grasses
# using pufferfish
# using heteroptera
list_length_5 = ListLength(List=extended_geometry_2)
point_6 = Point(dispatch_6.ListB)
number_3 = Number(dispatch_5.ListB)
jitter_3 = Jitter(List=point_6, Jitter="1", Seed=2)  # -> Values, Indices
divide_list_5 = DivideList(List=extended_geometry_2, Number=list_length_5)  # -> Chunk, Remainder
divide_list_6 = DivideList(List=jitter_3.Values, Number=list_length_5)  # -> Chunk, Remainder
min_max_3 = MinMax(Number=number_3)  # -> Minimum, Maximum
move_to_point_3 = MoveToPoint(Geometry=divide_list_5.Chunk, PointA=Point(0, 0, 0), PointB=divide_list_6.Chunk)  # -> flatten(Moved), flatten(Vector), Transform
construct_domain_3 = ConstructDomain(DomainStart=min_max_3.Minimum, DomainEnd=min_max_3.Maximum)
domain_3 = Panel("0.5 To 1.0")
remap_numbers_3 = RemapNumbers(Value=number_3, Source=construct_domain_3, Target=domain_3)  # -> Mapped, Clipped
list_length_6 = ListLength(List=move_to_point_3.Moved)
random_3 = Random(Range="0 To 360", Number=list_length_6, Seed=2)
rotate_3 = Rotate(Geometry=move_to_point_3.Moved, Angle=degrees(random_3), Plane=move_to_point_3.Vector)  # -> Geometry, Transform
curve_3 = Curve(surface_3)
polygon_center_4 = PolygonCenter(Polyline=curve_3)  # -> CenterV, CenterE, CenterA
scale_10 = Scale(Geometry=rotate_3.Geometry, Center=move_to_point_3.Vector, Factor=remap_numbers_3.Mapped)  # -> Geometry, Transform
center_3 = Center(Geometrical=scale_10.Geometry)  # -> Center, Dimension
scale_11 = Scale(Geometry=curve_3, Center=polygon_center_4.CenterA, Factor="0.98")  # -> Geometry, Transform
point_in_curve_3 = PointInCurve(Point=center_3.Center, Curve=graft(scale_11.Geometry))  # -> Relationship, Point
equality_3 = Equality(FirstNumber=point_in_curve_3.Relationship, SecondNumber="0")  # -> Equality, Inequality
cull_pattern_3 = CullPattern(List=scale_10.Geometry, CullPattern=equality_3.Inequality)
define_object_attributes_4 = DefineObjectAttributes(Layer="Grasses")
flatten_tree_3 = FlattenTree(Tree=cull_pattern_3, Path="{0}")
bake_objects_4 = BakeObjects(Geometry=flatten_tree_3, Attributes=define_object_attributes_4, Bake=False)
