# Grasshopper definition noise-garden.gh (Grasshopper 1.0.7)
# plug-ins: EleFront, EdiTree, Noise 4D

# ---- group: import thea plant(s)
# using elefront
extended_geometry = ExtendedGeometry([<elefrontblock referenced from the Rhino model> x4])

# ---- group: noise map on hexagonal grid
# using noise4d
Y = Slider(2, range=0..10)
extent_x = Slider(25, range=0..25)
extent_y = Slider(25, range=0..25)
time = Slider(1, range=0..100)
scale = Slider(0.05, range=0..1)
hexagonal = Hexagonal(Plane=PlaneXY(0, 0, 0), Size=Y, ExtentX=extent_x, ExtentY=extent_y)  # -> Cells, Points
perlinnoise = PerlinNoise(Values=flatten(hexagonal.Points), Time=time, Scale=scale)
bounds = Bounds(Numbers=perlinnoise)
remap_numbers = RemapNumbers(Value=perlinnoise, Source=bounds, Target=Domain(0, 1))  # -> Mapped, Clipped

# ---- group: ground
curve = Curve(hexagonal.Cells)
depth = Slider(1, range=0..10)
negative = Negative(Value=depth)
unit_z = UnitZ(Factor=negative)
extrude = Extrude(Base=curve, Direction=unit_z)
cap_holes = CapHoles(Brep=extrude)

# ---- group: pavers
offset = Slider(0.05, range=0..1)
# noise garden
curve_2 = Curve(hexagonal.Cells)
Z = Slider(0.3, range=0..3)
negative_2 = Negative(Value=offset)
unit_z_2 = UnitZ(Factor=Z)
offset_curve = OffsetCurve(Curve=curve_2, Distance=negative_2, Plane=PlaneXY(0, 0, 0), Corners=1)  # -> flatten(Curve)
extrude_2 = Extrude(Base=offset_curve, Direction=unit_z_2)
cap_holes_2 = CapHoles(Brep=extrude_2)

# ----
number = Number(remap_numbers.Mapped)
upper = Slider(0.5, range=0..1)

# ---- group: paving cull pattern
brep = Brep(cap_holes_2)
larger_than = LargerThan(FirstNumber=number, SecondNumber=upper)  # -> LargerThan, OrEqualTo
dispatch = Dispatch(List=number, DispatchPattern=larger_than.LargerThan)  # -> ListA, ListB
dispatch_2 = Dispatch(List=brep, DispatchPattern=larger_than.LargerThan)  # -> ListA, ListB
gradient = Gradient(LowerLimit=upper, UpperLimit=1, Parameter=dispatch.ListA, stops=[0: RGB(192, 192, 192), 1: RGB(64, 64, 64)])
custom_preview = CustomPreview(Geometry=dispatch_2.ListA, Material=gradient)

# ---- group: dispatch planting areas
curve_3 = Curve(hexagonal.Cells)
middle = Slider(0.3, range=0..1)
lower = Slider(0.2, range=0..1)
dispatch_3 = Dispatch(List=flatten(curve_3), DispatchPattern=larger_than.LargerThan)  # -> ListA, ListB
larger_than_2 = LargerThan(FirstNumber=dispatch.ListB, SecondNumber=middle)  # -> LargerThan, OrEqualTo
dispatch_4 = Dispatch(List=dispatch.ListB, DispatchPattern=larger_than_2.LargerThan)  # -> ListA, ListB
dispatch_5 = Dispatch(List=dispatch_3.ListB, DispatchPattern=larger_than_2.LargerThan)  # -> ListA, ListB
larger_than_3 = LargerThan(FirstNumber=dispatch_4.ListB, SecondNumber=lower)  # -> LargerThan, OrEqualTo
dispatch_6 = Dispatch(List=dispatch_5.ListB, DispatchPattern=larger_than_3.LargerThan)  # -> ListA, ListB

# ---- group: import thea plant(s)
# using elefront
extended_geometry_2 = ExtendedGeometry([<elefrontblock referenced from the Rhino model> x6])

# using elefront
extended_geometry_3 = ExtendedGeometry(<elefrontblock referenced from the Rhino model>)

# ---- group: bake ground
# using elefront
panel = Panel("soil")
define_layer = DefineLayer(Name=panel)
define_object_attributes = DefineObjectAttributes(Layer=define_layer)
bake_objects = BakeObjects(Geometry=cap_holes, Attributes=define_object_attributes, Bake=False)

# ---- group: bake pavers
# using elefront
panel_2 = Panel("paving")
define_layer_2 = DefineLayer(Name=panel_2)
define_object_attributes_2 = DefineObjectAttributes(Layer=define_layer_2)
bake_objects_2 = BakeObjects(Geometry=dispatch_2.ListA, Attributes=define_object_attributes_2, Bake=False)

# ---- group: grass areas
curve_4 = Curve(dispatch_5.ListA)

# ---- group: grasses
# using editree
curve_5 = Curve(curve_4)
seed = Slider(1, range=0..100)
list_length = ListLength(List=extended_geometry_2)
boundary_surfaces = BoundarySurfaces(Edges=curve_5)
list_length_2 = ListLength(List=curve_5)
divide_list = DivideList(List=extended_geometry_2, Number=list_length)  # -> Chunk, Remainder
random = Random(Range="50 To 100", Number=list_length_2, Seed=seed)
populate_geometry = PopulateGeometry(Geometry=boundary_surfaces, Count=random, Seed=1)  # -> flatten(Population)
jitter = Jitter(List=populate_geometry, Jitter="1", Seed=2)  # -> Values, Indices
divide_list_2 = DivideList(List=jitter.Values, Number=list_length)  # -> Chunk, Remainder
list_length_3 = ListLength(List=flatten(jitter.Values))
vector_2pt = Vector2Pt(PointA="0,0,0", PointB=divide_list_2.Chunk, Unitize=False)  # -> Vector, Length
random_2 = Random(Range="3 To 5", Number=list_length_3, Seed=seed)
move = Move(Geometry=divide_list.Chunk, Motion=vector_2pt.Vector)  # -> Geometry, Transform
scale_2 = Scale(Geometry=flatten(move.Geometry), Center=jitter.Values, Factor=random_2)  # -> Geometry, Transform
random_3 = Random(Range="0 To 360", Number=list_length_3, Seed=2)
plane = Plane(jitter.Values)
rotate = Rotate(Geometry=scale_2.Geometry, Angle=degrees(random_3), Plane=plane)  # -> Geometry, Transform

# ---- group: shrub areas
curve_6 = Curve(dispatch_6.ListA)

# ---- group: shrubs
# using editree
curve_7 = Curve(curve_6)
seed_2 = Slider(1, range=0..100)
list_length_4 = ListLength(List=extended_geometry)
boundary_surfaces_2 = BoundarySurfaces(Edges=curve_7)
list_length_5 = ListLength(List=curve_7)
divide_list_3 = DivideList(List=extended_geometry, Number=list_length_4)  # -> Chunk, Remainder
random_4 = Random(Range="1 To 3", Number=list_length_5, Seed=seed_2)
populate_geometry_2 = PopulateGeometry(Geometry=boundary_surfaces_2, Count=random_4, Seed=1)  # -> flatten(Population)
jitter_2 = Jitter(List=populate_geometry_2, Jitter="1", Seed=2)  # -> Values, Indices
divide_list_4 = DivideList(List=jitter_2.Values, Number=list_length_4)  # -> Chunk, Remainder
list_length_6 = ListLength(List=flatten(jitter_2.Values))
vector_2pt_2 = Vector2Pt(PointA="0,0,0", PointB=divide_list_4.Chunk, Unitize=False)  # -> Vector, Length
random_5 = Random(Range="3 To 6", Number=list_length_6, Seed=seed_2)
move_2 = Move(Geometry=divide_list_3.Chunk, Motion=vector_2pt_2.Vector)  # -> Geometry, Transform
scale_3 = Scale(Geometry=flatten(move_2.Geometry), Center=jitter_2.Values, Factor=random_5)  # -> Geometry, Transform
random_6 = Random(Range="0 To 360", Number=list_length_6, Seed=2)
plane_2 = Plane(jitter_2.Values)
rotate_2 = Rotate(Geometry=scale_3.Geometry, Angle=degrees(random_6), Plane=plane_2)  # -> Geometry, Transform

# ---- group: tree areas
curve_8 = Curve(dispatch_6.ListB)

# ---- group: trees
# using editree
curve_9 = Curve(curve_8)
seed_3 = Slider(1, range=0..100)
boundary_surfaces_3 = BoundarySurfaces(Edges=flatten(curve_9))
list_length_7 = ListLength(List=extended_geometry_3)
brep_join = BrepJoin(Breps=boundary_surfaces_3)  # -> Breps, Closed
brep_edges = BrepEdges(Brep=brep_join.Breps)  # -> Naked, Interior, NonManifold
divide_list_5 = DivideList(List=extended_geometry_3, Number=list_length_7)  # -> Chunk, Remainder
boundary_surfaces_4 = BoundarySurfaces(Edges=brep_edges.Naked)
populate_geometry_3 = PopulateGeometry(Geometry=boundary_surfaces_4, Count="1", Seed=1)  # -> flatten(Population)
jitter_3 = Jitter(List=populate_geometry_3, Jitter="1", Seed=2)  # -> Values, Indices
list_length_8 = ListLength(List=flatten(populate_geometry_3))
divide_list_6 = DivideList(List=jitter_3.Values, Number=list_length_7)  # -> Chunk, Remainder
random_7 = Random(Range="3 To 6", Number=list_length_8, Seed=seed_3)
vector_2pt_3 = Vector2Pt(PointA="0,0,0", PointB=divide_list_6.Chunk, Unitize=False)  # -> Vector, Length
move_3 = Move(Geometry=divide_list_5.Chunk, Motion=vector_2pt_3.Vector)  # -> Geometry, Transform
scale_4 = Scale(Geometry=flatten(move_3.Geometry), Center=jitter_3.Values, Factor=random_7)  # -> Geometry, Transform
random_8 = Random(Range="0 To 360", Number=list_length_8, Seed=2)
plane_3 = Plane(jitter_3.Values)
rotate_3 = Rotate(Geometry=scale_4.Geometry, Angle=degrees(random_8), Plane=plane_3)  # -> Geometry, Transform

# ---- group: bake shrubs
# using elefront
panel_3 = Panel("shrubs")
define_layer_3 = DefineLayer(Name=panel_3)
define_object_attributes_3 = DefineObjectAttributes(Layer=define_layer_3)
bake_objects_3 = BakeObjects(Geometry=rotate_2.Geometry, Attributes=define_object_attributes_3, Bake=False)

# ---- group: bake grasses
# using elefront
panel_4 = Panel("grasses")
define_layer_4 = DefineLayer(Name=panel_4)
define_object_attributes_4 = DefineObjectAttributes(Layer=define_layer_4)
bake_objects_4 = BakeObjects(Geometry=rotate.Geometry, Attributes=define_object_attributes_4, Bake=False)

# ---- group: bake trees
# using elefront
panel_5 = Panel("trees")
define_layer_5 = DefineLayer(Name=panel_5)
define_object_attributes_5 = DefineObjectAttributes(Layer=define_layer_5)
bake_objects_5 = BakeObjects(Geometry=rotate_3.Geometry, Attributes=define_object_attributes_5, Bake=False)
