# Grasshopper definition noise.gh (Grasshopper 1.0.7)
# Copyright: GNU General Public License 3.0
# plug-ins: Noise 4D

# ---- group: grid from noise
# noise
# with
# noise4d
# perlin noise grid
cellsize = Slider(1, range=0..10)
extent_x = Slider(25, range=0..150)
extent_y = Slider(25, range=0..150)
time = Slider(0, range=0..100)
scale = Slider(0.16, range=0..1)
square = Square(Plane=PlaneXY(0, 0, 0), Size=cellsize, ExtentX=extent_x, ExtentY=extent_y)  # -> flatten(Cells), Points
area = Area(Geometry=square.Cells)  # -> Area, Centroid
perlinnoise = PerlinNoise(Values=area.Centroid, Time=time, Scale=scale)
unit_z = UnitZ(Factor=cellsize)
extrude = Extrude(Base=square.Cells, Direction=unit_z)
bounds = Bounds(Numbers=perlinnoise)
deconstruct_domain = DeconstructDomain(Domain=bounds)  # -> Start, End
cap_holes = CapHoles(Brep=extrude)
gradient = Gradient(
    LowerLimit=deconstruct_domain.Start,
    UpperLimit=deconstruct_domain.End,
    Parameter=perlinnoise,
    stops=[0: RGB(68, 1, 84), 0.167: RGB(68, 57, 131), 0.334: RGB(49, 104, 142), 0.501: RGB(33, 145, 140), 0.668: RGB(53, 183, 121), 0.835: RGB(144, 215, 67), 1: RGB(253, 231, 37)])
custom_preview = CustomPreview(Geometry=cap_holes, Material=gradient)

# ---- group: construct mesh
# perlin noise mesh
extent_x_2 = Slider(25, range=0..100)
extent_y_2 = Slider(25, range=0..100)
time_2 = Slider(0, range=0..100)
scale_2 = Slider(0.16, range=0..1)
rectangle = Rectangle(Plane=PlaneXY(0, 0, 0), XSize=extent_x_2, YSize=extent_y_2, Radius=0)  # -> Rectangle, Length
mesh_plane = MeshPlane(Boundary=rectangle.Rectangle, WidthCount=expr("x-1", extent_x_2), HeightCount=expr("x-1", extent_y_2))  # -> Mesh, Area
deconstruct_mesh = DeconstructMesh(Mesh=mesh_plane.Mesh)  # -> Vertices, Faces, Colours, Normals
perlinnoise_2 = PerlinNoise(Values=deconstruct_mesh.Vertices, Time=time_2, Scale=scale_2)
mesh_face = MeshFace(deconstruct_mesh.Faces)
point = Point(deconstruct_mesh.Vertices)
noise = Number(perlinnoise_2)

# ---- group: 3d mesh from noise
point_2 = Point(point)
mesh_face_2 = MeshFace(mesh_face)
z_factor = Slider(1.5, range=0..10)
noise_2 = Number(noise)
bounds_2 = Bounds(Numbers=noise_2)
multiplication = Multiplication(A=z_factor, B=noise_2)
unit_z_2 = UnitZ(Factor=multiplication)
deconstruct_domain_2 = DeconstructDomain(Domain=bounds_2)  # -> Start, End
move = Move(Geometry=point_2, Motion=unit_z_2)  # -> Geometry, Transform
gradient_2 = Gradient(
    LowerLimit=deconstruct_domain_2.Start,
    UpperLimit=deconstruct_domain_2.End,
    Parameter=noise_2,
    stops=[0: RGB(68, 1, 84), 0.167: RGB(68, 57, 131), 0.334: RGB(49, 104, 142), 0.501: RGB(33, 145, 140), 0.668: RGB(53, 183, 121), 0.835: RGB(144, 215, 67), 1: RGB(253, 231, 37)])
construct_mesh = ConstructMesh(Vertices=move.Geometry, Faces=mesh_face_2)
mesh_colours = MeshColours(Mesh=construct_mesh, Colours=gradient_2)
mesh = Mesh(mesh_colours)

# ----
noise_3 = Panel(noise)
