# Grasshopper definition noisescape.gh (Grasshopper 1.0.7)
# plug-ins: Noise 4D, Pufferfish, BitmapPlus

# ---- group: simplex noise surface
# terrain from noise
# perlin noise
# using 4D noise
extent = Slider(40, range=0..100)
time = Slider(72, range=0..100)
scale = Slider(0.1, range=0..0.25)
# simplex noise
amplitude = Slider(6, range=0..10)
square = Square(Plane=PlaneXY(0, 0, 0), Size=1, ExtentX=extent, ExtentY=extent)  # -> Cells, flatten(Points)
perlinnoise = PerlinNoise(Values=square.Points, Time=time, Scale=scale)
multiplication = Multiplication(A=perlinnoise, B=amplitude)
unit_z = UnitZ(Factor=multiplication)
move = Move(Geometry=square.Points, Motion=unit_z)  # -> Geometry, Transform
extent_2 = Number(expr("x+1", extent))
surface_from_points = SurfaceFromPoints(Points=move.Geometry, UCount=extent_2, Interpolate=False)
custom_preview = CustomPreview(Geometry=surface_from_points, Material=ColourSwatch(SwatchColor=RGB(219, 219, 219)))

# using 4D noise
extent_3 = Slider(40, range=0..100)
time_2 = Slider(10, range=0..100)
scale_2 = Slider(0.07, range=0..0.25)
# solid modeling
amplitude_2 = Slider(6, range=0..10)
square_2 = Square(Plane=PlaneXY(0, 0, 0), Size=1, ExtentX=extent_3, ExtentY=extent_3)  # -> Cells, flatten(Points)
simplexnoise = SimplexNoise(Values=square_2.Points, Time=time_2, Scale=scale_2)
multiplication_2 = Multiplication(A=simplexnoise, B=amplitude_2)
unit_z_2 = UnitZ(Factor=multiplication_2)
move_2 = Move(Geometry=square_2.Points, Motion=unit_z_2)  # -> Geometry, Transform
extent_4 = Number(expr("x+1", extent_3))
surface_from_points_2 = SurfaceFromPoints(Points=move_2.Geometry, UCount=extent_4, Interpolate=False)
custom_preview_2 = CustomPreview(Geometry=surface_from_points_2, Material=ColourSwatch(SwatchColor=RGB(219, 219, 219)))

# ---- group: perlin noise surface
# using 4D noise
extent_5 = Slider(40, range=0..100)
time_3 = Slider(74, range=0..100)
scale_3 = Slider(0.16, range=0..0.25)
max_z = Slider(8, range=0..25)
square_3 = Square(Plane=PlaneXY(0, 0, 0), Size=1, ExtentX=extent_5, ExtentY=extent_5)  # -> Cells, flatten(Points)
perlinnoise_2 = PerlinNoise(Values=square_3.Points, Time=time_3, Scale=scale_3)
bounds = Bounds(Numbers=perlinnoise_2)
remap_numbers = RemapNumbers(Value=perlinnoise_2, Source=bounds, Target=max_z)  # -> Mapped, Clipped
unit_z_3 = UnitZ(Factor=remap_numbers.Mapped)
move_3 = Move(Geometry=square_3.Points, Motion=unit_z_3)  # -> Geometry, Transform
extent_6 = Number(expr("x+1", extent_5))
surface_from_points_3 = SurfaceFromPoints(Points=move_3.Geometry, UCount=extent_6, Interpolate=False)
surface = Surface(surface_from_points_3)

# ---- group: perlin noise image
# procedural noise image
# using bitmap+
seed = Slider(99, range=0..100)
extents = Slider(100, range=0..100)
depth = Slider(10, range=0..100)
mode = ValueList({"Value": 0, "Perlin": 1, "Cubic": 2, "Simplex": 3, "White": 4}, selected="Perlin")
interpolation = ValueList({"Linear": 0, "Hermite": 1, "Quintic": 2}, selected="Hermite")
# procedural noise surface
frequency = Slider(0.036, range=0..0.1)
procedural_noise = ProceduralNoise(Seed=seed, Width=extents, Height=extents, Depth=depth, Mode=mode, Interpolation=interpolation, Frequency=frequency)  # -> Image, Noise
prev_image = PrevImage(SmartBitmap=procedural_noise.Image)

# ---- group: perlin noise surface
# using bitmap+
extents_2 = Slider(100, range=0..100)
seed_2 = Slider(44, range=0..100)
depth_2 = Slider(32, range=0..100)
mode_2 = ValueList({"Value": 0, "Perlin": 1, "Cubic": 2, "Simplex": 3, "White": 4}, selected="Perlin")
interpolation_2 = ValueList({"Linear": 0, "Hermite": 1, "Quintic": 2}, selected="Hermite")
frequency_2 = Slider(0.045, range=0..0.1)
# fractal pass
intensity = Slider(8, range=0..100)
square_4 = Square(Plane=PlaneXY(0, 0, 0), Size=1, ExtentX=expr("x-1", extents_2), ExtentY=expr("x-1", extents_2))  # -> Cells, flatten(Points)
procedural_noise_2 = ProceduralNoise(
    Seed=seed_2,
    Width=extents_2,
    Height=extents_2,
    Depth=depth_2,
    Mode=mode_2,
    Interpolation=interpolation_2,
    Frequency=frequency_2)  # -> Image, Noise
deconstruct_bitmap = DeconstructBitmap(Image=procedural_noise_2.Image)
unit_z_4 = UnitZ(Factor=deconstruct_bitmap)
multiplication_3 = Multiplication(A=unit_z_4, B=intensity)
move_4 = Move(Geometry=square_4.Points, Motion=multiplication_3)  # -> Geometry, Transform
extent_7 = Number(extents_2)
surface_from_points_4 = SurfaceFromPoints(Points=move_4.Geometry, UCount=extent_7, Interpolate=False)
custom_preview_3 = CustomPreview(Geometry=surface_from_points_4, Material=ColourSwatch(SwatchColor=RGB(219, 219, 219)))
surface_2 = Surface(surface_from_points_4)

# ----
# using bitmap+
extents_3 = Slider(100, range=0..100)
seed_3 = Slider(99, range=0..100)
depth_3 = Slider(10, range=0..100)
mode_3 = ValueList({"Value": 0, "Perlin": 1, "Cubic": 2, "Simplex": 3, "White": 4}, selected="Perlin")
interpolation_3 = ValueList({"Linear": 0, "Hermite": 1, "Quintic": 2}, selected="Hermite")
frequency_3 = Slider(0.036, range=0..0.1)
mode_4 = ValueList({"FBM": 0, "Billow": 1, "Rigid": 2}, selected="FBM")
octaves = Slider(3, range=0..10)
lacunity = Slider(2, range=0..10)
gain = Slider(0.6, range=0..1)
# cellular surface
intensity_2 = Slider(5, range=0..10)
square_5 = Square(Plane=PlaneXY(0, 0, 0), Size=1, ExtentX=expr("x-1", extents_3), ExtentY=expr("x-1", extents_3))  # -> Cells, flatten(Points)
procedural_noise_3 = ProceduralNoise(
    Seed=seed_3,
    Width=extents_3,
    Height=extents_3,
    Depth=depth_3,
    Mode=mode_3,
    Interpolation=interpolation_3,
    Frequency=frequency_3)  # -> Image, Noise
procedural_fractal_pass = ProceduralFractalPass(Noise=procedural_noise_3.Noise, Mode=mode_4, Octaves=octaves, Lacunity=lacunity, Gain=gain)
deconstruct_bitmap_2 = DeconstructBitmap(Image=procedural_fractal_pass)
unit_z_5 = UnitZ(Factor=deconstruct_bitmap_2)
multiplication_4 = Multiplication(A=unit_z_5, B=intensity_2)
move_5 = Move(Geometry=square_5.Points, Motion=multiplication_4)  # -> Geometry, Transform
extent_8 = Number(extents_3)
surface_from_points_5 = SurfaceFromPoints(Points=move_5.Geometry, UCount=extent_8, Interpolate=False)
custom_preview_4 = CustomPreview(Geometry=surface_from_points_5, Material=ColourSwatch(SwatchColor=RGB(219, 219, 219)))
surface_3 = Surface(surface_from_points_5)

# ----
# using bitmap+
extents_4 = Slider(100, range=0..100)
seed_4 = Slider(25, range=0..100)
depth_4 = Slider(25, range=0..100)
boundary = ValueList({"Euclidean": 0, "Manhattan": 1, "Natural": 2}, selected="Euclidean")
interpolation_4 = Slider(5, range=0..5)
jitter = Slider(0.5, range=0..1)
frequency_4 = Slider(0.015, range=0..0.1)
intensity_3 = Slider(4, range=0..10)
square_6 = Square(Plane=PlaneXY(0, 0, 0), Size=1, ExtentX=expr("x-1", extents_4), ExtentY=expr("x-1", extents_4))  # -> Cells, flatten(Points)
procedural_cellular = ProceduralCellular(
    Seed=seed_4,
    Width=extents_4,
    Height=extents_4,
    Depth=depth_4,
    BoundaryMode=boundary,
    InterpolationMode=interpolation_4,
    Jitter=jitter,
    Frequency=frequency_4)
deconstruct_bitmap_3 = DeconstructBitmap(Image=procedural_cellular)
unit_z_6 = UnitZ(Factor=deconstruct_bitmap_3)
multiplication_5 = Multiplication(A=unit_z_6, B=intensity_3)
move_6 = Move(Geometry=square_6.Points, Motion=multiplication_5)  # -> Geometry, Transform
extent_9 = Number(extents_4)
surface_from_points_6 = SurfaceFromPoints(Points=move_6.Geometry, UCount=extent_9, Interpolate=False)
custom_preview_5 = CustomPreview(Geometry=surface_from_points_6, Material=ColourSwatch(SwatchColor=RGB(219, 219, 219)))
surface_4 = Surface(surface_from_points_6)

surface_5 = Surface(surface_from_points)
surface_6 = Surface(surface_from_points_2)

# ---- group: contours
surface_7 = Surface(surface_5)
interval = Slider(0.5, range=0..2)
contour = Contour(Shape=surface_7, Point=Point(0, 0, 0), Direction=Vector(0, 0, 1), Distance=interval)
custom_preview_6 = CustomPreview(Geometry=contour, Material=ColourSwatch(SwatchColor=RGB(38, 38, 38)))

surface_8 = Surface(surface_6)
interval_2 = Slider(0.5, range=0..2)
contour_2 = Contour(Shape=surface_8, Point=Point(0, 0, 0), Direction=Vector(0, 0, 1), Distance=interval_2)
custom_preview_7 = CustomPreview(Geometry=contour_2, Material=ColourSwatch(SwatchColor=RGB(38, 38, 38)))

# ---- group: preview
prev_image_2 = PrevImage(SmartBitmap=procedural_noise_2.Image)

prev_image_3 = PrevImage(SmartBitmap=procedural_cellular)

# ---- group: boolean difference
surface_9 = Surface(surface)
max_z_2 = Number(max_z)
extent_10 = Number(extent_5)
negative = Negative(Value=max_z_2)
plane_surface = PlaneSurface(Plane=PlaneXY(0, 0, 0), XSize=extent_10, YSize=extent_10)
unit_z_7 = UnitZ(Factor=negative)
extrude = Extrude(Base=surface_9, Direction=unit_z_7)
extrude_2 = Extrude(Base=plane_surface, Direction=unit_z_7)
solid_difference = SolidDifference(BrepsA=extrude, BrepsB=extrude_2)
custom_preview_8 = CustomPreview(Geometry=solid_difference, Material=ColourSwatch(SwatchColor=RGB(219, 219, 219)))

# ---- group: preview
prev_image_4 = PrevImage(SmartBitmap=procedural_fractal_pass)

# ---- group: cutting plane
surface_10 = Surface(surface_5)
water_depth = Slider(2, range=0..10)
bounding_rectangle = BoundingRectangle(Geometry=surface_10, Plane=PlaneXY(0, 0, 0), Axis=0, Slide=0, Union=True)  # -> Bounding, DimensionX, DimensionY
unit_z_8 = UnitZ(Factor=water_depth)
boundary_surfaces = BoundarySurfaces(Edges=bounding_rectangle.Bounding)
move_7 = Move(Geometry=boundary_surfaces, Motion=unit_z_8)  # -> Geometry, Transform
custom_preview_9 = CustomPreview(Geometry=move_7.Geometry, Material=ColourSwatch(SwatchColor=RGB(0, 0, 0)))

surface_11 = Surface(surface_6)
water_depth_2 = Slider(3.4, range=0..10)
bounding_rectangle_2 = BoundingRectangle(Geometry=surface_11, Plane=PlaneXY(0, 0, 0), Axis=0, Slide=0, Union=True)  # -> Bounding, DimensionX, DimensionY
unit_z_9 = UnitZ(Factor=water_depth_2)
boundary_surfaces_2 = BoundarySurfaces(Edges=bounding_rectangle_2.Bounding)
move_8 = Move(Geometry=boundary_surfaces_2, Motion=unit_z_9)  # -> Geometry, Transform
custom_preview_10 = CustomPreview(Geometry=move_8.Geometry, Material=ColourSwatch(SwatchColor=RGB(0, 0, 0)))
