# Grasshopper definition paneled-bench.gh (Grasshopper 1.0.7)
# Copyright: GNU General Public License 3.0

# ---- group: surface from interpolated curves
# parametric bench
point = Point(Point(0, 0, 0))
point_2 = Point(Point(0, 4.192741558, 1.359013339))
point_3 = Point(Point(0, 40.0280156, 0))
point_4 = Point(Point(2.624243035, 0, 0))
point_5 = Point(Point(5.092306532, 4.192741558, 0.3486026986))
point_6 = Point(Point(8.105550143, 14.05617472, 2.073408295))
point_7 = Point(Point(6.008178088, 20.31131201, 0.3200172636))
point_8 = Point(Point(3.59083715, 27.6912124, 0))
point_9 = Point(Point(3.000908326, 39.99856038, 0))
point_10 = Point(Point(0, 10.08962694, -1.082757608))
point_11 = Point(Point(0, 14.32175673, 0))
point_12 = Point(Point(0, 24, 0))
interpolate = Interpolate(Vertices=[point, point_2, point_10, point_11, point_12, point_3], Degree=3, Periodic=False, KnotStyle=1)  # -> Curve, Length, Domain
interpolate_2 = Interpolate(Vertices=[point_4, point_5, point_6, point_7, point_8, point_9], Degree=3, Periodic=False, KnotStyle=1)  # -> Curve, Length, Domain
ruled_surface = RuledSurface(CurveA=interpolate.Curve, CurveB=interpolate_2.Curve)

# ---- group: slice surface into panels
brep = Brep(ruled_surface)
ground = Slider(2, range=0..10)
X = Slider(0.6, range=0..2)
X_2 = Slider(0.3, range=0..2)
Z = Slider(1, range=0..2)
unit_z = UnitZ(Factor=ground)
move = Move(Geometry=brep, Motion=unit_z)  # -> Geometry, Transform
unit_y = UnitY(Factor=1)
contour = Contour(Shape=move.Geometry, Point=Point(0, 0, 0), Direction=unit_y, Distance=X)
unit_y_2 = UnitY(Factor=X_2)
unit_z_2 = UnitZ(Factor=Z)
extrude = Extrude(Base=contour, Direction=unit_y_2)
extrude_2 = Extrude(Base=extrude, Direction=unit_z_2)

# ----
ground_2 = Number(ground)
scaling = Slider(0.99, range=0..1)
curve = Curve([interpolate.Curve, interpolate_2.Curve])
radius = Slider(0.1, range=0..1)
Z_2 = Number(Z)
panel = Panel("""0.5
-0.5""")
division = Division(A=Z_2, B="2")
pipe = Pipe(Curve=curve, Radius=radius, Caps="1")  # -> flatten(Pipe)
addition = Addition(A=division, B=ground_2)
unit_z_3 = UnitZ(Factor=addition)
unit_x = UnitX(Factor=panel)
move_2 = Move(Geometry=pipe, Motion=unit_z_3)  # -> Geometry, Transform
move_3 = Move(Geometry=move_2.Geometry, Motion=unit_x)  # -> Geometry, Transform
bounding_box = BoundingBox(Content=move_3.Geometry, Plane=PlaneXY(0, 0, 0))  # -> Box, Box_2
box_properties = BoxProperties(Box=bounding_box.Box)  # -> Center, Diagonal, Area, Volume, Degeneracy
scale = Scale(Geometry=move_3.Geometry, Center=box_properties.Center, Factor=scaling)  # -> Geometry, Transform
custom_preview = CustomPreview(Geometry=scale.Geometry, Material=ColourSwatch(SwatchColor=RGB(92, 92, 92)))

# ----
# add expression x-1 to the index
# because the list starts at zero
brep_2 = Brep(flatten(extrude_2))
brep_3 = Brep(flatten(extrude))
Z_3 = Slider(2, range=0..10)
split_list = SplitList(List=brep_3, Index="1")  # -> ListA, ListB
split_list_2 = SplitList(List=brep_2, Index="1")  # -> ListA, ListB
negative = Negative(Value=Z_3)
list_length = ListLength(List=split_list_2.ListB)
list_length_2 = ListLength(List=split_list.ListB)
unit_z_4 = UnitZ(Factor=negative)
split_list_3 = SplitList(List=split_list.ListB, Index=expr("x-1", list_length_2))  # -> ListA, ListB
split_list_4 = SplitList(List=split_list_2.ListB, Index=expr("x-1", list_length))  # -> ListA, ListB
brep_4 = Brep([split_list.ListA, split_list_3.ListB])
brep_5 = Brep([split_list_2.ListA, split_list_4.ListB])
extrude_3 = Extrude(Base=brep_4, Direction=unit_z_4)
solid_union = SolidUnion(Breps=[brep_5, extrude_3])
custom_preview_2 = CustomPreview(Geometry=split_list_4.ListA, Material=ColourSwatch(SwatchColor=RGB(143, 70, 50)))
custom_preview_3 = CustomPreview(Geometry=solid_union, Material=ColourSwatch(SwatchColor=RGB(92, 92, 92)))
