# Grasshopper definition parametric-bench.gh (Grasshopper 1.0.7)
# Copyright: GNU General Public License 3.0

# ---- group: model surface
# parametric bench
point = Point(Point(0, 0, 0))
point_2 = Point(Point(0, 4.192741558, 1.359013339))
point_3 = Point(Point(0, 10.08962694, -1.082757608))
point_4 = Point(Point(0, 14.32175673, 0))
point_5 = Point(Point(0, 24, 0))
point_6 = Point(Point(0, 40.0280156, 0))
point_7 = Point(Point(0, 0, 0))
point_8 = Point(Point(2.5, 4.192741558, 0.3486026986))
point_9 = Point(Point(5.5, 14.05617472, 2.073408295))
point_10 = Point(Point(3.5, 20.31131201, 0.3200172636))
point_11 = Point(Point(1.576054248, 27.6912124, 0))
point_12 = Point(Point(0, 39.99856038, 0))
width = Slider(2.5, range=0..10)
interpolate = Interpolate(Vertices=[point, point_2, point_3, point_4, point_5, point_6], Degree=3, Periodic=False, KnotStyle=1)  # -> Curve, Length, Domain
interpolate_2 = Interpolate(Vertices=[point_7, point_8, point_9, point_10, point_11, point_12], Degree=3, Periodic=False, KnotStyle=1)  # -> Curve, Length, Domain
unit_x = UnitX(Factor=width)
move = Move(Geometry=interpolate_2.Curve, Motion=unit_x)  # -> Geometry, Transform
ruled_surface = RuledSurface(CurveA=interpolate.Curve, CurveB=move.Geometry)

# ---- group: model bench seat
surface = Brep(ruled_surface)
height = Slider(3.5, range=0..10)
thickness = Slider(0.5, range=0..2)
unit_z = UnitZ(Factor=height)
unit_z_2 = UnitZ(Factor=thickness)
move_2 = Move(Geometry=surface, Motion=unit_z)  # -> Geometry, Transform
negative = Negative(Value=unit_z_2)
extrude = Extrude(Base=move_2.Geometry, Direction=negative)
seat = Brep(extrude)

# ---- group: model bench legs
start_curve = Curve(interpolate.Curve)
end_curve = Curve(move.Geometry)
height_2 = Number(height)
thickness_2 = Number(thickness)
end_points = EndPoints(Curve=start_curve)  # -> Start, End
end_points_2 = EndPoints(Curve=end_curve)  # -> Start, End
line = Line(StartPoint=end_points.Start, EndPoint=end_points_2.Start)
line_2 = Line(StartPoint=end_points.End, EndPoint=end_points_2.End)
unit_z_3 = UnitZ(Factor=height_2)
unit_y = UnitY(Factor=thickness_2)
relay = Relay([line, line_2])
extrude_2 = Extrude(Base=relay, Direction=unit_z_3)
negative_2 = Negative(Value=unit_y)
extrude_3 = Extrude(Base=extrude_2, Direction=[unit_y, negative_2])
legs = Brep(extrude_3)

# ---- group: solid modeling
seat_2 = Brep(seat)
legs_2 = Brep(legs)
surface_2 = Brep(move_2.Geometry)
unit_z_4 = UnitZ(Factor="100")
solid_union = SolidUnion(Breps=[seat_2, legs_2])
extrude_4 = Extrude(Base=surface_2, Direction=unit_z_4)
solid_difference = SolidDifference(BrepsA=solid_union, BrepsB=extrude_4)
bench = Brep(solid_difference)

# ---- group: render bench
bench_2 = Brep(bench)
custom_preview = CustomPreview(Geometry=bench_2, Material=ColourSwatch(SwatchColor=RGB(204, 204, 204)))
