# Grasshopper definition parametric-cut-fill.gh (Grasshopper 1.0.7)
# Copyright: GNU General Public License 3.0
# plug-ins: Docofossor

# ----
# cut and fill
# with docofossor
# distance field
size = Slider(1, range=0..10)
extent = Slider(100, range=0..500)
square = Square(Plane=PlaneXY(0, 0, 0), Size=size, ExtentX=extent, ExtentY=extent)  # -> Cells, flatten(Points)
import_points = ImportPoints(Pts=square.Points)
grid_mesh = GridMesh(Df=import_points)
data = Data(import_points)
custom_preview = CustomPreview(Geometry=grid_mesh, Material=ColourSwatch(SwatchColor=RGB(217, 217, 217)))

# ----
# random population
extent_2 = Number(extent)
size_2 = Number(size)
Z = Slider(25, range=0..50)
count = Slider(10, range=0..100)
seed = Slider(0, range=0..100)
multiplication = Multiplication(A=extent_2, B=size_2)
negative = Negative(Value=Z)
domain = ConstructDomain(DomainStart=negative, DomainEnd=Z)
domain_box = DomainBox(Base=PlaneXY(0, 0, 0), X=multiplication, Y=multiplication, Z=domain)
populate_3d = Populate3D(Region=domain_box, Count=count, Seed=seed)
point = Point(populate_3d)

# ----
# cut in point
data_2 = Data(data)
point_2 = Point(point)
slope = Slider(30, range=0..100)
distance = Slider(90, range=0..100)
cut_in_point = CutInPoint(Df=data_2, Pt=point_2, Sa=slope, D=distance)  # -> Df, Vol
grid_mesh_2 = GridMesh(Df=cut_in_point.Df)
custom_preview_2 = CustomPreview(Geometry=grid_mesh_2, Material=ColourSwatch(SwatchColor=RGB(217, 217, 217)))

# ----
# fill in point
data_3 = Data(data)
point_3 = Point(point)
slope_2 = Slider(33, range=0..100)
distance_2 = Slider(90, range=0..100)
fill_in_point = FillInPoint(Df=data_3, Pt=point_3, Sa=slope_2, D=distance_2)  # -> Df, Vol
grid_mesh_3 = GridMesh(Df=fill_in_point.Df)
custom_preview_3 = CustomPreview(Geometry=grid_mesh_3, Material=ColourSwatch(SwatchColor=RGB(217, 217, 217)))

# ----
# cut on point
data_4 = Data(data)
point_4 = Point(point)
depth = Slider(10, range=0..100)
slope_3 = Slider(20, range=0..100)
cut_on_point = CutOnPoint(Df=data_4, Pt=point_4, Mxd=depth, Sa=slope_3)  # -> Df, Vol
grid_mesh_4 = GridMesh(Df=cut_on_point.Df)
custom_preview_4 = CustomPreview(Geometry=grid_mesh_4, Material=ColourSwatch(SwatchColor=RGB(217, 217, 217)))

# ----
# fill on point
data_5 = Data(data)
point_5 = Point(point)
depth_2 = Slider(10, range=0..100)
slope_4 = Slider(20, range=0..100)
fill_on_point = FillOnPoint(Df=data_5, Pt=point_5, Mxh=depth_2, Sa=slope_4)  # -> Df, Vol
grid_mesh_5 = GridMesh(Df=fill_on_point.Df)
custom_preview_5 = CustomPreview(Geometry=grid_mesh_5, Material=ColourSwatch(SwatchColor=RGB(217, 217, 217)))
