# Grasshopper definition parametric-flagstones.gh (Grasshopper 1.0.7)
# plug-ins: Noise 4D

# ----
# parametric flagstones
# randomly shaped flagstones
Y = Slider(2, range=0..10)
extent_x = Slider(4, range=0..25)
extent_y = Slider(4, range=0..25)
points = Slider(6, range=0..10)
seed = Slider(1, range=0..100)
# randomly scaled flagstones
height = Slider(0.2, range=0..1)
hexagonal = Hexagonal(Plane=PlaneXY(0, 0, 0), Size=Y, ExtentX=extent_x, ExtentY=extent_y)  # -> flatten(Cells), flatten(Points)
list_length = ListLength(List=hexagonal.Points)
random = Random(Range="1 To 999999", Number=list_length, Seed=seed)
boundary_surfaces = BoundarySurfaces(Edges=hexagonal.Cells)
populate_geometry = PopulateGeometry(Geometry=boundary_surfaces, Count=points, Seed=random)
unit_z = UnitZ(Factor=height)
convex_hull = ConvexHull(Points=populate_geometry, Plane=PlaneXY(0, 0, 0))  # -> Hull, HullZ, Indices
fillet = Fillet(Curve=convex_hull.Hull, Radius="0.5")  # -> flatten(Curve)
extrude = Extrude(Base=fillet, Direction=unit_z)
cap_holes = CapHoles(Brep=extrude)
custom_preview = CustomPreview(Geometry=cap_holes, Material=ColourSwatch(SwatchColor=RGB(92, 92, 92)))

Y_2 = Slider(2, range=0..10)
extent_x_2 = Slider(4, range=0..25)
extent_y_2 = Slider(4, range=0..25)
seed_2 = Slider(1, range=0..100)
height_2 = Slider(0.2, range=0..1)
hexagonal_2 = Hexagonal(Plane=PlaneXY(0, 0, 0), Size=Y_2, ExtentX=extent_x_2, ExtentY=extent_y_2)  # -> flatten(Cells), flatten(Points)
list_length_2 = ListLength(List=hexagonal_2.Points)
boundary_surfaces_2 = BoundarySurfaces(Edges=hexagonal_2.Cells)
random_2 = Random(Range="3 To 9", Number=list_length_2, Seed=seed_2)
random_3 = Random(Range="1 To 999999", Number=list_length_2, Seed=seed_2)
populate_geometry_2 = PopulateGeometry(Geometry=boundary_surfaces_2, Count=random_2, Seed=random_3)
convex_hull_2 = ConvexHull(Points=populate_geometry_2, Plane=PlaneXY(0, 0, 0))  # -> Hull, HullZ, Indices
unit_z_2 = UnitZ(Factor=height_2)
fillet_2 = Fillet(Curve=convex_hull_2.Hull, Radius="0.5")  # -> flatten(Curve)
extrude_2 = Extrude(Base=fillet_2, Direction=unit_z_2)
polygon_center = PolygonCenter(Polyline=convex_hull_2.Hull)  # -> CenterV, CenterE, CenterA
random_4 = Random(Range="0.5 To 1.0", Number=list_length_2, Seed=seed_2)
cap_holes_2 = CapHoles(Brep=extrude_2)
scale_nu = ScaleNU(Geometry=cap_holes_2, Plane=flatten(polygon_center.CenterA), ScaleX=random_4, ScaleY=random_4, ScaleZ=1)  # -> Geometry, Transform
custom_preview_2 = CustomPreview(Geometry=scale_nu.Geometry, Material=ColourSwatch(SwatchColor=RGB(92, 92, 92)))

# ----
# noisy flagstone path
# using noise4d
Y_3 = Slider(2, range=0..10)
extent_x_3 = Slider(20, range=0..25)
extent_y_3 = Slider(10, range=0..25)
points_2 = Slider(6, range=0..10)
seed_3 = Slider(1, range=0..100)
height_3 = Slider(0.1, range=0..1)
time = Slider(6, range=0..32)
scale = Slider(0.05, range=0..1)
threshold = Slider(0.6, range=0..1)
hexagonal_3 = Hexagonal(Plane=PlaneXY(0, 0, 0), Size=Y_3, ExtentX=extent_x_3, ExtentY=extent_y_3)  # -> flatten(Cells), flatten(Points)
list_length_3 = ListLength(List=hexagonal_3.Points)
random_5 = Random(Range="1 To 999999", Number=list_length_3, Seed=seed_3)
boundary_surfaces_3 = BoundarySurfaces(Edges=hexagonal_3.Cells)
perlinnoise = PerlinNoise(Values=hexagonal_3.Points, Time=time, Scale=scale)
populate_geometry_3 = PopulateGeometry(Geometry=boundary_surfaces_3, Count=points_2, Seed=random_5)
bounds = Bounds(Numbers=perlinnoise)
remap_numbers = RemapNumbers(Value=perlinnoise, Source=bounds, Target=Domain(0, 1))  # -> Mapped, Clipped
convex_hull_3 = ConvexHull(Points=populate_geometry_3, Plane=PlaneXY(0, 0, 0))  # -> flatten(Hull), HullZ, Indices
unit_z_3 = UnitZ(Factor=height_3)
larger_than = LargerThan(FirstNumber=remap_numbers.Mapped, SecondNumber=threshold)  # -> LargerThan, OrEqualTo
fillet_3 = Fillet(Curve=convex_hull_3.Hull, Radius="0.5")
extrude_3 = Extrude(Base=fillet_3, Direction=unit_z_3)
cap_holes_3 = CapHoles(Brep=extrude_3)
cull_pattern = CullPattern(List=remap_numbers.Mapped, CullPattern=larger_than.LargerThan)
cull_pattern_2 = CullPattern(List=cap_holes_3, CullPattern=larger_than.LargerThan)
gradient = Gradient(LowerLimit=threshold, UpperLimit=1, Parameter=cull_pattern, stops=[0: RGB(128, 128, 128), 1: RGB(64, 64, 64)])
custom_preview_3 = CustomPreview(Geometry=cull_pattern_2, Material=gradient)
