# Grasshopper definition parametric-grove.gh (Grasshopper 1.0.7)

# ---- group: generate a conical tree
# diameter at breast height (DBH)
crown_height = Slider(30, range=0..75)
canopy_layers = Slider(3, range=0..10)
canopy_diameter = Slider(10, range=0..100)
# parametric tree
trunk_diameter = Slider(0.75, range=0..2)
trunk_height = Slider(8, range=0..100)
conical_tree = ConicalTree(A=trunk_diameter, factor=trunk_height, factor_2=crown_height, B=canopy_layers, A_2=canopy_diameter)  # -> trunk, result
canopy_color = ColourSwatch(SwatchColor=RGBA(58, 94, 58, 232))
trunk_color = ColourSwatch(SwatchColor=RGB(139, 76, 57))
custom_preview = CustomPreview(Geometry=conical_tree.trunk, Material=trunk_color)
custom_preview_2 = CustomPreview(Geometry=conical_tree.result, Material=canopy_color)

# ---- group: array trees in a grid
# grid by age
trunks = Geometry(conical_tree.trunk)
canopies = Geometry(conical_tree.result)
size = Slider(15, range=0..360)
xy = Slider(9, range=0..360)
jitter = Slider(0.3, range=0..1)
seed = Slider(100, range=0..100)
square = Square(Plane=PlaneXY(0, 0, 0), Size=size, ExtentX=xy, ExtentY=xy)  # -> Cells, Points
vector_2pt = Vector2Pt(PointA="0,0,0", PointB=flatten(square.Points), Unitize=False)  # -> Vector, Length
vector_2pt_2 = Vector2Pt(PointA="0,0,0", PointB=flatten(square.Points), Unitize=False)  # -> Vector, Length
list_length = ListLength(List=flatten(square.Points))
move = Move(Geometry=trunks, Motion=vector_2pt.Vector)  # -> Geometry, Transform
move_2 = Move(Geometry=canopies, Motion=vector_2pt_2.Vector)  # -> Geometry, Transform
range = Range(Domain="0.5 To 1.0", Steps=list_length)
jitter_2 = Jitter(List=range, Jitter=jitter, Seed=seed)  # -> Values, Indices
scale = Scale(Geometry=move_2.Geometry, Center=vector_2pt_2.Vector, Factor=jitter_2.Values)  # -> Geometry, Transform

# ---- group: trunk color
# color
trunk_color_2 = ColourSwatch(SwatchColor=RGB(139, 76, 57))
custom_preview_3 = CustomPreview(Geometry=move.Geometry, Material=trunk_color_2)

# ---- group: canopy color
canopy_color_2 = ColourSwatch(SwatchColor=RGBA(58, 94, 58, 232))
canopy_color_3 = ColourSwatch(SwatchColor=RGBA(191, 115, 48, 232))
canopy_color_4 = ColourSwatch(SwatchColor=RGBA(128, 64, 64, 232))
range_2 = Range(Domain=Domain(0, 1), Steps=list_length)
colour = Colour([canopy_color_2, canopy_color_3, canopy_color_4])
interpolate_data = InterpolateData(Data=colour, Parameter=range_2, Interpolation=2)
custom_preview_4 = CustomPreview(Geometry=scale.Geometry, Material=interpolate_data)

# ==== cluster ConicalTree
factor = ClusterInput()
factor_2 = ClusterInput()
A = ClusterInput()
A_2 = ClusterInput()

# ---- group: conical tree
construct_point = ConstructPoint(XCoordinate=0, YCoordinate=0, ZCoordinate=0)
unit_z = UnitZ(Factor=factor)
unit_z_2 = UnitZ(Factor=factor_2)
division = Division(A=A, B="2.0")
division_2 = Division(A=A_2, B="2.0")
B = ClusterInput()
move = Move(Geometry=construct_point, Motion=unit_z_2)  # -> Geometry, Transform
move_2 = Move(Geometry=construct_point, Motion=unit_z)  # -> Geometry, Transform
division_3 = Division(A=unit_z_2, B=B)
line = Line(StartPoint=construct_point, EndPoint=move_2.Geometry)
line_2 = Line(StartPoint=move_2.Geometry, EndPoint=move.Geometry)
divide_distance = DivideDistance(Curve=line_2, Distance=division_3)  # -> Points, Tangents, Parameters
construct_plane = ConstructPlane(Origin=divide_distance.Points, XAxis=Vector(1, 0, 0), YAxis=Vector(0, 1, 0))
construct_domain = ConstructDomain(DomainStart="0.5", DomainEnd="1.75")
cone = Cone(Base=construct_plane, Radius=division_2, Length=division_3)  # -> Cone, Tip
list_length = ListLength(List=construct_plane)
range = Range(Domain=construct_domain, Steps=list_length)  # -> reverse(Range)
scale = Scale(Geometry=cone.Cone, Center=construct_plane, Factor=range)  # -> Geometry, Transform
pipe = Pipe(Curve=line, Radius=division, Caps=0)
cap_holes = CapHoles(Brep=scale.Geometry)
solid_union = SolidUnion(Breps=cap_holes)

# ----
trunk = ClusterOutput(pipe)
result = ClusterOutput(solid_union)
