# Grasshopper definition parametric-landforms.gh (Grasshopper 1.0.7)
# plug-ins: EleFront

# ---- group: surface from random points
# terrain from random points
xy = Slider(25, range=0..100)
count = Slider(100, range=0..1000)
seed = Slider(100, range=0..100)
# terrain visualization
flexibility = Slider(1, range=0..1)
spans = Slider(50, range=0..100)
rectangle = Rectangle(Plane=PlaneXY(0, 0, 0), XSize=xy, YSize=xy, Radius=0)  # -> Rectangle, Length
populate_2d = Populate2D(Region=rectangle.Rectangle, Count=count, Seed=seed)
random = Random(Range="-2 To 2", Number=count, Seed=seed)
unit_z = UnitZ(Factor=random)
move = Move(Geometry=populate_2d, Motion=unit_z)  # -> Geometry, Transform
patch = Patch(Curves=rectangle.Rectangle, Points=move.Geometry, Spans=spans, Flexibility=flexibility, Trim=True)
custom_preview = CustomPreview(Geometry=patch, Material=ColourSwatch(SwatchColor=RGB(204, 204, 204)))

# ---- group: contours
brep = Brep(patch)
distance = Slider(0.5, range=0..1)
contour = Contour(Shape=brep, Point=Point(0, 0, 0), Direction=Vector(0, 0, 1), Distance=distance)
custom_preview_2 = CustomPreview(Geometry=contour, Material=ColourSwatch(SwatchColor=RGB(0, 0, 0)))

# ---- group: cutting plane
rectangle_2 = Rectangle(rectangle.Rectangle)
depth = Slider(-0.5, range=-2..2)
unit_z_2 = UnitZ(Factor=depth)
boundary_surfaces = BoundarySurfaces(Edges=rectangle_2)
move_2 = Move(Geometry=boundary_surfaces, Motion=unit_z_2)  # -> Geometry, Transform
custom_preview_3 = CustomPreview(Geometry=move_2.Geometry, Material=ColourSwatch(SwatchColor=RGB(0, 0, 0)))

# ---- group: extrude and bake for 3d printing
# solid for 3d printing
# using elefront
brep_2 = Brep(patch)
depth_2 = Slider(4, range=0..10)
rectangle_3 = Rectangle(rectangle.Rectangle)
negative = Negative(Value=depth_2)
division = Division(A=negative, B="2")
unit_z_3 = UnitZ(Factor=negative)
unit_z_4 = UnitZ(Factor=division)
boundary_surfaces_2 = BoundarySurfaces(Edges=rectangle_3)
polygon_center = PolygonCenter(Polyline=rectangle_3)  # -> CenterV, CenterE, CenterA
move_3 = Move(Geometry=boundary_surfaces_2, Motion=unit_z_4)  # -> Geometry, Transform
extrude = Extrude(Base=brep_2, Direction=unit_z_3)
scale_nu = ScaleNU(Geometry=move_3.Geometry, Plane=polygon_center.CenterV, ScaleX="2", ScaleY="2", ScaleZ=1)  # -> Geometry, Transform
split_brep = SplitBrep(Brep=extrude, Cutter=scale_nu.Geometry)
list_item = ListItem(List=split_brep, Index="0", Wrap=True)
cap_holes = CapHoles(Brep=list_item)
bake_objects = BakeObjects(Geometry=cap_holes, Bake=False)

# ----
# terrain from grid
size = Slider(1, range=0..10)

xy_2 = Slider(11, range=0..100)
seed_2 = Slider(100, range=0..100)
square = Square(Plane=PlaneXY(0, 0, 0), Size=size, ExtentX=xy_2, ExtentY=xy_2)  # -> Cells, flatten(Points)
list_length = ListLength(List=square.Points)
random_2 = Random(Range="-1 To 1", Number=list_length, Seed=seed_2)
unit_z_5 = UnitZ(Factor=random_2)
move_4 = Move(Geometry=square.Points, Motion=unit_z_5)  # -> Geometry, Transform
surface_from_points = SurfaceFromPoints(Points=move_4.Geometry, UCount=expr("x+1", xy_2), Interpolate=Toggle(True))
custom_preview_4 = CustomPreview(Geometry=surface_from_points, Material=ColourSwatch(SwatchColor=RGB(204, 204, 204)))
