# Grasshopper definition parametric-paving.gh (Grasshopper 1.0.7)

# ---- group: paver from extruded rectangle
Z = Slider(1, range=0..10)
# parametric paver
X = Slider(2, range=0..10)
Y = Slider(4, range=0..10)
unit_z = UnitZ(Factor=Z)
rectangle = Rectangle(Plane=PlaneXY(0, 0, 0), XSize=X, YSize=Y, Radius=0)  # -> Rectangle, Length
extrude = Extrude(Base=rectangle.Rectangle, Direction=unit_z)
cap_holes = CapHoles(Brep=extrude)

# ---- group: move paver once
# row of pavers
X_2 = Slider(2, range=0..10)
Y_2 = Slider(4, range=0..10)
Z_2 = Slider(1, range=0..10)
spacing = Slider(1.25, range=1..2)
paver = Paver(x_size=X_2, y_size=Y_2, z_size=Z_2)
multiplication = Multiplication(A=Y_2, B=spacing)
unit_y = UnitY(Factor=multiplication)
move = Move(Geometry=paver, Motion=unit_y)  # -> Geometry, Transform

# ---- group: paver cluster
# cluster
# clusters package algorithms
# for reusability, modularity,
# and brevity
X_3 = Slider(2, range=0..10)
Y_3 = Slider(4, range=0..10)
Z_3 = Slider(1, range=0..10)
paver_2 = Paver(x_size=X_3, y_size=Y_3, z_size=Z_3)

# ---- group: linear array of pavers
# color gradient of pavers
X_4 = Slider(2, range=0..10)
Y_4 = Slider(4, range=0..10)
Z_4 = Slider(1, range=0..10)
spacing_2 = Slider(1.25, range=1..2)
count = Slider(10, range=0..10)
paver_3 = Paver(x_size=X_4, y_size=Y_4, z_size=Z_4)
multiplication_2 = Multiplication(A=Y_4, B=spacing_2)
unit_y_2 = UnitY(Factor=multiplication_2)
linear_array = LinearArray(Geometry=paver_3, Direction=unit_y_2, Count=count)  # -> Geometry, Transform

# ---- group: grid of hexagonal pavers
# hexagonal grid of pavers
size = Slider(2, range=0..10)
extent_x = Slider(10, range=0..10)
extent_y = Slider(10, range=0..10)
scaling = Slider(0.9, range=0..1)
height = Slider(1, range=0..3)
unit_z_2 = UnitZ(Factor=height)
hexagonal = Hexagonal(Plane=PlaneXY(0, 0, 0), Size=size, ExtentX=extent_x, ExtentY=extent_y)  # -> Cells, Points
extrude_2 = Extrude(Base=hexagonal.Cells, Direction=unit_z_2)
cap_holes_2 = CapHoles(Brep=extrude_2)
scale_nu = ScaleNU(Geometry=cap_holes_2, Plane=hexagonal.Points, ScaleX=scaling, ScaleY=scaling, ScaleZ=1)  # -> Geometry, Transform
list_length = ListLength(List=scale_nu.Geometry)
range = Range(Domain=Domain(0, 1), Steps=expr("x-1", list_length))
gradient = Gradient(LowerLimit=0, UpperLimit=1, Parameter=range, stops=[0.15: RGB(192, 192, 192), 0.85: RGB(105, 105, 105)])
custom_preview = CustomPreview(Geometry=scale_nu.Geometry, Material=gradient)

# ---- group: rectangular array of pavers
# grid of pavers
X_5 = Slider(2, range=0..10)
Y_5 = Slider(2, range=0..10)
Z_5 = Slider(1, range=0..10)
spacing_3 = Slider(0.5, range=0..1)
x_count = Slider(10, range=0..10)
y_count = Slider(10, range=0..10)
paver_4 = Paver(x_size=X_5, y_size=Y_5, z_size=Z_5)
addition = Addition(A=[X_5, Y_5], B=spacing_3)
split_list = SplitList(List=addition, Index="1")  # -> ListA, ListB
rectangle_2 = Rectangle(Plane=PlaneXY(0, 0, 0), XSize=split_list.ListA, YSize=split_list.ListB, Radius=0)  # -> Rectangle, Length
rectangular_array = RectangularArray(Geometry=paver_4, Cell=rectangle_2.Rectangle, XCount=x_count, YCount=y_count)  # -> Geometry, Transform

# ---- group: reference geometry from rhino
# simple paving patterns
# modeled paver
# draw a box in rhino,
# right click on this component,
# click set one geometry,
# and then select the box in rhino
geometry = Geometry(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)

# ---- group: paver from rectangular box
X_6 = Slider(2, range=0..10)
Y_6 = Slider(4, range=0..10)
Z_6 = Slider(1, range=0..10)
rectangle_3 = Rectangle(Plane=PlaneXY(0, 0, 0), XSize=X_6, YSize=Y_6, Radius=0)  # -> Rectangle, Length
box_rectangle = BoxRectangle(Rectangle=rectangle_3.Rectangle, Height=Z_6)

# ---- group: move multiple pavers
X_7 = Slider(2, range=0..10)
Y_7 = Slider(4, range=0..10)
Z_7 = Slider(1, range=0..10)
spacing_4 = Slider(1.25, range=1..2)
steps = Slider(9, range=0..10)
paver_5 = Paver(x_size=X_7, y_size=Y_7, z_size=Z_7)
multiplication_3 = Multiplication(A=Y_7, B=spacing_4)
multiplication_4 = Multiplication(A=multiplication_3, B=steps)
range_2 = Range(Domain=multiplication_4, Steps=steps)
unit_y_3 = UnitY(Factor=range_2)
move_2 = Move(Geometry=paver_5, Motion=unit_y_3)  # -> Geometry, Transform

# ---- group: set grayscale gradient
range_3 = Range(Domain=Domain(0, 1), Steps=expr("x-1", count))
gradient_2 = Gradient(LowerLimit=0, UpperLimit=1, Parameter=range_3, stops=[0.15: RGB(211, 211, 211), 0.85: RGB(105, 105, 105)])
custom_preview_2 = CustomPreview(Geometry=linear_array.Geometry, Material=gradient_2)

multiplication_5 = Multiplication(A=x_count, B=y_count)
range_4 = Range(Domain=Domain(0, 1), Steps=expr("x-1", multiplication_5))
gradient_3 = Gradient(LowerLimit=0, UpperLimit=1, Parameter=range_4, stops=[0.15: RGB(211, 211, 211), 0.85: RGB(105, 105, 105)])
custom_preview_3 = CustomPreview(Geometry=rectangular_array.Geometry, Material=gradient_3)

# ---- group: paver from box
X_8 = Slider(1, range=0..10)
Y_8 = Slider(2, range=0..10)
Z_8 = Slider(0.5, range=0..1)
construct_point = ConstructPoint(XCoordinate=X_8, YCoordinate=Y_8, ZCoordinate=Z_8)
center_box = CenterBox(Base=construct_point, X=X_8, Y=Y_8, Z=Z_8)

# ---- group: linear array of pavers
Y_9 = Slider(4, range=0..10)
X_9 = Slider(2, range=0..10)
Z_9 = Slider(1, range=0..10)
spacing_5 = Slider(1.25, range=1..2)
count_2 = Slider(10, range=0..10)
paver_6 = Paver(x_size=X_9, y_size=Y_9, z_size=Z_9)
multiplication_6 = Multiplication(A=Y_9, B=spacing_5)
unit_y_4 = UnitY(Factor=multiplication_6)
linear_array_2 = LinearArray(Geometry=paver_6, Direction=unit_y_4, Count=count_2)  # -> Geometry, Transform

X_10 = Slider(2, range=0..10)
Y_10 = Slider(4, range=0..10)
Z_10 = Slider(1, range=0..10)
spacing_6 = Slider(1.25, range=1..2)
count_3 = Slider(10, range=0..10)
paver_7 = Paver(x_size=X_10, y_size=Y_10, z_size=Z_10)
multiplication_7 = Multiplication(A=Y_10, B=spacing_6)
unit_y_5 = UnitY(Factor=multiplication_7)
linear_array_3 = LinearArray(Geometry=paver_7, Direction=unit_y_5, Count=count_3)  # -> Geometry, Transform

# ---- group: set color gradient
range_5 = Range(Domain=Domain(0, 1), Steps=expr("x-1", count_2))
interpolate_data = InterpolateData(
    Data=[ColourSwatch(SwatchColor=RGB(209, 73, 0)), ColourSwatch(SwatchColor=RGB(217, 126, 0)), ColourSwatch(SwatchColor=RGB(255, 212, 128))],
    Parameter=range_5,
    Interpolation=2)
custom_preview_4 = CustomPreview(Geometry=linear_array_2.Geometry, Material=interpolate_data)

# ==== cluster Paver
x_size = ClusterInput()
y_size = ClusterInput()
z_size = ClusterInput()
unit_z = UnitZ(Factor=z_size)
rectangle = Rectangle(Plane=PlaneXY(0, 0, 0), XSize=x_size, YSize=y_size, Radius=0)  # -> Rectangle, Length
extrude = Extrude(Base=rectangle.Rectangle, Direction=unit_z)
cap_holes = CapHoles(Brep=extrude)
box = ClusterOutput(cap_holes)
