# Grasshopper definition parametric-tree.gh (Grasshopper 1.0.7)

# ---- group: conical conifer
# parametric tree
trunk_diameter = Slider(1.5, range=0..3)
trunk_height = Slider(8, range=0..36)
tree_height = Slider(30, range=0..36)
canopy_diameter = Slider(17, range=0..36)
# cluster
canopy_divisions = Slider(3, range=0..36)
unit_z = UnitZ(Factor=trunk_height)
unit_z_2 = UnitZ(Factor=tree_height)
division = Division(A=canopy_diameter, B=4)
division_2 = Division(A=tree_height, B=canopy_divisions)
origin = Panel("0,0,0")
move = Move(Geometry=origin, Motion=unit_z)  # -> Geometry, Transform
move_2 = Move(Geometry=origin, Motion=unit_z_2)  # -> Geometry, Transform
line = Line(StartPoint=move.Geometry, EndPoint=move_2.Geometry)
line_2 = Line(StartPoint=origin, EndPoint=move.Geometry)
range = Range(Domain="0.75 To 2", Steps=expr("x-1", canopy_divisions))  # -> reverse(Range)
divide_distance = DivideDistance(Curve=line, Distance=division_2)  # -> Points, Tangents, Parameters
pipe = Pipe(Curve=line_2, Radius=expr("x/2", trunk_diameter), Caps=1)
cone = Cone(Base=divide_distance.Points, Radius=division, Length=division_2)  # -> Cone, Tip
scale = Scale(Geometry=cone.Cone, Center=divide_distance.Points, Factor=range)  # -> Geometry, Transform
cap_holes = CapHoles(Brep=scale.Geometry)
solid_union = SolidUnion(Breps=cap_holes)
trunk_color = ColourSwatch(SwatchColor=RGB(139, 76, 57))
canopy_color = ColourSwatch(SwatchColor=RGBA(58, 94, 84, 232))
custom_preview = CustomPreview(Geometry=pipe, Material=trunk_color)
custom_preview_2 = CustomPreview(Geometry=solid_union, Material=canopy_color)

# ---- group: generate a conical tree
# diameter at breast height (DBH)
trunk_diameter_2 = Slider(1, range=0..2)
crown_height = Slider(30, range=0..75)
canopy_layers = Slider(3, range=0..10)
canopy_diameter_2 = Slider(10, range=0..100)
trunk_height_2 = Slider(8, range=0..100)
conical_tree = ConicalTree(A=trunk_diameter_2, factor=trunk_height_2, factor_2=crown_height, B=canopy_layers, A_2=canopy_diameter_2)  # -> trunk, result
trunk_color_2 = ColourSwatch(SwatchColor=RGB(139, 76, 57))
canopy_color_2 = ColourSwatch(SwatchColor=RGBA(58, 94, 84, 232))
custom_preview_3 = CustomPreview(Geometry=conical_tree.trunk, Material=trunk_color_2)
custom_preview_4 = CustomPreview(Geometry=conical_tree.result, Material=canopy_color_2)

# ==== cluster ConicalTree
factor = ClusterInput()
factor_2 = ClusterInput()
A = ClusterInput()
A_2 = ClusterInput()

# ---- group: conical tree
construct_point = ConstructPoint(XCoordinate=0, YCoordinate=0, ZCoordinate=0)
unit_z = UnitZ(Factor=factor)
unit_z_2 = UnitZ(Factor=factor_2)
division = Division(A=A, B="2.0")
division_2 = Division(A=A_2, B="2.0")
B = ClusterInput()
move = Move(Geometry=construct_point, Motion=unit_z_2)  # -> Geometry, Transform
move_2 = Move(Geometry=construct_point, Motion=unit_z)  # -> Geometry, Transform
division_3 = Division(A=unit_z_2, B=B)
line = Line(StartPoint=construct_point, EndPoint=move_2.Geometry)
line_2 = Line(StartPoint=move_2.Geometry, EndPoint=move.Geometry)
divide_distance = DivideDistance(Curve=line_2, Distance=division_3)  # -> Points, Tangents, Parameters
construct_plane = ConstructPlane(Origin=divide_distance.Points, XAxis=Vector(1, 0, 0), YAxis=Vector(0, 1, 0))
construct_domain = ConstructDomain(DomainStart="0.5", DomainEnd="1.75")
cone = Cone(Base=construct_plane, Radius=division_2, Length=division_3)  # -> Cone, Tip
list_length = ListLength(List=construct_plane)
range = Range(Domain=construct_domain, Steps=list_length)  # -> reverse(Range)
scale = Scale(Geometry=cone.Cone, Center=construct_plane, Factor=range)  # -> Geometry, Transform
pipe = Pipe(Curve=line, Radius=division, Caps=0)
cap_holes = CapHoles(Brep=scale.Geometry)
solid_union = SolidUnion(Breps=cap_holes)

# ----
trunk = ClusterOutput(pipe)
result = ClusterOutput(solid_union)
