# Grasshopper definition parametric-wall.gh (Grasshopper 1.0.7)
# Copyright: GNU General Public License 3.0

# ---- group: parametric module
X = Slider(3, range=0..10)
Y = Slider(1, range=0..10)
Z = Slider(1, range=0..10)
domain_box = DomainBox(Base=PlaneXY(0, 0, 0), X=X, Y=Y, Z=Z)
module = Brep(domain_box)

# from trigonometry
X_2 = Slider(3, range=0..10)
Y_2 = Slider(1, range=0..10)
Z_2 = Slider(1, range=0..10)
domain_box_2 = DomainBox(Base=PlaneXY(0, 0, 0), X=X_2, Y=Y_2, Z=Z_2)
module_2 = Brep(domain_box_2)

# ---- group: surface from sine curves
domain = Slider(10, range=0..100)
steps = Slider(1000, range=0..1000)
start = Slider(5, range=0..10)
step = Slider(1, range=0..10)
count = Slider(4, range=0..10)
start_2 = Slider(0.3, range=0..1)
start_3 = Slider(0, range=0..10)
step_2 = Slider(1, range=0..10)
scale = Slider(5, range=0..25)
step_3 = Slider(-0.1, range=-1..0)
count_2 = Number(count)
count_3 = Number(count)
range = Range(Domain=domain, Steps=steps)
series = Series(Start=start, Step=step, Count=count)
series_2 = Series(Start=start_2, Step=step_3, Count=count_2)
series_3 = Series(Start=start_3, Step=step_2, Count=count_3)
expression = Expression(x=range, w=graft(series), a=graft(series_2), Expression="a*sin(2*π*x/w)")
construct_point = ConstructPoint(XCoordinate=range, YCoordinate=expression, ZCoordinate=0)
interpolate = Interpolate(Vertices=construct_point, Degree=3, Periodic=False, KnotStyle=1)  # -> flatten(Curve), Length, Domain
unit_z = UnitZ(Factor=series_3)
move = Move(Geometry=interpolate.Curve, Motion=unit_z)  # -> Geometry, Transform
loft = Loft(Curves=move.Geometry, Options={Adjust=False, Closed=False, LoftEnds=0, LoftSimp=0, LoftType=0, Rebuild=10, Refit=0.01})
scale_2 = Scale(Geometry=loft, Center=Point(0, 0, 0), Factor=scale)  # -> Geometry, Transform
surface = Surface(scale_2.Geometry)

# ---- group: orient modules to surface
module_3 = Brep(module_2)
surface_2 = Surface(surface)
unit_z_2 = UnitZ(Factor=1)
Z_3 = Number(Z_2)
count_4 = Slider(26, range=0..100)
contour = Contour(Shape=surface_2, Point=Point(0, 0, 0), Direction=unit_z_2, Distance=Z_3)  # -> flatten(Contours)
dispatch = Dispatch(List=contour, DispatchPattern=[True, False])  # -> ListA, ListB
horizontal_frames = HorizontalFrames(Curve=dispatch.ListA, Count=count_4)  # -> Frames, Parameters
horizontal_frames_2 = HorizontalFrames(Curve=dispatch.ListB, Count=count_4)  # -> Frames, Parameters
dispatch_2 = Dispatch(List=horizontal_frames.Frames, DispatchPattern=[True, False])  # -> ListA, ListB
dispatch_3 = Dispatch(List=horizontal_frames_2.Frames, DispatchPattern=[True, False])  # -> ListA, ListB
merge = Merge(Data1=dispatch_2.ListA, Data2=dispatch_3.ListB)
orient = Orient(Geometry=module_3, Source=PlaneXY(0, 0, 0), Target=merge)  # -> flatten(Geometry), Transform
modules = Brep(orient.Geometry)

# ---- group: color gradient
modules_2 = Brep(modules)
box_properties = BoxProperties(Box=modules_2)  # -> Center, Diagonal, Area, Volume, Degeneracy
vector_2pt = Vector2Pt(PointA="0,0,0", PointB=box_properties.Center, Unitize=False)  # -> Vector, Length
deconstruct_vector = DeconstructVector(Vector=vector_2pt.Vector)  # -> XComponent, YComponent, ZComponent
bounds = Bounds(Numbers=deconstruct_vector.YComponent)
remap_numbers = RemapNumbers(Value=deconstruct_vector.YComponent, Source=bounds, Target="0.2 To 0.8")  # -> Mapped, Clipped
gradient = Gradient(LowerLimit=0, UpperLimit=1, Parameter=remap_numbers.Mapped, stops=[0: RGB(255, 255, 255), 1: RGB(0, 0, 0)])
custom_preview = CustomPreview(Geometry=modules_2, Material=gradient)

# ---- group: attractors
# attractor
xz_plane = XZPlane(Origin=Point(0, 0, 0))
uv = Slider(10, range=0..10)
attractors = Point([Point(-3.199667486, 2.902164936, 0), Point(-0.2725900628, 1.116229088, -6.731696719), Point(7, 1.619954584, 4.937864103)])
domain_2 = Slider(2, range=0..10)
plane_surface = PlaneSurface(Plane=xz_plane, XSize=Domain(-10, 10), YSize=Domain(-10, 10))
divide_surface = DivideSurface(Surface=plane_surface, UCount=uv, VCount=uv)  # -> flatten(Points), Normals, Parameters
negative = Negative(Value=domain_2)
construct_domain = ConstructDomain(DomainStart=negative, DomainEnd=domain_2)
closest_point = ClosestPoint(Point=divide_surface.Points, Cloud=attractors)  # -> ClosestPoint, CPIndex, Distance
bounds_2 = Bounds(Numbers=closest_point.Distance)
remap_numbers_2 = RemapNumbers(Value=closest_point.Distance, Source=bounds_2, Target=construct_domain)  # -> Mapped, Clipped
unit_y = UnitY(Factor=remap_numbers_2.Mapped)
move_2 = Move(Geometry=divide_surface.Points, Motion=unit_y)  # -> Geometry, Transform
number = Number(uv)
surface_from_points = SurfaceFromPoints(Points=move_2.Geometry, UCount=expr("x+1", number), Interpolate=False)
surface_3 = Surface(surface_from_points)

# ---- group: orient modules to surface
module_4 = Brep(module_2)
unit_z_3 = UnitZ(Factor=1)
surface_4 = Surface(surface_3)
Z_4 = Number(Z_2)
count_5 = Slider(9, range=0..100)
contour_2 = Contour(Shape=surface_4, Point=Point(0, 0, 0), Direction=unit_z_3, Distance=Z_4)  # -> flatten(Contours)
dispatch_4 = Dispatch(List=contour_2, DispatchPattern=[True, False])  # -> ListA, ListB
horizontal_frames_3 = HorizontalFrames(Curve=dispatch_4.ListA, Count=count_5)  # -> Frames, Parameters
horizontal_frames_4 = HorizontalFrames(Curve=dispatch_4.ListB, Count=count_5)  # -> Frames, Parameters
dispatch_5 = Dispatch(List=horizontal_frames_3.Frames, DispatchPattern=[True, False])  # -> ListA, ListB
dispatch_6 = Dispatch(List=horizontal_frames_4.Frames, DispatchPattern=[True, False])  # -> ListA, ListB
merge_2 = Merge(Data1=dispatch_5.ListA, Data2=dispatch_6.ListB)
orient_2 = Orient(Geometry=module_4, Source=PlaneXY(0, 0, 0), Target=merge_2)  # -> flatten(Geometry), Transform
modules_3 = Brep(orient_2.Geometry)

# ---- group: color gradient
modules_4 = Brep(modules_3)
box_properties_2 = BoxProperties(Box=modules_4)  # -> Center, Diagonal, Area, Volume, Degeneracy
vector_2pt_2 = Vector2Pt(PointA="0,0,0", PointB=box_properties_2.Center, Unitize=False)  # -> Vector, Length
deconstruct_vector_2 = DeconstructVector(Vector=vector_2pt_2.Vector)  # -> XComponent, YComponent, ZComponent
bounds_3 = Bounds(Numbers=deconstruct_vector_2.YComponent)
remap_numbers_3 = RemapNumbers(Value=deconstruct_vector_2.YComponent, Source=bounds_3, Target="0.2 To 0.8")  # -> Mapped, Clipped
gradient_2 = Gradient(LowerLimit=0, UpperLimit=1, Parameter=remap_numbers_3.Mapped, stops=[0: RGB(255, 255, 255), 1: RGB(0, 0, 0)])
custom_preview_2 = CustomPreview(Geometry=modules_4, Material=gradient_2)

# ---- group: input surface
# parametric wall
# from surface
surface_5 = Surface(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)

# ---- group: orient modules to surface
module_5 = Brep(module)
surface_6 = Surface(surface_5)
unit_z_4 = UnitZ(Factor=1)
Z_5 = Number(Z)
count_6 = Slider(40, range=0..100)
contour_3 = Contour(Shape=surface_6, Point=Point(0, 0, 0), Direction=unit_z_4, Distance=Z_5)  # -> flatten(Contours)
dispatch_7 = Dispatch(List=contour_3, DispatchPattern=[True, False])  # -> ListA, ListB
horizontal_frames_5 = HorizontalFrames(Curve=dispatch_7.ListA, Count=count_6)  # -> Frames, Parameters
horizontal_frames_6 = HorizontalFrames(Curve=dispatch_7.ListB, Count=count_6)  # -> Frames, Parameters
# to do
# color from image
# surface from image
# gravity simulation
# surface slope
dispatch_8 = Dispatch(List=horizontal_frames_5.Frames, DispatchPattern=[True, False])  # -> ListA, ListB
dispatch_9 = Dispatch(List=horizontal_frames_6.Frames, DispatchPattern=[True, False])  # -> ListA, ListB
merge_3 = Merge(Data1=dispatch_8.ListA, Data2=dispatch_9.ListB)
# noise wall
orient_3 = Orient(Geometry=module_5, Source=PlaneXY(0, 0, 0), Target=merge_3)  # -> Geometry, Transform
modules_5 = Brep(orient_3.Geometry)
