# Grasshopper definition particle-forest.gh (Grasshopper 1.0.7)
# plug-ins: Kangaroo2 Components

# ---- group: generate a conical tree
# parametric tree
# diameter at breast height (DBH)
trunk_diameter = Slider(1, range=0..2)
trunk_height = Slider(8, range=0..100)
crown_height = Slider(30, range=0..75)
canopy_layers = Slider(3, range=0..10)
canopy_diameter = Slider(10, range=0..100)
conical_tree = ConicalTree(A=trunk_diameter, factor=trunk_height, factor_2=crown_height, B=canopy_layers, A_2=canopy_diameter)  # -> trunk, result
trunk_color = ColourSwatch(SwatchColor=RGB(139, 76, 57))
canopy_color = ColourSwatch(SwatchColor=RGBA(58, 94, 84, 232))
custom_preview = CustomPreview(Geometry=conical_tree.trunk, Material=trunk_color)
custom_preview_2 = CustomPreview(Geometry=conical_tree.result, Material=canopy_color)

# ---- group: particle system
# particle system
# run program
reset = BooleanToggle(False)
play = BooleanToggle(False)

radius = Slider(36, range=0..64)
count = Slider(180, range=0..360)
iterations = Slider(10, range=0..64)
point = Point(Point(0, -0.005287529503, 0))
circle = Circle(Plane=PlaneXY(0, 0, 0), Radius=radius)
boundary_surfaces = BoundarySurfaces(Edges=circle)
populate_geometry = PopulateGeometry(Geometry=boundary_surfaces, Count=count, Seed=1)
bomb = Bomb(Location=point, Points=populate_geometry, DetonationTime=1, Strength=1, Reset=reset)
curvepointcollide = CurvePointCollide(Points=populate_geometry, Curve=boundary_surfaces, Plane=PlaneXY(0, 0, 0), Interior=True, Strength=1)
spherecollide = SphereCollide(Points=populate_geometry, Radius=1, Strength=1)
bouncysolver = BouncySolver(
    GoalObjects=[curvepointcollide, bomb, spherecollide],
    Reset=reset,
    Threshold=1e-15,
    Tolerance=0.01,
    Damping=0.99,
    Iterations=iterations,
    On=play)  # -> I, V, O
cloud_display = CloudDisplay(Points=bouncysolver.V, Colours=ColourSwatch(SwatchColor=RGB(255, 255, 255)), Size=0.5, SpriteType=0)

# ---- group: forest from particle system
particles = Geometry(bouncysolver.V)
scale = Slider(3, range=0..100)
canopies = Geometry(conical_tree.result)
proportion = Slider(0.5, range=0..1)
# forest
trunks = Geometry(conical_tree.trunk)
scale_2 = Scale(Geometry=particles, Center=Point(0, 0, 0), Factor=scale)  # -> Geometry, Transform
origin = Panel("0,0,0")
vector_2pt = Vector2Pt(PointA=origin, PointB=scale_2.Geometry, Unitize=False)  # -> Vector, Length
vector_2pt_2 = Vector2Pt(PointA=origin, PointB=scale_2.Geometry, Unitize=False)  # -> Vector, Length
list_length = ListLength(List=scale_2.Geometry)
move = Move(Geometry=trunks, Motion=vector_2pt.Vector)  # -> Geometry, Transform
move_2 = Move(Geometry=canopies, Motion=vector_2pt_2.Vector)  # -> Geometry, Transform
range = Range(Domain="0.5 To 1", Steps=expr("x-1", list_length))
multiplication = Multiplication(A=list_length, B=proportion)
scale_3 = Scale(Geometry=move_2.Geometry, Center=vector_2pt_2.Vector, Factor=range)  # -> Geometry, Transform
split_list = SplitList(List=scale_3.Geometry, Index=multiplication)  # -> ListA, ListB
canopy_color_2 = ColourSwatch(SwatchColor=RGBA(80, 135, 110, 232))
trunk_color_2 = ColourSwatch(SwatchColor=RGB(139, 76, 57))
canopy_color_3 = ColourSwatch(SwatchColor=RGBA(58, 94, 78, 232))
custom_preview_3 = CustomPreview(Geometry=move.Geometry, Material=trunk_color_2)
custom_preview_4 = CustomPreview(Geometry=split_list.ListA, Material=canopy_color_2)
custom_preview_5 = CustomPreview(Geometry=split_list.ListB, Material=canopy_color_3)

# ==== cluster ConicalTree
factor = ClusterInput()
factor_2 = ClusterInput()
A = ClusterInput()
A_2 = ClusterInput()

# ---- group: conical tree
construct_point = ConstructPoint(XCoordinate=0, YCoordinate=0, ZCoordinate=0)
unit_z = UnitZ(Factor=factor)
unit_z_2 = UnitZ(Factor=factor_2)
division = Division(A=A, B="2.0")
division_2 = Division(A=A_2, B="2.0")
B = ClusterInput()
move = Move(Geometry=construct_point, Motion=unit_z_2)  # -> Geometry, Transform
move_2 = Move(Geometry=construct_point, Motion=unit_z)  # -> Geometry, Transform
division_3 = Division(A=unit_z_2, B=B)
line = Line(StartPoint=construct_point, EndPoint=move_2.Geometry)
line_2 = Line(StartPoint=move_2.Geometry, EndPoint=move.Geometry)
divide_distance = DivideDistance(Curve=line_2, Distance=division_3)  # -> Points, Tangents, Parameters
construct_plane = ConstructPlane(Origin=divide_distance.Points, XAxis=Vector(1, 0, 0), YAxis=Vector(0, 1, 0))
construct_domain = ConstructDomain(DomainStart="0.5", DomainEnd="1.75")
cone = Cone(Base=construct_plane, Radius=division_2, Length=division_3)  # -> Cone, Tip
list_length = ListLength(List=construct_plane)
range = Range(Domain=construct_domain, Steps=list_length)  # -> reverse(Range)
scale = Scale(Geometry=cone.Cone, Center=construct_plane, Factor=range)  # -> Geometry, Transform
pipe = Pipe(Curve=line, Radius=division, Caps=0)
cap_holes = CapHoles(Brep=scale.Geometry)
solid_union = SolidUnion(Breps=cap_holes)

# ----
trunk = ClusterOutput(pipe)
result = ClusterOutput(solid_union)
