# Grasshopper definition particle_meadow.gh (Grasshopper 1.0.7)
# plug-ins: Heteroptera, Pufferfish, EleFront, EdiTree, Kangaroo2 Components

# ----
# using heteroptera
timer = Timer(TimerInterval=1000, Target=seed_generator)  # disabled
seed_generator = SeedGenerator(Number=1)

# ----
# using heteroptera
timer_2 = Timer(TimerInterval=1000, Target=seed_generator_2)  # disabled
seed_generator_2 = SeedGenerator(Number=1)

# ----
# using heteroptera
timer_3 = Timer(TimerInterval=1000, Target=seed_generator_3)  # disabled
seed_generator_3 = SeedGenerator(Number=1)

# ----
# using heteroptera
timer_4 = Timer(TimerInterval=1000, Target=seed_generator_4)  # disabled
seed_generator_4 = SeedGenerator(Number=1)

# ----
# using heteroptera
timer_5 = Timer(TimerInterval=1000, Target=seed_generator_5)  # disabled
seed_generator_5 = SeedGenerator(Number=1)

# ----
# using heteroptera
timer_6 = Timer(TimerInterval=1000, Target=seed_generator_6)  # disabled
seed_generator_6 = SeedGenerator(Number=1)

# ----
# using heteroptera
timer_7 = Timer(TimerInterval=1000, Target=seed_generator_7)  # disabled
seed_generator_7 = SeedGenerator(Number=1)

# ----
# groundcover
# run program
reset = BooleanToggle(False)
play = BooleanToggle(False)

# ----
# rye
# run program
reset_2 = BooleanToggle(False)
play_2 = BooleanToggle(False)

# ----
# crocus
# run program
reset_3 = BooleanToggle(False)
play_3 = BooleanToggle(False)

# ----
# carrot
# run program
reset_4 = BooleanToggle(False)
play_4 = BooleanToggle(False)

# ----
# marigold
# run program
reset_5 = BooleanToggle(False)
play_5 = BooleanToggle(False)

# ----
# dahlia
# run program
reset_6 = BooleanToggle(False)
play_6 = BooleanToggle(False)

# ----
# onion
# run program
reset_7 = BooleanToggle(False)
play_7 = BooleanToggle(False)

# ---- group: generate particle system
# random population of initial points
# random attractors
attractors = Slider(3, range=0..10)
count = Slider(36, range=0..1000)
radius = Slider(0.45, range=0..6)
dampening = Slider(0.75, range=0..1)
polygon = Polygon(Plane=PlaneXY(0, 0, 0), Radius=radius, Segments=6, FilletRadius=0)  # -> Polygon, Length
boundary_surfaces = BoundarySurfaces(Edges=polygon.Polygon)
populate_geometry = PopulateGeometry(Geometry=boundary_surfaces, Count=count, Seed=1)
scale = Scale(Geometry=boundary_surfaces, Center=Point(0, 0, 0), Factor="0.6")  # -> Geometry, Transform
populate_geometry_2 = PopulateGeometry(Geometry=scale.Geometry, Count=attractors, Seed=seed_generator_3)
bomb = Bomb(Location=populate_geometry_2, Points=populate_geometry, DetonationTime=1, Strength="0.9", Reset=reset_3)
curvepointcollide = CurvePointCollide(Points=populate_geometry, Curve=polygon.Polygon, Plane=PlaneXY(0, 0, 0), Interior=True, Strength=1)
spherecollide = SphereCollide(Points=populate_geometry, Radius=0.01, Strength=0.2)
bouncysolver = BouncySolver(
    GoalObjects=[curvepointcollide, bomb, spherecollide],
    Reset=reset_3,
    Threshold=1e-15,
    Tolerance=0.01,
    Damping=dampening,
    Iterations=1,
    On=play_3)  # -> I, V, O

# random population of initial points
# random attractors
count_2 = Slider(125, range=0..1000)
radius_2 = Slider(0.45, range=0..6)
attractors_2 = Slider(3, range=0..10)
dampening_2 = Slider(0.75, range=0..1)
polygon_2 = Polygon(Plane=PlaneXY(0, 0, 0), Radius=radius_2, Segments=6, FilletRadius=0)  # -> Polygon, Length
boundary_surfaces_2 = BoundarySurfaces(Edges=polygon_2.Polygon)
populate_geometry_3 = PopulateGeometry(Geometry=boundary_surfaces_2, Count=count_2, Seed=1)
scale_2 = Scale(Geometry=boundary_surfaces_2, Center=Point(0, 0, 0), Factor="0.6")  # -> Geometry, Transform
populate_geometry_4 = PopulateGeometry(Geometry=scale_2.Geometry, Count=attractors_2, Seed=seed_generator_2)
bomb_2 = Bomb(Location=populate_geometry_4, Points=populate_geometry_3, DetonationTime=1, Strength="0.9", Reset=reset_2)
curvepointcollide_2 = CurvePointCollide(Points=populate_geometry_3, Curve=polygon_2.Polygon, Plane=PlaneXY(0, 0, 0), Interior=True, Strength=1)
spherecollide_2 = SphereCollide(Points=populate_geometry_3, Radius=0.01, Strength=0.2)
bouncysolver_2 = BouncySolver(
    GoalObjects=[curvepointcollide_2, bomb_2, spherecollide_2],
    Reset=reset_2,
    Threshold=1e-15,
    Tolerance=0.01,
    Damping=dampening_2,
    Iterations=1,
    On=play_2)  # -> I, V, O

# random population of initial points
# random attractors
count_3 = Slider(750, range=0..1000)
attractors_3 = Slider(3, range=0..10)
radius_3 = Slider(0.45, range=0..6)
dampening_3 = Slider(0.75, range=0..1)
polygon_3 = Polygon(Plane=PlaneXY(0, 0, 0), Radius=radius_3, Segments=6, FilletRadius=0)  # -> Polygon, Length
boundary_surfaces_3 = BoundarySurfaces(Edges=polygon_3.Polygon)
populate_geometry_5 = PopulateGeometry(Geometry=boundary_surfaces_3, Count=count_3, Seed=1)
scale_3 = Scale(Geometry=boundary_surfaces_3, Center=Point(0, 0, 0), Factor="0.6")  # -> Geometry, Transform
populate_geometry_6 = PopulateGeometry(Geometry=scale_3.Geometry, Count=attractors_3, Seed=seed_generator_4)
bomb_3 = Bomb(Location=populate_geometry_6, Points=populate_geometry_5, DetonationTime=1, Strength="0.9", Reset=reset_5)
curvepointcollide_3 = CurvePointCollide(Points=populate_geometry_5, Curve=polygon_3.Polygon, Plane=PlaneXY(0, 0, 0), Interior=True, Strength=1)
spherecollide_3 = SphereCollide(Points=populate_geometry_5, Radius=0.01, Strength=0.2)
bouncysolver_3 = BouncySolver(
    GoalObjects=[curvepointcollide_3, bomb_3, spherecollide_3],
    Reset=reset_5,
    Threshold=1e-15,
    Tolerance=0.01,
    Damping=dampening_3,
    Iterations=1,
    On=play_5)  # -> I, V, O

# random population of initial points
# random attractors
count_4 = Slider(36, range=0..1000)
attractors_4 = Slider(3, range=0..10)
dampening_4 = Slider(0.75, range=0..1)
radius_4 = Slider(0.45, range=0..6)
polygon_4 = Polygon(Plane=PlaneXY(0, 0, 0), Radius=radius_4, Segments=6, FilletRadius=0)  # -> Polygon, Length
boundary_surfaces_4 = BoundarySurfaces(Edges=polygon_4.Polygon)
populate_geometry_7 = PopulateGeometry(Geometry=boundary_surfaces_4, Count=count_4, Seed=1)
scale_4 = Scale(Geometry=boundary_surfaces_4, Center=Point(0, 0, 0), Factor="0.6")  # -> Geometry, Transform
populate_geometry_8 = PopulateGeometry(Geometry=scale_4.Geometry, Count=attractors_4, Seed=seed_generator_5)
bomb_4 = Bomb(Location=populate_geometry_8, Points=populate_geometry_7, DetonationTime=1, Strength="0.9", Reset=reset_6)
curvepointcollide_4 = CurvePointCollide(Points=populate_geometry_7, Curve=polygon_4.Polygon, Plane=PlaneXY(0, 0, 0), Interior=True, Strength=1)
spherecollide_4 = SphereCollide(Points=populate_geometry_7, Radius=0.01, Strength=0.2)
bouncysolver_4 = BouncySolver(
    GoalObjects=[curvepointcollide_4, bomb_4, spherecollide_4],
    Reset=reset_6,
    Threshold=1e-15,
    Tolerance=0.01,
    Damping=dampening_4,
    Iterations=1,
    On=play_6)  # -> I, V, O

# random population of initial points
# random attractors
count_5 = Slider(50, range=0..1000)
radius_5 = Slider(0.45, range=0..6)
attractors_5 = Slider(3, range=0..10)
dampening_5 = Slider(0.75, range=0..1)
polygon_5 = Polygon(Plane=PlaneXY(0, 0, 0), Radius=radius_5, Segments=6, FilletRadius=0)  # -> Polygon, Length
boundary_surfaces_5 = BoundarySurfaces(Edges=polygon_5.Polygon)
populate_geometry_9 = PopulateGeometry(Geometry=boundary_surfaces_5, Count=count_5, Seed=1)
scale_5 = Scale(Geometry=boundary_surfaces_5, Center=Point(0, 0, 0), Factor="0.6")  # -> Geometry, Transform
populate_geometry_10 = PopulateGeometry(Geometry=scale_5.Geometry, Count=attractors_5, Seed=seed_generator_6)
bomb_5 = Bomb(Location=populate_geometry_10, Points=populate_geometry_9, DetonationTime=1, Strength="0.9", Reset=reset_4)
curvepointcollide_5 = CurvePointCollide(Points=populate_geometry_9, Curve=polygon_5.Polygon, Plane=PlaneXY(0, 0, 0), Interior=True, Strength=1)
spherecollide_5 = SphereCollide(Points=populate_geometry_9, Radius=0.01, Strength=0.2)
bouncysolver_5 = BouncySolver(
    GoalObjects=[curvepointcollide_5, bomb_5, spherecollide_5],
    Reset=reset_4,
    Threshold=1e-15,
    Tolerance=0.01,
    Damping=dampening_5,
    Iterations=1,
    On=play_4)  # -> I, V, O

# random population of initial points
# random attractors
count_6 = Slider(25, range=0..1000)
dampening_6 = Slider(0.75, range=0..1)
attractors_6 = Slider(3, range=0..10)
radius_6 = Slider(0.45, range=0..6)
polygon_6 = Polygon(Plane=PlaneXY(0, 0, 0), Radius=radius_6, Segments=6, FilletRadius=0)  # -> Polygon, Length
boundary_surfaces_6 = BoundarySurfaces(Edges=polygon_6.Polygon)
populate_geometry_11 = PopulateGeometry(Geometry=boundary_surfaces_6, Count=count_6, Seed=1)
scale_6 = Scale(Geometry=boundary_surfaces_6, Center=Point(0, 0, 0), Factor="0.6")  # -> Geometry, Transform
populate_geometry_12 = PopulateGeometry(Geometry=scale_6.Geometry, Count=attractors_6, Seed=seed_generator_7)
bomb_6 = Bomb(Location=populate_geometry_12, Points=populate_geometry_11, DetonationTime=1, Strength="0.9", Reset=reset_7)
curvepointcollide_6 = CurvePointCollide(Points=populate_geometry_11, Curve=polygon_6.Polygon, Plane=PlaneXY(0, 0, 0), Interior=True, Strength=1)
spherecollide_6 = SphereCollide(Points=populate_geometry_11, Radius=0.01, Strength=0.2)
bouncysolver_6 = BouncySolver(
    GoalObjects=[curvepointcollide_6, bomb_6, spherecollide_6],
    Reset=reset_7,
    Threshold=1e-15,
    Tolerance=0.01,
    Damping=dampening_6,
    Iterations=1,
    On=play_7)  # -> I, V, O

# ---- group: grasses from particle system / import thea plant(s)
# using elefront
extended_geometry = ExtendedGeometry([<elefrontblock referenced from the Rhino model> x2])

# using elefront
extended_geometry_2 = ExtendedGeometry([<elefrontblock referenced from the Rhino model> x8])

# using elefront
extended_geometry_3 = ExtendedGeometry([<elefrontblock referenced from the Rhino model> x3])

# using elefront
extended_geometry_4 = ExtendedGeometry([<elefrontblock referenced from the Rhino model> x5])

# using elefront
extended_geometry_5 = ExtendedGeometry([<elefrontblock referenced from the Rhino model> x3])

# ---- group: grasses from particle system / import thea plants
# using elefront
extended_geometry_6 = ExtendedGeometry([<elefrontblock referenced from the Rhino model> x2])

# ---- group: grasses from particle system / import thea plant(s)
# using elefront
extended_geometry_7 = ExtendedGeometry([<elefrontblock referenced from the Rhino model> x5])

# ---- group: generate particle system
# random population of initial points
# random attractors
count_7 = Slider(1250, range=0..5000)
radius_7 = Slider(0.5, range=0..6)
attractors_7 = Slider(3, range=0..10)
dampening_7 = Slider(0.75, range=0..1)
depth = Slider(-0.05, range=-1..0)
polygon_7 = Polygon(Plane=PlaneXY(0, 0, 0), Radius=radius_7, Segments=6, FilletRadius=0)  # -> Polygon, Length
unit_z = UnitZ(Factor=depth)
extrude = Extrude(Base=polygon_7.Polygon, Direction=unit_z)
cap_holes = CapHoles(Brep=extrude)

# ----
scale_7 = Scale(Geometry=polygon_7.Polygon, Center=Point(0, 0, 0), Factor="0.975")  # -> Geometry, Transform

# ---- group: generate particle system (continued)
boundary_surfaces_7 = BoundarySurfaces(Edges=scale_7.Geometry)
populate_geometry_13 = PopulateGeometry(Geometry=boundary_surfaces_7, Count=count_7, Seed=1)
scale_8 = Scale(Geometry=boundary_surfaces_7, Center=Point(0, 0, 0), Factor="0.6")  # -> Geometry, Transform
populate_geometry_14 = PopulateGeometry(Geometry=scale_8.Geometry, Count=attractors_7, Seed=seed_generator)
bomb_7 = Bomb(Location=populate_geometry_14, Points=populate_geometry_13, DetonationTime=1, Strength="0.9", Reset=reset)
curvepointcollide_7 = CurvePointCollide(Points=populate_geometry_13, Curve=scale_7.Geometry, Plane=PlaneXY(0, 0, 0), Interior=True, Strength=1)
spherecollide_7 = SphereCollide(Points=populate_geometry_13, Radius="0.01", Strength="0.1")
bouncysolver_7 = BouncySolver(
    GoalObjects=[curvepointcollide_7, bomb_7, spherecollide_7],
    Reset=reset,
    Threshold=1e-15,
    Tolerance=0.01,
    Damping=dampening_7,
    Iterations=1,
    On=play)  # -> I, V, O

# ---- group: ground
geometry = Geometry(cap_holes)
define_object_attributes = DefineObjectAttributes(Layer="ground")
bake_objects = BakeObjects(Geometry=geometry, Attributes=define_object_attributes, Bake=False)

# ---- group: grasses from particle system
point = Point(bouncysolver_2.V)
list_length = ListLength(List=point)
list_length_2 = ListLength(List=extended_geometry_6)
divide_list = DivideList(List=extended_geometry_6, Number=list_length_2)  # -> Chunk, Remainder
divide_list_2 = DivideList(List=point, Number=list_length_2)  # -> Chunk, Remainder
move_to_point = MoveToPoint(Geometry=divide_list.Chunk, PointA=Point(0, 0, 0), PointB=divide_list_2.Chunk)  # -> Moved, Vector, Transform
random = Random(Range="0.35 To 0.75", Number=list_length, Seed=2)
random_2 = Random(Range="0 To 360", Number=list_length, Seed=2)
scale_9 = Scale(Geometry=flatten(move_to_point.Moved), Center=flatten(move_to_point.Vector), Factor=random)  # -> Geometry, Transform
rotate = Rotate(Geometry=scale_9.Geometry, Angle=degrees(random_2), Plane=PlaneXY(0, 0, 0))  # -> Geometry, Transform
center = Center(Geometrical=rotate.Geometry)  # -> Center, Dimension
point_in_curve = PointInCurve(Point=center.Center, Curve=scale_7.Geometry)  # -> Relationship, Point
equality = Equality(FirstNumber=point_in_curve.Relationship, SecondNumber="0")  # -> Equality, Inequality
define_object_attributes_2 = DefineObjectAttributes(Layer="rye")
cull_pattern = CullPattern(List=rotate.Geometry, CullPattern=equality.Inequality)
bake_objects_2 = BakeObjects(Geometry=cull_pattern, Attributes=define_object_attributes_2, Bake=False)

# using editree
# using pufferfish
point_2 = Point(bouncysolver_7.V)
list_length_3 = ListLength(List=point_2)
list_length_4 = ListLength(List=extended_geometry)
divide_list_3 = DivideList(List=extended_geometry, Number=list_length_4)  # -> Chunk, Remainder
divide_list_4 = DivideList(List=point_2, Number=list_length_4)  # -> Chunk, Remainder
move_to_point_2 = MoveToPoint(Geometry=divide_list_3.Chunk, PointA=Point(0, 0, 0), PointB=divide_list_4.Chunk)  # -> Moved, Vector, Transform
random_3 = Random(Range="0.5 To 1.0", Number=expr("x-1", list_length_3), Seed=2)
random_4 = Random(Range="0 To 360", Number=list_length_3, Seed=2)
scale_10 = Scale(Geometry=flatten(move_to_point_2.Moved), Center=flatten(move_to_point_2.Vector), Factor=random_3)  # -> Geometry, Transform
rotate_2 = Rotate(Geometry=scale_10.Geometry, Angle=degrees(random_4), Plane=PlaneXY(0, 0, 0))  # -> Geometry, Transform
center_2 = Center(Geometrical=rotate_2.Geometry)  # -> Center, Dimension
point_in_curve_2 = PointInCurve(Point=center_2.Center, Curve=scale_7.Geometry)  # -> Relationship, Point
equality_2 = Equality(FirstNumber=point_in_curve_2.Relationship, SecondNumber="0")  # -> Equality, Inequality
define_object_attributes_3 = DefineObjectAttributes(Layer="groundcover")
cull_pattern_2 = CullPattern(List=rotate_2.Geometry, CullPattern=equality_2.Inequality)
bake_objects_3 = BakeObjects(Geometry=cull_pattern_2, Attributes=define_object_attributes_3, Bake=False)

# using editree
# using pufferfish
point_3 = Point(bouncysolver.V)
list_length_5 = ListLength(List=point_3)
list_length_6 = ListLength(List=extended_geometry_4)
divide_list_5 = DivideList(List=extended_geometry_4, Number=list_length_6)  # -> Chunk, Remainder
divide_list_6 = DivideList(List=point_3, Number=list_length_6)  # -> Chunk, Remainder
move_to_point_3 = MoveToPoint(Geometry=divide_list_5.Chunk, PointA=Point(0, 0, 0), PointB=divide_list_6.Chunk)  # -> Moved, Vector, Transform
random_5 = Random(Range="0.5 To 1.0", Number=list_length_5, Seed=2)
random_6 = Random(Range="0 To 360", Number=list_length_5, Seed=2)
scale_11 = Scale(Geometry=flatten(move_to_point_3.Moved), Center=flatten(move_to_point_3.Vector), Factor=random_5)  # -> Geometry, Transform
rotate_3 = Rotate(Geometry=scale_11.Geometry, Angle=degrees(random_6), Plane=PlaneXY(0, 0, 0))  # -> Geometry, Transform
center_3 = Center(Geometrical=rotate_3.Geometry)  # -> Center, Dimension
point_in_curve_3 = PointInCurve(Point=center_3.Center, Curve=scale_7.Geometry)  # -> Relationship, Point
equality_3 = Equality(FirstNumber=point_in_curve_3.Relationship, SecondNumber="0")  # -> Equality, Inequality
define_object_attributes_4 = DefineObjectAttributes(Layer="crocus")
cull_pattern_3 = CullPattern(List=rotate_3.Geometry, CullPattern=equality_3.Inequality)
bake_objects_4 = BakeObjects(Geometry=cull_pattern_3, Attributes=define_object_attributes_4, Bake=False)

# using editree
# using pufferfish
point_4 = Point(bouncysolver_5.V)
list_length_7 = ListLength(List=extended_geometry_3)
list_length_8 = ListLength(List=point_4)
divide_list_7 = DivideList(List=extended_geometry_3, Number=list_length_7)  # -> Chunk, Remainder
divide_list_8 = DivideList(List=point_4, Number=list_length_7)  # -> Chunk, Remainder
move_to_point_4 = MoveToPoint(Geometry=divide_list_7.Chunk, PointA=Point(0, 0, 0), PointB=divide_list_8.Chunk)  # -> Moved, Vector, Transform
random_7 = Random(Range="0.5 To 1.0", Number=list_length_8, Seed=2)
random_8 = Random(Range="0 To 360", Number=list_length_8, Seed=2)
scale_12 = Scale(Geometry=flatten(move_to_point_4.Moved), Center=flatten(move_to_point_4.Vector), Factor=random_7)  # -> Geometry, Transform
rotate_4 = Rotate(Geometry=scale_12.Geometry, Angle=degrees(random_8), Plane=PlaneXY(0, 0, 0))  # -> Geometry, Transform
center_4 = Center(Geometrical=rotate_4.Geometry)  # -> Center, Dimension
point_in_curve_4 = PointInCurve(Point=center_4.Center, Curve=scale_7.Geometry)  # -> Relationship, Point
equality_4 = Equality(FirstNumber=point_in_curve_4.Relationship, SecondNumber="0")  # -> Equality, Inequality
define_object_attributes_5 = DefineObjectAttributes(Layer="carrot")
cull_pattern_4 = CullPattern(List=rotate_4.Geometry, CullPattern=equality_4.Inequality)
bake_objects_5 = BakeObjects(Geometry=cull_pattern_4, Attributes=define_object_attributes_5, Bake=False)

# using editree
# using pufferfish
point_5 = Point(bouncysolver_6.V)
list_length_9 = ListLength(List=extended_geometry_2)
list_length_10 = ListLength(List=point_5)
divide_list_9 = DivideList(List=extended_geometry_2, Number=list_length_9)  # -> Chunk, Remainder
divide_list_10 = DivideList(List=point_5, Number=list_length_9)  # -> Chunk, Remainder
move_to_point_5 = MoveToPoint(Geometry=divide_list_9.Chunk, PointA=Point(0, 0, 0), PointB=divide_list_10.Chunk)  # -> Moved, Vector, Transform
random_9 = Random(Range="0.5 To 1.0", Number=list_length_10, Seed=2)
random_10 = Random(Range="0 To 360", Number=list_length_10, Seed=2)
scale_13 = Scale(Geometry=flatten(move_to_point_5.Moved), Center=flatten(move_to_point_5.Vector), Factor=random_9)  # -> Geometry, Transform
rotate_5 = Rotate(Geometry=scale_13.Geometry, Angle=degrees(random_10), Plane=PlaneXY(0, 0, 0))  # -> Geometry, Transform
center_5 = Center(Geometrical=rotate_5.Geometry)  # -> Center, Dimension
point_in_curve_5 = PointInCurve(Point=center_5.Center, Curve=scale_7.Geometry)  # -> Relationship, Point
equality_5 = Equality(FirstNumber=point_in_curve_5.Relationship, SecondNumber="0")  # -> Equality, Inequality
define_object_attributes_6 = DefineObjectAttributes(Layer="onion")
cull_pattern_5 = CullPattern(List=rotate_5.Geometry, CullPattern=equality_5.Inequality)
bake_objects_6 = BakeObjects(Geometry=cull_pattern_5, Attributes=define_object_attributes_6, Bake=False)

# using editree
# using pufferfish
point_6 = Point(bouncysolver_3.V)
list_length_11 = ListLength(List=extended_geometry_7)
list_length_12 = ListLength(List=point_6)
divide_list_11 = DivideList(List=extended_geometry_7, Number=list_length_11)  # -> Chunk, Remainder
divide_list_12 = DivideList(List=point_6, Number=list_length_11)  # -> Chunk, Remainder
move_to_point_6 = MoveToPoint(Geometry=divide_list_11.Chunk, PointA=Point(0, 0, 0), PointB=divide_list_12.Chunk)  # -> Moved, Vector, Transform
random_11 = Random(Range="0.5 To 1.0", Number=list_length_12, Seed=2)
random_12 = Random(Range="0 To 360", Number=list_length_12, Seed=2)
scale_14 = Scale(Geometry=flatten(move_to_point_6.Moved), Center=flatten(move_to_point_6.Vector), Factor=random_11)  # -> Geometry, Transform
rotate_6 = Rotate(Geometry=scale_14.Geometry, Angle=degrees(random_12), Plane=PlaneXY(0, 0, 0))  # -> Geometry, Transform
center_6 = Center(Geometrical=rotate_6.Geometry)  # -> Center, Dimension
point_in_curve_6 = PointInCurve(Point=center_6.Center, Curve=scale_7.Geometry)  # -> Relationship, Point
equality_6 = Equality(FirstNumber=point_in_curve_6.Relationship, SecondNumber="0")  # -> Equality, Inequality
define_object_attributes_7 = DefineObjectAttributes(Layer="marigold")
cull_pattern_6 = CullPattern(List=rotate_6.Geometry, CullPattern=equality_6.Inequality)
bake_objects_7 = BakeObjects(Geometry=cull_pattern_6, Attributes=define_object_attributes_7, Bake=False)

point_7 = Point(bouncysolver_4.V)
list_length_13 = ListLength(List=extended_geometry_5)
list_length_14 = ListLength(List=point_7)
divide_list_13 = DivideList(List=extended_geometry_5, Number=list_length_13)  # -> Chunk, Remainder
divide_list_14 = DivideList(List=point_7, Number=list_length_13)  # -> Chunk, Remainder
move_to_point_7 = MoveToPoint(Geometry=divide_list_13.Chunk, PointA=Point(0, 0, 0), PointB=divide_list_14.Chunk)  # -> Moved, Vector, Transform
random_13 = Random(Range="0.5 To 1.0", Number=list_length_14, Seed=2)
random_14 = Random(Range="0 To 360", Number=list_length_14, Seed=2)
scale_15 = Scale(Geometry=flatten(move_to_point_7.Moved), Center=flatten(move_to_point_7.Vector), Factor=random_13)  # -> Geometry, Transform
rotate_7 = Rotate(Geometry=scale_15.Geometry, Angle=degrees(random_14), Plane=PlaneXY(0, 0, 0))  # -> Geometry, Transform
center_7 = Center(Geometrical=rotate_7.Geometry)  # -> Center, Dimension
point_in_curve_7 = PointInCurve(Point=center_7.Center, Curve=scale_7.Geometry)  # -> Relationship, Point
equality_7 = Equality(FirstNumber=point_in_curve_7.Relationship, SecondNumber="0")  # -> Equality, Inequality
define_object_attributes_8 = DefineObjectAttributes(Layer="dalhia")
cull_pattern_7 = CullPattern(List=rotate_7.Geometry, CullPattern=equality_7.Inequality)
bake_objects_8 = BakeObjects(Geometry=cull_pattern_7, Attributes=define_object_attributes_8, Bake=False)
