# Grasshopper definition point-cloud-planting.gh (Grasshopper 1.0.7)
# Copyright: GNU General Public License 3.0

# ---- group: right click to set point cloud
# point cloud planting
# set point clouds
# tree
# transform point clouds
point_cloud = PointCloud()

# fern
point_cloud_2 = PointCloud(<point cloud referenced from the Rhino model>)

# ----
# translate
point_cloud_3 = PointCloud(point_cloud_2)
radius = Slider(1, range=0..10)
count = Slider(15, range=0..100)
# scale
seed = Slider(2, range=0..100)
circle = Circle(Plane=PlaneXY(0, 0, 0), Radius=radius)
boundary_surfaces = BoundarySurfaces(Edges=circle)
populate_geometry = PopulateGeometry(Geometry=boundary_surfaces, Count=count, Seed=seed)
move = Move(Geometry=point_cloud_3, Motion=populate_geometry)  # -> Geometry, Transform
point_cloud_4 = PointCloud(move.Geometry)
point = Point(populate_geometry)

point_cloud_5 = PointCloud(point_cloud_4)
point_2 = Point(point)
count_2 = Number(count)
seed_2 = Number(seed)
random = Random(Range="0.5 To 1.0", Number=count_2, Seed=seed_2)
scale = Scale(Geometry=point_cloud_5, Center=point_2, Factor=random)  # -> Geometry, Transform
point_cloud_6 = PointCloud(scale.Geometry)

# ----
# rotate
point_cloud_7 = PointCloud(point_cloud_6)
point_3 = Point(point)
count_3 = Number(count)
seed_3 = Number(seed)
random_2 = Random(Range="0 To 360", Number=count_3, Seed=seed_3)
rotate = Rotate(Geometry=point_cloud_7, Angle=degrees(random_2), Plane=point_3)  # -> Geometry, Transform

# ---- group: bake
point_cloud_8 = PointCloud(rotate.Geometry)
