# Grasshopper definition point-cloud-voxel.gh (Grasshopper 1.0.7)
# Copyright: GNU General Public License 3.0
# plug-ins: DendroGH

# ---- group: settings
# using dendro
number_slider = Slider(0.01, range=0..1)
create_settings = CreateSettings(
    VoxelSize=number_slider,
    Bandwidth=Slider(1, range=0..10),
    Isovalue=Slider(0, range=0..1),
    Adaptivity=Slider(0.5, range=0..1))
volume_settings = VolumeSettings(create_settings)

# ----
radius = Slider(0.03, range=0..1)

# ---- group: input
# point cloud voxel
point = Point([<point referenced from the Rhino model> x5000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])

# ---- group: voxelize
point_2 = Point(point)
volume_settings_2 = VolumeSettings(volume_settings)
points_to_volume = PointsToVolume(Points=point_2, PointRadius=radius, Settings=volume_settings_2)
volume_union = VolumeUnion(Volumes=flatten(points_to_volume))
volume_to_mesh = VolumeToMesh(Volume=volume_union, VolumeSettings=volume_settings_2)
custom_preview = CustomPreview(Geometry=volume_to_mesh, Material=ColourSwatch(SwatchColor=RGB(209, 209, 209)))
