# Grasshopper definition pointillist-typeface.gh (Grasshopper 1.0.7)
# Copyright: GNU General Public License 3.0
# plug-ins: froGH, GraphicPlus

# ----
# pointillist typeface
# type
# using frogh
panel = Panel("Computational")
size = Slider(96, range=0..100)
text_to_geometry = TextToGeometry(
    TextString=panel,
    FontFace="IBM Plex Sans Semibold",
    Closed=Toggle(True),
    Size=size,
    SamplingPrecision=50,
    BasePlane=PlaneXY(0, 0, 0),
    Justification=0,
    TextOutputType="Surfaces")
geometry = Geometry(text_to_geometry)

# ----
# proportions
surface = Surface(geometry)
proportion = Slider(0.1, range=0..1)
area = Area(Geometry=surface)  # -> Area, Centroid
multiplication = Multiplication(A=area.Area, B=proportion)
count = Integer(multiplication)

# ----
# sorting
panel_2 = Panel("0,0,0")
size_2 = Number(size)
negative = Negative(Value=size_2)
construct_point = ConstructPoint(XCoordinate=0, YCoordinate=negative, ZCoordinate=0)
line = Line(StartPoint=panel_2, EndPoint=construct_point)
curve = Curve(line)

# ----
# points
surface_2 = Surface(geometry)
count_2 = Integer(count)
seed = Slider(0, range=0..100)
# length
curve_2 = Curve(curve)
populate_geometry = PopulateGeometry(Geometry=surface_2, Count=count_2, Seed=seed)
sort_along_curve = SortAlongCurve(Points=populate_geometry, Curve=curve_2)  # -> Points, Indices
point = Point(sort_along_curve.Points)

# ----
# culling
point_2 = Point(point)
deconstruct = Deconstruct(Point=point_2)  # -> flatten(XComponent), YComponent, ZComponent
bounds = Bounds(Numbers=deconstruct.XComponent)
deconstruct_domain = DeconstructDomain(Domain=bounds)  # -> Start, End
line_sdl = LineSDL(Start="0,0,0", Direction="1,0,0", Length=deconstruct_domain.End)
line_2 = Line(line_sdl)

point_3 = Point(point)
line_3 = Line(line_2)
jitter = Slider(0.4, range=0..1)
# circles
threshold = Slider(82, range=0..100)
pull_point = PullPoint(Point=point_3, Geometry=line_3, ClosestOnly=True)  # -> ClosestPoint, Distance
jitter_2 = Jitter(List=pull_point.Distance, Jitter=jitter, Seed=2)  # -> Values, Indices
evaluate = Evaluate(Expression="x<y", x=jitter_2.Values, y=threshold)
cull_pattern = CullPattern(List=point_3, CullPattern=evaluate)
point_4 = Point(cull_pattern)

point_5 = Point(point_4)
radius = Slider(2.5, range=0..10)
circle = Circle(Plane=point_5, Radius=radius)
boundary_surfaces = BoundarySurfaces(Edges=circle)
surface_3 = Surface(boundary_surfaces)

# ----
# gradient
surface_4 = Surface(surface_3)  # disabled
list_length = ListLength(List=surface_4)  # disabled
range = Range(Domain=Domain(0, 1), Steps=list_length)  # disabled
gradient = Gradient(LowerLimit=0, UpperLimit=1, Parameter=range, stops=[0: RGB(224, 224, 224), 1: RGB(0, 0, 0)])  # disabled
custom_preview = CustomPreview(Geometry=surface_4, Material=reverse(gradient))  # disabled

surface_5 = Surface(surface_3)
custom_preview_2 = CustomPreview(Geometry=surface_5, Material=ColourSwatch(SwatchColor=RGB(26, 26, 26)))

# ----
# export
# graphic+ plugin
surface_6 = Surface(flatten(surface_3))
width = Number(expr("x*0.75", deconstruct_domain.End))
height = Number(size)
resolution = Slider(300, range=0..1000)
solid_fill = SolidFill(ShapeGeometry=surface_6, Color=ColourSwatch(SwatchColor=RGB(255, 255, 255)))
stroke = Stroke(ShapeGeometry=solid_fill, Color=RGB(0, 0, 0), Weight="0", EndCap=0)
construct_drawing = ConstructDrawing(ShapesGeometry=stroke, Width=width, Height=height, Color=RGBA(255, 255, 255, 0))  # -> Drawing, Boundary

drawing_viewer = DrawingViewer(Drawing=construct_drawing.Drawing, Resolution=resolution)
