# Grasshopper definition quadrangle.gh (Grasshopper 1.0.7)
# Copyright: GNU General Public License

# ---- group: paths
# quadrangle
X = Slider(100, range=0..100)
Y = Slider(100, range=0..100)
start = Slider(34, range=0..100)
step = Slider(1, range=0..100)
count = Slider(4, range=0..10)
series = Series(Start=start, Step=step, Count=count)
plane_surface = PlaneSurface(Plane=PlaneXY(0, 0, 0), XSize=X, YSize=Y)
populate_2d = Populate2D(Region=plane_surface, Count="2", Seed=series)
dispatch = Dispatch(List=populate_2d, DispatchPattern=[True, False])  # -> ListA, ListB
line = Line(StartPoint=dispatch.ListA, EndPoint=dispatch.ListB)
curve_line = CurveLine(Curve=plane_surface, Line=line)  # -> Points, Params, Count
interpolate = Interpolate(Vertices=curve_line.Points, Degree=3, Periodic=False, KnotStyle=1)  # -> Curve, Length, Domain
boundary = Brep(plane_surface)
paths = Curve(interpolate.Curve)

# ---- group: pathways
paths_2 = Curve(paths)
width = Slider(4, range=0..10)
boundary_2 = Curve(boundary)
division = Division(A=width, B="2")
negative = Negative(Value=division)
offset_curve = OffsetCurve(Curve=paths_2, Distance=[division, negative], Plane=PlaneXY(0, 0, 0), Corners=1)  # -> flatten(Curve)
curve_line_2 = CurveLine(Curve=boundary_2, Line=offset_curve)  # -> Points, Params, Count
interpolate_2 = Interpolate(Vertices=curve_line_2.Points, Degree=3, Periodic=False, KnotStyle=1)  # -> Curve, Length, Domain
dispatch_2 = Dispatch(List=flatten(interpolate_2.Curve), DispatchPattern=[True, False])  # -> ListA, ListB
ruled_surface = RuledSurface(CurveA=dispatch_2.ListA, CurveB=dispatch_2.ListB)
region_intersection = RegionIntersection(CurvesA=ruled_surface, CurvesB=boundary_2)
region_union = RegionUnion(Curves=region_intersection)
boundary_surfaces = BoundarySurfaces(Edges=region_union)
pathways = Brep(boundary_surfaces)

# ----
lawn_color = ColourSwatch(SwatchColor=RGBA(98, 156, 139, 232))

# ---- group: ground
boundary_3 = Brep(boundary)
depth = Slider(3, range=0..10)
pathway = Brep(pathways)
thickness = Slider(0.5, range=0..1)
boundary_4 = Brep(boundary)
pathways_2 = Curve(ruled_surface)
grass = Slider(1, range=0..1)
region_difference = RegionDifference(CurvesA=boundary_4, CurvesB=pathways_2)
negative_2 = Negative(Value=depth)
unit_z = UnitZ(Factor=grass)
boundary_surfaces_2 = BoundarySurfaces(Edges=region_difference)
unit_z_2 = UnitZ(Factor=thickness)
unit_z_3 = UnitZ(Factor=negative_2)
extrude = Extrude(Base=boundary_3, Direction=unit_z_3)
extrude_2 = Extrude(Base=pathway, Direction=unit_z_2)
extrude_3 = Extrude(Base=boundary_surfaces_2, Direction=unit_z)
ground_color = ColourSwatch(SwatchColor=RGB(189, 110, 60))
paving_color = ColourSwatch(SwatchColor=RGB(51, 51, 51))
custom_preview = CustomPreview(Geometry=extrude, Material=ground_color)
custom_preview_2 = CustomPreview(Geometry=extrude_2, Material=paving_color)
custom_preview_3 = CustomPreview(Geometry=extrude_3, Material=lawn_color)
lawn = Brep(boundary_surfaces_2)

# ---- group: trees
trunk_diameter = Slider(1, range=0..2)
trunk_height = Slider(8, range=0..100)
boundary_5 = Brep(boundary)
trees = Slider(25, range=0..100)
seed = Slider(5, range=0..100)
lawn_2 = Brep(lawn)
offset = Slider(2, range=0..10)
crown_height = Slider(30, range=0..75)
canopy_layers = Slider(3, range=0..10)
canopy_diameter = Slider(10, range=0..100)
negative_3 = Negative(Value=offset)
conical_tree = ConicalTree(A=trunk_diameter, factor=trunk_height, factor_2=crown_height, B=canopy_layers, A_2=canopy_diameter)  # -> trunk, result
populate_geometry = PopulateGeometry(Geometry=flatten(boundary_5), Count=trees, Seed=seed)
offset_curve_2 = OffsetCurve(Curve=lawn_2, Distance=negative_3, Plane=PlaneXY(0, 0, 0), Corners=1)
point_in_curves = PointInCurves(Point=populate_geometry, Curves=offset_curve_2)  # -> Relationship, Index, Point
dispatch_3 = Dispatch(List=populate_geometry, DispatchPattern=point_in_curves.Relationship)  # -> ListA, ListB
point = Point(dispatch_3.ListA)
vector_2pt = Vector2Pt(PointA="0,0,0", PointB=point, Unitize=False)  # -> Vector, Length
move = Move(Geometry=conical_tree.trunk, Motion=vector_2pt.Vector)  # -> Geometry, Transform
move_2 = Move(Geometry=conical_tree.result, Motion=vector_2pt.Vector)  # -> Geometry, Transform
trunk_color = ColourSwatch(SwatchColor=RGB(139, 76, 57))
canopy_color = ColourSwatch(SwatchColor=RGBA(58, 94, 84, 232))
custom_preview_4 = CustomPreview(Geometry=move.Geometry, Material=trunk_color)
custom_preview_5 = CustomPreview(Geometry=move_2.Geometry, Material=canopy_color)

# ==== cluster ConicalTree
factor = ClusterInput()
factor_2 = ClusterInput()
A = ClusterInput()
A_2 = ClusterInput()

# ---- group: conical tree
construct_point = ConstructPoint(XCoordinate=0, YCoordinate=0, ZCoordinate=0)
unit_z = UnitZ(Factor=factor)
unit_z_2 = UnitZ(Factor=factor_2)
division = Division(A=A, B="2.0")
division_2 = Division(A=A_2, B="2.0")
B = ClusterInput()
move = Move(Geometry=construct_point, Motion=unit_z_2)  # -> Geometry, Transform
move_2 = Move(Geometry=construct_point, Motion=unit_z)  # -> Geometry, Transform
division_3 = Division(A=unit_z_2, B=B)
line = Line(StartPoint=construct_point, EndPoint=move_2.Geometry)
line_2 = Line(StartPoint=move_2.Geometry, EndPoint=move.Geometry)
divide_distance = DivideDistance(Curve=line_2, Distance=division_3)  # -> Points, Tangents, Parameters
construct_plane = ConstructPlane(Origin=divide_distance.Points, XAxis=Vector(1, 0, 0), YAxis=Vector(0, 1, 0))
construct_domain = ConstructDomain(DomainStart="0.5", DomainEnd="1.75")
cone = Cone(Base=construct_plane, Radius=division_2, Length=division_3)  # -> Cone, Tip
list_length = ListLength(List=construct_plane)
range = Range(Domain=construct_domain, Steps=list_length)  # -> reverse(Range)
scale = Scale(Geometry=cone.Cone, Center=construct_plane, Factor=range)  # -> Geometry, Transform
pipe = Pipe(Curve=line, Radius=division, Caps=0)
cap_holes = CapHoles(Brep=scale.Geometry)
solid_union = SolidUnion(Breps=cap_holes)

# ----
trunk = ClusterOutput(pipe)
result = ClusterOutput(solid_union)
