# Grasshopper definition random-forest.gh (Grasshopper 1.0.7)
# plug-ins: Pufferfish

# ---- group: generate a conical tree
# parametric tree
# diameter at breast height (DBH)
trunk_diameter = Slider(0.75, range=0..2)
trunk_height = Slider(8, range=0..100)
crown_height = Slider(30, range=0..75)
canopy_layers = Slider(3, range=0..10)
canopy_diameter = Slider(10, range=0..100)
conical_tree = ConicalTree(A=trunk_diameter, factor=trunk_height, factor_2=crown_height, B=canopy_layers, A_2=canopy_diameter)  # -> trunk, result
canopy_color = ColourSwatch(SwatchColor=RGBA(58, 94, 58, 232))
trunk_color = ColourSwatch(SwatchColor=RGB(139, 76, 57))
custom_preview = CustomPreview(Geometry=conical_tree.trunk, Material=trunk_color)
custom_preview_2 = CustomPreview(Geometry=conical_tree.result, Material=canopy_color)

# ---- group: cull trees from a random population
start = Slider(0, range=0..1)
end = Slider(1, range=0..1)
# culled forest
factor = Slider(0.5, range=0..1)
xy_size = Slider(150, range=0..360)
count = Slider(360, range=0..1000)
y_percentage = Slider(0.75, range=0..1)
construct_domain = ConstructDomain(DomainStart=start, DomainEnd=end)
rectangle = Rectangle(Plane=PlaneXY(0, 0, 0), XSize=xy_size, YSize=xy_size, Radius=0)  # -> Rectangle, Length
multiplication = Multiplication(A=xy_size, B=y_percentage)
construct_point = ConstructPoint(XCoordinate=0, YCoordinate=multiplication, ZCoordinate=0)
populate_2d = Populate2D(Region=rectangle.Rectangle, Count=count, Seed=1)
line = Line(StartPoint=Point(0, 0, 0), EndPoint=construct_point)
curve_closest_point = CurveClosestPoint(Point=populate_2d, Curve=line)  # -> Point, Parameter, Distance
list_length = ListLength(List=populate_2d)
random = Random(Range=construct_domain, Number=list_length, Seed=2)
addition = Addition(A=random, B=curve_closest_point.Parameter)
sort_list = SortList(Keys=addition, ValuesValuesA=populate_2d)  # -> Keys, ValuesValuesA
multiplication_2 = Multiplication(A=factor, B=list_length)
sub_list = SubList(List=sort_list.ValuesValuesA, Domain=multiplication_2, Wrap=True)  # -> List, Index
list_length_2 = ListLength(List=sub_list.List)

# ----
origin = Panel("0,0,0")
origin_2 = Panel("0,0,0")

# ---- group: randomly populate a region with trees
number_slider = Slider(150, range=0..360)
number_slider_2 = Slider(100, range=0..360)
canopies = Geometry(conical_tree.result)
# random array
trunks = Geometry(conical_tree.trunk)
rectangle_2 = Rectangle(Plane=PlaneXY(0, 0, 0), XSize=number_slider, YSize=number_slider, Radius=0)  # -> Rectangle, Length
populate_2d_2 = Populate2D(Region=rectangle_2.Rectangle, Count=number_slider_2, Seed=1)
sort_points = SortPoints(Points=populate_2d_2)  # -> Points, Indices
point_order = PointOrder(Points=populate_2d_2)
move_to_point = MoveToPoint(Geometry=canopies, PointA=origin_2, PointB=flatten(sort_points.Points))  # -> Moved, Vector, Transform
move_to_point_2 = MoveToPoint(Geometry=trunks, PointA=origin, PointB=sort_points.Points)  # -> Moved, Vector, Transform
random_2 = Random(Range="0.5 To 1.0", Number=number_slider_2, Seed=2)
point_order_2 = PointOrder(Points=sort_points.Points)
scale = Scale(Geometry=move_to_point.Moved, Center=flatten(sort_points.Points), Factor=random_2)  # -> Geometry, Transform

# ---- group: trunk color
trunk_color_2 = ColourSwatch(SwatchColor=RGB(139, 76, 57))
# color
custom_preview_3 = CustomPreview(Geometry=move_to_point_2.Moved, Material=trunk_color_2)

# ---- group: canopy color
canopy_color_2 = ColourSwatch(SwatchColor=RGBA(191, 115, 48, 232))
canopy_color_3 = ColourSwatch(SwatchColor=RGBA(128, 64, 64, 232))
canopy_color_4 = ColourSwatch(SwatchColor=RGBA(58, 94, 58, 232))
colour = Colour([canopy_color_4, canopy_color_2, canopy_color_3])
range = Range(Domain=Domain(0, 1), Steps=number_slider_2)
interpolate_data = InterpolateData(Data=colour, Parameter=range, Interpolation=2)
custom_preview_4 = CustomPreview(Geometry=scale.Geometry, Material=interpolate_data)

# ---- group: color
point = Point(sub_list.List)
number = Number(list_length_2)
tree_canopy = Geometry(conical_tree.result)
tree_trunk = Geometry(conical_tree.trunk)
move_to_point_3 = MoveToPoint(Geometry=tree_canopy, PointA="0,0,0", PointB=point)  # -> Moved, Vector, Transform
move_to_point_4 = MoveToPoint(Geometry=tree_trunk, PointA="0,0,0", PointB=point)  # -> Moved, Vector, Transform
random_3 = Random(Range="0.45 To 0.75", Number=number, Seed=2)
scale_2 = Scale(Geometry=move_to_point_3.Moved, Center=point, Factor=random_3)  # -> Geometry, Transform
canopy_color_5 = ColourSwatch(SwatchColor=RGBA(58, 94, 58, 232))
trunk_color_3 = ColourSwatch(SwatchColor=RGB(139, 76, 57))
custom_preview_5 = CustomPreview(Geometry=scale_2.Geometry, Material=canopy_color_5)
custom_preview_6 = CustomPreview(Geometry=move_to_point_4.Moved, Material=trunk_color_3)

# ---- group: canopy color gradient
canopy_color_6 = ColourSwatch(SwatchColor=RGBA(58, 94, 58, 232))
canopy_color_7 = ColourSwatch(SwatchColor=RGBA(123, 128, 64, 232))
canopy_color_8 = ColourSwatch(SwatchColor=RGBA(64, 128, 117, 232))
range_2 = Range(Domain=Domain(0, 1), Steps=expr("x-1", number))
colour_2 = Colour([canopy_color_6, canopy_color_8, canopy_color_7])
interpolate_data_2 = InterpolateData(Data=colour_2, Parameter=range_2, Interpolation=2)
custom_preview_7 = CustomPreview(Geometry=scale_2.Geometry, Material=interpolate_data_2)

# ---- group: color and size gradient
canopy_color_9 = ColourSwatch(SwatchColor=RGBA(58, 94, 58, 232))
canopy_color_10 = ColourSwatch(SwatchColor=RGBA(123, 128, 64, 232))
canopy_color_11 = ColourSwatch(SwatchColor=RGBA(64, 128, 117, 232))
range_3 = Range(Domain=Domain(0, 1), Steps=expr("x-1", number))
colour_3 = Colour([canopy_color_9, canopy_color_11, canopy_color_10])
graph_mapper = GraphMapper(
    range_3,
    x0=0,
    x1=1,
    y0=0,
    y1=1,
    container_name="Bezier",
    cpx=[0, 0.7027180791, 0.2938674688, 1],
    cpy=[1, 1, 0.6070680618, 0.6039702892])
interpolate_data_3 = InterpolateData(Data=colour_3, Parameter=range_3, Interpolation=2)
scale_3 = Scale(Geometry=move_to_point_3.Moved, Center=point, Factor=graph_mapper)  # -> Geometry, Transform
custom_preview_8 = CustomPreview(Geometry=scale_3.Geometry, Material=interpolate_data_3)

# ==== cluster ConicalTree
factor = ClusterInput()
factor_2 = ClusterInput()
A = ClusterInput()
A_2 = ClusterInput()

# ---- group: conical tree
construct_point = ConstructPoint(XCoordinate=0, YCoordinate=0, ZCoordinate=0)
unit_z = UnitZ(Factor=factor)
unit_z_2 = UnitZ(Factor=factor_2)
division = Division(A=A, B="2.0")
division_2 = Division(A=A_2, B="2.0")
B = ClusterInput()
move = Move(Geometry=construct_point, Motion=unit_z_2)  # -> Geometry, Transform
move_2 = Move(Geometry=construct_point, Motion=unit_z)  # -> Geometry, Transform
division_3 = Division(A=unit_z_2, B=B)
line = Line(StartPoint=construct_point, EndPoint=move_2.Geometry)
line_2 = Line(StartPoint=move_2.Geometry, EndPoint=move.Geometry)
divide_distance = DivideDistance(Curve=line_2, Distance=division_3)  # -> Points, Tangents, Parameters
construct_plane = ConstructPlane(Origin=divide_distance.Points, XAxis=Vector(1, 0, 0), YAxis=Vector(0, 1, 0))
construct_domain = ConstructDomain(DomainStart="0.5", DomainEnd="1.75")
cone = Cone(Base=construct_plane, Radius=division_2, Length=division_3)  # -> Cone, Tip
list_length = ListLength(List=construct_plane)
range = Range(Domain=construct_domain, Steps=list_length)  # -> reverse(Range)
scale = Scale(Geometry=cone.Cone, Center=construct_plane, Factor=range)  # -> Geometry, Transform
pipe = Pipe(Curve=line, Radius=division, Caps=0)
cap_holes = CapHoles(Brep=scale.Geometry)
solid_union = SolidUnion(Breps=cap_holes)

# ----
trunk = ClusterOutput(pipe)
result = ClusterOutput(solid_union)
