# Grasshopper definition random-grove.gh (Grasshopper 1.0.7)
# plug-ins: Pufferfish, EleFront, EdiTree

# ---- group: randomly distribute grasses / import thea plant(s)
# random meadow
# using elefront
extended_geometry = ExtendedGeometry([<elefrontblock referenced from the Rhino model> x2])

# ---- group: randomly distribute grasses
# using pufferfish
# using editree
number_slider = Slider(12000, range=0..15000)
list_length = ListLength(List=extended_geometry)
circle = Circle(Plane=PlaneXY(0, 0, 0), Radius=Slider(5, range=0..500))
unit_z = UnitZ(Factor=Slider(-0.125, range=-1..0))
boundary_surfaces = BoundarySurfaces(Edges=circle)
populate_geometry = PopulateGeometry(Geometry=boundary_surfaces, Count=number_slider, Seed=1)
divide_list = DivideList(List=extended_geometry, Number=list_length)  # -> Chunk, Remainder
extrude = Extrude(Base=boundary_surfaces, Direction=unit_z)
divide_list_2 = DivideList(List=populate_geometry, Number=list_length)  # -> Chunk, Remainder
move_to_point = MoveToPoint(Geometry=divide_list.Chunk, PointA=Point(0, 0, 0), PointB=divide_list_2.Chunk)  # -> Moved, Vector, Transform
random = Random(Range="0 To 360", Number=number_slider, Seed=2)
random_2 = Random(Range="0.5 To 1.0", Number=number_slider, Seed=2)
scale = Scale(Geometry=flatten(move_to_point.Moved), Center=flatten(move_to_point.Vector), Factor=random_2)  # -> Geometry, Transform
rotate = Rotate(Geometry=scale.Geometry, Angle=degrees(random), Plane=PlaneXY(0, 0, 0))  # -> Geometry, Transform
define_object_attributes = DefineObjectAttributes(Layer="grasses")
define_object_attributes_2 = DefineObjectAttributes(Layer="ground")
bake_objects = BakeObjects(Geometry=rotate.Geometry, Attributes=define_object_attributes, Bake=False)
bake_objects_2 = BakeObjects(Geometry=extrude, Attributes=define_object_attributes_2, Bake=False)

# ---- group: randomly distribute shrubs / import thea plant(s)
# random shrubs
# using elefront
extended_geometry_2 = ExtendedGeometry([<elefrontblock referenced from the Rhino model> x4])

# ---- group: randomly distribute shrubs
# using pufferfish
# using editree
number_slider_2 = Slider(24, range=0..36)
circle_2 = Circle(Plane=PlaneXY(0, 0, 0), Radius=Slider(5, range=0..500))
length = ListLength(List=extended_geometry_2)
boundary_surfaces_2 = BoundarySurfaces(Edges=circle_2)
populate_geometry_2 = PopulateGeometry(Geometry=boundary_surfaces_2, Count=number_slider_2, Seed=1)
divide_list_3 = DivideList(List=extended_geometry_2, Number=length)  # -> Chunk, Remainder
divide_list_4 = DivideList(List=populate_geometry_2, Number=length)  # -> Chunk, Remainder
move_to_point_2 = MoveToPoint(Geometry=divide_list_3.Chunk, PointA=Point(0, 0, 0), PointB=divide_list_4.Chunk)  # -> Moved, Vector, Transform
random_3 = Random(Range="0 To 360", Number=number_slider_2, Seed=2)
random_4 = Random(Range="0.5 To 1.0", Number=number_slider_2, Seed=2)
scale_2 = Scale(Geometry=flatten(move_to_point_2.Moved), Center=flatten(move_to_point_2.Vector), Factor=random_4)  # -> Geometry, Transform
rotate_2 = Rotate(Geometry=scale_2.Geometry, Angle=degrees(random_3), Plane=PlaneXY(0, 0, 0))  # -> Geometry, Transform
define_object_attributes_3 = DefineObjectAttributes(Layer="shrubs")
bake_objects_3 = BakeObjects(Geometry=rotate_2.Geometry, Attributes=define_object_attributes_3, Bake=False)

# ---- group: randomly distribute trees / import thea plant(s)
# random trees
# using elefront
extended_geometry_3 = ExtendedGeometry([<elefrontblock referenced from the Rhino model> x4])

# ---- group: randomly distribute trees
# using pufferfish
# using editree
number_slider_3 = Slider(8, range=0..36)
circle_3 = Circle(Plane=PlaneXY(0, 0, 0), Radius=Slider(5, range=0..500))
length_2 = ListLength(List=extended_geometry_3)
boundary_surfaces_3 = BoundarySurfaces(Edges=circle_3)
populate_geometry_3 = PopulateGeometry(Geometry=boundary_surfaces_3, Count=number_slider_3, Seed=1)
divide_list_5 = DivideList(List=extended_geometry_3, Number=length_2)  # -> Chunk, Remainder
divide_list_6 = DivideList(List=populate_geometry_3, Number=length_2)  # -> Chunk, Remainder
move_to_point_3 = MoveToPoint(Geometry=divide_list_5.Chunk, PointA=Point(0, 0, 0), PointB=divide_list_6.Chunk)  # -> Moved, Vector, Transform
random_5 = Random(Range="0 To 360", Number=number_slider_3, Seed=2)
random_6 = Random(Range="0.5 To 1.0", Number=number_slider_3, Seed=2)
scale_3 = Scale(Geometry=flatten(move_to_point_3.Moved), Center=flatten(move_to_point_3.Vector), Factor=random_6)  # -> Geometry, Transform
rotate_3 = Rotate(Geometry=scale_3.Geometry, Angle=degrees(random_5), Plane=PlaneXY(0, 0, 0))  # -> Geometry, Transform
define_object_attributes_4 = DefineObjectAttributes(Layer="trees")
bake_objects_4 = BakeObjects(Geometry=rotate_3.Geometry, Attributes=define_object_attributes_4, Bake=False)
