# Grasshopper definition random-meadow.gh (Grasshopper 1.0.7)
# plug-ins: EleFront, EdiTree

# ---- group: randomly distribute meadow plants / import thea plant(s)
# random meadow
# using elefront
extended_geometry = ExtendedGeometry(<elefrontblock referenced from the Rhino model>)

# ---- group: randomly distribute meadow plants
# using editree
count = Slider(2500, range=0..10000)
radius = Slider(5, range=0..10)
thickness = Slider(-0.125, range=-1..0)
circle = Circle(Plane=PlaneXY(0, 0, 0), Radius=radius)
list_length = ListLength(List=extended_geometry)
unit_z = UnitZ(Factor=thickness)
boundary_surfaces = BoundarySurfaces(Edges=circle)
populate_geometry = PopulateGeometry(Geometry=boundary_surfaces, Count=count, Seed=1)
scale = Scale(Geometry=boundary_surfaces, Center=Point(0, 0, 0), Factor="1.025")  # -> Geometry, Transform
divide_list = DivideList(List=extended_geometry, Number=list_length)  # -> flatten(Chunk), Remainder
extrude = Extrude(Base=scale.Geometry, Direction=unit_z)
divide_list_2 = DivideList(List=populate_geometry, Number=list_length)  # -> flatten(Chunk), Remainder
vector_2pt = Vector2Pt(PointA="0,0,0", PointB=divide_list_2.Chunk, Unitize=False)  # -> Vector, Length
random = Random(Range="0 To 360", Number=count, Seed=2)
random_2 = Random(Range="0.5 To 1.0", Number=count, Seed=2)
move = Move(Geometry=divide_list.Chunk, Motion=vector_2pt.Vector)  # -> Geometry, Transform
scale_2 = Scale(Geometry=move.Geometry, Center=vector_2pt.Vector, Factor=random_2)  # -> Geometry, Transform
rotate = Rotate(Geometry=scale_2.Geometry, Angle=degrees(random), Plane=PlaneXY(0, 0, 0))  # -> Geometry, Transform
define_object_attributes = DefineObjectAttributes(Layer="Ground")
define_object_attributes_2 = DefineObjectAttributes(Layer="Plants")
bake_objects = BakeObjects(Geometry=rotate.Geometry, Attributes=define_object_attributes_2, Bake=False)
bake_objects_2 = BakeObjects(Geometry=extrude, Attributes=define_object_attributes, Bake=False)
