# Grasshopper definition random-points.gh (Grasshopper 1.0.7)
# Copyright: GNU General Public License 3.0

# ---- group: generate random points
# random points
radius = Slider(20, range=0..36)
count = Slider(30, range=0..100)
seed = Slider(99, range=0..100)
lower = Slider(1, range=0..10)
upper = Slider(4, range=0..10)
circle = Circle(Plane=PlaneXY(0, 0, 0), Radius=radius)
construct_domain = ConstructDomain(DomainStart=lower, DomainEnd=upper)
boundary_surfaces = BoundarySurfaces(Edges=circle)
populate_geometry = PopulateGeometry(Geometry=boundary_surfaces, Count=count, Seed=seed)
random = Random(Range=construct_domain, Number=count, Seed=2)
circle_2 = Circle(Plane=populate_geometry, Radius=random)
boundary_surfaces_2 = BoundarySurfaces(Edges=circle_2)
custom_preview = CustomPreview(Geometry=boundary_surfaces_2, Material=ColourSwatch(SwatchColor=RGB(0, 0, 0)))
