# Grasshopper definition recursive-tree.gh (Grasshopper 1.0.7)
# plug-ins: Anemone

# ---- group: draw trunk
# recursive tree
# trunk
xy_plane = XYPlane(Origin=Point(0, 0, 0))
length = Slider(10, range=0..10)
unit_z = UnitZ(Factor=length)
move = Move(Geometry=xy_plane, Motion=unit_z)  # -> Geometry, Transform
line = Line(StartPoint=xy_plane, EndPoint=move.Geometry)

# trunk cluster
length_2 = Slider(10, range=0..10)
trunk = Trunk(factor=length_2)
trunk_2 = Curve(trunk)

# ---- group: draw branches
# branching
branches = Curve(line)
scaling = Slider(0.75, range=0..1)
angle = Slider(35, range=0..100)
length_3 = Length(Curve=branches)
negative = Negative(Value=angle)
end_points = EndPoints(Curve=branches)  # -> Start, End
multiplication = Multiplication(A=length_3, B=scaling)
relay = Relay([angle, negative])
vector_2pt = Vector2Pt(PointA=end_points.Start, PointB=end_points.End, Unitize=False)  # -> Vector, Length
yz_plane = YZPlane(Origin=Point(0, 0, 0))
rotate = Rotate(Geometry=vector_2pt.Vector, Angle=degrees(relay), Plane=yz_plane)  # -> Geometry, Transform
line_sdl = LineSDL(Start=end_points.End, Direction=rotate.Geometry, Length=multiplication)  # -> graft(Line)
branches_2 = Curve(line_sdl)

# branching cluster
branches_3 = Curve(line)
scaling_2 = Slider(0.75, range=0..1)
angle_2 = Slider(35, range=0..100)
branching = Branching(branches=branches_3, B=scaling_2, angle=angle_2)
branches_4 = Curve(branching)

# ---- group: recursive tree by looping
# recursive tree by looping
# using anemone
# using anemone
iterations = Slider(7, range=0..10)
length_4 = Slider(10, range=0..10)
scaling_3 = Slider(0.75, range=0..1)
angle_3 = Slider(35, range=0..100)
trunk_3 = Trunk(factor=length_4)
loop_start = LoopStart(Repeat=iterations, Trigger=Toggle(True), Data=trunk_3)  # -> port, Counter, Data
branching_2 = Branching(branches=loop_start.Data, B=scaling_3, angle=angle_3)
loop_end = LoopEnd(port=loop_start.port, Exit=False, Data=branching_2, TimeOutVal=0, pausedState=False, state="Constant & Record")
curve = Curve([trunk_3, loop_end])
join_curves = JoinCurves(Curves=flatten(curve), Preserve=False)
param_viewer = ParamViewer(curve)
pipe = Pipe(Curve=join_curves, Radius="0.2", Caps="2")
custom_preview = CustomPreview(Geometry=pipe, Material=ColourSwatch(SwatchColor=RGB(76, 76, 76)))

# ---- group: recursive tree from clusters
# recursive tree from clusters
length_5 = Slider(10, range=0..10)
scaling_4 = Slider(0.75, range=0..1)
angle_4 = Slider(35, range=0..100)
trunk_4 = Trunk(factor=length_5)
branching_3 = Branching(branches=trunk_4, B=scaling_4, angle=angle_4)
branching_4 = Branching(branches=branching_3, B=scaling_4, angle=angle_4)
branching_5 = Branching(branches=branching_4, B=scaling_4, angle=angle_4)
branching_6 = Branching(branches=branching_5, B=scaling_4, angle=angle_4)
branching_7 = Branching(branches=branching_6, B=scaling_4, angle=angle_4)
curve_2 = Curve([trunk_4, branching_3, branching_4, branching_5, branching_6, branching_7])
join_curves_2 = JoinCurves(Curves=flatten(curve_2), Preserve=False)
param_viewer_2 = ParamViewer(curve_2)
pipe_2 = Pipe(Curve=join_curves_2, Radius="0.2", Caps="2")
custom_preview_2 = CustomPreview(Geometry=pipe_2, Material=ColourSwatch(SwatchColor=RGB(76, 76, 76)))

# ==== cluster Trunk
factor = ClusterInput()
unit_z = UnitZ(Factor=factor)
xy_plane = XYPlane(Origin=Point(0, 0, 0))
move = Move(Geometry=xy_plane, Motion=unit_z)  # -> Geometry, Transform
line = Line(StartPoint=xy_plane, EndPoint=move.Geometry)
line_2 = ClusterOutput(line)

# ==== cluster Branching
branches = ClusterInput()
angle = ClusterInput()
branches_2 = Curve(branches)
angle_2 = Number(angle)
negative = Negative(Value=angle_2)
length = Length(Curve=branches_2)
B = ClusterInput()
end_points = EndPoints(Curve=branches_2)  # -> Start, End
multiplication = Multiplication(A=length, B=B)
relay = Relay([angle_2, negative])
yz_plane = YZPlane(Origin=Point(0, 0, 0))
vector_2pt = Vector2Pt(PointA=end_points.Start, PointB=end_points.End, Unitize=False)  # -> Vector, Length
rotate = Rotate(Geometry=vector_2pt.Vector, Angle=degrees(relay), Plane=yz_plane)  # -> Geometry, Transform
line_sdl = LineSDL(Start=end_points.End, Direction=rotate.Geometry, Length=multiplication)  # -> graft(Line)
branches_3 = Curve(line_sdl)
branches_4 = ClusterOutput(branches_3)
