# Grasshopper definition rendered-quadrangle.gh (Grasshopper 1.0.7)
# Copyright: GNU General Public License
# plug-ins: EleFront

# ---- group: paths
# rendered quadrangle
X = Slider(36, range=0..100)
Y = Slider(36, range=0..100)
start = Slider(34, range=0..100)
step = Slider(1, range=0..100)
count = Slider(4, range=0..10)
series = Series(Start=start, Step=step, Count=count)
plane_surface = PlaneSurface(Plane=PlaneXY(0, 0, 0), XSize=X, YSize=Y)
populate_2d = Populate2D(Region=plane_surface, Count="2", Seed=series)
dispatch = Dispatch(List=populate_2d, DispatchPattern=[True, False])  # -> ListA, ListB
line = Line(StartPoint=dispatch.ListA, EndPoint=dispatch.ListB)
curve_line = CurveLine(Curve=plane_surface, Line=line)  # -> Points, Params, Count
interpolate = Interpolate(Vertices=curve_line.Points, Degree=3, Periodic=False, KnotStyle=1)  # -> Curve, Length, Domain
boundary = Brep(plane_surface)
paths = Curve(interpolate.Curve)

# ---- group: pathways
paths_2 = Curve(paths)
width = Slider(1, range=0..2)
boundary_2 = Curve(boundary)
division = Division(A=width, B="2")
negative = Negative(Value=division)
offset_curve = OffsetCurve(Curve=paths_2, Distance=[division, negative], Plane=PlaneXY(0, 0, 0), Corners=1)  # -> flatten(Curve)
curve_line_2 = CurveLine(Curve=boundary_2, Line=offset_curve)  # -> Points, Params, Count
interpolate_2 = Interpolate(Vertices=curve_line_2.Points, Degree=3, Periodic=False, KnotStyle=1)  # -> Curve, Length, Domain
dispatch_2 = Dispatch(List=flatten(interpolate_2.Curve), DispatchPattern=[True, False])  # -> ListA, ListB
ruled_surface = RuledSurface(CurveA=dispatch_2.ListA, CurveB=dispatch_2.ListB)
region_intersection = RegionIntersection(CurvesA=ruled_surface, CurvesB=boundary_2)
region_union = RegionUnion(Curves=region_intersection)
boundary_surfaces = BoundarySurfaces(Edges=region_union)
pathways = Brep(boundary_surfaces)

# ----
gravel_color = ColourSwatch(SwatchColor=RGBA(117, 117, 117, 232))

# ---- group: ground
boundary_3 = Brep(boundary)
depth = Slider(1, range=0..10)
pathway = Brep(pathways)
thickness = Slider(0.2, range=0..1)
boundary_4 = Brep(boundary)
pathways_2 = Curve(ruled_surface)
grass = Slider(0.1, range=0..1)
region_difference = RegionDifference(CurvesA=boundary_4, CurvesB=pathways_2)
negative_2 = Negative(Value=depth)
unit_z = UnitZ(Factor=grass)
boundary_surfaces_2 = BoundarySurfaces(Edges=region_difference)
unit_z_2 = UnitZ(Factor=thickness)
unit_z_3 = UnitZ(Factor=negative_2)
extrude = Extrude(Base=boundary_3, Direction=unit_z_3)
extrude_2 = Extrude(Base=pathway, Direction=unit_z_2)
extrude_3 = Extrude(Base=boundary_surfaces_2, Direction=unit_z)
ground_color = ColourSwatch(SwatchColor=RGB(189, 110, 60))
paving_color = ColourSwatch(SwatchColor=RGB(51, 51, 51))
custom_preview = CustomPreview(Geometry=extrude, Material=ground_color)
custom_preview_2 = CustomPreview(Geometry=extrude_2, Material=paving_color)
custom_preview_3 = CustomPreview(Geometry=extrude_3, Material=gravel_color)
gravel = Brep(boundary_surfaces_2)

# ---- group: trees
# xfrog tree
# using elefront
# using elefront
# using elefront
extended_geometry = ExtendedGeometry(<elefrontblock referenced from the Rhino model>)
boundary_5 = Brep(boundary)
trees = Slider(25, range=0..100)
seed = Slider(5, range=0..100)
gravel_2 = Brep(gravel)
offset = Slider(0.4, range=0..1)
negative_3 = Negative(Value=offset)
populate_geometry = PopulateGeometry(Geometry=flatten(boundary_5), Count=trees, Seed=seed)
offset_curve_2 = OffsetCurve(Curve=gravel_2, Distance=negative_3, Plane=PlaneXY(0, 0, 0), Corners=1)
point_in_curves = PointInCurves(Point=populate_geometry, Curves=offset_curve_2)  # -> Relationship, Index, Point
dispatch_3 = Dispatch(List=populate_geometry, DispatchPattern=point_in_curves.Relationship)  # -> ListA, ListB
point = Point(dispatch_3.ListA)
vector_2pt = Vector2Pt(PointA="0,0,0", PointB=point, Unitize=False)  # -> Vector, Length
define_object_attributes = DefineObjectAttributes(Layer="trees")
move = Move(Geometry=extended_geometry, Motion=vector_2pt.Vector)  # -> Geometry, Transform
bake_objects = BakeObjects(Geometry=move.Geometry, Attributes=define_object_attributes, Bake=False)
