# Grasshopper definition algorithm.gh (Grasshopper 1.0.7)
# Copyright: GNU General Public License 3.0

# ----
# input
# parameters
# output
# parameter
# component
count = Slider(100, range=0..100)
seed = Slider(0, range=0..100)
# algorithm
populate_3d = Populate3D(Region={Plane=PlaneXY(0, 0, 0), X=Domain(0, 10), Y=Domain(0, 10), Z=Domain(0, 2)}, Count=count, Seed=seed)
point = Point(populate_3d)

# ----
# algorithm
# output
# parameter
# input parameters
# component
count_2 = Slider(100, range=0..100)
seed_2 = Slider(0, range=0..100)
populate_3d_2 = Populate3D(Region={Plane=PlaneXY(0, 0, 0), X=Domain(0, 10), Y=Domain(0, 10), Z=Domain(0, 2)}, Count=count_2, Seed=seed_2)
point_2 = Point(populate_3d_2)

# ---- group: input parameters
count_3 = Slider(100, range=0..100)

# ----
# algorithm
seed_3 = Slider(0, range=0..100)

count_4 = Slider(1, range=0..10)
seed_4 = Slider(0, range=0..100)

# ---- group: component
populate_3d_3 = Populate3D(Region={Plane=PlaneXY(0, 0, 0), X=Domain(0, 10), Y=Domain(0, 10), Z=Domain(0, 2)}, Count=count_3, Seed=seed_3)

# ----
populate_3d_4 = Populate3D(Region={Plane=PlaneXY(0, 0, 0), X=Domain(0, 10), Y=Domain(0, 10), Z=Domain(0, 2)}, Count=count_4, Seed=seed_4)

# ---- group: output parameter
point_3 = Point(populate_3d_3)

# ----
point_4 = Point(populate_3d_4)

# ---- group: input parameters
count_5 = Slider(100, range=0..100)
seed_5 = Slider(0, range=0..100)

# ---- group: algorithm
count_6 = Slider(100, range=0..100)
seed_6 = Slider(0, range=0..100)
populate_3d_5 = Populate3D(Region={Plane=PlaneXY(0, 0, 0), X=Domain(0, 10), Y=Domain(0, 10), Z=Domain(0, 2)}, Count=count_6, Seed=seed_6)
point_5 = Point(populate_3d_5)

# ----
# 1
count_7 = Slider(100, range=0..100)
# 2
seed_7 = Slider(0, range=0..100)
count_8 = Slider(100, range=0..100)
seed_8 = Slider(0, range=0..100)

# ---- group: component
populate_3d_6 = Populate3D(Region={Plane=PlaneXY(0, 0, 0), X=Domain(0, 10), Y=Domain(0, 10), Z=Domain(0, 2)}, Count=count_5, Seed=seed_5)

# ----
# 3
populate_3d_7 = Populate3D(Region={Plane=PlaneXY(0, 0, 0), X=Domain(0, 10), Y=Domain(0, 10), Z=Domain(0, 2)}, Count=count_7, Seed=seed_7)
populate_3d_8 = Populate3D(Region={Plane=PlaneXY(0, 0, 0), X=Domain(0, 10), Y=Domain(0, 10), Z=Domain(0, 2)}, Count=count_8, Seed=seed_8)
# 4
point_6 = Point(populate_3d_7)

# ---- group: output parameter
point_7 = Point(populate_3d_6)

# ----
point_8 = Point(point_7)
size = Slider(0.25, range=0..1)
cloud_display = CloudDisplay(Points=point_8, Colours=ColourSwatch(SwatchColor=RGB(38, 38, 38)), Size=size, SpriteType=1)

point_9 = Point(point_7)
size_2 = Slider(0.25, range=0..1)
dot_display = DotDisplay(Point=point_9, Colour=ColourSwatch(SwatchColor=RGB(38, 38, 38)), Size=size_2)

point_10 = Point(populate_3d_8)
