# Grasshopper definition anatomy.gh (Grasshopper 1.0.7)
# Copyright: GNU General Public License 3.0

# ----
# anatomy of a definition
# subtitle
# section
point = Point(Point(0, 0, 0))
X = Slider(10, range=0..100)
unit_x = UnitX(Factor=X)
move = Move(Geometry=point, Motion=unit_x)  # -> Geometry, Transform
point_2 = Point(move.Geometry)
