# Grasshopper definition attractor.gh (Grasshopper 1.0.7)
# plug-ins: MeshEdit Components, Pufferfish

# ---- group: point attractor by remapping
# point attractor by remapping
extent = Slider(9, range=0..100)
attractor_x = Slider(5, range=0..100)
attractor_y = Slider(2, range=0..100)
square = Square(Plane=PlaneXY(0, 0, 0), Size=1, ExtentX=extent, ExtentY=extent)  # -> Cells, flatten(Points)
construct_point = ConstructPoint(XCoordinate=attractor_x, YCoordinate=attractor_y, ZCoordinate=0)
number_slider = Slider(0.25, range=0..1)
number_slider_2 = Slider(0.5, range=0..1)
distance = Distance(PointA=square.Points, PointB=construct_point)
construct_domain = ConstructDomain(DomainStart=number_slider, DomainEnd=number_slider_2)
bounds = Bounds(Numbers=distance)
remap_numbers = RemapNumbers(Value=distance, Source=bounds, Target=construct_domain)  # -> Mapped, Clipped
graph_mapper = GraphMapper(
    remap_numbers.Mapped,
    x0=0,
    x1=1,
    y0=0,
    y1=1,
    container_name="Bezier",
    cpx=[0, 0.4012804925, 0.5025006533, 1],
    cpy=[0, 0, 1, 1])
circle = Circle(Plane=square.Points, Radius=graph_mapper)
gradient = Gradient(
    LowerLimit=number_slider,
    UpperLimit=number_slider_2,
    Parameter=graph_mapper,
    stops=[0: RGB(255, 255, 255), 1: RGB(0, 0, 0)])
mesh_frompoints = MeshFromPoints(Points=square.Points, UDirection=expr("x+1", extent), VDirection=expr("x+1", extent), Colour=gradient)

# ---- group: point attractor on square grid
# point attractor by vector
cell_size = Slider(1, range=0..10)
extent_2 = Slider(10, range=0..100)
attractor_x_2 = Slider(5, range=0..100)
attractor_y_2 = Slider(2, range=0..100)
attractor_z = Slider(1, range=0..100)
offset = Slider(0.5, range=0..1)
construct_point_2 = ConstructPoint(XCoordinate=attractor_x_2, YCoordinate=attractor_y_2, ZCoordinate=attractor_z)
square_2 = Square(Plane=PlaneXY(0, 0, 0), Size=cell_size, ExtentX=extent_2, ExtentY=extent_2)  # -> Cells, Points
vector_2pt = Vector2Pt(PointA=square_2.Points, PointB=construct_point_2, Unitize=False)  # -> Vector, Length
circle_cnr = CircleCNR(Center=square_2.Points, Normal=vector_2pt.Vector, Radius=cell_size)
negative = Negative(Value=offset)
offset_curve = OffsetCurve(Curve=circle_cnr, Distance=negative, Plane=PlaneXY(0, 0, 0), Corners=1)
boundary_surfaces = BoundarySurfaces(Edges=offset_curve)
custom_preview = CustomPreview(Geometry=boundary_surfaces, Material=ColourSwatch(SwatchColor=RGB(0, 0, 0)))

# ---- group: point attractor on hexgrid
size = Slider(0.444, range=0..1)
extents = Slider(10, range=0..100)
point = Point(Point(4.242560758, 5, 0.9397926582))
radius = Slider(0.15, range=0..1)
hexagonal = Hexagonal(Plane=PlaneXY(0, 0, 0), Size=size, ExtentX=extents, ExtentY=extents)  # -> Cells, Points
vector_2pt_2 = Vector2Pt(PointA=hexagonal.Points, PointB=point, Unitize=False)  # -> Vector, Length
negative_2 = Negative(Value=radius)
circle_cnr_2 = CircleCNR(Center=hexagonal.Points, Normal=vector_2pt_2.Vector, Radius=size)
offset_curve_2 = OffsetCurve(Curve=circle_cnr_2, Distance=negative_2, Plane=PlaneXY(0, 0, 0), BothSides=False, Kinks=0, CapType=1)
boundary_surfaces_2 = BoundarySurfaces(Edges=offset_curve_2)
custom_preview_2 = CustomPreview(Geometry=boundary_surfaces_2, Material=ColourSwatch(SwatchColor=RGB(0, 0, 0)))
