# Grasshopper definition attractors.gh (Grasshopper 1.0.7)
# Copyright: GNU General Public License 3.0

# ---- group: horizontal attractors with graph mapper
X = Slider(10, range=0..100)
Y = Slider(10, range=0..100)
attractors = Point([Point(2, 3, 0), Point(3, 7, 0), Point(8, 3, 0)])
square = Square(Plane=PlaneXY(0, 0, 0), Size=1, ExtentX=X, ExtentY=Y)  # -> Cells, graft(Points)
vector_2pt = Vector2Pt(PointA=square.Points, PointB=attractors, Unitize=Toggle(True))  # -> Vector, Length
pull_point = PullPoint(Point=square.Points, Geometry=attractors, ClosestOnly=True)  # -> ClosestPoint, Distance
mass_addition = MassAddition(Input=vector_2pt.Vector)  # -> Result, PartialResults
bounds = Bounds(Numbers=flatten(pull_point.Distance))
remap_numbers = RemapNumbers(Value=pull_point.Distance, Source=bounds, Target=Domain(0, 1))  # -> Mapped, Clipped
remap_numbers_2 = RemapNumbers(Value=pull_point.Distance, Source=bounds, Target=Domain(0, 1))  # -> Mapped, Clipped
graph_mapper = GraphMapper(
    remap_numbers.Mapped,
    x0=0,
    x1=1,
    y0=0,
    y1=1,
    container_name="Bezier",
    cpx=[0, 0.777778089, 0.07942266017, 1],
    cpy=[0, 0.3623188138, 1, 1])
graph_mapper_2 = GraphMapper(
    remap_numbers_2.Mapped,
    x0=0,
    x1=1,
    y0=0,
    y1=1,
    container_name="Bezier",
    cpx=[0, 0.2850244641, 0.2315098792, 1],
    cpy=[0.6014209986, 0.3599022031, 0.08816659451, 0.08519977331])
multiplication = Multiplication(A=mass_addition.Result, B=graph_mapper)
move = Move(Geometry=square.Points, Motion=multiplication)  # -> Geometry, Transform
circle = Circle(Plane=move.Geometry, Radius=graph_mapper_2)
boundary_surfaces = BoundarySurfaces(Edges=circle)

# ---- group: vertical attractors
# attractors
X_2 = Slider(10, range=0..100)
Y_2 = Slider(10, range=0..100)
point = Point([Point(3, 4.168870139, 0), Point(8, 5, 0), Point(3.780386977, 6.523258688, 0)])
domain = Slider(2, range=0..10)
square_2 = Square(Plane=PlaneXY(0, 0, 0), Size=1, ExtentX=X_2, ExtentY=Y_2)  # -> Cells, flatten(Points)
negative = Negative(Value=domain)
construct_domain = ConstructDomain(DomainStart=negative, DomainEnd=domain)
closest_point = ClosestPoint(Point=square_2.Points, Cloud=point)  # -> ClosestPoint, CPIndex, Distance
bounds_2 = Bounds(Numbers=closest_point.Distance)
remap_numbers_3 = RemapNumbers(Value=closest_point.Distance, Source=bounds_2, Target=construct_domain)  # -> Mapped, Clipped
unit_z = UnitZ(Factor=remap_numbers_3.Mapped)
move_2 = Move(Geometry=square_2.Points, Motion=unit_z)  # -> Geometry, Transform
dot_display = DotDisplay(Point=move_2.Geometry, Colour=ColourSwatch(SwatchColor=RGB(92, 92, 92)), Size="0.05")
dot_display_2 = DotDisplay(Point=point, Colour=ColourSwatch(SwatchColor=RGB(0, 0, 0)), Size="0.1")

# ---- group: random vertical attractors
X_3 = Slider(10, range=0..100)
Y_3 = Slider(10, range=0..100)
attractors_2 = Slider(12, range=0..100)
seed = Slider(20, range=0..100)
domain_2 = Slider(2, range=0..10)
rectangle = Rectangle(Plane=PlaneXY(0, 0, 0), XSize=X_3, YSize=Y_3, Radius=0)  # -> Rectangle, Length
populate_2d = Populate2D(Region=rectangle.Rectangle, Count=attractors_2, Seed=seed)
square_3 = Square(Plane=PlaneXY(0, 0, 0), Size=1, ExtentX=X_3, ExtentY=Y_3)  # -> Cells, flatten(Points)
point_2 = Point(populate_2d)
negative_2 = Negative(Value=domain_2)
construct_domain_2 = ConstructDomain(DomainStart=negative_2, DomainEnd=domain_2)
closest_point_2 = ClosestPoint(Point=square_3.Points, Cloud=point_2)  # -> ClosestPoint, CPIndex, Distance
bounds_3 = Bounds(Numbers=closest_point_2.Distance)
remap_numbers_4 = RemapNumbers(Value=closest_point_2.Distance, Source=bounds_3, Target=construct_domain_2)  # -> Mapped, Clipped
unit_z_2 = UnitZ(Factor=remap_numbers_4.Mapped)
move_3 = Move(Geometry=square_3.Points, Motion=unit_z_2)  # -> Geometry, Transform
dot_display_3 = DotDisplay(Point=move_3.Geometry, Colour=ColourSwatch(SwatchColor=RGB(92, 92, 92)), Size="0.05")
dot_display_4 = DotDisplay(Point=point_2, Colour=ColourSwatch(SwatchColor=RGB(0, 0, 0)), Size="0.1")

# ---- group: multiple horizontal attractors
X_4 = Slider(10, range=0..100)
Y_4 = Slider(10, range=0..100)
attractors_3 = Point([Point(2, 3, 0), Point(3, 7, 0), Point(8, 3, 0)])
factor = Slider(0.25, range=0..1)
square_4 = Square(Plane=PlaneXY(0, 0, 0), Size=1, ExtentX=X_4, ExtentY=Y_4)  # -> Cells, graft(Points)
vector_2pt_2 = Vector2Pt(PointA=square_4.Points, PointB=attractors_3, Unitize=Toggle(True))  # -> Vector, Length
pull_point_2 = PullPoint(Point=square_4.Points, Geometry=attractors_3, ClosestOnly=True)  # -> ClosestPoint, Distance
mass_addition_2 = MassAddition(Input=vector_2pt_2.Vector)  # -> Result, PartialResults
multiplication_2 = Multiplication(A=pull_point_2.Distance, B=factor)
multiplication_3 = Multiplication(A=mass_addition_2.Result, B=multiplication_2)
move_4 = Move(Geometry=square_4.Points, Motion=multiplication_3)  # -> Geometry, Transform
dot_display_5 = DotDisplay(Point=move_4.Geometry, Colour=ColourSwatch(SwatchColor=RGB(92, 92, 92)), Size="0.05")
dot_display_6 = DotDisplay(Point=attractors_3, Colour=ColourSwatch(SwatchColor=RGB(0, 0, 0)), Size="0.10")

# ---- group: horizontal attractors for circles
X_5 = Slider(10, range=0..100)
Y_5 = Slider(10, range=0..100)
attractors_4 = Point([Point(2, 3, 0), Point(3, 7, 0), Point(8, 3, 0)])
force = Slider(1.5, range=0..3)
square_5 = Square(Plane=PlaneXY(0, 0, 0), Size=1, ExtentX=X_5, ExtentY=Y_5)  # -> Cells, graft(Points)
vector_2pt_3 = Vector2Pt(PointA=square_5.Points, PointB=attractors_4, Unitize=Toggle(True))  # -> Vector, Length
pull_point_3 = PullPoint(Point=square_5.Points, Geometry=attractors_4, ClosestOnly=True)  # -> ClosestPoint, Distance
mass_addition_3 = MassAddition(Input=vector_2pt_3.Vector)  # -> Result, PartialResults
bounds_4 = Bounds(Numbers=flatten(pull_point_3.Distance))
remap_numbers_5 = RemapNumbers(Value=pull_point_3.Distance, Source=bounds_4, Target=force)  # -> Mapped, Clipped
remap_numbers_6 = RemapNumbers(Value=pull_point_3.Distance, Source=bounds_4, Target="0.1 To 0.5")  # -> Mapped, Clipped
multiplication_4 = Multiplication(A=mass_addition_3.Result, B=remap_numbers_5.Mapped)
move_5 = Move(Geometry=square_5.Points, Motion=multiplication_4)  # -> Geometry, Transform
circle_2 = Circle(Plane=move_5.Geometry, Radius=remap_numbers_6.Mapped)
boundary_surfaces_2 = BoundarySurfaces(Edges=circle_2)

# ---- group: contours
point_3 = Point(move_2.Geometry)
resolution = Slider(20, range=0..100)
tension = Slider(10, range=0..10)
interval = Slider(0.2, range=0..1)
patch = Patch(Points=point_3, Spans=resolution, Flexibility=tension, Trim=True)
contour = Contour(Shape=patch, Point=Point(0, 0, 0), Direction=Vector(0, 0, 1), Distance=interval)
project = Project(Geometry=contour, Plane=PlaneXY(0, 0, 0))  # -> flatten(Geometry), Transform
curve = Curve(project.Geometry)

point_4 = Point(move_3.Geometry)
resolution_2 = Slider(20, range=0..100)
tension_2 = Slider(10, range=0..10)
interval_2 = Slider(0.2, range=0..1)
region = Geometry(rectangle.Rectangle)
patch_2 = Patch(Curves=region, Points=point_4, Spans=resolution_2, Flexibility=tension_2, Trim=True)
contour_2 = Contour(Shape=patch_2, Point=Point(0, 0, 0), Direction=Vector(0, 0, 1), Distance=interval_2)
project_2 = Project(Geometry=contour_2, Plane=PlaneXY(0, 0, 0))  # -> flatten(Geometry), Transform
curve_2 = Curve(project_2.Geometry)
