# Grasshopper definition biome-noise.gh (Grasshopper 1.0.7)
# plug-ins: BitmapPlus

seed = Slider(0, range=0..100)
xy = Slider(300, range=0..1000)
depth = Slider(5000, range=0..10000)
value_list = ValueList({"Value": 0, "Perlin": 1, "Cubic": 2, "Simplex": 3, "WhiteNoise": 4}, selected="Cubic")
value_list_2 = ValueList({"Linear": 0, "Hermite": 1, "Quintic": 2}, selected="Quintic")
frequency = Slider(0.01, range=0..0.01)
value_list_3 = ValueList({"FBM": 0, "Billow": 1, "Rigid": 2}, selected="Billow")
octaves = Slider(3, range=0..10)
lacunity = Slider(3, range=0..10)
gain = Slider(0.2, range=0..1)
procedural_noise = ProceduralNoise(Seed=seed, Width=xy, Height=xy, Depth=depth, Mode=value_list, Interpolation=value_list_2, Frequency=frequency)  # -> Image, Noise
prev_image = PrevImage(SmartBitmap=procedural_noise.Image)
procedural_fractal_pass = ProceduralFractalPass(Noise=procedural_noise.Noise, Mode=value_list_3, Octaves=octaves, Lacunity=lacunity, Gain=gain)
prev_image_2 = PrevImage(SmartBitmap=procedural_fractal_pass)
data = Data(procedural_noise.Image)
data_2 = Data(procedural_fractal_pass)

list = ValueList({"Euclidean": 0, "Manhattan": 1, "Natural": 2}, selected="Euclidean")
list_2 = ValueList({"Value": 0, "Distance2": 2, "Dist2Add": 3, "Dist2Sub": 4, "Dist2Mul": 5, "Dist2Div": 6}, selected="Distance2")
seed_2 = Slider(0, range=0..100)
xy_2 = Slider(300, range=0..1000)
depth_2 = Slider(4360, range=0..10000)
jitter = Slider(0.5, range=0..1)
frequency_2 = Slider(0.015, range=0..0.1)
procedural_cellular = ProceduralCellular(
    Seed=seed_2,
    Width=xy_2,
    Height=xy_2,
    Depth=depth_2,
    BoundaryMode=list,
    InterpolationMode=list_2,
    Jitter=jitter,
    Frequency=frequency_2)
prev_image_3 = PrevImage(SmartBitmap=procedural_cellular)
data_3 = Data(procedural_cellular)

data_4 = Data(data_3)
Z = Slider(36, range=0..100)
bitmap_properties = BitmapProperties(Image=data_4)  # -> Boundary, Width, Height, HorizontalResolution, VerticalResolution, Format
deconstruct_bitmap = DeconstructBitmap(Image=data_4)
split_ahsv = SplitAHSV(Colour=deconstruct_bitmap)  # -> Alpha, Hue, Saturation, Value
mesh_plane = MeshPlane(
    Boundary=bitmap_properties.Boundary,
    WidthCount=expr("x-1", bitmap_properties.Width),
    HeightCount=expr("x-1", bitmap_properties.Height))  # -> Mesh, Area
gradient = Gradient(
    LowerLimit=0,
    UpperLimit=1,
    Parameter=split_ahsv.Value,
    stops=[0: RGB(55, 11, 65), 0.125: RGB(27, 30, 59), 0.25: RGB(22, 83, 76), 0.375: RGB(68, 119, 49), 0.5: RGB(161, 121, 74), 0.625: RGB(212, 132, 169), 0.75: RGB(198, 180, 238), 0.875: RGB(203, 232, 240), 1: RGB(255, 255, 255)])
multiplication = Multiplication(A=split_ahsv.Value, B=Z)
deconstruct_mesh = DeconstructMesh(Mesh=mesh_plane.Mesh)  # -> Vertices, Faces, Colours, Normals
unit_z = UnitZ(Factor=multiplication)
mesh_face = MeshFace(deconstruct_mesh.Faces)
point = Point(deconstruct_mesh.Vertices)
colour = Colour(gradient)
vector = Vector(unit_z)

point_2 = Point(point)
vector_2 = Vector(vector)
mesh_face_2 = MeshFace(mesh_face)
colour_2 = Colour(colour)
move = Move(Geometry=point_2, Motion=vector_2)  # -> Geometry, Transform
construct_mesh = ConstructMesh(Vertices=move.Geometry, Faces=mesh_face_2, Colours=colour_2)
point_3 = Point(move.Geometry)
mesh = Mesh(construct_mesh)

point_4 = Point(point_3)
noise = Number(split_ahsv.Value)
threshold = Slider(0.3, range=0..1)
smaller_than = SmallerThan(FirstNumber=noise, SecondNumber=threshold)  # -> SmallerThan, OrEqualTo
cull_pattern = CullPattern(List=point_4, CullPattern=smaller_than.OrEqualTo)
list_length = ListLength(List=cull_pattern)
multiplication_2 = Multiplication(A=list_length, B="0.9")
random_reduce = RandomReduce(List=cull_pattern, Reduction=multiplication_2, Seed=1)
point_5 = Point(random_reduce)

trunk_diameter = Slider(0.2, range=0..2)
trunk_height = Slider(1, range=0..3)
crown_height = Slider(3, range=0..5)
canopy_layers = Slider(3, range=0..10)
canopy_diameter = Slider(1.5, range=0..3)
point_6 = Point(point_5)
conical_tree = ConicalTree(A=trunk_diameter, factor=trunk_height, factor_2=crown_height, B=canopy_layers, A_2=canopy_diameter)  # -> trunk, result
move_2 = Move(Geometry=conical_tree.trunk, Motion=point_6)  # -> Geometry, Transform
move_3 = Move(Geometry=conical_tree.result, Motion=point_6)  # -> Geometry, Transform
trunk_color = ColourSwatch(SwatchColor=RGB(139, 76, 57))
canopy_color = ColourSwatch(SwatchColor=RGBA(58, 94, 84, 232))
custom_preview = CustomPreview(Geometry=move_2.Geometry, Material=trunk_color)
custom_preview_2 = CustomPreview(Geometry=move_3.Geometry, Material=canopy_color)

# ==== cluster ConicalTree
factor = ClusterInput()
factor_2 = ClusterInput()
A = ClusterInput()
A_2 = ClusterInput()

# ---- group: conical tree
construct_point = ConstructPoint(XCoordinate=0, YCoordinate=0, ZCoordinate=0)
unit_z = UnitZ(Factor=factor)
unit_z_2 = UnitZ(Factor=factor_2)
division = Division(A=A, B="2.0")
division_2 = Division(A=A_2, B="2.0")
B = ClusterInput()
move = Move(Geometry=construct_point, Motion=unit_z_2)  # -> Geometry, Transform
move_2 = Move(Geometry=construct_point, Motion=unit_z)  # -> Geometry, Transform
division_3 = Division(A=unit_z_2, B=B)
line = Line(StartPoint=construct_point, EndPoint=move_2.Geometry)
line_2 = Line(StartPoint=move_2.Geometry, EndPoint=move.Geometry)
divide_distance = DivideDistance(Curve=line_2, Distance=division_3)  # -> Points, Tangents, Parameters
construct_plane = ConstructPlane(Origin=divide_distance.Points, XAxis=Vector(1, 0, 0), YAxis=Vector(0, 1, 0))
construct_domain = ConstructDomain(DomainStart="0.5", DomainEnd="1.75")
cone = Cone(Base=construct_plane, Radius=division_2, Length=division_3)  # -> Cone, Tip
list_length = ListLength(List=construct_plane)
range = Range(Domain=construct_domain, Steps=list_length)  # -> reverse(Range)
scale = Scale(Geometry=cone.Cone, Center=construct_plane, Factor=range)  # -> Geometry, Transform
pipe = Pipe(Curve=line, Radius=division, Caps=0)
cap_holes = CapHoles(Brep=scale.Geometry)
solid_union = SolidUnion(Breps=cap_holes)

# ----
trunk = ClusterOutput(pipe)
result = ClusterOutput(solid_union)
