# Grasshopper definition biome-parametric.gh (Grasshopper 1.0.7)
# Copyright: GNU General Public License 3.0
# plug-ins: BitmapPlus

# ----
# biomes
# terrain
# procedural noise
seed = Slider(4, range=0..100)
width = Slider(36, range=0..100)
height = Slider(36, range=0..100)
depth = Slider(39, range=0..500)
list = ValueList({"Euclidean": 0, "Manhattan": 1, "Natural": 2}, selected="Euclidean")
list_2 = ValueList({"Value": 0, "Distance2": 2, "Dist2Add": 3, "Dist2Sub": 4, "Dist2Mul": 5, "Dist2Div": 6}, selected="Dist2Div")
procedural_cellular = ProceduralCellular(
    Seed=seed,
    Width=width,
    Height=height,
    Depth=depth,
    BoundaryMode=list,
    InterpolationMode=list_2,
    Jitter=Slider(0.5, range=0..1),
    Frequency=Slider(0.09, range=0..1))
prev_image = PrevImage(SmartBitmap=procedural_cellular)
image = Data(procedural_cellular)

image_2 = Data(image)
# extract noise from image
bitmap_properties = BitmapProperties(Image=image_2)  # -> Boundary, Width, Height, HorizontalResolution, VerticalResolution, Format
deconstruct_bitmap = DeconstructBitmap(Image=image_2)
mesh_plane = MeshPlane(
    Boundary=bitmap_properties.Boundary,
    WidthCount=expr("x-1", bitmap_properties.Width),
    HeightCount=expr("x-1", bitmap_properties.Height))  # -> Mesh, Area
split_ahsv = SplitAHSV(Colour=deconstruct_bitmap)  # -> Alpha, Hue, Saturation, Value
deconstruct_mesh = DeconstructMesh(Mesh=mesh_plane.Mesh)  # -> Vertices, Faces, Colours, Normals
mesh_face = MeshFace(deconstruct_mesh.Faces)
boundary = Curve(bitmap_properties.Boundary)
point = Point(deconstruct_mesh.Vertices)
noise = Number(split_ahsv.Value)

# ----
# 3D mesh
point_2 = Point(point)
mesh_face_2 = MeshFace(mesh_face)
z_factor = Slider(6, range=0..10)
noise_2 = Number(noise)
multiplication = Multiplication(A=z_factor, B=noise_2)
unit_z = UnitZ(Factor=multiplication)
gradient = Gradient(
    LowerLimit=0,
    UpperLimit=1,
    Parameter=noise_2,
    stops=[0: RGB(55, 11, 65), 0.125: RGB(27, 30, 59), 0.25: RGB(22, 83, 76), 0.375: RGB(68, 119, 49), 0.5: RGB(161, 121, 74), 0.625: RGB(212, 132, 169), 0.75: RGB(198, 180, 238), 0.875: RGB(203, 232, 240), 1: RGB(255, 255, 255)])
move = Move(Geometry=point_2, Motion=unit_z)  # -> Geometry, Transform
construct_mesh = ConstructMesh(Vertices=move.Geometry, Faces=mesh_face_2, Colours=gradient)
mesh = Mesh(construct_mesh)

# ----
# ecosystem
# group by elevation
mesh_2 = Mesh(mesh)
count = Slider(2000, range=0..10000)
seed_2 = Slider(0, range=0..100)
zones = Slider(3, range=0..10)
step = Slider(0.5, range=0..10)
populate_geometry = PopulateGeometry(Geometry=mesh_2, Count=count, Seed=seed_2)
series = Series(Start=0, Step=step, Count=zones)
deconstruct = Deconstruct(Point=populate_geometry)  # -> XComponent, YComponent, ZComponent
expression = Expression(z=deconstruct.ZComponent, n=graft(series), i=step, Expression="if((z≥n) and (z<(n+i)), True, False)")
cull_pattern = CullPattern(List=populate_geometry, CullPattern=expression)
point_3 = Point(cull_pattern)

# ----
# cull by elevation
point_4 = Point(point_3)
step_2 = Slider(1, range=0..20)
zones_2 = Number(zones)
exponent = Slider(2, range=0..10)
# tree types
initial = Slider(6, range=0..100)
series_2 = Series(Start="1", Step=step_2, Count=zones_2)
expression_2 = Expression(x=series_2, r=exponent, a=initial, Expression="a*(1+x)^r")  # -> graft(Result)
random_reduce = RandomReduce(List=point_4, Reduction=expression_2, Seed=1)
point_5 = Point(random_reduce)

trunk_height = Slider(0.2, range=0..4)
trunk_radius = Slider(0.025, range=0..1)
tree_height = Slider(1.25, range=0..4)
divisions = Slider(3, range=0..10)
canopy_radius = Slider(0.5, range=0..4)
conical_tree = ConicalTree(trunk_height=trunk_height, relay=trunk_radius, A=tree_height, relay_2=divisions, relay_3=canopy_radius)  # -> pipe_2, result
canopy_a = Brep(conical_tree.result)
trunk_a = Brep(conical_tree.pipe_2)

trunk_height_2 = Slider(0.2, range=0..4)
trunk_radius_2 = Slider(0.025, range=0..1)
tree_height_2 = Slider(1, range=0..4)
divisions_2 = Slider(3, range=0..10)
canopy_radius_2 = Slider(0.32, range=0..4)
conical_tree_2 = ConicalTree(trunk_height=trunk_height_2, relay=trunk_radius_2, A=tree_height_2, relay_2=divisions_2, relay_3=canopy_radius_2)  # -> pipe_2, result
canopy_b = Brep(conical_tree_2.result)
trunk_b = Brep(conical_tree_2.pipe_2)

trunk_radius_3 = Slider(0.025, range=0..1)
tree_height_3 = Slider(0.75, range=0..4)
divisions_3 = Slider(3, range=0..10)
# distribute trees
canopy_radius_3 = Slider(0.25, range=0..4)
trunk_height_3 = Slider(0.2, range=0..4)
conical_tree_3 = ConicalTree(trunk_height=trunk_height_3, relay=trunk_radius_3, A=tree_height_3, relay_2=divisions_3, relay_3=canopy_radius_3)  # -> pipe_2, result
canopy_c = Brep(conical_tree_3.result)
trunk_c = Brep(conical_tree_3.pipe_2)

trunks = Brep(graft([trunk_a, trunk_b, trunk_c]))
canopy = Brep(graft([canopy_a, canopy_b, canopy_c]))

trunks_2 = Brep(trunks)
canopy_2 = Brep(canopy)
point_6 = Point(point_5)
vector_2pt = Vector2Pt(PointA="0,0,0", PointB=point_6, Unitize=False)  # -> Vector, Length
move_2 = Move(Geometry=trunks_2, Motion=vector_2pt.Vector)  # -> Geometry, Transform
move_3 = Move(Geometry=canopy_2, Motion=vector_2pt.Vector)  # -> Geometry, Transform
trunks_3 = Brep(move_2.Geometry)
canopy_3 = Brep(move_3.Geometry)

# ----
# color trees
trunks_4 = Brep(trunks_3)
trunk_color = ColourSwatch(SwatchColor=RGB(139, 76, 57))
canopy_4 = Brep(canopy_3)
canopy_color = ColourSwatch(SwatchColor=RGBA(58, 94, 58, 232))
canopy_color_2 = ColourSwatch(SwatchColor=RGBA(64, 128, 117, 232))
canopy_color_3 = ColourSwatch(SwatchColor=RGBA(123, 128, 64, 232))
colour = Colour(graft([canopy_color, canopy_color_2, canopy_color_3]))
custom_preview = CustomPreview(Geometry=trunks_4, Material=trunk_color)
custom_preview_2 = CustomPreview(Geometry=canopy_4, Material=colour)

# ==== cluster ConicalTree
trunk_height = ClusterInput()
relay = ClusterInput()
A = ClusterInput()
relay_2 = ClusterInput()
relay_3 = ClusterInput()
unit_z = UnitZ(Factor=trunk_height)
subtraction = Subtraction(A=A, B=trunk_height)
move = Move(Geometry="0,0,0", Motion=unit_z)  # -> Geometry, Transform
top_of_trunk = Point(move.Geometry)
unit_z_2 = UnitZ(Factor=subtraction)
division = Division(A=subtraction, B=relay_2)
move_2 = Move(Geometry=top_of_trunk, Motion=unit_z_2)  # -> Geometry, Transform
line = Line(StartPoint="0,0,0", EndPoint=move.Geometry)
line_2 = Line(StartPoint=top_of_trunk, EndPoint=move_2.Geometry)
pipe = Pipe(Curve=line, Radius=relay, Caps="1")
divide_curve = DivideCurve(Curve=line_2, Count=relay_2, Kinks=False)  # -> Points, Tangents, Parameters
pipe_2 = ClusterOutput(pipe)
split_list = SplitList(List=divide_curve.Points, Index=relay_2)  # -> ListA, ListB
range = Range(Domain="1 To 0.5", Steps=expr("x-1", relay_2))
cone = Cone(Base=split_list.ListA, Radius=relay_3, Length=division)  # -> Cone, Tip
multiplication = Multiplication(A=range, B="2")
scale_nu = ScaleNU(Geometry=cone.Cone, Plane=split_list.ListA, ScaleX=range, ScaleY=range, ScaleZ=multiplication)  # -> Geometry, Transform
cap_holes = CapHoles(Brep=scale_nu.Geometry)
solid_union = SolidUnion(Breps=cap_holes)
result = ClusterOutput(solid_union)
