# Grasshopper definition biome-particle-system.gh (Grasshopper 1.0.7)
# Copyright: GNU General Public License 3.0
# plug-ins: BitmapPlus, Kangaroo2 Components

# ----
# biomes
# terrain
# procedural noise
seed = Slider(4, range=0..100)
width = Slider(36, range=0..100)
height = Slider(36, range=0..100)
depth = Slider(39, range=0..500)
list = ValueList({"Euclidean": 0, "Manhattan": 1, "Natural": 2}, selected="Euclidean")
list_2 = ValueList({"Value": 0, "Distance2": 2, "Dist2Add": 3, "Dist2Sub": 4, "Dist2Mul": 5, "Dist2Div": 6}, selected="Dist2Div")
# extract noise from image
number_slider = Slider(0.09, range=0..1)
procedural_cellular = ProceduralCellular(
    Seed=seed,
    Width=width,
    Height=height,
    Depth=depth,
    BoundaryMode=list,
    InterpolationMode=list_2,
    Jitter=Slider(0.5, range=0..1),
    Frequency=number_slider)
prev_image = PrevImage(SmartBitmap=procedural_cellular)
image = Data(procedural_cellular)

image_2 = Data(image)
bitmap_properties = BitmapProperties(Image=image_2)  # -> Boundary, Width, Height, HorizontalResolution, VerticalResolution, Format
deconstruct_bitmap = DeconstructBitmap(Image=image_2)
mesh_plane = MeshPlane(
    Boundary=bitmap_properties.Boundary,
    WidthCount=expr("x-1", bitmap_properties.Width),
    HeightCount=expr("x-1", bitmap_properties.Height))  # -> Mesh, Area
split_ahsv = SplitAHSV(Colour=deconstruct_bitmap)  # -> Alpha, Hue, Saturation, Value
deconstruct_mesh = DeconstructMesh(Mesh=mesh_plane.Mesh)  # -> Vertices, Faces, Colours, Normals
mesh_face = MeshFace(deconstruct_mesh.Faces)
boundary = Curve(bitmap_properties.Boundary)
point = Point(deconstruct_mesh.Vertices)
noise = Number(split_ahsv.Value)

# ----
# 3D mesh
point_2 = Point(point)
mesh_face_2 = MeshFace(mesh_face)
z_factor = Slider(6, range=0..10)
# ecosystem
noise_2 = Number(noise)
multiplication = Multiplication(A=z_factor, B=noise_2)
unit_z = UnitZ(Factor=multiplication)
gradient = Gradient(
    LowerLimit=0,
    UpperLimit=1,
    Parameter=noise_2,
    stops=[0: RGB(55, 11, 65), 0.125: RGB(27, 30, 59), 0.25: RGB(22, 83, 76), 0.375: RGB(68, 119, 49), 0.5: RGB(161, 121, 74), 0.625: RGB(212, 132, 169), 0.75: RGB(198, 180, 238), 0.875: RGB(203, 232, 240), 1: RGB(255, 255, 255)])
move = Move(Geometry=point_2, Motion=unit_z)  # -> Geometry, Transform
construct_mesh = ConstructMesh(Vertices=move.Geometry, Faces=mesh_face_2, Colours=gradient)
mesh = Mesh(construct_mesh)

mesh_2 = Mesh(mesh)
# elevation gradient
number_slider_2 = Slider(36, range=0..100)
unit_z_2 = UnitZ(Factor=Slider(0.001, range=0..0.02))
unit_z_3 = UnitZ(Factor=Slider(0.01, range=0..0.02))
negative = Negative(Value=unit_z_2)
negative_2 = Negative(Value=unit_z_3)
domain_box = DomainBox(Base=PlaneXY(0, 0, 0), X=number_slider_2, Y=number_slider_2, Z="36 to 64")
populate_3d = Populate3D(Region=domain_box, Count=Slider(500, range=0..1000), Seed=Slider(0, range=0..100))
point_3 = Point(populate_3d)
point_4 = Point(point_3)
point_5 = Point(point_3)
spherecollide = SphereCollide(Points=point_5, Radius=Slider(0.5, range=0..3), Strength=Slider(10, range=0..10))
load = Load(Point=point_5, ForceVector=negative, Weighting=1)
load_2 = Load(Point=point_4, ForceVector=negative_2, Weighting=1)
spherecollide_2 = SphereCollide(Points=point_4, Radius=Slider(0.5, range=0..1), Strength=Slider(1, range=0..10))
onmesh = OnMesh(Points=point_4, Mesh=mesh_2, Strength=1)
merge = Merge(Data1=spherecollide_2, Data2=onmesh, Data3=load_2)
bouncysolver = BouncySolver(
    GoalObjects=merge,
    Reset=Toggle(False),
    Threshold=1e-15,
    Tolerance=0.0001,
    Damping=Slider(1, range=0..1),
    Iterations=10,
    On=True)  # -> I, V, O
stepsolver = StepSolver(
    GoalObjects=merge,
    Tolerance=0.0001,
    Momentum=True,
    Damping=Slider(0.9, range=0..1),
    SubIterations=Slider(500, range=0..500),
    Animate=Toggle(True))  # -> I, V, O
extrude = Slider(10, range=0..10)
negative_3 = Negative(Value=extrude)
unit_z_4 = UnitZ(Factor=negative_3)

# ----
# noise surface
point_6 = Point(point)
noise_3 = Number(noise)
width_2 = Number(bitmap_properties.Width)

unit_z_5 = UnitZ(Factor=expr("x*6", noise_3))

move_2 = Move(Geometry=point_6, Motion=unit_z_5)  # -> Geometry, Transform
surface_from_points = SurfaceFromPoints(Points=move_2.Geometry, UCount=width_2, Interpolate=Toggle(True))
surface = Surface(surface_from_points)

# ----
# extrude
surface_2 = Surface(surface_from_points)
extrude_2 = Extrude(Base=surface_2, Direction=unit_z_4)
brep = Brep(extrude_2)

# ----
# boolean difference
brep_2 = Brep(brep)
domain_box_2 = DomainBox(Base=PlaneXY(0, 0, 0), X="-10 To 50", Y="-10 To 50", Z="-11 To -1")
solid_difference = SolidDifference(BrepsA=brep_2, BrepsB=domain_box_2)
custom_preview = CustomPreview(Geometry=solid_difference, Material=ColourSwatch(SwatchColor=RGB(204, 204, 204)))
brep_3 = Brep(solid_difference)

brep_4 = Brep(brep_3)
solidpointcollide = SolidPointCollide(Points=point_5, Solid=brep_4, Interior=False, Unidirectional=True, Strength=1)
solver = Solver(
    GoalObjects=[spherecollide, solidpointcollide, load],
    Reset=Toggle(True),
    Threshold=1e-15,
    Tolerance=0.0001,
    On=Toggle(True))  # -> I, V, O
