# Grasshopper definition bubble-wall-1.gh (Grasshopper 1.0.7)

X = Slider(5, range=0..100)
Y = Slider(0.5, range=0..2)
Z = Slider(5, range=0..100)
count = Slider(50, range=0..1000)
seed = Slider(1, range=0..100)
count_2 = Number(count)
seed_2 = Number(seed)
domain_box = DomainBox(Base=PlaneXY(0, 0, 0), X=X, Y=Y, Z=Z)
random = Random(Range="0.25 To 1", Number=count_2, Seed=seed)
populate_3d = Populate3D(Region=domain_box, Count=count, Seed=seed)
sphere = Sphere(Base=populate_3d, Radius=random)
solid_union = SolidUnion(Breps=sphere)
brep = Brep(solid_union)

scale = Slider(0.6, range=0..1)
box = Box(domain_box)
area = Area(Geometry=box)  # -> Area, Centroid
scale_2 = Scale(Geometry=box, Center=area.Centroid, Factor=scale)  # -> Geometry, Transform
box_2 = Box(scale_2.Geometry)

box_3 = Box(box_2)
count_3 = Slider(8, range=0..250)
tolerance = Slider(1.4, range=0..3)
seed_3 = Number(seed)
y_shift = Slider(0.3, range=0..2)
unit_y = UnitY(Factor=y_shift)
populate_3d_2 = Populate3D(Region=box_3, Count=count_3, Seed=seed_3)
cull_duplicates = CullDuplicates(Points=populate_3d_2, Tolerance=tolerance, CullMode=1)  # -> Points, Indices, Valence
list_length = ListLength(List=cull_duplicates.Points)
seed_4 = Number(seed)
random_2 = Random(Range="0.75 To 1.25", Number=list_length, Seed=seed_4)
sphere_2 = Sphere(Base=cull_duplicates.Points, Radius=random_2)
move = Move(Geometry=sphere_2, Motion=unit_y)  # -> Geometry, Transform
brep_2 = Brep(move.Geometry)

brep_3 = Brep(brep_2)
xy_scale = Slider(0.8, range=0..1)
z_scale = Slider(1, range=0..2)
z_shift = Slider(0.4, range=0..10)
area_2 = Area(Geometry=brep_3)  # -> Area, Centroid
scale_nu = ScaleNU(Geometry=brep_3, Plane=area_2.Centroid, ScaleX=xy_scale, ScaleY=z_scale, ScaleZ=xy_scale)  # -> Geometry, Transform
unit_y_2 = UnitY(Factor=z_shift)
move_2 = Move(Geometry=scale_nu.Geometry, Motion=unit_y_2)  # -> Geometry, Transform
yz_plane = YZPlane(Origin=area_2.Centroid)
rotate = Rotate(Geometry=move_2.Geometry, Angle=degrees("32"), Plane=yz_plane)  # -> Geometry, Transform
solid_difference = SolidDifference(BrepsA=brep_3, BrepsB=rotate.Geometry)
brep_4 = Brep(solid_difference)

brep_5 = Brep(brep)
brep_6 = Brep(brep_2)
solid_difference_2 = SolidDifference(BrepsA=brep_5, BrepsB=brep_6)
brep_7 = Brep(solid_difference_2)

brep_8 = Brep(brep_7)
box_4 = Box(domain_box)
y_scale = Slider(3, range=0..10)
area_3 = Area(Geometry=box_4)  # -> Area, Centroid
scale_nu_2 = ScaleNU(Geometry=box_4, Plane=area_3.Centroid, ScaleX=1, ScaleY=y_scale, ScaleZ=1)  # -> Geometry, Transform
solid_intersection = SolidIntersection(BrepsA=brep_8, BrepsB=scale_nu_2.Geometry)
brep_9 = Brep(solid_intersection)

brep_10 = Brep(rotate.Geometry)
transform = Transform(rotate.Transform)
volume = Volume(Geometry=brep_10)  # -> Volume, Centroid
inverse_transform = InverseTransform(Transform=transform)
plane_surface = PlaneSurface(Plane=volume.Centroid, XSize=Domain(-10, 10), YSize=Domain(-10, 10))
transform_2 = Transform(Geometry=plane_surface, Transform=inverse_transform)
split_brep = SplitBrep(Brep=brep_10, Cutter=transform_2)
dispatch = Dispatch(List=split_brep, DispatchPattern=[True, False])  # -> ListA, flatten(ListB)
cap_holes = CapHoles(Brep=dispatch.ListB)
brep_11 = Brep(cap_holes)

mesh = Mesh(brep_9)
mesh_2 = Mesh(brep_4)
mesh_3 = Mesh(brep_11)
# - color gradient by size or y depth
# 
# - try noise instead of random 3D pop
# 
# - divide in hex grid
custom_preview = CustomPreview(Geometry=mesh, Material=ColourSwatch(SwatchColor=RGB(191, 191, 191)))
custom_preview_2 = CustomPreview(Geometry=mesh_2, Material=ColourSwatch(SwatchColor=RGB(76, 76, 76)))
custom_preview_3 = CustomPreview(Geometry=mesh_3, Material=ColourSwatch(SwatchColor=RGB(145, 125, 108)))
