# Grasshopper definition bubble-wall-2.gh (Grasshopper 1.0.7)

X = Slider(5, range=0..100)
Y = Slider(0.5, range=0..2)
Z = Slider(5, range=0..100)
count = Slider(50, range=0..1000)
seed = Slider(1, range=0..100)
count_2 = Number(count)
domain_box = DomainBox(Base=PlaneXY(0, 0, 0), X=X, Y=Y, Z=Z)
random = Random(Range="0.25 To 1", Number=count_2, Seed=seed)
populate_3d = Populate3D(Region=domain_box, Count=count, Seed=seed)
sphere = Sphere(Base=populate_3d, Radius=random)
brep = Brep(sphere)

brep_2 = Brep(brep)
tolerance = Slider(0.5, range=0..2)
volume = Volume(Geometry=brep_2)  # -> Volume, Centroid
cull_duplicates = CullDuplicates(Points=volume.Centroid, Tolerance=tolerance, CullMode=1)  # -> Points, Indices, Valence
list_item = ListItem(List=brep_2, Index=cull_duplicates.Indices, Wrap=True)
brep_3 = Brep(list_item)

brep_4 = Brep(brep_3)
threshold = Slider(1.5, range=0..5)
factor = Slider(0.8, range=0..1)
volume_2 = Volume(Geometry=brep_4)  # -> Volume, Centroid
larger_than = LargerThan(FirstNumber=volume_2.Volume, SecondNumber=threshold)  # -> LargerThan, OrEqualTo
cull_pattern = CullPattern(List=brep_4, CullPattern=larger_than.OrEqualTo)
volume_3 = Volume(Geometry=cull_pattern)  # -> Volume, Centroid
scale = Scale(Geometry=cull_pattern, Center=volume_3.Centroid, Factor=factor)  # -> Geometry, Transform
brep_5 = Brep(scale.Geometry)

brep_6 = Brep(brep)
box = Box(domain_box)
y_scale = Slider(3, range=0..10)
brep_7 = Brep(brep_5)
area = Area(Geometry=box)  # -> Area, Centroid
scale_nu = ScaleNU(Geometry=box, Plane=area.Centroid, ScaleX=1, ScaleY=y_scale, ScaleZ=1)  # -> Geometry, Transform
solid_union = SolidUnion(Breps=brep_6)
solid_intersection = SolidIntersection(BrepsA=solid_union, BrepsB=scale_nu.Geometry)
solid_union_2 = SolidUnion(Breps=brep_7)
solid_difference = SolidDifference(BrepsA=solid_intersection, BrepsB=solid_union_2)
brep_8 = Brep(solid_difference)

brep_9 = Brep(brep_5)
volume_4 = Volume(Geometry=brep_9)  # -> Volume, Centroid
plane_surface = PlaneSurface(Plane=volume_4.Centroid, XSize=Domain(-10, 10), YSize=Domain(-10, 10))
split_brep = SplitBrep(Brep=brep_9, Cutter=plane_surface)
dispatch = Dispatch(List=split_brep, DispatchPattern=[True, False])  # -> ListA, flatten(ListB)
cap_holes = CapHoles(Brep=dispatch.ListB)
brep_10 = Brep(cap_holes)

brep_11 = Brep(brep_10)
degrees = Slider(-40, range=-100..100)
centroid = Point(volume_4.Centroid)
yz_plane = YZPlane(Origin=centroid)
rotate = Rotate(Geometry=brep_11, Angle=degrees(degrees), Plane=yz_plane)  # -> Geometry, Transform
brep_12 = Brep(rotate.Geometry)

brep_13 = Brep(brep_12)
box_2 = Box(domain_box)
y_scale_2 = Slider(3, range=0..10)
area_2 = Area(Geometry=box_2)  # -> Area, Centroid
scale_nu_2 = ScaleNU(Geometry=box_2, Plane=area_2.Centroid, ScaleX=1, ScaleY=y_scale_2, ScaleZ=1)  # -> Geometry, Transform
solid_union_3 = SolidUnion(Breps=brep_13)
solid_intersection_2 = SolidIntersection(BrepsA=solid_union_3, BrepsB=scale_nu_2.Geometry)
brep_14 = Brep(solid_intersection_2)

mesh = Mesh(brep_8)
custom_preview = CustomPreview(Geometry=mesh, Material=ColourSwatch(SwatchColor=RGB(178, 178, 178)))

mesh_2 = Mesh(brep_14)
custom_preview_2 = CustomPreview(Geometry=mesh_2, Material=ColourSwatch(SwatchColor=RGB(145, 125, 108)))
