# Grasshopper definition cellular-attractor-wall.gh (Grasshopper 1.0.7)
# Copyright: GNU General Public License 3.0

# ----
# cellular wall
# wave
t = Slider(4, range=0..10)
a = Slider(3, range=0..10)
b = Slider(1, range=0..10)
start = Slider(0.1, range=0..1)
step = Slider(0.1, range=0..1)
# region
count = Slider(1, range=0..100)
pi = Pi(Factor=t)
series = Series(Start=start, Step=step, Count=count)  # -> graft(Series)
range = Range(Domain=pi, Steps="400")
expression = Expression(x=range, a=a, b=b, f=series, Expression="a*sin(b*x)*e^(-f*x)")
construct_point = ConstructPoint(XCoordinate=0, YCoordinate=expression, ZCoordinate=range)
interpolate = Interpolate(Vertices=construct_point, Degree=3, Periodic=False, KnotStyle=1)  # -> flatten(Curve), Length, Domain
curve = Curve(interpolate.Curve)

Y = Slider(250, range=0..1000)
Z = Slider(500, range=0..1000)
yz_plane = YZPlane(Origin=Point(0, 0, 0))
rectangle = Rectangle(Plane=yz_plane, XSize=Y, YSize=Z, Radius=0)  # -> Rectangle, Length
rectangle_2 = Rectangle(rectangle.Rectangle)

# ----
# outer frame
rectangle_3 = Rectangle(rectangle.Rectangle)
Y_2 = Slider(1.1, range=0..10)
Z_2 = Slider(1.15, range=0..10)
z_shift = Slider(15, range=0..100)
X = Slider(20, range=0..100)
area = Area(Geometry=rectangle_3)  # -> Area, Centroid
scale_nu = ScaleNU(Geometry=rectangle_3, Plane=area.Centroid, ScaleX=1, ScaleY=Y_2, ScaleZ=Z_2)  # -> Geometry, Transform
unit_z = UnitZ(Factor=z_shift)
unit_x = UnitX(Factor=X)
move = Move(Geometry=scale_nu.Geometry, Motion=unit_z)  # -> Geometry, Transform
extrude = Extrude(Base=move.Geometry, Direction=unit_x)
cap_holes = CapHoles(Brep=extrude)
brep = Brep(cap_holes)

# ----
# transformation
curve_2 = Curve(curve)
scale = Slider(40, range=0..1000)
Y_3 = Number(Y)
division = Division(A=Y_3, B="2")
scale_2 = Scale(Geometry=curve_2, Center=Point(0, 0, 0), Factor=scale)  # -> Geometry, Transform
unit_y = UnitY(Factor=division)
move_2 = Move(Geometry=scale_2.Geometry, Motion=unit_y)  # -> Geometry, Transform
curve_3 = Curve(move_2.Geometry)

# ----
# voronoi diagram
rectangle_4 = Rectangle(rectangle_2)
count_2 = Slider(150, range=0..1000)
seed = Slider(0, range=0..1000)
curve_4 = Curve(curve_3)
amplitude = Slider(15, range=0..100)
panel = Panel("30 To 0")
populate_2d = Populate2D(Region=rectangle_4, Count=count_2, Seed=seed)
pull_point = PullPoint(Point=populate_2d, Geometry=curve_4, ClosestOnly=True)  # -> ClosestPoint, Distance
bounds = Bounds(Numbers=pull_point.Distance)
remap_numbers = RemapNumbers(Value=pull_point.Distance, Source=bounds, Target=amplitude)  # -> Mapped, Clipped
vector_2pt = Vector2Pt(PointA=populate_2d, PointB=pull_point.ClosestPoint, Unitize=True)  # -> Vector, Length
amplitude_2 = Amplitude(Vector=vector_2pt.Vector, Amplitude=remap_numbers.Mapped)
move_3 = Move(Geometry=populate_2d, Motion=amplitude_2)  # -> Geometry, Transform
rectangle_5 = Rectangle(rectangle_2)
voronoi = Voronoi(Points=move_3.Geometry, Boundary=rectangle_5, BruteForceOverride=False)
curve_5 = Curve(voronoi)

# ----
# face
curve_6 = Curve(curve_5)
# base
scale_3 = Slider(0.8, range=0..1)
area_2 = Area(Geometry=curve_6)  # -> Area, Centroid
scale_4 = Scale(Geometry=curve_6, Center=area_2.Centroid, Factor=scale_3)  # -> Geometry, Transform
boundary_surfaces = BoundarySurfaces(Edges=[curve_6, scale_4.Geometry])
brep_2 = Brep(boundary_surfaces)

curve_7 = Curve(scale_4.Geometry)
thickness = Slider(2, range=0..10)
unit_y_2 = UnitY(Factor=thickness)
boundary_surfaces_2 = BoundarySurfaces(Edges=curve_7)
extrude_2 = Extrude(Base=boundary_surfaces_2, Direction=unit_y_2)
custom_preview = CustomPreview(Geometry=extrude_2, Material=ColourSwatch(SwatchColor=RGB(204, 204, 204)))
brep_3 = Brep(extrude_2)

# ----
# extrusion
brep_4 = Brep(brep_2)
# random colors
depth = Slider(-45, range=-90..90)
area_3 = Area(Geometry=brep_4)  # -> Area, Centroid
bounds_2 = Bounds(Numbers=area_3.Area)
remap_numbers_2 = RemapNumbers(Value=area_3.Area, Source=bounds_2, Target="20 To 50")  # -> Mapped, Clipped
unit_x_2 = UnitX(Factor=remap_numbers_2.Mapped)
unit_y_3 = UnitY(Factor=1)
rotate = Rotate(Vector=unit_x_2, Axis=unit_y_3, Angle=degrees(depth))
extrude_3 = Extrude(Base=brep_4, Direction=rotate)
brep_5 = Brep(extrude_3)

brep_6 = Brep(brep_5)
area_4 = Number(area_3.Area)
bounds_3 = Bounds(Numbers=area_4)
remap_numbers_3 = RemapNumbers(Value=area_4, Source=bounds_3, Target=Domain(0, 1))  # -> Mapped, Clipped
gradient = Gradient(LowerLimit=0, UpperLimit=1, Parameter=remap_numbers_3.Mapped, stops=[0: RGB(224, 224, 224), 1: RGB(64, 64, 64)])
custom_preview_2 = CustomPreview(Geometry=brep_6, Material=gradient)

# ----
# inner frame
rectangle_6 = Rectangle(rectangle.Rectangle)
amplitude_3 = Slider(50, range=0..100)
unit_x_3 = UnitX(Factor=amplitude_3)
unit_y_4 = UnitY(Factor=1)
angle = Number(depth)
rotate_2 = Rotate(Vector=unit_x_3, Axis=unit_y_4, Angle=degrees(angle))
extrude_4 = Extrude(Base=rectangle_6, Direction=rotate_2)
cap_holes_2 = CapHoles(Brep=extrude_4)
brep_7 = Brep(cap_holes_2)

# ----
# difference
brep_8 = Brep(brep)
brep_9 = Brep(brep_7)
solid_difference = SolidDifference(BrepsA=brep_8, BrepsB=brep_9)
custom_preview_3 = CustomPreview(Geometry=solid_difference, Material=ColourSwatch(SwatchColor=RGB(204, 204, 204)))

# ----
# area
curve_8 = Curve(curve_5)
area_5 = Area(Geometry=curve_8)  # -> Area, Centroid
average = Average(Input=area_5.Area)
bounds_4 = Bounds(Numbers=area_5.Area)
panel_2 = Panel(average)
panel_3 = Panel(bounds_4)
