# Grasshopper definition cellular-rockery.gh (Grasshopper 1.0.7)
# Copyright: GNU General Public License 3.0

# ----
# cellular rockery
# voronoi diagram
count = Slider(100, range=0..1000)
seed = Slider(0, range=0..1000)
X = Slider(100, range=0..1000)
# extrusion
Y = Slider(100, range=0..1000)
rectangle = Rectangle(Plane=PlaneXY(0, 0, 0), XSize=X, YSize=Y, Radius=0)  # -> Rectangle, Length
populate_2d = Populate2D(Region=rectangle.Rectangle, Count=count, Seed=seed)
voronoi = Voronoi(Points=populate_2d, Boundary=rectangle.Rectangle, BruteForceOverride=False)
curve = Curve(voronoi)

curve_2 = Curve(curve)
count_2 = Number(count)
# random colors
seed_2 = Slider(0, range=0..100)
random = Random(Range="2 To 10", Number=count_2, Seed=seed_2)
unit_z = UnitZ(Factor=random)
boundary_surfaces = BoundarySurfaces(Edges=curve_2)
extrude = Extrude(Base=boundary_surfaces, Direction=unit_z)
brep = Brep(extrude)

count_3 = Number(count)
seed_3 = Number(seed_2)

brep_2 = Brep(brep)
random_2 = Random(Range=Domain(0, 1), Number=count_3, Seed=seed_3, Integers=False)
gradient = Gradient(LowerLimit=0, UpperLimit=1, Parameter=random_2, stops=[0: RGB(224, 224, 224), 1: RGB(64, 64, 64)])
custom_preview = CustomPreview(Geometry=brep_2, Material=gradient)
