# Grasshopper definition cellular-wall.gh (Grasshopper 1.0.7)
# Copyright: GNU General Public License 3.0

Y = Slider(250, range=0..1000)

# ----
# cellular wall
# voronoi diagram
count = Slider(150, range=0..1000)
seed = Slider(0, range=0..1000)
yz_plane = YZPlane(Origin=Point(0, 0, 0))
# face
Z = Slider(500, range=0..1000)
rectangle = Rectangle(Plane=yz_plane, XSize=Y, YSize=Z, Radius=0)  # -> Rectangle, Length
populate_2d = Populate2D(Region=rectangle.Rectangle, Count=count, Seed=seed)
voronoi = Voronoi(Points=populate_2d, Boundary=rectangle.Rectangle, BruteForceOverride=False)
curve = Curve(voronoi)

curve_2 = Curve(curve)
# base
scale = Slider(0.8, range=0..1)
area = Area(Geometry=curve_2)  # -> Area, Centroid
scale_2 = Scale(Geometry=curve_2, Center=area.Centroid, Factor=scale)  # -> Geometry, Transform
boundary_surfaces = BoundarySurfaces(Edges=[curve_2, scale_2.Geometry])
brep = Brep(boundary_surfaces)

curve_3 = Curve(scale_2.Geometry)
thickness = Slider(2, range=0..10)
unit_y = UnitY(Factor=thickness)
boundary_surfaces_2 = BoundarySurfaces(Edges=curve_3)
extrude = Extrude(Base=boundary_surfaces_2, Direction=unit_y)
custom_preview = CustomPreview(Geometry=extrude, Material=ColourSwatch(SwatchColor=RGB(204, 204, 204)))
brep_2 = Brep(extrude)

# ----
# extrusion
brep_3 = Brep(brep)
# random colors
angle = Slider(-45, range=-90..90)
area_2 = Area(Geometry=brep_3)  # -> Area, Centroid
bounds = Bounds(Numbers=area_2.Area)
remap_numbers = RemapNumbers(Value=area_2.Area, Source=bounds, Target="20 To 50")  # -> Mapped, Clipped
unit_x = UnitX(Factor=remap_numbers.Mapped)
unit_y_2 = UnitY(Factor=1)
rotate = Rotate(Vector=unit_x, Axis=unit_y_2, Angle=degrees(angle))
extrude_2 = Extrude(Base=brep_3, Direction=rotate)
brep_4 = Brep(extrude_2)

brep_5 = Brep(brep_4)
area_3 = Number(area_2.Area)
bounds_2 = Bounds(Numbers=area_3)
remap_numbers_2 = RemapNumbers(Value=area_3, Source=bounds_2, Target=Domain(0, 1))  # -> Mapped, Clipped
gradient = Gradient(LowerLimit=0, UpperLimit=1, Parameter=remap_numbers_2.Mapped, stops=[0: RGB(224, 224, 224), 1: RGB(64, 64, 64)])
custom_preview_2 = CustomPreview(Geometry=brep_5, Material=gradient)

# ----
# inner frame
rectangle_2 = Rectangle(rectangle.Rectangle)
amplitude = Slider(50, range=0..100)
unit_x_2 = UnitX(Factor=amplitude)
unit_y_3 = UnitY(Factor=1)
angle_2 = Number(angle)
rotate_2 = Rotate(Vector=unit_x_2, Axis=unit_y_3, Angle=degrees(angle_2))
extrude_3 = Extrude(Base=rectangle_2, Direction=rotate_2)
cap_holes = CapHoles(Brep=extrude_3)
brep_6 = Brep(cap_holes)

# ----
# outer frame
rectangle_3 = Rectangle(rectangle.Rectangle)
Y_2 = Slider(1.1, range=0..10)
Z_2 = Slider(1.15, range=0..10)
z_shift = Slider(15, range=0..100)
X = Slider(20, range=0..100)
area_4 = Area(Geometry=rectangle_3)  # -> Area, Centroid
scale_nu = ScaleNU(Geometry=rectangle_3, Plane=area_4.Centroid, ScaleX=1, ScaleY=Y_2, ScaleZ=Z_2)  # -> Geometry, Transform
unit_z = UnitZ(Factor=z_shift)
unit_x_3 = UnitX(Factor=X)
move = Move(Geometry=scale_nu.Geometry, Motion=unit_z)  # -> Geometry, Transform
extrude_4 = Extrude(Base=move.Geometry, Direction=unit_x_3)
cap_holes_2 = CapHoles(Brep=extrude_4)
brep_7 = Brep(cap_holes_2)

# ----
# difference
brep_8 = Brep(brep_7)
brep_9 = Brep(brep_6)
solid_difference = SolidDifference(BrepsA=brep_8, BrepsB=brep_9)
custom_preview_3 = CustomPreview(Geometry=solid_difference, Material=ColourSwatch(SwatchColor=RGB(204, 204, 204)))
