# Grasshopper definition color-plus.gh (Grasshopper 1.0.7)
# Copyright: GNU General Public License 3.0
# plug-ins: ColorPlus

# ----
# color palettes
# with color+ plugin
# using color+
collections = ValueList({"Known": 0, "System": 1, "Windows": 2, "Win8": 3, "Metro": 4, "Flat": 5, "Fluent": 6, "RAL": 7, "*Material": 8, "*Tailwind": 9, "*D3 Categorical": 10, "*D3 Seq. Single": 11, "*D3 Seq. Multiple": 12, "*D3 Seq. Spectrum": 13, "*D3 Diverging": 14, "*D3 Cyclical": 15}, selected="*D3 Seq. Spectrum")
sub_collection = ValueList({"1", "2", "3", "4", "5", "6", "7", "8", "9", "10", "11", "12"}, selected="1")
color_palettes = ColorPalettes(Collection=collections, SubCollection=sub_collection)  # -> Names, Colors
preview_colors = PreviewColors(Colors=color_palettes.Colors, Height=26, Label=True, Width=100)
