# Grasshopper definition curving-pathways.gh (Grasshopper 1.0.7)
# plug-ins: Parakeet

# sine curve
number_slider = Slider(2, range=0..10)
# curving pathway
number_slider_2 = Slider(25, range=0..100)
U = Slider(100, range=0..100)
V = Slider(6, range=0..100)

# ---- group: sine wave
# curve functions
number_slider_3 = Slider(1, range=0..2)
pi = Pi(Factor=Slider(2, range=0..12))
dom = ConstructDomain(DomainStart=0, DomainEnd=pi)
range = Range(Domain=dom, Steps=Slider(22, range=0..360))
multiplication = Multiplication(A=number_slider_3, B=range)
sin = Sine(Value=multiplication)
pt = ConstructPoint(XCoordinate=multiplication, YCoordinate=sin, ZCoordinate=0)
intcrv = Interpolate(Vertices=pt, Degree=3, Periodic=False, KnotStyle=1)  # -> Curve, Length, Domain
scale = Scale(Geometry=intcrv.Curve, Center=Point(0, 0, 0), Factor=1000)  # -> Geometry, Transform

# ---- group: sine wave with variable amplitude
pi_2 = Pi(Factor=Slider(2, range=0..12))
dom_2 = ConstructDomain(DomainStart=0, DomainEnd=pi_2)
range_2 = Range(Domain=dom_2, Steps=Slider(22, range=0..360))
expression = Expression(w=Slider(2, range=0..2), t=range_2, Expression="sin(w*t)")
pt_2 = ConstructPoint(XCoordinate=range_2, YCoordinate=expression, ZCoordinate=0)
intcrv_2 = Interpolate(Vertices=pt_2, Degree=3, Periodic=False, KnotStyle=1)  # -> Curve, Length, Domain
scale_2 = Scale(Geometry=intcrv_2.Curve, Center=Point(0, 0, 0), Factor=1000)  # -> Geometry, Transform

# ---- group: sine waves with variable amplitudes
pi_3 = Pi(Factor=Slider(2, range=0..12))
dom_3 = ConstructDomain(DomainStart=0, DomainEnd=pi_3)
range_3 = Range(Domain=dom_3, Steps=Slider(360, range=0..360))
expression_2 = Expression(w=graft([Slider(2, range=0..2), Slider(1, range=0..2), Slider(0.5, range=0..2)]), t=range_3, Expression="sin(w*t)")
pt_3 = ConstructPoint(XCoordinate=range_3, YCoordinate=expression_2, ZCoordinate=0)
intcrv_3 = Interpolate(Vertices=pt_3, Degree=3, Periodic=False, KnotStyle=1)  # -> Curve, Length, Domain
scale_3 = Scale(Geometry=intcrv_3.Curve, Center=Point(0, 0, 0), Factor=1000)  # -> Geometry, Transform

# ----
# venation
number_slider_4 = Slider(20, range=0..100)
distance = Slider(4, range=0..10)
# curving pathway
distance_2 = Slider(2, range=0..10)

size = Slider(2, range=0..10)
number_slider_5 = Slider(50, range=0..1000)
negative = Negative(Value=number_slider_5)
unit_y = UnitY(Factor=negative)
hexagonal = Hexagonal(Plane=unit_y, Size=size, ExtentX=Slider(60, range=0..1000), ExtentY=number_slider_5)  # -> Cells, Points

# ----
# interpolate pavers
point = Point(Point(0, 0, 0))
point_2 = Point(Point(298.014402, 0, 0))
point_3 = Point(Point(134.5791977, 60.11251803, 0))
steps = Slider(10, range=0..10)
relay = Relay([point, point_3, point_2])
range_4 = Range(Domain=Domain(0, 1), Steps=steps)
interpolate_data = InterpolateData(Data=relay, Parameter=range_4, Interpolation=4)

U_2 = Slider(100, range=0..100)
V_2 = Slider(5, range=0..100)
pi_4 = Pi(Factor=number_slider)
populate_2d = Populate2D(Region={Plane=PlaneXY(0, 0, 0), Size=Domain2(u=0..20, v=0..10)}, Count=number_slider_4, Seed=1)
series = Series(Start=0, Step=distance, Count=Slider(6, range=0..20))
range_5 = Range(Domain=pi_4, Steps=Slider(10, range=0..10))
sine = Sine(Value=range_5)
cull_pattern = CullPattern(List=populate_2d, CullPattern=[False, False, False, False, False, True])
panel = Panel("2")
construct_point = ConstructPoint(XCoordinate=range_5, YCoordinate=sine, ZCoordinate=0)
venation = Venation(
    VenationPoints=populate_2d,
    RootIndeces=cull_pattern,
    BranchCount=3,
    CutOffDistance=Slider(5, range=0..10),
    Iterations=120)
interpolate = Interpolate(Vertices=construct_point, Degree=3, Periodic=False, KnotStyle=1)  # -> Curve, Length, Domain
scale_4 = Scale(Geometry=interpolate.Curve, Center=Point(0, 0, 0), Factor=number_slider_2)  # -> Geometry, Transform
panel_2 = Panel("""True
False""")
curve = Curve(scale_4.Geometry)

curve_2 = Curve(curve)
offset = Slider(10, range=0..10)
offset_curve = OffsetCurve(Curve=curve_2, Distance=offset, Plane=PlaneXY(0, 0, 0), Corners=1)

# ----
# parakeet
curve_3 = Curve(curve)

# ----
# curving pathway
curve_4 = Curve(curve)
offset_2 = Slider(10, range=0..10)
offset_curve_2 = OffsetCurve(Curve=curve_4, Distance=offset_2, Plane=PlaneXY(0, 0, 0), Corners=1)

ruled_surface = RuledSurface(CurveA=curve_2, CurveB=offset_curve)
offset_curve_3 = OffsetCurve(Curve=curve_3, Distance=series, Plane=PlaneXY(0, 0, 0), Corners=1)
ruled_surface_2 = RuledSurface(CurveA=curve_4, CurveB=offset_curve_2)
divide_domain² = DivideDomain²(Domain=ruled_surface, UCount=U, VCount=V)
divide_distance = DivideDistance(Curve=offset_curve_3, Distance=distance_2)  # -> Points, Tangents, Parameters
isotrim = Isotrim(Surface=ruled_surface, Domain=divide_domain²)
explode_tree = ExplodeTree(Data=divide_distance.Points)  # -> _0000, _0010
surface_curve = SurfaceCurve(Surface=ruled_surface_2, Curve=hexagonal.Cells)  # -> Curves, Points, UVPoints, Normals, Parameters, Tangents
brep_wireframe = BrepWireframe(Brep=ruled_surface_2, Density=-1)
partition_list = PartitionList(List=explode_tree._0000, Size=Slider(2, range=0..10))
partition_list_2 = PartitionList(List=explode_tree._0010, Size=Slider(2, range=0..10))
dispatch = Dispatch(List=explode_tree._0000, DispatchPattern=panel_2)  # -> ListA, ListB
dispatch_2 = Dispatch(List=explode_tree._0010, DispatchPattern=invert(panel_2))  # -> ListA, ListB
closed = Closed(Curve=surface_curve.Curves)  # -> Closed, Periodic
weave = Weave(Pattern=[0, 1], Stream0=partition_list, Stream1=partition_list_2, NullGaps=False)
dispatch_3 = Dispatch(List=surface_curve.Curves, DispatchPattern=closed.Closed)  # -> ListA, ListB
weave_2 = Weave(Pattern=[0, 1], Stream0=dispatch.ListA, Stream1=dispatch_2.ListA, NullGaps=False)

# ---- group: array along sine wave
# arrays
number_slider_6 = Slider(50, range=0..100)
geo = Geometry()
curve_array = CurveArray(Geometry=geo, Curve=scale.Geometry, Count=number_slider_6)  # -> Geometry, Transform
divide = DivideCurve(Curve=scale.Geometry, Count=expr("x-1", number_slider_6), Kinks=False)  # -> Points, Tangents, Parameters
scale_5 = Scale(Geometry=curve_array.Geometry, Center=divide.Points, Factor=Slider(8, range=0..100))  # -> Geometry, Transform

# ---- group: array along sine wave and randomly scale
number_slider_7 = Slider(50, range=0..100)
geo_2 = Geometry()
dom_4 = ConstructDomain(DomainStart=Slider(10, range=0..100), DomainEnd=Slider(15, range=0..100))
random = Random(Range=dom_4, Number=number_slider_7, Seed=2)
divide_curve = DivideCurve(Curve=scale_2.Geometry, Count=expr("x-1", number_slider_7), Kinks=False)  # -> Points, Tangents, Parameters
curve_array_2 = CurveArray(Geometry=geo_2, Curve=scale_2.Geometry, Count=number_slider_7)  # -> Geometry, Transform
scale_6 = Scale(Geometry=curve_array_2.Geometry, Center=divide_curve.Points, Factor=random)  # -> Geometry, Transform

# ----
panel_3 = Panel("""True
True
False""")
dispatch_4 = Dispatch(List=weave, DispatchPattern=panel_3)  # -> ListA, ListB
polyline = PolyLine(Vertices=weave_2, Closed=False)
curve_5 = Curve(dispatch_3.ListA)
curve_6 = Curve(dispatch_3.ListB)
polyline_2 = PolyLine(Vertices=[dispatch_4.ListA, dispatch_4.ListB], Closed=Toggle(True))
end_points = EndPoints(Curve=curve_6)  # -> Start, End
line = Line(StartPoint=end_points.Start, EndPoint=end_points.End)
