# Grasshopper definition distance-field-display.gh (Grasshopper 1.0.7)
# Copyright: GNU General Public License 3.0
# plug-ins: Docofossor

# ----
# datum
size = Slider(1, range=0..10)
extent = Slider(100, range=0..500)
square = Square(Plane=PlaneXY(0, 0, 0), Size=size, ExtentX=extent, ExtentY=extent)  # -> Cells, flatten(Points)
import_points = ImportPoints(Pts=square.Points)
grid_mesh = GridMesh(Df=import_points)
data = Data(import_points)
custom_preview = CustomPreview(Geometry=grid_mesh, Material=ColourSwatch(SwatchColor=RGB(26, 26, 26)))

# ---- group: set points
# distance field
# with docofossor
# geometry
point = Point([Point(0, 0, 1.143266074), Point(1, 0, 1.748809221), Point(2, 0, 2.351021428), Point(3, 0, 2.94952491), Point(4, 0, 3.543885421), Point(5, 0, 4.133601961)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])

# ----
point_2 = Point(point)
# terrain
import_points_2 = ImportPoints(Pts=point_2)
grid_mesh_2 = GridMesh(Df=import_points_2)
split_list = SplitList(List=import_points_2, Index="10")  # -> ListA, ListB
custom_preview_2 = CustomPreview(Geometry=grid_mesh_2, Material=ColourSwatch(SwatchColor=RGB(217, 217, 217)))
elevation = Data(split_list.ListB)
header = Data(split_list.ListA)

point_3 = Point(point)
size_2 = Slider(0.5, range=0..1)
cloud_display = CloudDisplay(Points=point_3, Colours=ColourSwatch(SwatchColor=RGB(0, 0, 0)), Size=size_2, SpriteType=0)

header_2 = Panel(split_list.ListA)
elevation_2 = Panel(elevation)
