# Grasshopper definition ecological-attractor.gh (Grasshopper 1.0.7)
# plug-ins: Pufferfish, NudiBranch, atträctor

# ---- group: conical tree
# diameter at breast height (DBH)
trunk_color = ColourSwatch(SwatchColor=RGB(139, 76, 57))
canopy_color = ColourSwatch(SwatchColor=RGBA(58, 94, 58, 232))
trunk_height = Slider(8, range=0..100)
crown_height = Slider(30, range=0..75)
canopy_layers = Slider(3, range=0..10)
canopy_diameter = Slider(10, range=0..100)
# parametric trees
trunk_diameter = Slider(0.75, range=0..2)
construct_point = ConstructPoint(XCoordinate=0, YCoordinate=0, ZCoordinate=0)
unit_z = UnitZ(Factor=trunk_height)
unit_z_2 = UnitZ(Factor=crown_height)
division = Division(A=trunk_diameter, B="2.0")
division_2 = Division(A=canopy_diameter, B="2.0")
move = Move(Geometry=construct_point, Motion=unit_z_2)  # -> Geometry, Transform
move_2 = Move(Geometry=construct_point, Motion=unit_z)  # -> Geometry, Transform
division_3 = Division(A=unit_z_2, B=canopy_layers)
line = Line(StartPoint=construct_point, EndPoint=move_2.Geometry)
line_2 = Line(StartPoint=move_2.Geometry, EndPoint=move.Geometry)
divide_distance = DivideDistance(Curve=line_2, Distance=division_3)  # -> Points, Tangents, Parameters
construct_plane = ConstructPlane(Origin=divide_distance.Points, XAxis=Vector(1, 0, 0), YAxis=Vector(0, 1, 0))
construct_domain = ConstructDomain(DomainStart="0.5", DomainEnd="1.75")
cone = Cone(Base=construct_plane, Radius=division_2, Length=division_3)  # -> Cone, Tip
list_length = ListLength(List=construct_plane)
range = Range(Domain=construct_domain, Steps=list_length)  # -> reverse(Range)
scale = Scale(Geometry=cone.Cone, Center=construct_plane, Factor=range)  # -> Geometry, Transform
pipe = Pipe(Curve=line, Radius=division, Caps=0)
cap_holes = CapHoles(Brep=scale.Geometry)
group = Group(Objects=[cap_holes, pipe])
custom_preview = CustomPreview(Geometry=pipe, Material=trunk_color)
custom_preview_2 = CustomPreview(Geometry=cap_holes, Material=canopy_color)

# ---- group: circular region
division_4 = Division(A=Slider(360, range=0..1000), B="2")
pt = ConstructPoint(XCoordinate=division_4, YCoordinate=division_4, ZCoordinate=0)
cir = Circle(Plane=pt, Radius=division_4)
boundary = BoundarySurfaces(Edges=cir)
popgeo = PopulateGeometry(Geometry=boundary, Count=Slider(100, range=0..1000), Seed=1)

# ---- group: populate region
# populate region
number_slider = Slider(100, range=0..1000)
number_slider_2 = Slider(360, range=0..1000)
planesrf = PlaneSurface(Plane=PlaneXY(0, 0, 0), XSize=number_slider_2, YSize=number_slider_2)
populate_2d = Populate2D(Region=planesrf, Count=number_slider, Seed=1)

# ---- group: sine waves
# model terrain
number_slider_3 = Slider(0.25, range=0..2)
pi = Pi(Factor=Slider(6, range=0..12))
dom = ConstructDomain(DomainStart=0, DomainEnd=pi)
dom_2 = ConstructDomain(DomainStart=0, DomainEnd=Slider(20, range=0..360))
range_2 = Range(Domain=dom, Steps=Slider(36, range=0..360))
range_3 = Range(Domain=dom_2, Steps=Slider(3, range=0..6))
expression = Expression(
    x=graft([Slider(1.5, range=0..6), Slider(0.75, range=0..2), Slider(0.5, range=0..2), number_slider_3]),
    y=range_2,
    Expression="sin(x*y)")
pt_2 = ConstructPoint(XCoordinate=0, YCoordinate=range_2, ZCoordinate=expression)
X = UnitX(Factor=range_3)
intcrv = Interpolate(Vertices=pt_2, Degree=3, Periodic=False, KnotStyle=1)  # -> Curve, Length, Domain
move_3 = Move(Geometry=intcrv.Curve, Motion=graft(X))  # -> Geometry, Transform
scale_2 = Scale(Geometry=move_3.Geometry, Center=Point(0, 0, 0), Factor=Slider(20, range=0..360))  # -> Geometry, Transform
loft = Loft(
    Curves=flatten(scale_2.Geometry),
    Options={Adjust=False, Closed=False, LoftEnds=0, LoftSimp=0, LoftType=0, Rebuild=10, Refit=0.01})
contour = Contour(Shape=loft, Point=Point(0, 0, 0), Direction=Vector(0, 0, 1), Distance=Slider(3, range=0..10))
terrain_color = ColourSwatch(SwatchColor=RGB(242, 242, 242))
contour_color = ColourSwatch(SwatchColor=RGB(92, 92, 92))
preview = CustomPreview(Geometry=contour, Material=contour_color)
preview_2 = CustomPreview(Geometry=loft, Material=terrain_color)

# ---- group: attractor
# attractor
md_slider = MDSlider(
    SliderMode=0,
    slider_value=Point(0.7077919565, 0.6831045849, 0.5),
    x_domain=Domain(0, 1),
    y_domain=Domain(0, 1),
    z_domain=Domain(0, 1))
multiplication = Multiplication(A=md_slider, B=number_slider_2)
ptattractor = PointAttractor(
    Points=popgeo,
    Attractors=multiplication,
    Range=1,
    Distribution=0,
    AttractionRepulsion=True,
    AscDesc=False,
    MinMax=False,
    Force=0.5,
    Iterations=Slider(70, range=0..360))  # -> Length, NewPoints, NewVectors
vdis = VectorDisplay(Anchor=ptattractor.NewPoints, Vector=ptattractor.NewVectors)
graph = GraphMapper(
    ptattractor.Length,
    x0=0,
    x1=10,
    y0=0,
    y1=10,
    container_name="Bezier",
    cpx=[0, 0.1210548282, 0.3597323596, 1],
    cpy=[0.04884320498, 0.852419734, 0.866995573, 0.9908900857])
move_to_point = MoveToPoint(Geometry=group, PointA=construct_point, PointB=ptattractor.NewPoints)  # -> Moved, Vector, Transform
scale_3 = Scale(Geometry=move_to_point.Moved, Center=ptattractor.NewPoints, Factor=graph)  # -> Geometry, Transform

# ---- group: curve attractors for terrain and trees
md_slider_2 = MDSlider(
    SliderMode=0,
    slider_value=Point(0, 0.4674317895, 0.5),
    x_domain=Domain(0, 100),
    y_domain=Domain(0, 100),
    z_domain=Domain(0, 1))
md_slider_3 = MDSlider(
    SliderMode=0,
    slider_value=Point(0.2581489377, 0, 0.5),
    x_domain=Domain(0, 100),
    y_domain=Domain(0, 100),
    z_domain=Domain(0, 1))
md_slider_4 = MDSlider(
    SliderMode=0,
    slider_value=Point(0.4333466321, 0.2925824421, 0.5),
    x_domain=Domain(0, 100),
    y_domain=Domain(0, 100),
    z_domain=Domain(0, 1))
md_slider_5 = MDSlider(
    SliderMode=0,
    slider_value=Point(0.4333466321, 0.3263408382, 0.5),
    x_domain=Domain(0, 100),
    y_domain=Domain(0, 100),
    z_domain=Domain(0, 1))
number_slider_4 = Slider(100, range=0..360)
number_slider_5 = Slider(10, range=0..360)
md_slider_6 = MDSlider(
    SliderMode=0,
    slider_value=Point(0.860997642, 1, 0.5),
    x_domain=Domain(0, 100),
    y_domain=Domain(0, 100),
    z_domain=Domain(0, 1))
md_slider_7 = MDSlider(
    SliderMode=0,
    slider_value=Point(0.3585949409, 1, 0.5),
    x_domain=Domain(0, 100),
    y_domain=Domain(0, 100),
    z_domain=Domain(0, 1))
division_5 = Division(A=number_slider_4, B=number_slider_5)
z_factor = Slider(26, range=0..100)
z_factor_2 = Slider(18, range=0..100)
attractor = Point([md_slider_6, md_slider_4, md_slider_2])
attractor_2 = Point([md_slider_7, md_slider_5, md_slider_3])
sqgrid = Square(Plane=PlaneXY(0, 0, 0), Size=number_slider_5, ExtentX=division_5, ExtentY=division_5)  # -> Cells, Points
intcrv_2 = Interpolate(Vertices=attractor, Degree=3, Periodic=False, KnotStyle=1)  # -> Curve, Length, Domain
rectangle = Rectangle(Plane=PlaneXY(0, 0, 0), XSize=number_slider_4, YSize=number_slider_4, Radius=0)  # -> Rectangle, Length
intcrv_3 = Interpolate(Vertices=attractor_2, Degree=3, Periodic=False, KnotStyle=1)  # -> Curve, Length, Domain
pop2d = Populate2D(Region=rectangle.Rectangle, Count=Slider(100, range=0..360), Seed=1)
attr = Atträctor(Grid=sqgrid.Cells, Attractors=intcrv_2.Curve, Radius=Slider(10, range=0..100), isreversed="False")  # -> Grid, Values
attr_2 = Atträctor(Grid=sqgrid.Cells, Attractors=intcrv_3.Curve, Radius=Slider(16, range=0..100), isreversed="False")  # -> Grid, Values
attr_3 = Atträctor(Grid=pop2d, Attractors=intcrv_3.Curve, Radius=Slider(120, range=0..360), isreversed="False")  # -> Grid, Values
pt_3 = Point(attr_3.Grid)
multiplication_2 = Multiplication(A=attr.Values, B=z_factor)
multiplication_3 = Multiplication(A=attr_2.Values, B=z_factor_2)
Z = UnitZ(Factor=multiplication_2)
Z_2 = UnitZ(Factor=multiplication_3)
move_4 = Move(Geometry=sqgrid.Points, Motion=Z_2)  # -> Geometry, Transform
move_5 = Move(Geometry=sqgrid.Points, Motion=Z)  # -> Geometry, Transform
patch = Patch(Curves=rectangle.Rectangle, Points=flatten([move_5.Geometry, move_4.Geometry]), Spans=20, Flexibility=1, Trim=True)
project = ProjectPoint(Point=pt_3, Direction="0,0,1", Geometry=patch)  # -> Point, Index
project_2 = Project(Curve=[intcrv_2.Curve, intcrv_3.Curve], Brep=patch, Direction="0,0,1")
project_3 = ProjectPoint(Point=attractor, Direction="0,0,1", Geometry=patch)  # -> Point, Index
multiplication_4 = Multiplication(A=attr_3.Values, B=Slider(0.25, range=0..1))
contour_2 = Contour(Shape=patch, Point=Point(0, 0, 0), Direction=Vector(0, 0, 1), Distance=Slider(1, range=0..10))
attractor_color = ColourSwatch(SwatchColor=RGB(51, 51, 51))
attractor_color_2 = ColourSwatch(SwatchColor=RGB(0, 0, 0))
move2pt = MoveToPoint(Geometry=group, PointA=construct_point, PointB=project.Point)  # -> Moved, Vector, Transform
surface_color = ColourSwatch(SwatchColor=RGB(242, 242, 242))
contour_color_2 = ColourSwatch(SwatchColor=RGB(128, 128, 128))
preview_3 = CustomPreview(Geometry=project_2, Material=attractor_color)
preview_4 = CustomPreview(Geometry=project_3.Point, Material=attractor_color_2)
preview_5 = CustomPreview(Geometry=contour_2, Material=contour_color_2)
preview_6 = CustomPreview(Geometry=patch, Material=surface_color)
scale_4 = Scale(Geometry=move2pt.Moved, Center=project.Point, Factor=multiplication_4)  # -> Geometry, Transform
contour_color_3 = ColourSwatch(SwatchColor=RGB(128, 128, 128))
preview_7 = CustomPreview(Geometry=scale_4.Geometry, Material=contour_color_3)

# ----
md_slider_8 = MDSlider(SliderMode=0, slider_value=Point(0, 0, 0.5), x_domain=Domain(0, 100), y_domain=Domain(0, 100), z_domain=Domain(0, 1))
md_slider_9 = MDSlider(
    SliderMode=0,
    slider_value=Point(0.3357856564, 0.586503936, 0.5),
    x_domain=Domain(0, 100),
    y_domain=Domain(0, 100),
    z_domain=Domain(0, 1))
number_slider_6 = Slider(100, range=0..360)
number_slider_7 = Slider(10, range=0..360)
md_slider_10 = MDSlider(SliderMode=0, slider_value=Point(1, 1, 0.5), x_domain=Domain(0, 100), y_domain=Domain(0, 100), z_domain=Domain(0, 1))
division_6 = Division(A=number_slider_6, B=number_slider_7)
z_factor_3 = Slider(10, range=0..100)
attractor_3 = Point([md_slider_10, md_slider_9, md_slider_8])
sqgrid_2 = Square(Plane=PlaneXY(0, 0, 0), Size=number_slider_7, ExtentX=division_6, ExtentY=division_6)  # -> Cells, Points
rectangle_2 = Rectangle(Plane=PlaneXY(0, 0, 0), XSize=number_slider_6, YSize=number_slider_6, Radius=0)  # -> Rectangle, Length
intcrv_4 = Interpolate(Vertices=attractor_3, Degree=3, Periodic=False, KnotStyle=1)  # -> Curve, Length, Domain
pop2d_2 = Populate2D(Region=rectangle_2.Rectangle, Count=Slider(100, range=0..360), Seed=1)
attr_4 = Atträctor(Grid=sqgrid_2.Cells, Attractors=intcrv_4.Curve, Radius=Slider(21, range=0..100), isreversed="False")  # -> Grid, Values
attr_5 = Atträctor(Grid=pop2d_2, Attractors=intcrv_4.Curve, Radius=Slider(120, range=0..360), isreversed="False")  # -> Grid, Values
pt_4 = Point(attr_5.Grid)
multiplication_5 = Multiplication(A=attr_4.Values, B=z_factor_3)
Z_3 = UnitZ(Factor=multiplication_5)
move_6 = Move(Geometry=sqgrid_2.Points, Motion=Z_3)  # -> Geometry, Transform
patch_2 = Patch(Curves=rectangle_2.Rectangle, Points=flatten(move_6.Geometry), Spans=20, Flexibility=1, Trim=True)
project_4 = ProjectPoint(Point=pt_4, Direction="0,0,1", Geometry=patch_2)  # -> Point, Index
project_5 = Project(Curve=intcrv_4.Curve, Brep=patch_2, Direction="0,0,1")
multiplication_6 = Multiplication(A=attr_5.Values, B=Slider(0.25, range=0..1))
contour_3 = Contour(Shape=patch_2, Point=Point(0, 0, 0), Direction=Vector(0, 0, 1), Distance=Slider(1, range=0..10))
attractor_color_3 = ColourSwatch(SwatchColor=RGB(51, 51, 51))
surface_color_2 = ColourSwatch(SwatchColor=RGB(242, 242, 242))
move2pt_2 = MoveToPoint(Geometry=group, PointA=construct_point, PointB=project_4.Point)  # -> Moved, Vector, Transform
contour_color_4 = ColourSwatch(SwatchColor=RGB(128, 128, 128))
preview_8 = CustomPreview(Geometry=project_5, Material=attractor_color_3)
preview_9 = CustomPreview(Geometry=contour_3, Material=contour_color_4)
preview_10 = CustomPreview(Geometry=patch_2, Material=surface_color_2)
scale_5 = Scale(Geometry=move2pt_2.Moved, Center=project_4.Point, Factor=multiplication_6)  # -> Geometry, Transform
contour_color_5 = ColourSwatch(SwatchColor=RGB(128, 128, 128))
preview_11 = CustomPreview(Geometry=scale_5.Geometry, Material=contour_color_5)

# ---- group: curve attractor for terrain
sqgrid_3 = Square(
    Plane=PlaneXY(0, 0, 0),
    Size=Slider(10, range=0..360),
    ExtentX=Slider(10, range=0..360),
    ExtentY=Slider(10, range=0..360))  # -> Cells, Points

md_slider_11 = MDSlider(
    SliderMode=0,
    slider_value=Point(0, 0.4575039003, 0.5),
    x_domain=Domain(0, 100),
    y_domain=Domain(0, 100),
    z_domain=Domain(0, 1))
md_slider_12 = MDSlider(
    SliderMode=0,
    slider_value=Point(0.4333466321, 0.2925824421, 0.5),
    x_domain=Domain(0, 100),
    y_domain=Domain(0, 100),
    z_domain=Domain(0, 1))
md_slider_13 = MDSlider(SliderMode=0, slider_value=Point(1, 1, 0.5), x_domain=Domain(0, 100), y_domain=Domain(0, 100), z_domain=Domain(0, 1))
z_factor_4 = Slider(16, range=0..100)
attractor_4 = Point([md_slider_13, md_slider_12, md_slider_11])
intcrv_5 = Interpolate(Vertices=attractor_4, Degree=3, Periodic=False, KnotStyle=1)  # -> Curve, Length, Domain
attr_6 = Atträctor(Grid=sqgrid_3.Cells, Attractors=intcrv_5.Curve, Radius=Slider(10, range=0..100), isreversed="False")  # -> Grid, Values
multiplication_7 = Multiplication(A=attr_6.Values, B=z_factor_4)
Z_4 = UnitZ(Factor=multiplication_7)
move_7 = Move(Geometry=sqgrid_3.Points, Motion=Z_4)  # -> Geometry, Transform
patch_3 = Patch(Points=flatten(move_7.Geometry), Spans=20, Flexibility=1, Trim=True)
project_6 = Project(Curve=intcrv_5.Curve, Brep=patch_3, Direction="0,0,1")
project_7 = ProjectPoint(Point=attractor_4, Direction="0,0,1", Geometry=patch_3)  # -> Point, Index
contour_4 = Contour(Shape=patch_3, Point=Point(0, 0, 0), Direction=Vector(0, 0, 1), Distance=Slider(1, range=0..10))
attractor_color_4 = ColourSwatch(SwatchColor=RGB(51, 51, 51))
attractor_color_5 = ColourSwatch(SwatchColor=RGB(0, 0, 0))
surface_color_3 = ColourSwatch(SwatchColor=RGB(128, 128, 128))
surface_color_4 = ColourSwatch(SwatchColor=RGB(242, 242, 242))
preview_12 = CustomPreview(Geometry=project_6, Material=attractor_color_4)
preview_13 = CustomPreview(Geometry=project_7.Point, Material=attractor_color_5)
preview_14 = CustomPreview(Geometry=contour_4, Material=surface_color_3)
preview_15 = CustomPreview(Geometry=patch_3, Material=surface_color_4)

# ---- group: point attractor for terrain
sqgrid_4 = Square(
    Plane=PlaneXY(0, 0, 0),
    Size=Slider(10, range=0..360),
    ExtentX=Slider(10, range=0..360),
    ExtentY=Slider(10, range=0..360))  # -> Cells, Points

md_slider_14 = MDSlider(
    SliderMode=0,
    slider_value=Point(0.1820961557, 0.1421158953, 0.5),
    x_domain=Domain(0, 100),
    y_domain=Domain(0, 100),
    z_domain=Domain(0, 1))
md_slider_15 = MDSlider(
    SliderMode=0,
    slider_value=Point(0.4683897437, 0.456116467, 0.5),
    x_domain=Domain(0, 100),
    y_domain=Domain(0, 100),
    z_domain=Domain(0, 1))
md_slider_16 = MDSlider(
    SliderMode=0,
    slider_value=Point(0.7902415206, 0.7073170732, 0.5),
    x_domain=Domain(0, 100),
    y_domain=Domain(0, 100),
    z_domain=Domain(0, 1))
z_factor_5 = Slider(17, range=0..100)
attractor_5 = Point([md_slider_16, md_slider_15, md_slider_14])
attr_7 = Atträctor(Grid=sqgrid_4.Cells, Attractors=attractor_5, Radius=Slider(25, range=0..100), isreversed="False")  # -> Grid, Values
multiplication_8 = Multiplication(A=attr_7.Values, B=z_factor_5)
Z_5 = UnitZ(Factor=multiplication_8)
move_8 = Move(Geometry=sqgrid_4.Points, Motion=Z_5)  # -> Geometry, Transform
patch_4 = Patch(Points=flatten(move_8.Geometry), Spans=20, Flexibility=1, Trim=True)
project_8 = ProjectPoint(Point=attractor_5, Direction="0,0,1", Geometry=patch_4)  # -> Point, Index
contour_5 = Contour(Shape=patch_4, Point=Point(0, 0, 0), Direction=Vector(0, 0, 1), Distance=Slider(1, range=0..10))
attractor_color_6 = ColourSwatch(SwatchColor=RGB(0, 0, 0))
surface_color_5 = ColourSwatch(SwatchColor=RGB(128, 128, 128))
surface_color_6 = ColourSwatch(SwatchColor=RGB(242, 242, 242))
preview_16 = CustomPreview(Geometry=project_8.Point, Material=attractor_color_6)
preview_17 = CustomPreview(Geometry=contour_5, Material=surface_color_5)
preview_18 = CustomPreview(Geometry=patch_4, Material=surface_color_6)

# ---- group: populate terrain
popgeo_2 = PopulateGeometry(Geometry=loft, Count=Slider(100, range=0..300), Seed=1)

# ---- group: attractor
md_slider_17 = MDSlider(
    SliderMode=0,
    slider_value=Point(0.7077919565, 0.6831045849, 0.5),
    x_domain=Domain(0, 1),
    y_domain=Domain(0, 1),
    z_domain=Domain(0, 1))
multiplication_9 = Multiplication(A=md_slider_17, B=number_slider_2)
ptattractor_2 = PointAttractor(
    Points=popgeo_2,
    Attractors=multiplication_9,
    Range=1,
    Distribution=0,
    AttractionRepulsion=True,
    AscDesc=False,
    MinMax=False,
    Force=0.5,
    Iterations=Slider(70, range=0..360))  # -> Length, NewPoints, NewVectors
vdis_2 = VectorDisplay(Anchor=ptattractor_2.NewPoints, Vector=ptattractor_2.NewVectors)
project_9 = ProjectPoint(Point=ptattractor_2.NewPoints, Direction=Vector(0, 0, -1), Geometry=loft)  # -> Point, Index
move_to_point_2 = MoveToPoint(Geometry=group, PointA=construct_point, PointB=project_9.Point)  # -> Moved, Vector, Transform
graph_2 = GraphMapper(
    ptattractor_2.Length,
    x0=0,
    x1=10,
    y0=0,
    y1=10,
    container_name="Bezier",
    cpx=[0, 0.1210548282, 0.3597323596, 1],
    cpy=[0.04884320498, 0.852419734, 0.866995573, 0.9908900857])
scale_6 = Scale(Geometry=move_to_point_2.Moved, Center=project_9.Point, Factor=graph_2)  # -> Geometry, Transform
attractor_color_7 = ColourSwatch(SwatchColor=RGB(0, 0, 0))
tree_color = ColourSwatch(SwatchColor=RGB(51, 51, 51))
preview_19 = CustomPreview(Geometry=multiplication_9, Material=attractor_color_7)
preview_20 = CustomPreview(Geometry=scale_6.Geometry, Material=tree_color)
