# Grasshopper definition elk-osm.gh (Grasshopper 1.0.7)
# Copyright: GNU General Public License 3.0
# plug-ins: ElkGHComponents

file_path = FilePath("C:\Users\baharmon\Downloads\map-2.osm")
location = Location(FilePathText=file_path)  # -> OSMPointData, OSMFile, LongitudeDomain, LatitudeDomain
osm_data = OSMData(
    OSMPointData=location.OSMPointData,
    OSMFilePath=location.OSMFile,
    Feature="building",
    Generate3d=True,
    IndividualOutputs=False)  # -> Ways, Buildings, FeatureKey
osm_data_2 = OSMData(
    OSMPointData=location.OSMPointData,
    OSMFilePath=location.OSMFile,
    Feature="highway",
    Generate3d=False,
    IndividualOutputs=False)  # -> Ways, FeatureKey
polyline = PolyLine(Vertices=osm_data.Ways, Closed=False)
polyline_2 = PolyLine(Vertices=osm_data_2.Ways, Closed=False)
building_footprints = Curve(polyline)
buildings_3d = Brep(osm_data.Buildings)
roads = Curve(polyline_2)
