# Grasshopper definition fast-noise-grid.gh (Grasshopper 1.0.7)
# Copyright: GNU General Public License 3.0
# plug-ins: BitmapPlus

# ----
# fast noise grid
# with
# bitmap+
# procedural noise
seed = Slider(0, range=0..100)
width = Slider(50, range=0..250)
height = Slider(50, range=0..250)
depth = Slider(3173, range=0..10000)
list = ValueList({"Value": 0, "Perlin": 1, "Cubic": 2, "Simplex": 3, "WhiteNoise": 4}, selected="Perlin")
list_2 = ValueList({"Linear": 0, "Hermite": 1, "Quintic": 2}, selected="Hermite")
frequency = Slider(0.094, range=0..0.1)
procedural_noise = ProceduralNoise(Seed=seed, Width=width, Height=height, Depth=depth, Mode=list, Interpolation=list_2, Frequency=frequency)  # -> Image, Noise
prev_image = PrevImage(SmartBitmap=procedural_noise.Image)
image = Data(procedural_noise.Image)

image_2 = Data(image)
# noise from image
deconstruct_bitmap = DeconstructBitmap(Image=image_2)
text_split = TextSplit(Text=deconstruct_bitmap, Separators=",")
list_item = ListItem(List=text_split, Index=0, Wrap=True)  # -> flatten(Item)
division = Division(A=list_item, B="255")
noise = Number(division)

image_3 = Data(image_2)
cellsize = Slider(1, range=0..1)
noise_2 = Number(noise)
# grid from image
bitmap_properties = BitmapProperties(Image=image_3)  # -> Boundary, Width, Height, HorizontalResolution, VerticalResolution, Format
square = Square(Plane=PlaneXY(0, 0, 0), Size=1, ExtentX=bitmap_properties.Width, ExtentY=bitmap_properties.Height)  # -> flatten(Cells), Points
unit_z = UnitZ(Factor=cellsize)
extrude = Extrude(Base=square.Cells, Direction=unit_z)
gradient = Gradient(
    LowerLimit=0,
    UpperLimit=1,
    Parameter=noise_2,
    stops=[0: RGB(68, 1, 84), 0.167: RGB(68, 57, 131), 0.334: RGB(49, 104, 142), 0.501: RGB(33, 145, 140), 0.668: RGB(53, 183, 121), 0.835: RGB(144, 215, 67), 1: RGB(253, 231, 37)])
cap_holes = CapHoles(Brep=extrude)
custom_preview = CustomPreview(Geometry=cap_holes, Material=gradient)

# ----
# cellular noise
seed_2 = Slider(0, range=0..100)
width_2 = Slider(50, range=0..250)
height_2 = Slider(50, range=0..250)
depth_2 = Slider(0, range=0..10000)
list_3 = ValueList({"Euclidean": 0, "Manhattan": 1, "Natural": 2}, selected="Euclidean")
list_4 = ValueList({"Value": 0, "Distance2": 2, "Dist2Add": 3, "Dist2Sub": 4, "Dist2Mul": 5, "Dist2Div": 6}, selected="Dist2Div")
procedural_cellular = ProceduralCellular(
    Seed=seed_2,
    Width=width_2,
    Height=height_2,
    Depth=depth_2,
    BoundaryMode=list_3,
    InterpolationMode=list_4,
    Jitter=Slider(0.5, range=0..1),
    Frequency=Slider(0.08, range=0..1))
prev_image_2 = PrevImage(SmartBitmap=procedural_cellular)
image_4 = Data(procedural_cellular)
