# Grasshopper definition fast-noise-mesh-wall.gh (Grasshopper 1.0.7)
# Copyright: GNU General Public License 3.0
# plug-ins: BitmapPlus, Kangaroo2 Components

# ----
# fast noise
# with
# bitmap+
# procedural noise
seed = Slider(0, range=0..100)
width = Slider(50, range=0..1000)
height = Slider(100, range=0..100)
depth = Slider(5000, range=0..10000)
list = ValueList({"Value": 0, "Perlin": 1, "Cubic": 2, "Simplex": 3, "WhiteNoise": 4}, selected="Perlin")
list_2 = ValueList({"Linear": 0, "Hermite": 1, "Quintic": 2}, selected="Hermite")
frequency = Slider(0.25, range=0..1)
procedural_noise = ProceduralNoise(Seed=seed, Width=width, Height=height, Depth=depth, Mode=list, Interpolation=list_2, Frequency=frequency)  # -> Image, Noise
prev_image = PrevImage(SmartBitmap=procedural_noise.Image)
image = Data(procedural_noise.Image)

image_2 = Data(image)
# extract noise from image
bitmap_properties = BitmapProperties(Image=image_2)  # -> Boundary, Width, Height, HorizontalResolution, VerticalResolution, Format
deconstruct_bitmap = DeconstructBitmap(Image=image_2)
mesh_plane = MeshPlane(
    Boundary=bitmap_properties.Boundary,
    WidthCount=expr("x-1", bitmap_properties.Width),
    HeightCount=expr("x-1", bitmap_properties.Height))  # -> Mesh, Area
split_ahsv = SplitAHSV(Colour=deconstruct_bitmap)  # -> Alpha, Hue, Saturation, Value
yz_plane = YZPlane(Origin=Point(0, 0, 0))
rotate = Rotate(Geometry=mesh_plane.Mesh, Angle=degrees("90"), Plane=yz_plane)  # -> Geometry, Transform
deconstruct_mesh = DeconstructMesh(Mesh=rotate.Geometry)  # -> Vertices, Faces, Colours, Normals
mesh_face = MeshFace(deconstruct_mesh.Faces)
boundary = Mesh(rotate.Geometry)
point = Point(deconstruct_mesh.Vertices)
noise = Number(split_ahsv.Value)

# ----
# 3D mesh
point_2 = Point(point)
mesh_face_2 = MeshFace(mesh_face)
y_factor = Slider(10, range=0..20)
noise_2 = Number(noise)
multiplication = Multiplication(A=y_factor, B=noise_2)
negative = Negative(Value=multiplication)
unit_y = UnitY(Factor=negative)
gradient = Gradient(
    LowerLimit=0,
    UpperLimit=1,
    Parameter=noise_2,
    stops=[0: RGB(68, 1, 84), 0.167: RGB(68, 57, 131), 0.334: RGB(49, 104, 142), 0.501: RGB(33, 145, 140), 0.668: RGB(53, 183, 121), 0.835: RGB(144, 215, 67), 1: RGB(253, 231, 37)])
move = Move(Geometry=point_2, Motion=unit_y)  # -> Geometry, Transform
construct_mesh = ConstructMesh(Vertices=move.Geometry, Faces=mesh_face_2, Colours=gradient)
mesh = Mesh(construct_mesh)

mesh_2 = Mesh(mesh)
# mesh sides
Y = Slider(1, range=0..10)
# mesh base
deconstruct_mesh_2 = DeconstructMesh(Mesh=mesh_2)  # -> Vertices, Faces, Colours, Normals
unit_y_2 = UnitY(Factor=Y)
xz_plane = XZPlane(Origin=unit_y_2)
project = Project(Geometry=deconstruct_mesh_2.Vertices, Plane=xz_plane)  # -> Geometry, Transform
construct_mesh_2 = ConstructMesh(Vertices=project.Geometry, Faces=deconstruct_mesh_2.Faces)
mesh_3 = Mesh(construct_mesh_2)

mesh_4 = Mesh(mesh)
# join mesh
mesh_5 = Mesh(mesh_3)
mesh_edges = MeshEdges(Mesh=mesh_4)  # -> flatten(NakedEdges), InteriorEdges, NonManifoldEdges
mesh_edges_2 = MeshEdges(Mesh=mesh_5)  # -> flatten(NakedEdges), InteriorEdges, NonManifoldEdges
end_points = EndPoints(Curve=mesh_edges.NakedEdges)  # -> Start, End
end_points_2 = EndPoints(Curve=mesh_edges_2.NakedEdges)  # -> Start, End
merge = Merge(
    Data1=graft(end_points.Start),
    Data2=graft(end_points.End),
    Data3=graft(end_points_2.End),
    Data4=graft(end_points_2.Start))
construct_mesh_3 = ConstructMesh(Vertices=merge, Faces={A=0, B=1, C=2, D=3})  # -> flatten(Mesh)
mesh_6 = Mesh(construct_mesh_3)

mesh_7 = Mesh(mesh)
mesh_8 = Mesh(mesh_6)
mesh_9 = Mesh(mesh_3)
mesh_join = MeshJoin(Meshes=flatten([mesh_7, mesh_8, mesh_9]))
unify_mesh = UnifyMesh(Mesh=mesh_join)  # -> Result, Count
combine_clean = CombineClean(Meshes=unify_mesh.Result)
mesh_10 = Mesh(combine_clean)

# ----
# color mesh
mesh_11 = Mesh(mesh_10)
deconstruct_mesh_3 = DeconstructMesh(Mesh=mesh_11)  # -> Vertices, Faces, Colours, Normals
deconstruct = Deconstruct(Point=deconstruct_mesh_3.Vertices)  # -> XComponent, YComponent, ZComponent
negative_2 = Negative(Value=deconstruct.YComponent)
bounds = Bounds(Numbers=negative_2)
remap_numbers = RemapNumbers(Value=negative_2, Source=bounds, Target=Domain(0, 1))  # -> Mapped, Clipped
gradient_2 = Gradient(
    LowerLimit=0,
    UpperLimit=1,
    Parameter=remap_numbers.Mapped,
    stops=[0: RGB(68, 1, 84), 0.167: RGB(68, 57, 131), 0.334: RGB(49, 104, 142), 0.501: RGB(33, 145, 140), 0.668: RGB(53, 183, 121), 0.835: RGB(144, 215, 67), 1: RGB(253, 231, 37)])
mesh_colours = MeshColours(Mesh=mesh_11, Colours=gradient_2)
mesh_12 = Mesh(mesh_colours)

# ----
# cellular noise
seed_2 = Slider(4, range=0..100)
width_2 = Slider(250, range=0..1000)
height_2 = Slider(50, range=0..100)
depth_2 = Slider(39, range=0..500)
list_3 = ValueList({"Euclidean": 0, "Manhattan": 1, "Natural": 2}, selected="Euclidean")
list_4 = ValueList({"Value": 0, "Distance2": 2, "Dist2Add": 3, "Dist2Sub": 4, "Dist2Mul": 5, "Dist2Div": 6}, selected="Dist2Div")
procedural_cellular = ProceduralCellular(
    Seed=seed_2,
    Width=width_2,
    Height=height_2,
    Depth=depth_2,
    BoundaryMode=list_3,
    InterpolationMode=list_4,
    Jitter=Slider(0.5, range=0..1),
    Frequency=Slider(0.2, range=0..1))
prev_image_2 = PrevImage(SmartBitmap=procedural_cellular)
image_3 = Data(procedural_cellular)
