# Grasshopper definition fractal-paving.gh (Grasshopper 1.0.7)
# Copyright: GNU General Public License 3.0
# plug-ins: Multifold Henon Map

# ---- group: rockery from multifold henon map
# fractal terrain
# using chimpanzee
A = Slider(4, range=0..10)
B = Slider(0.9, range=0..1)
iterations = Slider(360, range=0..10000)
X = Slider(10, range=0..100)
Y = Slider(10, range=0..100)
xy = Slider(20, range=0..100)
rectangle = Rectangle(Plane=PlaneXY(0, 0, 0), XSize=xy, YSize=xy, Radius=0)  # -> Rectangle, Length
multifold_henon_map = MultifoldHenonMap(A=A, B=B, Iterations=iterations, X=X, Y=Y)
voronoi = Voronoi(Points=multifold_henon_map, Boundary=rectangle.Rectangle, BruteForceOverride=False)
boundary_surfaces = BoundarySurfaces(Edges=voronoi)
length = Length(Curve=boundary_surfaces)
bounds = Bounds(Numbers=length)
remap_numbers = RemapNumbers(Value=length, Source=bounds, Target="1 To 4")  # -> Mapped, Clipped
unit_z = UnitZ(Factor=remap_numbers.Mapped)
gradient = Gradient(LowerLimit=0, UpperLimit=bounds, Parameter=length, stops=[0: RGB(224, 224, 224), 1: RGB(64, 64, 64)])
extrude = Extrude(Base=boundary_surfaces, Direction=unit_z)
custom_preview = CustomPreview(Geometry=extrude, Material=gradient)

# ---- group: cutting plane
rectangle_2 = Rectangle(rectangle.Rectangle)
water_depth = Slider(1.7, range=0..10)
unit_z_2 = UnitZ(Factor=water_depth)
boundary_surfaces_2 = BoundarySurfaces(Edges=rectangle_2)
move = Move(Geometry=boundary_surfaces_2, Motion=unit_z_2)  # -> Geometry, Transform
custom_preview_2 = CustomPreview(Geometry=move.Geometry, Material=ColourSwatch(SwatchColor=RGB(0, 0, 0)))
