# Grasshopper definition grading.gh (Grasshopper 1.0.7)
# Copyright: GNU General Public License 3.0
# plug-ins: Docofossor

# ---- group: import xyz
# Grading
# using docofossor
file_path = FilePath("D:\generative-design\grasshopper\data\governors-island-landform.xyz")
import_xyz = ImportXYZ(F=file_path, N="3")
grid_shift = GridShift(Df=import_xyz)
grid_mesh = GridMesh(Df=grid_shift)
custom_preview = CustomPreview(Geometry=grid_mesh, Material=ColourSwatch(SwatchColor=RGB(204, 204, 204)))
data = Data(grid_shift)

# ---- group: grade landform
data_2 = Data(data)
point = Point([Point(593.0966104, 47.82972478, 9.208923794), Point(683.6743569, 109.664187, 31.36218972), Point(799.8718928, 155.7299106, 31.4421157), Point(1058.47585, 156.3609805, 17.45012827), Point(1160.015902, 140.5754654, 12.38230481)])
width = Slider(0.1, range=0..0.1)
slope_l = Slider(25, range=0..100)
slope_r = Slider(15, range=0..100)
distance = Slider(100, range=0..100)
interpolate = Interpolate(Vertices=point, Degree=3, Periodic=False, KnotStyle=1)  # -> Curve, Length, Domain
fill_in_path = FillInPath(Df=data_2, Crv=interpolate.Curve, Wt=width, Sa=slope_l, Sa2=slope_r, D=distance)  # -> Df, Vol
grid_mesh_2 = GridMesh(Df=fill_in_path.Df)
custom_preview_2 = CustomPreview(Geometry=grid_mesh_2, Material=ColourSwatch(SwatchColor=RGB(204, 204, 204)))
data_3 = Data(fill_in_path.Df)

# ---- group: calculate cut and fill
data_4 = Data(data)
data_5 = Data(data_3)
grid_compare = GridCompare(Df1=data_4, Df2=data_5)  # -> Cut, Fill, Balance, Df
grid_mesh_3 = GridMesh(Df=grid_compare.Df)
panel = Panel(grid_compare.Cut)
panel_2 = Panel(grid_compare.Fill)
custom_preview_3 = CustomPreview(Geometry=grid_mesh_3, Material=ColourSwatch(SwatchColor=RGB(204, 204, 204)))

# ---- group: export xyz
data_6 = Data(data_3)
file_path_2 = FilePath("D:\generative-design\grasshopper\data\governors-island-grading.xyz")
export_xyz = ExportXYZ(Df=data_6, F=file_path_2, W=Toggle(False))
