# Grasshopper definition hexagonal-living-wall.gh (Grasshopper 1.0.7)
# Copyright: GNU General Public License 3.0
# plug-ins: Volvox

size = Slider(30, range=0..100)
Y = Slider(6, range=0..100)
Z = Slider(12, range=0..100)
# hexagonal wall
# tessellation
yz_plane = YZPlane(Origin=Point(0, 0, 0))
hexagonal = Hexagonal(Plane=yz_plane, Size=size, ExtentX=Y, ExtentY=Z)  # -> flatten(Cells), flatten(Points)
curve = Curve(hexagonal.Cells)
point = Point(hexagonal.Points)

# ----
# attractor
point_2 = Point(point)
attractors = Point([Point(0, 39, 49), Point(0, 182, 195), Point(0, 70, 348), Point(0, 188, 547)])
closest_point = ClosestPoint(Point=point_2, Cloud=attractors)  # -> ClosestPoint, CPIndex, Distance
bounds = Bounds(Numbers=closest_point.Distance)
remap_numbers = RemapNumbers(Value=closest_point.Distance, Source=bounds, Target="3 To 6")  # -> Mapped, Clipped
round = Round(Number=remap_numbers.Mapped)  # -> Nearest, Floor, Ceiling
number = Number(round.Nearest)

# ----
# face
curve_2 = Curve(curve)
point_3 = Point(point)
# base
scale = Slider(0.9, range=0..1)
scale_2 = Scale(Geometry=curve_2, Center=point_3, Factor=scale)  # -> Geometry, Transform
boundary_surfaces = BoundarySurfaces(Edges=[curve_2, scale_2.Geometry])
brep = Brep(boundary_surfaces)

curve_3 = Curve(scale_2.Geometry)
thickness = Slider(5, range=0..10)
unit_y = UnitY(Factor=thickness)
boundary_surfaces_2 = BoundarySurfaces(Edges=curve_3)
extrude = Extrude(Base=boundary_surfaces_2, Direction=unit_y)
custom_preview = CustomPreview(Geometry=extrude, Material=ColourSwatch(SwatchColor=RGB(204, 204, 204)))
brep_2 = Brep(extrude)

# ----
# extrusion
brep_3 = Brep(brep)
number_2 = Number(number)
factor = Slider(10, range=0..100)
# random colors
angle = Slider(-45, range=-90..90)
multiplication = Multiplication(A=number_2, B=factor)
unit_x = UnitX(Factor=multiplication)
unit_y_2 = UnitY(Factor=1)
rotate = Rotate(Vector=unit_x, Axis=unit_y_2, Angle=degrees(angle))
extrude_2 = Extrude(Base=brep_3, Direction=rotate)
brep_4 = Brep(extrude_2)

brep_5 = Brep(brep_4)
volume = Volume(Geometry=brep_5)  # -> Volume, Centroid
bounds_2 = Bounds(Numbers=volume.Volume)
remap_numbers_2 = RemapNumbers(Value=volume.Volume, Source=bounds_2, Target=Domain(0, 1))  # -> Mapped, Clipped
gradient = Gradient(LowerLimit=0, UpperLimit=1, Parameter=remap_numbers_2.Mapped, stops=[0: RGB(224, 224, 224), 1: RGB(64, 64, 64)])
custom_preview_2 = CustomPreview(Geometry=brep_5, Material=gradient)

# ----
# inner frame
curve_4 = Curve(curve)
amplitude = Slider(50, range=0..100)
unit_x_2 = UnitX(Factor=amplitude)
unit_y_3 = UnitY(Factor=1)
region_union = RegionUnion(Curves=curve_4)
angle_2 = Number(angle)
rotate_2 = Rotate(Vector=unit_x_2, Axis=unit_y_3, Angle=degrees(angle_2))
extrude_3 = Extrude(Base=region_union, Direction=rotate_2)
cap_holes = CapHoles(Brep=extrude_3)
brep_6 = Brep(cap_holes)

# ----
# outer frame
curve_5 = Curve(curve)
scale_3 = Slider(1.2, range=0..10)
# solid frame
X = Slider(20, range=0..100)
bounding_box = BoundingBox(Content=curve_5, Plane=PlaneXY(0, 0, 0), UnionBox=True)  # -> Box, Box_2
deconstruct_box = DeconstructBox(Box=bounding_box.Box_2)  # -> Plane, X, Y, Z
plane = Plane(yz_plane)
rectangle = Rectangle(Plane=plane, XSize=deconstruct_box.Y, YSize=deconstruct_box.Z, Radius=0)  # -> Rectangle, Length
area = Area(Geometry=rectangle.Rectangle)  # -> Area, Centroid
unit_x_3 = UnitX(Factor=X)
scale_4 = Scale(Geometry=rectangle.Rectangle, Center=area.Centroid, Factor=scale_3)  # -> Geometry, Transform
extrude_4 = Extrude(Base=scale_4.Geometry, Direction=unit_x_3)
cap_holes_2 = CapHoles(Brep=extrude_4)
brep_7 = Brep(cap_holes_2)

brep_8 = Brep(brep_7)
brep_9 = Brep(brep_6)
solid_difference = SolidDifference(BrepsA=brep_8, BrepsB=brep_9)
custom_preview_3 = CustomPreview(Geometry=solid_difference, Material=ColourSwatch(SwatchColor=RGB(204, 204, 204)))

# ----
# planting
cloud = Cloud(<cloud referenced from the Rhino model>)
xz_plane = XZPlane(Origin=Point(0, 0, 0))
point_4 = Point(point)
# plant scaling
x_shift = Slider(0, range=0..100)
rotate_3 = Rotate(Geometry=cloud, Angle=degrees("-90"), Plane=xz_plane)  # -> Geometry, Transform
vector_2pt = Vector2Pt(PointA=xz_plane, PointB=point_4, Unitize=False)  # -> Vector, Length
move = Move(Geometry=rotate_3.Geometry, Motion=vector_2pt.Vector)  # -> Geometry, Transform
vector = Vector(rotate)
division = Division(A=vector, B="1.5")
move_2 = Move(Geometry=move.Geometry, Motion=vector)  # -> Geometry, Transform
unit_z = UnitZ(Factor=x_shift)
move_3 = Move(Geometry=move_2.Geometry, Motion=unit_z)  # -> Geometry, Transform
cloud_2 = Cloud(move_3.Geometry)

cloud_3 = Cloud(cloud_2)
number_3 = Number(closest_point.Distance)
bounds_3 = Bounds(Numbers=number_3)
remap_numbers_3 = RemapNumbers(Value=number_3, Source=bounds_3, Target="1.5 To 3")  # -> Mapped, Clipped
average = Average(Cloud=cloud_3, Percent=1)
scale_5 = Scale(Geometry=cloud_3, Center=average, Factor=remap_numbers_3.Mapped)  # -> Geometry, Transform
cloud_4 = Cloud(scale_5.Geometry)

# ----
# plant rotation
cloud_5 = Cloud(scale_5.Geometry)
# planting media
point_5 = Point(average)
list_length = ListLength(List=cloud_5)
random = Random(Range="0 To 360", Number=list_length, Seed=2)
yz_plane_2 = YZPlane(Origin=point_5)
rotate_4 = Rotate(Geometry=cloud_5, Angle=degrees(random), Plane=yz_plane_2)  # -> Geometry, Transform
cloud_6 = Cloud(rotate_4.Geometry)

curve_6 = Curve(scale_2.Geometry)
vector_2 = Vector(division)
boundary_surfaces_3 = BoundarySurfaces(Edges=curve_6)
extrude_5 = Extrude(Base=boundary_surfaces_3, Direction=vector_2)
custom_preview_4 = CustomPreview(Geometry=extrude_5, Material=ColourSwatch(SwatchColor=RGB(178, 159, 116)))

panel = Panel(number)
