# Grasshopper definition live-oak-allee.gh (Grasshopper 1.0.7)
# Copyright: GNU General Public License 3.0
# plug-ins: Volvox

# ----
# wave of paths
# textured sinusoidal waves
t = Slider(2, range=0..10)
start = Slider(0.5, range=0..1)
step = Slider(0.1, range=0..1)
count = Slider(3, range=0..10)
pi = Pi(Factor=t)
series = Series(Start=start, Step=step, Count=count)  # -> graft(Series)
range = Range(Domain=pi, Steps="200")
expression = Expression(x=range, a=series, Expression="a*sin(a^-1*x)+sin(x)")
construct_point = ConstructPoint(XCoordinate=range, YCoordinate=expression, ZCoordinate=0)
interpolate = Interpolate(Vertices=construct_point, Degree=3, Periodic=False, KnotStyle=1)  # -> flatten(Curve), Length, Domain
curve = Curve(interpolate.Curve)

# ----
# sinusoidal paths
curve_2 = Curve(curve)
scale = Slider(60, range=0..100)
offset = Slider(2, range=0..3)
scale_2 = Scale(Geometry=curve_2, Center=Point(0, 0, 0), Factor=scale)  # -> Geometry, Transform
offset_curve = OffsetCurve(Curve=scale_2.Geometry, Distance=offset, Corners=1)  # -> flatten(Curve)
ruled_surface = RuledSurface(CurveA=scale_2.Geometry, CurveB=offset_curve)
region_union = RegionUnion(Curves=ruled_surface)
boundary_surfaces = BoundarySurfaces(Edges=region_union)
custom_preview = CustomPreview(Geometry=boundary_surfaces, Material=ColourSwatch(SwatchColor=RGB(76, 76, 76)))
surface = Surface(boundary_surfaces)

# ----
# wave of trees
# textured sinusoidal waves
t_2 = Slider(2, range=0..10)
start_2 = Slider(0.2, range=0..1)
step_2 = Slider(0.1, range=0..1)
count_2 = Slider(3, range=0..10)
pi_2 = Pi(Factor=t_2)
series_2 = Series(Start=start_2, Step=step_2, Count=count_2)  # -> graft(Series)
range_2 = Range(Domain=pi_2, Steps="200")
expression_2 = Expression(x=range_2, a=series_2, Expression="a*sin(a^-1*x)+sin(x)")
construct_point_2 = ConstructPoint(XCoordinate=range_2, YCoordinate=expression_2, ZCoordinate=0)
interpolate_2 = Interpolate(Vertices=construct_point_2, Degree=3, Periodic=False, KnotStyle=1)  # -> flatten(Curve), Length, Domain
curve_3 = Curve(interpolate_2.Curve)

# ----
# sinusoidal planting
cloud = Cloud(<cloud referenced from the Rhino model>)
cloud_2 = Cloud(<cloud referenced from the Rhino model>)
curve_4 = Curve(curve_3)
scale_3 = Number(scale)
spacing = Slider(15, range=0..50)
tolerance = Slider(10, range=0..50)
surface_2 = Surface(surface)
scale_4 = Scale(Geometry=curve_4, Center=Point(0, 0, 0), Factor=scale_3)  # -> Geometry, Transform
divide_distance = DivideDistance(Curve=scale_4.Geometry, Distance=spacing)  # -> flatten(Points), Tangents, Parameters
cull_duplicates = CullDuplicates(Points=divide_distance.Points, Tolerance=tolerance, CullMode=3)  # -> Points, Indices, Valence
point = Point(cull_duplicates.Points)
point_2 = Point(cull_duplicates.Points)
list_length = ListLength(List=point_2)
list_length_2 = ListLength(List=point)
random = Random(Range="0 To 360", Number=list_length, Seed=2)
random_2 = Random(Range="0.8 To 1.2", Number=list_length_2, Seed=2)
vector_2pt = Vector2Pt(PointA="0,0,0", PointB=cull_duplicates.Points, Unitize=False)  # -> Vector, Length
move = Move(Geometry=cloud_2, Motion=vector_2pt.Vector)  # -> Geometry, Transform
cloud_3 = Cloud(move.Geometry)
cloud_4 = Cloud(cloud_3)
scale_5 = Scale(Geometry=cloud_4, Center=point, Factor=random_2)  # -> Geometry, Transform
cloud_5 = Cloud(scale_5.Geometry)
cloud_6 = Cloud(cloud_5)
rotate = Rotate(Geometry=cloud_6, Angle=degrees(random), Plane=point_2)  # -> Geometry, Transform
cloud_7 = Cloud(rotate.Geometry)
# cull planting
cloud_8 = Cloud(cloud_7)
collision_one_many = CollisionOneMany(Collider=cloud_8, Obstacles=surface_2)  # -> Collision, Index
gate_not = GateNot(A=collision_one_many.Collision)
cull_pattern = CullPattern(List=cloud_8, CullPattern=gate_not)
cloud_9 = Cloud(cull_pattern)
