# Grasshopper definition living-wall-2.gh (Grasshopper 1.0.7)
# Copyright: GNU General Public License 3.0
# plug-ins: BitmapPlus

# ----
# living wall
# noise attractor
# cellular noise
# using bitmap+
seed = Slider(44, range=0..100)
width = Slider(26, range=0..100)
height = Slider(7, range=0..100)
depth = Slider(39, range=0..500)
list = ValueList({"Euclidean": 0, "Manhattan": 1, "Natural": 2}, selected="Euclidean")
list_2 = ValueList({"Value": 0, "Distance2": 2, "Dist2Add": 3, "Dist2Sub": 4, "Dist2Mul": 5, "Dist2Div": 6}, selected="Dist2Div")
# extract noise from image
number_slider = Slider(0.275, range=0..1)
procedural_cellular = ProceduralCellular(
    Seed=seed,
    Width=width,
    Height=height,
    Depth=depth,
    BoundaryMode=list,
    InterpolationMode=list_2,
    Jitter=Slider(0.5, range=0..1),
    Frequency=number_slider)
prev_image = PrevImage(SmartBitmap=procedural_cellular)
image = Data(procedural_cellular)

image_2 = Data(image)
bitmap_properties = BitmapProperties(Image=image_2)  # -> Boundary, Width, Height, HorizontalResolution, VerticalResolution, Format
deconstruct_bitmap = DeconstructBitmap(Image=image_2)
mesh_plane = MeshPlane(
    Boundary=bitmap_properties.Boundary,
    WidthCount=expr("x-1", bitmap_properties.Width),
    HeightCount=expr("x-1", bitmap_properties.Height))  # -> Mesh, Area
split_ahsv = SplitAHSV(Colour=deconstruct_bitmap)  # -> Alpha, Hue, Saturation, Value
deconstruct_mesh = DeconstructMesh(Mesh=mesh_plane.Mesh)  # -> Vertices, Faces, Colours, Normals
point = Point(deconstruct_mesh.Vertices)
noise = Number(split_ahsv.Value)

# ----
# attractor
point_2 = Point(point)
yz_plane = YZPlane(Origin=Point(0, 0, 0))
scale = Slider(2, range=0..10)
noise_2 = Number(noise)
# grid
attraction = Slider(8, range=0..25)
bounds = Bounds(Numbers=noise_2)
rotate = Rotate(Geometry=point_2, Angle=1.570796327, Plane=yz_plane)  # -> Geometry, Transform
remap_numbers = RemapNumbers(Value=noise_2, Source=bounds, Target=attraction)  # -> Mapped, Clipped
scale_2 = Scale(Geometry=rotate.Geometry, Center=Point(0, 0, 0), Factor=scale)  # -> Geometry, Transform
unit_y = UnitY(Factor=remap_numbers.Mapped)
move = Move(Geometry=scale_2.Geometry, Motion=unit_y)  # -> Geometry, Transform
attractors = Point(move.Geometry)

size = Slider(1, range=0..100)
extent_x = Slider(36, range=0..100)
extent_x_2 = Slider(9, range=0..100)
attractors_2 = Point(attractors)
min = Slider(0.5, range=0..2)
max = Slider(3, range=0..10)
xz_plane = XZPlane(Origin=Point(0, 0, 0))
hexagonal = Hexagonal(Plane=xz_plane, Size=size, ExtentX=extent_x, ExtentY=extent_x_2)  # -> flatten(Cells), flatten(Points)
domain = ConstructDomain(DomainStart=min, DomainEnd=max)
closest_point = ClosestPoint(Point=hexagonal.Points, Cloud=attractors_2)  # -> ClosestPoint, CPIndex, Distance
bounds_2 = Bounds(Numbers=closest_point.Distance)
remap_numbers_2 = RemapNumbers(Value=closest_point.Distance, Source=bounds_2, Target=domain)  # -> Mapped, Clipped
negative = Negative(Value=remap_numbers_2.Mapped)
unit_y_2 = UnitY(Factor=negative)
move_2 = Move(Geometry=hexagonal.Cells, Motion=unit_y_2)  # -> Geometry, Transform
number = Number(remap_numbers_2.Mapped)
curve = Curve(hexagonal.Cells)
curve_2 = Curve(move_2.Geometry)

# ----
# transformations
curve_3 = Curve(curve_2)
radius = Slider(0.5, range=0..1)
rotation = Slider(45, range=0..100)
# surface
z_shift = Slider(0.5, range=0..2)
area = Area(Geometry=curve_3)  # -> Area, Centroid
centroid = Point(area.Centroid)
circle = Circle(Plane=area.Centroid, Radius=radius)
yz_plane_2 = YZPlane(Origin=centroid)
rotate_2 = Rotate(Geometry=circle, Angle=degrees(rotation), Plane=yz_plane_2)  # -> Geometry, Transform
unit_z = UnitZ(Factor=z_shift)
move_3 = Move(Geometry=rotate_2.Geometry, Motion=unit_z)  # -> Geometry, Transform
curve_4 = Curve(move_3.Geometry)

curve_5 = Curve(curve)
curve_6 = Curve(curve_4)
range = Range(Domain=Domain(0, 1), Steps=10)
min_2 = Integer(min)
max_2 = Integer(max)
number_2 = Number(number)
tween_curve = TweenCurve(CurveA=curve_5, CurveB=curve_6, Factor=graft(range), BlendType=0)
flip_matrix = FlipMatrix(Data=tween_curve)
gradient = Gradient(
    LowerLimit=min_2,
    UpperLimit=max_2,
    Parameter=number_2,
    stops=[0: RGB(68, 1, 84), 0.167: RGB(68, 57, 131), 0.334: RGB(49, 104, 142), 0.501: RGB(33, 145, 140), 0.668: RGB(53, 183, 121), 0.835: RGB(144, 215, 67), 1: RGB(253, 231, 37)])
loft = Loft(Curves=flip_matrix, Options={Adjust=False, Closed=False, LoftEnds=0, LoftSimp=0, LoftType=0, Rebuild=10, Refit=0.01})
custom_preview = CustomPreview(Geometry=flatten(loft), Material=gradient)

# ----
# base
cells = Curve(hexagonal.Cells)
depth_2 = Slider(1, range=0..10)
unit_y_3 = UnitY(Factor=depth_2)
extrude = Extrude(Base=cells, Direction=unit_y_3)
move_4 = Move(Geometry=cells, Motion=unit_y_3)  # -> Geometry, Transform
boundary_surfaces = BoundarySurfaces(Edges=move_4.Geometry)
relay = Relay([extrude, boundary_surfaces])
colour = Colour(gradient)
custom_preview_2 = CustomPreview(Geometry=relay, Material=colour)
