# Grasshopper definition living-wall-3.gh (Grasshopper 1.0.7)
# Copyright: GNU General Public License 3.0

radius = Slider(1.5, range=0..10)
segements = Slider(6, range=0..10)
fillet = Slider(0.25, range=0..1)
radius_2 = Slider(0.75, range=0..2)
X = Slider(1, range=0..3)
rotation = Slider(45, range=0..100)
# living wall
# module
yz_plane = YZPlane(Origin=Point(0, 0, 0))
xz_plane = XZPlane(Origin=Point(0, 0, 0))
plane = Plane(yz_plane)
polygon = Polygon(Plane=yz_plane, Radius=radius, Segments=segements, FilletRadius=fillet)  # -> Polygon, Length
circle_cnr = CircleCNR(Center=plane, Normal=plane, Radius=radius_2)
unit_x = UnitX(Factor=X)
move = Move(Geometry=circle_cnr, Motion=unit_x)  # -> Geometry, Transform
rotate = Rotate(Geometry=move.Geometry, Angle=degrees(rotation), Plane=xz_plane)  # -> Geometry, Transform
range = Range(Domain=Domain(0, 1), Steps=10)
curve = Curve(polygon.Polygon)
area = Area(Geometry=curve)  # -> Area, Centroid
tween_curve = TweenCurve(CurveA=curve, CurveB=rotate.Geometry, Factor=range, BlendType=0)
loft = Loft(Curves=tween_curve, Options={Adjust=False, Closed=False, LoftEnds=0, LoftSimp=0, LoftType=0, Rebuild=10, Refit=0.01})
custom_preview = CustomPreview(Geometry=loft, Material=ColourSwatch(SwatchColor=RGB(189, 189, 189)))
centroid = Point(area.Centroid)
module = Brep(loft)

# ----
# hexagonal grid
module_2 = Brep(module)
centroid_2 = Point(centroid)
extent_y = Slider(30, range=0..100)
extent_z = Slider(10, range=0..100)
yz_plane_2 = YZPlane(Origin=Point(0, 0, 0))
radius_3 = Number(radius)
expression = Expression(r=radius_3, x=extent_y, Expression="x/2*r")
expression_2 = Expression(r=radius_3, x=extent_z, Expression="x/2*r")
hexagonal = Hexagonal(Plane=yz_plane_2, Size=radius_3, ExtentX=expression, ExtentY=expression_2)  # -> flatten(Cells), Points
area_2 = Area(Geometry=hexagonal.Cells)  # -> Area, Centroid
vector_2pt = Vector2Pt(PointA=centroid_2, PointB=area_2.Centroid, Unitize=False)  # -> Vector, Length
move_2 = Move(Geometry=module_2, Motion=vector_2pt.Vector)  # -> Geometry, Transform
custom_preview_2 = CustomPreview(Geometry=move_2.Geometry, Material=ColourSwatch(SwatchColor=RGB(189, 189, 189)))
modules = Brep(move_2.Geometry)

radius_4 = Slider(1.5, range=0..10)
segements_2 = Slider(6, range=0..10)
# scaled grid
yz_plane_3 = YZPlane(Origin=Point(0, 0, 0))
polygon_2 = Polygon(Plane=yz_plane_3, Radius=radius_4, Segments=segements_2, FilletRadius=0)  # -> Polygon, Length
curve_2 = Curve(polygon_2.Polygon)

curve_3 = Curve(curve_2)
radius_5 = Number(radius_4)
extent_z_2 = Slider(10, range=0..100)
expression_3 = Expression(r=radius_5, Expression="r*0.8660254*2")
expression_4 = Expression(r=radius_5, x=extent_z_2, Expression="x/2*r")
series = Series(Start=0, Step=expression_3, Count=expression_4)
unit_z = UnitZ(Factor=series)
move_3 = Move(Geometry=curve_3, Motion=unit_z)  # -> Geometry, Transform
curve_4 = Curve(move_3.Geometry)

curve_5 = Curve(curve_4)
radius_6 = Number(radius_4)
expression_5 = Expression(r=radius_6, Expression="r*0.8660254")
expression_6 = Expression(r=radius_6, Expression="r*1.5")
# horizontal scaling
# S M L M S
# 
# refine module shape
# 
# solid module
# 
# multiple opening module
expression_7 = Expression(r=radius_6, Expression="r/2*1.25")
unit_z_2 = UnitZ(Factor=expression_5)
move_4 = Move(Geometry=curve_5, Motion=unit_z_2)  # -> Geometry, Transform
unit_y = UnitY(Factor=expression_6)
move_5 = Move(Geometry=move_4.Geometry, Motion=unit_y)  # -> Geometry, Transform
discontinuity = Discontinuity(Curve=move_5.Geometry, Level=1)  # -> Points, Parameters
shift_list = ShiftList(List=discontinuity.Points, Shift="-1", Wrap=True)
unit_y_2 = UnitY(Factor=expression_7)
split_list = SplitList(List=shift_list, Index="3")  # -> ListA, ListB
move_6 = Move(Geometry=split_list.ListA, Motion=unit_y_2)  # -> Geometry, Transform
merge = Merge(Data1=move_6.Geometry, Data2=split_list.ListB)
polyline = PolyLine(Vertices=merge, Closed=False)

repeat_data = RepeatData()
