# Grasshopper definition lungomare-bench-matrix.gh (Grasshopper 1.0.7)
# Copyright: GNU General Public License 3.0

# ----
# lungomare bench
# design matrix
initial_frequency = Slider(1, range=0..10)
frequency = Slider(3, range=0..10)
steps = Slider(4, range=0..10)
start = Slider(0.6, range=0..1)
amplitude = Slider(0.2, range=0..1)
count = Slider(4, range=0..10)
distance = Slider(50, range=0..100)
scale_x = Slider(30, range=0..100)
scale_y = Slider(30, range=0..100)
scale_z = Slider(20, range=0..100)
depth = Slider(10, range=0..100)
lungomare_bench = LungomareBench(
    initial_frequency=initial_frequency,
    frequency=frequency,
    steps=steps,
    start=start,
    amplitude=amplitude,
    count=count,
    distance=distance,
    scale_x=scale_x,
    scale_y=scale_y,
    scale_z=scale_z,
    depth=depth)

initial_frequency_2 = Slider(1, range=0..10)
frequency_2 = Slider(3, range=0..10)
steps_2 = Slider(4, range=0..10)
start_2 = Slider(0.6, range=0..1)
amplitude_2 = Slider(0.45, range=0..1)
count_2 = Slider(4, range=0..10)
distance_2 = Slider(50, range=0..100)
scale_x_2 = Slider(30, range=0..100)
scale_y_2 = Slider(30, range=0..100)
scale_z_2 = Slider(20, range=0..100)
depth_2 = Slider(10, range=0..100)
lungomare_bench_2 = LungomareBench_2(
    initial_frequency=initial_frequency_2,
    frequency=frequency_2,
    steps=steps_2,
    start=start_2,
    amplitude=amplitude_2,
    count=count_2,
    distance=distance_2,
    scale_x=scale_x_2,
    scale_y=scale_y_2,
    scale_z=scale_z_2,
    depth=depth_2)

initial_frequency_3 = Slider(1, range=0..10)
frequency_3 = Slider(3, range=0..10)
steps_3 = Slider(4, range=0..10)
start_3 = Slider(0.6, range=0..1)
amplitude_3 = Slider(0.65, range=0..1)
count_3 = Slider(4, range=0..10)
distance_3 = Slider(50, range=0..100)
scale_x_3 = Slider(30, range=0..100)
scale_y_3 = Slider(30, range=0..100)
scale_z_3 = Slider(20, range=0..100)
depth_3 = Slider(10, range=0..100)
lungomare_bench_3 = LungomareBench_2(
    initial_frequency=initial_frequency_3,
    frequency=frequency_3,
    steps=steps_3,
    start=start_3,
    amplitude=amplitude_3,
    count=count_3,
    distance=distance_3,
    scale_x=scale_x_3,
    scale_y=scale_y_3,
    scale_z=scale_z_3,
    depth=depth_3)

initial_frequency_4 = Slider(1, range=0..10)
frequency_4 = Slider(3, range=0..10)
steps_4 = Slider(4, range=0..10)
start_4 = Slider(0.6, range=0..1)
amplitude_4 = Slider(0.85, range=0..1)
count_4 = Slider(4, range=0..10)
distance_4 = Slider(50, range=0..100)
scale_x_4 = Slider(30, range=0..100)
scale_y_4 = Slider(30, range=0..100)
scale_z_4 = Slider(20, range=0..100)
depth_4 = Slider(10, range=0..100)
lungomare_bench_4 = LungomareBench_2(
    initial_frequency=initial_frequency_4,
    frequency=frequency_4,
    steps=steps_4,
    start=start_4,
    amplitude=amplitude_4,
    count=count_4,
    distance=distance_4,
    scale_x=scale_x_4,
    scale_y=scale_y_4,
    scale_z=scale_z_4,
    depth=depth_4)

initial_frequency_5 = Slider(1, range=0..10)
frequency_5 = Slider(3, range=0..10)
steps_5 = Slider(4, range=0..10)
start_5 = Slider(0.6, range=0..1)
amplitude_5 = Slider(0.25, range=0..1)
count_5 = Slider(4, range=0..10)
distance_5 = Slider(50, range=0..100)
scale_x_5 = Slider(30, range=0..100)
scale_y_5 = Slider(30, range=0..100)
scale_z_5 = Slider(20, range=0..100)
depth_5 = Slider(10, range=0..100)
lungomare_bench_5 = LungomareBench_2(
    initial_frequency=initial_frequency_5,
    frequency=frequency_5,
    steps=steps_5,
    start=start_5,
    amplitude=amplitude_5,
    count=count_5,
    distance=distance_5,
    scale_x=scale_x_5,
    scale_y=scale_y_5,
    scale_z=scale_z_5,
    depth=depth_5)

initial_frequency_6 = Slider(1, range=0..10)
frequency_6 = Slider(3, range=0..10)
steps_6 = Slider(4, range=0..10)
start_6 = Slider(0.6, range=0..1)
amplitude_6 = Slider(0.5, range=0..1)
count_6 = Slider(4, range=0..10)
distance_6 = Slider(50, range=0..100)
scale_x_6 = Slider(30, range=0..100)
scale_y_6 = Slider(30, range=0..100)
scale_z_6 = Slider(20, range=0..100)
depth_6 = Slider(10, range=0..100)
lungomare_bench_6 = LungomareBench_2(
    initial_frequency=initial_frequency_6,
    frequency=frequency_6,
    steps=steps_6,
    start=start_6,
    amplitude=amplitude_6,
    count=count_6,
    distance=distance_6,
    scale_x=scale_x_6,
    scale_y=scale_y_6,
    scale_z=scale_z_6,
    depth=depth_6)

initial_frequency_7 = Slider(1, range=0..10)
frequency_7 = Slider(3, range=0..10)
steps_7 = Slider(4, range=0..10)
start_7 = Slider(0.6, range=0..1)
amplitude_7 = Slider(0.7, range=0..1)
count_7 = Slider(4, range=0..10)
distance_7 = Slider(50, range=0..100)
scale_x_7 = Slider(30, range=0..100)
scale_y_7 = Slider(30, range=0..100)
scale_z_7 = Slider(20, range=0..100)
depth_7 = Slider(10, range=0..100)
lungomare_bench_7 = LungomareBench_2(
    initial_frequency=initial_frequency_7,
    frequency=frequency_7,
    steps=steps_7,
    start=start_7,
    amplitude=amplitude_7,
    count=count_7,
    distance=distance_7,
    scale_x=scale_x_7,
    scale_y=scale_y_7,
    scale_z=scale_z_7,
    depth=depth_7)

initial_frequency_8 = Slider(1, range=0..10)
frequency_8 = Slider(3, range=0..10)
steps_8 = Slider(4, range=0..10)
start_8 = Slider(0.6, range=0..1)
amplitude_8 = Slider(0.95, range=0..1)
count_8 = Slider(4, range=0..10)
distance_8 = Slider(50, range=0..100)
scale_x_8 = Slider(30, range=0..100)
scale_y_8 = Slider(30, range=0..100)
scale_z_8 = Slider(20, range=0..100)
depth_8 = Slider(10, range=0..100)
lungomare_bench_8 = LungomareBench_2(
    initial_frequency=initial_frequency_8,
    frequency=frequency_8,
    steps=steps_8,
    start=start_8,
    amplitude=amplitude_8,
    count=count_8,
    distance=distance_8,
    scale_x=scale_x_8,
    scale_y=scale_y_8,
    scale_z=scale_z_8,
    depth=depth_8)

initial_frequency_9 = Slider(1, range=0..10)
frequency_9 = Slider(3, range=0..10)
steps_9 = Slider(4, range=0..10)
start_9 = Slider(0.6, range=0..1)
amplitude_9 = Slider(0.3, range=0..1)
count_9 = Slider(4, range=0..10)
distance_9 = Slider(50, range=0..100)
scale_x_9 = Slider(30, range=0..100)
scale_y_9 = Slider(30, range=0..100)
scale_z_9 = Slider(20, range=0..100)
depth_9 = Slider(10, range=0..100)
lungomare_bench_9 = LungomareBench_2(
    initial_frequency=initial_frequency_9,
    frequency=frequency_9,
    steps=steps_9,
    start=start_9,
    amplitude=amplitude_9,
    count=count_9,
    distance=distance_9,
    scale_x=scale_x_9,
    scale_y=scale_y_9,
    scale_z=scale_z_9,
    depth=depth_9)

initial_frequency_10 = Slider(1, range=0..10)
frequency_10 = Slider(3, range=0..10)
steps_10 = Slider(4, range=0..10)
start_10 = Slider(0.6, range=0..1)
amplitude_10 = Slider(0.55, range=0..1)
count_10 = Slider(4, range=0..10)
distance_10 = Slider(50, range=0..100)
scale_x_10 = Slider(30, range=0..100)
scale_y_10 = Slider(30, range=0..100)
scale_z_10 = Slider(20, range=0..100)
depth_10 = Slider(10, range=0..100)
lungomare_bench_10 = LungomareBench_2(
    initial_frequency=initial_frequency_10,
    frequency=frequency_10,
    steps=steps_10,
    start=start_10,
    amplitude=amplitude_10,
    count=count_10,
    distance=distance_10,
    scale_x=scale_x_10,
    scale_y=scale_y_10,
    scale_z=scale_z_10,
    depth=depth_10)

initial_frequency_11 = Slider(1, range=0..10)
frequency_11 = Slider(3, range=0..10)
steps_11 = Slider(4, range=0..10)
start_11 = Slider(0.6, range=0..1)
amplitude_11 = Slider(0.75, range=0..1)
count_11 = Slider(4, range=0..10)
distance_11 = Slider(50, range=0..100)
scale_x_11 = Slider(30, range=0..100)
scale_y_11 = Slider(30, range=0..100)
scale_z_11 = Slider(20, range=0..100)
depth_11 = Slider(10, range=0..100)
lungomare_bench_11 = LungomareBench_2(
    initial_frequency=initial_frequency_11,
    frequency=frequency_11,
    steps=steps_11,
    start=start_11,
    amplitude=amplitude_11,
    count=count_11,
    distance=distance_11,
    scale_x=scale_x_11,
    scale_y=scale_y_11,
    scale_z=scale_z_11,
    depth=depth_11)

initial_frequency_12 = Slider(1, range=0..10)
frequency_12 = Slider(3, range=0..10)
steps_12 = Slider(4, range=0..10)
start_12 = Slider(0.6, range=0..1)
amplitude_12 = Slider(1, range=0..1)
count_12 = Slider(4, range=0..10)
distance_12 = Slider(50, range=0..100)
scale_x_12 = Slider(30, range=0..100)
scale_y_12 = Slider(30, range=0..100)
scale_z_12 = Slider(20, range=0..100)
depth_12 = Slider(10, range=0..100)
lungomare_bench_12 = LungomareBench_2(
    initial_frequency=initial_frequency_12,
    frequency=frequency_12,
    steps=steps_12,
    start=start_12,
    amplitude=amplitude_12,
    count=count_12,
    distance=distance_12,
    scale_x=scale_x_12,
    scale_y=scale_y_12,
    scale_z=scale_z_12,
    depth=depth_12)

initial_frequency_13 = Slider(1, range=0..10)
frequency_13 = Slider(3, range=0..10)
steps_13 = Slider(4, range=0..10)
start_13 = Slider(0.6, range=0..1)
amplitude_13 = Slider(0.4, range=0..1)
count_13 = Slider(4, range=0..10)
distance_13 = Slider(50, range=0..100)
scale_x_13 = Slider(30, range=0..100)
scale_y_13 = Slider(30, range=0..100)
scale_z_13 = Slider(20, range=0..100)
depth_13 = Slider(10, range=0..100)
lungomare_bench_13 = LungomareBench_2(
    initial_frequency=initial_frequency_13,
    frequency=frequency_13,
    steps=steps_13,
    start=start_13,
    amplitude=amplitude_13,
    count=count_13,
    distance=distance_13,
    scale_x=scale_x_13,
    scale_y=scale_y_13,
    scale_z=scale_z_13,
    depth=depth_13)

initial_frequency_14 = Slider(1, range=0..10)
frequency_14 = Slider(3, range=0..10)
steps_14 = Slider(4, range=0..10)
start_14 = Slider(0.6, range=0..1)
amplitude_14 = Slider(0.6, range=0..1)
count_14 = Slider(4, range=0..10)
distance_14 = Slider(50, range=0..100)
scale_x_14 = Slider(30, range=0..100)
scale_y_14 = Slider(30, range=0..100)
scale_z_14 = Slider(20, range=0..100)
depth_14 = Slider(10, range=0..100)
lungomare_bench_14 = LungomareBench_2(
    initial_frequency=initial_frequency_14,
    frequency=frequency_14,
    steps=steps_14,
    start=start_14,
    amplitude=amplitude_14,
    count=count_14,
    distance=distance_14,
    scale_x=scale_x_14,
    scale_y=scale_y_14,
    scale_z=scale_z_14,
    depth=depth_14)

initial_frequency_15 = Slider(1, range=0..10)
frequency_15 = Slider(3, range=0..10)
steps_15 = Slider(4, range=0..10)
start_15 = Slider(0.6, range=0..1)
amplitude_15 = Slider(0.8, range=0..1)
count_15 = Slider(4, range=0..10)
distance_15 = Slider(50, range=0..100)
scale_x_15 = Slider(30, range=0..100)
scale_y_15 = Slider(30, range=0..100)
scale_z_15 = Slider(20, range=0..100)
depth_15 = Slider(10, range=0..100)
lungomare_bench_15 = LungomareBench_2(
    initial_frequency=initial_frequency_15,
    frequency=frequency_15,
    steps=steps_15,
    start=start_15,
    amplitude=amplitude_15,
    count=count_15,
    distance=distance_15,
    scale_x=scale_x_15,
    scale_y=scale_y_15,
    scale_z=scale_z_15,
    depth=depth_15)

initial_frequency_16 = Slider(1, range=0..10)
frequency_16 = Slider(3, range=0..10)
steps_16 = Slider(4, range=0..10)
start_16 = Slider(0.6, range=0..1)
amplitude_16 = Slider(1.05, range=0..2)
count_16 = Slider(4, range=0..10)
distance_16 = Slider(50, range=0..100)
scale_x_16 = Slider(30, range=0..100)
scale_y_16 = Slider(30, range=0..100)
scale_z_16 = Slider(20, range=0..100)
depth_16 = Slider(10, range=0..100)
lungomare_bench_16 = LungomareBench_2(
    initial_frequency=initial_frequency_16,
    frequency=frequency_16,
    steps=steps_16,
    start=start_16,
    amplitude=amplitude_16,
    count=count_16,
    distance=distance_16,
    scale_x=scale_x_16,
    scale_y=scale_y_16,
    scale_z=scale_z_16,
    depth=depth_16)

row = Slider(0, range=0..10)
brep = Brep([lungomare_bench, lungomare_bench_5, lungomare_bench_9, lungomare_bench_13])
number_slider = Slider(250, range=0..1000)
list_length = ListLength(List=brep)
series = Series(Start=0, Step=number_slider, Count=list_length)
unit_x = UnitX(Factor=series)
move = Move(Geometry=brep, Motion=unit_x)  # -> Geometry, Transform
multiplication = Multiplication(A=number_slider, B=row)
unit_y = UnitY(Factor=multiplication)
move_2 = Move(Geometry=move.Geometry, Motion=unit_y)  # -> Geometry, Transform
custom_preview = CustomPreview(Geometry=move_2.Geometry, Material=ColourSwatch(SwatchColor=RGB(204, 204, 204)))

row_2 = Slider(1, range=0..10)
brep_2 = Brep([lungomare_bench_2, lungomare_bench_6, lungomare_bench_10, lungomare_bench_14])
number_slider_2 = Slider(250, range=0..1000)
list_length_2 = ListLength(List=brep_2)
series_2 = Series(Start=0, Step=number_slider_2, Count=list_length_2)
unit_x_2 = UnitX(Factor=series_2)
move_3 = Move(Geometry=brep_2, Motion=unit_x_2)  # -> Geometry, Transform
multiplication_2 = Multiplication(A=number_slider_2, B=row_2)
unit_y_2 = UnitY(Factor=multiplication_2)
move_4 = Move(Geometry=move_3.Geometry, Motion=unit_y_2)  # -> Geometry, Transform
custom_preview_2 = CustomPreview(Geometry=move_4.Geometry, Material=ColourSwatch(SwatchColor=RGB(204, 204, 204)))

brep_3 = Brep([lungomare_bench_3, lungomare_bench_7, lungomare_bench_11, lungomare_bench_15])
row_3 = Slider(2, range=0..10)
number_slider_3 = Slider(250, range=0..1000)
list_length_3 = ListLength(List=brep_3)
series_3 = Series(Start=0, Step=number_slider_3, Count=list_length_3)
unit_x_3 = UnitX(Factor=series_3)
move_5 = Move(Geometry=brep_3, Motion=unit_x_3)  # -> Geometry, Transform
multiplication_3 = Multiplication(A=number_slider_3, B=row_3)
unit_y_3 = UnitY(Factor=multiplication_3)
move_6 = Move(Geometry=move_5.Geometry, Motion=unit_y_3)  # -> Geometry, Transform
custom_preview_3 = CustomPreview(Geometry=move_6.Geometry, Material=ColourSwatch(SwatchColor=RGB(204, 204, 204)))

brep_4 = Brep([lungomare_bench_4, lungomare_bench_8, lungomare_bench_12, lungomare_bench_16])
row_4 = Slider(3, range=0..10)
number_slider_4 = Slider(250, range=0..1000)
list_length_4 = ListLength(List=brep_4)
series_4 = Series(Start=0, Step=number_slider_4, Count=list_length_4)
unit_x_4 = UnitX(Factor=series_4)
move_7 = Move(Geometry=brep_4, Motion=unit_x_4)  # -> Geometry, Transform
multiplication_4 = Multiplication(A=number_slider_4, B=row_4)
unit_y_4 = UnitY(Factor=multiplication_4)
move_8 = Move(Geometry=move_7.Geometry, Motion=unit_y_4)  # -> Geometry, Transform
custom_preview_4 = CustomPreview(Geometry=move_8.Geometry, Material=ColourSwatch(SwatchColor=RGB(204, 204, 204)))

# ==== cluster LungomareBench
frequency = ClusterInput()
steps = ClusterInput()
start = ClusterInput()
amplitude = ClusterInput()
scale_z = ClusterInput()
scale_y = ClusterInput()
count = ClusterInput()
scale_x = ClusterInput()
initial_frequency = ClusterInput()
distance = ClusterInput()
depth = ClusterInput()
count_2 = Number(count)
pi = Pi(InitialFrequency=initial_frequency)
pi_2 = Pi(Frequency=frequency)
series = Series(Start=start, Amplitude=amplitude, Count=count_2)
construct_domain = ConstructDomain(DomainStart=pi, DomainEnd=pi_2)
steps_2 = Number(steps)
range = Range(Domain=construct_domain, Steps=steps_2)
multiplication = Multiplication(A=range, B=graft(series))
sine = Sine(Value=multiplication)
construct_point = ConstructPoint(XCoordinate=range, YCoordinate=0, ZCoordinate=sine)
series_2 = Series(Start=0, Distance=distance, Count=count_2)
scale_x_2 = Number(scale_x)
interpolate = Interpolate(Vertices=construct_point, Degree=3, Periodic=False, KnotStyle=1)  # -> Curve, Length, Domain
scale_y_2 = Number(scale_y)
scale_z_2 = Number(scale_z)
scale_nu = ScaleNU(Geometry=interpolate.Curve, Plane=PlaneXY(0, 0, 0), ScaleX=scale_x_2, ScaleY=scale_y_2, ScaleZ=scale_z_2)  # -> Geometry, Transform
unit_y = UnitY(Factor=series_2)
move = Move(Geometry=flatten(scale_nu.Geometry), Motion=unit_y)  # -> Geometry, Transform
unit_z = UnitZ(Factor=depth)
loft = Loft(Curves=move.Geometry, Options={Adjust=False, Closed=False, LoftEnds=0, LoftSimp=0, LoftType=0, Rebuild=10, Refit=0.01})
extrude = Extrude(Base=loft, Direction=unit_z)
bench = Brep(extrude)
bench_2 = ClusterOutput(bench)

# ==== cluster LungomareBench_2
count = ClusterInput()
initial_frequency = ClusterInput()
frequency = ClusterInput()
start = ClusterInput()
amplitude = ClusterInput()
count_2 = Number(count)
pi = Pi(InitialFrequency=initial_frequency)
pi_2 = Pi(Frequency=frequency)
series = Series(Start=start, Amplitude=amplitude, Count=count_2)
construct_domain = ConstructDomain(DomainStart=pi, DomainEnd=pi_2)
steps = ClusterInput()
steps_2 = Number(steps)
range = Range(Domain=construct_domain, Steps=steps_2)
multiplication = Multiplication(A=range, B=graft(series))
sine = Sine(Value=multiplication)
distance = ClusterInput()
construct_point = ConstructPoint(XCoordinate=range, YCoordinate=0, ZCoordinate=sine)
series_2 = Series(Start=0, Distance=distance, Count=count_2)
scale_x = ClusterInput()
scale_y = ClusterInput()
scale_x_2 = Number(scale_x)
scale_z = ClusterInput()
interpolate = Interpolate(Vertices=construct_point, Degree=3, Periodic=False, KnotStyle=1)  # -> Curve, Length, Domain
scale_y_2 = Number(scale_y)
scale_z_2 = Number(scale_z)
scale_nu = ScaleNU(Geometry=interpolate.Curve, Plane=PlaneXY(0, 0, 0), ScaleX=scale_x_2, ScaleY=scale_y_2, ScaleZ=scale_z_2)  # -> Geometry, Transform
unit_y = UnitY(Factor=series_2)
depth = ClusterInput()
move = Move(Geometry=flatten(scale_nu.Geometry), Motion=unit_y)  # -> Geometry, Transform
unit_z = UnitZ(Factor=depth)
loft = Loft(Curves=move.Geometry, Options={Adjust=False, Closed=False, LoftEnds=0, LoftSimp=0, LoftType=0, Rebuild=10, Refit=0.01})
extrude = Extrude(Base=loft, Direction=unit_z)
bench = Brep(extrude)
bench_2 = ClusterOutput(bench)
