# Grasshopper definition lungomare-bench-random-matrix.gh (Grasshopper 1.0.7)
# Copyright: GNU General Public License 3.0

# ---- group: generate a family of forms
# lungomare bench
# design matrix
initial_frequency = Slider(1, range=0..10)
frequency = Slider(3, range=0..10)
steps = Slider(4, range=0..10)
curves = Slider(4, range=0..10)
designs = Slider(24, range=0..100)
seed = Slider(0, range=0..100)
distance = Slider(50, range=0..100)
scale_x = Slider(30, range=0..100)
scale_z = Slider(20, range=0..100)
depth = Slider(10, range=0..100)
spacing = Slider(225, range=0..1000)
random = Random(Range="0 To 10000", Number=designs, Seed=seed)
random_2 = Random(Range="0.5 to 1.5", Number=curves, Seed=random)
pi = Pi(Factor=initial_frequency)
pi_2 = Pi(Factor=frequency)
construct_domain = ConstructDomain(DomainStart=pi, DomainEnd=pi_2)
range = Range(Domain=construct_domain, Steps=steps)
multiplication = Multiplication(A=range, B=graft(random_2))
sine = Sine(Value=multiplication)
construct_point = ConstructPoint(XCoordinate=range, YCoordinate=0, ZCoordinate=sine)
series = Series(Start=0, Step=distance, Count=curves)
interpolate = Interpolate(Vertices=construct_point, Degree=3, Periodic=False, KnotStyle=1)  # -> Curve, Length, Domain
scale_nu = ScaleNU(Geometry=interpolate.Curve, Plane=PlaneXY(0, 0, 0), ScaleX=scale_x, ScaleY=1, ScaleZ=scale_z)  # -> Geometry, Transform
unit_y = UnitY(Factor=series)
curves_2 = Number(curves)
unit_z = UnitZ(Factor=depth)
partition_list = PartitionList(List=flatten(scale_nu.Geometry), Size=curves_2)
move = Move(Geometry=partition_list, Motion=unit_y)  # -> Geometry, Transform
loft = Loft(Curves=move.Geometry, Options={Adjust=False, Closed=False, LoftEnds=0, LoftSimp=0, LoftType=0, Rebuild=10, Refit=0.01})
extrude = Extrude(Base=loft, Direction=unit_z)

# ---- group: arrange in a matrix
brep = Brep(extrude)
designs_2 = Number(designs)
square_root = SquareRoot(Value=designs_2)
division = Division(A=designs_2, B=square_root)
partition_list_2 = PartitionList(List=flatten(brep), Size=division)
series_2 = Series(Start=0, Step=spacing, Count=division)
unit_x = UnitX(Factor=series_2)
unit_y_2 = UnitY(Factor=series_2)
move_2 = Move(Geometry=partition_list_2, Motion=unit_x)  # -> Geometry, Transform
move_3 = Move(Geometry=move_2.Geometry, Motion=graft(unit_y_2))  # -> Geometry, Transform
custom_preview = CustomPreview(Geometry=move_3.Geometry, Material=ColourSwatch(SwatchColor=RGB(204, 204, 204)))
