# Grasshopper definition noise-v0.gh (Grasshopper 1.0.7)
# Copyright: GNU General Public License 3.0
# plug-ins: Noise 4D, BitmapPlus

# ----
# noise with grasshopper
# perlin noise list
# perlin noise grid
count = Slider(10, range=0..100)
series = Series(Start=0, Step=1, Count=count)
graph_mapper = GraphMapper(
    series,
    x0=0,
    x1=1,
    y0=0,
    y1=1,
    amplitude=0.3081877232,
    container_name="Perlin",
    decay=0.5007970333,
    frequency=0.1,
    x_offset=0.6109933257,
    y_offset=0.5023454428)
panel = Panel(graph_mapper)

cellsize = Slider(1, range=0..10)
extent_x = Slider(25, range=0..100)
extent_y = Slider(25, range=0..100)
square = Square(Plane=PlaneXY(0, 0, 0), Size=cellsize, ExtentX=extent_x, ExtentY=extent_y)  # -> flatten(Cells), Points
boundary_surfaces = BoundarySurfaces(Edges=square.Cells)
list_length = ListLength(List=square.Cells)
series_2 = Series(Start=0, Step=1, Count=list_length)
graph_mapper_2 = GraphMapper(
    series_2,
    x0=0,
    x1=1,
    y0=0,
    y1=1,
    amplitude=0.3081877232,
    container_name="Perlin",
    decay=0.5007970333,
    frequency=0.1,
    x_offset=0.6109933257,
    y_offset=0.5023454428)
bounds = Bounds(Numbers=graph_mapper_2)
deconstruct_domain = DeconstructDomain(Domain=bounds)  # -> Start, End
gradient = Gradient(
    LowerLimit=deconstruct_domain.Start,
    UpperLimit=deconstruct_domain.End,
    Parameter=graph_mapper_2,
    stops=[0: RGB(68, 1, 84), 0.167: RGB(68, 57, 131), 0.334: RGB(49, 104, 142), 0.501: RGB(33, 145, 140), 0.668: RGB(53, 183, 121), 0.835: RGB(144, 215, 67), 1: RGB(253, 231, 37)])
custom_preview = CustomPreview(Geometry=boundary_surfaces, Material=gradient)

# ----
# noise4d
# perlin noise grid
cellsize_2 = Slider(1, range=0..10)
extent_x_2 = Slider(50, range=0..100)
extent_y_2 = Slider(50, range=0..100)
time = Slider(0, range=0..100)
scale = Slider(0.16, range=0..1)
square_2 = Square(Plane=PlaneXY(0, 0, 0), Size=cellsize_2, ExtentX=extent_x_2, ExtentY=extent_y_2)  # -> flatten(Cells), Points
area = Area(Geometry=square_2.Cells)  # -> Area, Centroid
perlinnoise = PerlinNoise(Values=area.Centroid, Time=time, Scale=scale)
unit_z = UnitZ(Factor=cellsize_2)
extrude = Extrude(Base=square_2.Cells, Direction=unit_z)
bounds_2 = Bounds(Numbers=perlinnoise)
deconstruct_domain_2 = DeconstructDomain(Domain=bounds_2)  # -> Start, End
cap_holes = CapHoles(Brep=extrude)
gradient_2 = Gradient(
    LowerLimit=deconstruct_domain_2.Start,
    UpperLimit=deconstruct_domain_2.End,
    Parameter=perlinnoise,
    stops=[0: RGB(68, 1, 84), 0.167: RGB(68, 57, 131), 0.334: RGB(49, 104, 142), 0.501: RGB(33, 145, 140), 0.668: RGB(53, 183, 121), 0.835: RGB(144, 215, 67), 1: RGB(253, 231, 37)])
custom_preview_2 = CustomPreview(Geometry=cap_holes, Material=gradient_2)

# ----
# perlin noise mesh
extent_x_3 = Slider(25, range=0..100)
extent_y_3 = Slider(25, range=0..100)
time_2 = Slider(0, range=0..100)
scale_2 = Slider(0.16, range=0..1)
rectangle = Rectangle(Plane=PlaneXY(0, 0, 0), XSize=extent_x_3, YSize=extent_y_3, Radius=0)  # -> Rectangle, Length
mesh_plane = MeshPlane(Boundary=rectangle.Rectangle, WidthCount=expr("x-1", extent_x_3), HeightCount=expr("x-1", extent_y_3))  # -> Mesh, Area
deconstruct_mesh = DeconstructMesh(Mesh=mesh_plane.Mesh)  # -> Vertices, Faces, Colours, Normals
perlinnoise_2 = PerlinNoise(Values=deconstruct_mesh.Vertices, Time=time_2, Scale=scale_2)
mesh_face = MeshFace(deconstruct_mesh.Faces)
point = Point(deconstruct_mesh.Vertices)
noise = Number(perlinnoise_2)

point_2 = Point(point)
mesh_face_2 = MeshFace(mesh_face)
z_factor = Slider(1.5, range=0..10)
noise_2 = Number(noise)
bounds_3 = Bounds(Numbers=noise_2)
multiplication = Multiplication(A=z_factor, B=noise_2)
unit_z_2 = UnitZ(Factor=multiplication)
deconstruct_domain_3 = DeconstructDomain(Domain=bounds_3)  # -> Start, End
move = Move(Geometry=point_2, Motion=unit_z_2)  # -> Geometry, Transform
gradient_3 = Gradient(
    LowerLimit=deconstruct_domain_3.Start,
    UpperLimit=deconstruct_domain_3.End,
    Parameter=noise_2,
    stops=[0: RGB(68, 1, 84), 0.167: RGB(68, 57, 131), 0.334: RGB(49, 104, 142), 0.501: RGB(33, 145, 140), 0.668: RGB(53, 183, 121), 0.835: RGB(144, 215, 67), 1: RGB(253, 231, 37)])
construct_mesh = ConstructMesh(Vertices=move.Geometry, Faces=mesh_face_2)
mesh_colours = MeshColours(Mesh=construct_mesh, Colours=gradient_3)
mesh = Mesh(mesh_colours)

# ----
# bitmap+
# perlin noise map
seed = Slider(0, range=0..100)
width = Slider(100, range=0..100)
height = Slider(100, range=0..100)
depth = Slider(1000, range=0..10000)
list = ValueList({"Value": 0, "Perlin": 1, "Cubic": 2, "Simplex": 3, "WhiteNoise": 4}, selected="Perlin")
list_2 = ValueList({"Linear": 0, "Hermite": 1, "Quintic": 2}, selected="Hermite")
frequency = Slider(0.05, range=0..0.1)
procedural_noise = ProceduralNoise(Seed=seed, Width=width, Height=height, Depth=depth, Mode=list, Interpolation=list_2, Frequency=frequency)  # -> Image, Noise
prev_image = PrevImage(SmartBitmap=procedural_noise.Image)

cellsize_3 = Slider(1, range=0..1)
seed_2 = Slider(0, range=0..100)
width_2 = Slider(50, range=0..100)
# perlin noise grid
extent_x_4 = Integer(width_2)
height_2 = Slider(50, range=0..100)
extent_y_4 = Integer(height_2)
depth_2 = Slider(3173, range=0..10000)
list_3 = ValueList({"Value": 0, "Perlin": 1, "Cubic": 2, "Simplex": 3, "WhiteNoise": 4}, selected="Perlin")
list_4 = ValueList({"Linear": 0, "Hermite": 1, "Quintic": 2}, selected="Hermite")
# perlin noise mesh
frequency_2 = Slider(0.094, range=0..0.1)
procedural_noise_2 = ProceduralNoise(Seed=seed_2, Width=width_2, Height=height_2, Depth=depth_2, Mode=list_3, Interpolation=list_4, Frequency=frequency_2)  # -> Image, Noise
square_3 = Square(Plane=PlaneXY(0, 0, 0), Size=cellsize_3, ExtentX=extent_x_4, ExtentY=extent_y_4)  # -> flatten(Cells), Points
deconstruct_bitmap = DeconstructBitmap(Image=procedural_noise_2.Image)
unit_z_3 = UnitZ(Factor=cellsize_3)
text_split = TextSplit(Text=deconstruct_bitmap, Separators=",")
extrude_2 = Extrude(Base=square_3.Cells, Direction=unit_z_3)
list_item = ListItem(List=text_split, Index=0, Wrap=True)  # -> flatten(Item)
cap_holes_2 = CapHoles(Brep=extrude_2)
division = Division(A=list_item, B="255")
gradient_4 = Gradient(
    LowerLimit=0,
    UpperLimit=1,
    Parameter=division,
    stops=[0: RGB(68, 1, 84), 0.167: RGB(68, 57, 131), 0.334: RGB(49, 104, 142), 0.501: RGB(33, 145, 140), 0.668: RGB(53, 183, 121), 0.835: RGB(144, 215, 67), 1: RGB(253, 231, 37)])
custom_preview_3 = CustomPreview(Geometry=cap_holes_2, Material=gradient_4)

seed_3 = Slider(0, range=0..100)
width_3 = Slider(50, range=0..100)
height_3 = Slider(50, range=0..100)
depth_3 = Slider(3173, range=0..10000)
list_5 = ValueList({"Value": 0, "Perlin": 1, "Cubic": 2, "Simplex": 3, "WhiteNoise": 4}, selected="Perlin")
list_6 = ValueList({"Linear": 0, "Hermite": 1, "Quintic": 2}, selected="Hermite")
# perlin noise mesh
frequency_3 = Slider(0.094, range=0..0.1)
procedural_noise_3 = ProceduralNoise(Seed=seed_3, Width=width_3, Height=height_3, Depth=depth_3, Mode=list_5, Interpolation=list_6, Frequency=frequency_3)  # -> Image, Noise
bitmap_properties = BitmapProperties(Image=procedural_noise_3.Image)  # -> Boundary, Width, Height, HorizontalResolution, VerticalResolution, Format
deconstruct_bitmap_2 = DeconstructBitmap(Image=procedural_noise_3.Image)
text_split_2 = TextSplit(Text=deconstruct_bitmap_2, Separators=",")
mesh_plane_2 = MeshPlane(
    Boundary=bitmap_properties.Boundary,
    WidthCount=expr("x-1", bitmap_properties.Width),
    HeightCount=expr("x-1", bitmap_properties.Height))  # -> Mesh, Area
list_item_2 = ListItem(List=text_split_2, Index=0, Wrap=True)  # -> flatten(Item)
division_2 = Division(A=list_item_2, B="255")
gradient_5 = Gradient(
    LowerLimit=0,
    UpperLimit=1,
    Parameter=division_2,
    stops=[0: RGB(68, 1, 84), 0.167: RGB(68, 57, 131), 0.334: RGB(49, 104, 142), 0.501: RGB(33, 145, 140), 0.668: RGB(53, 183, 121), 0.835: RGB(144, 215, 67), 1: RGB(253, 231, 37)])
mesh_colours_2 = MeshColours(Mesh=mesh_plane_2.Mesh, Colours=gradient_5)
mesh_2 = Mesh(mesh_colours_2)

seed_4 = Slider(0, range=0..100)
width_4 = Slider(50, range=0..100)
height_4 = Slider(50, range=0..100)
depth_4 = Slider(3173, range=0..10000)
list_7 = ValueList({"Value": 0, "Perlin": 1, "Cubic": 2, "Simplex": 3, "WhiteNoise": 4}, selected="Perlin")
list_8 = ValueList({"Linear": 0, "Hermite": 1, "Quintic": 2}, selected="Hermite")
frequency_4 = Slider(0.094, range=0..0.1)
procedural_noise_4 = ProceduralNoise(Seed=seed_4, Width=width_4, Height=height_4, Depth=depth_4, Mode=list_7, Interpolation=list_8, Frequency=frequency_4)  # -> Image, Noise
bitmap_properties_2 = BitmapProperties(Image=procedural_noise_4.Image)  # -> Boundary, Width, Height, HorizontalResolution, VerticalResolution, Format
deconstruct_bitmap_3 = DeconstructBitmap(Image=procedural_noise_4.Image)
text_split_3 = TextSplit(Text=deconstruct_bitmap_3, Separators=",")
mesh_plane_3 = MeshPlane(
    Boundary=bitmap_properties_2.Boundary,
    WidthCount=expr("x-1", bitmap_properties_2.Width),
    HeightCount=expr("x-1", bitmap_properties_2.Height))  # -> Mesh, Area
list_item_3 = ListItem(List=text_split_3, Index=0, Wrap=True)  # -> flatten(Item)
deconstruct_mesh_2 = DeconstructMesh(Mesh=mesh_plane_3.Mesh)  # -> Vertices, Faces, Colours, Normals
division_3 = Division(A=list_item_3, B="255")
mesh_face_3 = MeshFace(deconstruct_mesh_2.Faces)
point_3 = Point(deconstruct_mesh_2.Vertices)
noise_3 = Number(division_3)

point_4 = Point(point_3)
mesh_face_4 = MeshFace(mesh_face_3)
z_factor_2 = Slider(3, range=0..10)
noise_4 = Number(noise_3)
multiplication_2 = Multiplication(A=z_factor_2, B=noise_4)
unit_z_4 = UnitZ(Factor=multiplication_2)
gradient_6 = Gradient(
    LowerLimit=0,
    UpperLimit=1,
    Parameter=noise_4,
    stops=[0: RGB(68, 1, 84), 0.167: RGB(68, 57, 131), 0.334: RGB(49, 104, 142), 0.501: RGB(33, 145, 140), 0.668: RGB(53, 183, 121), 0.835: RGB(144, 215, 67), 1: RGB(253, 231, 37)])
move_2 = Move(Geometry=point_4, Motion=unit_z_4)  # -> Geometry, Transform
construct_mesh_2 = ConstructMesh(Vertices=move_2.Geometry, Faces=mesh_face_4, Colours=gradient_6)
mesh_3 = Mesh(construct_mesh_2)

noise_5 = Panel(noise)
