# Grasshopper definition noise-wall.gh (Grasshopper 1.0.8)
# Copyright: GNU General Public License 3.0
# plug-ins: BitmapPlus

# ----
# noise wall
# procedural noise
# bitmap+
seed = Slider(0, range=0..100)
width = Slider(100, range=0..100)
height = Slider(20, range=0..100)
depth = Slider(5000, range=0..10000)
list = ValueList({"Value": 0, "Perlin": 1, "Cubic": 2, "Simplex": 3, "WhiteNoise": 4}, selected="Perlin")
list_2 = ValueList({"Linear": 0, "Hermite": 1, "Quintic": 2}, selected="Hermite")
# construct grid
frequency = Slider(0.094, range=0..0.1)
procedural_noise = ProceduralNoise(Seed=seed, Width=width, Height=height, Depth=depth, Mode=list, Interpolation=list_2, Frequency=frequency)  # -> Image, Noise
prev_image = PrevImage(SmartBitmap=procedural_noise.Image)
image = Data(procedural_noise.Image)

image_2 = Data(image)
bitmap_properties = BitmapProperties(Image=image_2)  # -> Boundary, Width, Height, HorizontalResolution, VerticalResolution, Format
mesh_plane = MeshPlane(
    Boundary=bitmap_properties.Boundary,
    WidthCount=expr("x-1", bitmap_properties.Width),
    HeightCount=expr("x-1", bitmap_properties.Height))  # -> Mesh, Area
deconstruct_mesh = DeconstructMesh(Mesh=mesh_plane.Mesh)  # -> Vertices, Faces, Colours, Normals
mesh_face = MeshFace(deconstruct_mesh.Faces)
point = Point(deconstruct_mesh.Vertices)

image_3 = Data(image_2)
# extract noise
deconstruct_bitmap = DeconstructBitmap(Image=image_3)
split_ahsv = SplitAHSV(Colour=deconstruct_bitmap)  # -> Alpha, Hue, Saturation, Value
noise = Number(split_ahsv.Value)

# ----
# 3D mesh
point_2 = Point(point)
mesh_face_2 = MeshFace(mesh_face)
z_factor = Slider(3, range=0..10)
noise_2 = Number(noise)
multiplication = Multiplication(A=z_factor, B=noise_2)
unit_z = UnitZ(Factor=multiplication)
gradient = Gradient(
    LowerLimit=0,
    UpperLimit=1,
    Parameter=noise_2,
    stops=[0: RGB(68, 1, 84), 0.167: RGB(68, 57, 131), 0.334: RGB(49, 104, 142), 0.501: RGB(33, 145, 140), 0.668: RGB(53, 183, 121), 0.835: RGB(144, 215, 67), 1: RGB(253, 231, 37)])
move = Move(Geometry=point_2, Motion=unit_z)  # -> Geometry, Transform
construct_mesh = ConstructMesh(Vertices=move.Geometry, Faces=mesh_face_2, Colours=gradient)
mesh = Mesh(construct_mesh)

# ---- group: parametric module
# module
X = Slider(3, range=0..10)
Y = Slider(1, range=0..10)
Z = Slider(1, range=0..10)
domain_box = DomainBox(Base=PlaneXY(0, 0, 0), X=X, Y=Y, Z=Z)
module = Brep(domain_box)

# ----
# contours
mesh_2 = Mesh(mesh)
yz_plane = YZPlane(Origin=Point(0, 0, 0))
Z_2 = Number(Z)
rotate = Rotate(Geometry=mesh_2, Angle=1.570796327, Plane=yz_plane)  # -> Geometry, Transform
unit_z_2 = UnitZ(Factor=1)
contour = Contour(Shape=rotate.Geometry, Point=Point(0, 0, 0), Direction=unit_z_2, Distance=Z_2)  # -> flatten(Contours)
dispatch = Dispatch(List=contour, DispatchPattern=[True, False])  # -> ListA, ListB
curve_a = Curve(dispatch.ListA)
curve_b = Curve(dispatch.ListB)

# ----
# wall
module_2 = Brep(module)
curve_a_2 = Curve(curve_a)
curve_b_2 = Curve(curve_b)
count = Slider(50, range=0..100)
horizontal_frames = HorizontalFrames(Curve=curve_a_2, Count=count)  # -> Frames, Parameters
horizontal_frames_2 = HorizontalFrames(Curve=curve_b_2, Count=count)  # -> Frames, Parameters
xy_plane = XYPlane(Origin=horizontal_frames.Frames)
xy_plane_2 = XYPlane(Origin=horizontal_frames_2.Frames)
dispatch_2 = Dispatch(List=xy_plane, DispatchPattern=[True, False])  # -> ListA, ListB
dispatch_3 = Dispatch(List=xy_plane_2, DispatchPattern=[True, False])  # -> ListA, ListB
merge = Merge(Data1=dispatch_2.ListA, Data2=dispatch_3.ListB)
orient = Orient(Geometry=module_2, Source=PlaneXY(0, 0, 0), Target=merge)  # -> flatten(Geometry), Transform
modules = Brep(orient.Geometry)

# ----
# visualization
modules_2 = Brep(modules)
custom_preview = CustomPreview(Geometry=modules_2, Material=ColourSwatch(SwatchColor=RGB(102, 102, 102)))
