# Grasshopper definition noise.gh (Grasshopper 1.0.7)
# Copyright: GNU General Public License 3.0
# plug-ins: Noise 4D, BitmapPlus

# ----
# noise
# noise4d
# perlin noise grid
cellsize = Slider(1, range=0..10)
extent_x = Slider(50, range=0..100)
extent_y = Slider(50, range=0..100)
time = Slider(0, range=0..100)
scale = Slider(0.16, range=0..1)
square = Square(Plane=PlaneXY(0, 0, 0), Size=cellsize, ExtentX=extent_x, ExtentY=extent_y)  # -> flatten(Cells), Points
area = Area(Geometry=square.Cells)  # -> Area, Centroid
perlinnoise = PerlinNoise(Values=area.Centroid, Time=time, Scale=scale)
unit_z = UnitZ(Factor=cellsize)
extrude = Extrude(Base=square.Cells, Direction=unit_z)
bounds = Bounds(Numbers=perlinnoise)
deconstruct_domain = DeconstructDomain(Domain=bounds)  # -> Start, End
cap_holes = CapHoles(Brep=extrude)
gradient = Gradient(
    LowerLimit=deconstruct_domain.Start,
    UpperLimit=deconstruct_domain.End,
    Parameter=perlinnoise,
    stops=[0: RGB(68, 1, 84), 0.167: RGB(68, 57, 131), 0.334: RGB(49, 104, 142), 0.501: RGB(33, 145, 140), 0.668: RGB(53, 183, 121), 0.835: RGB(144, 215, 67), 1: RGB(253, 231, 37)])
custom_preview = CustomPreview(Geometry=cap_holes, Material=gradient)

# ----
# perlin noise mesh
extent_x_2 = Slider(25, range=0..100)
extent_y_2 = Slider(25, range=0..100)
time_2 = Slider(0, range=0..100)
scale_2 = Slider(0.16, range=0..1)
rectangle = Rectangle(Plane=PlaneXY(0, 0, 0), XSize=extent_x_2, YSize=extent_y_2, Radius=0)  # -> Rectangle, Length
mesh_plane = MeshPlane(Boundary=rectangle.Rectangle, WidthCount=expr("x-1", extent_x_2), HeightCount=expr("x-1", extent_y_2))  # -> Mesh, Area
deconstruct_mesh = DeconstructMesh(Mesh=mesh_plane.Mesh)  # -> Vertices, Faces, Colours, Normals
perlinnoise_2 = PerlinNoise(Values=deconstruct_mesh.Vertices, Time=time_2, Scale=scale_2)
mesh_face = MeshFace(deconstruct_mesh.Faces)
point = Point(deconstruct_mesh.Vertices)
noise = Number(perlinnoise_2)

point_2 = Point(point)
mesh_face_2 = MeshFace(mesh_face)
z_factor = Slider(1.5, range=0..10)
noise_2 = Number(noise)
bounds_2 = Bounds(Numbers=noise_2)
multiplication = Multiplication(A=z_factor, B=noise_2)
unit_z_2 = UnitZ(Factor=multiplication)
deconstruct_domain_2 = DeconstructDomain(Domain=bounds_2)  # -> Start, End
move = Move(Geometry=point_2, Motion=unit_z_2)  # -> Geometry, Transform
gradient_2 = Gradient(
    LowerLimit=deconstruct_domain_2.Start,
    UpperLimit=deconstruct_domain_2.End,
    Parameter=noise_2,
    stops=[0: RGB(68, 1, 84), 0.167: RGB(68, 57, 131), 0.334: RGB(49, 104, 142), 0.501: RGB(33, 145, 140), 0.668: RGB(53, 183, 121), 0.835: RGB(144, 215, 67), 1: RGB(253, 231, 37)])
construct_mesh = ConstructMesh(Vertices=move.Geometry, Faces=mesh_face_2)
mesh_colours = MeshColours(Mesh=construct_mesh, Colours=gradient_2)
mesh = Mesh(mesh_colours)

# ----
# bitmap+
# procedural noise
seed = Slider(0, range=0..100)
width = Slider(100, range=0..100)
height = Slider(100, range=0..100)
depth = Slider(3173, range=0..10000)
list = ValueList({"Value": 0, "Perlin": 1, "Cubic": 2, "Simplex": 3, "WhiteNoise": 4}, selected="Perlin")
list_2 = ValueList({"Linear": 0, "Hermite": 1, "Quintic": 2}, selected="Hermite")
frequency = Slider(0.094, range=0..0.1)
procedural_noise = ProceduralNoise(Seed=seed, Width=width, Height=height, Depth=depth, Mode=list, Interpolation=list_2, Frequency=frequency)  # -> Image, Noise
prev_image = PrevImage(SmartBitmap=procedural_noise.Image)
image = Data(procedural_noise.Image)

# ----
# cellular noise
seed_2 = Slider(0, range=0..100)
width_2 = Slider(100, range=0..100)
height_2 = Slider(100, range=0..100)
depth_2 = Slider(0, range=0..10000)
list_3 = ValueList({"Euclidean": 0, "Manhattan": 1, "Natural": 2}, selected="Euclidean")
list_4 = ValueList({"Value": 0, "Distance2": 2, "Dist2Add": 3, "Dist2Sub": 4, "Dist2Mul": 5, "Dist2Div": 6}, selected="Dist2Div")
procedural_cellular = ProceduralCellular(
    Seed=seed_2,
    Width=width_2,
    Height=height_2,
    Depth=depth_2,
    BoundaryMode=list_3,
    InterpolationMode=list_4,
    Jitter=Slider(0.5, range=0..1),
    Frequency=Slider(0.08, range=0..1))
prev_image_2 = PrevImage(SmartBitmap=procedural_cellular)
image_2 = Data(procedural_cellular)

image_3 = Data(image_2)
# mesh grid from image
bitmap_properties = BitmapProperties(Image=image_3)  # -> Boundary, Width, Height, HorizontalResolution, VerticalResolution, Format
mesh_plane_2 = MeshPlane(
    Boundary=bitmap_properties.Boundary,
    WidthCount=expr("x-1", bitmap_properties.Width),
    HeightCount=expr("x-1", bitmap_properties.Height))  # -> Mesh, Area
deconstruct_mesh_2 = DeconstructMesh(Mesh=mesh_plane_2.Mesh)  # -> Vertices, Faces, Colours, Normals
mesh_face_3 = MeshFace(deconstruct_mesh_2.Faces)
point_3 = Point(deconstruct_mesh_2.Vertices)

image_4 = Data(image_3)
# noise from image
deconstruct_bitmap = DeconstructBitmap(Image=image_4)
text_split = TextSplit(Text=deconstruct_bitmap, Separators=",")
list_item = ListItem(List=text_split, Index=0, Wrap=True)  # -> flatten(Item)
division = Division(A=list_item, B="255")
noise_3 = Number(division)

# ----
# 3D mesh
point_4 = Point(point_3)
noise_4 = Number(noise_3)
mesh_face_4 = MeshFace(mesh_face_3)
z_factor_2 = Slider(4, range=0..10)
multiplication_2 = Multiplication(A=z_factor_2, B=noise_4)
unit_z_3 = UnitZ(Factor=multiplication_2)
gradient_3 = Gradient(
    LowerLimit=0,
    UpperLimit=1,
    Parameter=noise_4,
    stops=[0: RGB(68, 1, 84), 0.167: RGB(68, 57, 131), 0.334: RGB(49, 104, 142), 0.501: RGB(33, 145, 140), 0.668: RGB(53, 183, 121), 0.835: RGB(144, 215, 67), 1: RGB(253, 231, 37)])
move_2 = Move(Geometry=point_4, Motion=unit_z_3)  # -> Geometry, Transform
construct_mesh_2 = ConstructMesh(Vertices=move_2.Geometry, Faces=mesh_face_4, Colours=gradient_3)
mesh_2 = Mesh(construct_mesh_2)

# ---- group: compute contours
# contours
mesh_3 = Mesh(mesh_2)
interval = Slider(0.2, range=0..1)
contour = Contour(Shape=mesh_3, Point=Point(0, 0, 0), Direction=Vector(0, 0, 1), Distance=interval)
custom_preview_2 = CustomPreview(Geometry=contour, Material=ColourSwatch(SwatchColor=RGB(255, 255, 255)))

# ----
noise_5 = Panel(noise)
