# Grasshopper definition parametric-landscape.gh (Grasshopper 1.0.7)
# plug-ins: Pufferfish

# ---- group: ellispoidal tree
# diameter at breast height (DBH)
trunk_color = ColourSwatch(SwatchColor=RGB(139, 76, 57))
canopy_color = ColourSwatch(SwatchColor=RGBA(101, 150, 102, 232))
crown_height = Slider(30, range=0..75)
canopy_diameter = Slider(8, range=0..100)
# parametric trees
trunk_diameter = Slider(0.5, range=0..2)
trunk_height = Slider(10, range=0..100)
construct_point = ConstructPoint(XCoordinate=0, YCoordinate=0, ZCoordinate=0)
unit_z = UnitZ(Factor=trunk_height)
unit_z_2 = UnitZ(Factor=crown_height)
division = Division(A=trunk_diameter, B="2.0")
division_2 = Division(A=canopy_diameter, B="2.0")
move = Move(Geometry=construct_point, Motion=unit_z_2)  # -> Geometry, Transform
division_3 = Division(A=trunk_height, B=division_2)
move_2 = Move(Geometry=construct_point, Motion=unit_z)  # -> Geometry, Transform
line = Line(StartPoint=construct_point, EndPoint=move_2.Geometry)
line_2 = Line(StartPoint=move_2.Geometry, EndPoint=move.Geometry)
curve_middle = CurveMiddle(Curve=line_2)
construct_plane = ConstructPlane(Origin=curve_middle, XAxis=Vector(1, 0, 0), YAxis=Vector(0, 1, 0))
sphere = Sphere(Base=construct_plane, Radius=division_2)
scale_nu = ScaleNU(Geometry=sphere, Plane=construct_plane, ScaleX=1, ScaleY=1, ScaleZ=division_3)  # -> Geometry, Transform
pipe = Pipe(Curve=line, Radius=division, Caps=0)
custom_preview = CustomPreview(Geometry=pipe, Material=trunk_color)
custom_preview_2 = CustomPreview(Geometry=scale_nu.Geometry, Material=canopy_color)
group = Group(Objects=[scale_nu.Geometry, pipe])

# ---- group: conical tree
# diameter at breast height (DBH)
trunk_color_2 = ColourSwatch(SwatchColor=RGB(139, 76, 57))
canopy_color_2 = ColourSwatch(SwatchColor=RGBA(58, 94, 58, 232))
trunk_height_2 = Slider(8, range=0..100)
crown_height_2 = Slider(30, range=0..75)
canopy_layers = Slider(3, range=0..10)
canopy_diameter_2 = Slider(10, range=0..100)
trunk_diameter_2 = Slider(0.75, range=0..2)
construct_point_2 = ConstructPoint(XCoordinate=0, YCoordinate=0, ZCoordinate=0)
unit_z_3 = UnitZ(Factor=trunk_height_2)
unit_z_4 = UnitZ(Factor=crown_height_2)
division_4 = Division(A=trunk_diameter_2, B="2.0")
division_5 = Division(A=canopy_diameter_2, B="2.0")
move_3 = Move(Geometry=construct_point_2, Motion=unit_z_4)  # -> Geometry, Transform
move_4 = Move(Geometry=construct_point_2, Motion=unit_z_3)  # -> Geometry, Transform
division_6 = Division(A=unit_z_4, B=canopy_layers)
line_3 = Line(StartPoint=construct_point_2, EndPoint=move_4.Geometry)
line_4 = Line(StartPoint=move_4.Geometry, EndPoint=move_3.Geometry)
divide_distance = DivideDistance(Curve=line_4, Distance=division_6)  # -> Points, Tangents, Parameters
construct_plane_2 = ConstructPlane(Origin=divide_distance.Points, XAxis=Vector(1, 0, 0), YAxis=Vector(0, 1, 0))
construct_domain = ConstructDomain(DomainStart="0.5", DomainEnd="1.75")
cone = Cone(Base=construct_plane_2, Radius=division_5, Length=division_6)  # -> Cone, Tip
list_length = ListLength(List=construct_plane_2)
range = Range(Domain=construct_domain, Steps=list_length)  # -> reverse(Range)
scale = Scale(Geometry=cone.Cone, Center=construct_plane_2, Factor=range)  # -> Geometry, Transform
pipe_2 = Pipe(Curve=line_3, Radius=division_4, Caps=0)
cap_holes = CapHoles(Brep=scale.Geometry)
group_2 = Group(Objects=[cap_holes, pipe_2])
custom_preview_3 = CustomPreview(Geometry=pipe_2, Material=trunk_color_2)
custom_preview_4 = CustomPreview(Geometry=cap_holes, Material=canopy_color_2)

# ---- group: randomly populate ring with trees
circle = Circle(Plane=PlaneXY(0, 0, 0), Radius=Slider(250, range=0..1000))
offset_curve = OffsetCurve(Curve=circle, Distance=Slider(50, range=0..1000), Plane=PlaneXY(0, 0, 0), Corners=1)
boundary_surfaces = BoundarySurfaces(Edges=flatten([offset_curve, circle]))
populate_geometry = PopulateGeometry(Geometry=boundary_surfaces, Count=Slider(75, range=0..1000), Seed=1)
move_to_point = MoveToPoint(Geometry=group_2, PointA=construct_point_2, PointB=populate_geometry)  # -> Moved, Vector, Transform

# ---- group: randomly populate rectangular region with trees
# parametric forest
number_slider = Slider(75, range=0..1000)
number_slider_2 = Slider(250, range=0..1000)
rectangle = Rectangle(Plane=PlaneXY(0, 0, 0), XSize=number_slider_2, YSize=number_slider_2, Radius=0)  # -> Rectangle, Length
populate_2d = Populate2D(Region=rectangle.Rectangle, Count=number_slider, Seed=1)
move_to_point_2 = MoveToPoint(Geometry=group_2, PointA=construct_point_2, PointB=populate_2d)  # -> Moved, Vector, Transform

# ---- group: randomly populate round region with trees
circle_2 = Circle(Plane=PlaneXY(0, 0, 0), Radius=Slider(250, range=0..1000))
boundary_surfaces_2 = BoundarySurfaces(Edges=circle_2)
populate_geometry_2 = PopulateGeometry(Geometry=boundary_surfaces_2, Count=Slider(250, range=0..1000), Seed=1)
move_to_point_3 = MoveToPoint(Geometry=group_2, PointA=construct_point_2, PointB=populate_geometry_2)  # -> Moved, Vector, Transform

# ---- group: sine waves
pi = Pi(Factor=Slider(6, range=0..12))
dom = ConstructDomain(DomainStart=0, DomainEnd=pi)
dom_2 = ConstructDomain(DomainStart=0, DomainEnd=Slider(12, range=0..360))
range_2 = Range(Domain=dom, Steps=Slider(36, range=0..360))
range_3 = Range(Domain=dom_2, Steps=Slider(3, range=0..6))
expression = Expression(
    x=graft([Slider(1.5, range=0..6), Slider(0.75, range=0..2), Slider(0.5, range=0..2), Slider(0.25, range=0..2)]),
    y=range_2,
    Expression="sin(x*y)")
pt = ConstructPoint(XCoordinate=0, YCoordinate=range_2, ZCoordinate=expression)
X = UnitX(Factor=range_3)
intcrv = Interpolate(Vertices=pt, Degree=3, Periodic=False, KnotStyle=1)  # -> Curve, Length, Domain
move_5 = Move(Geometry=intcrv.Curve, Motion=graft(X))  # -> Geometry, Transform
scale_2 = Scale(Geometry=move_5.Geometry, Center=Point(0, 0, 0), Factor=Slider(20, range=0..360))  # -> Geometry, Transform
loft = Loft(
    Curves=flatten(scale_2.Geometry),
    Options={Adjust=False, Closed=False, LoftEnds=0, LoftSimp=0, LoftType=0, Rebuild=10, Refit=0.01})

# ---- group: populate with trees
# conical tree
# tree origin
number_slider_3 = Slider(0.4, range=0..1)
number_slider_4 = Slider(150, range=0..300)
number_slider_5 = Slider(0, range=0..100)
popgeo = PopulateGeometry(Geometry=loft, Count=number_slider_4, Seed=number_slider_5)
geo = Geometry(group_2)
pt_2 = Point(construct_point)
dom_3 = ConstructDomain(DomainStart=number_slider_3, DomainEnd=Slider(0.75, range=0..1))
move2pt = MoveToPoint(Geometry=geo, PointA=pt_2, PointB=popgeo)  # -> Moved, Vector, Transform
random = Random(Range=dom_3, Number=number_slider_4, Seed=number_slider_5)
# tree attractor
scale_3 = Scale(Geometry=move2pt.Moved, Center=move2pt.Vector, Factor=random)  # -> Geometry, Transform
