# Grasshopper definition parametric-wave.gh (Grasshopper 1.0.7)
# Copyright: GNU General Public License 3.0

# ---- group: u
# parametric waves
# derived from
# Joseph Choma, Morphing
# A Guide to Mathematical Transformations for Architects and Designers
u = Slider(0.5, range=-1..1)
steps = Slider(25, range=0..250)
negative = Negative(Value=u)
pi = Pi(Factor=negative)
pi_2 = Pi(Factor=u)
construct_domain = ConstructDomain(DomainStart=pi, DomainEnd=pi_2)
range = Range(Domain=construct_domain, Steps=steps)
u_2 = Number(range)

# ---- group: v
v = Slider(1, range=-10..10)
steps_2 = Slider(25, range=0..250)
pi_3 = Pi(Factor=v)
range_2 = Range(Domain=pi_3, Steps=steps_2)
v_2 = Number(range_2)

# ---- group: cx
u_3 = Number(range)
cosine = Cosine(Value=u_3)
cx = Number(cosine)

# ---- group: cy
u_4 = Number(range)
sine = Sine(Value=u_4)
cy = Number(sine)

# ---- group: cz
v_3 = Number(range_2)
cz = Number(v_3)

# ---- group: sx
cz_2 = Number(v_3)
cx_2 = Number(cosine)
sine_2 = Sine(Value=cz_2)
multiplication = Multiplication(A=sine_2, B=cx_2)
sx = Number(multiplication)

# ---- group: sy
cz_3 = Number(v_3)
cy_2 = Number(sine)
sine_3 = Sine(Value=cz_3)
multiplication_2 = Multiplication(A=sine_3, B=cy_2)
sy = Number(multiplication_2)

# ---- group: sz
cz_4 = Number(v_3)
cosine_2 = Cosine(Value=cz_4)
sz = Number(cosine_2)

# ---- group: x, y, z
cz_5 = Number(v_3)
sx_2 = Number(multiplication)
sy_2 = Number(multiplication_2)
cy_3 = Number(sine)
sx_3 = Number(multiplication)
sy_3 = Number(multiplication_2)
sx_4 = Number(multiplication)
sy_4 = Number(multiplication_2)
sz_2 = Number(cosine_2)
expression = Expression(cz=cz_5, sx=sx_2, sy=sy_2, Expression="cz")
expression_2 = Expression(cy=cy_3, sx=sx_3, sy=sy_3, Expression="cy")
expression_3 = Expression(sx=graft(sx_4), sy=graft(sy_4), sz=sz_2, Expression="sx * sy * sz")
x = Number(expression)
y = Number(expression_2)
z = Number(expression_3)
construct_point = ConstructPoint(XCoordinate=graft(x), YCoordinate=y, ZCoordinate=z)
count = Number(steps)
surface_from_points = SurfaceFromPoints(Points=flatten(construct_point), UCount=expr("x+1", count), Interpolate=Toggle(True))
surface = Surface(surface_from_points)

# ---- group: surface color gradient
surface_2 = Surface(surface)
mesh_brep = MeshBrep(
    Brep=surface_2,
    Settings={GridMaxCount=0, GridMinCount=16, JaggedSeams=False, MaxEdgeLength=0, MinEdgeLength=0.0001, MinTolerance=0, Refine=True, RefineAngle=0, RelativeTolerance=0.65, SimplePlanes=True, Tolerance=0})
deconstruct_mesh = DeconstructMesh(Mesh=mesh_brep)  # -> Vertices, Faces, Colours, Normals
deconstruct = Deconstruct(Point=deconstruct_mesh.Vertices)  # -> XComponent, YComponent, ZComponent
bounds = Bounds(Numbers=deconstruct.ZComponent)
remap_numbers = RemapNumbers(Value=deconstruct.ZComponent, Source=bounds, Target=Domain(0, 1))  # -> Mapped, Clipped
gradient = Gradient(
    LowerLimit=0,
    UpperLimit=1,
    Parameter=remap_numbers.Mapped,
    stops=[0: RGB(0, 0, 4), 0.167: RGB(50, 10, 94), 0.334: RGB(120, 28, 109), 0.501: RGB(205, 55, 84), 0.668: RGB(237, 105, 37), 0.835: RGB(251, 182, 26), 1: RGB(252, 255, 164)])
mesh_colours = MeshColours(Mesh=mesh_brep, Colours=gradient)
mesh = Mesh(mesh_colours)
