# Grasshopper definition particle-forest.gh (Grasshopper 1.0.7)
# Copyright: GNU General Public License 3.0
# plug-ins: Kangaroo2 Components

# ---- group: generate a conical tree
# particle forest
# diameter at breast height (DBH)
trunk_diameter = Slider(1, range=0..2)
trunk_height = Slider(8, range=0..100)
crown_height = Slider(30, range=0..75)
canopy_layers = Slider(3, range=0..10)
canopy_diameter = Slider(10, range=0..100)
conical_tree = ConicalTree(A=trunk_diameter, factor=trunk_height, factor_2=crown_height, B=canopy_layers, A_2=canopy_diameter)  # -> trunk, result
trunk_color = ColourSwatch(SwatchColor=RGB(139, 76, 57))
canopy_color = ColourSwatch(SwatchColor=RGBA(58, 94, 84, 232))
custom_preview = CustomPreview(Geometry=conical_tree.trunk, Material=trunk_color)
custom_preview_2 = CustomPreview(Geometry=conical_tree.result, Material=canopy_color)

# ----
region_radius = Slider(100, range=0..1000)
count = Slider(64, range=0..360)
seed = Slider(0, range=0..100)
circle = Circle(Plane=PlaneXY(0, 0, 0), Radius=region_radius)
boundary_surfaces = BoundarySurfaces(Edges=circle)
populate_geometry = PopulateGeometry(Geometry=boundary_surfaces, Count=count, Seed=seed)
population = Point(populate_geometry)
region = Circle(circle)
ground = Surface(boundary_surfaces)

# ---- group: ground
ground_2 = Surface(ground)
depth = Slider(3, range=0..10)
negative = Negative(Value=depth)
unit_z = UnitZ(Factor=negative)
extrude = Extrude(Base=ground_2, Direction=unit_z)
canopy_color_2 = ColourSwatch(SwatchColor=RGBA(181, 173, 152, 232))
custom_preview_3 = CustomPreview(Geometry=extrude, Material=canopy_color_2)

# ---- group: run program
reset = BooleanToggle(False)
run = BooleanToggle(True)

# ---- group: particle system
bomb = Point(Point(0, 0, 0))
detonation_time = Slider(1, range=0..100)
bomb_strength = Slider(10, range=0..10)
population_2 = Point(population)
canopy_diameter_2 = Number(canopy_diameter)
strength = Slider(5, range=0..10)
region_2 = Circle(region)
boundary_strength = Slider(5, range=0..10)
division = Division(A=canopy_diameter_2, B="2")
bomb_2 = Bomb(Location=bomb, Points=population_2, DetonationTime=detonation_time, Strength=bomb_strength, Reset=reset)
curvepointcollide = CurvePointCollide(Points=population_2, Curve=region_2, Plane=PlaneXY(0, 0, 0), Interior="True", Strength=boundary_strength)
spherecollide = SphereCollide(Points=population_2, Radius=division, Strength=strength)
bouncysolver = BouncySolver(
    GoalObjects=[spherecollide, bomb_2, curvepointcollide],
    Reset=reset,
    Threshold="0.001",
    Tolerance=0.01,
    Damping=0.99,
    Iterations=10,
    On=run)  # -> I, V, O
count_2 = Number(count)
split_list = SplitList(List=bouncysolver.V, Index=count_2)  # -> ListA, ListB
dot_display = DotDisplay(Point=bouncysolver.V, Colour=RGB(0, 0, 0), Size=canopy_diameter_2)
particles = Point(split_list.ListA)

# ---- group: forest from particles
trunk = Brep(conical_tree.trunk)
particles_2 = Point(particles)
canopy = Brep(conical_tree.result)
count_3 = Number(count)
origin = Panel("0,0,0")
origin_2 = Panel("0,0,0")
vector_2pt = Vector2Pt(PointA=origin, PointB=particles_2, Unitize=False)  # -> Vector, Length
vector_2pt_2 = Vector2Pt(PointA=origin_2, PointB=particles_2, Unitize=False)  # -> Vector, Length
move = Move(Geometry=trunk, Motion=vector_2pt.Vector)  # -> Geometry, Transform
move_2 = Move(Geometry=canopy, Motion=vector_2pt_2.Vector)  # -> Geometry, Transform
random = Random(Range="0.5 To 1", Number=count_3, Seed=2)
scale = Scale(Geometry=move.Geometry, Center=vector_2pt.Vector, Factor=random)  # -> Geometry, Transform
scale_2 = Scale(Geometry=move_2.Geometry, Center=vector_2pt_2.Vector, Factor=random)  # -> Geometry, Transform
range = Range(Domain=Domain(0, 1), Steps=expr("x-1", count_3))
canopy_color_3 = ColourSwatch(SwatchColor=RGBA(95, 153, 137, 232))
canopy_color_4 = ColourSwatch(SwatchColor=RGBA(47, 76, 68, 232))
interpolate_data = InterpolateData(Data=[canopy_color_3, canopy_color_4], Parameter=range, Interpolation=2)
trunk_color_2 = ColourSwatch(SwatchColor=RGB(139, 76, 57))
custom_preview_4 = CustomPreview(Geometry=scale.Geometry, Material=trunk_color_2)
custom_preview_5 = CustomPreview(Geometry=scale_2.Geometry, Material=interpolate_data)

# ==== cluster ConicalTree
factor = ClusterInput()
factor_2 = ClusterInput()
A = ClusterInput()
A_2 = ClusterInput()

# ---- group: conical tree
construct_point = ConstructPoint(XCoordinate=0, YCoordinate=0, ZCoordinate=0)
unit_z = UnitZ(Factor=factor)
unit_z_2 = UnitZ(Factor=factor_2)
division = Division(A=A, B="2.0")
division_2 = Division(A=A_2, B="2.0")
B = ClusterInput()
move = Move(Geometry=construct_point, Motion=unit_z_2)  # -> Geometry, Transform
move_2 = Move(Geometry=construct_point, Motion=unit_z)  # -> Geometry, Transform
division_3 = Division(A=unit_z_2, B=B)
line = Line(StartPoint=construct_point, EndPoint=move_2.Geometry)
line_2 = Line(StartPoint=move_2.Geometry, EndPoint=move.Geometry)
divide_distance = DivideDistance(Curve=line_2, Distance=division_3)  # -> Points, Tangents, Parameters
construct_plane = ConstructPlane(Origin=divide_distance.Points, XAxis=Vector(1, 0, 0), YAxis=Vector(0, 1, 0))
construct_domain = ConstructDomain(DomainStart="0.5", DomainEnd="1.75")
cone = Cone(Base=construct_plane, Radius=division_2, Length=division_3)  # -> Cone, Tip
list_length = ListLength(List=construct_plane)
range = Range(Domain=construct_domain, Steps=list_length)  # -> reverse(Range)
scale = Scale(Geometry=cone.Cone, Center=construct_plane, Factor=range)  # -> Geometry, Transform
pipe = Pipe(Curve=line, Radius=division, Caps=0)
cap_holes = CapHoles(Brep=scale.Geometry)
solid_union = SolidUnion(Breps=cap_holes)

# ----
trunk = ClusterOutput(pipe)
result = ClusterOutput(solid_union)
