# Grasshopper definition particle-system.gh (Grasshopper 1.0.7)
# plug-ins: Heteroptera

# ---- group: particle distribution for forest
# particle system
# using heteroptera
number_slider = Slider(100, range=0..100)
timer = Timer(TimerInterval=1000, Target=seed_generator)  # disabled
seed_generator = SeedGenerator(Number=1)
point = Point(Point(0, 0, 0))
point_emitter = PointEmitter(
    Emitter=point,
    Radius=number_slider,
    Number=Slider(100, range=0..100),
    Tendency=Slider(0.5, range=0..1),
    SeedOptional=seed_generator,
    isflat=True)
