# Grasshopper definition path-to-cloud.gh (Grasshopper 1.0.7)
# Copyright: GNU General Public License 3.0
# plug-ins: Volvox

surface = Surface()
range = Range(Domain=Domain(0, 1), Steps=expr("x-1", "100"))
populate_geometry = PopulateGeometry(Geometry=surface, Count="100", Seed=1)
gradient = Gradient(LowerLimit=0, UpperLimit=1, Parameter=range, stops=[0: RGB(169, 169, 169), 1: RGB(64, 64, 64)])
colour_swatch = ColourSwatch(SwatchColor=RGB(64, 64, 64))
construct_cloud = ConstructCloud(Points=populate_geometry, Colors=gradient)
custom_preview = CustomPreview(Geometry=populate_geometry, Material=gradient)
gradient_2 = Gradient(LowerLimit=0, UpperLimit=1, stops=[0: RGB(192, 192, 192), 1: RGB(64, 64, 64)])
gradient_3 = Gradient(LowerLimit=0, UpperLimit=1, stops=[0: RGB(192, 192, 192), 1: RGB(64, 64, 64)])
gradient_4 = Gradient(LowerLimit=0, UpperLimit=1, stops=[0: RGB(192, 192, 192), 1: RGB(64, 64, 64)])
