# Grasshopper definition point-cloud-blocks.gh (Grasshopper 1.0.7)
# Copyright: GNU General Public License 3.0

# ---- group: set path to rhino model
# point cloud planting
# import blocks
# tree
file_path = FilePath("D:\academia\libraries\trees\laurus-nobilis-01\clouds\laurus-nobilis-01-s.3dm")

# ---- group: set path to rhino file
# fern
file_path_2 = FilePath("D:\academia\libraries\trees\polystichum-acrostichoides-01\polystichum-acrostichoides-01-s.3dm")

# ----
import_model_block_definition = ImportModelBlockDefinition(FilePath=file_path, UpdateType=0)
xy_plane = XYPlane(Origin=Point(0, 0, 0))
model_block_instance = ModelBlockInstance(BlockDefinition=import_model_block_definition, Transform=xy_plane)  # -> BlockInstance, BlockDefinition, Transform
explode_block_instance = ExplodeBlockInstance(BlockInstance=model_block_instance.BlockInstance)

import_model_block_definition_2 = ImportModelBlockDefinition(FilePath=file_path_2, UpdateType=0)
xy_plane_2 = XYPlane(Origin=Point(0, 0, 0))
model_block_instance_2 = ModelBlockInstance(BlockDefinition=import_model_block_definition_2, Transform=xy_plane_2)  # -> BlockInstance, BlockDefinition, Transform
geometry = Geometry(model_block_instance_2.BlockInstance)

# ----
# transform blocks
# translate
geometry_2 = Geometry(geometry)
radius = Slider(1, range=0..10)
count = Slider(15, range=0..100)
# scale
seed = Slider(2, range=0..100)
circle = Circle(Plane=PlaneXY(0, 0, 0), Radius=radius)
boundary_surfaces = BoundarySurfaces(Edges=circle)
populate_geometry = PopulateGeometry(Geometry=boundary_surfaces, Count=count, Seed=seed)
move = Move(Geometry=geometry_2, Motion=populate_geometry)  # -> Geometry, Transform
geometry_3 = Geometry(move.Geometry)
point = Point(populate_geometry)

geometry_4 = Geometry(geometry_3)
point_2 = Point(point)
count_2 = Number(count)
# rotate
seed_2 = Number(seed)
random = Random(Range="0.5 To 1.0", Number=count_2, Seed=seed_2)
scale = Scale(Geometry=geometry_4, Center=point_2, Factor=random)  # -> Geometry, Transform
geometry_5 = Geometry(scale.Geometry)

geometry_6 = Geometry(geometry_5)
count_3 = Number(count)
seed_3 = Number(seed)
point_3 = Point(point)
random_2 = Random(Range="0 To 360", Number=count_3, Seed=seed_3)
rotate = Rotate(Geometry=geometry_6, Angle=degrees(random_2), Plane=point_3)  # -> Geometry, Transform
explode_block_instance_2 = ExplodeBlockInstance(BlockInstance=rotate.Geometry)  # -> flatten(Objects)

# ---- group: bake
geometry_7 = Geometry(explode_block_instance_2)

geometry_8 = Geometry(explode_block_instance)
