# Grasshopper definition point-cloud-conversion.gh (Grasshopper 1.0.7)
# Copyright: GNU General Public License 3.0
# plug-ins: Volvox

# ----
# point cloud conversion
# color
geometry = Geometry([<brep referenced from the Rhino model> x3986])
count = Slider(20, range=0..100)
point = Point([Point(-0.1861987473, -0.401494024, 0), Point(1.343443611, 0.07055996036, 0), Point(-1.915740592, 0.07330969399, 0), Point(0.2395542689, 2.159241582, 0), Point(-1.579313462, 2.033374356, 0), Point(1.733623889, -2.283685393, 0)])
populate_3d = Populate3D(Region=geometry, Count=count, Seed=1)  # -> flatten(Population)
point_2 = Point(populate_3d)
factor = Slider(2, range=0..2)
closest_point = ClosestPoint(Point=point_2, Cloud=point)  # -> ClosestPoint, CPIndex, Distance
list_length = ListLength(List=point_2)
bounds = Bounds(Numbers=closest_point.Distance)
random = Random(Range=Domain(0, 1), Number=list_length, Seed=2, Integers=False)
remap_numbers = RemapNumbers(Value=closest_point.Distance, Source=bounds, Target=Domain(0, 1))  # -> Mapped, Clipped
multiplication = Multiplication(A=remap_numbers.Mapped, B=random)
multiplication_2 = Multiplication(A=multiplication, B=factor)
gradient = Gradient(LowerLimit=0, UpperLimit=1, Parameter=multiplication_2, stops=[0: RGB(192, 192, 192), 1: RGB(64, 64, 64)])
construct_cloud = ConstructCloud(Points=populate_3d, Colors=gradient)
cloud = Cloud(construct_cloud)
