# Grasshopper definition procedural-grading.gh (Grasshopper 1.0.7)
# Copyright: GNU General Public License 3.0
# plug-ins: BitmapPlus, Docofossor

# ----
# procedural grading
# with bitmap+ and docofossor
# procedural noise
seed = Slider(0, range=0..100)
xy = Slider(100, range=0..1000)
depth = Slider(5000, range=0..10000)
value_list = ValueList({"Value": 0, "Perlin": 1, "Cubic": 2, "Simplex": 3, "WhiteNoise": 4}, selected="Cubic")
value_list_2 = ValueList({"Linear": 0, "Hermite": 1, "Quintic": 2}, selected="Quintic")
# fractal pass
frequency = Slider(0.032, range=0..0.1)
procedural_noise = ProceduralNoise(Seed=seed, Width=xy, Height=xy, Depth=depth, Mode=value_list, Interpolation=value_list_2, Frequency=frequency)  # -> Image, Noise
data = Data(procedural_noise.Noise)

data_2 = Data(data)
value_list_3 = ValueList({"FBM": 0, "Billow": 1, "Rigid": 2}, selected="Billow")
octaves = Slider(3, range=0..10)
lacunity = Slider(3, range=0..10)
# construct grid
gain = Slider(0.2, range=0..1)
procedural_fractal_pass = ProceduralFractalPass(Noise=data_2, Mode=value_list_3, Octaves=octaves, Lacunity=lacunity, Gain=gain)
data_3 = Data(procedural_fractal_pass)

data_4 = Data(data_3)
bitmap_properties = BitmapProperties(Image=data_4)  # -> Boundary, Width, Height, HorizontalResolution, VerticalResolution, Format
mesh_plane = MeshPlane(
    Boundary=bitmap_properties.Boundary,
    WidthCount=expr("x-1", bitmap_properties.Width),
    HeightCount=expr("x-1", bitmap_properties.Height))  # -> Mesh, Area
deconstruct_mesh = DeconstructMesh(Mesh=mesh_plane.Mesh)  # -> Vertices, Faces, Colours, Normals
point = Point(deconstruct_mesh.Vertices)

# ----
# extract noise from image
data_5 = Data(data_3)
deconstruct_bitmap = DeconstructBitmap(Image=data_5)
split_ahsv = SplitAHSV(Colour=deconstruct_bitmap)  # -> Alpha, Hue, Saturation, Value
noise = Number(split_ahsv.Value)

# ----
# move points
point_2 = Point(point)
noise_2 = Number(noise)
# distance field
z_factor = Slider(6, range=0..10)
multiplication = Multiplication(A=noise_2, B=z_factor)
unit_z = UnitZ(Factor=multiplication)
move = Move(Geometry=point_2, Motion=unit_z)  # -> Geometry, Transform
point_3 = Point(move.Geometry)

point_4 = Point(point_3)
import_points = ImportPoints(Pts=point_4)
grid_mesh = GridMesh(Df=import_points)
custom_preview = CustomPreview(Geometry=grid_mesh, Material=ColourSwatch(SwatchColor=RGB(204, 204, 204)))
mesh = Mesh(grid_mesh)

mesh_2 = Mesh(mesh)
noise_3 = Number(noise)
# gradient
deconstruct_mesh_2 = DeconstructMesh(Mesh=mesh_2)  # -> Vertices, Faces, Colours, Normals
gradient = Gradient(
    LowerLimit=0,
    UpperLimit=1,
    Parameter=noise_3,
    stops=[0: RGB(55, 11, 65), 0.125: RGB(27, 30, 59), 0.25: RGB(22, 83, 76), 0.375: RGB(68, 119, 49), 0.5: RGB(161, 121, 74), 0.625: RGB(212, 132, 169), 0.75: RGB(198, 180, 238), 0.875: RGB(203, 232, 240), 1: RGB(255, 255, 255)])
construct_mesh = ConstructMesh(Vertices=deconstruct_mesh_2.Vertices, Faces=deconstruct_mesh_2.Faces, Colours=gradient)
mesh_3 = Mesh(construct_mesh)

prev_image = PrevImage(SmartBitmap=procedural_noise.Image)
prev_image_2 = PrevImage(SmartBitmap=procedural_fractal_pass)
