# Grasshopper definition random-grove.gh (Grasshopper 1.0.7)

# ---- group: generate a conical tree
# tree
# diameter at breast height (DBH)
trunk_diameter = Slider(0.75, range=0..2)
trunk_height = Slider(8, range=0..100)
crown_height = Slider(30, range=0..75)
canopy_layers = Slider(3, range=0..10)
canopy_diameter = Slider(10, range=0..100)
conical_tree = ConicalTree(A=trunk_diameter, factor=trunk_height, factor_2=crown_height, B=canopy_layers, A_2=canopy_diameter)  # -> trunk, result
trunk_color = ColourSwatch(SwatchColor=RGB(139, 76, 57))
canopy_color = ColourSwatch(SwatchColor=RGBA(58, 94, 58, 232))
custom_preview = CustomPreview(Geometry=conical_tree.trunk, Material=trunk_color)
custom_preview_2 = CustomPreview(Geometry=conical_tree.result, Material=canopy_color)

# ---- group: populate a circular region
# region
radius = Slider(100, range=0..100)
count = Slider(360, range=0..1000)
seed = Slider(0, range=0..1000)
circle = Circle(Plane=PlaneXY(0, 0, 0), Radius=radius)
boundary_surfaces = BoundarySurfaces(Edges=circle)
populate_geometry = PopulateGeometry(Geometry=boundary_surfaces, Count=count, Seed=seed)

# ---- group: cull points by distance from center
# cull by distance
panel = Panel("0,0,0")
point = Point(populate_geometry)
count_2 = Number(count)
closest_points = ClosestPoints(Point=panel, Cloud=point, Count=count_2)  # -> ClosestPoint, CPIndex, Distance
range = Range(Domain=Domain(0, 1), Steps=expr("x-1", count_2))
random = Random(Range=Domain(0, 1), Number=count_2, Seed=seed)
graph_mapper = GraphMapper(
    range,
    x0=0,
    x1=1,
    y0=0,
    y1=1,
    container_name="Bezier",
    cpx=[0, 0.3367159069, 0.8007264137, 1],
    cpy=[0, 0.8999996185, 0.1527468562, 0.9981682897])
smaller_than = SmallerThan(FirstNumber=graph_mapper, SecondNumber=random)  # -> SmallerThan, OrEqualTo
cull_pattern = CullPattern(List=closest_points.ClosestPoint, CullPattern=smaller_than.SmallerThan)

# ---- group: cull every nth point
# cull nth
point_2 = Point(populate_geometry)
frequency = Slider(2, range=0..10)
cull_nth = CullNth(List=point_2, CullFrequency=frequency)

# ---- group: randomly cull points
reduction = Slider(2, range=0..3)
# cull random
point_3 = Point(populate_geometry)
count_3 = Number(count)
division = Division(A=count_3, B=reduction)
random_reduce = RandomReduce(List=point_3, Reduction=division, Seed=1)

# ---- group: ground
surface = Surface(boundary_surfaces)
scale = Slider(1.05, range=0..10)
depth = Slider(2, range=0..10)
scale_2 = Scale(Geometry=surface, Center=Point(0, 0, 0), Factor=scale)  # -> Geometry, Transform
negative = Negative(Value=depth)
unit_z = UnitZ(Factor=negative)
extrude = Extrude(Base=scale_2.Geometry, Direction=unit_z)
ground_color = ColourSwatch(SwatchColor=RGB(140, 123, 118))
custom_preview_3 = CustomPreview(Geometry=extrude, Material=ground_color)

# ---- group: move and scale trees
# array
trunks = Geometry(conical_tree.trunk)
canopies = Geometry(conical_tree.result)
point_4 = Point(cull_pattern)
list_length = ListLength(List=cull_pattern)
merge = Merge(Data1=trunks, Data2=canopies)
range_2 = Range(Domain="0.5 To 1.0", Steps=expr("x-1", list_length))  # -> reverse(Range)
vector_2pt = Vector2Pt(PointA="0,0,0", PointB=point_4, Unitize=False)  # -> Vector, Length
move = Move(Geometry=merge, Motion=vector_2pt.Vector)  # -> Geometry, Transform

# ----
graph_mapper_2 = GraphMapper(
    range_2,
    x0=0,
    x1=1,
    y0=0,
    y1=1,
    container_name="Bezier",
    cpx=[0, 0.3367159069, 0.8007264137, 1],
    cpy=[0, 0.8999996185, 0.1527468562, 0.9981682897])

# ---- group: move and scale trees (continued)
scale_3 = Scale(Geometry=move.Geometry, Center=vector_2pt.Vector, Factor=graph_mapper_2)  # -> Geometry, Transform

# ---- group: tree color
# color
explode_tree = ExplodeTree(Data=scale_3.Geometry)  # -> _0000, _0001
culled_count = Number(list_length)
canopy_color_2 = ColourSwatch(SwatchColor=RGBA(58, 94, 58, 232))
canopy_color_3 = ColourSwatch(SwatchColor=RGBA(64, 128, 117, 232))
canopy_color_4 = ColourSwatch(SwatchColor=RGBA(123, 128, 64, 232))
range_3 = Range(Domain=Domain(0, 1), Steps=culled_count)
colour = Colour([canopy_color_2, canopy_color_3, canopy_color_4])
interpolate_data = InterpolateData(Data=colour, Parameter=range_3, Interpolation=2)
trunk_color_2 = ColourSwatch(SwatchColor=RGB(139, 76, 57))
custom_preview_4 = CustomPreview(Geometry=explode_tree._0000, Material=trunk_color_2)
custom_preview_5 = CustomPreview(Geometry=explode_tree._0001, Material=interpolate_data)

# ==== cluster ConicalTree
factor = ClusterInput()
factor_2 = ClusterInput()
A = ClusterInput()
A_2 = ClusterInput()

# ---- group: conical tree
construct_point = ConstructPoint(XCoordinate=0, YCoordinate=0, ZCoordinate=0)
unit_z = UnitZ(Factor=factor)
unit_z_2 = UnitZ(Factor=factor_2)
division = Division(A=A, B="2.0")
division_2 = Division(A=A_2, B="2.0")
B = ClusterInput()
move = Move(Geometry=construct_point, Motion=unit_z_2)  # -> Geometry, Transform
move_2 = Move(Geometry=construct_point, Motion=unit_z)  # -> Geometry, Transform
division_3 = Division(A=unit_z_2, B=B)
line = Line(StartPoint=construct_point, EndPoint=move_2.Geometry)
line_2 = Line(StartPoint=move_2.Geometry, EndPoint=move.Geometry)
divide_distance = DivideDistance(Curve=line_2, Distance=division_3)  # -> Points, Tangents, Parameters
construct_plane = ConstructPlane(Origin=divide_distance.Points, XAxis=Vector(1, 0, 0), YAxis=Vector(0, 1, 0))
construct_domain = ConstructDomain(DomainStart="0.5", DomainEnd="1.75")
cone = Cone(Base=construct_plane, Radius=division_2, Length=division_3)  # -> Cone, Tip
list_length = ListLength(List=construct_plane)
range = Range(Domain=construct_domain, Steps=list_length)  # -> reverse(Range)
scale = Scale(Geometry=cone.Cone, Center=construct_plane, Factor=range)  # -> Geometry, Transform
pipe = Pipe(Curve=line, Radius=division, Caps=0)
cap_holes = CapHoles(Brep=scale.Geometry)
solid_union = SolidUnion(Breps=cap_holes)

# ----
trunk = ClusterOutput(pipe)
result = ClusterOutput(solid_union)
