# Grasshopper definition random-paving.gh (Grasshopper 1.0.7)
# plug-ins: EleFront, Noise 4D

# ---- group: colored pavers
# random paving patterns
# colored grid of pavers
X = Slider(1, range=0..10)
Y = Slider(3, range=0..10)
extent_x = Slider(30, range=0..30)
extent_y = Slider(10, range=0..30)
Z = Slider(0.05, range=0..1)
Z_2 = Slider(0.5, range=0..3)
unit_z = UnitZ(Factor=Z_2)
rectangular = Rectangular(Plane=PlaneXY(0, 0, 0), SizeX=X, SizeY=Y, ExtentX=extent_x, ExtentY=extent_y)  # -> Cells, Points
negative = Negative(Value=Z)
offset_curve = OffsetCurve(Curve=rectangular.Cells, Distance=negative, Plane=PlaneXY(0, 0, 0), Corners=1)
extrude = Extrude(Base=offset_curve, Direction=unit_z)
cap_holes = CapHoles(Brep=extrude)
panel = Panel("""True
False
False""")
sift_pattern = SiftPattern(List=flatten(cap_holes), SiftPattern=panel)  # -> Output0, Output1
custom_preview = CustomPreview(Geometry=sift_pattern.Output0, Material=ColourSwatch(SwatchColor=RGB(191, 191, 191)))
custom_preview_2 = CustomPreview(Geometry=sift_pattern.Output1, Material=ColourSwatch(SwatchColor=RGB(64, 64, 64)))

# ---- group: randomly colored pavers
# randomly colored grid of pavers
X_2 = Slider(1, range=0..10)
Y_2 = Slider(3, range=0..10)
extent_x_2 = Slider(30, range=0..30)
extent_y_2 = Slider(10, range=0..30)
Z_3 = Slider(0.05, range=0..1)
Z_4 = Slider(0.5, range=0..3)
seed = Slider(0, range=0..100)
unit_z_2 = UnitZ(Factor=Z_4)
rectangular_2 = Rectangular(Plane=PlaneXY(0, 0, 0), SizeX=X_2, SizeY=Y_2, ExtentX=extent_x_2, ExtentY=extent_y_2)  # -> Cells, Points
negative_2 = Negative(Value=Z_3)
offset_curve_2 = OffsetCurve(Curve=rectangular_2.Cells, Distance=negative_2, Plane=PlaneXY(0, 0, 0), Corners=1)  # -> flatten(Curve)
extrude_2 = Extrude(Base=offset_curve_2, Direction=unit_z_2)
list_length = ListLength(List=offset_curve_2)
cap_holes_2 = CapHoles(Brep=extrude_2)
random = Random(Range=Domain(0, 1), Number=list_length, Seed=seed, Integers=True)
dispatch = Dispatch(List=cap_holes_2, DispatchPattern=random)  # -> ListA, ListB
colour_swatch = ColourSwatch(SwatchColor=RGB(191, 191, 191))
colour_swatch_2 = ColourSwatch(SwatchColor=RGB(64, 64, 64))
custom_preview_3 = CustomPreview(Geometry=dispatch.ListA, Material=colour_swatch)
custom_preview_4 = CustomPreview(Geometry=dispatch.ListB, Material=colour_swatch_2)

# ---- group: random gradient of pavers
# random gradient of colored pavers
X_3 = Slider(1, range=0..10)
Y_3 = Slider(3, range=0..10)
extent_x_3 = Slider(30, range=0..30)
extent_y_3 = Slider(10, range=0..10)
offset = Slider(0.05, range=0..1)
Z_5 = Slider(0.5, range=0..3)
seed_2 = Slider(0, range=0..100)
unit_z_3 = UnitZ(Factor=Z_5)
rectangular_3 = Rectangular(Plane=PlaneXY(0, 0, 0), SizeX=X_3, SizeY=Y_3, ExtentX=extent_x_3, ExtentY=extent_y_3)  # -> Cells, Points
negative_3 = Negative(Value=offset)
offset_curve_3 = OffsetCurve(Curve=rectangular_3.Cells, Distance=negative_3, Plane=PlaneXY(0, 0, 0), Corners=1)  # -> flatten(Curve)
extrude_3 = Extrude(Base=offset_curve_3, Direction=unit_z_3)
list_length_2 = ListLength(List=offset_curve_3)
cap_holes_3 = CapHoles(Brep=extrude_3)
random_2 = Random(Range=Domain(0, 1), Number=list_length_2, Seed=seed_2, Integers=False)
gradient = Gradient(LowerLimit=0, UpperLimit=1, Parameter=random_2, stops=[0: RGB(224, 224, 224), 1: RGB(64, 64, 64)])
custom_preview_5 = CustomPreview(Geometry=cap_holes_3, Material=gradient)

# ---- group: paving color from noise
# noisy paving colors
# using noise4d
X_4 = Slider(1, range=0..10)
Y_4 = Slider(3, range=0..10)
extent_x_4 = Slider(30, range=0..30)
extent_y_4 = Slider(10, range=0..30)
Z_6 = Slider(0.5, range=0..3)
offset_2 = Slider(0.05, range=0..1)
time = Slider(3, range=0..100)
scale = Slider(0.05, range=0..1)
rectangular_4 = Rectangular(Plane=PlaneXY(0, 0, 0), SizeX=X_4, SizeY=Y_4, ExtentX=extent_x_4, ExtentY=extent_y_4)  # -> Cells, Points
negative_4 = Negative(Value=offset_2)
unit_z_4 = UnitZ(Factor=Z_6)
polygon_center = PolygonCenter(Polyline=flatten(rectangular_4.Cells))  # -> CenterV, CenterE, CenterA
offset_curve_4 = OffsetCurve(Curve=rectangular_4.Cells, Distance=negative_4, Plane=PlaneXY(0, 0, 0), Corners=1)  # -> flatten(Curve)
extrude_4 = Extrude(Base=offset_curve_4, Direction=unit_z_4)
perlinnoise = PerlinNoise(Values=polygon_center.CenterA, Time=time, Scale=scale)
cap_holes_4 = CapHoles(Brep=extrude_4)
bounds = Bounds(Numbers=perlinnoise)
remap_numbers = RemapNumbers(Value=perlinnoise, Source=bounds, Target=Domain(0, 1))  # -> Mapped, Clipped
gradient_2 = Gradient(LowerLimit=0, UpperLimit=1, Parameter=remap_numbers.Mapped, stops=[0: RGB(224, 224, 224), 1: RGB(64, 64, 64)])
custom_preview_6 = CustomPreview(Geometry=cap_holes_4, Material=gradient_2)

# ----
# noisy paving elevation
# using noise4d
X_5 = Slider(2, range=0..10)
Y_5 = Slider(2, range=0..10)
extent_x_5 = Slider(20, range=0..30)
extent_y_5 = Slider(20, range=0..30)
offset_3 = Slider(0.05, range=0..1)
time_2 = Slider(3, range=0..100)
scale_2 = Slider(0.06, range=0..1)
Z_7 = Slider(1, range=0..3)
rectangular_5 = Rectangular(Plane=PlaneXY(0, 0, 0), SizeX=X_5, SizeY=Y_5, ExtentX=extent_x_5, ExtentY=extent_y_5)  # -> Cells, Points
negative_5 = Negative(Value=offset_3)
unit_z_5 = UnitZ(Factor=Z_7)
polygon_center_2 = PolygonCenter(Polyline=flatten(rectangular_5.Cells))  # -> CenterV, CenterE, CenterA
offset_curve_5 = OffsetCurve(Curve=rectangular_5.Cells, Distance=negative_5, Plane=PlaneXY(0, 0, 0), Corners=1)  # -> flatten(Curve)
extrude_5 = Extrude(Base=offset_curve_5, Direction=unit_z_5)
perlinnoise_2 = PerlinNoise(Values=polygon_center_2.CenterA, Time=time_2, Scale=scale_2)
cap_holes_5 = CapHoles(Brep=extrude_5)
bounds_2 = Bounds(Numbers=perlinnoise_2)
bounds_3 = Bounds(Numbers=perlinnoise_2)
remap_numbers_2 = RemapNumbers(Value=perlinnoise_2, Source=bounds_2, Target="-3 To 3")  # -> Mapped, Clipped
remap_numbers_3 = RemapNumbers(Value=perlinnoise_2, Source=bounds_3, Target=Domain(0, 1))  # -> Mapped, Clipped
gradient_3 = Gradient(LowerLimit=0, UpperLimit=1, Parameter=remap_numbers_3.Mapped, stops=[0: RGB(224, 224, 224), 1: RGB(64, 64, 64)])
unit_z_6 = UnitZ(Factor=remap_numbers_2.Mapped)
move = Move(Geometry=cap_holes_5, Motion=unit_z_6)  # -> Geometry, Transform
custom_preview_7 = CustomPreview(Geometry=move.Geometry, Material=gradient_3)

# ---- group: paving pattern from noise
# gradient of hexagonal pavers
# using noise4d
Y_6 = Slider(2, range=0..10)
extent_x_6 = Slider(25, range=0..250)
extent_y_6 = Slider(25, range=0..250)
Z_8 = Slider(0.3, range=0..3)
offset_4 = Slider(0.05, range=0..1)
time_3 = Slider(1, range=0..100)
scale_3 = Slider(0.05, range=0..1)
threshold = Slider(0.5, range=0..1)
hexagonal = Hexagonal(Plane=PlaneXY(0, 0, 0), Size=Y_6, ExtentX=extent_x_6, ExtentY=extent_y_6)  # -> Cells, Points
unit_z_7 = UnitZ(Factor=Z_8)
negative_6 = Negative(Value=offset_4)
offset_curve_6 = OffsetCurve(Curve=hexagonal.Cells, Distance=negative_6, Plane=PlaneXY(0, 0, 0), Corners=1)  # -> flatten(Curve)
perlinnoise_3 = PerlinNoise(Values=flatten(hexagonal.Points), Time=time_3, Scale=scale_3)
extrude_6 = Extrude(Base=offset_curve_6, Direction=unit_z_7)
bounds_4 = Bounds(Numbers=perlinnoise_3)
remap_numbers_4 = RemapNumbers(Value=perlinnoise_3, Source=bounds_4, Target=Domain(0, 1))  # -> Mapped, Clipped
cap_holes_6 = CapHoles(Brep=extrude_6)
larger_than = LargerThan(FirstNumber=remap_numbers_4.Mapped, SecondNumber=threshold)  # -> LargerThan, OrEqualTo
cull_pattern = CullPattern(List=cap_holes_6, CullPattern=larger_than.LargerThan)
cull_pattern_2 = CullPattern(List=remap_numbers_4.Mapped, CullPattern=larger_than.LargerThan)
gradient_4 = Gradient(LowerLimit=threshold, UpperLimit=1, Parameter=cull_pattern_2, stops=[0: RGB(192, 192, 192), 1: RGB(64, 64, 64)])
custom_preview_8 = CustomPreview(Geometry=cull_pattern, Material=gradient_4)

# ---- group: bake to new layers
# using elefront
seed_3 = Text(seed)
colour = Colour([colour_swatch, colour_swatch_2])
geometry = Geometry([dispatch.ListA, dispatch.ListB])
concatenate = Concatenate(Fragment_A="Seed ", Fragment_B=seed_3, A=[" Light", " Dark"])
define_layer = DefineLayer(Name=concatenate, Color=colour)
define_object_attributes = DefineObjectAttributes(Layer=define_layer, Material=colour)
bake_objects = BakeObjects(Geometry=geometry, Attributes=define_object_attributes, Bake=False)

# ---- group: paving color from noise
# noisy hexagonal pavers
# using noise4d
Y_7 = Slider(2, range=0..10)
extent_x_7 = Slider(25, range=0..100)
extent_y_7 = Slider(25, range=0..100)
Z_9 = Slider(0.5, range=0..3)
offset_5 = Slider(0.05, range=0..1)
time_4 = Slider(1, range=0..100)
scale_4 = Slider(0.05, range=0..1)
unit_z_8 = UnitZ(Factor=Z_9)
negative_7 = Negative(Value=offset_5)

# ----
hexagonal_2 = Hexagonal(Plane=PlaneXY(0, 0, 0), Size=Y_7, ExtentX=extent_x_7, ExtentY=extent_y_7)  # -> Cells, Points

# ---- group: paving color from noise (continued)
perlinnoise_4 = PerlinNoise(Values=flatten(hexagonal_2.Points), Time=time_4, Scale=scale_4)
offset_curve_7 = OffsetCurve(Curve=hexagonal_2.Cells, Distance=negative_7, Plane=PlaneXY(0, 0, 0), Corners=1)  # -> flatten(Curve)
extrude_7 = Extrude(Base=offset_curve_7, Direction=unit_z_8)
bounds_5 = Bounds(Numbers=perlinnoise_4)
remap_numbers_5 = RemapNumbers(Value=perlinnoise_4, Source=bounds_5, Target=Domain(0, 1))  # -> Mapped, Clipped
cap_holes_7 = CapHoles(Brep=extrude_7)
gradient_5 = Gradient(LowerLimit=0, UpperLimit=1, Parameter=remap_numbers_5.Mapped, stops=[0: RGB(224, 224, 224), 1: RGB(64, 64, 64)])
custom_preview_9 = CustomPreview(Geometry=cap_holes_7, Material=gradient_5)
