# Grasshopper definition random-sine-curves.gh (Grasshopper 1.0.7)

# ----
# random sine curves
factor = Slider(1.61, range=0..3)
steps = Slider(10, range=0..10)
count = Slider(6, range=0..10)
seed = Slider(5, range=0..100)
x_scale = Slider(100, range=0..360)
y_scale = Slider(75, range=0..360)
pi = Pi(Factor=factor)
random = Random(Range="0 To 2", Number=count, Seed=seed)
range = Range(Domain=pi, Steps=steps)
multiplication = Multiplication(A=range, B=graft(random))
sine = Sine(Value=multiplication)
construct_point = ConstructPoint(XCoordinate=range, YCoordinate=sine, ZCoordinate=0)
interpolate = Interpolate(Vertices=construct_point, Degree=3, Periodic=False, KnotStyle=1)  # -> Curve, Length, Domain
scale_nu = ScaleNU(Geometry=interpolate.Curve, Plane=PlaneXY(0, 0, 0), ScaleX=x_scale, ScaleY=y_scale, ScaleZ=1)  # -> Geometry, Transform
curve = Curve(flatten(scale_nu.Geometry))
