# Grasshopper definition robotic-wall.gh (Grasshopper 1.0.8)
# Copyright: GNU General Public License 3.0
# plug-ins: BitmapPlus

# ----
# robotic wall
# procedural noise
# bitmap+
seed = Slider(0, range=0..100)
width = Slider(34, range=0..100)
height = Slider(32, range=0..100)
depth = Slider(5000, range=0..10000)
list = ValueList({"Value": 0, "Perlin": 1, "Cubic": 2, "Simplex": 3, "WhiteNoise": 4}, selected="Perlin")
list_2 = ValueList({"Linear": 0, "Hermite": 1, "Quintic": 2}, selected="Hermite")
# construct grid
frequency = Slider(0.094, range=0..0.1)
procedural_noise = ProceduralNoise(Seed=seed, Width=width, Height=height, Depth=depth, Mode=list, Interpolation=list_2, Frequency=frequency)  # -> Image, Noise
prev_image = PrevImage(SmartBitmap=procedural_noise.Image)
image = Data(procedural_noise.Image)

image_2 = Data(image)
bitmap_properties = BitmapProperties(Image=image_2)  # -> Boundary, Width, Height, HorizontalResolution, VerticalResolution, Format
mesh_plane = MeshPlane(
    Boundary=bitmap_properties.Boundary,
    WidthCount=expr("x-1", bitmap_properties.Width),
    HeightCount=expr("x-1", bitmap_properties.Height))  # -> Mesh, Area
xz_plane = XZPlane(Origin=Point(0, 0, 0))
orient = Orient(Geometry=mesh_plane.Mesh, Source=PlaneXY(0, 0, 0), Target=xz_plane)  # -> Geometry, Transform
deconstruct_mesh = DeconstructMesh(Mesh=orient.Geometry)  # -> Vertices, Faces, Colours, Normals
mesh_face = MeshFace(deconstruct_mesh.Faces)
point = Point(deconstruct_mesh.Vertices)

image_3 = Data(image_2)
# extract noise
deconstruct_bitmap = DeconstructBitmap(Image=image_3)
split_ahsv = SplitAHSV(Colour=deconstruct_bitmap)  # -> Alpha, Hue, Saturation, Value
noise = Number(split_ahsv.Value)

# ----
# 3D mesh
point_2 = Point(point)
mesh_face_2 = MeshFace(mesh_face)
y_factor = Slider(4, range=0..10)
noise_2 = Number(noise)
multiplication = Multiplication(A=y_factor, B=noise_2)
unit_y = UnitY(Factor=multiplication)
gradient = Gradient(
    LowerLimit=0,
    UpperLimit=1,
    Parameter=noise_2,
    stops=[0: RGB(68, 1, 84), 0.167: RGB(68, 57, 131), 0.334: RGB(49, 104, 142), 0.501: RGB(33, 145, 140), 0.668: RGB(53, 183, 121), 0.835: RGB(144, 215, 67), 1: RGB(253, 231, 37)])
move = Move(Geometry=point_2, Motion=unit_y)  # -> Geometry, Transform
construct_mesh = ConstructMesh(Vertices=move.Geometry, Faces=mesh_face_2, Colours=gradient)
mesh = Mesh(construct_mesh)

# ---- group: parametric module
# module
X = Slider(6, range=0..10)
Y = Slider(4, range=0..10)
Z = Slider(2, range=0..10)
domain_box = DomainBox(Base=PlaneXY(0, 0, 0), X=X, Y=Y, Z=Z)
module = Brep(domain_box)

# ----
# contour
mesh_2 = Mesh(mesh)
Z_2 = Number(Z)
count = Slider(10, range=0..100)
contour = Contour(Shape=mesh_2, Point=Point(0, 0, 0), Direction=Vector(0, 0, 1), Distance=Z_2)  # -> flatten(Contours)
divide_curve = DivideCurve(Curve=contour, Count=count, Kinks=False)  # -> flatten(Points), Tangents, Parameters
dispatch = Dispatch(List=divide_curve.Points, DispatchPattern=[True, False])  # -> ListA, ListB
point_3 = Point(dispatch.ListA)

# ----
# assemble wall
module_2 = Brep(module)
point_4 = Point(point_3)
deconstruct = Deconstruct(Point=point_4)  # -> XComponent, YComponent, expr("x*100", ZComponent)
addition = Addition(A=deconstruct.XComponent, B=deconstruct.ZComponent)
sort_list = SortList(Keys=addition, ValuesValuesA=point_4)  # -> Keys, ValuesValuesA
move_2 = Move(Geometry=module_2, Motion=sort_list.ValuesValuesA)  # -> Geometry, Transform
modules = Brep(move_2.Geometry)
point_5 = Point(sort_list.ValuesValuesA)

# ----
# depth
point_6 = Point(dispatch.ListA)
unit_y_2 = UnitY(Factor=1)
negative = Negative(Value=unit_y_2)
xz_plane_2 = XZPlane(Origin=Point(0, 0, 0))
project_point = ProjectPoint(Point=point_6, Direction=negative, Geometry=xz_plane_2)  # -> Point, Index
distance = Distance(PointA=point_6, PointB=project_point.Point)
number = Number(distance)

# ----
# gradient
modules_2 = Brep(modules)
number_2 = Number(number)
bounds = Bounds(Numbers=number_2)
remap_numbers = RemapNumbers(Value=number_2, Source=bounds, Target=Domain(0, 1))  # -> Mapped, Clipped
gradient_2 = Gradient(
    LowerLimit=0,
    UpperLimit=1,
    Parameter=remap_numbers.Mapped,
    stops=[0: RGB(68, 1, 84), 0.167: RGB(68, 57, 131), 0.334: RGB(49, 104, 142), 0.501: RGB(33, 145, 140), 0.668: RGB(53, 183, 121), 0.835: RGB(144, 215, 67), 1: RGB(253, 231, 37)])
custom_preview = CustomPreview(Geometry=modules_2, Material=gradient_2)

# ----
# cellular noise
seed_2 = Slider(4, range=0..100)
width_2 = Slider(36, range=0..100)
height_2 = Slider(16, range=0..100)
depth_2 = Slider(150, range=0..500)
list_3 = ValueList({"Euclidean": 0, "Manhattan": 1, "Natural": 2}, selected="Euclidean")
list_4 = ValueList({"Value": 0, "Distance2": 2, "Dist2Add": 3, "Dist2Sub": 4, "Dist2Mul": 5, "Dist2Div": 6}, selected="Dist2Div")
procedural_cellular = ProceduralCellular(
    Seed=seed_2,
    Width=width_2,
    Height=height_2,
    Depth=depth_2,
    BoundaryMode=list_3,
    InterpolationMode=list_4,
    Jitter=Slider(0.5, range=0..1),
    Frequency=Slider(0.07, range=0..1))
prev_image_2 = PrevImage(SmartBitmap=procedural_cellular)
image_4 = Data(procedural_cellular)
