# Grasshopper definition solidify.gh (Grasshopper 1.0.7)
# Copyright: GNU General Public License 3.0
# plug-ins: Kangaroo2 Components

# ---- group: set terrain mesh
# solidify
# input geometry
# extract base
mesh = Mesh(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)

# ----
Z = Slider(-15, range=-50..50)
# extract sides
mesh_2 = Mesh(mesh)
deconstruct_mesh = DeconstructMesh(Mesh=mesh_2)  # -> Vertices, Faces, Colours, Normals
unit_z = UnitZ(Factor=Z)
project = Project(Geometry=deconstruct_mesh.Vertices, Plane=unit_z)  # -> Geometry, Transform
construct_mesh = ConstructMesh(Vertices=project.Geometry, Faces=deconstruct_mesh.Faces)
mesh_3 = Mesh(construct_mesh)

mesh_4 = Mesh(mesh)
mesh_5 = Mesh(mesh_3)
mesh_edges = MeshEdges(Mesh=mesh_4)  # -> flatten(NakedEdges), InteriorEdges, NonManifoldEdges
mesh_edges_2 = MeshEdges(Mesh=mesh_5)  # -> flatten(NakedEdges), InteriorEdges, NonManifoldEdges
end_points = EndPoints(Curve=mesh_edges.NakedEdges)  # -> Start, End
end_points_2 = EndPoints(Curve=mesh_edges_2.NakedEdges)  # -> Start, End
merge = Merge(
    Data1=graft(end_points.Start),
    Data2=graft(end_points.End),
    Data3=graft(end_points_2.End),
    Data4=graft(end_points_2.Start))
construct_mesh_2 = ConstructMesh(Vertices=merge, Faces={A=0, B=1, C=2, D=3})  # -> flatten(Mesh)
mesh_6 = Mesh(construct_mesh_2)

# ----
# join meshes
mesh_7 = Mesh(mesh)
mesh_8 = Mesh(mesh_6)
mesh_9 = Mesh(mesh_3)
mesh_join = MeshJoin(Meshes=flatten([mesh_7, mesh_8, mesh_9]))
unify_mesh = UnifyMesh(Mesh=mesh_join)  # -> Result, Count
combine_clean = CombineClean(Meshes=unify_mesh.Result)
custom_preview = CustomPreview(Geometry=combine_clean, Material=ColourSwatch(SwatchColor=RGB(217, 217, 217)))
mesh_10 = Mesh(combine_clean)

# ----
# color mesh
mesh_11 = Mesh(mesh_10)
deconstruct_mesh_2 = DeconstructMesh(Mesh=mesh_11)  # -> Vertices, Faces, Colours, Normals
deconstruct = Deconstruct(Point=deconstruct_mesh_2.Vertices)  # -> XComponent, YComponent, ZComponent
bounds = Bounds(Numbers=deconstruct.ZComponent)
remap_numbers = RemapNumbers(Value=deconstruct.ZComponent, Source=bounds, Target=Domain(0, 1))  # -> Mapped, Clipped
graph_mapper = GraphMapper(
    remap_numbers.Mapped,
    x0=0,
    x1=1,
    y0=0,
    y1=1,
    Gx=0.7958365083,
    Gy=0.3527982235,
    container_name="Power",
    power=4.562323175)
gradient = Gradient(
    LowerLimit=0,
    UpperLimit=1,
    Parameter=graph_mapper,
    stops=[0: RGB(55, 11, 65), 0.125: RGB(27, 30, 59), 0.25: RGB(22, 83, 76), 0.375: RGB(68, 119, 49), 0.5: RGB(161, 121, 74), 0.625: RGB(212, 132, 169), 0.75: RGB(198, 180, 238), 0.875: RGB(203, 232, 240), 1: RGB(255, 255, 255)])
mesh_colours = MeshColours(Mesh=mesh_11, Colours=gradient)
mesh_12 = Mesh(mesh_colours)
