# Grasshopper definition solids.gh (Grasshopper 1.0.7)
# Copyright: GNU General Public License 3.0

# ---- group: boolean difference
# solids
X = Slider(10, range=0..10)
Y = Slider(10, range=0..10)
Z = Slider(10, range=0..10)
plane_y = Slider(5, range=0..10)
construct_point = ConstructPoint(XCoordinate=0, YCoordinate=plane_y, ZCoordinate=0)
rectangle = Rectangle(Plane=PlaneXY(0, 0, 0), XSize=X, YSize=Y, Radius=0)  # -> Rectangle, Length
box_rectangle = BoxRectangle(Rectangle=rectangle.Rectangle, Height=Z)
xz_plane = XZPlane(Origin=construct_point)
plane_surface = PlaneSurface(Plane=xz_plane, XSize=Domain(-10, 10), YSize=Domain(-10, 10))
solid_difference = SolidDifference(BrepsA=box_rectangle, BrepsB=plane_surface)
