# Grasshopper definition sort-points.gh (Grasshopper 1.0.8)

point = Point()
point_order = PointOrder(Points=point)
deconstruct = Deconstruct(Point=point)  # -> XComponent, YComponent, expr("x*100", ZComponent)
# package as component
addition = Addition(A=deconstruct.XComponent, B=deconstruct.ZComponent)
sort_list = SortList(Keys=addition, ValuesValuesA=point)  # -> Keys, ValuesValuesA
point_order_2 = PointOrder(Points=sort_list.ValuesValuesA)
