# Grasshopper definition terrain-grading.gh (Grasshopper 1.0.7)
# Copyright: GNU General Public License 3.0
# plug-ins: Docofossor

file_path = FilePath("D:\generative-design\grasshopper\data\elevation.xyz")
skip = Slider(2, range=0..10)
import_xyz = ImportXYZ(F=file_path, N=skip)
grid_shift = GridShift(Df=import_xyz)
grid_mesh = GridMesh(Df=grid_shift)
area = Area(Geometry=grid_mesh)  # -> Area, Centroid
xz_plane = XZPlane(Origin=area.Centroid)
mirror = Mirror(Geometry=grid_mesh, Plane=xz_plane)  # -> Geometry, Transform
custom_preview = CustomPreview(Geometry=mirror.Geometry, Material=ColourSwatch(SwatchColor=RGB(204, 204, 204)))

data = Data(grid_shift)
curve = Curve(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)
slope = Slider(33, range=0..100)
distance = Slider(30, range=0..100)
width = Slider(1, range=0..10)
cut_fill_in_path = CutFillInPath(Df=data, Crv=curve, W=width, Sa=slope, D=distance)  # -> Df, Vol
grid_mesh_2 = GridMesh(Df=cut_fill_in_path.Df)
bounding_box = BoundingBox(Content=grid_mesh_2, Plane=PlaneXY(0, 0, 0))  # -> Box, Box_2
evaluate_box = EvaluateBox(Box=bounding_box.Box, UParameter=0.5, VParameter=0.5, WParameter=0.5)  # -> Plane, Point, Include
xz_plane_2 = XZPlane(Origin=evaluate_box.Point)
mirror_2 = Mirror(Geometry=grid_mesh_2, Plane=xz_plane_2)  # -> Geometry, Transform
custom_preview_2 = CustomPreview(Geometry=mirror_2.Geometry, Material=ColourSwatch(SwatchColor=RGB(204, 204, 204)))

data_2 = Data(cut_fill_in_path.Df)
point = Point(Point(40.76848003, 48.62849138, 10.74654629))
radius = Slider(16, range=0..25)
wavelength = Slider(32, range=0..100)
amplitude = Slider(2, range=0..10)
smoothing = Slider(10, range=0..10)
circle = Circle(Plane=point, Radius=radius)
noise = Noise(Df=data_2, Crv=circle, Wl=wavelength, A=amplitude, S=smoothing)
grid_mesh_3 = GridMesh(Df=noise)
bounding_box_2 = BoundingBox(Content=grid_mesh_3, Plane=PlaneXY(0, 0, 0))  # -> Box, Box_2
evaluate_box_2 = EvaluateBox(Box=bounding_box_2.Box, UParameter=0.5, VParameter=0.5, WParameter=0.5)  # -> Plane, Point, Include
xz_plane_3 = XZPlane(Origin=evaluate_box_2.Point)
mirror_3 = Mirror(Geometry=grid_mesh_3, Plane=xz_plane_3)  # -> Geometry, Transform
custom_preview_3 = CustomPreview(Geometry=mirror_3.Geometry, Material=ColourSwatch(SwatchColor=RGB(204, 204, 204)))

data_3 = Data(grid_shift)
surface = Surface(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)
slope_2 = Slider(33, range=0..100)
distance_2 = Slider(30, range=0..100)
cut_in_surface = CutInSurface(Df=data_3, Srf=surface, Sa=slope_2, D=distance_2)  # -> Df, Vol
grid_mesh_4 = GridMesh(Df=cut_in_surface.Df)
bounding_box_3 = BoundingBox(Content=grid_mesh_4, Plane=PlaneXY(0, 0, 0))  # -> Box, Box_2
evaluate_box_3 = EvaluateBox(Box=bounding_box_3.Box, UParameter=0.5, VParameter=0.5, WParameter=0.5)  # -> Plane, Point, Include
xz_plane_4 = XZPlane(Origin=evaluate_box_3.Point)
mirror_4 = Mirror(Geometry=grid_mesh_4, Plane=xz_plane_4)  # -> Geometry, Transform
custom_preview_4 = CustomPreview(Geometry=mirror_4.Geometry, Material=ColourSwatch(SwatchColor=RGB(204, 204, 204)))

data_4 = Data(grid_shift)
surface_2 = Surface(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)
slope_3 = Slider(33, range=0..100)
distance_3 = Slider(30, range=0..100)
surface_3 = Surface(<surface referenced from the Rhino model>)
cut_in_surface_2 = CutInSurface(Df=data_4, Srf=surface_2, Sa=slope_3, D=distance_3)  # -> Df, Vol
cut_fill_in_surface = CutFillInSurface(Df=cut_in_surface_2.Df, Srf=surface_3)  # -> Df, Vol
grid_mesh_5 = GridMesh(Df=cut_fill_in_surface.Df)
bounding_box_4 = BoundingBox(Content=grid_mesh_5, Plane=PlaneXY(0, 0, 0))  # -> Box, Box_2
evaluate_box_4 = EvaluateBox(Box=bounding_box_4.Box, UParameter=0.5, VParameter=0.5, WParameter=0.5)  # -> Plane, Point, Include
xz_plane_5 = XZPlane(Origin=evaluate_box_4.Point)
mirror_5 = Mirror(Geometry=grid_mesh_5, Plane=xz_plane_5)  # -> Geometry, Transform
custom_preview_5 = CustomPreview(Geometry=mirror_5.Geometry, Material=ColourSwatch(SwatchColor=RGB(204, 204, 204)))
