# Grasshopper definition terrain-mesh-attractor.gh (Grasshopper 1.0.7)
# Copyright: GNU General Public License 3.0

# ----
# terrain
# mesh
point = Point([<point referenced from the Rhino model> x625])
delaunay_mesh = DelaunayMesh(Points=point, Plane=PlaneXY(0, 0, 0))
deconstruct_mesh = DeconstructMesh(Mesh=delaunay_mesh)  # -> Vertices, Faces, Colours, Normals
deconstruct = Deconstruct(Point=deconstruct_mesh.Vertices)  # -> XComponent, YComponent, ZComponent
bounds = Bounds(Numbers=deconstruct.ZComponent)
remap_numbers = RemapNumbers(Value=deconstruct.ZComponent, Source=bounds, Target=Domain(0, 1))  # -> Mapped, Clipped
gradient = Gradient(
    LowerLimit=0,
    UpperLimit=1,
    Parameter=remap_numbers.Mapped,
    stops=[0: RGB(55, 11, 65), 0.125: RGB(27, 30, 59), 0.25: RGB(22, 83, 76), 0.375: RGB(68, 119, 49), 0.5: RGB(161, 121, 74), 0.625: RGB(212, 132, 169), 0.75: RGB(198, 180, 238), 0.875: RGB(203, 232, 240), 1: RGB(255, 255, 255)])
construct_mesh = ConstructMesh(Vertices=deconstruct_mesh.Vertices, Faces=deconstruct_mesh.Faces, Colours=gradient)
mesh = Mesh(construct_mesh)

point_2 = Point([<point referenced from the Rhino model> x625])
point_3 = Point(Point(201.3088426, 120.388531, 0.06190810079))
number_slider = Slider(12, range=0..100)
closest_point = ClosestPoint(Point=point_2, Cloud=point_3)  # -> ClosestPoint, CPIndex, Distance
panel = Panel("1 To 0")
bounds_2 = Bounds(Numbers=closest_point.Distance)
remap_numbers_2 = RemapNumbers(Value=closest_point.Distance, Source=bounds_2, Target=Domain(0, 1))  # -> Mapped, Clipped
graph_mapper = GraphMapper(
    remap_numbers_2.Mapped,
    x0=0,
    x1=1,
    y0=0,
    y1=1,
    container_name="Bezier",
    cpx=[0, 0.6075855494, 0, 1],
    cpy=[1, 0.2314590216, 0, 0])
multiplication = Multiplication(A=graph_mapper, B=Slider(10, range=0..100))
unit_z = UnitZ(Factor=multiplication)
move = Move(Geometry=point_2, Motion=unit_z)  # -> Geometry, Transform
point_4 = Point(move.Geometry)

point_5 = Point(point_4)
delaunay_mesh_2 = DelaunayMesh(Points=point_5, Plane=PlaneXY(0, 0, 0))
deconstruct_mesh_2 = DeconstructMesh(Mesh=delaunay_mesh_2)  # -> Vertices, Faces, Colours, Normals
deconstruct_2 = Deconstruct(Point=deconstruct_mesh_2.Vertices)  # -> XComponent, YComponent, ZComponent
bounds_3 = Bounds(Numbers=deconstruct_2.ZComponent)
remap_numbers_3 = RemapNumbers(Value=deconstruct_2.ZComponent, Source=bounds_3, Target=Domain(0, 1))  # -> Mapped, Clipped
gradient_2 = Gradient(
    LowerLimit=0,
    UpperLimit=1,
    Parameter=remap_numbers_3.Mapped,
    stops=[0: RGB(55, 11, 65), 0.125: RGB(27, 30, 59), 0.25: RGB(22, 83, 76), 0.375: RGB(68, 119, 49), 0.5: RGB(161, 121, 74), 0.625: RGB(212, 132, 169), 0.75: RGB(198, 180, 238), 0.875: RGB(203, 232, 240), 1: RGB(255, 255, 255)])
construct_mesh_2 = ConstructMesh(Vertices=deconstruct_mesh_2.Vertices, Faces=deconstruct_mesh_2.Faces, Colours=gradient_2)
mesh_2 = Mesh(construct_mesh_2)

# ----
# contours
mesh_3 = Mesh(mesh_2)
interval = Slider(1, range=0..10)
contour = Contour(Shape=mesh_3, Point=Point(0, 0, 0), Direction=Vector(0, 0, 1), Distance=interval)  # -> flatten(Contours)
custom_preview = CustomPreview(Geometry=contour, Material=ColourSwatch(SwatchColor=RGB(171, 171, 171)))

# ----
# contours
mesh_4 = Mesh(mesh)
interval_2 = Slider(1, range=0..10)
contour_2 = Contour(Shape=mesh_4, Point=Point(0, 0, 0), Direction=Vector(0, 0, 1), Distance=interval_2)  # -> flatten(Contours)
custom_preview_2 = CustomPreview(Geometry=contour_2, Material=ColourSwatch(SwatchColor=RGB(0, 0, 0)))
