# Grasshopper definition terrain-modeling-reverse-list.gh (Grasshopper 1.0.7)
# plug-ins: Docofossor

# ----
# import terrain
# using docofossor
file_path = FilePath("D:\generative-design\grasshopper\data\elevation.xyz")
import_xyz = ImportXYZ(F=file_path, N="5")
grid_shift = GridShift(Df=import_xyz)
split_list = SplitList(List=grid_shift, Index="10")  # -> ListA, ListB
reverse_list = ReverseList(List=split_list.ListB)
merge = Merge(Data1=split_list.ListA, Data2=reverse_list)
grid_mesh = GridMesh(Df=merge)
custom_preview = CustomPreview(Geometry=grid_mesh, Material=ColourSwatch(SwatchColor=RGB(230, 230, 230)))
