# Grasshopper definition topographic-attractor.gh (Grasshopper 1.0.7)
# plug-ins: Pufferfish, atträctor

# ---- group: generate a conical tree
# diameter at breast height (DBH)
trunk_diameter = Slider(0.75, range=0..2)
crown_height = Slider(30, range=0..75)
trunk_height = Slider(8, range=0..100)
canopy_layers = Slider(3, range=0..10)
canopy_diameter = Slider(10, range=0..100)
conical_tree = ConicalTree(A=trunk_diameter, factor=trunk_height, factor_2=crown_height, B=canopy_layers, A_2=canopy_diameter)  # -> trunk, canopy
canopy_color = ColourSwatch(SwatchColor=RGBA(58, 94, 58, 232))
trunk_color = ColourSwatch(SwatchColor=RGB(139, 76, 57))
custom_preview = CustomPreview(Geometry=conical_tree.trunk, Material=trunk_color)
custom_preview_2 = CustomPreview(Geometry=conical_tree.canopy, Material=canopy_color)

# ---- group: point attractors for terrain
number_slider = Slider(10, range=0..360)
number_slider_2 = Slider(10, range=0..360)
sqgrid = Square(Plane=PlaneXY(0, 0, 0), Size=number_slider_2, ExtentX=number_slider, ExtentY=number_slider)  # -> Cells, Points

# ---- group: point attractors for trees
# parametric trees
number_slider_3 = Slider(250, range=0..360)
# forest attractor
number_slider_4 = Slider(30, range=0..360)
multiplication = Multiplication(A=number_slider_2, B=number_slider)
rectangle = Rectangle(Plane=PlaneXY(0, 0, 0), XSize=multiplication, YSize=multiplication, Radius=0)  # -> Rectangle, Length
pop2d = Populate2D(Region=rectangle.Rectangle, Count=number_slider_3, Seed=1)

# ---- group: point attractors for terrain
# topographic attractor
md_slider = MDSlider(
    SliderMode=0,
    slider_value=Point(0.3125097693, 0.32472229, 0.5),
    x_domain=Domain(0, 100),
    y_domain=Domain(0, 100),
    z_domain=Domain(0, 1))
md_slider_2 = MDSlider(
    SliderMode=0,
    slider_value=Point(0.536037352, 0.6216709788, 0.5),
    x_domain=Domain(0, 100),
    y_domain=Domain(0, 100),
    z_domain=Domain(0, 1))
md_slider_3 = MDSlider(
    SliderMode=0,
    slider_value=Point(0.7389675233, 0.5557407286, 0.5),
    x_domain=Domain(0, 100),
    y_domain=Domain(0, 100),
    z_domain=Domain(0, 1))
z_factor = Slider(5, range=0..100)
step = Slider(6, range=0..100)
range = Range(Domain=Domain(0, 1), Steps=step)
attractor = Point([md_slider_3, md_slider_2, md_slider])
interpolate_data = InterpolateData(Data=attractor, Parameter=range, Interpolation=4)
attr = Atträctor(Grid=sqgrid.Cells, Attractors=interpolate_data, Radius=Slider(50, range=0..100), isreversed="False")  # -> Grid, Values
multiplication_2 = Multiplication(A=attr.Values, B=z_factor)
Z = UnitZ(Factor=multiplication_2)
move = Move(Geometry=sqgrid.Points, Motion=Z)  # -> Geometry, Transform
patch = Patch(Curves=rectangle.Rectangle, Points=flatten(move.Geometry), Spans=20, Flexibility=1, Trim=True)
project = ProjectPoint(Point=attractor, Direction="0,0,1", Geometry=patch)  # -> Point, Index
contour = Contour(Shape=patch, Point=Point(0, 0, 0), Direction=Vector(0, 0, 1), Distance=Slider(1, range=0..10))
attractor_color = ColourSwatch(SwatchColor=RGB(0, 0, 0))
surface_color = ColourSwatch(SwatchColor=RGB(183, 207, 182))
surface_color_2 = ColourSwatch(SwatchColor=RGB(76, 76, 76))
preview = CustomPreview(Geometry=project.Point, Material=attractor_color)
preview_2 = CustomPreview(Geometry=contour, Material=surface_color_2)
preview_3 = CustomPreview(Geometry=patch, Material=surface_color)

# ---- group: point attractors for trees (continued)
attr_2 = Atträctor(Grid=pop2d, Attractors=interpolate_data, Radius=number_slider_4, isreversed="True")  # -> Grid, Values
pt = Point(attr_2.Grid)
project_2 = ProjectPoint(Point=pt, Direction="0,0,-1", Geometry=patch)  # -> Point, Index
project_3 = ProjectPoint(Point=pt, Direction="0,0,1", Geometry=patch)  # -> Point, Index
move2pt = MoveToPoint(Geometry=graft(conical_tree.canopy), PointA="0,0,0", PointB=[project_2.Point, project_3.Point])  # -> Moved, Vector, Transform
move2pt_2 = MoveToPoint(Geometry=conical_tree.trunk, PointA="0,0,0", PointB=[project_3.Point, project_2.Point])  # -> Moved, Vector, Transform
scale = Scale(Geometry=move2pt.Moved, Center=[project_2.Point, project_3.Point], Factor="0.25")  # -> Geometry, Transform
scale_2 = Scale(Geometry=move2pt_2.Moved, Center=project_3.Point, Factor=0.5)  # -> Geometry, Transform

# ---- group: canopy color
canopy_color_2 = ColourSwatch(SwatchColor=RGBA(58, 94, 58, 232))
custom_preview_3 = CustomPreview(Geometry=scale.Geometry, Material=canopy_color_2)

# ---- group: trunk color
trunk_color_2 = ColourSwatch(SwatchColor=RGB(139, 76, 57))
custom_preview_4 = CustomPreview(Geometry=scale_2.Geometry, Material=trunk_color_2)

# ==== cluster ConicalTree
factor = ClusterInput()
factor_2 = ClusterInput()
A = ClusterInput()
A_2 = ClusterInput()

# ---- group: conical tree
construct_point = ConstructPoint(XCoordinate=0, YCoordinate=0, ZCoordinate=0)
unit_z = UnitZ(Factor=factor)
unit_z_2 = UnitZ(Factor=factor_2)
division = Division(A=A, B="2.0")
division_2 = Division(A=A_2, B="2.0")
B = ClusterInput()
move = Move(Geometry=construct_point, Motion=unit_z_2)  # -> Geometry, Transform
move_2 = Move(Geometry=construct_point, Motion=unit_z)  # -> Geometry, Transform
division_3 = Division(A=unit_z_2, B=B)
line = Line(StartPoint=construct_point, EndPoint=move_2.Geometry)
line_2 = Line(StartPoint=move_2.Geometry, EndPoint=move.Geometry)
divide_distance = DivideDistance(Curve=line_2, Distance=division_3)  # -> Points, Tangents, Parameters
construct_plane = ConstructPlane(Origin=divide_distance.Points, XAxis=Vector(1, 0, 0), YAxis=Vector(0, 1, 0))
construct_domain = ConstructDomain(DomainStart="0.5", DomainEnd="1.75")
cone = Cone(Base=construct_plane, Radius=division_2, Length=division_3)  # -> Cone, Tip
list_length = ListLength(List=construct_plane)
range = Range(Domain=construct_domain, Steps=list_length)  # -> reverse(Range)
scale = Scale(Geometry=cone.Cone, Center=construct_plane, Factor=range)  # -> Geometry, Transform
pipe = Pipe(Curve=line, Radius=division, Caps=0)
cap_holes = CapHoles(Brep=scale.Geometry)

# ----
canopy = ClusterOutput(cap_holes)
trunk = ClusterOutput(pipe)
