# Grasshopper definition trigonometric-texture.gh (Grasshopper 1.0.7)
# Copyright: GNU General Public License 3.0

# ----
# landforms from textured sine curves
u = Slider(3, range=0..10)
frequency = Slider(0.5, range=0..2)
count = Slider(6, range=0..10)
series = Series(Start="1", Step=frequency, Count=count)  # -> graft(Series)
pi = Pi(Factor=u)
range = Range(Domain=pi, Steps="100")
expression = Expression(u=range, A=series, Expression="sin(A*u)/A+sin(u)")
construct_point = ConstructPoint(XCoordinate=range, YCoordinate=0, ZCoordinate=expression)
interpolate = Interpolate(Vertices=construct_point, Degree=3, Periodic=False, KnotStyle=1)  # -> Curve, Length, Domain
curve = Curve(interpolate.Curve)

# ----
# landforms from random textured sine curves
u_2 = Slider(3, range=0..10)
count_2 = Slider(10, range=0..10)
seed = Slider(52, range=0..100)
pi_2 = Pi(Factor=u_2)
random = Random(Range="1 To 10", Number=count_2, Seed=seed)  # -> graft(Random)
range_2 = Range(Domain=pi_2, Steps="100")
expression_2 = Expression(u=range_2, A=random, Expression="sin(A*u)/A+sin(u)")
construct_point_2 = ConstructPoint(XCoordinate=range_2, YCoordinate=0, ZCoordinate=expression_2)
interpolate_2 = Interpolate(Vertices=construct_point_2, Degree=3, Periodic=False, KnotStyle=1)  # -> Curve, Length, Domain
curve_2 = Curve(interpolate_2.Curve)

y_step = Slider(2, range=0..10)
count_3 = Integer(count)
curve_3 = Curve(curve)
series_2 = Series(Start=0, Step=y_step, Count=count_3)  # -> graft(Series)
unit_y = UnitY(Factor=series_2)
move = Move(Geometry=curve_3, Motion=unit_y)  # -> flatten(Geometry), Transform
loft = Loft(Curves=move.Geometry, Options={Adjust=False, Closed=False, LoftEnds=0, LoftSimp=0, LoftType=0, Rebuild=10, Refit=0.01})
custom_preview = CustomPreview(Geometry=loft, Material=ColourSwatch(SwatchColor=RGB(230, 230, 230)))

curve_4 = Curve(curve_2)
y_step_2 = Slider(1, range=0..10)
count_4 = Integer(count_2)
series_3 = Series(Start=0, Step=y_step_2, Count=count_4)  # -> graft(Series)
unit_y_2 = UnitY(Factor=series_3)
move_2 = Move(Geometry=curve_4, Motion=unit_y_2)  # -> flatten(Geometry), Transform
loft_2 = Loft(Curves=move_2.Geometry, Options={Adjust=False, Closed=False, LoftEnds=0, LoftSimp=0, LoftType=0, Rebuild=10, Refit=0.01})
custom_preview_2 = CustomPreview(Geometry=loft_2, Material=ColourSwatch(SwatchColor=RGB(230, 230, 230)))

# ---- group: cutting plane
surface = Surface(loft)
water_depth = Slider(1.3, range=0..4)
bounding_box = BoundingBox(Content=surface, Plane=PlaneXY(0, 0, 0))  # -> Box, Box_2
brep_edges = BrepEdges(Brep=bounding_box.Box)  # -> Naked, Interior, NonManifold
split_list = SplitList(List=brep_edges.Interior, Index="4")  # -> ListA, ListB
unit_z = UnitZ(Factor=water_depth)
boundary_surfaces = BoundarySurfaces(Edges=split_list.ListA)
move_3 = Move(Geometry=boundary_surfaces, Motion=unit_z)  # -> Geometry, Transform
custom_preview_3 = CustomPreview(Geometry=move_3.Geometry, Material=ColourSwatch(SwatchColor=RGB(0, 0, 0)))

surface_2 = Surface(loft_2)
water_depth_2 = Slider(1.1, range=0..4)
bounding_box_2 = BoundingBox(Content=surface_2, Plane=PlaneXY(0, 0, 0))  # -> Box, Box_2
brep_edges_2 = BrepEdges(Brep=bounding_box_2.Box)  # -> Naked, Interior, NonManifold
split_list_2 = SplitList(List=brep_edges_2.Interior, Index="4")  # -> ListA, ListB
unit_z_2 = UnitZ(Factor=water_depth_2)
boundary_surfaces_2 = BoundarySurfaces(Edges=split_list_2.ListA)
move_4 = Move(Geometry=boundary_surfaces_2, Motion=unit_z_2)  # -> Geometry, Transform
custom_preview_4 = CustomPreview(Geometry=move_4.Geometry, Material=ColourSwatch(SwatchColor=RGB(0, 0, 0)))
