# Grasshopper definition trigonometry-basics-2.gh (Grasshopper 1.0.7)
# Copyright: GNU General Public License 3.0

# ---- group: circle from trigonometry
# t -> center + cos(t)*radius*xaxis + sin(t)*radius*yaxis
panel = Panel("2")
radius = Slider(2, range=0..10)
center_x = Slider(2, range=0..10)
radius_2 = Number(radius)
center_y = Slider(2, range=0..10)
pi = Pi(Factor=panel)
pi_2 = Pi(Factor="2")
range = Range(Domain=pi, Steps=10)
range_2 = Range(Domain=pi_2, Steps=10)
sine = Sine(Value=range)
cosine = Cosine(Value=range_2)
multiplication = Multiplication(A=sine, B=radius)
multiplication_2 = Multiplication(A=cosine, B=radius_2)
addition = Addition(A=multiplication, B=center_x)
addition_2 = Addition(A=multiplication_2, B=center_y)
construct_point = ConstructPoint(XCoordinate=addition, YCoordinate=addition_2, ZCoordinate=0)
interpolate = Interpolate(Vertices=construct_point, Degree=3, Periodic=False, KnotStyle=1)  # -> Curve, Length, Domain
curve = Curve(interpolate.Curve)

# ---- group: sine curve
# y(t) = amplitude*sin(frequency*t + phase)
time = Slider(6, range=0..10)
steps = Slider(100, range=0..100)
frequency = Slider(1, range=0..3)
phase = Slider(0, range=0..10)
amplitude = Slider(2, range=0..2)
pi_3 = Pi(Factor=time)
range_3 = Range(Domain=pi_3, Steps=steps)
multiplication_3 = Multiplication(A=range_3, B=frequency)
addition_3 = Addition(A=multiplication_3, B=phase)
sine_2 = Sine(Value=addition_3)
multiplication_4 = Multiplication(A=sine_2, B=amplitude)
construct_point_2 = ConstructPoint(XCoordinate=range_3, YCoordinate=0, ZCoordinate=multiplication_4)
interpolate_2 = Interpolate(Vertices=construct_point_2, Degree=3, Periodic=False, KnotStyle=1)  # -> Curve, Length, Domain
curve_2 = Curve(interpolate_2.Curve)

# ---- group: sine curve using expression
wavelength = Slider(0.5, range=0..10)
u = Slider(4, range=0..10)
amplitude_2 = Slider(2, range=0..10)
pi_4 = Pi(Factor=u)
range_4 = Range(Domain=pi_4, Steps=1000)
expression = Expression(x=range_4, w=wavelength, a=amplitude_2, Expression="a*sin(x/w)")
construct_point_3 = ConstructPoint(XCoordinate=range_4, YCoordinate=expression, ZCoordinate=0)
interpolate_3 = Interpolate(Vertices=construct_point_3, Degree=3, Periodic=False, KnotStyle=1)  # -> Curve, Length, Domain
curve_3 = Curve(interpolate_3.Curve)

# ---- group: sine curve with decay function
# decay function
domain = Slider(20, range=0..100)
steps_2 = Slider(1000, range=0..1000)
wavelength_2 = Slider(2, range=0..10)
amplitude_3 = Slider(2, range=0..10)
halflife = Slider(2, range=0..10)
range_5 = Range(Domain=domain, Steps=steps_2)
expression_2 = Expression(x=range_5, w=wavelength_2, a=amplitude_3, h=halflife, Expression="1/2^(x/h)*a*sin(2*π*x/w)")
construct_point_4 = ConstructPoint(XCoordinate=range_5, YCoordinate=expression_2, ZCoordinate=0)
interpolate_4 = Interpolate(Vertices=construct_point_4, Degree=3, Periodic=False, KnotStyle=1)  # -> Curve, Length, Domain
curve_4 = Curve(interpolate_4.Curve)

# ---- group: sine curve using expression
domain_2 = Slider(20, range=0..100)
steps_3 = Slider(1000, range=0..1000)
frequency_2 = Slider(0.34, range=0..3)
phase_2 = Slider(0, range=0..10)
amplitude_4 = Slider(1.3, range=0..10)
range_6 = Range(Domain=domain_2, Steps=steps_3)
expression_3 = Expression(x=range_6, f=frequency_2, p=phase_2, a=amplitude_4, Expression="a*sin(2*π*x*f+p)")
construct_point_5 = ConstructPoint(XCoordinate=range_6, YCoordinate=expression_3, ZCoordinate=0)
interpolate_5 = Interpolate(Vertices=construct_point_5, Degree=3, Periodic=False, KnotStyle=1)  # -> Curve, Length, Domain
curve_5 = Curve(interpolate_5.Curve)
