# Grasshopper definition trigonometry-basics.gh (Grasshopper 1.0.7)
# Copyright: GNU General Public License 3.0

# ---- group: simple sine curve
# trigonometry basics
panel = Panel("2")
pi = Pi(Factor=panel)
range = Range(Domain=pi, Steps=10)
sine = Sine(Value=range)
construct_point = ConstructPoint(XCoordinate=range, YCoordinate=sine, ZCoordinate=0)
interpolate = Interpolate(Vertices=construct_point, Degree=3, Periodic=False, KnotStyle=1)  # -> Curve, Length, Domain
curve = Curve(interpolate.Curve)

# ---- group: simple cosine curve
pi_2 = Pi(Factor="2")
range_2 = Range(Domain=pi_2, Steps=10)
cosine = Cosine(Value=range_2)
construct_point_2 = ConstructPoint(XCoordinate=range_2, YCoordinate=cosine, ZCoordinate=0)
interpolate_2 = Interpolate(Vertices=construct_point_2, Degree=3, Periodic=False, KnotStyle=1)  # -> Curve, Length, Domain
curve_2 = Curve(interpolate_2.Curve)

# ---- group: unit circle from trigonometry
# t -> cos(t)*xaxis + sin(t)*yaxis
panel_2 = Panel("2")
pi_3 = Pi(Factor=panel_2)
pi_4 = Pi(Factor="2")
range_3 = Range(Domain=pi_3, Steps=10)
range_4 = Range(Domain=pi_4, Steps=10)
sine_2 = Sine(Value=range_3)
cosine_2 = Cosine(Value=range_4)
construct_point_3 = ConstructPoint(XCoordinate=sine_2, YCoordinate=cosine_2, ZCoordinate=0)
interpolate_3 = Interpolate(Vertices=construct_point_3, Degree=3, Periodic=False, KnotStyle=1)  # -> Curve, Length, Domain
curve_3 = Curve(interpolate_3.Curve)

# ---- group: circle from trigonometry
# t -> center + cos(t)*radius*xaxis + sin(t)*radius*yaxis
panel_3 = Panel("2")
radius = Slider(2, range=0..10)
center_x = Slider(2, range=0..10)
radius_2 = Number(radius)
center_y = Slider(2, range=0..10)
pi_5 = Pi(Factor=panel_3)
pi_6 = Pi(Factor="2")
range_5 = Range(Domain=pi_5, Steps=10)
range_6 = Range(Domain=pi_6, Steps=10)
sine_3 = Sine(Value=range_5)
cosine_3 = Cosine(Value=range_6)
multiplication = Multiplication(A=sine_3, B=radius)
multiplication_2 = Multiplication(A=cosine_3, B=radius_2)
addition = Addition(A=multiplication, B=center_x)
addition_2 = Addition(A=multiplication_2, B=center_y)
construct_point_4 = ConstructPoint(XCoordinate=addition, YCoordinate=addition_2, ZCoordinate=0)
interpolate_4 = Interpolate(Vertices=construct_point_4, Degree=3, Periodic=False, KnotStyle=1)  # -> Curve, Length, Domain
curve_4 = Curve(interpolate_4.Curve)

# ---- group: sine curve
# y(t) = amplitude*sin(frequency*t + phase)
time = Slider(6, range=0..10)
steps = Slider(100, range=0..100)
frequency = Slider(1, range=0..3)
phase = Slider(0, range=0..10)
amplitude = Slider(2, range=0..2)
pi_7 = Pi(Factor=time)
range_7 = Range(Domain=pi_7, Steps=steps)
multiplication_3 = Multiplication(A=range_7, B=frequency)
addition_3 = Addition(A=multiplication_3, B=phase)
sine_4 = Sine(Value=addition_3)
multiplication_4 = Multiplication(A=sine_4, B=amplitude)
construct_point_5 = ConstructPoint(XCoordinate=range_7, YCoordinate=0, ZCoordinate=multiplication_4)
interpolate_5 = Interpolate(Vertices=construct_point_5, Degree=3, Periodic=False, KnotStyle=1)  # -> Curve, Length, Domain
curve_5 = Curve(interpolate_5.Curve)

# ---- group: sine curve using expression
domain = Slider(20, range=0..100)
steps_2 = Slider(1000, range=0..1000)
wavelength = Slider(2, range=0..10)
amplitude_2 = Slider(2, range=0..10)
range_8 = Range(Domain=domain, Steps=steps_2)
expression = Expression(x=range_8, w=wavelength, a=amplitude_2, Expression="a*sin(2*π*x/w)")
construct_point_6 = ConstructPoint(XCoordinate=range_8, YCoordinate=0, ZCoordinate=expression)
interpolate_6 = Interpolate(Vertices=construct_point_6, Degree=3, Periodic=False, KnotStyle=1)  # -> Curve, Length, Domain
curve_6 = Curve(interpolate_6.Curve)

# ---- group: sine curve with decay function
domain_2 = Slider(20, range=0..100)
steps_3 = Slider(1000, range=0..1000)
wavelength_2 = Slider(2, range=0..10)
amplitude_3 = Slider(2, range=0..10)
halflife = Slider(2, range=0..10)
range_9 = Range(Domain=domain_2, Steps=steps_3)
expression_2 = Expression(x=range_9, w=wavelength_2, a=amplitude_3, h=halflife, Expression="1/2^(x/h)*a*sin(2*π*x/w)")
construct_point_7 = ConstructPoint(XCoordinate=range_9, YCoordinate=0, ZCoordinate=expression_2)
interpolate_7 = Interpolate(Vertices=construct_point_7, Degree=3, Periodic=False, KnotStyle=1)  # -> Curve, Length, Domain
curve_7 = Curve(interpolate_7.Curve)

# ---- group: sine curve using expression
domain_3 = Slider(20, range=0..100)
steps_4 = Slider(1000, range=0..1000)
frequency_2 = Slider(0.5, range=0..3)
phase_2 = Slider(0, range=0..10)
amplitude_4 = Slider(2, range=0..10)
range_10 = Range(Domain=domain_3, Steps=steps_4)
expression_3 = Expression(x=range_10, f=frequency_2, p=phase_2, a=amplitude_4, Expression="a*sin(2*π*x*f+p)")
construct_point_8 = ConstructPoint(XCoordinate=range_10, YCoordinate=0, ZCoordinate=expression_3)
interpolate_8 = Interpolate(Vertices=construct_point_8, Degree=3, Periodic=False, KnotStyle=1)  # -> Curve, Length, Domain
curve_8 = Curve(interpolate_8.Curve)
