# Grasshopper definition vector-field.gh (Grasshopper 1.0.7)
# Copyright: GNU General Public License 3.0
# plug-ins: Pufferfish, Anemone, Noise 4D

time = Slider(4, range=0..10)
time_2 = Slider(8, range=0..10)
scale = Slider(0.13, range=0..1)
scale_2 = Slider(0.1, range=0..1)

time_3 = Slider(1, range=0..10)
scale_3 = Slider(0.04, range=0..1)
time_4 = Slider(1, range=0..10)
scale_4 = Slider(0.23, range=0..1)

iterations = Slider(40, range=0..100)
amplitude = Slider(0.12, range=0..1)

cell_size = Slider(1, range=0..10)
X = Slider(30, range=0..100)
Y = Slider(30, range=0..100)
distance = Slider(0.9, range=0..1)
initial_angle = Slider(0, range=-90..90)
square = Square(Plane=PlaneXY(0, 0, 0), Size=cell_size, ExtentX=X, ExtentY=Y)  # -> Cells, Points
multiplication = Multiplication(A=cell_size, B=distance)
polygon_center = PolygonCenter(Polyline=square.Cells)  # -> CenterV, CenterE, CenterA
unit_x = UnitX(Factor=multiplication)
point = Point(flatten(polygon_center.CenterA))
move = Move(Geometry=point, Motion=unit_x)  # -> Geometry, Transform
unit_z = UnitZ(Factor=1)
vector_2pt = Vector2Pt(PointA=point, PointB=move.Geometry, Unitize=False)  # -> Vector, Length
rotate = Rotate(Vector=vector_2pt.Vector, Axis=unit_z, Angle=degrees(initial_angle))

grid_point = Point(flatten(point))
perlinnoise = PerlinNoise(Values=grid_point, Time=time, Scale=scale)
perlinnoise_2 = PerlinNoise(Values=grid_point, Time=time_2, Scale=scale_2)
bounds = Bounds(Numbers=perlinnoise)
bounds_2 = Bounds(Numbers=perlinnoise_2)
remap_numbers = RemapNumbers(Value=perlinnoise, Source=bounds, Target="-1 To 1")  # -> Mapped, Clipped
remap_numbers_2 = RemapNumbers(Value=perlinnoise_2, Source=bounds_2, Target="-1 To 1")  # -> Mapped, Clipped
unit_y = UnitY(Factor=remap_numbers_2.Mapped)
unit_x_2 = UnitX(Factor=remap_numbers.Mapped)
move_2 = Move(Geometry=grid_point, Motion=unit_x_2)  # -> Geometry, Transform
move_3 = Move(Geometry=move_2.Geometry, Motion=unit_y)  # -> Geometry, Transform
vector_2pt_2 = Vector2Pt(PointA=grid_point, PointB=move_3.Geometry, Unitize=False)  # -> Vector, Length
line = Line(StartPoint=grid_point, EndPoint=move_3.Geometry)
insert_items = InsertItems(List=graft(grid_point), Item=graft(move_3.Geometry), Indices="1", Wrap=True)

grid_point_2 = Point(flatten(point))
perlinnoise_3 = PerlinNoise(Values=grid_point_2, Time=time_3, Scale=scale_3)
perlinnoise_4 = PerlinNoise(Values=grid_point_2, Time=time_4, Scale=scale_4)
unit_x_3 = UnitX(Factor=perlinnoise_3)
unit_y_2 = UnitY(Factor=perlinnoise_4)
move_4 = Move(Geometry=grid_point_2, Motion=unit_x_3)  # -> Geometry, Transform
move_5 = Move(Geometry=move_4.Geometry, Motion=unit_y_2)  # -> Geometry, Transform
vector_2pt_3 = Vector2Pt(PointA=grid_point_2, PointB=move_5.Geometry, Unitize=False)  # -> Vector, Length
line_2 = Line(StartPoint=grid_point_2, EndPoint=move_5.Geometry)
insert_items_2 = InsertItems(List=graft(grid_point_2), Item=graft(move_5.Geometry), Indices="1", Wrap=True)

Y_2 = Number(Y)

partition_list = PartitionList(List=rotate, Size=Y_2)
vector_display = VectorDisplay(Anchor=point, Vector=partition_list)

initial_vector = Vector(partition_list)
angle = Slider(50, range=0..100)
X_2 = Number(X)
seed = Slider(10, range=0..100)
negative = Negative(Value=angle)
construct_domain = ConstructDomain(DomainStart=negative, DomainEnd=angle)
random = Random(Range=construct_domain, Number=X_2, Seed=seed)
mass_addition = MassAddition(Input=random)  # -> Result, PartialResults
unit_z_2 = UnitZ(Factor=1)
rotate_2 = Rotate(Vector=initial_vector, Axis=unit_z_2, Angle=degrees(mass_addition.PartialResults))
point_2 = Point(point)
vector_display_2 = VectorDisplay(Anchor=point_2, Vector=rotate_2)

initial_vector_2 = Vector(rotate_2)
angle_2 = Slider(50, range=0..100)
Y_3 = Number(Y)
seed_2 = Slider(10, range=0..100)
negative_2 = Negative(Value=angle_2)
flip_matrix = FlipMatrix(Data=initial_vector_2)
construct_domain_2 = ConstructDomain(DomainStart=negative_2, DomainEnd=angle_2)
random_2 = Random(Range=construct_domain_2, Number=Y_3, Seed=seed_2)
mass_addition_2 = MassAddition(Input=random_2)  # -> Result, PartialResults
unit_z_3 = UnitZ(Factor=1)
rotate_3 = Rotate(Vector=flip_matrix, Axis=unit_z_3, Angle=degrees(mass_addition_2.PartialResults))
point_3 = Point(point)
flip_matrix_2 = FlipMatrix(Data=rotate_3)  # -> flatten(Data)
vector_display_3 = VectorDisplay(Anchor=point_3, Vector=flip_matrix_2)

geometry = Geometry(square.Cells)
bounding_rectangle = BoundingRectangle(Geometry=flatten(geometry), Plane=PlaneXY(0, 0, 0), Axis=0, Slide=0, Union=True)  # -> Bounding, DimensionX, DimensionY
boundary_surfaces = BoundarySurfaces(Edges=bounding_rectangle.Bounding)

point_4 = Point(insert_items_2)
grid_points = Point(flatten(point))
vector = Vector(flatten(vector_2pt_3.Vector))
loop_start = LoopStart(Repeat=iterations, Trigger=Toggle(False), Data=point_4)  # -> port, Counter, Data
list_item = ListItem(List=loop_start.Data, Index=loop_start.Counter, Wrap=True)  # -> Item, Item1
closest_point = ClosestPoint(Point=flatten(list_item.Item), Cloud=grid_points)  # -> ClosestPoint, CPIndex, Distance
vector_2pt_4 = Vector2Pt(PointA=list_item.Item, PointB=list_item.Item1, Unitize=False)  # -> flatten(Vector), Length
list_item_2 = ListItem(List=vector, Index=closest_point.CPIndex, Wrap=True)
addition = Addition(A=vector_2pt_4.Vector, B=list_item_2)
amplitude_2 = Amplitude(Vector=addition, Amplitude=amplitude)
move_6 = Move(Geometry=flatten(list_item.Item1), Motion=amplitude_2)  # -> Geometry, Transform
addition_2 = Addition(A=loop_start.Counter, B="2")
insert_items_3 = InsertItems(List=loop_start.Data, Item=graft(move_6.Geometry), Indices=addition_2, Wrap=True)
loop_end = LoopEnd(port=loop_start.port, Exit=False, Data=insert_items_3, TimeOutVal=0, pausedState=False, state="Constant output")
interpolate = Interpolate(Vertices=loop_end, Degree=3, Periodic=False, KnotStyle=1)  # -> Curve, Length, Domain
curve = Curve(bounding_rectangle.Bounding)
trim_with_region = TrimWithRegion(Curve=interpolate.Curve, Region=curve)  # -> Inside, Outside
curve_2 = Curve(trim_with_region.Inside)

geometry_2 = Geometry(boundary_surfaces)
seed_3 = Slider(0, range=0..100)
grid_point_3 = Point(flatten(point))
vector_2 = Vector(flatten(flip_matrix_2))
list_length = ListLength(List=grid_point_3)
populate_geometry = PopulateGeometry(Geometry=geometry_2, Count=list_length, Seed=seed_3)  # -> flatten(Population)
closest_point_2 = ClosestPoint(Point=populate_geometry, Cloud=grid_point_3)  # -> ClosestPoint, CPIndex, Distance
list_item_3 = ListItem(List=vector_2, Index=closest_point_2.CPIndex, Wrap=True)
move_7 = Move(Geometry=grid_point_3, Motion=list_item_3)  # -> Geometry, Transform
vector_display_4 = VectorDisplay(Anchor=grid_point_3, Vector=list_item_3)
insert_items_4 = InsertItems(List=graft(grid_point_3), Item=graft(move_7.Geometry), Indices="1", Wrap=True)

iterations_2 = Slider(20, range=0..100)
point_5 = Point(insert_items_4)
grid_points_2 = Point(flatten(point))
vector_3 = Vector(flatten(flip_matrix_2))
amplitude_3 = Slider(0.12, range=0..1)
loop_start_2 = LoopStart(Repeat=iterations_2, Trigger=Toggle(False), Data=point_5)  # -> port, Counter, Data; disabled
list_item_4 = ListItem(List=loop_start_2.Data, Index=loop_start_2.Counter, Wrap=True)  # -> Item, Item1
closest_point_3 = ClosestPoint(Point=flatten(list_item_4.Item), Cloud=grid_points_2)  # -> ClosestPoint, CPIndex, Distance
vector_2pt_5 = Vector2Pt(PointA=list_item_4.Item, PointB=list_item_4.Item1, Unitize=False)  # -> flatten(Vector), Length
list_item_5 = ListItem(List=vector_3, Index=closest_point_3.CPIndex, Wrap=True)
addition_3 = Addition(A=vector_2pt_5.Vector, B=list_item_5)
amplitude_4 = Amplitude(Vector=addition_3, Amplitude=amplitude_3)
move_8 = Move(Geometry=flatten(list_item_4.Item1), Motion=amplitude_4)  # -> Geometry, Transform
addition_4 = Addition(A=loop_start_2.Counter, B="2")
insert_items_5 = InsertItems(List=loop_start_2.Data, Item=graft(move_8.Geometry), Indices=addition_4, Wrap=True)
loop_end_2 = LoopEnd(port=loop_start_2.port, Exit=False, Data=insert_items_5, TimeOutVal=0, pausedState=False, state="Constant output")
interpolate_2 = Interpolate(Vertices=loop_end_2, Degree=3, Periodic=False, KnotStyle=1)  # -> Curve, Length, Domain
curve_3 = Curve(bounding_rectangle.Bounding)
trim_with_region_2 = TrimWithRegion(Curve=interpolate_2.Curve, Region=curve_3)  # -> Inside, Outside
curve_4 = Curve(trim_with_region_2.Inside)
