# Grasshopper definition 01-basic-voxel-tower.gh (Grasshopper 1.0.8)
# Copyright: GNU General Public License 3.0
# plug-ins: VoxelTools

# ---- group: define region
# voxel modeling
# basic voxel tower
# input region
X = Slider(50, range=0..100)
Y = Slider(50, range=0..100)
Z = Slider(100, range=0..100)
domain_box = DomainBox(Base=PlaneXY(0, 0, 0), X=X, Y=Y, Z=Z)
box = Box(domain_box)

# ---- group: input curve
# input geometry
# OR
# right click to set curve
curve = Curve(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)

# ---- group: input box
X_2 = Slider(25, range=0..100)
Y_2 = Slider(25, range=0..100)
Z_2 = Slider(100, range=0..100)
domain_box_2 = DomainBox(Base="12.5,12.5,0", X=X_2, Y=Y_2, Z=Z_2)
box_2 = Box(domain_box_2)

# ---- group: input curve from random points
box_3 = Box(domain_box)
# OR
count = Slider(6, range=0..10)
seed = Slider(1, range=0..100)
populate_3d = Populate3D(Region=box_3, Count=count, Seed=seed)
interpolate = Interpolate(Vertices=populate_3d, Degree=3, Periodic=False, KnotStyle=1)  # -> Curve, Length, Domain
curve_2 = Curve(interpolate.Curve)

# ---- group: voxelate geometry
# voxels
geometry = Geometry(curve_2)
box_4 = Box(box)
voxel_size = Slider(1, range=0..10)
# mesh
distance = Slider(20, range=0..100)
create_voxelgrid = CreateVoxelGrid(BoundingBox=box_4, SizeX=voxel_size, SizeY=voxel_size, SizeZ=voxel_size)
voxelategeometry = VoxelateGeometry(Geometry=geometry, VoxelGrid=create_voxelgrid, Distance=distance)
voxelgrid = VoxelGrid(voxelategeometry)

# ---- group: meshing
voxelgrid_2 = VoxelGrid(voxelgrid)
hull_from_marching_cubes = HullFromMarchingCubes(Grids=voxelgrid_2, Isolevel="0.5")
custom_preview = CustomPreview(Geometry=hull_from_marching_cubes, Material=ColourSwatch(SwatchColor=RGB(184, 184, 184)))
