# Grasshopper definition 02-root-tower.gh (Grasshopper 1.0.8)
# Copyright: GNU General Public License 3.0
# plug-ins: VoxelTools

# ---- group: define region
# voxel modeling
# root tower
# input region
X = Slider(50, range=0..100)
Y = Slider(50, range=0..100)
Z = Slider(100, range=0..100)
domain_box = DomainBox(Base=PlaneXY(0, 0, 0), X=X, Y=Y, Z=Z)
box = Box(domain_box)

# ---- group: input curve
# input geometry
# OR
# right click to set curves
curve = Curve([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])

# ---- group: voxelate geometry
# input geometry
geometry = Geometry(curve)
box_2 = Box(box)
voxel_size = Slider(1, range=0..10)
distance = Slider(8, range=0..100)
create_voxelgrid = CreateVoxelGrid(BoundingBox=box_2, SizeX=voxel_size, SizeY=voxel_size, SizeZ=voxel_size)
voxelategeometry = VoxelateGeometry(Geometry=geometry, VoxelGrid=create_voxelgrid, Distance=distance)
voxelgrid = VoxelGrid(voxelategeometry)

# ---- group: meshing
# mesh
voxelgrid_2 = VoxelGrid(voxelgrid)
hull_from_marching_cubes = HullFromMarchingCubes(Grids=voxelgrid_2, Isolevel="0.5")
custom_preview = CustomPreview(Geometry=hull_from_marching_cubes, Material=ColourSwatch(SwatchColor=RGB(184, 184, 184)))
