# Grasshopper definition 03-accumulated-tower.gh (Grasshopper 1.0.8)
# Copyright: GNU General Public License 3.0
# plug-ins: VoxelTools

# ---- group: define outer region
# voxel modeling
# accumulated tower
# input region
X = Slider(50, range=0..100)
Y = Slider(50, range=0..100)
Z = Slider(100, range=0..100)
domain_box = DomainBox(Base=PlaneXY(0, 0, 0), X=X, Y=Y, Z=Z)
box = Box(domain_box)

# ----
# input geometry
box_2 = Box(box)
count = Slider(200, range=0..1000)
seed = Slider(0, range=0..100)
size = Slider(10, range=0..100)
populate_3d = Populate3D(Region=box_2, Count=count, Seed=seed)
division = Division(A=size, B="2")
center_box = CenterBox(Base=populate_3d, X=division, Y=division, Z=division)
box_3 = Box(center_box)

# ----
# voxel box
geometry = Geometry(box_3)
box_4 = Box(box)

voxel_size = Slider(1, range=0..10)
create_voxelgrid = CreateVoxelGrid(BoundingBox=box_4, SizeX=voxel_size, SizeY=voxel_size, SizeZ=voxel_size)
voxelategeometry = VoxelateGeometry(Geometry=geometry, VoxelGrid=create_voxelgrid, Distance=0)
voxelgrid = VoxelGrid(voxelategeometry)

# ---- group: meshing
# mesh
voxelgrid_2 = VoxelGrid(voxelgrid)
hull_from_marching_cubes = HullFromMarchingCubes(Grids=voxelgrid_2, Isolevel="0.5")
custom_preview = CustomPreview(Geometry=hull_from_marching_cubes, Material=ColourSwatch(SwatchColor=RGB(184, 184, 184)))
