# Grasshopper definition 04-subtractive-tower.gh (Grasshopper 1.0.8)
# Copyright: GNU General Public License 3.0
# plug-ins: VoxelTools

# ---- group: define region
# voxel modeling
# subtractive tower
# input region
X = Slider(50, range=0..100)
Y = Slider(50, range=0..100)
Z = Slider(100, range=0..100)
domain_box = DomainBox(Base=PlaneXY(0, 0, 0), X=X, Y=Y, Z=Z)
box = Box(domain_box)

# ---- group: input curve from random points
# input geometry
box_2 = Box(domain_box)
count = Slider(6, range=0..10)
seed = Slider(2, range=0..100)
populate_3d = Populate3D(Region=box_2, Count=count, Seed=seed)
interpolate = Interpolate(Vertices=populate_3d, Degree=3, Periodic=False, KnotStyle=1)  # -> Curve, Length, Domain
curve = Curve(interpolate.Curve)

# ----
# voxel box
box_3 = Box(box)
voxel_size = Slider(1, range=0..10)
create_voxelgrid = CreateVoxelGrid(BoundingBox=box_3, SizeX=voxel_size, SizeY=voxel_size, SizeZ=voxel_size)
voxelategeometry = VoxelateGeometry(Geometry=box_3, VoxelGrid=create_voxelgrid, Distance=0)
voxelgrid_a = VoxelGrid(voxelategeometry)

# ----
# voxel curve
curve_2 = Curve(curve)
box_4 = Box(box)
voxel_size_2 = Slider(1, range=0..10)
# boolean difference
distance = Slider(15, range=0..100)
create_voxelgrid_2 = CreateVoxelGrid(BoundingBox=box_4, SizeX=voxel_size_2, SizeY=voxel_size_2, SizeZ=voxel_size_2)
voxelategeometry_2 = VoxelateGeometry(Geometry=curve_2, VoxelGrid=create_voxelgrid_2, Distance=distance)
voxelgrid_b = VoxelGrid(voxelategeometry_2)

voxelgrid_a_2 = VoxelGrid(voxelgrid_a)
voxelgrid_b_2 = VoxelGrid(voxelgrid_b)
voxelgrid_boolean_subtract = VoxelGridBooleanSubtract(Grids=flatten([voxelgrid_a_2, voxelgrid_b_2]))
voxelgrid = VoxelGrid(voxelgrid_boolean_subtract)

# ---- group: meshing
# mesh
voxelgrid_2 = VoxelGrid(voxelgrid)
hull_from_marching_cubes = HullFromMarchingCubes(Grids=voxelgrid_2, Isolevel="0.5")
custom_preview = CustomPreview(Geometry=hull_from_marching_cubes, Material=ColourSwatch(SwatchColor=RGB(184, 184, 184)))
