# Grasshopper definition 06-additive-tower.gh (Grasshopper 1.0.8)
# Copyright: GNU General Public License 3.0
# plug-ins: VoxelTools

# ---- group: define outer region
# voxel modeling
# additive tower
# input region
X = Slider(50, range=0..100)
Y = Slider(50, range=0..100)
Z = Slider(100, range=0..100)
domain_box = DomainBox(Base=PlaneXY(0, 0, 0), X=X, Y=Y, Z=Z)
box = Box(domain_box)

# ----
box_2 = Box(box)

# ---- group: define inner region
box_3 = Box(box)
scale = Slider(0.8, range=0..1)
volume = Volume(Geometry=box_3)  # -> Volume, Centroid
scale_nu = ScaleNU(Geometry=box_3, Plane=volume.Centroid, ScaleX=scale, ScaleY=scale, ScaleZ=1)  # -> Geometry, Transform
box_4 = Box(scale_nu.Geometry)

# ----
# input geometry
box_5 = Box(box_4)
count = Slider(200, range=0..1000)
seed = Slider(0, range=0..100)
size = Slider(10, range=0..100)
populate_3d = Populate3D(Region=box_5, Count=count, Seed=seed)
division = Division(A=size, B="2")
center_box = CenterBox(Base=populate_3d, X=division, Y=division, Z=division)
box_6 = Box(center_box)

# ----
# voxel box
geometry = Geometry(box_4)

voxel_size = Slider(1, range=0..10)
create_voxelgrid = CreateVoxelGrid(BoundingBox=box_2, SizeX=voxel_size, SizeY=voxel_size, SizeZ=voxel_size)
voxelategeometry = VoxelateGeometry(Geometry=geometry, VoxelGrid=create_voxelgrid, Distance=0)
voxelgrid_a = VoxelGrid(voxelategeometry)

# ----
# voxel geometry
geometry_2 = Geometry(box_6)
box_7 = Box(box)
# boolean union
voxel_size_2 = Slider(1, range=0..10)
create_voxelgrid_2 = CreateVoxelGrid(BoundingBox=box_7, SizeX=voxel_size_2, SizeY=voxel_size_2, SizeZ=voxel_size_2)
voxelategeometry_2 = VoxelateGeometry(Geometry=flatten(geometry_2), VoxelGrid=create_voxelgrid_2, Distance=0)
voxelgrid_b = VoxelGrid(voxelategeometry_2)

voxelgrid_a_2 = VoxelGrid(voxelgrid_a)
voxelgrid_b_2 = VoxelGrid(voxelgrid_b)
voxelgrid_boolean_union = VoxelGridBooleanUnion(Grids=flatten([voxelgrid_a_2, voxelgrid_b_2]))
voxelgrid = VoxelGrid(voxelgrid_boolean_union)

# ---- group: meshing
# mesh
voxelgrid_2 = VoxelGrid(voxelgrid)
hull_from_marching_cubes = HullFromMarchingCubes(Grids=voxelgrid_2, Isolevel="0.5")
custom_preview = CustomPreview(Geometry=hull_from_marching_cubes, Material=ColourSwatch(SwatchColor=RGB(184, 184, 184)))
