# Grasshopper definition wave-grove-dampened.gh (Grasshopper 1.0.7)
# Copyright: GNU General Public License 3.0

# ---- group: tree cluster
# surfaces
# parametric tree
trunk_height = Slider(5, range=0..100)
trunk_radius = Slider(0.5, range=0..1)
tree_height = Slider(20, range=0..100)
divisions = Slider(3, range=0..10)
canopy_radius = Slider(5, range=0..10)
# parametric paving
conical_tree = ConicalTree(trunk_height=trunk_height, relay=trunk_radius, A=tree_height, relay_2=divisions, relay_3=canopy_radius)  # -> pipe_2, result
canopy_color = ColourSwatch(SwatchColor=RGBA(58, 94, 84, 232))
trunk_color = ColourSwatch(SwatchColor=RGB(139, 76, 57))
custom_preview = CustomPreview(Geometry=conical_tree.pipe_2, Material=trunk_color)
custom_preview_2 = CustomPreview(Geometry=conical_tree.result, Material=canopy_color)

# ----
threshold = Slider(-1, range=-4..4)

# ---- group: surface from dampened sinusoidal waves
# surface from waves
step = Slider(10, range=0..10)
count = Slider(11, range=0..100)
a = Slider(4, range=0..10)
b = Slider(2, range=0..10)
c = Slider(1, range=0..10)
d = Slider(0, range=0..10)
# terrain color
f = Slider(0.01, range=0..0.1)
series = Series(Start=0, Step=step, Count=count)
expression = Expression(
    x=graft(series),
    y=series,
    a=a,
    b=b,
    c=c,
    d=d,
    f=f,
    Expression="((a * sin(b * x - c) + d) * e^(-f * x) * (a * cos(b * y - c) + d) * e^(-f * y))")
construct_point = ConstructPoint(XCoordinate=graft(series), YCoordinate=series, ZCoordinate=expression)
count_2 = Number(count)
surface_from_points = SurfaceFromPoints(Points=flatten(construct_point), UCount=count_2, Interpolate=Toggle(True))
number = Number(expression)
point = Point(construct_point)
surface = Surface(surface_from_points)

# ----
# transform
trunk = Brep(conical_tree.pipe_2)
canopy = Brep(conical_tree.result)
point_2 = Point(point)
number_2 = Number(number)
vector_2pt = Vector2Pt(PointA="0,0,0", PointB=point_2, Unitize=False)  # -> Vector, Length
bounds = Bounds(Numbers=number_2)
# cull
panel = Panel("0.5 To 1.25")
remap_numbers = RemapNumbers(Value=number_2, Source=bounds, Target=panel)  # -> Mapped, Clipped
move = Move(Geometry=trunk, Motion=vector_2pt.Vector)  # -> Geometry, Transform
move_2 = Move(Geometry=canopy, Motion=vector_2pt.Vector)  # -> Geometry, Transform
scale = Scale(Geometry=move_2.Geometry, Center=vector_2pt.Vector, Factor=remap_numbers.Mapped)  # -> Geometry, Transform
canopies = Brep(scale.Geometry)
trunks = Brep(move.Geometry)

trunks_2 = Brep(trunks)
number_3 = Number(number)
canopies_2 = Brep(canopies)
larger_than = LargerThan(FirstNumber=number_3, SecondNumber=threshold)  # -> LargerThan, OrEqualTo
cull_pattern = CullPattern(List=number_3, CullPattern=larger_than.LargerThan)
cull_pattern_2 = CullPattern(List=trunks_2, CullPattern=larger_than.LargerThan)
cull_pattern_3 = CullPattern(List=canopies_2, CullPattern=larger_than.LargerThan)
canopies_3 = Brep(cull_pattern_3)
number_4 = Number(cull_pattern)
trunks_3 = Brep(cull_pattern_2)

# ----
# tree colors
trunks_4 = Brep(trunks_3)
canopies_4 = Brep(canopies_3)
number_5 = Number(number_4)
bounds_2 = Bounds(Numbers=number_5)
remap_numbers_2 = RemapNumbers(Value=number_5, Source=bounds_2, Target="0 To 1")  # -> Mapped, Clipped
color_a = ColourSwatch(SwatchColor=RGBA(73, 140, 132, 232))
color_b = ColourSwatch(SwatchColor=RGBA(58, 94, 84, 232))
interpolate_data = InterpolateData(Data=[color_a, color_b], Parameter=remap_numbers_2.Mapped, Interpolation=2)
trunk_color_2 = ColourSwatch(SwatchColor=RGB(139, 76, 57))
custom_preview_3 = CustomPreview(Geometry=trunks_4, Material=trunk_color_2)
custom_preview_4 = CustomPreview(Geometry=canopies_4, Material=interpolate_data)

# ---- group: surface color gradient
surface_2 = Surface(surface)
mesh_brep = MeshBrep(
    Brep=surface_2,
    Settings={GridMaxCount=0, GridMinCount=16, JaggedSeams=False, MaxEdgeLength=0, MinEdgeLength=0.0001, MinTolerance=0, Refine=True, RefineAngle=0, RelativeTolerance=0.65, SimplePlanes=True, Tolerance=0})
deconstruct_mesh = DeconstructMesh(Mesh=mesh_brep)  # -> Vertices, Faces, Colours, Normals
deconstruct = Deconstruct(Point=deconstruct_mesh.Vertices)  # -> XComponent, YComponent, ZComponent
bounds_3 = Bounds(Numbers=deconstruct.ZComponent)
remap_numbers_3 = RemapNumbers(Value=deconstruct.ZComponent, Source=bounds_3, Target=Domain(0, 1))  # -> Mapped, Clipped

# ----
gradient = Gradient(
    LowerLimit=0,
    UpperLimit=1,
    Parameter=remap_numbers_3.Mapped,
    stops=[0: RGB(139, 69, 19), 1: RGB(250, 235, 215), 1: RGB(188, 143, 143)])

# ---- group: surface color gradient (continued)
mesh_colours = MeshColours(Mesh=mesh_brep, Colours=gradient)
mesh = Mesh(mesh_colours)

# ==== cluster ConicalTree
trunk_height = ClusterInput()
relay = ClusterInput()
A = ClusterInput()
relay_2 = ClusterInput()
relay_3 = ClusterInput()
unit_z = UnitZ(Factor=trunk_height)
subtraction = Subtraction(A=A, B=trunk_height)
move = Move(Geometry="0,0,0", Motion=unit_z)  # -> Geometry, Transform
top_of_trunk = Point(move.Geometry)
unit_z_2 = UnitZ(Factor=subtraction)
division = Division(A=subtraction, B=relay_2)
move_2 = Move(Geometry=top_of_trunk, Motion=unit_z_2)  # -> Geometry, Transform
line = Line(StartPoint="0,0,0", EndPoint=move.Geometry)
line_2 = Line(StartPoint=top_of_trunk, EndPoint=move_2.Geometry)
pipe = Pipe(Curve=line, Radius=relay, Caps="1")
divide_curve = DivideCurve(Curve=line_2, Count=relay_2, Kinks=False)  # -> Points, Tangents, Parameters
pipe_2 = ClusterOutput(pipe)
split_list = SplitList(List=divide_curve.Points, Index=relay_2)  # -> ListA, ListB
range = Range(Domain="1 To 0.5", Steps=expr("x-1", relay_2))
cone = Cone(Base=split_list.ListA, Radius=relay_3, Length=division)  # -> Cone, Tip
multiplication = Multiplication(A=range, B="2")
scale_nu = ScaleNU(Geometry=cone.Cone, Plane=split_list.ListA, ScaleX=range, ScaleY=range, ScaleZ=multiplication)  # -> Geometry, Transform
cap_holes = CapHoles(Brep=scale_nu.Geometry)
solid_union = SolidUnion(Breps=cap_holes)
result = ClusterOutput(solid_union)
