# Grasshopper definition wave-path-dampened.gh (Grasshopper 1.0.7)
# Copyright: GNU General Public License 3.0

# ----
# waving path
# dampened sinusoidal waves
t = Slider(2, range=0..10)
a = Slider(2, range=0..10)
b = Slider(2, range=0..10)
start = Slider(0.1, range=0..1)
step = Slider(0.1, range=0..1)
# sinusoidal paths
count = Slider(3, range=0..100)
pi = Pi(Factor=t)
series = Series(Start=start, Step=step, Count=count)  # -> graft(Series)
range = Range(Domain=pi, Steps="400")
expression = Expression(x=range, a=a, b=b, f=series, Expression="a*sin(b*x)*e^(-f*x)")
construct_point = ConstructPoint(XCoordinate=range, YCoordinate=expression, ZCoordinate=0)
interpolate = Interpolate(Vertices=construct_point, Degree=3, Periodic=False, KnotStyle=1)  # -> flatten(Curve), Length, Domain
curve = Curve(interpolate.Curve)

curve_2 = Curve(curve)
scale = Slider(20, range=0..100)
offset = Slider(2, range=0..3)
scale_2 = Scale(Geometry=curve_2, Center=Point(0, 0, 0), Factor=scale)  # -> Geometry, Transform
offset_curve = OffsetCurve(Curve=scale_2.Geometry, Distance=offset, Corners=1)  # -> flatten(Curve)
ruled_surface = RuledSurface(CurveA=scale_2.Geometry, CurveB=offset_curve)
region_union = RegionUnion(Curves=ruled_surface)
boundary_surfaces = BoundarySurfaces(Edges=region_union)
custom_preview = CustomPreview(Geometry=boundary_surfaces, Material=ColourSwatch(SwatchColor=RGB(76, 76, 76)))
surface = Surface(boundary_surfaces)

# ----
# planting wave
# dampened sinusoidal waves
t_2 = Slider(2, range=0..10)
a_2 = Slider(2, range=0..10)
b_2 = Slider(2, range=0..10)
c = Slider(0.4, range=0..1)
d = Slider(0.1, range=0..1)
start_2 = Slider(0.1, range=0..1)
step_2 = Slider(0.1, range=0..1)
# sinusoidal planting
count_2 = Slider(6, range=0..10)
pi_2 = Pi(Factor=t_2)
series_2 = Series(Start=start_2, Step=step_2, Count=count_2)  # -> graft(Series)
range_2 = Range(Domain=pi_2, Steps="400")
expression_2 = Expression(x=range_2, a=a_2, b=b_2, c=c, d=d, f=series_2, Expression="a*sin(b*x-c)*e^(-f*x)+d")
construct_point_2 = ConstructPoint(XCoordinate=range_2, YCoordinate=expression_2, ZCoordinate=0)
interpolate_2 = Interpolate(Vertices=construct_point_2, Degree=3, Periodic=False, KnotStyle=1)  # -> flatten(Curve), Length, Domain
curve_3 = Curve(interpolate_2.Curve)

trunk_height = Slider(2, range=0..100)
trunk_radius = Slider(0.25, range=0..1)
tree_height = Slider(10, range=0..100)
divisions = Slider(3, range=0..10)
canopy_radius = Slider(3, range=0..10)
curve_4 = Curve(curve_3)
scale_3 = Number(scale)
spacing = Slider(8, range=0..20)
# cull and color planting
tolerance = Slider(3, range=0..10)
conical_tree = ConicalTree(trunk_height=trunk_height, relay=trunk_radius, A=tree_height, relay_2=divisions, relay_3=canopy_radius)  # -> pipe_2, result
scale_4 = Scale(Geometry=curve_4, Center=Point(0, 0, 0), Factor=scale_3)  # -> Geometry, Transform
divide_distance = DivideDistance(Curve=scale_4.Geometry, Distance=spacing)  # -> flatten(Points), Tangents, Parameters
cull_duplicates = CullDuplicates(Points=divide_distance.Points, Tolerance=tolerance, CullMode=3)  # -> Points, Indices, Valence
vector_2pt = Vector2Pt(PointA="0,0,0", PointB=cull_duplicates.Points, Unitize=False)  # -> Vector, Length
move = Move(Geometry=conical_tree.pipe_2, Motion=vector_2pt.Vector)  # -> Geometry, Transform
move_2 = Move(Geometry=conical_tree.result, Motion=vector_2pt.Vector)  # -> Geometry, Transform
trunk = Brep(move.Geometry)
canopy = Brep(move_2.Geometry)

trunk_2 = Brep(trunk)
canopy_2 = Brep(canopy)
surface_2 = Surface(surface)
collision_many_many = CollisionManyMany(Colliders=[trunk_2, surface_2])  # -> Collision, Indices
gate_not = GateNot(A=collision_many_many.Collision)
cull_pattern = CullPattern(List=trunk_2, CullPattern=gate_not)
cull_pattern_2 = CullPattern(List=canopy_2, CullPattern=gate_not)
list_length = ListLength(List=cull_pattern_2)
range_3 = Range(Domain=Domain(0, 1), Steps=list_length)
color_a = ColourSwatch(SwatchColor=RGB(176, 152, 106))
color_b = ColourSwatch(SwatchColor=RGB(73, 140, 132))
color_c = ColourSwatch(SwatchColor=RGB(58, 94, 84))
interpolate_data = InterpolateData(Data=[color_a, color_b, color_c], Parameter=range_3, Interpolation=2)
trunk_color = ColourSwatch(SwatchColor=RGB(139, 76, 57))
custom_preview_2 = CustomPreview(Geometry=cull_pattern, Material=trunk_color)
custom_preview_3 = CustomPreview(Geometry=cull_pattern_2, Material=interpolate_data)

# ==== cluster ConicalTree
trunk_height = ClusterInput()
relay = ClusterInput()
A = ClusterInput()
relay_2 = ClusterInput()
relay_3 = ClusterInput()
unit_z = UnitZ(Factor=trunk_height)
subtraction = Subtraction(A=A, B=trunk_height)
move = Move(Geometry="0,0,0", Motion=unit_z)  # -> Geometry, Transform
top_of_trunk = Point(move.Geometry)
unit_z_2 = UnitZ(Factor=subtraction)
division = Division(A=subtraction, B=relay_2)
move_2 = Move(Geometry=top_of_trunk, Motion=unit_z_2)  # -> Geometry, Transform
line = Line(StartPoint="0,0,0", EndPoint=move.Geometry)
line_2 = Line(StartPoint=top_of_trunk, EndPoint=move_2.Geometry)
pipe = Pipe(Curve=line, Radius=relay, Caps="1")
divide_curve = DivideCurve(Curve=line_2, Count=relay_2, Kinks=False)  # -> Points, Tangents, Parameters
pipe_2 = ClusterOutput(pipe)
split_list = SplitList(List=divide_curve.Points, Index=relay_2)  # -> ListA, ListB
range = Range(Domain="1 To 0.5", Steps=expr("x-1", relay_2))
cone = Cone(Base=split_list.ListA, Radius=relay_3, Length=division)  # -> Cone, Tip
multiplication = Multiplication(A=range, B="2")
scale_nu = ScaleNU(Geometry=cone.Cone, Plane=split_list.ListA, ScaleX=range, ScaleY=range, ScaleZ=multiplication)  # -> Geometry, Transform
cap_holes = CapHoles(Brep=scale_nu.Geometry)
solid_union = SolidUnion(Breps=cap_holes)
result = ClusterOutput(solid_union)
