# Grasshopper definition wave-planting.gh (Grasshopper 1.0.7)
# Copyright: GNU General Public License 3.0

# ----
# wave of paths
# textured sinusoidal waves
t = Slider(2, range=0..10)
start = Slider(0.5, range=0..1)
step = Slider(0.1, range=0..1)
count = Slider(3, range=0..10)
pi = Pi(Factor=t)
series = Series(Start=start, Step=step, Count=count)  # -> graft(Series)
range = Range(Domain=pi, Steps="200")
expression = Expression(x=range, a=series, Expression="a*sin(a^-1*x)+sin(x)")
construct_point = ConstructPoint(XCoordinate=range, YCoordinate=expression, ZCoordinate=0)
interpolate = Interpolate(Vertices=construct_point, Degree=3, Periodic=False, KnotStyle=1)  # -> flatten(Curve), Length, Domain
curve = Curve(interpolate.Curve)

# ----
# sinusoidal paths
curve_2 = Curve(curve)
scale = Slider(20, range=0..100)
offset = Slider(2, range=0..3)
scale_2 = Scale(Geometry=curve_2, Center=Point(0, 0, 0), Factor=scale)  # -> Geometry, Transform
offset_curve = OffsetCurve(Curve=scale_2.Geometry, Distance=offset, Corners=1)  # -> flatten(Curve)
ruled_surface = RuledSurface(CurveA=scale_2.Geometry, CurveB=offset_curve)
region_union = RegionUnion(Curves=ruled_surface)
boundary_surfaces = BoundarySurfaces(Edges=region_union)
custom_preview = CustomPreview(Geometry=boundary_surfaces, Material=ColourSwatch(SwatchColor=RGB(76, 76, 76)))
surface = Surface(boundary_surfaces)

# ----
# wave of trees
# textured sinusoidal waves
t_2 = Slider(2, range=0..10)
start_2 = Slider(0.2, range=0..1)
step_2 = Slider(0.1, range=0..1)
count_2 = Slider(3, range=0..10)
pi_2 = Pi(Factor=t_2)
series_2 = Series(Start=start_2, Step=step_2, Count=count_2)  # -> graft(Series)
range_2 = Range(Domain=pi_2, Steps="200")
expression_2 = Expression(x=range_2, a=series_2, Expression="a*sin(a^-1*x)+sin(x)")
construct_point_2 = ConstructPoint(XCoordinate=range_2, YCoordinate=expression_2, ZCoordinate=0)
interpolate_2 = Interpolate(Vertices=construct_point_2, Degree=3, Periodic=False, KnotStyle=1)  # -> flatten(Curve), Length, Domain
curve_3 = Curve(interpolate_2.Curve)

# ----
# sinusoidal planting
trunk_height = Slider(2, range=0..100)
trunk_radius = Slider(0.25, range=0..1)
tree_height = Slider(10, range=0..100)
divisions = Slider(3, range=0..10)
canopy_radius = Slider(3, range=0..10)
curve_4 = Curve(curve_3)
scale_3 = Number(scale)
spacing = Slider(8, range=0..20)
tolerance = Slider(3, range=0..10)
conical_tree = ConicalTree(trunk_height=trunk_height, relay=trunk_radius, A=tree_height, relay_2=divisions, relay_3=canopy_radius)  # -> pipe_2, result
scale_4 = Scale(Geometry=curve_4, Center=Point(0, 0, 0), Factor=scale_3)  # -> Geometry, Transform
divide_distance = DivideDistance(Curve=scale_4.Geometry, Distance=spacing)  # -> flatten(Points), Tangents, Parameters
cull_duplicates = CullDuplicates(Points=divide_distance.Points, Tolerance=tolerance, CullMode=3)  # -> Points, Indices, Valence
vector_2pt = Vector2Pt(PointA="0,0,0", PointB=cull_duplicates.Points, Unitize=False)  # -> Vector, Length
move = Move(Geometry=conical_tree.pipe_2, Motion=vector_2pt.Vector)  # -> Geometry, Transform
move_2 = Move(Geometry=conical_tree.result, Motion=vector_2pt.Vector)  # -> Geometry, Transform
trunk = Brep(move.Geometry)
canopy = Brep(move_2.Geometry)

# ----
# cull and color planting
trunk_2 = Brep(trunk)
canopy_2 = Brep(canopy)
surface_2 = Surface(surface)
collision_many_many = CollisionManyMany(Colliders=[trunk_2, surface_2])  # -> Collision, Indices
gate_not = GateNot(A=collision_many_many.Collision)
cull_pattern = CullPattern(List=trunk_2, CullPattern=gate_not)
cull_pattern_2 = CullPattern(List=canopy_2, CullPattern=gate_not)
list_length = ListLength(List=cull_pattern_2)
range_3 = Range(Domain=Domain(0, 1), Steps=list_length)
color_a = ColourSwatch(SwatchColor=RGB(176, 152, 106))
color_b = ColourSwatch(SwatchColor=RGB(73, 140, 132))
color_c = ColourSwatch(SwatchColor=RGB(58, 94, 84))
interpolate_data = InterpolateData(Data=[color_a, color_b, color_c], Parameter=range_3, Interpolation=2)
trunk_color = ColourSwatch(SwatchColor=RGB(139, 76, 57))
custom_preview_2 = CustomPreview(Geometry=cull_pattern, Material=trunk_color)
custom_preview_3 = CustomPreview(Geometry=cull_pattern_2, Material=interpolate_data)

# ----
# wave of shrubs
# textured sinusoidal waves
X = Slider(125, range=0..250)
Y = Slider(100, range=0..100)
count_3 = Slider(6000, range=0..10000)
seed = Slider(99, range=0..100)
curve_5 = Curve(scale_2.Geometry)
spacing_2 = Slider(1, range=0..20)
# shrub attractor
threshold = Slider(0.4, range=0..2)
rectangle = Rectangle(Plane="0,-50,0", XSize=X, YSize=Y, Radius=0)  # -> Rectangle, Length
divide_distance_2 = DivideDistance(Curve=curve_5, Distance=spacing_2)  # -> flatten(Points), Tangents, Parameters
populate_2d = Populate2D(Region=rectangle.Rectangle, Count=count_3, Seed=seed)
closest_point = ClosestPoint(Point=populate_2d, Cloud=divide_distance_2.Points)  # -> ClosestPoint, CPIndex, Distance
bounds = Bounds(Numbers=closest_point.Distance)
remap_numbers = RemapNumbers(Value=closest_point.Distance, Source=bounds, Target="1 To 0")  # -> Mapped, Clipped
graph_mapper = GraphMapper(
    remap_numbers.Mapped,
    x0=0,
    x1=1,
    y0=0,
    y1=1,
    container_name="Bezier",
    cpx=[0, 0.8630043864, 0.9253070951, 1],
    cpy=[0, 0.08003038168, 0.1245311499, 1])
larger_than = LargerThan(FirstNumber=graph_mapper, SecondNumber=threshold)  # -> LargerThan, OrEqualTo
cull_pattern_3 = CullPattern(List=populate_2d, CullPattern=larger_than.LargerThan)
cull_pattern_4 = CullPattern(List=graph_mapper, CullPattern=larger_than.LargerThan)
number = Number(cull_pattern_4)
point = Point(cull_pattern_3)

radius = Slider(1, range=0..2)
point_2 = Point(point)
number_2 = Number(number)
bounds_2 = Bounds(Numbers=number_2)
quad_sphere = QuadSphere(Base=PlaneXY(0, 0, 0), Radius=radius)
plane_surface = PlaneSurface(Plane=PlaneXY(0, 0, 0), XSize=Domain(-10, 10), YSize=Domain(-10, 10))
remap_numbers_2 = RemapNumbers(Value=number_2, Source=bounds_2, Target=".5 To 1.5")  # -> Mapped, Clipped
split_brep = SplitBrep(Brep=quad_sphere, Cutter=plane_surface)
list_item = ListItem(List=split_brep, Index="0", Wrap=True)
vector_2pt_2 = Vector2Pt(PointA="0,0,0", PointB=point_2, Unitize=False)  # -> Vector, Length
cap_holes = CapHoles(Brep=list_item)
move_3 = Move(Geometry=cap_holes, Motion=vector_2pt_2.Vector)  # -> Geometry, Transform
scale_5 = Scale(Geometry=move_3.Geometry, Center=vector_2pt_2.Vector, Factor=remap_numbers_2.Mapped)  # -> Geometry, Transform
shrubs = Brep(scale_5.Geometry)

# ----
# cull and color shrubs
shrubs_2 = Brep(shrubs)
surface_3 = Surface(surface)
collision_one_many = CollisionOneMany(Collider=shrubs_2, Obstacles=surface_3)  # -> Collision, Index
gate_not_2 = GateNot(A=collision_one_many.Collision)
cull_pattern_5 = CullPattern(List=shrubs_2, CullPattern=gate_not_2)
list_length_2 = ListLength(List=cull_pattern_5)
area = Area(Geometry=cull_pattern_5)  # -> Area, Centroid
random = Random(Range="0.5 To 1.5", Number=list_length_2, Seed=2)
range_4 = Range(Domain=Domain(0, 1), Steps=list_length_2)
scale_6 = Scale(Geometry=cull_pattern_5, Center=area.Centroid, Factor=random)  # -> Geometry, Transform
color_c_2 = ColourSwatch(SwatchColor=RGB(103, 143, 131))
color_c_3 = ColourSwatch(SwatchColor=RGB(13, 99, 75))
interpolate_data_2 = InterpolateData(Data=[color_c_2, color_c_3], Parameter=range_4, Interpolation=2)
custom_preview_4 = CustomPreview(Geometry=scale_6.Geometry, Material=interpolate_data_2)

# ==== cluster ConicalTree
trunk_height = ClusterInput()
relay = ClusterInput()
A = ClusterInput()
relay_2 = ClusterInput()
relay_3 = ClusterInput()
unit_z = UnitZ(Factor=trunk_height)
subtraction = Subtraction(A=A, B=trunk_height)
move = Move(Geometry="0,0,0", Motion=unit_z)  # -> Geometry, Transform
top_of_trunk = Point(move.Geometry)
unit_z_2 = UnitZ(Factor=subtraction)
division = Division(A=subtraction, B=relay_2)
move_2 = Move(Geometry=top_of_trunk, Motion=unit_z_2)  # -> Geometry, Transform
line = Line(StartPoint="0,0,0", EndPoint=move.Geometry)
line_2 = Line(StartPoint=top_of_trunk, EndPoint=move_2.Geometry)
pipe = Pipe(Curve=line, Radius=relay, Caps="1")
divide_curve = DivideCurve(Curve=line_2, Count=relay_2, Kinks=False)  # -> Points, Tangents, Parameters
pipe_2 = ClusterOutput(pipe)
split_list = SplitList(List=divide_curve.Points, Index=relay_2)  # -> ListA, ListB
range = Range(Domain="1 To 0.5", Steps=expr("x-1", relay_2))
cone = Cone(Base=split_list.ListA, Radius=relay_3, Length=division)  # -> Cone, Tip
multiplication = Multiplication(A=range, B="2")
scale_nu = ScaleNU(Geometry=cone.Cone, Plane=split_list.ListA, ScaleX=range, ScaleY=range, ScaleZ=multiplication)  # -> Geometry, Transform
cap_holes = CapHoles(Brep=scale_nu.Geometry)
solid_union = SolidUnion(Breps=cap_holes)
result = ClusterOutput(solid_union)
