# Grasshopper definition wave-surface-color-plus.gh (Grasshopper 1.0.7)
# Copyright: GNU General Public License 3.0
# plug-ins: ColorPlus

# ---- group: surface from sinusoidal waves
# surfaces
# surface from waves
step = Slider(1, range=0..10)
count = Slider(11, range=0..100)
series = Series(Start=0, Step=step, Count=count)
expression = Expression(x=graft(series), y=series, Expression="sin(x)*cos(y)")
construct_point = ConstructPoint(XCoordinate=graft(series), YCoordinate=series, ZCoordinate=expression)
surface_from_points = SurfaceFromPoints(Points=flatten(construct_point), UCount=count, Interpolate=False)
surface = Surface(surface_from_points)

# ----
# grid to surface
step_2 = Slider(1, range=0..10)
# color gradient
xy = Slider(10, range=0..100)
square = Square(Plane=PlaneXY(0, 0, 0), Size=step_2, ExtentX=xy, ExtentY=xy)  # -> Cells, Points
addition = Addition(A=xy, B="1")
series_2 = Series(Start=0, Step=step_2, Count=addition)
expression_2 = Expression(x=graft(series_2), y=series_2, Expression="sin(x)*cos(y)")
unit_z = UnitZ(Factor=expression_2)
move = Move(Geometry=square.Points, Motion=unit_z)  # -> Geometry, Transform
surface_from_points_2 = SurfaceFromPoints(Points=flatten(move.Geometry), UCount=addition, Interpolate=False)
surface_2 = Surface(surface_from_points_2)

surface_3 = Surface(surface)
mesh_brep = MeshBrep(
    Brep=surface_3,
    Settings={GridMaxCount=0, GridMinCount=16, JaggedSeams=False, MaxEdgeLength=0, MinEdgeLength=0.0001, MinTolerance=0, Refine=True, RefineAngle=0, RelativeTolerance=0.65, SimplePlanes=True, Tolerance=0})
deconstruct_mesh = DeconstructMesh(Mesh=mesh_brep)  # -> Vertices, Faces, Colours, Normals
deconstruct = Deconstruct(Point=deconstruct_mesh.Vertices)  # -> XComponent, YComponent, ZComponent
bounds = Bounds(Numbers=deconstruct.ZComponent)
remap_numbers = RemapNumbers(Value=deconstruct.ZComponent, Source=bounds, Target=Domain(0, 1))  # -> Mapped, Clipped
gradient = Gradient(
    LowerLimit=0,
    UpperLimit=1,
    Parameter=remap_numbers.Mapped,
    stops=[0: RGB(0, 0, 4), 0.167: RGB(50, 10, 94), 0.334: RGB(120, 28, 109), 0.501: RGB(205, 55, 84), 0.668: RGB(237, 105, 37), 0.835: RGB(251, 182, 26), 1: RGB(252, 255, 164)])
mesh_colours = MeshColours(Mesh=mesh_brep, Colours=gradient)
mesh = Mesh(mesh_colours)

# ----
# color+ plugin
# using color+
# using color+
surface_4 = Surface(surface)
mesh_brep_2 = MeshBrep(
    Brep=surface_4,
    Settings={GridMaxCount=0, GridMinCount=16, JaggedSeams=False, MaxEdgeLength=0, MinEdgeLength=0.0001, MinTolerance=0, Refine=True, RefineAngle=0, RelativeTolerance=0.65, SimplePlanes=True, Tolerance=0})
deconstruct_mesh_2 = DeconstructMesh(Mesh=mesh_brep_2)  # -> Vertices, Faces, Colours, Normals
deconstruct_2 = Deconstruct(Point=deconstruct_mesh_2.Vertices)  # -> XComponent, YComponent, ZComponent
bounds_2 = Bounds(Numbers=deconstruct_2.ZComponent)
remap_numbers_2 = RemapNumbers(Value=deconstruct_2.ZComponent, Source=bounds_2, Target=Domain(0, 1))  # -> Mapped, Clipped
color_palettes = ColorPalettes(Collection=13, SubCollection=2)  # -> Names, Colors
construct_gradient = ConstructGradient(Colors=color_palettes.Colors, Sample=remap_numbers_2.Mapped, InterpolationMode=0)
mesh_colours_2 = MeshColours(Mesh=mesh_brep_2, Colours=construct_gradient)
mesh_2 = Mesh(mesh_colours_2)
