# Grasshopper definition wave-surface-voxel.gh (Grasshopper 1.0.7)
# Copyright: GNU General Public License 3.0

# ---- group: surface from sinusoidal wave
# wave surface
# surface from waves
step = Slider(1, range=0..10)
count = Slider(11, range=0..100)
a = Slider(2, range=0..2)
b = Slider(1, range=0..2)
c = Slider(1, range=0..10)
d = Slider(0, range=0..10)
# color gradient
f = Slider(0.1, range=0..1)
series = Series(Start=0, Step=step, Count=count)
expression = Expression(
    x=graft(series),
    y=series,
    a=a,
    b=b,
    c=c,
    d=d,
    f=f,
    Expression="(a * sin(b * x - c) + d) * e^(-f * x) * (a * cos(b * y - c) + d) * e^(-f * y)")
construct_point = ConstructPoint(XCoordinate=graft(series), YCoordinate=series, ZCoordinate=expression)
count_2 = Number(count)
surface_from_points = SurfaceFromPoints(Points=flatten(construct_point), UCount=count_2, Interpolate=Toggle(True))
surface = Surface(surface_from_points)

# ---- group: surface color gradient
surface_2 = Surface(surface)
mesh_brep = MeshBrep(
    Brep=surface_2,
    Settings={GridMaxCount=0, GridMinCount=16, JaggedSeams=False, MaxEdgeLength=0, MinEdgeLength=0.0001, MinTolerance=0, Refine=True, RefineAngle=0, RelativeTolerance=0.65, SimplePlanes=True, Tolerance=0})
deconstruct_mesh = DeconstructMesh(Mesh=mesh_brep)  # -> Vertices, Faces, Colours, Normals
deconstruct = Deconstruct(Point=deconstruct_mesh.Vertices)  # -> XComponent, YComponent, ZComponent
bounds = Bounds(Numbers=deconstruct.ZComponent)
remap_numbers = RemapNumbers(Value=deconstruct.ZComponent, Source=bounds, Target=Domain(0, 1))  # -> Mapped, Clipped
gradient = Gradient(
    LowerLimit=0,
    UpperLimit=1,
    Parameter=remap_numbers.Mapped,
    stops=[0: RGB(0, 0, 4), 0.167: RGB(50, 10, 94), 0.334: RGB(120, 28, 109), 0.501: RGB(205, 55, 84), 0.668: RGB(237, 105, 37), 0.835: RGB(251, 182, 26), 1: RGB(252, 255, 164)])
mesh_colours = MeshColours(Mesh=mesh_brep, Colours=gradient)
mesh = Mesh(mesh_colours)

# ---- group: contours from surface
# contours
surface_3 = Surface(surface)
interval = Slider(0.1, range=0..1)
contour = Contour(Shape=surface_3, Point=Point(0, 0, 0), Direction=Vector(0, 0, 1), Distance=interval)  # -> flatten(Contours)
list_length = ListLength(List=contour)
range = Range(Domain=Domain(0, 1), Steps=list_length)
gradient_2 = Gradient(
    LowerLimit=0,
    UpperLimit=1,
    Parameter=range,
    stops=[0: RGB(0, 0, 4), 0.167: RGB(50, 10, 94), 0.334: RGB(120, 28, 109), 0.501: RGB(205, 55, 84), 0.668: RGB(237, 105, 37), 0.835: RGB(251, 182, 26), 1: RGB(252, 255, 164)])
custom_preview = CustomPreview(Geometry=contour, Material=gradient_2)

# ----
# mesh
point = Point(flatten(construct_point))
delaunay_mesh = DelaunayMesh(Points=point, Plane=PlaneXY(0, 0, 0))
deconstruct_mesh_2 = DeconstructMesh(Mesh=delaunay_mesh)  # -> Vertices, Faces, Colours, Normals
deconstruct_2 = Deconstruct(Point=deconstruct_mesh_2.Vertices)  # -> XComponent, YComponent, ZComponent
bounds_2 = Bounds(Numbers=deconstruct_2.ZComponent)
remap_numbers_2 = RemapNumbers(Value=deconstruct_2.ZComponent, Source=bounds_2, Target=Domain(0, 1))  # -> Mapped, Clipped
gradient_3 = Gradient(
    LowerLimit=0,
    UpperLimit=1,
    Parameter=remap_numbers_2.Mapped,
    stops=[0: RGB(0, 0, 4), 0.167: RGB(50, 10, 94), 0.334: RGB(120, 28, 109), 0.501: RGB(205, 55, 84), 0.668: RGB(237, 105, 37), 0.835: RGB(251, 182, 26), 1: RGB(252, 255, 164)])
mesh_colours_2 = MeshColours(Mesh=delaunay_mesh, Colours=gradient_3)
mesh_2 = Mesh(mesh_colours_2)

# ----
# voxels
step_2 = Number(step)
count_3 = Number(count)
surface_4 = Surface(surface)
series_2 = Series(Start=0, Step=step_2, Count=count_3)
subtraction = Subtraction(A=count_3, B="1")
division = Division(A=subtraction, B="2")
count_4 = Number(count_3)
unit_z = UnitZ(Factor=count_4)
subtraction_2 = Subtraction(A=series_2, B=division)
construct_point_2 = ConstructPoint(XCoordinate=graft(series_2), YCoordinate=series_2, ZCoordinate=0)
unit_z_2 = UnitZ(Factor=subtraction_2)
negative = Negative(Value=unit_z)
move = Move(Geometry=flatten(construct_point_2), Motion=graft(unit_z_2))  # -> flatten(Geometry), Transform
extrude = Extrude(Base=surface_4, Direction=negative)
point_in_brep = PointInBrep(Brep=extrude, Point=move.Geometry, Strict=False)
cull_pattern = CullPattern(List=move.Geometry, CullPattern=point_in_brep)
point_2 = Point(cull_pattern)

point_3 = Point(flatten(point_2))
step_3 = Number(step)
division_2 = Division(A=step_3, B="2")
negative_2 = Negative(Value=division_2)
construct_domain = ConstructDomain(DomainStart=negative_2, DomainEnd=division_2)
domain_box = DomainBox(Base=point_3, X=construct_domain, Y=construct_domain, Z=construct_domain)
brep = Brep(domain_box)

brep_2 = Brep(brep)
point_4 = Point(point_2)
deconstruct_3 = Deconstruct(Point=point_4)  # -> XComponent, YComponent, ZComponent
bounds_3 = Bounds(Numbers=deconstruct_3.ZComponent)
remap_numbers_3 = RemapNumbers(Value=deconstruct_3.ZComponent, Source=bounds_3, Target=Domain(0, 1))  # -> Mapped, Clipped
gradient_4 = Gradient(
    LowerLimit=0,
    UpperLimit=1,
    Parameter=remap_numbers_3.Mapped,
    stops=[0: RGB(0, 0, 4), 0.167: RGB(50, 10, 94), 0.334: RGB(120, 28, 109), 0.501: RGB(205, 55, 84), 0.668: RGB(237, 105, 37), 0.835: RGB(251, 182, 26), 1: RGB(252, 255, 164)])
custom_preview_2 = CustomPreview(Geometry=brep_2, Material=gradient_4)
