# Grasshopper definition wave-surface.gh (Grasshopper 1.0.7)
# Copyright: GNU General Public License 3.0

# ---- group: surface from sinusoidal waves
# surface
# surface from waves
step = Slider(1, range=0..10)
count = Slider(11, range=0..100)
series = Series(Start=0, Step=step, Count=count)
expression = Expression(x=graft(series), y=series, Expression="sin(x)*cos(y)")
construct_point = ConstructPoint(XCoordinate=graft(series), YCoordinate=series, ZCoordinate=expression)
surface_from_points = SurfaceFromPoints(Points=flatten(construct_point), UCount=count, Interpolate=False)
surface = Surface(surface_from_points)

# ---- group: surface color gradient
# color gradient
surface_2 = Surface(surface)
mesh_brep = MeshBrep(
    Brep=surface_2,
    Settings={GridMaxCount=0, GridMinCount=16, JaggedSeams=False, MaxEdgeLength=0, MinEdgeLength=0.0001, MinTolerance=0, Refine=True, RefineAngle=0, RelativeTolerance=0.65, SimplePlanes=True, Tolerance=0})
deconstruct_mesh = DeconstructMesh(Mesh=mesh_brep)  # -> Vertices, Faces, Colours, Normals
deconstruct = Deconstruct(Point=deconstruct_mesh.Vertices)  # -> XComponent, YComponent, ZComponent
bounds = Bounds(Numbers=deconstruct.ZComponent)
remap_numbers = RemapNumbers(Value=deconstruct.ZComponent, Source=bounds, Target=Domain(0, 1))  # -> Mapped, Clipped
gradient = Gradient(
    LowerLimit=0,
    UpperLimit=1,
    Parameter=remap_numbers.Mapped,
    stops=[0: RGB(0, 0, 4), 0.167: RGB(50, 10, 94), 0.334: RGB(120, 28, 109), 0.501: RGB(205, 55, 84), 0.668: RGB(237, 105, 37), 0.835: RGB(251, 182, 26), 1: RGB(252, 255, 164)])
mesh_colours = MeshColours(Mesh=mesh_brep, Colours=gradient)
mesh = Mesh(mesh_colours)

# ---- group: contours from surface
# contours
surface_3 = Surface(surface)
interval = Slider(0.1, range=0..1)
contour = Contour(Shape=surface_3, Point=Point(0, 0, 0), Direction=Vector(0, 0, 1), Distance=interval)
custom_preview = CustomPreview(Geometry=contour, Material=ColourSwatch(SwatchColor=RGB(0, 0, 0)))
