# Grasshopper definition weaverbird.gh (Grasshopper 1.0.7)
# plug-ins: Weaverbird

# ---- group: mesh shaped by attractors / set multiple attractors
point = Point([Point(2.935578694, 8.472659962, 0), Point(2.770458601, 2.231120429, 0), Point(8.285469722, 8.269942564, 0)])

# ---- group: mesh shaped by attractors
# mesh attractor
extents = Slider(10, range=0..10)
square = Square(Plane=PlaneXY(0, 0, 0), Size=1, ExtentX=extents, ExtentY=extents)  # -> Cells, flatten(Points)
closest_point = ClosestPoint(Point=square.Points, Cloud=point)  # -> ClosestPoint, CPIndex, Distance
unit_z = UnitZ(Factor=closest_point.Distance)
move = Move(Geometry=square.Points, Motion=unit_z)  # -> Geometry, Transform
delaunay_mesh = DelaunayMesh(Points=move.Geometry, Plane=PlaneXY(0, 0, 0))
mesh_edges = MeshEdges(Mesh=delaunay_mesh)  # -> NakedEdges, InteriorEdges, NonManifoldEdges
mesh = Mesh(delaunay_mesh)

# ----
# mesh thicken
mesh_2 = Mesh(mesh)
distance = Slider(9, range=0..100)
distance_2 = Slider(0.4, range=0..1)
level = Slider(3, range=0..10)
picture_frame = WeaverbirdsPictureFrame(MeshPolylines=mesh_2, Distance=distance, InsetType=0)
mesh_thicken = WeaverbirdsMeshThicken(MeshCurves=picture_frame, Distance=distance_2, OffsetType=0)
catmull_clark = WeaverbirdsCatmullClarkSubdivision(MeshCurves=mesh_thicken, Level=level, SmoothNakedEdges=1)
custom_preview = CustomPreview(Geometry=catmull_clark, Material=ColourSwatch(SwatchColor=RGB(178, 178, 178)))
