# Grasshopper definition sine-vessel.gh (Grasshopper 1.0.7)
# plug-ins: Pufferfish

# ---- group: circular base
circle = Circle(Plane=PlaneXY(0, 0, 0), Radius=Slider(3, range=0..10))
divide_curve = DivideCurve(Curve=circle, Count=Slider(8, range=0..10), Kinks=False)  # -> Points, Tangents, Parameters

# ---- group: sine wave with variable amplitude
# sine vase
number_slider = Slider(1, range=0..2)
pi = Pi(Factor=Slider(2.4, range=0..12))
dom = ConstructDomain(DomainStart=0, DomainEnd=pi)
range = Range(Domain=dom, Steps=Slider(22, range=0..360))
expression = Expression(w=number_slider, t=range, Expression="sin(w*t)")
pt = ConstructPoint(XCoordinate=range, YCoordinate=expression, ZCoordinate=0)
intcrv = Interpolate(Vertices=pt, Degree=3, Periodic=False, KnotStyle=1)  # -> Curve, Length, Domain

# ---- group: revolve around sine curve
xz_plane = XZPlane(Origin=Point(0, 0, 0))
list_item = ListItem(List=divide_curve.Points, Index=0, Wrap=True)
rotate = Rotate(Geometry=intcrv.Curve, Angle=1.570796327, Plane=xz_plane)  # -> Geometry, Transform
xy_plane = XYPlane(Origin=Point(0, 0, 0))
move_to_point = MoveToPoint(Geometry=rotate.Geometry, PointA=xy_plane, PointB=list_item)  # -> Moved, Vector, Transform
rotate_2 = Rotate(Geometry=move_to_point.Moved, Angle=1.570796327, Plane=move_to_point.Vector)  # -> Geometry, Transform
line = Line(StartPoint="0,0,0", EndPoint="0,0,1")
revolution = Revolution(Curve=rotate_2.Geometry, Axis=line, Domain=Domain(0, 6.283185307))

# ---- group: mirror
xy_plane_2 = XYPlane(Origin=Point(0, 0, 0))
mirror = Mirror(Geometry=revolution, Plane=xy_plane_2)  # -> Geometry, Transform
