# Grasshopper definition slime-mold.gh (Grasshopper 1.0.7)
# plug-ins: MeshEdit Components, Nuclei, Noise 4D

# ---- group: slime mold
# slime mold
# using nuclei
# using meshedit
# enable the timer
# then toogle reset
# to fasle to start
# using nuclei
# using nuclei
xy = Slider(100, range=0..100)
environment_constructor = EnvironmentConstructor(VoxelSize=1, XVoxels=xy, YVoxels=xy)  # -> OutputVoxels, OutputVoxelPositions, OutputVoxelAddresses
cull_pattern = CullPattern(List=environment_constructor.OutputVoxelPositions, CullPattern=[False, True, False, False, False, False])
distance = Slider(3.25, range=0..10)
deposit = Slider(1.5, range=0..10)
point = Point(cull_pattern)
construct_particles = ConstructParticles(InitialParticles=point, Speed=1, SensorDistance=distance, SensorAngle=45, RotationAngle=45, Deposit=deposit)
timer = Timer(TimerInterval=20, Target=nuclei_solver)  # disabled
nuclei_solver = NucleiSolver(Reset=Toggle(False), Voxels=environment_constructor.OutputVoxels, Particles=construct_particles)  # -> Iteration, OutputParticles, OutputParticleAngle, OutputVoxelDensities
gradient = Gradient(LowerLimit=0, UpperLimit=1, Parameter=nuclei_solver.OutputVoxelDensities, stops=[0: RGB(255, 255, 255), 1: RGB(0, 0, 0)])
panel = Panel(nuclei_solver.Iteration)
mesh_frompoints = MeshFromPoints(Points=environment_constructor.OutputVoxelPositions, UDirection=xy, VDirection=xy, Colour=gradient)

# noisy slime mold
# using meshedit
# using nuclei
# using nuclei
# using nuclei
# using nuclei
# using noise4d
# using nuclei
X = Slider(100, range=0..250)
Y = Slider(250, range=0..250)
environment_constructor_2 = EnvironmentConstructor(VoxelSize=1, XVoxels=X, YVoxels=Y)  # -> OutputVoxels, OutputVoxelPositions, OutputVoxelAddresses
cull_pattern_2 = CullPattern(List=environment_constructor_2.OutputVoxelPositions, CullPattern=[False, True, False, False, False, False])
distance_2 = Slider(3.25, range=0..10)
deposit_2 = Slider(1.5, range=0..10)
point_2 = Point(cull_pattern_2)
construct_particles_2 = ConstructParticles(InitialParticles=point_2, Speed=1, SensorDistance=distance_2, SensorAngle=45, RotationAngle=45, Deposit=deposit_2)
point_3 = Point(environment_constructor_2.OutputVoxelPositions)
perlinnoise = PerlinNoise(Values=point_3, Time=Slider(0.33, range=0..1), Scale=Slider(0.065, range=0..0.1))
bounds = Bounds(Numbers=perlinnoise)
remap_numbers = RemapNumbers(Value=perlinnoise, Source=bounds, Target=Domain(0, 1))  # -> Mapped, Clipped
graph_mapper = GraphMapper(remap_numbers.Mapped, x0=0, x1=1, y0=0, y1=1, container_name="Bezier", cpx=[0, 0.8256906867, 0, 1], cpy=[0, 0, 1, 1])
construct_domain = ConstructDomain(DomainStart=Slider(1, range=0..10), DomainEnd=Slider(3, range=0..10))
remap_numbers_2 = RemapNumbers(Value=graph_mapper, Source=Domain(0, 1), Target=construct_domain)  # -> Mapped, Clipped
list = ValueList({"Minimum Density": "minDensity", "Maximum Density": "maxDensity", "Speed": "speed", "Sensor Distance": "sensorDistance", "Sensor Angle": "sensorAngle", "Rotation Angle": "rotationAngle", "Local Angle": "localAngle"}, selected="Speed")
list_2 = ValueList({"Minimum Density": "minDensity", "Maximum Density": "maxDensity", "Speed": "speed", "Sensor Distance": "sensorDistance", "Sensor Angle": "sensorAngle", "Rotation Angle": "rotationAngle", "Local Angle": "localAngle"}, selected="Sensor Distance")
list_3 = ValueList({"Minimum Density": "minDensity", "Maximum Density": "maxDensity", "Speed": "speed", "Sensor Distance": "sensorDistance", "Sensor Angle": "sensorAngle", "Rotation Angle": "rotationAngle", "Local Angle": "localAngle"}, selected="Maximum Density")
environment_values = EnvironmentValues(Type=list, VoxelAddress=environment_constructor_2.OutputVoxelAddresses, VoxelValue=remap_numbers_2.Mapped)
environment_values_2 = EnvironmentValues(Type=list_2, VoxelAddress=environment_constructor_2.OutputVoxelAddresses, VoxelValue=remap_numbers_2.Mapped)
environment_values_3 = EnvironmentValues(Type=list_3, VoxelAddress=environment_constructor_2.OutputVoxelAddresses, VoxelValue=remap_numbers_2.Mapped)
relay = Relay([environment_values, environment_values_2, environment_values_3])
solver_settings = SolverSettings(
    DiffuseRate=0.1,
    DiffuseRange=Slider(0.5, range=0..1),
    DecayRate=0.01,
    Wrap=Toggle(True),
    DynamicPopulation=False,
    MinimumPopulation=100,
    MaximumPopulation=20000)
timer_2 = Timer(TimerInterval=20, Target=nuclei_solver_2)  # disabled
nuclei_solver_2 = NucleiSolver(
    Reset=Toggle(True),
    Voxels=environment_constructor_2.OutputVoxels,
    VoxelValue=relay,
    Particles=construct_particles_2,
    SolverSettings=solver_settings)  # -> Iteration, OutputParticles, OutputParticleAngle, OutputVoxelDensities
gradient_2 = Gradient(
    LowerLimit=0,
    UpperLimit=1,
    Parameter=nuclei_solver_2.OutputVoxelDensities,
    stops=[0: RGB(255, 255, 255), 1: RGB(0, 0, 0)])
panel_2 = Panel(nuclei_solver_2.Iteration)
mesh_frompoints_2 = MeshFromPoints(Points=environment_constructor_2.OutputVoxelPositions, UDirection=X, VDirection=Y, Colour=gradient_2)

# ---- group: construct obstacle
radius = Slider(50, range=0..250)
height = Slider(1, range=0..250)
X_2 = Slider(75, range=0..250)
Y_2 = Slider(100, range=0..250)
construct_point = ConstructPoint(XCoordinate=X_2, YCoordinate=Y_2, ZCoordinate=0)
cylinder = Cylinder(Base=construct_point, Radius=radius, Length=height)
cap_holes = CapHoles(Brep=cylinder)

# ---- group: slime mold with obstacles
# slime mold with obstacles
# using meshedit
# using nuclei
# using nuclei
# using nuclei
X_3 = Slider(100, range=0..250)
Y_3 = Slider(250, range=0..250)
environment_constructor_3 = EnvironmentConstructor(VoxelSize=1, XVoxels=X_3, YVoxels=Y_3)  # -> OutputVoxels, OutputVoxelPositions, OutputVoxelAddresses
cull_pattern_3 = CullPattern(List=environment_constructor_3.OutputVoxelPositions, CullPattern=[False, True, False, False, False, False])
deposit_3 = Slider(1.5, range=0..10)
distance_3 = Slider(3.25, range=0..10)
point_4 = Point(environment_constructor_3.OutputVoxelPositions)
point_5 = Point(cull_pattern_3)
construct_particles_3 = ConstructParticles(InitialParticles=point_5, Speed=1, SensorDistance=distance_3, SensorAngle=45, RotationAngle=45, Deposit=deposit_3)
point_in_brep = PointInBrep(Brep=graft(cap_holes), Point=point_4, Strict=False)
flip_matrix = FlipMatrix(Data=point_in_brep)  # -> simplify(Data)
mass_addition = MassAddition(Input=flip_matrix)  # -> flatten(Result), PartialResults
boolean = Boolean(mass_addition.Result)
expression = Expression(x=boolean, Expression="if(x=true, 0, -1)")
list_4 = ValueList({"Minimum Density": "minDensity", "Maximum Density": "maxDensity", "Speed": "speed", "Sensor Distance": "sensorDistance", "Sensor Angle": "sensorAngle", "Rotation Angle": "rotationAngle", "Local Angle": "localAngle"}, selected="Maximum Density")
environment_values_4 = EnvironmentValues(Type=list_4, VoxelAddress=environment_constructor_3.OutputVoxelAddresses, VoxelValue=expression)
timer_3 = Timer(TimerInterval=20, Target=nuclei_solver_3)  # disabled
# using nuclei
nuclei_solver_3 = NucleiSolver(
    Reset=Toggle(True),
    Voxels=environment_constructor_3.OutputVoxels,
    VoxelValue=environment_values_4,
    Particles=construct_particles_3)  # -> Iteration, OutputParticles, OutputParticleAngle, OutputVoxelDensities
gradient_3 = Gradient(
    LowerLimit=0,
    UpperLimit=1,
    Parameter=nuclei_solver_3.OutputVoxelDensities,
    stops=[0: RGB(255, 255, 255), 1: RGB(0, 0, 0)])
panel_3 = Panel(nuclei_solver_3.Iteration)
mesh_frompoints_3 = MeshFromPoints(Points=environment_constructor_3.OutputVoxelPositions, UDirection=X_3, VDirection=Y_3, Colour=gradient_3)
