# Grasshopper definition soundforest.gh (Grasshopper 1.0.7)
# plug-ins: Pufferfish, MosquitoAudio2, EdiTree

# ---- group: soundscape
# landform from audio waveform
# mosquito plugin
path = FilePath("D:\generative-design\grasshopper\data\Neon Drip.mp3")
x_offset = Slider(0.5, range=0..1)
stop = Slider(250, range=0..10000)
start = Slider(0, range=0..10000)
divisions = Slider(12, range=0..36)
# parametric tree
y_factor = Slider(2, range=0..12)
skip = Slider(500, range=0..5000)
z_factor = Slider(3, range=0..12)
audiowave = AudioWave(AudioFile=path, XOffset=x_offset, Skip=skip)  # -> Peak, Points, Length
play = AudioPlay(AudioFile=path, Boolean=Toggle(False))
split_list = SplitList(List=audiowave.Points, Index=stop)  # -> ListA, ListB
split_list_2 = SplitList(List=split_list.ListA, Index=start)  # -> ListA, ListB
divide_list = DivideList(List=split_list_2.ListB, Number=divisions)  # -> Chunk, Remainder
interpolate = Interpolate(Vertices=divide_list.Chunk, Degree=3, Periodic=False, KnotStyle=1)  # -> Curve, Length, Domain
scale_nu = ScaleNU(Geometry=interpolate.Curve, Plane=PlaneXY(0, 0, 0), ScaleX=1, ScaleY=1, ScaleZ=z_factor)  # -> Geometry, Transform
series = Series(Start=0, Step=y_factor, Count=divisions)
end_points = EndPoints(Curve=scale_nu.Geometry)  # -> Start, End
unit_y = UnitY(Factor=graft(series))
move_to_point = MoveToPoint(Geometry=scale_nu.Geometry, PointA=end_points.Start, PointB=unit_y)  # -> flatten(Moved), Vector, Transform
loft_type = ValueList({"Normal": 0, "Loose": 1, "Tight": 2, "Straight": 3, "Uniform": 5}, selected="Normal")
loft_options = LoftOptions(Closed=Toggle(False), Adjust=False, Rebuild=0, Refit=0, Type=loft_type)
loft = Loft(Curves=move_to_point.Moved, Options=loft_options)

# ---- group: generate a conical tree
# diameter at breast height (DBH)
canopy_layers = Slider(3, range=0..10)
camopy_diameter = Slider(10, range=0..100)
trunk_diameter = Slider(0.75, range=0..2)
trunk_height = Slider(8, range=0..100)
crown_height = Slider(30, range=0..75)
conical_tree = ConicalTree(A=trunk_diameter, factor=trunk_height, factor_2=crown_height, B=canopy_layers, A_2=camopy_diameter)  # -> trunk, result
canopy_color = ColourSwatch(SwatchColor=RGBA(58, 94, 58, 232))
trunk_color = ColourSwatch(SwatchColor=RGB(139, 76, 57))
custom_preview = CustomPreview(Geometry=conical_tree.trunk, Material=trunk_color)
custom_preview_2 = CustomPreview(Geometry=conical_tree.result, Material=canopy_color)

# ---- group: terrain visualization
# terrain
number_slider = Slider(20, range=0..100)
# water
number_slider_2 = Slider(2, range=0..10)
scale = Scale(Geometry=loft, Center=Point(0, 0, 0), Factor=number_slider)  # -> Geometry, Transform
contour = Contour(Shape=scale.Geometry, Point=Point(0, 0, 0), Direction=Vector(0, 0, 1), Distance=number_slider_2)
custom_preview_3 = CustomPreview(Geometry=scale.Geometry, Material=ColourSwatch(SwatchColor=RGB(230, 230, 230)))
custom_preview_4 = CustomPreview(Geometry=contour, Material=ColourSwatch(SwatchColor=RGB(92, 92, 92)))

# ---- group: water level
# forest
number_slider_3 = Slider(-2, range=-20..20)
bounding_rectangle = BoundingRectangle(Geometry=scale.Geometry, Plane=PlaneXY(0, 0, 0), Axis=0, Slide=0, Union=True)  # -> Bounding, DimensionX, DimensionY
unit_z = UnitZ(Factor=number_slider_3)
plane_surface = PlaneSurface(Plane=PlaneXY(0, 0, 0), XSize=bounding_rectangle.DimensionX, YSize=bounding_rectangle.DimensionY)
move = Move(Geometry=plane_surface, Motion=unit_z)  # -> Geometry, Transform
custom_preview_5 = CustomPreview(Geometry=move.Geometry, Material=ColourSwatch(SwatchColor=RGBA(115, 136, 230, 100)))

# ---- group: culled forest distribution
factor = Slider(0.4, range=0..1)
origin = Panel("0,0,-20")
count = Slider(360, range=0..1000)
xy_plane = XYPlane(Origin=origin)
bounding_rectangle_2 = BoundingRectangle(Geometry=scale.Geometry, Plane=xy_plane, Axis=0, Slide=0, Union=True)  # -> Bounding, DimensionX, DimensionY
plane_surface_2 = PlaneSurface(Plane=xy_plane, XSize=bounding_rectangle_2.DimensionX, YSize=bounding_rectangle_2.DimensionY)
construct_point = ConstructPoint(XCoordinate=0, YCoordinate=bounding_rectangle_2.DimensionY, ZCoordinate=0)
populate_2d = Populate2D(Region=plane_surface_2, Count=count, Seed=1)
line = Line(StartPoint=Point(0, 0, 0), EndPoint=construct_point)
curve_closest_point = CurveClosestPoint(Point=populate_2d, Curve=line)  # -> Point, Parameter, Distance
list_length = ListLength(List=populate_2d)
random = Random(Range="0.0 To 0.5", Number=list_length, Seed=2)
multiplication = Multiplication(A=list_length, B=factor)
addition = Addition(A=random, B=curve_closest_point.Parameter)
sort_list = SortList(Keys=addition, ValuesValuesA=populate_2d)  # -> Keys, ValuesValuesA
sub_list = SubList(List=sort_list.ValuesValuesA, Domain=multiplication, Wrap=True)  # -> List, Index
project_point = ProjectPoint(Point=sub_list.List, Direction="0,0,1", Geometry=scale.Geometry)  # -> Point, Index
list_length_2 = ListLength(List=sub_list.List)
tree_canopy = Geometry(conical_tree.result)
tree_trunk = Geometry(conical_tree.trunk)
move_to_point_2 = MoveToPoint(Geometry=tree_canopy, PointA="0,0,0", PointB=project_point.Point)  # -> Moved, Vector, Transform
move_to_point_3 = MoveToPoint(Geometry=tree_trunk, PointA="0,0,0", PointB=project_point.Point)  # -> Moved, Vector, Transform
random_2 = Random(Range="0.45 To 0.75", Number=list_length_2, Seed=2)
scale_2 = Scale(Geometry=move_to_point_2.Moved, Center=project_point.Point, Factor=random_2)  # -> Geometry, Transform
trunk_color_2 = ColourSwatch(SwatchColor=RGB(139, 76, 57))
canopy_color_2 = ColourSwatch(SwatchColor=RGBA(58, 94, 58, 232))
custom_preview_6 = CustomPreview(Geometry=move_to_point_3.Moved, Material=trunk_color_2)
custom_preview_7 = CustomPreview(Geometry=scale_2.Geometry, Material=canopy_color_2)

# ---- group: canopy color gradient
canopy_color_3 = ColourSwatch(SwatchColor=RGBA(64, 128, 117, 232))
canopy_color_4 = ColourSwatch(SwatchColor=RGBA(58, 94, 58, 232))
colour = Colour([canopy_color_4, canopy_color_3])
range = Range(Domain=Domain(0, 1), Steps=expr("x-1", list_length_2))
interpolate_data = InterpolateData(Data=colour, Parameter=range, Interpolation=2)
custom_preview_8 = CustomPreview(Geometry=scale_2.Geometry, Material=interpolate_data)

# ==== cluster ConicalTree
factor = ClusterInput()
factor_2 = ClusterInput()
A = ClusterInput()
A_2 = ClusterInput()

# ---- group: conical tree
construct_point = ConstructPoint(XCoordinate=0, YCoordinate=0, ZCoordinate=0)
unit_z = UnitZ(Factor=factor)
unit_z_2 = UnitZ(Factor=factor_2)
division = Division(A=A, B="2.0")
division_2 = Division(A=A_2, B="2.0")
B = ClusterInput()
move = Move(Geometry=construct_point, Motion=unit_z_2)  # -> Geometry, Transform
move_2 = Move(Geometry=construct_point, Motion=unit_z)  # -> Geometry, Transform
division_3 = Division(A=unit_z_2, B=B)
line = Line(StartPoint=construct_point, EndPoint=move_2.Geometry)
line_2 = Line(StartPoint=move_2.Geometry, EndPoint=move.Geometry)
divide_distance = DivideDistance(Curve=line_2, Distance=division_3)  # -> Points, Tangents, Parameters
construct_plane = ConstructPlane(Origin=divide_distance.Points, XAxis=Vector(1, 0, 0), YAxis=Vector(0, 1, 0))
construct_domain = ConstructDomain(DomainStart="0.5", DomainEnd="1.75")
cone = Cone(Base=construct_plane, Radius=division_2, Length=division_3)  # -> Cone, Tip
list_length = ListLength(List=construct_plane)
range = Range(Domain=construct_domain, Steps=list_length)  # -> reverse(Range)
scale = Scale(Geometry=cone.Cone, Center=construct_plane, Factor=range)  # -> Geometry, Transform
pipe = Pipe(Curve=line, Radius=division, Caps=0)
cap_holes = CapHoles(Brep=scale.Geometry)
solid_union = SolidUnion(Breps=cap_holes)

# ----
result = ClusterOutput(solid_union)
trunk = ClusterOutput(pipe)
