# Grasshopper definition soundgrid.gh (Grasshopper 1.0.7)
# plug-ins: Pufferfish, MosquitoAudio2, Docofossor, EdiTree

# ---- group: soundscape
# mosquito plugin
toggle = BooleanToggle(False)
x_offset = Slider(0.5, range=0..1)
skip = Slider(500, range=0..5000)
y_factor = Slider(2, range=0..12)
stop = Slider(250, range=0..10000)
start = Slider(0, range=0..10000)
divisions = Slider(12, range=0..36)
z_factor = Slider(3, range=0..12)
# landform from audio waveform
path = FilePath("D:\rhino\grasshopper\Neon Drip.mp3")
audiowave = AudioWave(AudioFile=path, XOffset=x_offset, Skip=skip)  # -> Peak, Points, Length
play = AudioPlay(AudioFile=path, Boolean=toggle)
split_list = SplitList(List=audiowave.Points, Index=stop)  # -> ListA, ListB
split_list_2 = SplitList(List=split_list.ListA, Index=start)  # -> ListA, ListB
divide_list = DivideList(List=split_list_2.ListB, Number=divisions)  # -> Chunk, Remainder
interpolate = Interpolate(Vertices=divide_list.Chunk, Degree=3, Periodic=False, KnotStyle=1)  # -> Curve, Length, Domain
scale_nu = ScaleNU(Geometry=interpolate.Curve, Plane=PlaneXY(0, 0, 0), ScaleX=1, ScaleY=1, ScaleZ=z_factor)  # -> Geometry, Transform
series = Series(Start=0, Step=y_factor, Count=divisions)
end_points = EndPoints(Curve=scale_nu.Geometry)  # -> Start, End
unit_y = UnitY(Factor=graft(series))
move_to_point = MoveToPoint(Geometry=scale_nu.Geometry, PointA=end_points.Start, PointB=unit_y)  # -> flatten(Moved), Vector, Transform
loft_type = ValueList({"Normal": 0, "Loose": 1, "Tight": 2, "Straight": 3, "Uniform": 5}, selected="Normal")
loft_options = LoftOptions(Closed=Toggle(False), Adjust=False, Rebuild=0, Refit=0, Type=loft_type)
loft = Loft(Curves=move_to_point.Moved, Options=loft_options)

# ----
# conversion to grid with docofossor
scale = Scale(Geometry=loft, Center=Point(0, 0, 0), Factor="2")  # -> Geometry, Transform
bounding_rectangle = BoundingRectangle(Geometry=scale.Geometry, Plane=PlaneXY(0, 0, 0), Axis=0, Slide=0, Union=True)  # -> Bounding, DimensionX, DimensionY
empty_grid = EmptyGrid(Nr=expr("x+1", bounding_rectangle.DimensionY), Nc=expr("x+1", bounding_rectangle.DimensionX), Cx=1, Cy=1)
cut_fill_in_surface = CutFillInSurface(Df=empty_grid, Srf=scale.Geometry)  # -> Df, Vol
grid_mesh = GridMesh(Df=cut_fill_in_surface.Df)
custom_preview = CustomPreview(Geometry=grid_mesh, Material=ColourSwatch(SwatchColor=RGB(230, 230, 230)))
