# Grasshopper definition soundscape.gh (Grasshopper 1.0.7)
# plug-ins: Pufferfish, MosquitoAudio2, EdiTree

# ---- group: soundscape
# mosquito plugin
toggle = BooleanToggle(False)
x_offset = Slider(0.5, range=0..1)
skip = Slider(2500, range=0..5000)
stop = Slider(250, range=0..10000)
start = Slider(0, range=0..10000)
divisions = Slider(12, range=0..36)
z_factor = Slider(3, range=0..12)
# landform from audio waveform
path = FilePath("C:\Users\baharmon\Downloads\Blue_Dot_Sessions_-_Neon_Drip.mp3")
audiowave = AudioWave(AudioFile=path, XOffset=x_offset, Skip=skip)  # -> Peak, Points, Length
play = AudioPlay(AudioFile=path, Boolean=toggle)
split_list = SplitList(List=audiowave.Points, Index=stop)  # -> ListA, ListB
split_list_2 = SplitList(List=split_list.ListA, Index=start)  # -> ListA, ListB
divide_list = DivideList(List=split_list_2.ListB, Number=divisions)  # -> Chunk, Remainder
interpolate = Interpolate(Vertices=divide_list.Chunk, Degree=3, Periodic=False, KnotStyle=1)  # -> flatten(Curve), Length, Domain
scale_nu = ScaleNU(Geometry=interpolate.Curve, Plane=PlaneXY(0, 0, 0), ScaleX=1, ScaleY=1, ScaleZ=z_factor)  # -> Geometry, Transform
end_points = EndPoints(Curve=scale_nu.Geometry)  # -> Start, End
origin = Panel("0,0,0")
degrees = Panel("360")
move_to_point = MoveToPoint(Geometry=scale_nu.Geometry, PointA=end_points.Start, PointB=origin)  # -> Moved, Vector, Transform
division = Division(A=degrees, B=divisions)
count = Integer(divisions)
series = Series(Start=0, Step=division, Count=count)
rotate = Rotate(Geometry=move_to_point.Moved, Angle=degrees(series), Plane=PlaneXY(0, 0, 0))  # -> Geometry, Transform
curve = Curve(rotate.Geometry)
loft_type = ValueList({"Normal": 0, "Loose": 1, "Tight": 2, "Straight": 3, "Uniform": 5}, selected="Loose")
loft_options = LoftOptions(Closed=Toggle(True), Adjust=False, Rebuild=0, Refit=0, Type=loft_type)
loft = Loft(Curves=curve, Options=loft_options)

# ---- group: visualization
unit_z = UnitZ(Factor=Slider(-3, range=-10..10))
unit_z_2 = UnitZ(Factor=Slider(-3, range=-10..10))
center_box = CenterBox(Base=PlaneXY(0, 0, 0), X=Slider(10, range=-10..10), Y=Slider(10, range=-10..10), Z=Slider(2, range=-10..10))
move = Move(Geometry=center_box, Motion=unit_z)  # -> Geometry, Transform
extrude = Extrude(Base=loft, Direction=unit_z_2)
contour = Contour(Shape=loft, Point=Point(0, 0, 0), Direction=Vector(0, 0, 1), Distance=Slider(0.05, range=0..10))
solid_difference = SolidDifference(BrepsA=extrude, BrepsB=move.Geometry)
custom_preview = CustomPreview(Geometry=contour, Material=ColourSwatch(SwatchColor=RGB(0, 0, 0)))
custom_preview_2 = CustomPreview(Geometry=solid_difference, Material=ColourSwatch(SwatchColor=RGB(230, 230, 230)))
