# Grasshopper definition space-filling-curve.gh (Grasshopper 1.0.7)
# plug-ins: Kangaroo2 Components

scale = Slider(0.7, range=0..1)

# ----
# space filling curve
radius = Slider(36, range=0..100)
count = Slider(3, range=0..10)
seed = Slider(475, range=0..1000)
circle = Circle(Plane=PlaneXY(0, 0, 0), Radius=radius)
scale_2 = Scale(Geometry=circle, Center=Point(0, 0, 0), Factor=scale)  # -> Geometry, Transform
boundary_surfaces = BoundarySurfaces(Edges=scale_2.Geometry)
populate_geometry = PopulateGeometry(Geometry=boundary_surfaces, Count=count, Seed=seed)
random = Random(Range="3 To 15", Number=count, Seed=seed)
circle_2 = Circle(Plane=populate_geometry, Radius=random)
region_difference = RegionDifference(CurvesA=circle, CurvesB=circle_2)
boundary_surfaces_2 = BoundarySurfaces(Edges=region_difference)
mesh_surface = MeshSurface(Surface=boundary_surfaces_2, UCount="250", VCount="250", Overhang=True, Equalize=False)
surface = Surface(boundary_surfaces_2)
mesh = Mesh(mesh_surface)

circle_3 = Circle(circle)
offset = Slider(3, range=0..10)
point_spacing = Slider(1, range=0..1)
amplitude = Slider(0.15, range=0..1)
seed_2 = Slider(2, range=0..10)
negative = Negative(Value=offset)
offset_curve = OffsetCurve(Curve=circle_3, Distance=negative, Plane=PlaneXY(0, 0, 0), Corners=1)
divide_length = DivideLength(Curve=offset_curve, Length=point_spacing)  # -> simplify(Points), Tangents, Parameters
amplitude_2 = Amplitude(Vector=divide_length.Points, Amplitude=amplitude)
list_length = ListLength(List=amplitude_2)
random_2 = Random(Range="0 To 2*PI", Number=list_length, Seed=seed_2)
rotate = Rotate(Geometry=amplitude_2, Angle=random_2, Plane=PlaneXY(0, 0, 0))  # -> simplify(Geometry), Transform
move = Move(Geometry=divide_length.Points, Motion=rotate.Geometry)  # -> Geometry, Transform
point = Point(move.Geometry)

# ---- group: run & reset
boolean_toggle = BooleanToggle(False)
boolean_toggle_2 = BooleanToggle(False)

# ----
mesh_2 = Mesh(mesh)
point_2 = Point(point)
point_3 = Point(point)
point_4 = Point(point)
list_length_2 = ListLength(List=point_4)
polyline = PolyLine(Vertices=point_2, Closed="True")  # -> flatten(Polyline)
series = Series(Start=0, Step=1, Count=list_length_2)
partition_list = PartitionList(List=series, Size=list_length_2)
explode = Explode(Curve=polyline, Recursive=True)  # -> Segments, Vertices
line = Line(explode.Segments)
list_length_3 = ListLength(List=line)
series_2 = Series(Start=0, Step=1, Count=list_length_3)
partition_list_2 = PartitionList(List=series_2, Size=list_length_3)
shift_list = ShiftList(List=partition_list_2, Shift=1, Wrap=True)
shift_list_2 = ShiftList(List=partition_list, Shift=1, Wrap=True)
shift_list_3 = ShiftList(List=explode.Segments, Shift=1, Wrap=True)
integer = Integer(partition_list_2)
integer_2 = Integer(shift_list)
integer_3 = Integer(partition_list)
integer_4 = Integer(shift_list_2)
length_line = LengthLine(Line=flatten(explode.Segments), Length="6", Strength="10")
show = Show(G=polyline)
angle = Angle(LineA=explode.Segments, LineB=shift_list_3, RestAngle="0", Strength="1000")
collider = Collider(Objects=point_4, Radii="2", IgnoreA=integer_3, IgnoreB=integer_4, Strength="100")
onmesh = OnMesh(Points=point_3, Mesh=mesh_2, Strength="1000")
collider_2 = Collider(Objects=line, Radii="0.5", IgnoreA=integer, IgnoreB=integer_2, Strength="100")
entwine = Entwine(
    Branch00=show,
    Branch01=onmesh,
    Branch02=length_line,
    Branch03=angle,
    Branch04=collider,
    Branch05=collider_2,
    FlattenInputs=True)
solver = Solver(GoalObjects=entwine, Reset=boolean_toggle_2, Threshold=0, Tolerance=0.01, On=boolean_toggle)  # -> I, V, O
fillet = Fillet(Curve=solver.O, Radius="20")  # -> flatten(Curve)
join_curves = JoinCurves(Curves=fillet, Preserve=False)
curve = Curve(join_curves)

curve_2 = Curve(curve)
offset_2 = Slider(1, range=0..1)
Z = Slider(5, range=0..10)
negative_2 = Negative(Value=offset_2)
offset_curve_loose = OffsetCurveLoose(Curve=curve_2, Distance=[offset_2, negative_2])
dispatch = Dispatch(List=offset_curve_loose, DispatchPattern=[True, False])  # -> ListA, ListB
unit_z = UnitZ(Factor=Z)
ruled_surface = RuledSurface(CurveA=dispatch.ListA, CurveB=dispatch.ListB)
extrude = Extrude(Base=ruled_surface, Direction=unit_z)

curve_3 = Curve(curve)
Z_2 = Slider(24, range=0..100)
count_2 = Slider(24, range=0..100)
scale_3 = Slider(0.7, range=0..1)
unit_z_2 = UnitZ(Factor=Z_2)
move_2 = Move(Geometry=curve_3, Motion=unit_z_2)  # -> Geometry, Transform
rebuild_curve = RebuildCurve(Curve=move_2.Geometry, Count=count_2, Tangents=False)
scale_nu = ScaleNU(Geometry=rebuild_curve, Plane=PlaneXY(0, 0, 0), ScaleX=scale_3, ScaleY=scale_3, ScaleZ=1)  # -> Geometry, Transform
loft = Loft(
    Curves=[curve_3, scale_nu.Geometry],
    Options={Adjust=False, Closed=False, LoftEnds=0, LoftSimp=0, LoftType=0, Rebuild=10, Refit=0.01})
custom_preview = CustomPreview(Geometry=loft, Material=ColourSwatch(SwatchColor=RGB(230, 230, 230)))
