# Grasshopper definition strange-attractor.gh (Grasshopper 1.0.7)
# plug-ins: Chen System, EleFront

# ---- group: chen system strange attractor
# strange attractor
# using chimpanzee
a = Slider(44, range=0..100)
iterations = Slider(40000, range=0..100000)
chen_system = ChenSystem(A=a, Iterations=iterations)
interpolate = Interpolate(Vertices=chen_system, Degree=3, Periodic=False, KnotStyle=1)  # -> Curve, Length, Domain

# ---- group: variable pipe
# using elefront
radius = Slider(0.4, range=0..8)
radius_2 = Slider(1.6, range=0..8)
radius_3 = Slider(0.1, range=0..8)
relay = Relay([radius_2, radius, radius_3])
list_length = ListLength(List=relay)
divide = DivideCurve(Curve=interpolate.Curve, Count=expr("x-1", list_length), Kinks=False)  # -> Points, Tangents, Parameters
vpipe = PipeVariable(Curve=interpolate.Curve, Parameters=divide.Parameters, Radii=relay, Caps=2)
bake_objects = BakeObjects(Geometry=vpipe, Bake=False)
custom_preview = CustomPreview(Geometry=vpipe, Material=ColourSwatch(SwatchColor=RGB(255, 255, 255)))
