# Grasshopper definition surface-export.gh (Grasshopper 1.0.7)
# Copyright: GNU General Public License
# plug-ins: Docofossor

# ---- group: export surface as gridded xyz point cloud
# export surface
# using docofossor
size = Slider(1, range=0..1)
X = Slider(120, range=0..1000)
Y = Slider(120, range=0..1000)
surface = Surface(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)
scale = Slider(10, range=0..100)
scale_2 = Scale(Geometry=surface, Center=Point(0, 0, 0), Factor=scale)  # -> Geometry, Transform
square = Square(Plane=PlaneXY(0, 0, 0), Size=size, ExtentX=X, ExtentY=Y)  # -> Cells, flatten(Points)
import_points = ImportPoints(Pts=square.Points)
cut_fill_in_surface = CutFillInSurface(Df=import_points, Srf=scale_2.Geometry)  # -> Df, Vol
grid_mesh = GridMesh(Df=cut_fill_in_surface.Df)
export_xyz = ExportXYZ(Df=cut_fill_in_surface.Df, F="parametric_landform", W=Toggle(False))

# ----
custom_preview = CustomPreview(Geometry=grid_mesh, Material=ColourSwatch(SwatchColor=RGB(227, 227, 227)))
