# Grasshopper definition terrain-export.gh (Grasshopper 1.0.7)
# plug-ins: Docofossor

# ---- group: import xyz data as grid
# import terrain
# using docofossor
file_path = FilePath("D:\generative-design\grasshopper\data\elevation.xyz")
resolution = Panel("5")
import_xyz = ImportXYZ(F=file_path, N=resolution)
grid_shift = GridShift(Df=import_xyz)
grid_mesh = GridMesh(Df=grid_shift)
custom_preview = CustomPreview(Geometry=grid_mesh, Material=ColourSwatch(SwatchColor=RGB(204, 204, 204)))
data = Data(grid_shift)

# ---- group: generate landform from noise
data_2 = Data(data)
point = Point(Point(40.79787807, 46.65670225, 10.93171013))
radius = Panel("15")
wavelength = Slider(10, range=0..16)
amplitude = Slider(1, range=0..16)
smoothing = Slider(0, range=0..16)
circle = Circle(Plane=point, Radius=radius)
noise = Noise(Df=data_2, Crv=circle, Wl=wavelength, A=amplitude, S=smoothing)
grid_mesh_2 = GridMesh(Df=noise)
custom_preview_2 = CustomPreview(Geometry=grid_mesh_2, Material=ColourSwatch(SwatchColor=RGB(204, 204, 204)))
data_3 = Data(noise)

# ----
data_4 = Data(data_3)

export_xyz = ExportXYZ(Df=data_4, F="noise", W=Toggle(False))

# ---- group: grade path along curve
# grade terrain
data_5 = Data(data)
point_2 = Point([Point(40.12628892, 56.34606202, 10.83309371), Point(42.27544677, 52.1317047, 11.12692908), Point(39.3251499, 48.8502798, 11.68504499), Point(32.36525037, 52.0480171, 12.36396472), Point(34.0394827, 60.09095025, 12.46644012), Point(44.7076506, 61.50995536, 11.27369495), Point(51.44090332, 56.51487493, 10.72774025)])
width = Slider(1, range=0..10)
slope = Slider(25, range=0..90)
interpolate = Interpolate(Vertices=point_2, Degree=3, Periodic=False, KnotStyle=1)  # -> Curve, Length, Domain

# ----
cut_fill_in_path = CutFillInPath(Df=data_5, Crv=interpolate.Curve, W=width, Sa=slope)  # -> Df, Vol

# ---- group: grade path along curve (continued)
grid_mesh_3 = GridMesh(Df=cut_fill_in_path.Df)
custom_preview_3 = CustomPreview(Geometry=grid_mesh_3, Material=ColourSwatch(SwatchColor=RGB(204, 204, 204)))
data_6 = Data(cut_fill_in_path.Df)

# ----
# export terrain
data_7 = Data(data_6)

export_xyz_2 = ExportXYZ(Df=data_7, F="landform", W=Toggle(False))
