# Grasshopper definition terrain-grading.gh (Grasshopper 1.0.7)
# plug-ins: Docofossor

# ---- group: import xyz data as grid
# using docofossor
resolution = Panel("2")
# import terrain
file_path = FilePath("D:\generative-design\grasshopper\data\elevation.xyz")
import_xyz = ImportXYZ(F=file_path, N=resolution)
grid_shift = GridShift(Df=import_xyz)
grid_mesh = GridMesh(Df=grid_shift)
custom_preview = CustomPreview(Geometry=grid_mesh, Material=ColourSwatch(SwatchColor=RGB(204, 204, 204)))
data = Data(grid_shift)

# ---- group: grade path along curve
# grade terrain
data_2 = Data(data)
point = Point([Point(54.27524179, 52.00292887, 10.8), Point(55.54513326, 44.17383964, 10.85), Point(54.53760057, 35.48752377, 10.9), Point(51.02705962, 28.80476325, 11), Point(43.203973, 24.46200402, 11), Point(34.00841503, 25.42273396, 11), Point(26.29029682, 33.11468892, 11), Point(17.53875898, 56.94382569, 11)])
width = Slider(1, range=0..10)
slope = Slider(30, range=0..90)
interpolate = Interpolate(Vertices=point, Degree=3, Periodic=False, KnotStyle=1)  # -> Curve, Length, Domain
dfcutfillinpath = CutFillInPath(Df=data_2, Crv=interpolate.Curve, W=width, Sa=slope)  # -> Df, Vol
dfgridmesh = GridMesh(Df=dfcutfillinpath.Df)
custom_preview_2 = CustomPreview(Geometry=dfgridmesh, Material=ColourSwatch(SwatchColor=RGB(204, 204, 204)))
data_3 = Data(dfcutfillinpath.Df)

# ----
data_4 = Data(data_3)

# ---- group: generate landform from noise
wavelength = Slider(10, range=0..16)
smoothing = Slider(2, range=0..16)
point_2 = Point(Point(41.10513252, 50.67117443, 10.93171013))
radius = Panel("12")
amplitude = Slider(1, range=0..16)
circle = Circle(Plane=point_2, Radius=radius)
noise = Noise(Df=data_4, Crv=circle, Wl=wavelength, A=amplitude, S=smoothing)
grid_mesh_2 = GridMesh(Df=noise)
custom_preview_3 = CustomPreview(Geometry=grid_mesh_2, Material=ColourSwatch(SwatchColor=RGB(204, 204, 204)))

# ----
data_5 = Data(noise)

# ---- group: calculate cut and fill
data_6 = Data(data)
data_7 = Data(data_5)
grid_compare = GridCompare(Df1=data_6, Df2=data_7)  # -> Cut, Fill, Balance, Df
panel = Panel(grid_compare.Cut)
panel_2 = Panel(grid_compare.Fill)
grid_mesh_3 = GridMesh(Df=grid_compare.Df)
custom_preview_4 = CustomPreview(Geometry=grid_mesh_3, Material=ColourSwatch(SwatchColor=RGB(204, 204, 204)))

# ---- group: transform
data_8 = Data(data_5)
grid_mesh_4 = GridMesh(Df=data_8)
area = Area(Geometry=grid_mesh_4)  # -> Area, Centroid
xz_plane = XZPlane(Origin=area.Centroid)
mirror = Mirror(Geometry=grid_mesh_4, Plane=xz_plane)  # -> Geometry, Transform
custom_preview_5 = CustomPreview(Geometry=mirror.Geometry, Material=ColourSwatch(SwatchColor=RGB(230, 230, 230)))
