# Grasshopper definition terrain-mesh.gh (Grasshopper 1.0.7)
# Copyright: GNU General Public License 3.0

# ---- group: mesh
# terrain
# mesh
point = Point()
delaunay_mesh = DelaunayMesh(Points=point, Plane=PlaneXY(0, 0, 0))
deconstruct_mesh = DeconstructMesh(Mesh=delaunay_mesh)  # -> Vertices, Faces, Colours, Normals
deconstruct = Deconstruct(Point=deconstruct_mesh.Vertices)  # -> XComponent, YComponent, ZComponent
bounds = Bounds(Numbers=deconstruct.ZComponent)
remap_numbers = RemapNumbers(Value=deconstruct.ZComponent, Source=bounds, Target=Domain(0, 1))  # -> Mapped, Clipped
gradient = Gradient(
    LowerLimit=0,
    UpperLimit=1,
    Parameter=remap_numbers.Mapped,
    stops=[0: RGB(55, 11, 65), 0.125: RGB(27, 30, 59), 0.25: RGB(22, 83, 76), 0.375: RGB(68, 119, 49), 0.5: RGB(161, 121, 74), 0.625: RGB(212, 132, 169), 0.75: RGB(198, 180, 238), 0.875: RGB(203, 232, 240), 1: RGB(255, 255, 255)])
construct_mesh = ConstructMesh(Vertices=deconstruct_mesh.Vertices, Faces=deconstruct_mesh.Faces, Colours=gradient)
mesh = Mesh(construct_mesh)

# ---- group: contours
# contours
mesh_2 = Mesh(mesh)
interval = Slider(1, range=0..10)
contour = Contour(Shape=mesh_2, Point=Point(0, 0, 0), Direction=Vector(0, 0, 1), Distance=interval)  # -> flatten(Contours)
custom_preview = CustomPreview(Geometry=contour, Material=ColourSwatch(SwatchColor=RGB(255, 255, 255)))
