# Grasshopper definition terrain-modeling.gh (Grasshopper 1.0.7)
# plug-ins: Docofossor

# ---- group: import xyz data as grid
# import terrain
# using docofossor
file_path = FilePath("D:\generative-design\grasshopper\data\elevation.xyz")
import_xyz = ImportXYZ(F=file_path)
grid_shift = GridShift(Df=import_xyz)
grid_mesh = GridMesh(Df=grid_shift)
bounding_box = BoundingBox(Content=grid_mesh, Plane=PlaneXY(0, 0, 0))  # -> Box, Box_2
evaluate_box = EvaluateBox(Box=bounding_box.Box, UParameter=0.5, VParameter=0.5, WParameter=0.5)  # -> Plane, Point, Include

# ----
xz_plane = XZPlane(Origin=evaluate_box.Plane)
mirror = Mirror(Geometry=grid_mesh, Plane=xz_plane)  # -> Geometry, Transform

# ---- group: import xyz data as grid (continued)
custom_preview = CustomPreview(Geometry=mirror.Geometry, Material=ColourSwatch(SwatchColor=RGB(230, 230, 230)))
