# Grasshopper definition topographic-attractors.gh (Grasshopper 1.0.7)

# ---- group: random attractors
cell_size = Slider(1, range=0..100)
extents = Slider(10, range=0..100)
count = Slider(50, range=0..100)
seed = Slider(7, range=0..100)
square = Square(Plane=PlaneXY(0, 0, 0), Size=cell_size, ExtentX=extents, ExtentY=extents)  # -> Cells, flatten(Points)
rectangle = Rectangle(Plane=PlaneXY(0, 0, 0), XSize=extents, YSize=extents, Radius=0)  # -> Rectangle, Length
populate_2d = Populate2D(Region=rectangle.Rectangle, Count=count, Seed=seed)
closest_point = ClosestPoint(Point=square.Points, Cloud=populate_2d)  # -> ClosestPoint, CPIndex, Distance
bounds = Bounds(Numbers=closest_point.Distance)
remap_numbers = RemapNumbers(Value=closest_point.Distance, Source=bounds, Target="-2 To 2")  # -> Mapped, Clipped
unit_z = UnitZ(Factor=remap_numbers.Mapped)
reverse = Reverse(Vector=unit_z)
move = Move(Geometry=square.Points, Motion=reverse)  # -> Geometry, Transform
extents_2 = Number(extents)
surface_from_points = SurfaceFromPoints(Points=move.Geometry, UCount=expr("x+1", extents_2), Interpolate=False)
custom_preview = CustomPreview(Geometry=surface_from_points, Material=ColourSwatch(SwatchColor=RGB(204, 204, 204)))

# ---- group: contours
# terrain visualization
brep = Brep(surface_from_points)
distance = Slider(0.2, range=0..1)
contour = Contour(Shape=brep, Point=Point(0, 0, 0), Direction=Vector(0, 0, 1), Distance=distance)
custom_preview_2 = CustomPreview(Geometry=contour, Material=ColourSwatch(SwatchColor=RGB(0, 0, 0)))

# ---- group: cutting plane
rectangle_2 = Rectangle(rectangle.Rectangle)
depth = Slider(0.2, range=-2..2)
unit_z_2 = UnitZ(Factor=depth)
boundary_surfaces = BoundarySurfaces(Edges=rectangle_2)
move_2 = Move(Geometry=boundary_surfaces, Motion=unit_z_2)  # -> Geometry, Transform
custom_preview_3 = CustomPreview(Geometry=move_2.Geometry, Material=ColourSwatch(SwatchColor=RGB(0, 0, 0)))

# ---- group: point attractor
# attractor
cell_size_2 = Slider(1, range=0..100)
extents_3 = Slider(10, range=0..100)
attractor_x = Slider(5, range=0..10)
attractor_y = Slider(2, range=0..10)
# multiple attractors
panel = Panel("-2 To 2")
square_2 = Square(Plane=PlaneXY(0, 0, 0), Size=cell_size_2, ExtentX=extents_3, ExtentY=extents_3)  # -> Cells, flatten(Points)
construct_point = ConstructPoint(XCoordinate=attractor_x, YCoordinate=attractor_y, ZCoordinate=0)
distance_2 = Distance(PointA=square_2.Points, PointB=construct_point)
bounds_2 = Bounds(Numbers=distance_2)
remap_numbers_2 = RemapNumbers(Value=distance_2, Source=bounds_2, Target=panel)  # -> Mapped, Clipped
unit_z_3 = UnitZ(Factor=remap_numbers_2.Mapped)
move_3 = Move(Geometry=square_2.Points, Motion=unit_z_3)  # -> Geometry, Transform
vector_display = VectorDisplay(Anchor=square_2.Points, Vector=unit_z_3)
extents_4 = Number(extents_3)
surface_from_points_2 = SurfaceFromPoints(Points=move_3.Geometry, UCount=expr("x+1", extents_4), Interpolate=False)
custom_preview_4 = CustomPreview(Geometry=surface_from_points_2, Material=ColourSwatch(SwatchColor=RGB(204, 204, 204)))

# ---- group: multiple attractors
cell_size_3 = Slider(1, range=0..100)
extents_5 = Slider(10, range=0..100)
attractors = Point([Point(8, 2, 0), Point(3.62087937, 2, 0), Point(2.867237984, 5, 0), Point(8, 8.216126361, 0), Point(6.285853306, 3.253837459, 0)])
# random attractors
panel_2 = Panel("-2 To 2")
square_3 = Square(Plane=PlaneXY(0, 0, 0), Size=cell_size_3, ExtentX=extents_5, ExtentY=extents_5)  # -> Cells, flatten(Points)
closest_point_2 = ClosestPoint(Point=square_3.Points, Cloud=attractors)  # -> ClosestPoint, CPIndex, Distance
bounds_3 = Bounds(Numbers=closest_point_2.Distance)
remap_numbers_3 = RemapNumbers(Value=closest_point_2.Distance, Source=bounds_3, Target=panel_2)  # -> Mapped, Clipped
unit_z_4 = UnitZ(Factor=remap_numbers_3.Mapped)
reverse_2 = Reverse(Vector=unit_z_4)
move_4 = Move(Geometry=square_3.Points, Motion=reverse_2)  # -> Geometry, Transform
extents_6 = Number(extents_5)
surface_from_points_3 = SurfaceFromPoints(Points=move_4.Geometry, UCount=expr("x+1", extents_6), Interpolate=False)
custom_preview_5 = CustomPreview(Geometry=surface_from_points_3, Material=ColourSwatch(SwatchColor=RGB(204, 204, 204)))
