# Grasshopper definition topographic-modeling.gh (Grasshopper 1.0.7)
# Copyright: GNU General Public License 3.0
# plug-ins: Docofossor

# ---- group: import xyz data as grid
# grading
# modeling
# using docofossor
file_path = FilePath("D:\generative-design\grasshopper\data\governors-island-landform.xyz")
resolution = Slider(3, range=0..10)
import_xyz = ImportXYZ(F=file_path, N=resolution)
grid_shift = GridShift(Df=import_xyz)
grid_mesh = GridMesh(Df=grid_shift)
data = Data(grid_shift)
mesh = Mesh(grid_mesh)

# ---- group: grade landform from curve
# grading
data_2 = Data(data)
point = Point([Point(593.0966104, 47.82972478, 9.208923794), Point(683.6743569, 109.664187, 31.36218972), Point(799.8718928, 155.7299106, 31.4421157), Point(1058.47585, 156.3609805, 17.45012827), Point(1160.015902, 140.5754654, 12.38230481)])
width = Slider(5, range=0..10)
outer_slope = Slider(25, range=0..90)
inner_slope = Slider(15, range=0..90)
max_distance = Slider(100, range=0..250)
interpolate = Interpolate(Vertices=point, Degree=3, Periodic=False, KnotStyle=1)  # -> Curve, Length, Domain
cut_fill_in_path = CutFillInPath(Df=data_2, Crv=interpolate.Curve, W=width, Sa=outer_slope, Sa2=inner_slope, D=max_distance)  # -> Df, Vol
grid_mesh_2 = GridMesh(Df=cut_fill_in_path.Df)
data_3 = Data(cut_fill_in_path.Df)
mesh_2 = Mesh(grid_mesh_2)

# ---- group: calculate cut and fill
# cut and fill
data_4 = Data(data)
data_5 = Data(data_3)
grid_compare = GridCompare(Df1=data_4, Df2=data_5)  # -> Cut, Fill, Balance, Df
panel = Panel(grid_compare.Cut)
panel_2 = Panel(grid_compare.Fill)
grid_mesh_3 = GridMesh(Df=grid_compare.Df)
custom_preview = CustomPreview(Geometry=grid_mesh_3, Material=ColourSwatch(SwatchColor=RGB(204, 204, 204)))

# ---- group: transform and visualize
# visualization
mesh_3 = Mesh(mesh_2)
area = Area(Geometry=mesh_3)  # -> Area, Centroid
xz_plane = XZPlane(Origin=area.Centroid)
mirror = Mirror(Geometry=mesh_3, Plane=xz_plane)  # -> Geometry, Transform
custom_preview_2 = CustomPreview(Geometry=mirror.Geometry, Material=ColourSwatch(SwatchColor=RGB(204, 204, 204)))
mesh_4 = Mesh(mirror.Geometry)

# ---- group: calculate contours
# contours
mesh_5 = Mesh(mesh_4)
unit_z = UnitZ(Factor=1)
contour_interval = Slider(1, range=0..10)
contour = Contour(Shape=mesh_5, Point=Point(0, 0, 0), Direction=unit_z, Distance=contour_interval)
custom_preview_3 = CustomPreview(Geometry=contour, Material=ColourSwatch(SwatchColor=RGB(0, 0, 0)))

# ---- group: visualize sea level rise
# cutting plane
surface = Surface(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)
unit_z_2 = UnitZ(Factor=Slider(5, range=0..100))
move = Move(Geometry=surface, Motion=unit_z_2)  # -> Geometry, Transform
custom_preview_4 = CustomPreview(Geometry=move.Geometry, Material=ColourSwatch(SwatchColor=RGB(0, 0, 0)))

# ---- group: export xyz
# export
data_6 = Data(data_3)
file_path_2 = FilePath("D:\generative-design\grasshopper\data\governors-island-grading.xyz")
grid_global = GridGlobal(Df=data_6)
export_xyz = ExportXYZ(Df=grid_global, F=file_path_2, W=Toggle(False))
