# Grasshopper definition topographic-simulation.gh (Grasshopper 1.0.7)
# Copyright: GNU General Public License 3.0
# plug-ins: Docofossor

# ---- group: import xyz data as grid
# terrain modeling
# terrain
# using docofossor
file_path = FilePath("D:\generative-design\grasshopper\data\governors-island-landform.xyz")
resolution = Slider(5, range=0..10)
import_xyz = ImportXYZ(F=file_path, N=resolution)
grid_shift = GridShift(Df=import_xyz)
grid_mesh = GridMesh(Df=grid_shift)
data = Data(grid_shift)
mesh = Mesh(grid_mesh)

# ----
# surface
surface = Surface(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)
scale = Slider(25, range=0..100)
X = Slider(1390, range=0..1500)
Y = Slider(230, range=0..1000)
Z = Slider(10, range=0..100)
angle = Slider(45, range=0..360)
scale_2 = Scale(Geometry=surface, Center=Point(0, 0, 0), Factor=scale)  # -> Geometry, Transform
vector_xyz = VectorXYZ(XComponent=X, YComponent=Y, ZComponent=Z)  # -> Vector, Length
move = Move(Geometry=scale_2.Geometry, Motion=vector_xyz.Vector)  # -> Geometry, Transform
box_properties = BoxProperties(Box=move.Geometry)  # -> Center, Diagonal, Area, Volume, Degeneracy
rotate = Rotate(Geometry=move.Geometry, Angle=degrees(angle), Plane=box_properties.Center)  # -> Geometry, Transform
surface_2 = Surface(rotate.Geometry)

# ----
# grading
data_2 = Data(data)
surface_3 = Surface(surface_2)
slope = Slider(33, range=0..90)
max_distance = Slider(30, range=0..250)
fill_in_surface = FillInSurface(Df=data_2, Srf=surface_3, Sa=slope, D=max_distance)  # -> Df, Vol
grid_mesh_2 = GridMesh(Df=fill_in_surface.Df)
custom_preview = CustomPreview(Geometry=grid_mesh_2, Material=ColourSwatch(SwatchColor=RGB(204, 204, 204)))
data_3 = Data(fill_in_surface.Df)
mesh_2 = Mesh(grid_mesh_2)

# ---- group: calculate cut and fill
# difference
data_4 = Data(data)
data_5 = Data(data_3)
grid_compare = GridCompare(Df1=data_4, Df2=data_5)  # -> Cut, Fill, Balance, Df
panel = Panel(grid_compare.Cut)
panel_2 = Panel(grid_compare.Fill)
grid_mesh_3 = GridMesh(Df=grid_compare.Df)
custom_preview_2 = CustomPreview(Geometry=grid_mesh_3, Material=ColourSwatch(SwatchColor=RGB(204, 204, 204)))

# ---- group: calculate contours
# contours
mesh_3 = Mesh(mesh_2)
contour_interval = Slider(1, range=0..10)
contour = Contour(Shape=mesh_3, Point=Point(0, 0, 0), Direction=Vector(0, 0, 1), Distance=contour_interval)
custom_preview_3 = CustomPreview(Geometry=contour, Material=ColourSwatch(SwatchColor=RGB(0, 0, 0)))

# ----
# export
data_6 = Data(data_3)
export_xyz = ExportXYZ(Df=data_6, F="hills", W=Toggle(False))
