# Grasshopper definition topography-from-contours.gh (Grasshopper 1.0.7)
# Copyright: GNU General Public License 3.0
# plug-ins: Docofossor

# ---- group: create grid
# terrain from contours
# with docofosser
rows = Slider(150, range=0..500)
columns = Slider(340, range=0..1000)
resolution = Slider(5, range=0..10)
empty_grid = EmptyGrid(Nr=expr("x+1", rows), Nc=expr("x+1", columns), Cx=resolution, Cy=resolution)
data = Data(empty_grid)

# ---- group: fill on contours
data_2 = Data(empty_grid)
curve = Curve([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])
max_elevation = Slider(2, range=0..10)
slope = Slider(20, range=0..100)
closed = Closed(Curve=curve)  # -> Closed, Periodic
dispatch = Dispatch(List=curve, DispatchPattern=closed.Closed)  # -> ListA, ListB
fill_on_area = FillOnArea(Df=data_2, Crv=dispatch.ListA, Mxh=max_elevation, Sa=slope)  # -> Df, Vol
grid_mesh = GridMesh(Df=fill_on_area.Df)
custom_preview = CustomPreview(Geometry=grid_mesh, Material=ColourSwatch(SwatchColor=RGB(204, 204, 204)))
