# Grasshopper definition trigonometric-bench.gh (Grasshopper 1.0.7)
# Copyright: GNU General Public License 3.0

# ---- group: damped sine wave
# damped wave bench
domain = Slider(8, range=0..20)
frequency = Slider(2, range=0..10)
amplitude = Slider(2.5, range=0..10)
half_life = Slider(1.5, range=0..10)
range = Range(Domain=domain, Steps=10)
pi = Pi(Factor="2")
multiplication = Multiplication(A=range, B=pi)
multiplication_2 = Multiplication(A=range, B=half_life)
division = Division(A=multiplication, B=frequency)
sine = Sine(Value=division)
power = Power(A="0.5", B=multiplication_2)
multiplication_3 = Multiplication(A=sine, B=amplitude)
multiplication_4 = Multiplication(A=multiplication_3, B=power)
construct_point = ConstructPoint(XCoordinate=range, YCoordinate=0, ZCoordinate=multiplication_4)
interpolate = Interpolate(Vertices=construct_point, Degree=3, Periodic=False, KnotStyle=1)  # -> Curve, Length, Domain

# ---- group: extrude curve
curve = Curve(interpolate.Curve)
width = Slider(2, range=0..10)
depth = Slider(0.2, range=0..2)
height = Slider(0.6, range=0..4)
unit_y = UnitY(Factor=width)
unit_z = UnitZ(Factor=depth)
unit_z_2 = UnitZ(Factor=height)
extrude = Extrude(Base=curve, Direction=unit_y)
negative = Negative(Value=unit_z)
extrude_2 = Extrude(Base=extrude, Direction=negative)
move = Move(Geometry=extrude_2, Motion=unit_z_2)  # -> Geometry, Transform
custom_preview = CustomPreview(Geometry=move.Geometry, Material=ColourSwatch(SwatchColor=RGB(76, 76, 76)))

# ---- group: trim to ground plane
brep = Brep(move.Geometry)
plane_surface = PlaneSurface(Plane=PlaneXY(0, 0, 0), XSize=Domain(-10, 10), YSize=Domain(-10, 10))
solid_difference = SolidDifference(BrepsA=brep, BrepsB=plane_surface)
custom_preview_2 = CustomPreview(Geometry=solid_difference, Material=ColourSwatch(SwatchColor=RGB(76, 76, 76)))
