# Grasshopper definition trigonometric-landforms.gh (Grasshopper 1.0.7)

# ---- group: sine curve
# sine curve
frequency = Slider(6, range=0..10)
steps = Slider(10, range=0..10)
amplitude = Slider(0.5, range=0..1)
# landforms from sine curves
scale = Slider(25, range=0..100)
pi = Pi(Factor=frequency)
range = Range(Domain=pi, Steps=steps)
multiplication = Multiplication(A=range, B=amplitude)
sine = Sine(Value=multiplication)
construct_point = ConstructPoint(XCoordinate=range, YCoordinate=0, ZCoordinate=sine)
interpolate = Interpolate(Vertices=construct_point, Degree=3, Periodic=False, KnotStyle=1)  # -> Curve, Length, Domain
scale_2 = Scale(Geometry=interpolate.Curve, Center=Point(0, 0, 0), Factor=scale)  # -> Geometry, Transform
curve = Curve(scale_2.Geometry)

# ---- group: loft from series of sine curves
frequency_2 = Slider(4, range=0..10)
steps_2 = Slider(10, range=0..10)
amplitude_2 = Slider(0.66, range=0..1)
count = Slider(6, range=0..10)
distance = Slider(64, range=0..100)
scale_3 = Slider(25, range=0..100)
pi_2 = Pi(Factor=frequency_2)
series = Series(Start=0, Step=amplitude_2, Count=count)  # -> graft(Series)
range_2 = Range(Domain=pi_2, Steps=steps_2)
multiplication_2 = Multiplication(A=range_2, B=series)
sine_2 = Sine(Value=multiplication_2)
construct_point_2 = ConstructPoint(XCoordinate=range_2, YCoordinate=0, ZCoordinate=sine_2)
series_2 = Series(Start=0, Step=distance, Count=count)
interpolate_2 = Interpolate(Vertices=construct_point_2, Degree=3, Periodic=False, KnotStyle=1)  # -> Curve, Length, Domain
scale_4 = Scale(Geometry=interpolate_2.Curve, Center=Point(0, 0, 0), Factor=scale_3)  # -> Geometry, Transform
unit_y = UnitY(Factor=series_2)
curve_2 = Curve(flatten(scale_4.Geometry))
move = Move(Geometry=curve_2, Motion=unit_y)  # -> Geometry, Transform
loft = Loft(Curves=move.Geometry, Options={Adjust=False, Closed=False, LoftEnds=0, LoftSimp=0, LoftType=0, Rebuild=10, Refit=0.01})
custom_preview = CustomPreview(Geometry=loft, Material=ColourSwatch(SwatchColor=RGB(230, 230, 230)))

# ---- group: loft from random sine curves
# landforms from randomized sine curves
factor = Slider(4, range=0..10)
steps_3 = Slider(10, range=0..10)
count_2 = Slider(6, range=0..10)
seed = Slider(15, range=0..100)
distance_2 = Slider(64, range=0..100)
scale_5 = Slider(25, range=0..100)
pi_3 = Pi(Factor=factor)
random = Random(Range="0 To 2", Number=count_2, Seed=seed)  # -> graft(Random)
range_3 = Range(Domain=pi_3, Steps=steps_3)
multiplication_3 = Multiplication(A=range_3, B=random)
sine_3 = Sine(Value=multiplication_3)
construct_point_3 = ConstructPoint(XCoordinate=range_3, YCoordinate=0, ZCoordinate=sine_3)
series_3 = Series(Start=0, Step=distance_2, Count=count_2)
interpolate_3 = Interpolate(Vertices=construct_point_3, Degree=3, Periodic=False, KnotStyle=1)  # -> Curve, Length, Domain
scale_6 = Scale(Geometry=interpolate_3.Curve, Center=Point(0, 0, 0), Factor=scale_5)  # -> Geometry, Transform
unit_y_2 = UnitY(Factor=series_3)
curve_3 = Curve(flatten(scale_6.Geometry))
move_2 = Move(Geometry=curve_3, Motion=unit_y_2)  # -> Geometry, Transform
loft_2 = Loft(Curves=move_2.Geometry, Options={Adjust=False, Closed=False, LoftEnds=0, LoftSimp=0, LoftType=0, Rebuild=10, Refit=0.01})
custom_preview_2 = CustomPreview(Geometry=loft_2, Material=ColourSwatch(SwatchColor=RGB(230, 230, 230)))

# ---- group: contours
surface = Surface(loft)
interval = Slider(5, range=0..10)
contour = Contour(Shape=surface, Point=Point(0, 0, 0), Direction=Vector(0, 0, 1), Distance=interval)
custom_preview_3 = CustomPreview(Geometry=contour, Material=ColourSwatch(SwatchColor=RGB(38, 38, 38)))

surface_2 = Surface(loft_2)
interval_2 = Slider(5, range=0..10)
contour_2 = Contour(Shape=surface_2, Point=Point(0, 0, 0), Direction=Vector(0, 0, 1), Distance=interval_2)
custom_preview_4 = CustomPreview(Geometry=contour_2, Material=ColourSwatch(SwatchColor=RGB(38, 38, 38)))

# ---- group: cutting plane
surface_3 = Surface(loft)
water_depth = Slider(20, range=0..100)
bounding_box = BoundingBox(Content=surface_3, Plane=PlaneXY(0, 0, 0))  # -> Box, Box_2
brep_edges = BrepEdges(Brep=bounding_box.Box)  # -> Naked, Interior, NonManifold
split_list = SplitList(List=brep_edges.Interior, Index="4")  # -> ListA, ListB
unit_z = UnitZ(Factor=water_depth)
boundary_surfaces = BoundarySurfaces(Edges=split_list.ListA)
move_3 = Move(Geometry=boundary_surfaces, Motion=unit_z)  # -> Geometry, Transform
custom_preview_5 = CustomPreview(Geometry=move_3.Geometry, Material=ColourSwatch(SwatchColor=RGB(0, 0, 0)))

surface_4 = Surface(loft_2)
water_depth_2 = Slider(20, range=0..100)
bounding_box_2 = BoundingBox(Content=surface_4, Plane=PlaneXY(0, 0, 0))  # -> Box, Box_2
brep_edges_2 = BrepEdges(Brep=bounding_box_2.Box)  # -> Naked, Interior, NonManifold
split_list_2 = SplitList(List=brep_edges_2.Interior, Index="4")  # -> ListA, ListB
unit_z_2 = UnitZ(Factor=water_depth_2)
boundary_surfaces_2 = BoundarySurfaces(Edges=split_list_2.ListA)
move_4 = Move(Geometry=boundary_surfaces_2, Motion=unit_z_2)  # -> Geometry, Transform
custom_preview_6 = CustomPreview(Geometry=move_4.Geometry, Material=ColourSwatch(SwatchColor=RGB(0, 0, 0)))
