# Grasshopper definition cut-fill-display.gh (Grasshopper 1.0.7)
# Copyright: GNU General Public License 3.0

Z = Slider(-4, range=-10..6)

# ---- group: set low point
# cut and fill display
# geometry
# display point
point = Point(Point(50, 50, -15))

# ---- group: set high point
point_2 = Point(Point(50, 50, 15))

# ----
point_3 = Point(point_2)
size = Slider(1.5, range=0..2)
unit_z = UnitZ(Factor=Z)
move = Move(Geometry=point_3, Motion=unit_z)  # -> Geometry, Transform
sphere = Sphere(Base=move.Geometry, Radius=size)
custom_preview = CustomPreview(Geometry=sphere, Material=ColourSwatch(SwatchColor=RGB(0, 0, 0)))

# ---- group: set 3D curve
curve = Curve(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)

# ---- group: set 2D curve
curve_2 = Curve(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)

# ----
# display curve
curve_3 = Curve(curve_2)
Z_2 = Slider(-9.5, range=-15..15)
radius = Slider(0.5, range=0..1)
unit_z_2 = UnitZ(Factor=Z_2)
move_2 = Move(Geometry=curve_3, Motion=unit_z_2)  # -> Geometry, Transform
caps = ValueList({"None": 0, "Flat": 1, "Round": 2}, selected="Round")
pipe = Pipe(Curve=move_2.Geometry, Radius=radius, Caps=caps)
custom_preview_2 = CustomPreview(Geometry=pipe, Material=ColourSwatch(SwatchColor=RGB(0, 0, 0)))

# ----
# display curve width
curve_4 = Curve(move_2.Geometry)
steps = Slider(2, range=0..10)
length = Length(Curve=curve_4)
integer = Integer(expr("x-4", length))
range = Range(Domain=integer, Steps=steps)
bounds = Bounds(Numbers=range)
remap_numbers = RemapNumbers(Value=range, Source=bounds, Target=Domain(0, 1))  # -> Mapped, Clipped
graph_mapper = GraphMapper(
    remap_numbers.Mapped,
    x0=0,
    x1=1,
    y0=0,
    y1=1,
    Ox=0.5086957216,
    Oy=0.5166670084,
    Px=1,
    Py=0.3422577381,
    container_name="Parabola")
caps_2 = ValueList({"None": 0, "Flat": 1, "Round": 2}, selected="Round")
pipe_variable = PipeVariable(Curve=curve_4, Parameters=range, Radii=graph_mapper, Caps=caps_2)
custom_preview_3 = CustomPreview(Geometry=pipe_variable, Material=ColourSwatch(SwatchColor=RGB(0, 0, 0)))
