# Grasshopper definition voronoi-attractors.gh (Grasshopper 1.0.7)
# Copyright: GNU General Public License 3.0

number_slider = Slider(10, range=0..10)
rectangle = Rectangle(Plane=PlaneXY(0, 0, 0), XSize=number_slider, YSize=number_slider, Radius=0)  # -> Rectangle, Length
populate_2d = Populate2D(Region=rectangle.Rectangle, Count=100, Seed=1)
unit_z = UnitZ(Factor=Slider(0.5, range=0..1))
voronoi = Voronoi(Points=populate_2d, Boundary=rectangle.Rectangle, BruteForceOverride=False)
extrude = Extrude(Base=voronoi, Direction=unit_z)

# ---- group: create grid
# voronoi attractor
extents = Slider(10, range=0..10)
rectangle_2 = Rectangle(Plane=PlaneXY(0, 0, 0), XSize=extents, YSize=extents, Radius=0)  # -> Rectangle, Length
square = Square(Plane=PlaneXY(0, 0, 0), Size=1, ExtentX=extents, ExtentY=extents)  # -> Cells, Points
grid = Point(flatten(square.Points))
region = Rectangle(rectangle_2.Rectangle)

# ---- group: set multiple attractors
attractor = Point([Point(7.882769214, 7.610649904, 0), Point(1.969347895, 7.917421259, 0), Point(3.068064969, 1.941892976, 0)])

# ----
grid_2 = Point(grid)
closest_point = ClosestPoint(Point=grid_2, Cloud=attractor)  # -> ClosestPoint, CPIndex, Distance
bounds = Bounds(Numbers=closest_point.Distance)
remap_numbers = RemapNumbers(Value=closest_point.Distance, Source=bounds, Target="-2 To 2")  # -> Mapped, Clipped
unit_x = UnitX(Factor=remap_numbers.Mapped)
unit_y = UnitY(Factor=remap_numbers.Mapped)
move = Move(Geometry=grid_2, Motion=unit_x)  # -> Geometry, Transform
move_2 = Move(Geometry=move.Geometry, Motion=unit_y)  # -> Geometry, Transform
points = Point(move_2.Geometry)

# ---- group: create cells
points_2 = Point(points)
region_2 = Rectangle(region)
voronoi_2 = Voronoi(Points=points_2, Boundary=region_2, BruteForceOverride=False)

# ---- group: Attractor
point = Point([Point(2.935578694, 8.472659962, 0), Point(2.770458601, 2.231120429, 0), Point(8.285469722, 8.269942564, 0)])

# ----
extents_2 = Slider(10, range=0..10)
square_2 = Square(Plane=PlaneXY(0, 0, 0), Size=1, ExtentX=extents_2, ExtentY=extents_2)  # -> Cells, Points
point_2 = Point(flatten(square_2.Points))
closest_point_2 = ClosestPoint(Point=point_2, Cloud=point)  # -> ClosestPoint, CPIndex, Distance
unit_z_2 = UnitZ(Factor=closest_point_2.Distance)
move_3 = Move(Geometry=point_2, Motion=unit_z_2)  # -> Geometry, Transform
delaunay_mesh = DelaunayMesh(Points=move_3.Geometry, Plane=PlaneXY(0, 0, 0))
mesh_edges = MeshEdges(Mesh=delaunay_mesh)  # -> NakedEdges, InteriorEdges, NonManifoldEdges

# ---- group: extrude cells
distance = Number(closest_point.Distance)
bounds_2 = Bounds(Numbers=distance)
remap_numbers_2 = RemapNumbers(Value=distance, Source=bounds_2, Target="0.25 To 2")  # -> Mapped, Clipped
unit_z_3 = UnitZ(Factor=remap_numbers_2.Mapped)
extrude_2 = Extrude(Base=voronoi_2, Direction=unit_z_3)

# ----
populate_2d_2 = Populate2D(Region={Plane=PlaneXY(0, 0, 0), Size=Domain2(u=0..20, v=0..10)}, Count=100, Seed=1)
delaunay_edges = DelaunayEdges(Points=populate_2d_2, Plane=PlaneXY(0, 0, 0))  # -> Connectivity, Edges
