# Grasshopper definition voronoi-diagram.gh (Grasshopper 1.0.7)
# Copyright: GNU General Public License 3.0

# ----
# voronoi diagram
count = Slider(10, range=0..100)
seed = Slider(0, range=0..1000)
X = Slider(10, range=0..100)
Y = Slider(10, range=0..100)
rectangle = Rectangle(Plane=PlaneXY(0, 0, 0), XSize=X, YSize=Y, Radius=0)  # -> Rectangle, Length
populate_2d = Populate2D(Region=rectangle.Rectangle, Count=count, Seed=seed)
voronoi = Voronoi(Points=populate_2d, Boundary=rectangle.Rectangle, BruteForceOverride=False)
curve = Curve(voronoi)
