# Grasshopper definition wandering-noise.gh (Grasshopper 1.0.7)
# plug-ins: Nursery

# ---- group: particles wandering across noise field
# using nursery
point = Point(Point(0, 0, 0))
size = Slider(1, range=0..10)
extents = Slider(20, range=0..20)
distance = Slider(25, range=0..100)
attenuation = Slider(0.46, range=0..1)
noise = Slider(0.1, range=0..1)
rotation = Slider(2, range=0..10)
xy = Slider(10, range=0..10)
scale = Slider(3, range=0..10)
xy_2 = XYPlane(Origin=point)
createnoiseelement = CreateNoiseFieldElement(
    NoiseLocation=xy_2,
    Weight=Slider(2, range=0..10),
    MaxDistance=distance,
    Attenuation=attenuation,
    NoiseScale=noise,
    RotationScale=rotation,
    XY=True)
sqgrid = Square(Plane=xy_2, Size=size, ExtentX=extents, ExtentY=extents)  # -> Cells, flatten(Points)
construct_point = ConstructPoint(XCoordinate=xy, YCoordinate=xy, ZCoordinate=0)
createfield = CreateField(FieldElements=createnoiseelement)
steps = Slider(100, range=0..1000)
circle = Circle(Plane=construct_point, Radius=xy)
xy_3 = XYPlane(Origin=sqgrid.Points)
simfield = SimulateField(Planes=xy_3, Field=createfield, SimulationSteps=steps, Strength=Slider(2, range=0..10), Normalize=False)
point_in_curve = PointInCurve(Point=simfield, Curve=circle)  # -> Relationship, Point
inside = Panel("2")
equality = Equality(FirstNumber=point_in_curve.Relationship, SecondNumber=inside)  # -> Equality, Inequality
cull_pattern = CullPattern(List=simfield, CullPattern=equality.Equality)
prune_tree = PruneTree(Tree=cull_pattern, Minimum="2", Maximum=0)
interpolate = Interpolate(Vertices=prune_tree, Degree=3, Periodic=False, KnotStyle=1)  # -> Curve, Length, Domain
scale_2 = Scale(Geometry=interpolate.Curve, Center=Point(0, 0, 0), Factor=scale)  # -> Geometry, Transform
colour = ColourSwatch(SwatchColor=RGB(0, 0, 0))
custom_preview = CustomPreview(Geometry=scale_2.Geometry, Material=colour)

# ---- group: particle wandering across noise field
# wandering noise
# using nursery
point_2 = Point(Point(0, 0, 0))
distance_2 = Slider(50, range=0..100)
attenuation_2 = Slider(0.8, range=0..1)
noise_2 = Slider(0.3, range=0..1)
rotation_2 = Slider(5, range=0..10)
xy_4 = XYPlane(Origin=point_2)
createnoiseelement_2 = CreateNoiseFieldElement(
    NoiseLocation=xy_4,
    Weight=Slider(2, range=0..10),
    MaxDistance=distance_2,
    Attenuation=attenuation_2,
    NoiseScale=noise_2,
    RotationScale=rotation_2,
    XY=True)
createfield_2 = CreateField(FieldElements=createnoiseelement_2)
steps_2 = Slider(1000, range=0..1000)
xy_5 = XYPlane(Origin=Point(0, 0, 0))
simfield_2 = SimulateField(Planes=xy_5, Field=createfield_2, SimulationSteps=steps_2, Strength=Slider(2, range=0..10), Normalize=False)
interpolate_2 = Interpolate(Vertices=simfield_2, Degree=3, Periodic=False, KnotStyle=1)  # -> Curve, Length, Domain
colour_2 = ColourSwatch(SwatchColor=RGB(0, 0, 0))
custom_preview_2 = CustomPreview(Geometry=interpolate_2.Curve, Material=colour_2)
