# Grasshopper definition hello-python.gh (Grasshopper 1.0.7)
# Copyright: GNU General Public License 3.0
# plug-ins: Hops

# ---- group: hello world
# Hello Python
# cpython via hops
# python hello-python.py
# http://127.0.0.1:5000/hello
panel = Panel("World")
hops = Hops(
    Name=panel,
    CacheResultsInMemory=True,
    CacheSolveResults=True,
    RemoteDefinitionLocation="http://127.0.0.1:5000/hello",
    RemoteSolveVersion=(0, 1, 0),
    ShowInput_Enabled=False,
    ShowInput_Path=False,
    SynchronousSolve=True)
panel_2 = Panel(hops)

# ---- group: random integer
# numpy via hops
# python hello-numpy.py
# http://127.0.0.1:5000/randominteger
range = Slider(100, range=0..100)
hops_2 = Hops(
    Range=range,
    CacheResultsInMemory=False,
    CacheSolveResults=False,
    RemoteDefinitionLocation="http://127.0.0.1:5000/randominteger",
    RemoteSolveVersion=(0, 1, 0),
    ShowInput_Enabled=False,
    ShowInput_Path=False,
    SynchronousSolve=True)
panel_3 = Panel(hops_2)

# ---- group: random 1D array
# python hello-numpy.py
# http://127.0.0.1:5000/randomarray
range_2 = Slider(100, range=0..100)
hops_3 = Hops(
    Range=range_2,
    CacheResultsInMemory=False,
    CacheSolveResults=False,
    RemoteDefinitionLocation="http://127.0.0.1:5000/randomarray",
    RemoteSolveVersion=(0, 1, 0),
    ShowInput_Enabled=False,
    ShowInput_Path=False,
    SynchronousSolve=True)
panel_4 = Panel(hops_3)

# ---- group: random 2D array
# python hello-numpy.py
# http://127.0.0.1:5000/array2d
range_3 = Slider(25, range=0..100)

# ----
hops_4 = Hops(
    Range=range_3,
    CacheResultsInMemory=False,
    CacheSolveResults=False,
    RemoteDefinitionLocation="http://127.0.0.1:5000/array6",
    RemoteSolveVersion=(0, 1, 0),
    ShowInput_Enabled=False,
    ShowInput_Path=False,
    SynchronousSolve=True)

# ---- group: random 2D array (continued)
integer = Integer(hops_4)

# ---- group: array to points to mesh
res = Slider(25, range=0..100)
X = Slider(4, range=0..10)
Y = Slider(4, range=0..10)
integer_2 = Integer(integer)
# TODO
# add array x & y dimensions as hops input
# add random seed parameter
# TODO
# generate points from array in python
list = Panel(integer_2)
square = Square(Plane=PlaneXY(0, 0, 0), Size=res, ExtentX=expr("x-1", X), ExtentY=expr("x-1", Y))  # -> Cells, flatten(Points)
unit_z = UnitZ(Factor=integer_2)
move = Move(Geometry=square.Points, Motion=unit_z)  # -> Geometry, Transform
delaunay_mesh = DelaunayMesh(Points=move.Geometry, Plane=PlaneXY(0, 0, 0))
face_boundaries = FaceBoundaries(Mesh=delaunay_mesh)
