# Grasshopper definition random-planting.gh (Grasshopper 1.0.7)
# Copyright: GNU General Public License 3.0
# plug-ins: RhinoCodePluginGH

# ---- group: right click to set point cloud
# random planting
# set point clouds
point_cloud = PointCloud()

# ----
# scatter plants
boolean_toggle = BooleanToggle(False)
point_cloud_2 = PointCloud(point_cloud)
count = Slider(36, range=0..100)
deviation = Slider(2, range=0..10)
gaussian = Script(Run=boolean_toggle, Cloud=point_cloud_2, Count=count, Deviation=deviation)  # -> out, Clouds
# ---------- gaussian: Python ----------
"""Gaussian Planting"""
#! python 3

# requirements: numpy
import numpy as np
import rhinoscriptsyntax as rs
import scriptcontext as sc
sc.doc = Rhino.RhinoDoc.ActiveDoc

if Run:

    # instantiate random number generator
    rng = np.random.default_rng()

    # generate random x, y, and z values
    n = int(Count)
    mu = 0 # mean
    sigma = float(Deviation) # standard deviation
    x = rng.normal(mu, sigma, n)
    y = rng.normal(mu, sigma, n)
    z = np.zeros(n)

    # interweave coordinates
    coordinates = np.column_stack((x, y, z))

    # create points
    points = rs.AddPoints(coordinates)

    # loop
    Clouds = []
    for point in points:

        # set variables
        angle = rng.uniform(0.0, 360.0)
        s = rng.uniform(0.5, 1.0)
        scaling = (s, s, s)

        # transform
        transform = rs.CopyObject(Cloud, point)
        transform = rs.RotateObject(transform, point, angle)
        transform = rs.ScaleObject(transform, point, scaling)
        Clouds.append(transform)
# ---------- end gaussian ----------
point_cloud_3 = PointCloud(gaussian.Clouds)
