# Grasshopper definition hello-world.gh (Grasshopper 1.0.7)
# plug-ins: RhinoCodePluginGH

# ----
# rhinocode
# hello world
boolean_toggle = BooleanToggle(False)
hello_world = RhinoCode(Run=boolean_toggle)  # -> Text
# ---------- hello_world: Python ----------
if Run:
    Text = "Hello World"
# ---------- end hello_world ----------
panel = Panel(hello_world)
