# Grasshopper definition import-npy.gh (Grasshopper 1.0.7)
# Copyright: GNU General Public License 3.0
# plug-ins: RhinoCodePluginGH

# ----
# rhinocode
# import point cloud
file_path = FilePath("D:\generative-design\python\dev\data\miniregion\elevation_1ft.npy")
# generate terrain mesh
boolean_toggle = BooleanToggle(False)
import_numpy = Script(Path=file_path, Run=boolean_toggle)  # -> out, Points
# ---------- import_numpy: Python ----------
# requirements: numpy
import numpy as np
import rhinoscriptsyntax as rs

if Run:

    # load array
    xyz = np.load(Path)

    # generate point cloud
    Points = rs.AddPoints(xyz)
# ---------- end import_numpy ----------
point = Point(import_numpy.Points)

point_2 = Point(point)
delaunay_mesh = DelaunayMesh(Points=point_2, Plane=PlaneXY(0, 0, 0))
deconstruct_mesh = DeconstructMesh(Mesh=delaunay_mesh)  # -> Vertices, Faces, Colours, Normals
deconstruct = Deconstruct(Point=deconstruct_mesh.Vertices)  # -> XComponent, YComponent, ZComponent
bounds = Bounds(Numbers=deconstruct.ZComponent)
remap_numbers = RemapNumbers(Value=deconstruct.ZComponent, Source=bounds, Target=Domain(0, 1))  # -> Mapped, Clipped
gradient = Gradient(
    LowerLimit=0,
    UpperLimit=1,
    Parameter=remap_numbers.Mapped,
    stops=[0: RGB(55, 11, 65), 0.125: RGB(27, 30, 59), 0.25: RGB(22, 83, 76), 0.375: RGB(68, 119, 49), 0.5: RGB(161, 121, 74), 0.625: RGB(212, 132, 169), 0.75: RGB(198, 180, 238), 0.875: RGB(203, 232, 240), 1: RGB(255, 255, 255)])
construct_mesh = ConstructMesh(Vertices=deconstruct_mesh.Vertices, Faces=deconstruct_mesh.Faces, Colours=gradient)
mesh = Mesh(construct_mesh)
