# Grasshopper definition machina-ur10e-simple-handwriting.gh (Grasshopper 1.0.7)
# plug-ins: Machina

# ---- group: create robot system
# using machina
panel = Panel("UR")
# system
panel_2 = Panel("simple_handwriting")
# UR10e
# real-time control
# simple handwriting
createrobot = CreateRobot(Name=panel_2, Brand=panel)

# ---- group: set initial speed
speed = Slider(25, range=0..100)
speedto = SpeedTo(Speed=speed, Relative=False)

# ---- group: set precision
precision = Slider(2, range=0..10)
precisionto = PrecisionTo(Radius=precision, Relative=False)

# ---- group: generate path
# set curve
curve = Curve(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)
program_zero = Panel("500,0,-60")
count = Slider(1000, range=0..10000)
xy_plane = XYPlane(Origin=Point(0, 0, 0))
vector_2pt = Vector2Pt(PointA=xy_plane, PointB=program_zero, Unitize=False)  # -> Vector, Length
move = Move(Geometry=curve, Motion=vector_2pt.Vector)  # -> Geometry, Transform
divide_curve = DivideCurve(Curve=move.Geometry, Count=count, Kinks=False)  # -> Points, Tangents, Parameters
division = Division(A=count, B="2")
split_list = SplitList(List=divide_curve.Points, Index=expr("x+1", division))  # -> ListA, ListB
point = Point(split_list.ListA)
pl = ConstructPlane(Origin=point, XAxis="-1,0,0", YAxis=Vector(0, 1, 0))
transformto = TransformTo(Plane=pl, Relative=False)  # -> flatten(Action)

# ---- group: wait
time = Slider(500, range=0..5000)
wait = Wait(Time=time)

# ---- group: set speed
speed_2 = Slider(50, range=0..100)
speedto_2 = SpeedTo(Speed=speed_2, Relative=False)

# ---- group: move home
# commands
# set home position
# using joint rotation angles
# in degrees
panel_3 = Panel("0")
axesto = AxesTo(A1=panel_3, A2="-90", A3="-90", A4="-90", A5="90", A6=panel_3, Relative=False)

# set home position
# using joint rotation angles
# in degrees
panel_4 = Panel("0")
axesto_2 = AxesTo(A1=panel_4, A2="-90", A3="-90", A4="-90", A5="90", A6=panel_4, Relative=False)

# ----
# MoveJ
motionmode = MotionMode(MotionMode=1)

# ---- group: merge actions
# program
merge = Merge(
    Data1=axesto,
    Data2=motionmode,
    Data3=speedto,
    Data4=precisionto,
    Data5=transformto,
    Data6=wait,
    Data7=speedto_2,
    Data8=axesto_2)
panel_5 = Panel(merge)

# ----
# workspace
panel_6 = Panel("400,600,0")
rectangle_2pt = Rectangle2Pt(Plane=PlaneXY(0, 0, 0), PointA=panel_6, PointB="1300,-600,0", Radius=0)  # -> Rectangle, Length
custom_preview = CustomPreview(Geometry=rectangle_2pt.Rectangle, Material=ColourSwatch(SwatchColor=RGB(255, 255, 255)))

# ----
# paper
panel_7 = Panel("400,225,0")
rectangle_2pt_2 = Rectangle2Pt(Plane=PlaneXY(0, 0, 0), PointA=panel_7, PointB="1000,-225,0", Radius=0)  # -> Rectangle, Length
custom_preview_2 = CustomPreview(Geometry=rectangle_2pt_2.Rectangle, Material=ColourSwatch(SwatchColor=RGB(209, 209, 209)))

# ---- group: generate program
compileprogram = CompileProgram(Robot=createrobot, Actions=merge, InLineTargets=Toggle(True), Comments=Toggle(True))

# ---- group: save program
# output
# stream
c_script = CSharpScript()  # -> out, here
# ---------- c_script: C# usings ----------
using System.IO;
# ---------- c_script: C# ----------
    string targetFolder = "";

    GH_Document gh_d = owner.OnPingDocument();
    if (gh_d.IsFilePathDefined)
    {
      string ghFilePath = gh_d.FilePath;
      targetFolder = Path.GetDirectoryName(ghFilePath);
    }
    else
    {
      Print("No local folder found, please save your file locally.");
    }

    here = targetFolder;
# ---------- end c_script ----------
saveprogram = SaveProgram(Robot=createrobot, RobotProgram=compileprogram, Path=c_script.here)
panel_8 = Panel(saveprogram)

# ---- group: stream program via machina bridge
connect_to_bridge = BooleanToggle(False)
send_program = Button()
connect = Connect(URL="ws://127.0.0.1:6999/Bridge", Name="Grasshopper", Connect=connect_to_bridge)  # -> Status, Bridge
send = Send(Bridge=connect.Bridge, Actions=merge, Send=send_program)  # -> Sent, Instructions
listen = Listen(Bridge=connect.Bridge, Autoupdate=True, Interval=66)
panel_9 = Panel(connect.Status)
actionexecuted = ActionExecuted(BridgeMessage=listen)  # -> LastAction, ActionTCP, ActionAxes, ActionExternalAxes, PendingActions, PendingActionsOnDevice
panel_10 = Panel(send.Sent)
panel_11 = Panel(send.Instructions)
panel_12 = Panel(actionexecuted.PendingActions)
panel_13 = Panel(actionexecuted.LastAction)
data_recorder = DataRecorder(actionexecuted.ActionTCP, DataLimit=-10, RecordData=True)
plane = Plane(data_recorder)

# ---- group: print program
displayprogram = DisplayProgram(RobotProgram=compileprogram)
panel_14 = Panel(displayprogram)
