# Grasshopper definition machina-ur5e-noise-field.gh (Grasshopper 1.0.7)
# plug-ins: Machina, Heteroptera, Pufferfish, Noise 4D, Anemone

panel = Panel("-75")

# ---- group: create robot system
# using machina
panel_2 = Panel("UR")
# system
panel_3 = Panel("noise_field")
# UR5e
# real-time control
# noise field
createrobot = CreateRobot(Name=panel_3, Brand=panel_2)

# ---- group: grid
# particles in noise field
cell_size = Slider(3, range=0..10)
X = Slider(10, range=0..100)
Y = Slider(10, range=0..100)
square = Square(Plane=PlaneXY(0, 0, 0), Size=cell_size, ExtentX=X, ExtentY=Y)  # -> Cells, Points
bounding_rectangle = BoundingRectangle(Geometry=flatten(square.Cells), Plane=PlaneXY(0, 0, 0), Axis=0, Slide=0, Union=True)  # -> Bounding, DimensionX, DimensionY
polygon_center = PolygonCenter(Polyline=square.Cells)  # -> CenterV, CenterE, CenterA
grid_points = Point(flatten(polygon_center.CenterA))
curve = Curve(bounding_rectangle.Bounding)

# ---- group: vectors from noise
time = Slider(0.8, range=0..10)
scale = Slider(0.031, range=0..0.5)
grid_point = Point(flatten(grid_points))
time_2 = Slider(0.4, range=0..10)
scale_2 = Slider(0.025, range=0..0.5)
perlinnoise = PerlinNoise(Values=grid_point, Time=time_2, Scale=scale_2)
perlinnoise_2 = PerlinNoise(Values=grid_point, Time=time, Scale=scale)
unit_x = UnitX(Factor=perlinnoise)
unit_y = UnitY(Factor=perlinnoise_2)
move = Move(Geometry=grid_point, Motion=unit_x)  # -> Geometry, Transform
move_2 = Move(Geometry=move.Geometry, Motion=unit_y)  # -> Geometry, Transform
vector_2pt = Vector2Pt(PointA=grid_point, PointB=move_2.Geometry, Unitize=False)  # -> Vector, Length
line = Line(StartPoint=grid_point, EndPoint=move_2.Geometry)
insert_items = InsertItems(List=graft(grid_point), Item=graft(move_2.Geometry), Indices="1", Wrap=True)
translated_points = Point(insert_items)
vector = Vector(vector_2pt.Vector)

# ---- group: particles move across noise field
iterations = Slider(50, range=0..100)
translated_points_2 = Point(translated_points)
# commands
amplitude = Slider(0.12, range=0..1)
vector_2 = Vector(flatten(vector))
grid_points_2 = Point(flatten(grid_points))
loop_start = LoopStart(Repeat=iterations, Trigger=Toggle(True), Data=translated_points_2)  # -> port, Counter, Data
list_item = ListItem(List=loop_start.Data, Index=loop_start.Counter, Wrap=True)  # -> Item, Item1
closest_point = ClosestPoint(Point=flatten(list_item.Item), Cloud=grid_points_2)  # -> ClosestPoint, CPIndex, Distance
vector_2pt_2 = Vector2Pt(PointA=list_item.Item, PointB=list_item.Item1, Unitize=False)  # -> flatten(Vector), Length
list_item_2 = ListItem(List=vector_2, Index=closest_point.CPIndex, Wrap=True)
addition = Addition(A=vector_2pt_2.Vector, B=list_item_2)
amplitude_2 = Amplitude(Vector=addition, Amplitude=amplitude)
move_3 = Move(Geometry=flatten(list_item.Item1), Motion=amplitude_2)  # -> Geometry, Transform
addition_2 = Addition(A=loop_start.Counter, B="2")
insert_items_2 = InsertItems(List=loop_start.Data, Item=graft(move_3.Geometry), Indices=addition_2, Wrap=True)
loop_end = LoopEnd(port=loop_start.port, Exit=False, Data=insert_items_2, TimeOutVal=0, pausedState=False, state="Constant output")
interpolate = Interpolate(Vertices=loop_end, Degree=3, Periodic=False, KnotStyle=1)  # -> Curve, Length, Domain
curve_2 = Curve(curve)
trim_with_region = TrimWithRegion(Curve=interpolate.Curve, Region=curve_2)  # -> Inside, Outside
curve_3 = Curve(flatten(trim_with_region.Inside))

# ---- group: set initial speed
speed = Slider(36, range=0..100)
speedto = SpeedTo(Speed=speed, Relative=False)

# ---- group: wait
time_3 = Slider(1000, range=0..5000)
wait = Wait(Time=time_3)

# ---- group: set speed
speed_2 = Slider(50, range=0..100)
speedto_2 = SpeedTo(Speed=speed_2, Relative=False)

# ----
# brush height variation
panel_4 = Panel("-10 To 10")

# ---- group: move home
# set home position
# using joint rotation angles
# in degrees
panel_5 = Panel("0")
axesto = AxesTo(A1=panel_5, A2="-90", A3="-90", A4="-90", A5="90", A6=panel_5, Relative=False)

# ----
# MoveJ
motionmode = MotionMode(MotionMode=1)

# ---- group: generate path / generate waypoints
initial_brush_height = Slider(-130, range=-300..300)
distance = Slider(25, range=0..100)
unit_z = UnitZ(Factor=initial_brush_height)

# ---- group: generate path
engage_retract = Slider(50, range=0..100)

# ----
unit_z_2 = UnitZ(Factor=engage_retract)

# ----
# workspace
panel_6 = Panel("400,200,0")
rectangle_2pt = Rectangle2Pt(Plane=PlaneXY(0, 0, 0), PointA=panel_6, PointB="850,-200,0", Radius=0)  # -> Rectangle, Length
rectangle = Rectangle(Plane=PlaneXY(0, 0, 0), XSize="400", YSize="400", Radius=0)  # -> Rectangle, Length
polygon_center_2 = PolygonCenter(Polyline=rectangle_2pt.Rectangle)  # -> CenterV, CenterE, CenterA
polygon_center_3 = PolygonCenter(Polyline=rectangle.Rectangle)  # -> CenterV, CenterE, CenterA
vector_2pt_3 = Vector2Pt(PointA=polygon_center_3.CenterA, PointB=polygon_center_2.CenterA, Unitize=False)  # -> Vector, Length
move_4 = Move(Geometry=rectangle.Rectangle, Motion=vector_2pt_3.Vector)  # -> Geometry, Transform
rotate = Rotate(Geometry=rectangle_2pt.Rectangle, Angle=degrees("-90"), Plane=PlaneXY(0, 0, 0))  # -> Geometry, Transform
custom_preview = CustomPreview(Geometry=rotate.Geometry, Material=ColourSwatch(SwatchColor=RGB(255, 255, 255)))
centroid = Point(polygon_center_2.CenterA)

rotate_2 = Rotate(Geometry=move_4.Geometry, Angle=degrees("-90"), Plane=PlaneXY(0, 0, 0))  # -> Geometry, Transform

custom_preview_2 = CustomPreview(Geometry=rotate_2.Geometry, Material=ColourSwatch(SwatchColor=RGB(209, 209, 209)))
paper = Curve(rotate_2.Geometry)

# ---- group: inkwell
paper_2 = Curve(rotate_2.Geometry)
discontinuity = Discontinuity(Curve=paper_2, Level=1)  # -> Points, Parameters
list_item_3 = ListItem(List=discontinuity.Points, Index=0, Wrap=True)
ink_well = Point(list_item_3)

# ---- group: generate path (continued)
ink_well_2 = Point(ink_well)
move_5 = Move(Geometry=ink_well_2, Motion=unit_z)  # -> Geometry, Transform

# ---- group: transform to paper space
curve_4 = Curve(curve_3)
centroid_2 = Point(centroid)
scale_3 = Slider(13, range=0..25)
center = Center(Geometry=curve_4, forall=True, referenceAll=0)  # -> Center, Dimension
vector_2pt_4 = Vector2Pt(PointA=center.Center, PointB=centroid_2, Unitize=False)  # -> Vector, Length
move_6 = Move(Geometry=curve_4, Motion=vector_2pt_4.Vector)  # -> Geometry, Transform
scale_4 = Scale(Geometry=move_6.Geometry, Center=centroid_2, Factor=scale_3)  # -> Geometry, Transform
count = Slider(8, range=0..10)
rebuild_curve = RebuildCurve(Curve=scale_4.Geometry, Count=count, Tangents=False)
rotate_3 = Rotate(Geometry=rebuild_curve, Angle=degrees("-90"), Plane=PlaneXY(0, 0, 0))  # -> Geometry, Transform
colour = ColourSwatch(SwatchColor=RGB(0, 0, 0))
custom_preview_3 = CustomPreview(Geometry=rotate_3.Geometry, Material=colour)
curve_5 = Curve(rotate_3.Geometry)

# ---- group: generate path / generate waypoints (continued)
curve_6 = Curve(curve_5)
list_length = ListLength(List=curve_6)
move_7 = Move(Geometry=curve_6, Motion=unit_z)  # -> Geometry, Transform

# ----
random = Random(Range=panel_4, Number=list_length, Seed=2)

# ---- group: generate path / generate waypoints (continued)
unit_z_3 = UnitZ(Factor=random)
move_8 = Move(Geometry=move_7.Geometry, Motion=unit_z_3)  # -> Geometry, Transform
divide_distance = DivideDistance(Curve=move_8.Geometry, Distance=distance)  # -> Points, Tangents, Parameters

# ---- group: generate path / engage with start points
unit_z_4 = UnitZ(Factor=engage_retract)
list_item_4 = ListItem(List=divide_distance.Points, Index="0", Wrap=True)
move_9 = Move(Geometry=list_item_4, Motion=unit_z_4)  # -> Geometry, Transform
insert_items_3 = InsertItems(List=divide_distance.Points, Item=move_9.Geometry, Indices="0", Wrap=True)

# ---- group: generate path / retract from end points
list_length_2 = ListLength(List=insert_items_3)
unit_z_5 = UnitZ(Factor=engage_retract)
list_item_5 = ListItem(List=insert_items_3, Index=expr("x-1", list_length_2), Wrap=True)
move_10 = Move(Geometry=list_item_5, Motion=unit_z_5)  # -> Geometry, Transform
insert_items_4 = InsertItems(List=insert_items_3, Item=move_10.Geometry, Indices=list_length_2, Wrap=True)

# ---- group: save program
# output
c_script = CSharpScript()  # -> out, here
# ---------- c_script: C# usings ----------
using System.IO;
# ---------- c_script: C# ----------
    string targetFolder = "";

    GH_Document gh_d = owner.OnPingDocument();
    if (gh_d.IsFilePathDefined)
    {
      string ghFilePath = gh_d.FilePath;
      targetFolder = Path.GetDirectoryName(ghFilePath);
    }
    else
    {
      Print("No local folder found, please save your file locally.");
    }

    here = targetFolder;
# ---------- end c_script ----------

# ---- group: generate path / dip in inkwell
ink_well_3 = Point(move_5.Geometry)
vector_2pt_5 = Vector2Pt(PointA=move_10.Geometry, PointB=ink_well_3, Unitize=False)  # -> Vector, Length
unit_z_6 = UnitZ(Factor=engage_retract)
move_11 = Move(Geometry=move_10.Geometry, Motion=vector_2pt_5.Vector)  # -> Geometry, Transform
negative = Negative(Value=unit_z_2)
move_12 = Move(Geometry=move_11.Geometry, Motion=unit_z_6)  # -> Geometry, Transform
insert_items_5 = InsertItems(List=insert_items_4, Item=move_12.Geometry, Indices=expr("x+1", list_length_2), Wrap=True)

# ----
move_13 = Move(Geometry=move_12.Geometry, Motion=negative)  # -> Geometry, Transform

# ---- group: generate path / dip in inkwell (continued)
move_14 = Move(Geometry=move_13.Geometry, Motion=unit_z_2)  # -> Geometry, Transform
insert_items_6 = InsertItems(List=insert_items_5, Item=move_13.Geometry, Indices=expr("x+2", list_length_2), Wrap=True)
insert_items_7 = InsertItems(List=insert_items_6, Item=move_14.Geometry, Indices=expr("x+3", list_length_2), Wrap=True)

# ---- group: generate path / transform to planes
construct_plane = ConstructPlane(Origin=flatten(insert_items_7), XAxis="-1,0,0", YAxis=Vector(0, 1, 0))
transformto = TransformTo(Plane=construct_plane, Relative=False)  # -> flatten(Action)

# ---- group: merge actions
# program
merge = Merge(Data1=motionmode, Data2=speedto, Data3=transformto)
panel_7 = Panel(merge)

# ---- group: generate program
compileprogram = CompileProgram(Robot=createrobot, Actions=merge, InLineTargets=Toggle(True), Comments=Toggle(True))

# ---- group: save program (continued)
saveprogram = SaveProgram(Robot=createrobot, RobotProgram=compileprogram, Path=c_script.here)
panel_8 = Panel(saveprogram)

# ---- group: print program
displayprogram = DisplayProgram(RobotProgram=compileprogram)
panel_9 = Panel(displayprogram)
