# Grasshopper definition hex-gradient.gh (Grasshopper 1.0.7)
# plug-ins: Noise 4D

# ----
# workspace
extent = Slider(500, range=0..1000)
division = Division(A=extent, B="2")
negative = Negative(Value=division)
construct_point = ConstructPoint(XCoordinate=negative, YCoordinate=negative, ZCoordinate=0)
rectangle = Rectangle(Plane=construct_point, XSize=extent, YSize=extent, Radius=0)  # -> Rectangle, Length
rectangle_2 = Rectangle(rectangle.Rectangle)

# ----
# gradient of hexagons
cellsize = Slider(24, range=0..30)
extent_2 = Slider(282, range=0..1000)
offset = Slider(5, range=0..10)
time = Slider(8, range=0..100)
scale = Slider(0.07, range=0..1)
extent_3 = Slider(235, range=0..1000)
threshold = Slider(0.4, range=0..1)
division_2 = Division(A=extent_2, B=cellsize)
division_3 = Division(A=extent_3, B=cellsize)
negative_2 = Negative(Value=offset)
point = Point(Point(-200.3750329, -200.3599715, 0))
hexagonal = Hexagonal(Plane=point, Size=cellsize, ExtentX=division_2, ExtentY=division_3)  # -> Cells, Points
offset_curve = OffsetCurve(Curve=hexagonal.Cells, Distance=negative_2, Plane=PlaneXY(0, 0, 0), Corners=1)  # -> flatten(Curve)
# using noise4d
perlinnoise = PerlinNoise(Values=flatten(hexagonal.Points), Time=time, Scale=scale)
bounds = Bounds(Numbers=perlinnoise)
remap_numbers = RemapNumbers(Value=perlinnoise, Source=bounds, Target=Domain(0, 1))  # -> Mapped, Clipped
larger_than = LargerThan(FirstNumber=remap_numbers.Mapped, SecondNumber=threshold)  # -> LargerThan, OrEqualTo
cull_pattern = CullPattern(List=offset_curve, CullPattern=larger_than.LargerThan)
