# Grasshopper definition noise-field-500mm.gh (Grasshopper 1.0.7)
# plug-ins: Heteroptera, Pufferfish, Noise 4D, Anemone

# ---- group: grid
# noise
# particles in noise field
cell_size = Slider(3, range=0..10)
X = Slider(9, range=0..100)
Y = Slider(9, range=0..100)
square = Square(Plane=PlaneXY(0, 0, 0), Size=cell_size, ExtentX=X, ExtentY=Y)  # -> Cells, Points
bounding_rectangle = BoundingRectangle(Geometry=flatten(square.Cells), Plane=PlaneXY(0, 0, 0), Axis=0, Slide=0, Union=True)  # -> Bounding, DimensionX, DimensionY
polygon_center = PolygonCenter(Polyline=square.Cells)  # -> CenterV, CenterE, CenterA
grid_points = Point(flatten(polygon_center.CenterA))
curve = Curve(bounding_rectangle.Bounding)

# ---- group: vectors from noise
time = Slider(1.2, range=0..10)
scale = Slider(0.032, range=0..0.5)
grid_point = Point(flatten(grid_points))
time_2 = Slider(1.4, range=0..10)
scale_2 = Slider(0.018, range=0..0.5)
perlinnoise = PerlinNoise(Values=grid_point, Time=time_2, Scale=scale_2)
perlinnoise_2 = PerlinNoise(Values=grid_point, Time=time, Scale=scale)
unit_x = UnitX(Factor=perlinnoise)
unit_y = UnitY(Factor=perlinnoise_2)
move = Move(Geometry=grid_point, Motion=unit_x)  # -> Geometry, Transform
move_2 = Move(Geometry=move.Geometry, Motion=unit_y)  # -> Geometry, Transform
vector_2pt = Vector2Pt(PointA=grid_point, PointB=move_2.Geometry, Unitize=False)  # -> Vector, Length
line = Line(StartPoint=grid_point, EndPoint=move_2.Geometry)
insert_items = InsertItems(List=graft(grid_point), Item=graft(move_2.Geometry), Indices="1", Wrap=True)
translated_points = Point(insert_items)
vector = Vector(vector_2pt.Vector)

# ---- group: particles move across noise field
iterations = Slider(75, range=0..100)
translated_points_2 = Point(translated_points)
vector_2 = Vector(flatten(vector))
grid_points_2 = Point(flatten(grid_points))
amplitude = Slider(0.12, range=0..1)
loop_start = LoopStart(Repeat=iterations, Trigger=Toggle(True), Data=translated_points_2)  # -> port, Counter, Data
list_item = ListItem(List=loop_start.Data, Index=loop_start.Counter, Wrap=True)  # -> Item, Item1
closest_point = ClosestPoint(Point=flatten(list_item.Item), Cloud=grid_points_2)  # -> ClosestPoint, CPIndex, Distance
vector_2pt_2 = Vector2Pt(PointA=list_item.Item, PointB=list_item.Item1, Unitize=False)  # -> flatten(Vector), Length
list_item_2 = ListItem(List=vector_2, Index=closest_point.CPIndex, Wrap=True)
addition = Addition(A=vector_2pt_2.Vector, B=list_item_2)
amplitude_2 = Amplitude(Vector=addition, Amplitude=amplitude)
move_3 = Move(Geometry=flatten(list_item.Item1), Motion=amplitude_2)  # -> Geometry, Transform
addition_2 = Addition(A=loop_start.Counter, B="2")
insert_items_2 = InsertItems(List=loop_start.Data, Item=graft(move_3.Geometry), Indices=addition_2, Wrap=True)
loop_end = LoopEnd(port=loop_start.port, Exit=False, Data=insert_items_2, TimeOutVal=0, pausedState=False, state="Constant output")
interpolate = Interpolate(Vertices=loop_end, Degree=3, Periodic=False, KnotStyle=1)  # -> Curve, Length, Domain
curve_2 = Curve(curve)
trim_with_region = TrimWithRegion(Curve=interpolate.Curve, Region=curve_2)  # -> Inside, Outside
curve_3 = Curve(flatten(trim_with_region.Inside))

# ---- group: transform to paper space
# using heteroptera
curve_4 = Curve(curve_3)
scale_3 = Slider(15, range=0..25)
origin = Point(Point(0, 0, 0))
center = Center(Geometry=curve_4, forall=True, referenceAll=0)  # -> Center, Dimension
vector_2pt_3 = Vector2Pt(PointA=center.Center, PointB=origin, Unitize=False)  # -> Vector, Length
move_4 = Move(Geometry=curve_4, Motion=vector_2pt_3.Vector)  # -> Geometry, Transform
scale_4 = Scale(Geometry=move_4.Geometry, Center=origin, Factor=scale_3)  # -> Geometry, Transform
count = Slider(8, range=0..10)
rebuild_curve = RebuildCurve(Curve=scale_4.Geometry, Count=count, Tangents=False)
colour = ColourSwatch(SwatchColor=RGB(0, 0, 0))
custom_preview = CustomPreview(Geometry=rebuild_curve, Material=colour)
curve_5 = Curve(rebuild_curve)

# ----
# workspace
extent = Slider(500, range=0..1000)
division = Division(A=extent, B="2")
negative = Negative(Value=division)
construct_point = ConstructPoint(XCoordinate=negative, YCoordinate=negative, ZCoordinate=0)
rectangle = Rectangle(Plane=construct_point, XSize=extent, YSize=extent, Radius=0)  # -> Rectangle, Length
rectangle_2 = Rectangle(rectangle.Rectangle)
