# Grasshopper definition text-sampler-path.gh (Grasshopper 1.0.7)

# ---- group: image sampler
# image sampler
xy = Slider(50, range=0..100)
square = Square(Plane=PlaneXY(0, 0, 0), Size=1, ExtentX=xy, ExtentY=xy)  # -> Cells, flatten(Points)
image_sampler = ImageSampler(square.Points, Filter="Value", Interpolate=False, Umax=50, Umin=0, Vmax=50, Vmin=0, Wrap=1)
smaller_than = SmallerThan(FirstNumber=image_sampler, SecondNumber="1")  # -> SmallerThan, OrEqualTo
dispatch = Dispatch(List=square.Points, DispatchPattern=smaller_than.SmallerThan)  # -> ListA, ListB
dispatch_2 = Dispatch(List=image_sampler, DispatchPattern=smaller_than.SmallerThan)  # -> ListA, ListB
number = Number(dispatch_2.ListA)
point = Point(dispatch.ListA)

# ---- group: filter by distance
# filter
point_2 = Point(point)
distance = Slider(2, range=0..10)
polyline = PolyLine(Vertices=point_2, Closed=False)
explode = Explode(Curve=polyline, Recursive=True)  # -> Segments, Vertices
end_points = EndPoints(Curve=explode.Segments)  # -> Start, End
distance_2 = Distance(PointA=end_points.Start, PointB=end_points.End)
larger_than = LargerThan(FirstNumber=distance_2, SecondNumber=distance)  # -> LargerThan, OrEqualTo
dispatch_3 = Dispatch(List=explode.Segments, DispatchPattern=larger_than.LargerThan)  # -> ListA, ListB
line = Line(dispatch_3.ListB)

# ---- group: retract over long distances
# path
line_2 = Line(line)
Z = Slider(6, range=0..100)
join_curves = JoinCurves(Curves=line_2, Preserve=False)
end_points_2 = EndPoints(Curve=join_curves)  # -> Start, End
unit_z = UnitZ(Factor=Z)
move = Move(Geometry=end_points_2.End, Motion=unit_z)  # -> Geometry, Transform
panel = Panel("""0
1
2""")
weave = Weave(Pattern=panel, Stream0=end_points_2.Start, Stream1=end_points_2.End, Stream2=move.Geometry, NullGaps=False)
point_3 = Point(weave)

# ---- group: simulation
# simulation
point_4 = Point(point_3)
polyline_2 = PolyLine(Vertices=point_4, Closed=False)
explode_2 = Explode(Curve=polyline_2, Recursive=True)  # -> Segments, Vertices
list_item = ListItem(List=flatten(explode_2.Segments), Index=Slider(1, range=0..101), Wrap=True)
custom_preview = CustomPreview(Geometry=list_item, Material=ColourSwatch(SwatchColor=RGB(0, 0, 0)))
