# Grasshopper definition machina-brick-laying-2.gh (Grasshopper 1.0.8)
# plug-ins: Machina

# ---- group: set pick
# operations
# input
brep = Brep(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)

# ---- group: set place
# pick
brep_2 = Brep([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])

# ---- group: wait
milliseconds = Panel("1000")
wait = Wait(Time=milliseconds)
action = Data(wait)

# ---- group: close gripper
close_gripper = Panel("""rq_set_pos_spd_for(255, 51, 26, "1")
  rq_wait_pos_spe_for_request(255, 51, 26, "1")
  rq_go_to("1")
  rq_wait("1")""")
customcode = CustomCode(Statement=close_gripper, IsDeclaration=False)
action_2 = Data(customcode)

# ---- group: wait
milliseconds_2 = Panel("1000")
wait_2 = Wait(Time=milliseconds_2)
action_3 = Data(wait_2)

milliseconds_3 = Panel("1000")
wait_3 = Wait(Time=milliseconds_3)
action_4 = Data(wait_3)

# ---- group: open gripper
open_gripper = Panel("""rq_set_pos_spd_for(0, 51, 26, "1")
  rq_wait_pos_spe_for_request(0, 51, 26, "1")
  rq_go_to("1")
  rq_wait("1")""")
customcode_2 = CustomCode(Statement=open_gripper, IsDeclaration=False)
action_5 = Data(customcode_2)

# ---- group: wait
milliseconds_4 = Panel("1000")
wait_4 = Wait(Time=milliseconds_4)
action_6 = Data(wait_4)

# ---- group: find coordinates
# UR5e
volume = Volume(Geometry=brep)  # -> Volume, Centroid
stock = Point(volume.Centroid)

# ---- group: move to stock
stock_2 = Point(stock)
transformto = TransformTo(Plane=stock_2, Relative=False)
action_7 = Data(transformto)

# ---- group: find coordinates
volume_2 = Volume(Geometry=brep_2)  # -> Volume, Centroid
point = Point(volume_2.Centroid)

# ---- group: find coordinates above stock
stock_3 = Point(stock)
point_2 = Point(volume_2.Centroid)
panel = Panel("3")
deconstruct = Deconstruct(Point=stock_3)  # -> XComponent, YComponent, ZComponent
deconstruct_2 = Deconstruct(Point=point_2)  # -> XComponent, YComponent, ZComponent
unit_z = UnitZ(Factor=panel)
construct_point = ConstructPoint(XCoordinate=deconstruct.XComponent, YCoordinate=deconstruct.YComponent, ZCoordinate=deconstruct_2.ZComponent)
move = Move(Geometry=construct_point, Motion=unit_z)  # -> Geometry, Transform
above_stock = Point(move.Geometry)

# ---- group: move above stock
above_stock_2 = Point(move.Geometry)
transformto_2 = TransformTo(Plane=above_stock_2, Relative=False)
action_8 = Data(transformto_2)

# place
above_stock_3 = Point(above_stock)
transformto_3 = TransformTo(Plane=above_stock_3, Relative=False)
action_9 = Data(transformto_3)

# ---- group: move above position
point_3 = Point(point)
unit_z_2 = UnitZ(Factor="3")
move_2 = Move(Geometry=point_3, Motion=unit_z_2)  # -> Geometry, Transform
transformto_4 = TransformTo(Plane=move_2.Geometry, Relative=False)
action_10 = Data(transformto_4)

# ---- group: move into position
point_4 = Point(point)
transformto_5 = TransformTo(Plane=point_4, Relative=False)
action_11 = Data(transformto_5)

# ---- group: retract
number = Number(panel)
point_5 = Point(point)
unit_z_3 = UnitZ(Factor=number)
move_3 = Move(Geometry=point_5, Motion=unit_z_3)  # -> Geometry, Transform
transformto_6 = TransformTo(Plane=move_3.Geometry, Relative=False)
action_12 = Data(transformto_6)

# ---- group: create robot system
# compilation
# system
# using machina
panel_2 = Panel("gripper")
createrobot = CreateRobot(Name=panel_2, Brand="UR")
robot = Data(createrobot)

# ---- group: generate program
# program
robot_2 = Data(robot)
actions = Data()
actions_2 = Panel(actions)
compileprogram = CompileProgram(Robot=robot_2, Actions=actions, InLineTargets=Toggle(True), Comments=Toggle(False))
robotprogram = Data(compileprogram)

# ---- group: save program
c_script = CSharpScript()  # -> out, here
# ---------- c_script: C# usings ----------
using System.IO;
# ---------- c_script: C# ----------
    string targetFolder = "";

    GH_Document gh_d = owner.OnPingDocument();
    if (gh_d.IsFilePathDefined)
    {
      string ghFilePath = gh_d.FilePath;
      targetFolder = Path.GetDirectoryName(ghFilePath);
    }
    else
    {
      Print("No local folder found, please save your file locally.");
    }

    here = targetFolder;
# ---------- end c_script ----------
# output
robot_3 = Data(robot)
robotprogram_2 = Data(robotprogram)
saveprogram = SaveProgram(Robot=robot_3, RobotProgram=robotprogram_2, Path=c_script.here)
panel_3 = Panel(saveprogram)

# ---- group: print program
robotprogram_3 = Data(robotprogram)
displayprogram = DisplayProgram(RobotProgram=robotprogram_3)
panel_4 = Panel(displayprogram)

# ----
pick = Data([action_8, action_7, action, action_2, action_3, action_9])
place = Data([action_10, action_11, action_4, action_5, action_6, action_12])
