# Grasshopper definition machina-brick-laying-3.gh (Grasshopper 1.0.8)
# plug-ins: BitmapPlus, Machina

# ----
# procedural wall
# procedural noise
# bitmap+
seed = Slider(0, range=0..100)
width = Slider(36, range=0..100)
height = Slider(16, range=0..100)
depth = Slider(5000, range=0..10000)
list = ValueList({"Value": 0, "Perlin": 1, "Cubic": 2, "Simplex": 3, "WhiteNoise": 4}, selected="Perlin")
list_2 = ValueList({"Linear": 0, "Hermite": 1, "Quintic": 2}, selected="Hermite")
# construct grid
frequency = Slider(0.094, range=0..0.1)
# robotic wall
procedural_noise = ProceduralNoise(Seed=seed, Width=width, Height=height, Depth=depth, Mode=list, Interpolation=list_2, Frequency=frequency)  # -> Image, Noise
prev_image = PrevImage(SmartBitmap=procedural_noise.Image)
# UR5e
image = Data(procedural_noise.Image)

image_2 = Data(image)
bitmap_properties = BitmapProperties(Image=image_2)  # -> Boundary, Width, Height, HorizontalResolution, VerticalResolution, Format
mesh_plane = MeshPlane(
    Boundary=bitmap_properties.Boundary,
    WidthCount=expr("x-1", bitmap_properties.Width),
    HeightCount=expr("x-1", bitmap_properties.Height))  # -> Mesh, Area
xz_plane = XZPlane(Origin=Point(0, 0, 0))
orient = Orient(Geometry=mesh_plane.Mesh, Source=PlaneXY(0, 0, 0), Target=xz_plane)  # -> Geometry, Transform
deconstruct_mesh = DeconstructMesh(Mesh=orient.Geometry)  # -> Vertices, Faces, Colours, Normals
mesh_face = MeshFace(deconstruct_mesh.Faces)
point = Point(deconstruct_mesh.Vertices)

image_3 = Data(image_2)
# extract noise
deconstruct_bitmap = DeconstructBitmap(Image=image_3)
split_ahsv = SplitAHSV(Colour=deconstruct_bitmap)  # -> Alpha, Hue, Saturation, Value
noise = Number(split_ahsv.Value)

# ----
# 3D mesh
point_2 = Point(point)
mesh_face_2 = MeshFace(mesh_face)
y_factor = Slider(4, range=0..10)
noise_2 = Number(noise)
multiplication = Multiplication(A=y_factor, B=noise_2)
unit_y = UnitY(Factor=multiplication)
gradient = Gradient(
    LowerLimit=0,
    UpperLimit=1,
    Parameter=noise_2,
    stops=[0: RGB(68, 1, 84), 0.167: RGB(68, 57, 131), 0.334: RGB(49, 104, 142), 0.501: RGB(33, 145, 140), 0.668: RGB(53, 183, 121), 0.835: RGB(144, 215, 67), 1: RGB(253, 231, 37)])
move = Move(Geometry=point_2, Motion=unit_y)  # -> Geometry, Transform
construct_mesh = ConstructMesh(Vertices=move.Geometry, Faces=mesh_face_2, Colours=gradient)
mesh = Mesh(construct_mesh)

# ---- group: parametric module
# module
X = Slider(6, range=0..10)
Y = Slider(4, range=0..10)
# wall
Z = Slider(2, range=0..10)
domain_box = DomainBox(Base=PlaneXY(0, 0, 0), X=X, Y=Y, Z=Z)
module = Brep(domain_box)

# ----
module_2 = Brep(module)
mesh_2 = Mesh(mesh)
Z_2 = Number(Z)
# depth
count = Slider(10, range=0..100)
contour = Contour(Shape=mesh_2, Point=Point(0, 0, 0), Direction=Vector(0, 0, 1), Distance=Z_2)  # -> flatten(Contours)
divide_curve = DivideCurve(Curve=contour, Count=count, Kinks=False)  # -> flatten(Points), Tangents, Parameters
dispatch = Dispatch(List=divide_curve.Points, DispatchPattern=[True, False])  # -> ListA, ListB
move_2 = Move(Geometry=module_2, Motion=dispatch.ListA)  # -> Geometry, Transform
modules = Brep(move_2.Geometry)

point_3 = Point(dispatch.ListA)
unit_y_2 = UnitY(Factor=1)
negative = Negative(Value=unit_y_2)
xz_plane_2 = XZPlane(Origin=Point(0, 0, 0))
project_point = ProjectPoint(Point=point_3, Direction=negative, Geometry=xz_plane_2)  # -> Point, Index
distance = Distance(PointA=point_3, PointB=project_point.Point)
number = Number(distance)

# ----
# gradient
modules_2 = Brep(modules)
number_2 = Number(number)
bounds = Bounds(Numbers=number_2)
remap_numbers = RemapNumbers(Value=number_2, Source=bounds, Target=Domain(0, 1))  # -> Mapped, Clipped
gradient_2 = Gradient(
    LowerLimit=0,
    UpperLimit=1,
    Parameter=remap_numbers.Mapped,
    stops=[0: RGB(68, 1, 84), 0.167: RGB(68, 57, 131), 0.334: RGB(49, 104, 142), 0.501: RGB(33, 145, 140), 0.668: RGB(53, 183, 121), 0.835: RGB(144, 215, 67), 1: RGB(253, 231, 37)])
custom_preview = CustomPreview(Geometry=modules_2, Material=gradient_2)

# ---- group: set pick
# operations
# input
brep = Brep(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)

# ---- group: set place
brep_2 = Brep(modules)

# ---- group: wait
milliseconds = Panel("1000")
wait = Wait(Time=milliseconds)
action = Data(wait)

# ---- group: close gripper
close_gripper = Panel("""rq_set_pos_spd_for(255, 51, 26, "1")
  rq_wait_pos_spe_for_request(255, 51, 26, "1")
  rq_go_to("1")
  rq_wait("1")""")
customcode = CustomCode(Statement=close_gripper, IsDeclaration=False)
action_2 = Data(customcode)

# ---- group: wait
milliseconds_2 = Panel("1000")
wait_2 = Wait(Time=milliseconds_2)
action_3 = Data(wait_2)

milliseconds_3 = Panel("1000")
wait_3 = Wait(Time=milliseconds_3)
action_4 = Data(wait_3)

# ---- group: open gripper
open_gripper = Panel("""rq_set_pos_spd_for(0, 51, 26, "1")
  rq_wait_pos_spe_for_request(0, 51, 26, "1")
  rq_go_to("1")
  rq_wait("1")""")
customcode_2 = CustomCode(Statement=open_gripper, IsDeclaration=False)
action_5 = Data(customcode_2)

# ---- group: wait
milliseconds_4 = Panel("1000")
wait_4 = Wait(Time=milliseconds_4)
action_6 = Data(wait_4)

# ---- group: retract
motionmode = MotionMode(MotionMode=0)
unit_z = UnitZ(Factor="3")
move_3 = Move(Vector=unit_z, Relative=True)
action_7 = Data([motionmode, move_3])

# ---- group: find coordinate
volume = Volume(Geometry=brep)  # -> Volume, Centroid
stock = Point(volume.Centroid)

# ---- group: move to stock
stock_2 = Point(stock)
transformto = TransformTo(Plane=stock_2, Relative=False)
action_8 = Data(transformto)

# ---- group: find coordinates
volume_2 = Volume(Geometry=brep_2)  # -> Volume, Centroid
point_4 = Point(volume_2.Centroid)

# ---- group: find coordinates above stock
stock_3 = Point(stock)
point_5 = Point(volume_2.Centroid)
# pick
deconstruct = Deconstruct(Point=stock_3)  # -> XComponent, YComponent, ZComponent
deconstruct_2 = Deconstruct(Point=point_5)  # -> XComponent, YComponent, ZComponent
unit_z_2 = UnitZ(Factor="3")
construct_point = ConstructPoint(XCoordinate=deconstruct.XComponent, YCoordinate=deconstruct.YComponent, ZCoordinate=deconstruct_2.ZComponent)
move_4 = Move(Geometry=construct_point, Motion=unit_z_2)  # -> Geometry, Transform
above_stock = Point(move_4.Geometry)

# ---- group: move above stock
above_stock_2 = Point(above_stock)
transformto_2 = TransformTo(Plane=above_stock_2, Relative=False)
action_9 = Data(transformto_2)

# place
above_stock_3 = Point(above_stock)
transformto_3 = TransformTo(Plane=above_stock_3, Relative=False)
action_10 = Data(transformto_3)

# ---- group: move above position
point_6 = Point(point_4)
unit_z_3 = UnitZ(Factor="3")
move_5 = Move(Geometry=point_6, Motion=unit_z_3)  # -> Geometry, Transform
transformto_4 = TransformTo(Plane=move_5.Geometry, Relative=False)
action_11 = Data(transformto_4)

# ---- group: move into position
point_7 = Point(point_4)
transformto_5 = TransformTo(Plane=point_7, Relative=False)
action_12 = Data(transformto_5)

# ---- group: pick position
# sequence
# of operations
enter = Data(action_9)
retract = Data(action_10)
weave = Weave(Pattern=[0, 1], Stream0=enter, Stream1=retract, NullGaps=False)
partition_list = PartitionList(List=weave, Size="2")
pick = Data(partition_list)

# ---- group: pick and grip
pick_2 = Data(pick)
actions = Data([action_8, action, action_2, action_3])
list_length = ListLength(List=actions)
series = Series(Start="1", Step="0", Count=list_length)
insert_items = InsertItems(List=pick_2, Item=actions, Indices=series, Wrap=False)
pick_3 = Data(insert_items)

# ---- group: enter and place
entry = Data(transformto_4)
place = Data(transformto_5)
weave_2 = Weave(Pattern=[0, 1], Stream0=entry, Stream1=place, NullGaps=False)
partition_list_2 = PartitionList(List=weave_2, Size="2")
place_2 = Data(partition_list_2)

# ---- group: pick and place
place_3 = Data(place_2)
pick_4 = Data(pick_3)
list_length_2 = ListLength(List=pick_4)
series_2 = Series(Start=0, Step="0", Count=list_length_2)
insert_items_2 = InsertItems(List=place_3, Item=pick_4, Indices=series_2, Wrap=False)
pick_place = Data(insert_items_2)

# ---- group: pick, place, and retract
pick_place_2 = Data(pick_place)
close = Data([action_4, action_5, action_6, action_7])
list_length_3 = ListLength(List=pick_place_2)  # -> flatten(Length)
list_item = ListItem(List=list_length_3, Index=0, Wrap=True)
list_length_4 = ListLength(List=close)
series_3 = Series(Start=list_item, Step="0", Count=list_length_4)
insert_items_3 = InsertItems(List=pick_place_2, Item=close, Indices=series_3, Wrap=False)
pick_place_3 = Data(insert_items_3)

# ---- group: create robot system
# compilation
# system
# using machina
panel = Panel("robotic-wall-2")
createrobot = CreateRobot(Name=panel, Brand="UR")
robot = Data(createrobot)

# ---- group: generate program
# program
robot_2 = Data(robot)
actions_2 = Data(flatten(pick_place_3))
actions_3 = Panel(actions_2)
compileprogram = CompileProgram(Robot=robot_2, Actions=actions_2, InLineTargets=Toggle(True), Comments=Toggle(False))
robotprogram = Data(compileprogram)

# ---- group: save program
c_script = CSharpScript()  # -> out, here
# ---------- c_script: C# usings ----------
using System.IO;
# ---------- c_script: C# ----------
    string targetFolder = "";

    GH_Document gh_d = owner.OnPingDocument();
    if (gh_d.IsFilePathDefined)
    {
      string ghFilePath = gh_d.FilePath;
      targetFolder = Path.GetDirectoryName(ghFilePath);
    }
    else
    {
      Print("No local folder found, please save your file locally.");
    }

    here = targetFolder;
# ---------- end c_script ----------
# output
robot_3 = Data(robot)
robotprogram_2 = Data(robotprogram)
saveprogram = SaveProgram(Robot=robot_3, RobotProgram=robotprogram_2, Path=c_script.here)
panel_2 = Panel(saveprogram)

# ---- group: print program
robotprogram_3 = Data(robotprogram)
displayprogram = DisplayProgram(RobotProgram=robotprogram_3)
panel_3 = Panel(displayprogram)
