# Grasshopper definition machina-robotiq-gripper-script.gh (Grasshopper 1.0.8)
# plug-ins: RhinoCodePluginGH, Machina

# ---- group: create robot system
# using machina
# commands
panel = Panel("UR")
# system
panel_2 = Panel("gripperscript")
# UR5e
createrobot = CreateRobot(Name=panel_2, Brand=panel)

# ----
wait = Wait(Time="1000")
wait_2 = Wait(Time="2000")
merge = Merge(Data1=wait, Data2=wait_2)

# ---- group: input program data
# input
input_points = Point([Point(0, 0, 0), Point(10, 10, 0)])

# ---- group: generate program
# program
boolean_toggle = BooleanToggle(True)
compileprogram = CompileProgram(Robot=createrobot, Actions=merge, InLineTargets=boolean_toggle, Comments=Toggle(False))

# ---- group: save program
# output
c_script = CSharpScript()  # -> out, here
# ---------- c_script: C# usings ----------
using System.IO;
# ---------- c_script: C# ----------
    string targetFolder = "";

    GH_Document gh_d = owner.OnPingDocument();
    if (gh_d.IsFilePathDefined)
    {
      string ghFilePath = gh_d.FilePath;
      targetFolder = Path.GetDirectoryName(ghFilePath);
    }
    else
    {
      Print("No local folder found, please save your file locally.");
    }

    here = targetFolder;
# ---------- end c_script ----------
saveprogram = SaveProgram(Robot=createrobot, RobotProgram=compileprogram, Path=c_script.here)
panel_3 = Panel(saveprogram)

# ---- group: print program
displayprogram = DisplayProgram(RobotProgram=compileprogram)
panel_4 = Panel(displayprogram)

# ---- group: add gripper operations
# recompute solution
directory = Text(c_script.here)
program = Text(panel_2)
script = Script(x=directory, y=program)  # -> out, a
# ---------- script: Python ----------
"""Robotiq Gripper"""

__author__ = "baharmon"
__version__ = "2024.03.16"

import os
import re

# set path 
script = os.path.join(x,'{y}_Program'.format(y=y),'{y}.script'.format(y=y))

# set variables
close_grip = """
  rq_set_pos_spd_for(255, 51, 26, "1")
  rq_wait_pos_spe_for_request(255, 51, 26, "1")
  rq_go_to("1")
  rq_wait("1")
"""
open_grip = """
  rq_set_pos_spd_for(0, 51, 26, "1")
  rq_wait_pos_spe_for_request(0, 51, 26, "1")
  rq_go_to("1")
  rq_wait("1")
"""

# define functions
def close_gripper(matchobj):
    return f"{matchobj.group()}{close_grip}"

def open_gripper(matchobj):
    return f"{matchobj.group()}{open_grip}"

# read
with open(script) as file :
  filedata = file.read()

# close gripper
filedata = re.sub(r"sleep\(1\)", close_gripper, filedata)
# filedata = re.sub(r"movej\(.*\)", close_gripper, filedata)

# open gripper
filedata = re.sub(r"sleep\(2\)", open_gripper, filedata)
# filedata = re.sub(r"movej\(.*\)", open_gripper, filedata)

# write
with open(script, 'w') as file:
  file.write(filedata)

# print
print(filedata)
# ---------- end script ----------
panel_5 = Panel(script.out)
