# Grasshopper definition machina-ur10e-3d-printing-multivolume.gh (Grasshopper 1.0.7)
# plug-ins: Machina

# ---- group: create robot system
# using machina
panel = Panel("UR")
# system
panel_2 = Panel("printing")
# UR10e
createrobot = CreateRobot(Name=panel_2, Brand=panel)
robot = Data(createrobot)

# ---- group: set motion mode
# commands
motionmode = MotionMode(MotionMode=0)

# ---- group: set precision
precision = Slider(10, range=0..100)
precisionto = PrecisionTo(Radius=precision, Relative=False)

# ---- group: set speed
speed = Slider(30, range=0..100)
speedto = SpeedTo(Speed=speed, Relative=False)

# ---- group: set acceleration
acceleration = Slider(30, range=0..100)
accelerationto = AccelerationTo(Acceleration=acceleration, Relative=False)

# ---- group: start extruding
# ExtruderOn
panel_3 = Panel("0")
writedigital = WriteDigital(DigitalPin=panel_3, On=Toggle(True), ToolPin=False)

digital_output = Text(panel_3)
writedigital_2 = WriteDigital(DigitalPin=digital_output, On=Toggle(True), ToolPin=False)
start = Data(writedigital_2)

# ---- group: wait
wait_ms = Slider(100, range=0..10000)
wait = Wait(Time=wait_ms)
wait_2 = Data(wait)

# ---- group: stop extruding
digital_output_2 = Text(panel_3)
writedigital_3 = WriteDigital(DigitalPin=digital_output_2, On=Toggle(False), ToolPin=False)

# ---- group: wait
wait_ms_2 = Slider(1000, range=0..10000)
wait_3 = Wait(Time=wait_ms_2)
end_wait = Data(wait_3)

# ---- group: start extruding
digital_output_3 = Text(panel_3)
writedigital_4 = WriteDigital(DigitalPin=digital_output_3, On=Toggle(True), ToolPin=False)
start_2 = Data(writedigital_4)

# ---- group: wait
wait_4 = Number(wait_ms)
wait_5 = Wait(Time=wait_4)
wait_6 = Data(wait_5)

# ---- group: stop extruding
digital_output_4 = Text(panel_3)
writedigital_5 = WriteDigital(DigitalPin=digital_output_4, On=Toggle(False), ToolPin=False)

# ---- group: wait
end_wait_2 = Number(wait_ms_2)
wait_7 = Wait(Time=end_wait_2)
end_wait_3 = Data(wait_7)

# ---- group: Input geometry
geometry = Geometry(<brep referenced from the Rhino model>)

# ----
# input
geometry_2 = Geometry(geometry)
Z = Slider(-27, range=-50..50)
layer_height = Slider(3, range=0..10)
split = Slider(29, range=0..100)
resolution = Slider(2, range=0..10)
Z_2 = UnitZ(Factor=Z)
move = Move(Geometry=geometry_2, Motion=Z_2)  # -> Geometry, Transform
contour = Contour(Shape=move.Geometry, Point=Point(0, 0, 0), Direction=Vector(0, 0, 1), Distance=layer_height)
split_list = SplitList(List=flatten(contour), Index=split)  # -> ListA, ListB
dispatch = Dispatch(List=split_list.ListB, DispatchPattern=[True, False])  # -> ListA, ListB
resolution_2 = Number(resolution)
curve = Curve(dispatch.ListA)
curve_2 = Curve(split_list.ListA)
curve_3 = Curve(dispatch.ListB)
divide_distance = DivideDistance(Curve=curve_2, Distance=resolution_2)  # -> Points, Tangents, Parameters
divide_distance_2 = DivideDistance(Curve=curve, Distance=resolution_2)  # -> Points, Tangents, Parameters
divide_distance_3 = DivideDistance(Curve=curve_3, Distance=resolution_2)  # -> Points, Tangents, Parameters
base_points = Point(flatten(divide_distance.Points))
a_points = Point(divide_distance_2.Points)
b_points = Point(divide_distance_3.Points)

# ---- group: engage extruder
base_points_2 = Point(base_points)
retract = Slider(20, range=0..250)
unit_z = UnitZ(Factor=retract)
list_item = ListItem(List=base_points_2, Index="0", Wrap=True)
move_2 = Move(Geometry=list_item, Motion=unit_z)  # -> Geometry, Transform
transformto = TransformTo(Plane=move_2.Geometry, Relative=False)

# ---- group: transformations
base_points_3 = Point(base_points)
transformto_2 = TransformTo(Plane=base_points_3, Relative=False)

# ---- group: transform
a_points_2 = Point(a_points)
transformto_3 = TransformTo(Plane=a_points_2, Relative=False)

b_points_2 = Point(b_points)
transformto_4 = TransformTo(Plane=b_points_2, Relative=False)

# ----
list_length = ListLength(List=transformto_3)
shift_list = ShiftList(List=transformto_3, Shift=expr("x/2-1", list_length), Wrap=True)
list_length_2 = ListLength(List=shift_list)  # -> expr("x-1", Length)
list_item_2 = ListItem(List=shift_list, Index=list_length_2, Wrap=True)
insert_items = InsertItems(List=shift_list, Item=list_item_2, Indices="0", Wrap=True)
wait_8 = Data(wait_2)
insert_items_2 = InsertItems(List=insert_items, Item=wait_8, Indices="1", Wrap=True)
start_3 = Data(start)
insert_items_3 = InsertItems(List=insert_items_2, Item=start_3, Indices="2", Wrap=True)
wait_9 = Data(wait_2)
insert_items_4 = InsertItems(List=insert_items_3, Item=wait_9, Indices="3", Wrap=True)
list_length_3 = ListLength(List=insert_items_4)
insert_items_5 = InsertItems(List=insert_items_4, Item=writedigital_3, Indices=list_length_3, Wrap=True)
list_length_4 = ListLength(List=insert_items_5)
end_wait_4 = Data(end_wait)
insert_items_6 = InsertItems(List=insert_items_5, Item=end_wait_4, Indices=list_length_4, Wrap=True)

list_length_5 = ListLength(List=transformto_4)
shift_list_2 = ShiftList(List=transformto_4, Shift=expr("x/2-1", list_length_5), Wrap=True)
list_length_6 = ListLength(List=shift_list_2)  # -> expr("x-1", Length)
list_item_3 = ListItem(List=shift_list_2, Index=expr("x-1", list_length_6), Wrap=True)
insert_items_7 = InsertItems(List=shift_list_2, Item=list_item_3, Indices="0", Wrap=True)
wait_10 = Data(wait_6)
insert_items_8 = InsertItems(List=insert_items_7, Item=wait_10, Indices="1", Wrap=True)
start_4 = Data(start_2)
insert_items_9 = InsertItems(List=insert_items_8, Item=start_4, Indices="2", Wrap=True)
wait_11 = Data(wait_6)
insert_items_10 = InsertItems(List=insert_items_9, Item=wait_11, Indices="3", Wrap=True)
list_length_7 = ListLength(List=insert_items_10)
insert_items_11 = InsertItems(List=insert_items_10, Item=writedigital_5, Indices=list_length_7, Wrap=True)
list_length_8 = ListLength(List=insert_items_11)
end_wait_5 = Data(end_wait_3)
insert_items_12 = InsertItems(List=insert_items_11, Item=end_wait_5, Indices=list_length_8, Wrap=True)

# ---- group: settings
merge = Merge(Data1=motionmode, Data2=precisionto, Data3=speedto, Data4=accelerationto)
settings = Data(merge)

# ----
pattern = Panel("""0
1
2""")
weave = Weave(Pattern=pattern, Stream0=transformto, Stream1=writedigital, Stream2=transformto_2, NullGaps=False)
base = Data(weave)

shift_paths = ShiftPaths(Data=[insert_items_6, insert_items_12], Offset=-1)  # -> flatten(Data)
null_item = NullItem(Item=shift_paths)  # -> NullFlags, InvalidFlags, Description
cull_pattern = CullPattern(List=shift_paths, CullPattern=invert(null_item.NullFlags))
volumes = Data(cull_pattern)

volumes_2 = Data(volumes)

# ---- group: generate program
# program
robot_2 = Data(createrobot)
settings_2 = Data(settings)
base_2 = Data(base)
merge_2 = Merge(Data1=settings_2, Data2=base_2, Data3=volumes_2)
actions = Panel(merge_2)
compileprogram = CompileProgram(Robot=robot_2, Actions=merge_2, InLineTargets=Toggle(True), Comments=Toggle(True))

# ---- group: save program
# output
robot_3 = Data(createrobot)
c_script = CSharpScript()  # -> out, here
# ---------- c_script: C# usings ----------
using System.IO;
# ---------- c_script: C# ----------
    string targetFolder = "";

    GH_Document gh_d = owner.OnPingDocument();
    if (gh_d.IsFilePathDefined)
    {
      string ghFilePath = gh_d.FilePath;
      targetFolder = Path.GetDirectoryName(ghFilePath);
    }
    else
    {
      Print("No local folder found, please save your file locally.");
    }

    here = targetFolder;
# ---------- end c_script ----------
saveprogram = SaveProgram(Robot=robot_3, RobotProgram=compileprogram, Path=c_script.here)
panel_4 = Panel(saveprogram)

# ---- group: print program
displayprogram = DisplayProgram(RobotProgram=compileprogram)
panel_5 = Panel(displayprogram)

# ---- group: transform pose
program = Text(panel_2)
ghpython_script = GhPythonScript(x=c_script.here, y=program, z="Tray", u=saveprogram)  # -> out, a
# ---------- ghpython_script: Python ----------
"""Transform Pose.
    Inputs:
        x: file path
        y: program name
        z: feature plane"""

__author__ = "baharmon"
__version__ = "2021.11.10"

import rhinoscriptsyntax as rs
import os

# set variables
script = os.path.join(x,'{y}_Program'.format(y=y),'{y}.script'.format(y=y))

# read
with open(script, 'r') as file :
  filedata = file.read()

# pose transformation
filedata = filedata.replace(
    'movep(p', 'movep(pose_trans({z},p'.format(z=z)
    )
filedata = filedata.replace(']', '])')

# write
with open(script, 'w') as file:
  file.write(filedata)
# ---------- end ghpython_script ----------
