# Grasshopper definition machina-ur10e-3d-printing-zero.gh (Grasshopper 1.0.7)
# plug-ins: Machina

# ---- group: create robot system
# using machina
panel = Panel("UR")
# system
panel_2 = Panel("zero")
# UR10e
createrobot = CreateRobot(Name=panel_2, Brand=panel)
robot = Data(createrobot)

# ---- group: set motion mode
# commands
motionmode = MotionMode(MotionMode=0)

# ---- group: set precision
precision = Slider(10, range=0..100)
precisionto = PrecisionTo(Radius=precision, Relative=False)

# ---- group: set speed
speed = Slider(20, range=0..100)
speedto = SpeedTo(Speed=speed, Relative=False)

# ---- group: set acceleration
acceleration = Slider(20, range=0..100)
accelerationto = AccelerationTo(Acceleration=acceleration, Relative=False)

# ---- group: transformations
point = Point(Point(0, 0, 0))
transformto = TransformTo(Plane=point, Relative=False)

# ---- group: action
merge = Merge(Data1=motionmode, Data2=precisionto, Data3=speedto, Data4=accelerationto, Data5=transformto)
actions = Data(merge)

# ---- group: generate program
# program
robot_2 = Data(createrobot)
settings = Data(actions)
actions_2 = Panel(actions)
compileprogram = CompileProgram(Robot=robot_2, Actions=settings, InLineTargets=Toggle(True), Comments=Toggle(True))

# ---- group: save program
# output
robot_3 = Data(createrobot)
c_script = CSharpScript()  # -> out, here
# ---------- c_script: C# usings ----------
using System.IO;
# ---------- c_script: C# ----------
    string targetFolder = "";

    GH_Document gh_d = owner.OnPingDocument();
    if (gh_d.IsFilePathDefined)
    {
      string ghFilePath = gh_d.FilePath;
      targetFolder = Path.GetDirectoryName(ghFilePath);
    }
    else
    {
      Print("No local folder found, please save your file locally.");
    }

    here = targetFolder;
# ---------- end c_script ----------
saveprogram = SaveProgram(Robot=robot_3, RobotProgram=compileprogram, Path=c_script.here)
panel_3 = Panel(saveprogram)

# ---- group: print program
displayprogram = DisplayProgram(RobotProgram=compileprogram)
panel_4 = Panel(displayprogram)

# ---- group: transform pose
program = Text(panel_2)
ghpython_script = GhPythonScript(x=c_script.here, y=program, z="Tray", u=saveprogram)  # -> out, a
# ---------- ghpython_script: Python ----------
"""Transform Pose.
    Inputs:
        x: file path
        y: program name
        z: feature plane"""

__author__ = "baharmon"
__version__ = "2021.11.10"

import rhinoscriptsyntax as rs
import os

# set variables
script = os.path.join(x,'{y}_Program'.format(y=y),'{y}.script'.format(y=y))

# read
with open(script, 'r') as file :
  filedata = file.read()

# pose transformation
filedata = filedata.replace(
    'movep(p', 'movep(pose_trans({z},p'.format(z=z)
    )
filedata = filedata.replace(']', '])')

# write
with open(script, 'w') as file:
  file.write(filedata)
# ---------- end ghpython_script ----------
