# Grasshopper definition machina-ur10e-canvas.gh (Grasshopper 1.0.7)
# plug-ins: Machina

# ---- group: create robot system
# using machina
panel = Panel("UR")
# system
panel_2 = Panel("canvas")
# UR10e
createrobot = CreateRobot(Name=panel_2, Brand=panel)

# ---- group: set motion mode
# commands
motionmode = MotionMode(MotionMode=0)

# ---- group: set initial speed
speed = Slider(60, range=0..100)
speedto = SpeedTo(Speed=speed, Relative=False)

# ----
# workspace
panel_3 = Panel("400,600,0")
rectangle_2pt = Rectangle2Pt(Plane=PlaneXY(0, 0, 0), PointA=panel_3, PointB="1300,-600,0", Radius=0)  # -> Rectangle, Length
rectangle = Rectangle(Plane=PlaneXY(0, 0, 0), XSize="800", YSize="800", Radius=0)  # -> Rectangle, Length
polygon_center = PolygonCenter(Polyline=rectangle_2pt.Rectangle)  # -> CenterV, CenterE, CenterA
polygon_center_2 = PolygonCenter(Polyline=rectangle.Rectangle)  # -> CenterV, CenterE, CenterA
vector_2pt = Vector2Pt(PointA=polygon_center_2.CenterA, PointB=polygon_center.CenterA, Unitize=False)  # -> Vector, Length
move = Move(Geometry=rectangle.Rectangle, Motion=vector_2pt.Vector)  # -> Geometry, Transform
custom_preview = CustomPreview(Geometry=rectangle_2pt.Rectangle, Material=ColourSwatch(SwatchColor=RGB(255, 255, 255)))
custom_preview_2 = CustomPreview(Geometry=move.Geometry, Material=ColourSwatch(SwatchColor=RGB(209, 209, 209)))
centroid = Point(polygon_center.CenterA)
paper = Curve(move.Geometry)

# ----
# geometry
geometry = Geometry(paper)
explode = Explode(Curve=geometry, Recursive=True)  # -> Segments, Vertices
point = Point(explode.Vertices)

# ---- group: transformations
point_2 = Point(flatten(point))
flip_plane = FlipPlane(Plane=point_2, ReverseX=False, ReverseY=False, SwapAxes=True)
transformto = TransformTo(Plane=flip_plane, Relative=False)

# ---- group: merge actions
merge = Merge(Data1=motionmode, Data2=speedto, Data3=transformto)

# ---- group: generate program
# program
boolean_toggle = BooleanToggle(True)
actions = Panel(merge)
compileprogram = CompileProgram(Robot=createrobot, Actions=merge, InLineTargets=boolean_toggle, Comments=Toggle(True))

# ---- group: inkwell
paper_2 = Curve(paper)
shift = Slider(100, range=0..250)
discontinuity = Discontinuity(Curve=paper_2, Level=1)  # -> Points, Parameters
list_item = ListItem(List=discontinuity.Points, Index=0, Wrap=True)
negative = Negative(Value=shift)
unit_y = UnitY(Factor=negative)
move_2 = Move(Geometry=list_item, Motion=unit_y)  # -> Geometry, Transform
ink_well = Point(move_2.Geometry)

# ---- group: save program
# output
c_script = CSharpScript()  # -> out, here
# ---------- c_script: C# usings ----------
using System.IO;
# ---------- c_script: C# ----------
    string targetFolder = "";

    GH_Document gh_d = owner.OnPingDocument();
    if (gh_d.IsFilePathDefined)
    {
      string ghFilePath = gh_d.FilePath;
      targetFolder = Path.GetDirectoryName(ghFilePath);
    }
    else
    {
      Print("No local folder found, please save your file locally.");
    }

    here = targetFolder;
# ---------- end c_script ----------
saveprogram = SaveProgram(Robot=createrobot, RobotProgram=compileprogram, Path=c_script.here)
panel_4 = Panel(saveprogram)

# ---- group: print program
displayprogram = DisplayProgram(RobotProgram=compileprogram)
panel_5 = Panel(displayprogram)
