# Grasshopper definition machina-ur10e-path.gh (Grasshopper 1.0.7)
# plug-ins: Machina

# ---- group: create robot system
# using machina
panel = Panel("UR")
# system
panel_2 = Panel("noise")
# UR10e
createrobot = CreateRobot(Name=panel_2, Brand=panel)

# ---- group: set motion mode
# commands
motionmode = MotionMode(MotionMode=1)

# ---- group: set initial speed
speed = Slider(30, range=0..100)
speedto = SpeedTo(Speed=speed, Relative=False)

# ---- group: input program data
input_points = Point([Point(602, -96, 0), Point(621, -74, 0), Point(641, -53, 0), Point(660, -32, 0), Point(679, -11, 0), Point(699, 11, 0)])

# ---- group: transformations
point = Point(flatten(input_points))
flip_plane = FlipPlane(Plane=point, ReverseX=False, ReverseY=False, SwapAxes=True)
transformto = TransformTo(Plane=flip_plane, Relative=False)

# ---- group: merge actions
merge = Merge(Data1=motionmode, Data2=speedto, Data3=transformto)

# ----
# input
panel_3 = Panel("""0
1
2""")

# ---- group: generate program
# program
boolean_toggle = BooleanToggle(True)
actions = Panel(merge)
compileprogram = CompileProgram(Robot=createrobot, Actions=merge, InLineTargets=boolean_toggle, Comments=Toggle(True))

# ----
point_2 = Point(input_points)
shift_list = ShiftList(List=point_2, Shift="1", Wrap=False)
panel_4 = Panel("""0
1
2
3""")
panel_5 = Panel(point_2)
weave = Weave(Pattern=panel_4, Stream0=point_2, Stream1=shift_list, Stream2=point_2, Stream3=shift_list, NullGaps=False)
panel_6 = Panel(shift_list)
point_3 = Point(weave)

# ---- group: simulation
# simulation
point_4 = Point(point_3)
index = Slider(0, range=0..20)
shift_list_2 = ShiftList(List=point_4, Shift=1, Wrap=False)
vector_2pt = Vector2Pt(PointA=point_4, PointB=shift_list_2, Unitize=False)  # -> Vector, Length
list_item = ListItem(List=flatten(point_4), Index=index, Wrap=True)
list_item_2 = ListItem(List=flatten(vector_2pt.Vector), Index=index, Wrap=True)
vector_display = VectorDisplay(Anchor=point_4, Vector=vector_2pt.Vector)
vector_display_2 = VectorDisplay(Anchor=list_item, Vector=list_item_2)

# ----
panel_7 = Panel(weave)

# ---- group: save program
# output
c_script = CSharpScript()  # -> out, here
# ---------- c_script: C# usings ----------
using System.IO;
# ---------- c_script: C# ----------
    string targetFolder = "";

    GH_Document gh_d = owner.OnPingDocument();
    if (gh_d.IsFilePathDefined)
    {
      string ghFilePath = gh_d.FilePath;
      targetFolder = Path.GetDirectoryName(ghFilePath);
    }
    else
    {
      Print("No local folder found, please save your file locally.");
    }

    here = targetFolder;
# ---------- end c_script ----------
saveprogram = SaveProgram(Robot=createrobot, RobotProgram=compileprogram, Path=c_script.here)
panel_8 = Panel(saveprogram)

# ---- group: print program
displayprogram = DisplayProgram(RobotProgram=compileprogram)
panel_9 = Panel(displayprogram)

# ---- group: set workspace
# workspace
panel_10 = Panel("250,600,0")
rectangle_2pt = Rectangle2Pt(Plane=PlaneXY(0, 0, 0), PointA=panel_10, PointB="1150,-600,0", Radius=0)  # -> Rectangle, Length
rectangle = Rectangle(Plane=PlaneXY(0, 0, 0), XSize="250", YSize="250", Radius=0)  # -> Rectangle, Length
custom_preview = CustomPreview(Geometry=rectangle_2pt.Rectangle, Material=ColourSwatch(SwatchColor=RGB(255, 255, 255)))

# ----
area = Area(Geometry=rectangle_2pt.Rectangle)  # -> Area, Centroid
area_2 = Area(Geometry=rectangle.Rectangle)  # -> Area, Centroid

# ---- group: set workspace (continued)
vector_2pt_2 = Vector2Pt(PointA=area_2.Centroid, PointB=area.Centroid, Unitize=False)  # -> Vector, Length
move = Move(Geometry=rectangle.Rectangle, Motion=vector_2pt_2.Vector)  # -> Geometry, Transform
custom_preview_2 = CustomPreview(Geometry=move.Geometry, Material=ColourSwatch(SwatchColor=RGB(209, 209, 209)))
workspace = Curve(move.Geometry)
work_zero = Point(area.Centroid)
