# Grasshopper definition machina-ur10e-sine-curves.gh (Grasshopper 1.0.7)
# plug-ins: Machina

# ---- group: create robot system
# using machina
panel = Panel("UR")
# system
panel_2 = Panel("sine_curves")
# UR10e
# real-time control
# sine curves
createrobot = CreateRobot(Name=panel_2, Brand=panel)

# ----
steps = Slider(64, range=0..100)
count = Slider(6, range=0..10)
seed = Slider(5, range=0..100)
x_scale = Slider(100, range=0..360)
# sine curves
factor = Slider(1.61, range=0..3)
y_scale = Slider(75, range=0..360)
retract = Slider(50, range=0..100)
pi = Pi(Factor=factor)
random = Random(Range="0 To 2", Number=count, Seed=seed)
range = Range(Domain=pi, Steps=steps)
multiplication = Multiplication(A=range, B=graft(random))
sine = Sine(Value=multiplication)
construct_point = ConstructPoint(XCoordinate=range, YCoordinate=sine, ZCoordinate=0)
scale_nu = ScaleNU(Geometry=construct_point, Plane=PlaneXY(0, 0, 0), ScaleX=x_scale, ScaleY=y_scale, ScaleZ=1)  # -> Geometry, Transform
steps_2 = Number(steps)
unit_z = UnitZ(Factor=retract)
list_item = ListItem(List=scale_nu.Geometry, Index=steps_2, Wrap=True)
move = Move(Geometry=list_item, Motion=unit_z)  # -> Geometry, Transform
addition = Addition(A=steps_2, B="1")
insert_items = InsertItems(List=scale_nu.Geometry, Item=move.Geometry, Indices=addition, Wrap=True)
retract_engage = Number(retract)
construct_point_2 = ConstructPoint(XCoordinate=0, YCoordinate=0, ZCoordinate=retract_engage)
addition_2 = Addition(A=addition, B="1")
insert_items_2 = InsertItems(List=insert_items, Item=construct_point_2, Indices=addition_2, Wrap=True)
polyline = PolyLine(Vertices=insert_items_2, Closed=False)
point = Point(flatten(insert_items_2))
curve = Curve(flatten(polyline))

# ---- group: set initial speed
speed = Slider(50, range=0..100)
speedto = SpeedTo(Speed=speed, Relative=False)

# ---- group: set precision
precision = Slider(2, range=0..10)
precisionto = PrecisionTo(Radius=precision, Relative=False)

# ---- group: set path
xy_plane = XYPlane(Origin=Point(0, 0, 0))
points = Point(point)
origin = Panel("500,0,-50")
vector_2pt = Vector2Pt(PointA=xy_plane, PointB=origin, Unitize=False)  # -> Vector, Length
move_2 = Move(Geometry=points, Motion=vector_2pt.Vector)  # -> Geometry, Transform
pl = ConstructPlane(Origin=move_2.Geometry, XAxis="-1,0,0", YAxis=Vector(0, 1, 0))
transformto = TransformTo(Plane=pl, Relative=False)  # -> flatten(Action)

# ---- group: wait
time = Slider(500, range=0..5000)
wait = Wait(Time=time)

# ---- group: set speed
speed_2 = Slider(50, range=0..100)
speedto_2 = SpeedTo(Speed=speed_2, Relative=False)

# ---- group: move home
# commands
# set home position
# using joint rotation angles
# in degrees
panel_3 = Panel("0")
axesto = AxesTo(A1=panel_3, A2="-90", A3="-90", A4="-90", A5="90", A6=panel_3, Relative=False)

# set home position
# using joint rotation angles
# in degrees
panel_4 = Panel("0")
axesto_2 = AxesTo(A1=panel_4, A2="-90", A3="-90", A4="-90", A5="90", A6=panel_4, Relative=False)

# ---- group: merge actions
# program
merge = Merge(Data1=axesto, Data2=speedto, Data3=precisionto, Data4=transformto, Data5=wait, Data6=speedto_2, Data7=axesto_2)
panel_5 = Panel(merge)

# ----
# workspace
panel_6 = Panel("400,600,0")
rectangle_2pt = Rectangle2Pt(Plane=PlaneXY(0, 0, 0), PointA=panel_6, PointB="1300,-600,0", Radius=0)  # -> Rectangle, Length
custom_preview = CustomPreview(Geometry=rectangle_2pt.Rectangle, Material=ColourSwatch(SwatchColor=RGB(255, 255, 255)))

# ----
# paper
panel_7 = Panel("450,225,0")
rectangle_2pt_2 = Rectangle2Pt(Plane=PlaneXY(0, 0, 0), PointA=panel_7, PointB="1050,-225,0", Radius=0)  # -> Rectangle, Length
custom_preview_2 = CustomPreview(Geometry=rectangle_2pt_2.Rectangle, Material=ColourSwatch(SwatchColor=RGB(209, 209, 209)))

# ---- group: generate program
compileprogram = CompileProgram(Robot=createrobot, Actions=merge, InLineTargets=Toggle(True), Comments=Toggle(True))

# ---- group: save program
# output
# stream
c_script = CSharpScript()  # -> out, here
# ---------- c_script: C# usings ----------
using System.IO;
# ---------- c_script: C# ----------
    string targetFolder = "";

    GH_Document gh_d = owner.OnPingDocument();
    if (gh_d.IsFilePathDefined)
    {
      string ghFilePath = gh_d.FilePath;
      targetFolder = Path.GetDirectoryName(ghFilePath);
    }
    else
    {
      Print("No local folder found, please save your file locally.");
    }

    here = targetFolder;
# ---------- end c_script ----------
saveprogram = SaveProgram(Robot=createrobot, RobotProgram=compileprogram, Path=c_script.here)
panel_8 = Panel(saveprogram)

# ---- group: stream program via machina bridge
connect_to_bridge = BooleanToggle(False)
send_program = Button()
connect = Connect(URL="ws://127.0.0.1:6999/Bridge", Name="Grasshopper", Connect=connect_to_bridge)  # -> Status, Bridge
send = Send(Bridge=connect.Bridge, Actions=merge, Send=send_program)  # -> Sent, Instructions
listen = Listen(Bridge=connect.Bridge, Autoupdate=True, Interval=66)
panel_9 = Panel(connect.Status)
actionexecuted = ActionExecuted(BridgeMessage=listen)  # -> LastAction, ActionTCP, ActionAxes, ActionExternalAxes, PendingActions, PendingActionsOnDevice
panel_10 = Panel(send.Sent)
panel_11 = Panel(send.Instructions)
panel_12 = Panel(actionexecuted.PendingActions)
panel_13 = Panel(actionexecuted.LastAction)
data_recorder = DataRecorder(actionexecuted.ActionTCP, DataLimit=-10, RecordData=True)
plane = Plane(data_recorder)

# ---- group: print program
displayprogram = DisplayProgram(RobotProgram=compileprogram)
panel_14 = Panel(displayprogram)
