# Grasshopper definition machina-ur10e-single-path.gh (Grasshopper 1.0.7)
# plug-ins: Machina

# ---- group: create robot system
# using machina
panel = Panel("UR")
# system
panel_2 = Panel("path")
# UR10e
createrobot = CreateRobot(Name=panel_2, Brand=panel)

# ---- group: set motion mode
# commands
motionmode = MotionMode(MotionMode=1)

# ---- group: set initial speed
speed = Slider(30, range=0..100)
speedto = SpeedTo(Speed=speed, Relative=False)

# ---- group: input program data
# input
input_points = Point([Point(600, -92, 0), Point(654, -32, 0), Point(626, 6, 0), Point(640, 62, 0), Point(675, 84, 0), Point(721, 63, 0), Point(752, 28, 0), Point(742, -13, 0), Point(746, -48, 0), Point(775, -75, 0)])

# ---- group: transformations
point = Point(flatten(input_points))
flip_plane = FlipPlane(Plane=point, ReverseX=False, ReverseY=False, SwapAxes=True)
transformto = TransformTo(Plane=flip_plane, Relative=False)

# ---- group: simulation
# simulation
point_2 = Point(input_points)
polyline = PolyLine(Vertices=point_2, Closed=False)
list_item = ListItem(List=flatten(polyline), Index=Slider(0, range=0..101), Wrap=True)
custom_preview = CustomPreview(Geometry=list_item, Material=ColourSwatch(SwatchColor=RGB(0, 0, 0)))

# ---- group: merge actions
merge = Merge(Data1=motionmode, Data2=speedto, Data3=transformto)

# ---- group: generate program
# program
boolean_toggle = BooleanToggle(True)
actions = Panel(merge)
compileprogram = CompileProgram(Robot=createrobot, Actions=merge, InLineTargets=boolean_toggle, Comments=Toggle(True))

# ---- group: save program
# output
c_script = CSharpScript()  # -> out, here
# ---------- c_script: C# usings ----------
using System.IO;
# ---------- c_script: C# ----------
    string targetFolder = "";

    GH_Document gh_d = owner.OnPingDocument();
    if (gh_d.IsFilePathDefined)
    {
      string ghFilePath = gh_d.FilePath;
      targetFolder = Path.GetDirectoryName(ghFilePath);
    }
    else
    {
      Print("No local folder found, please save your file locally.");
    }

    here = targetFolder;
# ---------- end c_script ----------
saveprogram = SaveProgram(Robot=createrobot, RobotProgram=compileprogram, Path=c_script.here)
panel_3 = Panel(saveprogram)

# ---- group: print program
displayprogram = DisplayProgram(RobotProgram=compileprogram)
panel_4 = Panel(displayprogram)

# ---- group: set workspace
# workspace
panel_5 = Panel("250,600,0")
rectangle_2pt = Rectangle2Pt(Plane=PlaneXY(0, 0, 0), PointA=panel_5, PointB="1150,-600,0", Radius=0)  # -> Rectangle, Length
rectangle = Rectangle(Plane=PlaneXY(0, 0, 0), XSize="250", YSize="250", Radius=0)  # -> Rectangle, Length
custom_preview_2 = CustomPreview(Geometry=rectangle_2pt.Rectangle, Material=ColourSwatch(SwatchColor=RGB(255, 255, 255)))

# ----
area = Area(Geometry=rectangle_2pt.Rectangle)  # -> Area, Centroid
area_2 = Area(Geometry=rectangle.Rectangle)  # -> Area, Centroid

# ---- group: set workspace (continued)
vector_2pt = Vector2Pt(PointA=area_2.Centroid, PointB=area.Centroid, Unitize=False)  # -> Vector, Length
move = Move(Geometry=rectangle.Rectangle, Motion=vector_2pt.Vector)  # -> Geometry, Transform
custom_preview_3 = CustomPreview(Geometry=move.Geometry, Material=ColourSwatch(SwatchColor=RGB(209, 209, 209)))
workspace = Curve(move.Geometry)
work_zero = Point(area.Centroid)
