# Grasshopper definition machina-ur10e-slime-mold.gh (Grasshopper 1.0.7)
# plug-ins: MeshEdit Components, Nuclei, Machina

# ---- group: create robot system
# using machina
panel = Panel("UR")
# system
panel_2 = Panel("slime_mold")
# UR10e
# real-time control
# slime mold
createrobot = CreateRobot(Name=panel_2, Brand=panel)

# ----
# commands
Y = Slider(150, range=0..500)

# ---- group: slime mold
# slime mold
# using nuclei
# enable the timer
# then toogle reset
# to fasle to start
# using nuclei
# using meshedit
# using nuclei
X = Slider(100, range=0..500)
environment_constructor = EnvironmentConstructor(VoxelSize=1, XVoxels=X, YVoxels=Y)  # -> OutputVoxels, OutputVoxelPositions, OutputVoxelAddresses
cull_pattern = CullPattern(List=environment_constructor.OutputVoxelPositions, CullPattern=[False, True, False, False, False, False])
distance = Slider(3.25, range=0..10)
deposit = Slider(1.5, range=0..10)
construct_particles = ConstructParticles(InitialParticles=cull_pattern, Speed=1, SensorDistance=distance, SensorAngle=45, RotationAngle=45, Deposit=deposit)
timer = Timer(TimerInterval=20, Target=nuclei_solver)  # disabled
nuclei_solver = NucleiSolver(Reset=Toggle(False), Voxels=environment_constructor.OutputVoxels, Particles=construct_particles)  # -> Iteration, OutputParticles, OutputParticleAngle, OutputVoxelDensities
panel_3 = Panel(nuclei_solver.Iteration)
gradient = Gradient(LowerLimit=0, UpperLimit=1, Parameter=nuclei_solver.OutputVoxelDensities, stops=[0: RGB(255, 255, 255), 1: RGB(0, 0, 0)])
mesh_frompoints = MeshFromPoints(Points=environment_constructor.OutputVoxelPositions, UDirection=X, VDirection=Y, Colour=gradient)
point = Point(nuclei_solver.OutputParticles)

# ---- group: set initial speed
speed = Slider(25, range=0..100)
speedto = SpeedTo(Speed=speed, Relative=False)

# ---- group: wait
time = Slider(500, range=0..5000)
wait = Wait(Time=time)

# ---- group: set speed
speed_2 = Slider(50, range=0..100)
speedto_2 = SpeedTo(Speed=speed_2, Relative=False)

# ---- group: move home
# set home position
# using joint rotation angles
# in degrees
panel_4 = Panel("0")
axesto = AxesTo(A1=panel_4, A2="-90", A3="-90", A4="-90", A5="90", A6=panel_4, Relative=False)

# set home position
# using joint rotation angles
# in degrees
panel_5 = Panel("0")
axesto_2 = AxesTo(A1=panel_5, A2="-90", A3="-90", A4="-90", A5="90", A6=panel_5, Relative=False)

# ----
# MoveJ
motionmode = MotionMode(MotionMode=1)

# ----
# workspace
panel_6 = Panel("0,0,-60")
# paper
panel_7 = Panel("1300,-600,0")
xy_plane = XYPlane(Origin=panel_6)
rectangle_2pt = Rectangle2Pt(Plane=xy_plane, PointA="400,600,0", PointB=panel_7, Radius=0)  # -> Rectangle, Length
custom_preview = CustomPreview(Geometry=rectangle_2pt.Rectangle, Material=ColourSwatch(SwatchColor=RGB(255, 255, 255)))

xy_plane_2 = XYPlane(Origin="0,0,-60")
rectangle_2pt_2 = Rectangle2Pt(Plane=xy_plane_2, PointA="500,200,0", PointB="950,-400,0", Radius=0)  # -> Rectangle, Length
boundary_surfaces = BoundarySurfaces(Edges=rectangle_2pt_2.Rectangle)
custom_preview_2 = CustomPreview(Geometry=boundary_surfaces, Material=ColourSwatch(SwatchColor=RGBA(255, 255, 255, 70)))

# ---- group: cull and order points
# using sequential
# closest point
point_2 = Point(point)
X_2 = Number(X)
Y_2 = Number(Y)
scale = Slider(0.96, range=0..1)
culling = Slider(0.6, range=0..2)
rectangle = Rectangle(Plane=PlaneXY(0, 0, 0), XSize=X_2, YSize=Y_2, Radius=0)  # -> Rectangle, Length
polygon_center = PolygonCenter(Polyline=rectangle.Rectangle)  # -> CenterV, CenterE, CenterA
scale_2 = Scale(Geometry=rectangle.Rectangle, Center=polygon_center.CenterA, Factor=scale)  # -> Geometry, Transform
point_in_curve = PointInCurve(Point=point_2, Curve=scale_2.Geometry)  # -> Relationship, Point
equality = Equality(FirstNumber=point_in_curve.Relationship, SecondNumber="2")  # -> Equality, Inequality
dispatch = Dispatch(List=point_in_curve.Point, DispatchPattern=equality.Equality)  # -> ListA, ListB
cull_duplicates = CullDuplicates(Points=dispatch.ListA, Tolerance=culling, CullMode=3)  # -> Points, Indices, Valence
sequential_closest_points = SequentialClosestPoints(P=polygon_center.CenterA, S=cull_duplicates.Points)  # -> A, I; inputs P: Point3d, S: list of Point3d
# ---------- sequential_closest_points: VB ----------
    Component.Params.Input(0).Name = "Sample Point"
    Component.Params.Input(0).Description = "The point to start from"
    Component.Params.Input(1).Name = "Sample Point List"
    Component.Params.Input(1).Description = "The list of points to be sequentially sampled"

    Component.Params.Output(0).Name = "Point List"
    Component.Params.Output(0).Description = "The sorted list of points"
    Component.Params.Output(1).Name = "Indices"
    Component.Params.Output(1).Description = "The parallel sorted list of indices"

    Dim k,j As Integer
    Dim pt As point3d
    Dim pts As New point3dList
    Dim ptList As New list(Of point3d)
    Dim srsEnum As IEnumerable(Of Integer) = Enumerable.Range(0, S.count())
    Dim srsList As New list (Of Integer)
    Dim intList As New list(Of Integer)
    pts.AddRange(S.toarray())

    Pt = P

    srsList = srsEnum.tolist()

    For k = 0 To pts.Count() - 1 Step 1
      j = pts.ClosestIndex(pt)
      ptList.add(pts.item(j))
      intList.add(srsList.item(j))
      pt = pts.item(j)
      pts.RemoveAt(j)
      srsList.RemoveAt(j)
    Next

    A = ptList
    I = intList
# ---------- end sequential_closest_points ----------
point_3 = Point(sequential_closest_points.A)

# ---- group: generate path
point_4 = Point(point_3)
scale_3 = Slider(3, range=0..36)
program_zero = Panel("575,-350,-62")
engage_retract = Slider(15, range=0..100)
brush_height = Slider(3, range=0..10)
scale_nu = ScaleNU(Geometry=point_4, Plane=PlaneXY(0, 0, 0), ScaleX=scale_3, ScaleY=scale_3, ScaleZ=1)  # -> Geometry, Transform
list_length = ListLength(List=point_4)
xy_plane_3 = XYPlane(Origin=Point(0, 0, 0))
random = Random(Range=brush_height, Number=list_length, Seed=2)
vector_2pt = Vector2Pt(PointA=xy_plane_3, PointB=program_zero, Unitize=False)  # -> Vector, Length
move = Move(Geometry=scale_nu.Geometry, Motion=vector_2pt.Vector)  # -> Geometry, Transform
unit_z = UnitZ(Factor=random)
unit_z_2 = UnitZ(Factor=engage_retract)
move_2 = Move(Geometry=move.Geometry, Motion=unit_z)  # -> Geometry, Transform
list_length_2 = ListLength(List=point_4)
move_3 = Move(Geometry=move_2.Geometry, Motion=unit_z_2)  # -> Geometry, Transform
series = Series(Start=0, Step=1, Count=list_length_2)
insert_items = InsertItems(List=move_2.Geometry, Item=move_3.Geometry, Indices=series, Wrap=True)
pl = ConstructPlane(Origin=insert_items, XAxis="-1,0,0", YAxis=Vector(0, 1, 0))
point_order = PointOrder(Points=insert_items)
transformto = TransformTo(Plane=pl, Relative=False)  # -> flatten(Action)

# ---- group: merge actions
# program
merge = Merge(Data1=axesto, Data2=motionmode, Data3=speedto, Data4=transformto, Data5=wait, Data6=speedto_2, Data7=axesto_2)
panel_8 = Panel(merge)

# ---- group: generate program
compileprogram = CompileProgram(Robot=createrobot, Actions=merge, InLineTargets=Toggle(True), Comments=Toggle(True))

# ---- group: save program
# output
# stream
c_script = CSharpScript()  # -> out, here
# ---------- c_script: C# usings ----------
using System.IO;
# ---------- c_script: C# ----------
    string targetFolder = "";

    GH_Document gh_d = owner.OnPingDocument();
    if (gh_d.IsFilePathDefined)
    {
      string ghFilePath = gh_d.FilePath;
      targetFolder = Path.GetDirectoryName(ghFilePath);
    }
    else
    {
      Print("No local folder found, please save your file locally.");
    }

    here = targetFolder;
# ---------- end c_script ----------
saveprogram = SaveProgram(Robot=createrobot, RobotProgram=compileprogram, Path=c_script.here)
panel_9 = Panel(saveprogram)

# ---- group: stream program via machina bridge
connect_to_bridge = BooleanToggle(False)
send_program = Button()
connect = Connect(URL="ws://127.0.0.1:6999/Bridge", Name="Grasshopper", Connect=connect_to_bridge)  # -> Status, Bridge
send = Send(Bridge=connect.Bridge, Actions=merge, Send=send_program)  # -> Sent, Instructions
listen = Listen(Bridge=connect.Bridge, Autoupdate=True, Interval=66)
panel_10 = Panel(connect.Status)
actionexecuted = ActionExecuted(BridgeMessage=listen)  # -> LastAction, ActionTCP, ActionAxes, ActionExternalAxes, PendingActions, PendingActionsOnDevice
panel_11 = Panel(send.Sent)
panel_12 = Panel(send.Instructions)
panel_13 = Panel(actionexecuted.PendingActions)
panel_14 = Panel(actionexecuted.LastAction)
data_recorder = DataRecorder(actionexecuted.ActionTCP, DataLimit=-10, RecordData=True)
plane = Plane(data_recorder)

# ---- group: print program
displayprogram = DisplayProgram(RobotProgram=compileprogram)
panel_15 = Panel(displayprogram)
