# Grasshopper definition machina-ur10e-vector-drawing.gh (Grasshopper 1.0.7)
# plug-ins: Machina

# ---- group: create robot system
# using machina
panel = Panel("UR")
# system
panel_2 = Panel("vector_drawing")
# UR10e
# real-time control
# move to point
createrobot = CreateRobot(Name=panel_2, Brand=panel)

# ---- group: set initial speed
# commands
speed = Slider(10, range=0..100)
speedto = SpeedTo(Speed=speed, Relative=False)

# ---- group: wait
time = Slider(1000, range=0..5000)
wait = Wait(Time=time)

# ---- group: set speed
speed_2 = Slider(50, range=0..100)
speedto_2 = SpeedTo(Speed=speed_2, Relative=False)

# ---- group: generate waypoints
curve = Curve([<curve referenced from the Rhino model> x196])
initial_brush_height = Slider(-120, range=-300..300)
distance = Slider(25, range=0..100)
list_length = ListLength(List=curve)
unit_z = UnitZ(Factor=initial_brush_height)
move = Move(Geometry=curve, Motion=unit_z)  # -> Geometry, Transform
divide_distance = DivideDistance(Curve=move.Geometry, Distance=distance)  # -> Points, Tangents, Parameters

# ----
engage_retract = Slider(36, range=0..100)

# ---- group: move home
# set home position
# using joint rotation angles
# in degrees
panel_3 = Panel("0")
axesto = AxesTo(A1=panel_3, A2="-90", A3="-90", A4="-90", A5="90", A6=panel_3, Relative=False)

# ----
# MoveJ
motionmode = MotionMode(MotionMode=1)

# ----
# workspace
panel_4 = Panel("400,600,0")
rectangle_2pt = Rectangle2Pt(Plane=PlaneXY(0, 0, 0), PointA=panel_4, PointB="1300,-600,0", Radius=0)  # -> Rectangle, Length
rectangle = Rectangle(Plane=PlaneXY(0, 0, 0), XSize="450", YSize="600", Radius=0)  # -> Rectangle, Length
polygon_center = PolygonCenter(Polyline=rectangle_2pt.Rectangle)  # -> CenterV, CenterE, CenterA
polygon_center_2 = PolygonCenter(Polyline=rectangle.Rectangle)  # -> CenterV, CenterE, CenterA
vector_2pt = Vector2Pt(PointA=polygon_center_2.CenterA, PointB=polygon_center.CenterA, Unitize=False)  # -> Vector, Length
move_2 = Move(Geometry=rectangle.Rectangle, Motion=vector_2pt.Vector)  # -> Geometry, Transform
custom_preview = CustomPreview(Geometry=rectangle_2pt.Rectangle, Material=ColourSwatch(SwatchColor=RGB(255, 255, 255)))
custom_preview_2 = CustomPreview(Geometry=move_2.Geometry, Material=ColourSwatch(SwatchColor=RGB(209, 209, 209)))
centroid = Point(polygon_center.CenterA)
paper = Curve(move_2.Geometry)

# ---- group: engage with start points
unit_z_2 = UnitZ(Factor=engage_retract)
list_item = ListItem(List=divide_distance.Points, Index="0", Wrap=True)
move_3 = Move(Geometry=list_item, Motion=unit_z_2)  # -> Geometry, Transform
insert_items = InsertItems(List=divide_distance.Points, Item=move_3.Geometry, Indices="0", Wrap=True)

# ---- group: inkwell
paper_2 = Curve(move_2.Geometry)
discontinuity = Discontinuity(Curve=paper_2, Level=1)  # -> Points, Parameters
list_item_2 = ListItem(List=discontinuity.Points, Index=0, Wrap=True)
ink_well = Point(list_item_2)

# ----
ink_well_2 = Point(ink_well)
move_4 = Move(Geometry=ink_well_2, Motion=unit_z)  # -> Geometry, Transform

# ---- group: retract from end points
list_length_2 = ListLength(List=insert_items)
unit_z_3 = UnitZ(Factor=engage_retract)
list_item_3 = ListItem(List=insert_items, Index=expr("x-1", list_length_2), Wrap=True)
move_5 = Move(Geometry=list_item_3, Motion=unit_z_3)  # -> Geometry, Transform
insert_items_2 = InsertItems(List=insert_items, Item=move_5.Geometry, Indices=list_length_2, Wrap=True)

# ---- group: transform to planes
construct_plane = ConstructPlane(Origin=flatten(insert_items_2), XAxis="-1,0,0", YAxis=Vector(0, 1, 0))
transformto = TransformTo(Plane=construct_plane, Relative=False)  # -> flatten(Action)

# ---- group: merge actions
# program
merge = Merge(Data1=motionmode, Data2=speedto, Data3=transformto, Data4=wait, Data5=speedto_2, Data6=axesto)
panel_5 = Panel(merge)

# ---- group: generate program
compileprogram = CompileProgram(Robot=createrobot, Actions=merge, InLineTargets=Toggle(True), Comments=Toggle(True))

# ---- group: save program
# output
c_script = CSharpScript()  # -> out, here
# ---------- c_script: C# usings ----------
using System.IO;
# ---------- c_script: C# ----------
    string targetFolder = "";

    GH_Document gh_d = owner.OnPingDocument();
    if (gh_d.IsFilePathDefined)
    {
      string ghFilePath = gh_d.FilePath;
      targetFolder = Path.GetDirectoryName(ghFilePath);
    }
    else
    {
      Print("No local folder found, please save your file locally.");
    }

    here = targetFolder;
# ---------- end c_script ----------
saveprogram = SaveProgram(Robot=createrobot, RobotProgram=compileprogram, Path=c_script.here)
panel_6 = Panel(saveprogram)

# ---- group: print program
displayprogram = DisplayProgram(RobotProgram=compileprogram)
panel_7 = Panel(displayprogram)
