# Grasshopper definition machina-ur5e-sand-modeling.gh (Grasshopper 1.0.7)
# plug-ins: Machina, Heteroptera, Pufferfish

# ---- group: create robot system
# system
# using machina
panel = Panel("sand_modeling")
# UR10e
# real-time control
# move to point
createrobot = CreateRobot(Name=panel, Brand="UR")

# ---- group: set initial speed
# commands
speed = Slider(36, range=0..100)
speedto = SpeedTo(Speed=speed, Relative=False)

# ---- group: set speed
speed_2 = Slider(20, range=0..100)
speedto_2 = SpeedTo(Speed=speed_2, Relative=False)

# ---- group: wait
time = Slider(1000, range=0..5000)
wait = Wait(Time=time)

# ---- group: set speed
speed_3 = Slider(50, range=0..100)
speedto_3 = SpeedTo(Speed=speed_3, Relative=False)

# ---- group: move home
# set home position
# using joint rotation angles
# in degrees
panel_2 = Panel("0")
axesto = AxesTo(A1=panel_2, A2="-90", A3="-90", A4="-90", A5="90", A6=panel_2, Relative=False)

# ----
# MoveJ
motionmode = MotionMode(MotionMode=1)

panel_3 = Panel("400,600,0")
panel_4 = Panel("1300,-600,0")

# ---- group: loft from series of sine curves
# landforms from sine curves
frequency = Slider(5, range=0..10)
steps = Slider(7, range=0..10)
amplitude = Slider(0.32, range=0..1)
count = Slider(6, range=0..10)
distance = Slider(60, range=0..100)
scale = Slider(10, range=0..100)
pi = Pi(Factor=frequency)
series = Series(Start=0, Step=amplitude, Count=count)  # -> graft(Series)
range = Range(Domain=pi, Steps=steps)
multiplication = Multiplication(A=range, B=series)
sine = Sine(Value=multiplication)
construct_point = ConstructPoint(XCoordinate=range, YCoordinate=0, ZCoordinate=sine)
series_2 = Series(Start=0, Step=distance, Count=count)
interpolate = Interpolate(Vertices=construct_point, Degree=3, Periodic=False, KnotStyle=1)  # -> Curve, Length, Domain
scale_2 = Scale(Geometry=interpolate.Curve, Center=Point(0, 0, 0), Factor=scale)  # -> Geometry, Transform
unit_y = UnitY(Factor=series_2)
curve = Curve(flatten(scale_2.Geometry))
move = Move(Geometry=curve, Motion=unit_y)  # -> Geometry, Transform
loft = Loft(Curves=move.Geometry, Options={Adjust=False, Closed=False, LoftEnds=0, LoftSimp=0, LoftType=0, Rebuild=10, Refit=0.01})
landform = Brep(loft)

# ----
Z = Slider(30, range=0..100)
negative = Negative(Value=Z)
unit_z = UnitZ(Factor=negative)
panel_5 = Panel("""0
1
2""")

# ---- group: stream program via machina bridge
connect_to_bridge = BooleanToggle(False)
send_program = Button()
connect = Connect(URL="ws://127.0.0.1:6999/Bridge", Name="Grasshopper", Connect=connect_to_bridge)  # -> Status, Bridge
listen = Listen(Bridge=connect.Bridge, Autoupdate=True, Interval=66)
panel_6 = Panel(connect.Status)
actionexecuted = ActionExecuted(BridgeMessage=listen)  # -> LastAction, ActionTCP, ActionAxes, ActionExternalAxes, PendingActions, PendingActionsOnDevice
panel_7 = Panel(actionexecuted.LastAction)
data_recorder = DataRecorder(actionexecuted.ActionTCP, DataLimit=-10, RecordData=True)
panel_8 = Panel(actionexecuted.PendingActions)
plane = Plane(data_recorder)

# ---- group: safe workspace
Z_2 = Slider(-75, range=-100..0)
# workspace
rectangle_2pt = Rectangle2Pt(Plane=PlaneXY(0, 0, 0), PointA="400,200,0", PointB="850,-200,0", Radius=0)  # -> Rectangle, Length
polygon_center = PolygonCenter(Polyline=rectangle_2pt.Rectangle)  # -> CenterV, CenterE, CenterA
unit_z_2 = UnitZ(Factor="-240")
unit_z_3 = UnitZ(Factor=Z_2)
move_2 = Move(Geometry=polygon_center.CenterA, Motion=unit_z_3)  # -> Geometry, Transform

# ----
move_3 = Move(Geometry=rectangle_2pt.Rectangle, Motion=unit_z_2)  # -> Geometry, Transform
rotate = Rotate(Geometry=move_3.Geometry, Angle=degrees("-90"), Plane=PlaneXY(0, 0, 0))  # -> Geometry, Transform
rotate_2 = Rotate(Geometry=move_2.Geometry, Angle=degrees("-90"), Plane=PlaneXY(0, 0, 0))  # -> Geometry, Transform

# ---- group: safe workspace (continued)
custom_preview = CustomPreview(Geometry=rotate.Geometry, Material=ColourSwatch(SwatchColor=RGB(255, 255, 255)))
work_zero = Point(rotate_2.Geometry)

# ---- group: move to point
work_zero_2 = Point(work_zero)
moveto = MoveTo(Point=work_zero_2, Relative=False)

# ----
work_zero_3 = Point(work_zero)
panel_9 = Panel(work_zero)

# ---- group: model
rectangle = Rectangle(Plane=move_3.Geometry, XSize="180", YSize="300", Radius=0)  # -> Rectangle, Length
polygon_center_2 = PolygonCenter(Polyline=rectangle.Rectangle)  # -> CenterV, CenterE, CenterA
vector_2pt = Vector2Pt(PointA=polygon_center_2.CenterA, PointB=work_zero_3, Unitize=False)  # -> Vector, Length
move_4 = Move(Geometry=rectangle.Rectangle, Motion=vector_2pt.Vector)  # -> Geometry, Transform

# ----
rotate_3 = Rotate(Geometry=move_4.Geometry, Angle=degrees("-90"), Plane=work_zero_3)  # -> Geometry, Transform

# ---- group: model (continued)
custom_preview_2 = CustomPreview(Geometry=rotate_3.Geometry, Material=ColourSwatch(SwatchColor=RGB(209, 209, 209)))
model = Curve(rotate_3.Geometry)

# ----
control_points = ControlPoints(Curve=model)  # -> Points, Weights, Knots
list_item = ListItem(List=control_points.Points, Index=Slider(2, range=0..4), Wrap=True)
panel_10 = Panel(list_item)

# ---- group: points from landform
# using heteroptera
landform_2 = Brep(landform)
centroid = Point(work_zero)
center = Center(Geometry=landform_2)  # -> Center, Dimension
vector_2pt_2 = Vector2Pt(PointA=center.Center, PointB=centroid, Unitize=False)  # -> Vector, Length
move_5 = Move(Geometry=landform_2, Motion=vector_2pt_2.Vector)  # -> Geometry, Transform
U = Slider(60, range=0..100)
V = Slider(36, range=0..100)
rebuild_surface = RebuildSurface(Surface=move_5.Geometry, CountU=U, CountV=V)
surface_points = SurfacePoints(Surface=rebuild_surface)  # -> Points, Weights, Greville, UCount, VCount

# ----
rotate_4 = Rotate(Geometry=surface_points.Points, Angle=degrees("-90"), Plane=work_zero_3)  # -> Geometry, Transform

# ---- group: points from landform (continued)
custom_preview_3 = CustomPreview(Geometry=rotate_4.Geometry, Material=ColourSwatch(SwatchColor=RGB(82, 82, 82)))
point = Point(rotate_4.Geometry)

# ----
point_2 = Point(point)
move_6 = Move(Geometry=point_2, Motion=unit_z)  # -> Geometry, Transform
weave = Weave(Pattern=panel_5, Stream0=point_2, Stream1=move_6.Geometry, Stream2=point_2, NullGaps=False)
moveto_2 = MoveTo(Point=flatten(weave), Relative=False)

# ---- group: merge actions
# program
merge = Merge(Data1=motionmode, Data2=speedto, Data3=moveto, Data4=speedto_2, Data5=moveto_2, Data6=wait, Data7=speedto_3)
panel_11 = Panel(merge)

# ---- group: generate program
compileprogram = CompileProgram(Robot=createrobot, Actions=merge, InLineTargets=Toggle(True), Comments=Toggle(True))

# ---- group: save program
# output
# stream
c_script = CSharpScript()  # -> out, here
# ---------- c_script: C# usings ----------
using System.IO;
# ---------- c_script: C# ----------
    string targetFolder = "";

    GH_Document gh_d = owner.OnPingDocument();
    if (gh_d.IsFilePathDefined)
    {
      string ghFilePath = gh_d.FilePath;
      targetFolder = Path.GetDirectoryName(ghFilePath);
    }
    else
    {
      Print("No local folder found, please save your file locally.");
    }

    here = targetFolder;
# ---------- end c_script ----------
saveprogram = SaveProgram(Robot=createrobot, RobotProgram=compileprogram, Path=c_script.here)
panel_12 = Panel(saveprogram)

# ---- group: stream program via machina bridge (continued)
send = Send(Bridge=connect.Bridge, Actions=merge, Send=send_program)  # -> Sent, Instructions
panel_13 = Panel(send.Sent)
panel_14 = Panel(send.Instructions)

# ---- group: print program
displayprogram = DisplayProgram(RobotProgram=compileprogram)
panel_15 = Panel(displayprogram)
