# Grasshopper definition ur5e-random-move.gh (Grasshopper 1.0.7)
# Copyright: GNU General Public License 3.0
# plug-ins: Machina

# ---- group: system
# program
panel = Panel("random_move")
brand = ValueList({"ABB", "UR", "KUKA", "ZMorph", "HUMAN"}, selected="UR")
# UR5e
# random move
robot_create = RobotCreate(Name=panel, Brand=brand)

# ---- group: workspace
rectangle_2pt = Rectangle2Pt(Plane=PlaneXY(0, 0, 0), PointA="125,-250,0", PointB="625,250,0", Radius=0)  # -> Rectangle, Length

# ---- group: random paths
rectangle = Rectangle(rectangle_2pt.Rectangle)
count = Slider(100, range=0..100)
engage = Slider(100, range=0..1000)
height = Slider(25, range=0..100)
# geometry
boundary_surfaces = BoundarySurfaces(Edges=rectangle)
populate_geometry = PopulateGeometry(Geometry=boundary_surfaces, Count=count, Seed=1)
random = Random(Range=height, Number=count, Seed=2)
unit_z = UnitZ(Factor=random)
move = Move(Geometry=populate_geometry, Motion=unit_z)  # -> Geometry, Transform
unit_z_2 = UnitZ(Factor=engage)
move_2 = Move(Geometry=populate_geometry, Motion=unit_z_2)  # -> Geometry, Transform
weave = Weave(Pattern=[0, 1], Stream0=move_2.Geometry, Stream1=move.Geometry, NullGaps=False)
point = Point(weave)

# ---- group: actions
number_slider = Slider(30, range=0..100)
point_2 = Point(point)
speedto = SpeedTo(Speed=number_slider, Relative=False)
moveto = MoveTo(Point=point_2, Relative=False)
motionmode = MotionMode(MotionMode=1)

# ---- group: program
merge = Merge(Data1=motionmode, Data2=speedto, Data3=moveto)  # -> flatten(Result)
compileprogram = CompileProgram(Robot=robot_create, Actions=merge, InLineTargets=True, Comments=True)
file_path = FilePath("C:\Users\baharmon\Downloads\")
saveprogram = SaveProgram(Robot=robot_create, RobotProgram=compileprogram, Path=file_path)
displayprogram = DisplayProgram(RobotProgram=compileprogram)
panel_2 = Panel(displayprogram)
