# Grasshopper definition machina-pick-and-place.gh (Grasshopper 1.0.8)
# plug-ins: Machina

# ---- group: set joint motion
# modes
motionmode = MotionMode(MotionMode=1)
joint = Data(motionmode)

# ---- group: close gripper
# gripper
close_gripper = Panel("""rq_set_pos_spd_for(255, 51, 26, "1")
  rq_wait_pos_spe_for_request(255, 51, 26, "1")
  rq_go_to("1")
  rq_wait("1")""")
customcode = CustomCode(Statement=close_gripper, IsDeclaration=False)
close = Data(customcode)

# ---- group: open gripper
open_gripper = Panel("""rq_set_pos_spd_for(0, 51, 26, "1")
  rq_wait_pos_spe_for_request(0, 51, 26, "1")
  rq_go_to("1")
  rq_wait("1")""")
customcode_2 = CustomCode(Statement=open_gripper, IsDeclaration=False)
action = Data(customcode_2)

# ---- group: wait
# wait
milliseconds = Panel("1000")
wait = Wait(Time=milliseconds)
wait_2 = Data(wait)

# ---- group: set pick point
# operations
# inputs
pick = Point(Point(180, -600, -290))

# ---- group: move above pickup position
# moves
pick_2 = Plane(pick)
unit_z = UnitZ(Factor="200")
move = Move(Geometry=pick_2, Motion=unit_z)  # -> Geometry, Transform
plane_normal = PlaneNormal(Origin=move.Geometry, ZAxis="0,0,-1")
rotate = Rotate(Geometry=plane_normal, Angle=degrees("90"), Plane=plane_normal)  # -> Geometry, Transform
transformto = TransformTo(Plane=rotate.Geometry, Relative=False)
entry = Data(transformto)

# ---- group: move to pickup position
pick_3 = Plane(pick)
plane_normal_2 = PlaneNormal(Origin=pick_3, ZAxis="0,0,-1")
rotate_2 = Rotate(Geometry=plane_normal_2, Angle=degrees("90"), Plane=plane_normal_2)  # -> Geometry, Transform
transformto_2 = TransformTo(Plane=rotate_2.Geometry, Relative=False)
pick_4 = Data(transformto_2)

# ---- group: set place point
# pick & place
# UR5e
place = Point(Point(-180, -600, -290))

# ---- group: move above pickup position
place_2 = Plane(place)
unit_z_2 = UnitZ(Factor="200")
move_2 = Move(Geometry=place_2, Motion=unit_z_2)  # -> Geometry, Transform
plane_normal_3 = PlaneNormal(Origin=move_2.Geometry, ZAxis="0,0,-1")
rotate_3 = Rotate(Geometry=plane_normal_3, Angle=degrees("90"), Plane=plane_normal_3)  # -> Geometry, Transform
transformto_3 = TransformTo(Plane=rotate_3.Geometry, Relative=False)
entry_2 = Data(transformto_3)

# ---- group: move to pickup position
place_3 = Plane(place)
plane_normal_4 = PlaneNormal(Origin=place_3, ZAxis="0,0,-1")
rotate_4 = Rotate(Geometry=plane_normal_4, Angle=degrees("90"), Plane=plane_normal_4)  # -> Geometry, Transform
transformto_4 = TransformTo(Plane=rotate_4.Geometry, Relative=False)
place_4 = Data(transformto_4)

# ---- group: set linear motion
motionmode_2 = MotionMode(MotionMode=0)
linear = Data(motionmode_2)

# ----
# processes
# pick
joint_2 = Data(joint)
linear_2 = Data(linear)

# ---- group: pick
entry_3 = Data(entry)
pick_5 = Data(pick_4)
close_2 = Data(close)
wait_3 = Data(wait_2)
wait_4 = Data(wait_2)
# place
exit = Data(entry)
merge = Merge(Data1=joint_2, Data2=entry_3, Data3=linear_2, Data4=pick_5, Data5=wait_4, Data6=close_2, Data7=wait_3, Data8=exit)

# ----
joint_3 = Data(joint)
linear_3 = Data(linear)

# ---- group: place
entry_4 = Data(entry_2)
place_5 = Data(place_4)
open = Data(action)
wait_5 = Data(wait_2)
wait_6 = Data(wait_2)
exit_2 = Data(entry_2)
merge_2 = Merge(Data1=joint_3, Data2=entry_4, Data3=linear_3, Data4=place_5, Data5=wait_6, Data6=open, Data7=wait_5, Data8=exit_2)

# ---- group: create robot system
# compilation
# system
# using machina
panel = Panel("pick_and_place")
createrobot = CreateRobot(Name=panel, Brand="UR")
robot = Data(createrobot)

# ---- group: generate program
actions = Data(flatten([merge, merge_2]))
# program
robot_2 = Data(robot)
compileprogram = CompileProgram(Robot=robot_2, Actions=actions, InLineTargets=Toggle(True), Comments=Toggle(False))
robotprogram = Data(compileprogram)

# ---- group: save program
c_script = CSharpScript()  # -> out, here
# ---------- c_script: C# usings ----------
using System.IO;
# ---------- c_script: C# ----------
    string targetFolder = "";

    GH_Document gh_d = owner.OnPingDocument();
    if (gh_d.IsFilePathDefined)
    {
      string ghFilePath = gh_d.FilePath;
      targetFolder = Path.GetDirectoryName(ghFilePath);
    }
    else
    {
      Print("No local folder found, please save your file locally.");
    }

    here = targetFolder;
# ---------- end c_script ----------
# output
robot_3 = Data(robot)
robotprogram_2 = Data(robotprogram)
saveprogram = SaveProgram(Robot=robot_3, RobotProgram=robotprogram_2, Path=c_script.here)
panel_2 = Panel(saveprogram)

# ---- group: print program
robotprogram_3 = Data(robotprogram)
displayprogram = DisplayProgram(RobotProgram=robotprogram_3)
panel_3 = Panel(displayprogram)
