# Grasshopper definition machina-procedural-wall.gh (Grasshopper 1.0.8)
# plug-ins: BitmapPlus, Machina

# ----
# procedural wall
# procedural noise
# bitmap+
seed = Slider(0, range=0..100)
width = Slider(36, range=0..100)
height = Slider(32, range=0..100)
depth = Slider(5000, range=0..10000)
list = ValueList({"Value": 0, "Perlin": 1, "Cubic": 2, "Simplex": 3, "WhiteNoise": 4}, selected="Perlin")
list_2 = ValueList({"Linear": 0, "Hermite": 1, "Quintic": 2}, selected="Hermite")
# construct grid
frequency = Slider(0.094, range=0..0.1)
# robotic wall
procedural_noise = ProceduralNoise(Seed=seed, Width=width, Height=height, Depth=depth, Mode=list, Interpolation=list_2, Frequency=frequency)  # -> Image, Noise
prev_image = PrevImage(SmartBitmap=procedural_noise.Image)
# UR5e
image = Data(procedural_noise.Image)

image_2 = Data(image)
bitmap_properties = BitmapProperties(Image=image_2)  # -> Boundary, Width, Height, HorizontalResolution, VerticalResolution, Format
mesh_plane = MeshPlane(
    Boundary=bitmap_properties.Boundary,
    WidthCount=expr("x-1", bitmap_properties.Width),
    HeightCount=expr("x-1", bitmap_properties.Height))  # -> Mesh, Area
xz_plane = XZPlane(Origin=Point(0, 0, 0))
orient = Orient(Geometry=mesh_plane.Mesh, Source=PlaneXY(0, 0, 0), Target=xz_plane)  # -> Geometry, Transform
deconstruct_mesh = DeconstructMesh(Mesh=orient.Geometry)  # -> Vertices, Faces, Colours, Normals
mesh_face = MeshFace(deconstruct_mesh.Faces)
point = Point(deconstruct_mesh.Vertices)

image_3 = Data(image_2)
# extract noise
deconstruct_bitmap = DeconstructBitmap(Image=image_3)
split_ahsv = SplitAHSV(Colour=deconstruct_bitmap)  # -> Alpha, Hue, Saturation, Value
noise = Number(split_ahsv.Value)

# ----
# 3D mesh
point_2 = Point(point)
mesh_face_2 = MeshFace(mesh_face)
y_factor = Slider(4, range=0..10)
noise_2 = Number(noise)
multiplication = Multiplication(A=y_factor, B=noise_2)
unit_y = UnitY(Factor=multiplication)
gradient = Gradient(
    LowerLimit=0,
    UpperLimit=1,
    Parameter=noise_2,
    stops=[0: RGB(68, 1, 84), 0.167: RGB(68, 57, 131), 0.334: RGB(49, 104, 142), 0.501: RGB(33, 145, 140), 0.668: RGB(53, 183, 121), 0.835: RGB(144, 215, 67), 1: RGB(253, 231, 37)])
move = Move(Geometry=point_2, Motion=unit_y)  # -> Geometry, Transform
construct_mesh = ConstructMesh(Vertices=move.Geometry, Faces=mesh_face_2, Colours=gradient)
mesh = Mesh(construct_mesh)

# ---- group: parametric module
# module
X = Slider(6, range=0..10)
Y = Slider(4, range=0..10)
Z = Slider(2, range=0..10)
domain_box = DomainBox(Base=PlaneXY(0, 0, 0), X=X, Y=Y, Z=Z)
module = Brep(domain_box)

# ----
# contour
mesh_2 = Mesh(mesh)
Z_2 = Number(Z)
count = Slider(10, range=0..100)
contour = Contour(Shape=mesh_2, Point=Point(0, 0, 0), Direction=Vector(0, 0, 1), Distance=Z_2)  # -> flatten(Contours)
divide_curve = DivideCurve(Curve=contour, Count=count, Kinks=False)  # -> flatten(Points), Tangents, Parameters
dispatch = Dispatch(List=divide_curve.Points, DispatchPattern=[True, False])  # -> ListA, ListB
point_3 = Point(dispatch.ListA)

# ----
# assemble
module_2 = Brep(module)
# transform
point_4 = Point(point_3)
deconstruct = Deconstruct(Point=point_4)  # -> XComponent, YComponent, expr("x*100", ZComponent)
addition = Addition(A=deconstruct.XComponent, B=deconstruct.ZComponent)
sort_list = SortList(Keys=addition, ValuesValuesA=point_4)  # -> Keys, ValuesValuesA
move_2 = Move(Geometry=module_2, Motion=sort_list.ValuesValuesA)  # -> Geometry, Transform
modules = Brep(move_2.Geometry)
point_5 = Point(sort_list.ValuesValuesA)

modules_2 = Brep(modules)
# depth
panel = Panel("-170, -600, -310")
scale = Scale(Geometry=modules_2, Center=Point(0, 0, 0), Factor="10")  # -> Geometry, Transform
move_3 = Move(Geometry=scale.Geometry, Motion=panel)  # -> Geometry, Transform
modules_3 = Brep(move_3.Geometry)

point_6 = Point(point_5)
unit_y_2 = UnitY(Factor=1)
negative = Negative(Value=unit_y_2)
xz_plane_2 = XZPlane(Origin=Point(0, 0, 0))
project_point = ProjectPoint(Point=point_6, Direction=negative, Geometry=xz_plane_2)  # -> Point, Index
distance = Distance(PointA=point_6, PointB=project_point.Point)
number = Number(distance)

# ----
# gradient
modules_4 = Brep(modules_3)
number_2 = Number(number)
bounds = Bounds(Numbers=number_2)
remap_numbers = RemapNumbers(Value=number_2, Source=bounds, Target=Domain(0, 1))  # -> Mapped, Clipped
gradient_2 = Gradient(
    LowerLimit=0,
    UpperLimit=1,
    Parameter=remap_numbers.Mapped,
    stops=[0: RGB(68, 1, 84), 0.167: RGB(68, 57, 131), 0.334: RGB(49, 104, 142), 0.501: RGB(33, 145, 140), 0.668: RGB(53, 183, 121), 0.835: RGB(144, 215, 67), 1: RGB(253, 231, 37)])
custom_preview = CustomPreview(Geometry=modules_4, Material=gradient_2)

# ----
# stock
modules_5 = Brep(modules_3)
list_item = ListItem(List=modules_5, Index="0", Wrap=True)
unit_x = UnitX(Factor="-100")
move_4 = Move(Geometry=list_item, Motion=unit_x)  # -> Geometry, Transform
stock = Brep(move_4.Geometry)

# ---- group: set joint motion
# operations
# modes
motionmode = MotionMode(MotionMode=1)
joint = Data(motionmode)

# ---- group: wait
# wait
# stock
milliseconds = Panel("1000")
wait = Wait(Time=milliseconds)
wait_2 = Data(wait)

# ---- group: set stock and zero
stock_2 = Brep(stock)
# waypoints
panel_2 = Panel("360")
volume = Volume(Geometry=stock_2)  # -> Volume, Centroid
unit_z = UnitZ(Factor=panel_2)
flip_plane = FlipPlane(Plane=volume.Centroid, ReverseX=False, ReverseY=False, SwapAxes=True)
move_5 = Move(Geometry=volume.Centroid, Motion=unit_z)  # -> Geometry, Transform
plane_normal = PlaneNormal(Origin=flip_plane, ZAxis="0,0,-1")
plane_normal_2 = PlaneNormal(Origin=move_5.Geometry, ZAxis="0,0,-1")
rotate = Rotate(Geometry=plane_normal, Angle=degrees("90"), Plane=plane_normal)  # -> Geometry, Transform
rotate_2 = Rotate(Geometry=plane_normal_2, Angle=degrees("90"), Plane=plane_normal_2)  # -> Geometry, Transform
transformto = TransformTo(Plane=rotate.Geometry, Relative=False)
transformto_2 = TransformTo(Plane=rotate_2.Geometry, Relative=False)
stock_3 = Data(transformto)
zero = Data(transformto_2)

# ---- group: close gripper
# gripper
close_gripper = Panel("""rq_set_pos_spd_for(255, 51, 26, "1")
  rq_wait_pos_spe_for_request(255, 51, 26, "1")
  rq_go_to("1")
  rq_wait("1")""")
customcode = CustomCode(Statement=close_gripper, IsDeclaration=False)
close = Data(customcode)

# ---- group: open gripper
open_gripper = Panel("""rq_set_pos_spd_for(0, 51, 26, "1")
  rq_wait_pos_spe_for_request(0, 51, 26, "1")
  rq_go_to("1")
  rq_wait("1")""")
customcode_2 = CustomCode(Statement=open_gripper, IsDeclaration=False)
open = Data(customcode_2)

# ---- group: set joint speed
# speed
speed = Slider(20, range=0..100)
acceleration = Slider(30, range=0..100)
accelerationto = AccelerationTo(Acceleration=acceleration, Relative=False)
speedto = SpeedTo(Speed=speed, Relative=False)
joint_speed = Data([speedto, accelerationto])

# ---- group: set linear speed
speed_2 = Slider(40, range=0..100)
acceleration_2 = Slider(60, range=0..100)
accelerationto_2 = AccelerationTo(Acceleration=acceleration_2, Relative=False)
speedto_2 = SpeedTo(Speed=speed_2, Relative=False)
speed_3 = Data([speedto_2, accelerationto_2])

# ---- group: set linear motion
motionmode_2 = MotionMode(MotionMode=0)
linear = Data(motionmode_2)

# ---- group: pick
# sequence
# of operations
joint_speed_2 = Data(joint_speed)
speed_4 = Data(speed_3)
joint_2 = Data(joint)
zero_2 = Data(zero)
linear_2 = Data(linear)
stock_4 = Data(stock_3)
wait_3 = Data(wait_2)
close_2 = Data(close)
wait_4 = Data(wait_2)
zero_3 = Data(zero)
merge = Merge(
    Data1=joint_speed_2,
    Data2=joint_2,
    Data3=zero_2,
    Data4=speed_4,
    Data5=linear_2,
    Data6=stock_4,
    Data7=wait_3,
    Data8=close_2,
    Data9=wait_4,
    Data10=zero_3)
pick = Data(merge)

# ----
pick_2 = Panel(merge)

# ---- group: create robot system
# compilation
# system
# using machina
panel_3 = Panel("robotic_wall")
createrobot = CreateRobot(Name=panel_3, Brand="UR")
robot = Data(createrobot)

# ---- group: set waypoints
place = Brep(modules_3)
volume_2 = Volume(Geometry=place)  # -> Volume, Centroid
unit_z_2 = UnitZ(Factor="40")

# ----
plane_normal_3 = PlaneNormal(Origin=volume_2.Centroid, ZAxis="0,0,-1")

# ---- group: set waypoints (continued)
move_6 = Move(Geometry=plane_normal_3, Motion=unit_z_2)  # -> Geometry, Transform
rotate_3 = Rotate(Geometry=plane_normal_3, Angle=degrees("90"), Plane=plane_normal_3)  # -> Geometry, Transform
rotate_4 = Rotate(Geometry=move_6.Geometry, Angle=degrees("90"), Plane=move_6.Geometry)  # -> Geometry, Transform
transformto_3 = TransformTo(Plane=rotate_3.Geometry, Relative=False)
transformto_4 = TransformTo(Plane=rotate_4.Geometry, Relative=False)
place_2 = Data(transformto_3)
entry = Data(transformto_4)

# ---- group: place
joint_3 = Data(joint)
linear_3 = Data(linear)
place_3 = Data(place_2)
open_2 = Data(open)
entry_2 = Data(entry)
entry_3 = Data(entry)
wait_5 = Data(wait_2)
wait_6 = Data(wait_2)
insert_items = InsertItems(List=graft(entry_3), Item=joint_3, Indices="0", Wrap=True)
insert_items_2 = InsertItems(List=graft(place_3), Item=linear_3, Indices="0", Wrap=True)
merge_2 = Merge(Data1=wait_5, Data2=open_2, Data3=wait_6)
joint_speed_3 = Data(joint_speed)
speed_5 = Data(speed_3)
insert_items_3 = InsertItems(List=insert_items, Item=joint_speed_3, Indices="0", Wrap=True)
insert_items_4 = InsertItems(List=insert_items_2, Item=speed_5, Indices="0", Wrap=True)
merge_3 = Merge(Data1=insert_items_3, Data2=insert_items_4)
list_length = ListLength(List=merge_3)  # -> flatten(Length)
panel_4 = Panel("0")

# ----
list_item_2 = ListItem(List=list_length, Index=panel_4, Wrap=False)

# ---- group: place (continued)
insert_items_5 = InsertItems(List=merge_3, Item=merge_2, Indices=list_item_2, Wrap=False)
insert_items_6 = InsertItems(List=graft(entry_2), Item=insert_items_5, Indices="0", Wrap=False)
place_4 = Data(insert_items_6)

# ----
place_5 = Panel(place_4)

# ---- group: pick & place
pick_3 = Data(pick)
place_6 = Data(place_4)
insert_items_7 = InsertItems(List=place_6, Item=pick_3, Indices="0", Wrap=True)
pick_place = Data(insert_items_7)

# ----
pick_place_2 = Panel(pick_place)

# ---- group: generate program
# program
robot_2 = Data(robot)
actions = Data(flatten(pick_place))
compileprogram = CompileProgram(Robot=robot_2, Actions=actions, InLineTargets=Toggle(True), Comments=Toggle(False))
robotprogram = Data(compileprogram)

# ---- group: save program
c_script = CSharpScript()  # -> out, here
# ---------- c_script: C# usings ----------
using System.IO;
# ---------- c_script: C# ----------
    string targetFolder = "";

    GH_Document gh_d = owner.OnPingDocument();
    if (gh_d.IsFilePathDefined)
    {
      string ghFilePath = gh_d.FilePath;
      targetFolder = Path.GetDirectoryName(ghFilePath);
    }
    else
    {
      Print("No local folder found, please save your file locally.");
    }

    here = targetFolder;
# ---------- end c_script ----------
# output
robot_3 = Data(robot)
robotprogram_2 = Data(robotprogram)
saveprogram = SaveProgram(Robot=robot_3, RobotProgram=robotprogram_2, Path=c_script.here)
panel_5 = Panel(saveprogram)

# ---- group: print program
robotprogram_3 = Data(robotprogram)
displayprogram = DisplayProgram(RobotProgram=robotprogram_3)
panel_6 = Panel(displayprogram)
