# Grasshopper definition machina-robotic-wall.gh (Grasshopper 1.0.8)
# plug-ins: BitmapPlus, Machina

# ----
# procedural wall
# procedural noise
# bitmap+
seed = Slider(4, range=0..100)
width = Slider(36, range=0..100)
height = Slider(36, range=0..100)
depth = Slider(1000, range=0..10000)
list = ValueList({"Value": 0, "Perlin": 1, "Cubic": 2, "Simplex": 3, "WhiteNoise": 4}, selected="Perlin")
list_2 = ValueList({"Linear": 0, "Hermite": 1, "Quintic": 2}, selected="Hermite")
# construct grid
frequency = Slider(0.05, range=0..0.1)
# robotic wall
procedural_noise = ProceduralNoise(Seed=seed, Width=width, Height=height, Depth=depth, Mode=list, Interpolation=list_2, Frequency=frequency)  # -> Image, Noise
prev_image = PrevImage(SmartBitmap=procedural_noise.Image)
# UR5e
image = Data(procedural_noise.Image)

image_2 = Data(image)
bitmap_properties = BitmapProperties(Image=image_2)  # -> Boundary, Width, Height, HorizontalResolution, VerticalResolution, Format
mesh_plane = MeshPlane(
    Boundary=bitmap_properties.Boundary,
    WidthCount=expr("x-1", bitmap_properties.Width),
    HeightCount=expr("x-1", bitmap_properties.Height))  # -> Mesh, Area
xz_plane = XZPlane(Origin=Point(0, 0, 0))
orient = Orient(Geometry=mesh_plane.Mesh, Source=PlaneXY(0, 0, 0), Target=xz_plane)  # -> Geometry, Transform
deconstruct_mesh = DeconstructMesh(Mesh=orient.Geometry)  # -> Vertices, Faces, Colours, Normals
mesh_face = MeshFace(deconstruct_mesh.Faces)
point = Point(deconstruct_mesh.Vertices)

image_3 = Data(image_2)
# extract noise
deconstruct_bitmap = DeconstructBitmap(Image=image_3)
split_ahsv = SplitAHSV(Colour=deconstruct_bitmap)  # -> Alpha, Hue, Saturation, Value
noise = Number(split_ahsv.Value)

# ----
# 3D mesh
point_2 = Point(point)
mesh_face_2 = MeshFace(mesh_face)
y_factor = Slider(4, range=0..10)
noise_2 = Number(noise)
multiplication = Multiplication(A=y_factor, B=noise_2)
unit_y = UnitY(Factor=multiplication)
gradient = Gradient(
    LowerLimit=0,
    UpperLimit=1,
    Parameter=noise_2,
    stops=[0: RGB(68, 1, 84), 0.167: RGB(68, 57, 131), 0.334: RGB(49, 104, 142), 0.501: RGB(33, 145, 140), 0.668: RGB(53, 183, 121), 0.835: RGB(144, 215, 67), 1: RGB(253, 231, 37)])
move = Move(Geometry=point_2, Motion=unit_y)  # -> Geometry, Transform
construct_mesh = ConstructMesh(Vertices=move.Geometry, Faces=mesh_face_2, Colours=gradient)
mesh = Mesh(construct_mesh)

# ----
# module
panel = Panel("60")
# find frames
panel_2 = Panel("20")
domain_box = DomainBox(Base=PlaneXY(0, 0, 0), X=panel, Y="40", Z=panel_2)
module = Brep(domain_box)

# ----
# stock
module_2 = Brep(module)
# work zero
panel_3 = Panel("-300")
construct_point = ConstructPoint(XCoordinate="600", YCoordinate="0", ZCoordinate=panel_3)
move_2 = Move(Geometry=module_2, Motion=construct_point)  # -> Geometry, Transform
stock = Brep(move_2.Geometry)

module_3 = Brep(module)
construct_point_2 = ConstructPoint(XCoordinate="0", YCoordinate="-500", ZCoordinate="100")
move_3 = Move(Geometry=module_3, Motion=construct_point_2)  # -> Geometry, Transform
volume = Volume(Geometry=move_3.Geometry)  # -> Volume, Centroid
zero = Point(volume.Centroid)

# ----
# transform
mesh_2 = Mesh(mesh)
scale = Scale(Geometry=mesh_2, Center=Point(0, 0, 0), Factor="10")  # -> Geometry, Transform
move_4 = Move(Geometry=scale.Geometry, Motion="-170, -600, -310")  # -> Geometry, Transform
mesh_3 = Mesh(move_4.Geometry)

Z = Number(panel_2)
mesh_4 = Mesh(mesh_3)
count = Slider(10, range=0..100)
contour = Contour(Shape=mesh_4, Point=Point(0, 0, 0), Direction=Vector(0, 0, 1), Distance=Z)  # -> flatten(Contours)
dispatch = Dispatch(List=contour, DispatchPattern=[True, False])  # -> ListA, ListB
horizontal_frames = HorizontalFrames(Curve=dispatch.ListA, Count=count)  # -> Frames, Parameters
horizontal_frames_2 = HorizontalFrames(Curve=dispatch.ListB, Count=count)  # -> Frames, Parameters
dispatch_2 = Dispatch(List=horizontal_frames.Frames, DispatchPattern=[True, False])  # -> ListA, ListB
dispatch_3 = Dispatch(List=horizontal_frames_2.Frames, DispatchPattern=[True, False])  # -> ListA, ListB
merge = Merge(Data1=dispatch_2.ListA, Data2=dispatch_3.ListB)  # -> flatten(Result)
plane = Plane(merge)

plane_2 = Plane(plane)
# sort planes
deconstruct_plane = DeconstructPlane(Plane=plane_2)  # -> Origin, XAxis, YAxis, ZAxis
deconstruct = Deconstruct(Point=deconstruct_plane.Origin)  # -> XComponent, YComponent, expr("x*100", ZComponent)
addition = Addition(A=deconstruct.XComponent, B=deconstruct.ZComponent)
sort_list = SortList(Keys=addition, ValuesValuesA=deconstruct_plane.Origin)  # -> Keys, ValuesValuesA
absolute = Absolute(Value=deconstruct_plane.XAxis)
absolute_2 = Absolute(Value=deconstruct_plane.YAxis)
construct_plane = ConstructPlane(Origin=sort_list.ValuesValuesA, XAxis=absolute, YAxis=absolute_2)
adjust_plane = AdjustPlane(Plane=construct_plane, Normal=Vector(0, 0, 1))
plane_3 = Plane(adjust_plane)

# ----
# orient modules
module_4 = Brep(module)
plane_4 = Plane(plane_3)
orient_2 = Orient(Geometry=module_4, Source=PlaneXY(0, 0, 0), Target=plane_4)  # -> Geometry, Transform
deconstruct_2 = Deconstruct(Point=plane_4)  # -> XComponent, YComponent, ZComponent
bounds = Bounds(Numbers=deconstruct_2.YComponent)
remap_numbers = RemapNumbers(Value=deconstruct_2.YComponent, Source=bounds, Target=Domain(0, 1))  # -> Mapped, Clipped
gradient_2 = Gradient(
    LowerLimit=0,
    UpperLimit=1,
    Parameter=remap_numbers.Mapped,
    stops=[0: RGB(68, 1, 84), 0.167: RGB(68, 57, 131), 0.334: RGB(49, 104, 142), 0.501: RGB(33, 145, 140), 0.668: RGB(53, 183, 121), 0.835: RGB(144, 215, 67), 1: RGB(253, 231, 37)])
custom_preview = CustomPreview(Geometry=orient_2.Geometry, Material=gradient_2)
modules = Brep(orient_2.Geometry)

# ----
# waypoints
plane_5 = Plane(plane_3)
modules_2 = Brep(modules)
volume_2 = Volume(Geometry=modules_2)  # -> Volume, Centroid
vector_2pt = Vector2Pt(PointA=plane_5, PointB=volume_2.Centroid, Unitize=False)  # -> Vector, Length
move_5 = Move(Geometry=plane_5, Motion=vector_2pt.Vector)  # -> Geometry, Transform
waypoints = Plane(move_5.Geometry)

# ---- group: set joint motion
# operations
# modes
motionmode = MotionMode(MotionMode=1)
joint = Data(motionmode)

# ---- group: wait
# wait
# stock
milliseconds = Panel("1000")
wait = Wait(Time=milliseconds)
wait_2 = Data(wait)

# ---- group: set stock and stage
stock_2 = Brep(stock)
volume_3 = Volume(Geometry=stock_2)  # -> Volume, Centroid
unit_z = UnitZ(Factor="200")
flip_plane = FlipPlane(Plane=volume_3.Centroid, ReverseX=False, ReverseY=False, SwapAxes=True)
move_6 = Move(Geometry=volume_3.Centroid, Motion=unit_z)  # -> Geometry, Transform
plane_normal = PlaneNormal(Origin=flip_plane, ZAxis="0,0,-1")
plane_normal_2 = PlaneNormal(Origin=move_6.Geometry, ZAxis="0,0,-1")
rotate = Rotate(Geometry=plane_normal, Angle=degrees("90"), Plane=plane_normal)  # -> Geometry, Transform
rotate_2 = Rotate(Geometry=plane_normal_2, Angle=degrees("90"), Plane=plane_normal_2)  # -> Geometry, Transform
transformto = TransformTo(Plane=rotate.Geometry, Relative=False)
transformto_2 = TransformTo(Plane=rotate_2.Geometry, Relative=False)
stock_3 = Data(transformto)
staging = Data(transformto_2)

# ---- group: set zero
# zero
zero_2 = Point(zero)
plane_normal_3 = PlaneNormal(Origin=zero_2, ZAxis="0,0,-1")
rotate_3 = Rotate(Geometry=plane_normal_3, Angle=degrees("90"), Plane=plane_normal_3)  # -> Geometry, Transform
transformto_3 = TransformTo(Plane=rotate_3.Geometry, Relative=False)
zero_3 = Data(transformto_3)

# ----
# waypoints
waypoints_2 = Plane(waypoints)
unit_z_2 = UnitZ(Factor="40")
plane_normal_4 = PlaneNormal(Origin=waypoints_2, ZAxis="0,0,-1")
move_7 = Move(Geometry=plane_normal_4, Motion=unit_z_2)  # -> Geometry, Transform
rotate_4 = Rotate(Geometry=plane_normal_4, Angle=degrees("90"), Plane=plane_normal_4)  # -> Geometry, Transform
rotate_5 = Rotate(Geometry=move_7.Geometry, Angle=degrees("90"), Plane=move_7.Geometry)  # -> Geometry, Transform
transformto_4 = TransformTo(Plane=rotate_4.Geometry, Relative=False)
transformto_5 = TransformTo(Plane=rotate_5.Geometry, Relative=False)
entry = Data(transformto_5)
place = Data(transformto_4)

# ---- group: close gripper
# gripper
close_gripper = Panel("""rq_set_pos_spd_for(255, 51, 26, "1")
  rq_wait_pos_spe_for_request(255, 51, 26, "1")
  rq_go_to("1")
  rq_wait("1")""")
customcode = CustomCode(Statement=close_gripper, IsDeclaration=False)
close = Data(customcode)

# ---- group: open gripper
open_gripper = Panel("""rq_set_pos_spd_for(0, 51, 26, "1")
  rq_wait_pos_spe_for_request(0, 51, 26, "1")
  rq_go_to("1")
  rq_wait("1")""")
customcode_2 = CustomCode(Statement=open_gripper, IsDeclaration=False)
open = Data(customcode_2)

# ---- group: set joint speed
# speed
speed = Slider(20, range=0..100)
acceleration = Slider(30, range=0..100)
accelerationto = AccelerationTo(Acceleration=acceleration, Relative=False)
speedto = SpeedTo(Speed=speed, Relative=False)
joint_speed = Data([speedto, accelerationto])

# ---- group: set linear speed
speed_2 = Slider(60, range=0..100)
acceleration_2 = Slider(90, range=0..100)
accelerationto_2 = AccelerationTo(Acceleration=acceleration_2, Relative=False)
speedto_2 = SpeedTo(Speed=speed_2, Relative=False)
speed_3 = Data([speedto_2, accelerationto_2])

# ---- group: set linear motion
motionmode_2 = MotionMode(MotionMode=0)
linear = Data(motionmode_2)

# ---- group: pick
# sequence
# of operations
joint_speed_2 = Data(joint_speed)
joint_2 = Data(joint)
zero_4 = Data(zero_3)
staging_2 = Data(staging)
speed_4 = Data(speed_3)
linear_2 = Data(linear)
stock_4 = Data(stock_3)
wait_3 = Data(wait_2)
close_2 = Data(close)
wait_4 = Data(wait_2)
staging_3 = Data(staging)
joint_speed_3 = Data(joint_speed)
joint_3 = Data(joint)
zero_5 = Data(zero_3)
merge_2 = Merge(
    Data1=joint_speed_2,
    Data2=joint_2,
    Data3=zero_4,
    Data4=staging_2,
    Data5=speed_4,
    Data6=linear_2,
    Data7=stock_4,
    Data8=wait_3,
    Data9=close_2,
    Data10=wait_4,
    Data11=staging_3,
    Data12=joint_speed_3,
    Data13=joint_3,
    Data14=zero_5)
pick = Data(merge_2)

# ----
pick_2 = Panel(merge_2)

# ---- group: create robot system
# compilation
# system
# using machina
panel_4 = Panel("robotic_wall")
createrobot = CreateRobot(Name=panel_4, Brand="UR")
robot = Data(createrobot)

# ---- group: place
joint_4 = Data(joint)
entry_2 = Data(entry)
linear_3 = Data(linear)
place_2 = Data(place)
open_2 = Data(open)
wait_5 = Data(wait_2)
entry_3 = Data(entry)
wait_6 = Data(wait_2)
insert_items = InsertItems(List=graft(entry_2), Item=joint_4, Indices="0", Wrap=True)
insert_items_2 = InsertItems(List=graft(place_2), Item=linear_3, Indices="0", Wrap=True)
merge_3 = Merge(Data1=wait_6, Data2=open_2, Data3=wait_5)
joint_speed_4 = Data(joint_speed)
speed_5 = Data(speed_3)
insert_items_3 = InsertItems(List=insert_items, Item=joint_speed_4, Indices="0", Wrap=True)
insert_items_4 = InsertItems(List=insert_items_2, Item=speed_5, Indices="0", Wrap=True)
merge_4 = Merge(Data1=insert_items_3, Data2=insert_items_4)
list_length = ListLength(List=merge_4)  # -> flatten(Length)
panel_5 = Panel("0")

# ----
list_item = ListItem(List=list_length, Index=panel_5, Wrap=False)

# ---- group: place (continued)
insert_items_5 = InsertItems(List=merge_4, Item=merge_3, Indices=list_item, Wrap=False)
insert_items_6 = InsertItems(List=graft(entry_3), Item=insert_items_5, Indices="0", Wrap=False)
place_3 = Data(insert_items_6)

# ----
place_4 = Panel(place_3)

# ---- group: pick & place
pick_3 = Data(pick)
place_5 = Data(place_3)
insert_items_7 = InsertItems(List=place_5, Item=pick_3, Indices="0", Wrap=True)
pick_place = Data(insert_items_7)

# ----
pick_place_2 = Panel(pick_place)

# ---- group: generate program
# program
robot_2 = Data(robot)
actions = Data(flatten(pick_place))
compileprogram = CompileProgram(Robot=robot_2, Actions=actions, InLineTargets=Toggle(True), Comments=Toggle(False))
robotprogram = Data(compileprogram)

# ---- group: save program
c_script = CSharpScript()  # -> out, here
# ---------- c_script: C# usings ----------
using System.IO;
# ---------- c_script: C# ----------
    string targetFolder = "";

    GH_Document gh_d = owner.OnPingDocument();
    if (gh_d.IsFilePathDefined)
    {
      string ghFilePath = gh_d.FilePath;
      targetFolder = Path.GetDirectoryName(ghFilePath);
    }
    else
    {
      Print("No local folder found, please save your file locally.");
    }

    here = targetFolder;
# ---------- end c_script ----------
# output
robot_3 = Data(robot)
robotprogram_2 = Data(robotprogram)
saveprogram = SaveProgram(Robot=robot_3, RobotProgram=robotprogram_2, Path=c_script.here)
panel_6 = Panel(saveprogram)

# ---- group: print program
robotprogram_3 = Data(robotprogram)
displayprogram = DisplayProgram(RobotProgram=robotprogram_3)
panel_7 = Panel(displayprogram)
