# Grasshopper definition machina-robotiq-gripper.gh (Grasshopper 1.0.8)
# plug-ins: Machina

# ---- group: create robot system
# using machina
panel = Panel("UR")
# system
panel_2 = Panel("gripper")
# UR5e
createrobot = CreateRobot(Name=panel_2, Brand=panel)
robot = Data(createrobot)

# ---- group: close gripper
# commands
close_gripper = Panel("""rq_set_pos_spd_for(255, 51, 26, "1")
  rq_wait_pos_spe_for_request(255, 51, 26, "1")
  rq_go_to("1")
  rq_wait("1")""")
customcode = CustomCode(Statement=close_gripper, IsDeclaration=False)

# ---- group: wait
milliseconds = Panel("1000")
wait = Wait(Time=milliseconds)

# ---- group: open gripper
open_gripper = Panel("""rq_set_pos_spd_for(0, 51, 26, "1")
  rq_wait_pos_spe_for_request(0, 51, 26, "1")
  rq_go_to("1")
  rq_wait("1")""")
customcode_2 = CustomCode(Statement=open_gripper, IsDeclaration=False)

# ---- group: actions
actions = Data([customcode, wait, customcode_2])

# ---- group: generate program
# program
robot_2 = Data(robot)
actions_2 = Data(actions)
compileprogram = CompileProgram(Robot=robot_2, Actions=actions_2, InLineTargets=Toggle(True), Comments=Toggle(False))
robotprogram = Data(compileprogram)

# ---- group: save program
c_script = CSharpScript()  # -> out, here
# ---------- c_script: C# usings ----------
using System.IO;
# ---------- c_script: C# ----------
    string targetFolder = "";

    GH_Document gh_d = owner.OnPingDocument();
    if (gh_d.IsFilePathDefined)
    {
      string ghFilePath = gh_d.FilePath;
      targetFolder = Path.GetDirectoryName(ghFilePath);
    }
    else
    {
      Print("No local folder found, please save your file locally.");
    }

    here = targetFolder;
# ---------- end c_script ----------
# output
robot_3 = Data(robot)
robotprogram_2 = Data(robotprogram)
saveprogram = SaveProgram(Robot=robot_3, RobotProgram=robotprogram_2, Path=c_script.here)
panel_3 = Panel(saveprogram)

# ---- group: print program
robotprogram_3 = Data(robotprogram)
displayprogram = DisplayProgram(RobotProgram=robotprogram_3)
panel_4 = Panel(displayprogram)
