# Grasshopper definition machina-ur10e-3d-printing-complex.gh (Grasshopper 1.0.7)
# plug-ins: Machina

# ---- group: create robot system
# using machina
panel = Panel("UR")
# system
panel_2 = Panel("printing")
# UR10e
createrobot = CreateRobot(Name=panel_2, Brand=panel)
robot = Data(createrobot)

# ---- group: set motion mode
# commands
motionmode = MotionMode(MotionMode=0)

# ---- group: set precision
precision = Slider(10, range=0..100)
precisionto = PrecisionTo(Radius=precision, Relative=False)

# ---- group: set speed
speed = Slider(20, range=0..100)
speedto = SpeedTo(Speed=speed, Relative=False)

# ---- group: set acceleration
acceleration = Slider(20, range=0..100)
accelerationto = AccelerationTo(Acceleration=acceleration, Relative=False)

# ----
panel_3 = Panel("ExtruderOn")

# ---- group: start extruding
panel_4 = Panel("0")
writedigital = WriteDigital(DigitalPin=panel_4, On=Toggle(True), ToolPin=False)

# ---- group: stop extruding
digital_output = Text(panel_4)
writedigital_2 = WriteDigital(DigitalPin=digital_output, On=Toggle(False), ToolPin=False)

# ----
# workspace
extent = Slider(200, range=0..1000)
division = Division(A=extent, B="2")
negative = Negative(Value=division)
construct_point = ConstructPoint(XCoordinate=negative, YCoordinate=negative, ZCoordinate=0)
rectangle = Rectangle(Plane=construct_point, XSize=extent, YSize=extent, Radius=0)  # -> Rectangle, Length
rectangle_2 = Rectangle(rectangle.Rectangle)

# ---- group: settings
merge = Merge(Data1=motionmode, Data2=precisionto, Data3=speedto, Data4=accelerationto)
settings = Data(merge)

# ---- group: input program data
# input
curve = Curve()

# ---- group: generate waypoints
control_points = ControlPoints(Curve=curve)  # -> Points, Weights, Knots
point = Point(control_points.Points)

# ---- group: engage extruder
point_2 = Point(point)
retract = Slider(50, range=0..250)
unit_z = UnitZ(Factor=retract)
list_item = ListItem(List=point_2, Index="0", Wrap=True)
move = Move(Geometry=list_item, Motion=unit_z)  # -> Geometry, Transform
transformto = TransformTo(Plane=move.Geometry, Relative=False)

# ---- group: transformations
point_3 = Point(point)
transformto_2 = TransformTo(Plane=point_3, Relative=False)

# ---- group: retract extruder
point_4 = Point(point)
retract_2 = Number(retract)
list_length = ListLength(List=point_4)
unit_z_2 = UnitZ(Factor=retract_2)
list_item_2 = ListItem(List=point_4, Index=expr("x-1", list_length), Wrap=True)
move_2 = Move(Geometry=list_item_2, Motion=unit_z_2)  # -> Geometry, Transform
transformto_3 = TransformTo(Plane=move_2.Geometry, Relative=False)

# ---- group: simulation
# simulation
engage = Point(move.Geometry)
point_5 = Point(point_3)
retract_3 = Point(move_2.Geometry)
index = Slider(0, range=0..100)
weave = Weave(Pattern=[0, 1], Stream0=engage, Stream1=point_5, NullGaps=False)
list_length_2 = ListLength(List=weave)
insert_items = InsertItems(List=weave, Item=retract_3, Indices=list_length_2, Wrap=True)
waypoints = Data(insert_items)
polyline = PolyLine(Vertices=flatten(waypoints), Closed=False)
polyline_2 = PolyLine(Vertices=waypoints, Closed=False)
list_item_3 = ListItem(List=flatten(polyline_2), Index=index, Wrap=True)
custom_preview = CustomPreview(Geometry=list_item_3, Material=ColourSwatch(SwatchColor=RGB(0, 0, 0)))
curve_2 = Curve(polyline)

# ---- group: toolpath
pattern = Panel("""0
1
2""")
weave_2 = Weave(Pattern=pattern, Stream0=transformto, Stream1=writedigital, Stream2=transformto_2, NullGaps=False)
list_length_3 = ListLength(List=weave_2)
insert_items_2 = InsertItems(List=weave_2, Item=writedigital_2, Indices=list_length_3, Wrap=True)
list_length_4 = ListLength(List=insert_items_2)
insert_items_3 = InsertItems(List=insert_items_2, Item=transformto_3, Indices=list_length_4, Wrap=True)
toolpath = Data(insert_items_3)

# ---- group: generate program
# program
robot_2 = Data(createrobot)
settings_2 = Data(settings)
toolpath_2 = Data(toolpath)
merge_2 = Merge(Data1=settings_2, Data2=flatten(toolpath_2))
actions = Panel(merge_2)
compileprogram = CompileProgram(Robot=robot_2, Actions=merge_2, InLineTargets=Toggle(True), Comments=Toggle(True))

# ---- group: save program
# output
robot_3 = Data(createrobot)
c_script = CSharpScript()  # -> out, here
# ---------- c_script: C# usings ----------
using System.IO;
# ---------- c_script: C# ----------
    string targetFolder = "";

    GH_Document gh_d = owner.OnPingDocument();
    if (gh_d.IsFilePathDefined)
    {
      string ghFilePath = gh_d.FilePath;
      targetFolder = Path.GetDirectoryName(ghFilePath);
    }
    else
    {
      Print("No local folder found, please save your file locally.");
    }

    here = targetFolder;
# ---------- end c_script ----------
saveprogram = SaveProgram(Robot=robot_3, RobotProgram=compileprogram, Path=c_script.here)
panel_5 = Panel(saveprogram)

# ---- group: print program
displayprogram = DisplayProgram(RobotProgram=compileprogram)
panel_6 = Panel(displayprogram)

# ---- group: transform pose
program = Text(panel_2)
ghpython_script = GhPythonScript(x=c_script.here, y=program, z="Tray", u=saveprogram)  # -> out, a
# ---------- ghpython_script: Python ----------
"""Transform Pose.
    Inputs:
        x: file path
        y: program name
        z: feature plane"""

__author__ = "baharmon"
__version__ = "2021.11.10"

import rhinoscriptsyntax as rs
import os

# set variables
script = os.path.join(x,'{y}_Program'.format(y=y),'{y}.script'.format(y=y))

# read
with open(script, 'r') as file :
  filedata = file.read()

# pose transformation
filedata = filedata.replace(
    'movep(p', 'movep(pose_trans({z},p'.format(z=z)
    )
filedata = filedata.replace(']', '])')

# write
with open(script, 'w') as file:
  file.write(filedata)
# ---------- end ghpython_script ----------
