# Grasshopper definition machina-ur10e-3d-printing.gh (Grasshopper 1.0.7)
# plug-ins: Machina

# ---- group: create robot system
# using machina
panel = Panel("UR")
# system
panel_2 = Panel("printing")
# UR10e
createrobot = CreateRobot(Name=panel_2, Brand=panel)

# ---- group: set motion mode
# commands
motionmode = MotionMode(MotionMode=0)

# ---- group: set precision
precision = Slider(3, range=0..100)
precisionto = PrecisionTo(Radius=precision, Relative=False)

# ---- group: set speed
speed = Slider(30, range=0..100)
speedto = SpeedTo(Speed=speed, Relative=False)

# ---- group: set acceleration
acceleration = Slider(30, range=0..100)
accelerationto = AccelerationTo(Acceleration=acceleration, Relative=False)

# ---- group: start extruding
panel_3 = Panel("ExtruderOn")
writedigital = WriteDigital(DigitalPin=panel_3, On=Toggle(True), ToolPin=False)

# ---- group: stop extruding
digital_output = Text(panel_3)
writedigital_2 = WriteDigital(DigitalPin=digital_output, On=Toggle(False), ToolPin=False)

# ----
# workspace
panel_4 = Panel("-100,-100,0")
rectangle = Rectangle(Plane=panel_4, XSize="200", YSize="200", Radius=0)  # -> Rectangle, Length
rectangle_2 = Rectangle(rectangle.Rectangle)

# ---- group: input program data
# input
input_points = Point()

# ---- group: transformations
point = Point(flatten(input_points))
transformto = TransformTo(Plane=point, Relative=False)

# ---- group: simulation
# simulation
point_2 = Point(input_points)
index = Slider(0, range=0..100)
polyline = PolyLine(Vertices=point_2, Closed=False)
list_item = ListItem(List=flatten(polyline), Index=index, Wrap=True)
custom_preview = CustomPreview(Geometry=list_item, Material=ColourSwatch(SwatchColor=RGB(0, 0, 0)))

# ---- group: merge actions
merge = Merge(
    Data1=motionmode,
    Data2=precisionto,
    Data3=speedto,
    Data4=accelerationto,
    Data5=writedigital,
    Data6=transformto,
    Data7=writedigital_2)

# ---- group: generate program
# program
boolean_toggle = BooleanToggle(True)
actions = Panel(merge)
compileprogram = CompileProgram(Robot=createrobot, Actions=merge, InLineTargets=boolean_toggle, Comments=Toggle(True))

# ---- group: save program
# output
c_script = CSharpScript()  # -> out, here
# ---------- c_script: C# usings ----------
using System.IO;
# ---------- c_script: C# ----------
    string targetFolder = "";

    GH_Document gh_d = owner.OnPingDocument();
    if (gh_d.IsFilePathDefined)
    {
      string ghFilePath = gh_d.FilePath;
      targetFolder = Path.GetDirectoryName(ghFilePath);
    }
    else
    {
      Print("No local folder found, please save your file locally.");
    }

    here = targetFolder;
# ---------- end c_script ----------
saveprogram = SaveProgram(Robot=createrobot, RobotProgram=compileprogram, Path=c_script.here)
panel_5 = Panel(saveprogram)

# ---- group: print program
displayprogram = DisplayProgram(RobotProgram=compileprogram)
panel_6 = Panel(displayprogram)
