# Grasshopper definition machina-ur10e-move-to-point.gh (Grasshopper 1.0.7)
# plug-ins: Machina

# ---- group: create robot system
# using machina
panel = Panel("UR")
# system
panel_2 = Panel("move_to_point")
# UR10e
# real-time control
# move to point
createrobot = CreateRobot(Name=panel_2, Brand=panel)

# ---- group: starting message
# commands
panel_3 = Panel("move to point and return to home")
message = Message(Message=panel_3)

# ---- group: set initial speed
speed = Slider(36, range=0..100)
speedto = SpeedTo(Speed=speed, Relative=False)

# ---- group: move to point
x = Slider(1000, range=-1300..1300)
y = Slider(0, range=-1300..1300)
z = Slider(400, range=0..1300)
construct_point = ConstructPoint(XCoordinate=x, YCoordinate=y, ZCoordinate=z)
moveto = MoveTo(Point=construct_point, Relative=False)

# ---- group: wait
time = Slider(1000, range=0..5000)
wait = Wait(Time=time)

# ---- group: set speed
speed_2 = Slider(50, range=0..100)
speedto_2 = SpeedTo(Speed=speed_2, Relative=False)

# ---- group: move home
# set home position
# using joint rotation angles
# in degrees
panel_4 = Panel("0")
axesto = AxesTo(A1=panel_4, A2="-90", A3="-90", A4="-90", A5="90", A6=panel_4, Relative=False)

# ---- group: merge actions
# program
merge = Merge(Data1=message, Data2=speedto, Data3=moveto, Data4=wait, Data5=speedto_2, Data6=axesto)
panel_5 = Panel(merge)

# ---- group: generate program
compileprogram = CompileProgram(Robot=createrobot, Actions=merge, InLineTargets=Toggle(True), Comments=Toggle(True))

# ---- group: stream program via machina bridge
connect_to_bridge = BooleanToggle(False)
send_program = Button()
connect = Connect(URL="ws://127.0.0.1:6999/Bridge", Name="Grasshopper", Connect=connect_to_bridge)  # -> Status, Bridge
send = Send(Bridge=connect.Bridge, Actions=merge, Send=send_program)  # -> Sent, Instructions
listen = Listen(Bridge=connect.Bridge, Autoupdate=True, Interval=66)
panel_6 = Panel(connect.Status)
actionexecuted = ActionExecuted(BridgeMessage=listen)  # -> LastAction, ActionTCP, ActionAxes, ActionExternalAxes, PendingActions, PendingActionsOnDevice
panel_7 = Panel(send.Sent)
panel_8 = Panel(send.Instructions)
panel_9 = Panel(actionexecuted.LastAction)
data_recorder = DataRecorder(actionexecuted.ActionTCP, DataLimit=-10, RecordData=True)
panel_10 = Panel(actionexecuted.PendingActions)
plane = Plane(data_recorder)

# ---- group: save program
# output
# stream
c_script = CSharpScript()  # -> out, here
# ---------- c_script: C# usings ----------
using System.IO;
# ---------- c_script: C# ----------
    string targetFolder = "";

    GH_Document gh_d = owner.OnPingDocument();
    if (gh_d.IsFilePathDefined)
    {
      string ghFilePath = gh_d.FilePath;
      targetFolder = Path.GetDirectoryName(ghFilePath);
    }
    else
    {
      Print("No local folder found, please save your file locally.");
    }

    here = targetFolder;
# ---------- end c_script ----------
saveprogram = SaveProgram(Robot=createrobot, RobotProgram=compileprogram, Path=c_script.here)
panel_11 = Panel(saveprogram)

# ---- group: print program
displayprogram = DisplayProgram(RobotProgram=compileprogram)
panel_12 = Panel(displayprogram)
