# Grasshopper definition machina-ur10e-noise-field.gh (Grasshopper 1.0.7)
# plug-ins: Machina, Heteroptera, Pufferfish, Noise 4D, Anemone

# ---- group: create robot system
# using machina
panel = Panel("UR")
# system
panel_2 = Panel("noise")
# UR10e
createrobot = CreateRobot(Name=panel_2, Brand=panel)

# ---- group: set motion mode
# commands
motionmode = MotionMode(MotionMode=1)

# ---- group: set initial speed
speed = Slider(30, range=0..100)
speedto = SpeedTo(Speed=speed, Relative=False)

# ---- group: grid
# particles in noise field
cell_size = Slider(3, range=0..10)
X = Slider(10, range=0..100)
Y = Slider(10, range=0..100)
square = Square(Plane=PlaneXY(0, 0, 0), Size=cell_size, ExtentX=X, ExtentY=Y)  # -> Cells, Points
bounding_rectangle = BoundingRectangle(Geometry=flatten(square.Cells), Plane=PlaneXY(0, 0, 0), Axis=0, Slide=0, Union=True)  # -> Bounding, DimensionX, DimensionY
polygon_center = PolygonCenter(Polyline=square.Cells)  # -> CenterV, CenterE, CenterA
grid_points = Point(flatten(polygon_center.CenterA))
curve = Curve(bounding_rectangle.Bounding)

# ---- group: vectors from noise
grid_point = Point(flatten(grid_points))
time = Slider(0.6, range=0..10)
scale = Slider(0.025, range=0..0.5)
time_2 = Slider(0.4, range=0..10)
scale_2 = Slider(0.031, range=0..0.5)
perlinnoise = PerlinNoise(Values=grid_point, Time=time, Scale=scale)
perlinnoise_2 = PerlinNoise(Values=grid_point, Time=time_2, Scale=scale_2)
unit_x = UnitX(Factor=perlinnoise)
unit_y = UnitY(Factor=perlinnoise_2)
move = Move(Geometry=grid_point, Motion=unit_x)  # -> Geometry, Transform
move_2 = Move(Geometry=move.Geometry, Motion=unit_y)  # -> Geometry, Transform
vector_2pt = Vector2Pt(PointA=grid_point, PointB=move_2.Geometry, Unitize=False)  # -> Vector, Length
line = Line(StartPoint=grid_point, EndPoint=move_2.Geometry)
insert_items = InsertItems(List=graft(grid_point), Item=graft(move_2.Geometry), Indices="1", Wrap=True)
translated_points = Point(insert_items)
vector = Vector(vector_2pt.Vector)

# ---- group: particles move across noise field
iterations = Slider(75, range=0..100)
translated_points_2 = Point(translated_points)
# workspace
amplitude = Slider(0.12, range=0..1)
vector_2 = Vector(flatten(vector))
grid_points_2 = Point(flatten(grid_points))
loop_start = LoopStart(Repeat=iterations, Trigger=Toggle(True), Data=translated_points_2)  # -> port, Counter, Data
list_item = ListItem(List=loop_start.Data, Index=loop_start.Counter, Wrap=True)  # -> Item, Item1
closest_point = ClosestPoint(Point=flatten(list_item.Item), Cloud=grid_points_2)  # -> ClosestPoint, CPIndex, Distance
vector_2pt_2 = Vector2Pt(PointA=list_item.Item, PointB=list_item.Item1, Unitize=False)  # -> flatten(Vector), Length
list_item_2 = ListItem(List=vector_2, Index=closest_point.CPIndex, Wrap=True)
addition = Addition(A=vector_2pt_2.Vector, B=list_item_2)
amplitude_2 = Amplitude(Vector=addition, Amplitude=amplitude)
move_3 = Move(Geometry=flatten(list_item.Item1), Motion=amplitude_2)  # -> Geometry, Transform
addition_2 = Addition(A=loop_start.Counter, B="2")
insert_items_2 = InsertItems(List=loop_start.Data, Item=graft(move_3.Geometry), Indices=addition_2, Wrap=True)
loop_end = LoopEnd(port=loop_start.port, Exit=False, Data=insert_items_2, TimeOutVal=0, pausedState=False, state="Constant output")
interpolate = Interpolate(Vertices=loop_end, Degree=3, Periodic=False, KnotStyle=1)  # -> Curve, Length, Domain
curve_2 = Curve(curve)
trim_with_region = TrimWithRegion(Curve=interpolate.Curve, Region=curve_2)  # -> Inside, Outside
curve_3 = Curve(flatten(trim_with_region.Inside))

# ----
rectangle_2pt = Rectangle2Pt(Plane=PlaneXY(0, 0, 0), PointA="250,600,0", PointB="1150,-600,0", Radius=0)  # -> Rectangle, Length
rectangle = Rectangle(Plane=PlaneXY(0, 0, 0), XSize="600", YSize="600", Radius=0)  # -> Rectangle, Length
polygon_center_2 = PolygonCenter(Polyline=rectangle_2pt.Rectangle)  # -> CenterV, CenterE, CenterA
polygon_center_3 = PolygonCenter(Polyline=rectangle.Rectangle)  # -> CenterV, CenterE, CenterA
vector_2pt_3 = Vector2Pt(PointA=polygon_center_3.CenterA, PointB=polygon_center_2.CenterA, Unitize=False)  # -> Vector, Length
move_4 = Move(Geometry=rectangle.Rectangle, Motion=vector_2pt_3.Vector)  # -> Geometry, Transform
custom_preview = CustomPreview(Geometry=rectangle_2pt.Rectangle, Material=ColourSwatch(SwatchColor=RGB(255, 255, 255)))
custom_preview_2 = CustomPreview(Geometry=move_4.Geometry, Material=ColourSwatch(SwatchColor=RGB(209, 209, 209)))
centroid = Point(polygon_center_2.CenterA)
paper = Curve(move_4.Geometry)

paper_2 = Curve(paper)
y_shift = Slider(50, range=0..250)
explode = Explode(Curve=paper_2, Recursive=True)  # -> Segments, Vertices
curve_middle = CurveMiddle(Curve=explode.Segments)
negative = Negative(Value=y_shift)
unit_y_2 = UnitY(Factor=negative)
list_item_3 = ListItem(List=curve_middle, Index=0, Wrap=True)
move_5 = Move(Geometry=list_item_3, Motion=unit_y_2)  # -> Geometry, Transform
move_6 = Move(Geometry=move_5.Geometry, Motion=Vector(0, 0, 10))  # -> Geometry, Transform
ink_well = Point(move_6.Geometry)

# ---- group: dip in inkwell
# path
inkwell = Point(ink_well)
engage = Slider(56, range=0..100)
negative_2 = Negative(Value=engage)
unit_z = UnitZ(Factor=negative_2)
move_7 = Move(Geometry=inkwell, Motion=unit_z)  # -> Geometry, Transform
above_ink_well = Point(inkwell)
in_ink_well = Point(move_7.Geometry)

# ---- group: transform to paper space
curve_4 = Curve(curve_3)
centroid_2 = Point(centroid)
scale_3 = Slider(20, range=0..100)
center = Center(Geometry=curve_4, forall=True, referenceAll=0)  # -> Center, Dimension
vector_2pt_4 = Vector2Pt(PointA=center.Center, PointB=centroid_2, Unitize=False)  # -> Vector, Length
move_8 = Move(Geometry=curve_4, Motion=vector_2pt_4.Vector)  # -> Geometry, Transform
scale_4 = Scale(Geometry=move_8.Geometry, Center=centroid_2, Factor=scale_3)  # -> Geometry, Transform
count = Slider(6, range=0..20)
rebuild_curve = RebuildCurve(Curve=scale_4.Geometry, Count=count, Tangents=False)
colour = ColourSwatch(SwatchColor=RGB(0, 0, 0))
custom_preview_3 = CustomPreview(Geometry=rebuild_curve, Material=colour)
curve_5 = Curve(rebuild_curve)

# ---- group: generate waypoints
curve_6 = Curve(curve_5)
curve_7 = Curve(curve_5)
distance = Slider(25, range=0..100)
list_length = ListLength(List=curve_7)
discontinuity = Discontinuity(Curve=curve_6, Level=1)  # -> Points, Parameters
move_9 = Move(Geometry=curve_7, Motion=unit_z)  # -> Geometry, Transform
random = Random(Range="-10 To 12", Number=list_length, Seed=2)
unit_z_2 = UnitZ(Factor=random)
dispatch = Dispatch(List=discontinuity.Points, DispatchPattern=[True, False])  # -> ListA, ListB
move_10 = Move(Geometry=move_9.Geometry, Motion=unit_z_2)  # -> Geometry, Transform
divide_distance = DivideDistance(Curve=move_10.Geometry, Distance=distance)  # -> Points, Tangents, Parameters
insert_items_3 = InsertItems(List=divide_distance.Points, Item=dispatch.ListA, Indices="0", Wrap=True)
list_length_2 = ListLength(List=insert_items_3)
insert_items_4 = InsertItems(List=insert_items_3, Item=dispatch.ListB, Indices=list_length_2, Wrap=True)
drawing_points = Point(insert_items_4)

# ---- group: weave waypoints
panel_3 = Panel("""0
1
2
3""")
above_ink_well_2 = Point(above_ink_well)
in_ink_well_2 = Point(in_ink_well)
drawing_points_2 = Point(drawing_points)
weave = Weave(
    Pattern=panel_3,
    Stream0=graft(above_ink_well_2),
    Stream1=graft(in_ink_well_2),
    Stream2=graft(above_ink_well_2),
    Stream3=drawing_points_2,
    NullGaps=False)
waypoints = Point(weave)

# ---- group: transformations
point = Point(flatten(waypoints))
flip_plane = FlipPlane(Plane=point, ReverseX=False, ReverseY=False, SwapAxes=True)
transformto = TransformTo(Plane=flip_plane, Relative=False)

# ---- group: merge actions
merge = Merge(Data1=motionmode, Data2=speedto, Data3=transformto)

# ---- group: generate program
# program
boolean_toggle = BooleanToggle(True)
actions = Panel(merge)
compileprogram = CompileProgram(Robot=createrobot, Actions=merge, InLineTargets=boolean_toggle, Comments=Toggle(True))

# ---- group: save program
# output
c_script = CSharpScript()  # -> out, here
# ---------- c_script: C# usings ----------
using System.IO;
# ---------- c_script: C# ----------
    string targetFolder = "";

    GH_Document gh_d = owner.OnPingDocument();
    if (gh_d.IsFilePathDefined)
    {
      string ghFilePath = gh_d.FilePath;
      targetFolder = Path.GetDirectoryName(ghFilePath);
    }
    else
    {
      Print("No local folder found, please save your file locally.");
    }

    here = targetFolder;
# ---------- end c_script ----------
saveprogram = SaveProgram(Robot=createrobot, RobotProgram=compileprogram, Path=c_script.here)
panel_4 = Panel(saveprogram)

# ---- group: print program
displayprogram = DisplayProgram(RobotProgram=compileprogram)
panel_5 = Panel(displayprogram)

# ---- group: simulation
polyline = PolyLine(Vertices=weave, Closed=False)
list_item_4 = ListItem(List=flatten(polyline), Index=Slider(0, range=0..101), Wrap=True)
custom_preview_4 = CustomPreview(Geometry=list_item_4, Material=ColourSwatch(SwatchColor=RGB(0, 0, 0)))
