# Grasshopper definition machina-ur10e-sine-curves.gh (Grasshopper 1.0.7)
# plug-ins: Machina

# ---- group: create robot system
# using machina
panel = Panel("UR")
# system
panel_2 = Panel("wandering_vector")
# UR10e
# real-time control
# move to point
createrobot = CreateRobot(Name=panel_2, Brand=panel)

# ----
count = Slider(6, range=0..10)
seed = Slider(5, range=0..100)
x_scale = Slider(125, range=0..360)
# sine curves
factor = Slider(1.61, range=0..3)
steps = Slider(10, range=0..10)
y_scale = Slider(75, range=0..360)
pi = Pi(Factor=factor)
random = Random(Range="0 To 2", Number=count, Seed=seed)
range = Range(Domain=pi, Steps=steps)
multiplication = Multiplication(A=range, B=graft(random))
sine = Sine(Value=multiplication)
construct_point = ConstructPoint(XCoordinate=range, YCoordinate=sine, ZCoordinate=0)
interpolate = Interpolate(Vertices=construct_point, Degree=3, Periodic=False, KnotStyle=1)  # -> Curve, Length, Domain
scale_nu = ScaleNU(Geometry=interpolate.Curve, Plane=PlaneXY(0, 0, 0), ScaleX=x_scale, ScaleY=y_scale, ScaleZ=1)  # -> Geometry, Transform
curve = Curve(flatten(scale_nu.Geometry))

# ---- group: move to starting position
curve_2 = Curve(curve)
xy_plane = XYPlane(Origin=Point(0, 0, 0))
# commands
origin = Panel("500,0,-50")
vector_2pt = Vector2Pt(PointA=xy_plane, PointB=origin, Unitize=False)  # -> Vector, Length
move = Move(Geometry=curve_2, Motion=vector_2pt.Vector)  # -> Geometry, Transform
curve_3 = Curve(move.Geometry)

# ---- group: set initial speed
speed = Slider(50, range=0..100)
speedto = SpeedTo(Speed=speed, Relative=False)

# ---- group: set precision
precision = Slider(2, range=0..10)
precisionto = PrecisionTo(Radius=precision, Relative=False)

# ---- group: set path
curve_4 = Curve(curve_3)
count_2 = Slider(36, range=0..10000)
perp_frames = PerpFrames(Curve=curve_4, Count=count_2, Align=True)  # -> Frames, Parameters
deconstruct_plane = DeconstructPlane(Plane=perp_frames.Frames)  # -> Origin, XAxis, YAxis, ZAxis
rotate_3d = Rotate3D(Geometry=perp_frames.Frames, Angle="-0.5 * PI", Center=deconstruct_plane.Origin, Axis=deconstruct_plane.XAxis)  # -> Geometry, Transform
transformto = TransformTo(Plane=rotate_3d.Geometry, Relative=False)  # -> flatten(Action)

# ---- group: wait
time = Slider(500, range=0..5000)
wait = Wait(Time=time)

# ---- group: set speed
speed_2 = Slider(50, range=0..100)
speedto_2 = SpeedTo(Speed=speed_2, Relative=False)

# ---- group: move home
# set home position
# using joint rotation angles
# in degrees
panel_3 = Panel("0")
axesto = AxesTo(A1=panel_3, A2="-90", A3="-90", A4="-90", A5="90", A6=panel_3, Relative=False)

# set home position
# using joint rotation angles
# in degrees
panel_4 = Panel("0")
axesto_2 = AxesTo(A1=panel_4, A2="-90", A3="-90", A4="-90", A5="90", A6=panel_4, Relative=False)

# ---- group: merge actions
# program
merge = Merge(Data1=axesto, Data2=speedto, Data3=precisionto, Data4=transformto, Data5=wait, Data6=speedto_2, Data7=axesto_2)
panel_5 = Panel(merge)

# ---- group: generate program
compileprogram = CompileProgram(Robot=createrobot, Actions=merge, InLineTargets=Toggle(True), Comments=Toggle(True))

# ---- group: save program
# output
# stream
c_script = CSharpScript()  # -> out, here
# ---------- c_script: C# usings ----------
using System.IO;
# ---------- c_script: C# ----------
    string targetFolder = "";

    GH_Document gh_d = owner.OnPingDocument();
    if (gh_d.IsFilePathDefined)
    {
      string ghFilePath = gh_d.FilePath;
      targetFolder = Path.GetDirectoryName(ghFilePath);
    }
    else
    {
      Print("No local folder found, please save your file locally.");
    }

    here = targetFolder;
# ---------- end c_script ----------
saveprogram = SaveProgram(Robot=createrobot, RobotProgram=compileprogram, Path=c_script.here)
panel_6 = Panel(saveprogram)

# ---- group: stream program via machina bridge
connect_to_bridge = BooleanToggle(False)
send_program = Button()
connect = Connect(URL="ws://127.0.0.1:6999/Bridge", Name="Grasshopper", Connect=connect_to_bridge)  # -> Status, Bridge
send = Send(Bridge=connect.Bridge, Actions=merge, Send=send_program)  # -> Sent, Instructions
listen = Listen(Bridge=connect.Bridge, Autoupdate=True, Interval=66)
panel_7 = Panel(connect.Status)
actionexecuted = ActionExecuted(BridgeMessage=listen)  # -> LastAction, ActionTCP, ActionAxes, ActionExternalAxes, PendingActions, PendingActionsOnDevice
panel_8 = Panel(send.Sent)
panel_9 = Panel(send.Instructions)
panel_10 = Panel(actionexecuted.PendingActions)
panel_11 = Panel(actionexecuted.LastAction)
data_recorder = DataRecorder(actionexecuted.ActionTCP, DataLimit=-10, RecordData=True)
plane = Plane(data_recorder)

# ---- group: print program
displayprogram = DisplayProgram(RobotProgram=compileprogram)
panel_12 = Panel(displayprogram)
