# Grasshopper definition machina-ur10e-strange-attractor.gh (Grasshopper 1.0.7)
# plug-ins: Chen System, Machina

# ---- group: create robot system
# using machina
panel = Panel("UR")
# system
panel_2 = Panel("strange_attractor")
# UR10e
# real-time control
# strange attractor
createrobot = CreateRobot(Name=panel_2, Brand=panel)

# ---- group: chen system strange attractor
# strange attractor
# using chimpanzee
a = Slider(42, range=0..100)
iterations = Slider(8000, range=0..36000)
chen_system = ChenSystem(A=a, Iterations=iterations)
interpolate = Interpolate(Vertices=chen_system, Degree=3, Periodic=False, KnotStyle=1)  # -> Curve, Length, Domain
xz_plane = XZPlane(Origin=Point(0, 0, 0))
rotate = Rotate(Geometry=interpolate.Curve, Angle=degrees("90"), Plane=xz_plane)  # -> Geometry, Transform
yz_plane = YZPlane(Origin=Point(0, 0, 0))
rotate_2 = Rotate(Geometry=rotate.Geometry, Angle=degrees("135"), Plane=yz_plane)  # -> Geometry, Transform
project = Project(Geometry=rotate_2.Geometry, Plane=PlaneXY(0, 0, 0))  # -> Geometry, Transform
curve = Curve(project.Geometry)

# ---- group: set initial speed
speed = Slider(25, range=0..100)
speedto = SpeedTo(Speed=speed, Relative=False)

# ---- group: generate path
curve_2 = Curve(curve)
scale = Slider(10, range=0..100)
program_zero = Panel("900,0,-60")
count = Slider(3000, range=0..10000)
brush_height = Panel("0 To 10")
scale_nu = ScaleNU(Geometry=curve_2, Plane=PlaneXY(0, 0, 0), ScaleX=scale, ScaleY=scale, ScaleZ=1)  # -> Geometry, Transform
xy_plane = XYPlane(Origin=Point(0, 0, 0))
vector_2pt = Vector2Pt(PointA=xy_plane, PointB=program_zero, Unitize=False)  # -> Vector, Length
range = Range(Domain=brush_height, Steps=count)
move = Move(Geometry=scale_nu.Geometry, Motion=vector_2pt.Vector)  # -> Geometry, Transform
divide_curve = DivideCurve(Curve=move.Geometry, Count=count, Kinks=False)  # -> Points, Tangents, Parameters
unit_z = UnitZ(Factor=range)
move_2 = Move(Geometry=divide_curve.Points, Motion=unit_z)  # -> Geometry, Transform
pl = ConstructPlane(Origin=move_2.Geometry, XAxis="-1,0,0", YAxis=Vector(0, 1, 0))
transformto = TransformTo(Plane=pl, Relative=False)  # -> flatten(Action)

# ---- group: wait
time = Slider(500, range=0..5000)
wait = Wait(Time=time)

# ---- group: set speed
speed_2 = Slider(50, range=0..100)
speedto_2 = SpeedTo(Speed=speed_2, Relative=False)

# ---- group: move home
# commands
# set home position
# using joint rotation angles
# in degrees
panel_3 = Panel("0")
axesto = AxesTo(A1=panel_3, A2="-90", A3="-90", A4="-90", A5="90", A6=panel_3, Relative=False)

# set home position
# using joint rotation angles
# in degrees
panel_4 = Panel("0")
axesto_2 = AxesTo(A1=panel_4, A2="-90", A3="-90", A4="-90", A5="90", A6=panel_4, Relative=False)

# ----
# MoveJ
motionmode = MotionMode(MotionMode=1)

# ---- group: merge actions
# program
merge = Merge(Data1=axesto, Data2=motionmode, Data3=speedto, Data4=transformto, Data5=wait, Data6=speedto_2, Data7=axesto_2)
panel_5 = Panel(merge)

# ----
# workspace
panel_6 = Panel("400,600,0")
rectangle_2pt = Rectangle2Pt(Plane=PlaneXY(0, 0, 0), PointA=panel_6, PointB="1300,-600,0", Radius=0)  # -> Rectangle, Length
custom_preview = CustomPreview(Geometry=rectangle_2pt.Rectangle, Material=ColourSwatch(SwatchColor=RGB(255, 255, 255)))

# ----
# paper
panel_7 = Panel("500,200,0")
rectangle_2pt_2 = Rectangle2Pt(Plane=PlaneXY(0, 0, 0), PointA=panel_7, PointB="950,-400,0", Radius=0)  # -> Rectangle, Length
custom_preview_2 = CustomPreview(Geometry=rectangle_2pt_2.Rectangle, Material=ColourSwatch(SwatchColor=RGB(209, 209, 209)))

# ---- group: generate program
compileprogram = CompileProgram(Robot=createrobot, Actions=merge, InLineTargets=Toggle(True), Comments=Toggle(True))

# ---- group: save program
# output
# stream
c_script = CSharpScript()  # -> out, here
# ---------- c_script: C# usings ----------
using System.IO;
# ---------- c_script: C# ----------
    string targetFolder = "";

    GH_Document gh_d = owner.OnPingDocument();
    if (gh_d.IsFilePathDefined)
    {
      string ghFilePath = gh_d.FilePath;
      targetFolder = Path.GetDirectoryName(ghFilePath);
    }
    else
    {
      Print("No local folder found, please save your file locally.");
    }

    here = targetFolder;
# ---------- end c_script ----------
saveprogram = SaveProgram(Robot=createrobot, RobotProgram=compileprogram, Path=c_script.here)
panel_8 = Panel(saveprogram)

# ---- group: stream program via machina bridge
connect_to_bridge = BooleanToggle(False)
send_program = Button()
connect = Connect(URL="ws://127.0.0.1:6999/Bridge", Name="Grasshopper", Connect=connect_to_bridge)  # -> Status, Bridge
send = Send(Bridge=connect.Bridge, Actions=merge, Send=send_program)  # -> Sent, Instructions
listen = Listen(Bridge=connect.Bridge, Autoupdate=True, Interval=66)
panel_9 = Panel(connect.Status)
actionexecuted = ActionExecuted(BridgeMessage=listen)  # -> LastAction, ActionTCP, ActionAxes, ActionExternalAxes, PendingActions, PendingActionsOnDevice
panel_10 = Panel(send.Sent)
panel_11 = Panel(send.Instructions)
panel_12 = Panel(actionexecuted.PendingActions)
panel_13 = Panel(actionexecuted.LastAction)
data_recorder = DataRecorder(actionexecuted.ActionTCP, DataLimit=-10, RecordData=True)
plane = Plane(data_recorder)

# ---- group: print program
displayprogram = DisplayProgram(RobotProgram=compileprogram)
panel_14 = Panel(displayprogram)
