# Grasshopper definition machina-ur10e-wandering-noise.gh (Grasshopper 1.0.7)
# plug-ins: Heteroptera, Machina, Nursery

# ---- group: set initial speed
speed = Slider(36, range=0..100)
speedto = SpeedTo(Speed=speed, Relative=False)

# ---- group: create robot system
# using machina
panel = Panel("UR")
# system
panel_2 = Panel("wandering_noise")
# UR10e
# real-time control
# move to point
createrobot = CreateRobot(Name=panel_2, Brand=panel)

# ---- group: particles wandering across noise field
# using nursery
number_slider = Slider(2, range=0..10)
distance = Slider(25, range=0..100)
attenuation = Slider(0.46, range=0..1)
noise = Slider(0.1, range=0..1)
rotation = Slider(2, range=0..10)
xy = Slider(10, range=0..10)
# wandering vector
size = Slider(1, range=0..10)
extents = Slider(20, range=0..20)
point = Point(Point(0, 0, 0))
# commands
scale = Slider(3, range=0..10)
xy_2 = XYPlane(Origin=point)
createnoiseelement = CreateNoiseFieldElement(
    NoiseLocation=xy_2,
    Weight=number_slider,
    MaxDistance=distance,
    Attenuation=attenuation,
    NoiseScale=noise,
    RotationScale=rotation,
    XY=True)
sqgrid = Square(Plane=xy_2, Size=size, ExtentX=extents, ExtentY=extents)  # -> Cells, flatten(Points)
construct_point = ConstructPoint(XCoordinate=xy, YCoordinate=xy, ZCoordinate=0)
createfield = CreateField(FieldElements=createnoiseelement)
steps = Slider(100, range=0..1000)
circle = Circle(Plane=construct_point, Radius=xy)
xy_3 = XYPlane(Origin=sqgrid.Points)
simfield = SimulateField(Planes=xy_3, Field=createfield, SimulationSteps=steps, Strength=Slider(2, range=0..10), Normalize=False)
point_in_curve = PointInCurve(Point=simfield, Curve=circle)  # -> Relationship, Point
inside = Panel("2")
equality = Equality(FirstNumber=point_in_curve.Relationship, SecondNumber=inside)  # -> Equality, Inequality
cull_pattern = CullPattern(List=simfield, CullPattern=equality.Equality)
prune_tree = PruneTree(Tree=cull_pattern, Minimum="2", Maximum=0)
interpolate = Interpolate(Vertices=prune_tree, Degree=3, Periodic=False, KnotStyle=1)  # -> Curve, Length, Domain
scale_2 = Scale(Geometry=interpolate.Curve, Center=Point(0, 0, 0), Factor=scale)  # -> Geometry, Transform
curve = Curve(flatten(scale_2.Geometry))

# ---- group: wait
time = Slider(1000, range=0..5000)
wait = Wait(Time=time)

# ---- group: set speed
speed_2 = Slider(50, range=0..100)
speedto_2 = SpeedTo(Speed=speed_2, Relative=False)

# ---- group: move home
# set home position
# using joint rotation angles
# in degrees
panel_3 = Panel("0")
axesto = AxesTo(A1=panel_3, A2="-90", A3="-90", A4="-90", A5="90", A6=panel_3, Relative=False)

# ----
# MoveJ
motionmode = MotionMode(MotionMode=1)

# ----
# workspace
panel_4 = Panel("400,600,0")
rectangle_2pt = Rectangle2Pt(Plane=PlaneXY(0, 0, 0), PointA=panel_4, PointB="1300,-600,0", Radius=0)  # -> Rectangle, Length
rectangle = Rectangle(Plane=PlaneXY(0, 0, 0), XSize="450", YSize="600", Radius=0)  # -> Rectangle, Length
polygon_center = PolygonCenter(Polyline=rectangle_2pt.Rectangle)  # -> CenterV, CenterE, CenterA
polygon_center_2 = PolygonCenter(Polyline=rectangle.Rectangle)  # -> CenterV, CenterE, CenterA
vector_2pt = Vector2Pt(PointA=polygon_center_2.CenterA, PointB=polygon_center.CenterA, Unitize=False)  # -> Vector, Length
move = Move(Geometry=rectangle.Rectangle, Motion=vector_2pt.Vector)  # -> Geometry, Transform
custom_preview = CustomPreview(Geometry=rectangle_2pt.Rectangle, Material=ColourSwatch(SwatchColor=RGB(255, 255, 255)))
custom_preview_2 = CustomPreview(Geometry=move.Geometry, Material=ColourSwatch(SwatchColor=RGB(209, 209, 209)))
centroid = Point(polygon_center.CenterA)
paper = Curve(move.Geometry)

# ---- group: inkwell
paper_2 = Curve(move.Geometry)
discontinuity = Discontinuity(Curve=paper_2, Level=1)  # -> Points, Parameters
list_item = ListItem(List=discontinuity.Points, Index=0, Wrap=True)
ink_well = Point(list_item)

# ---- group: transform to paper space
curve_2 = Curve(curve)
centroid_2 = Point(centroid)
scale_3 = Slider(6, range=0..10)
center = Center(Geometry=curve_2, forall=True, referenceAll=0)  # -> Center, Dimension
vector_2pt_2 = Vector2Pt(PointA=center.Center, PointB=centroid_2, Unitize=False)  # -> Vector, Length
move_2 = Move(Geometry=curve_2, Motion=vector_2pt_2.Vector)  # -> Geometry, Transform
scale_4 = Scale(Geometry=move_2.Geometry, Center=centroid_2, Factor=scale_3)  # -> Geometry, Transform
colour = ColourSwatch(SwatchColor=RGB(0, 0, 0))
custom_preview_3 = CustomPreview(Geometry=scale_4.Geometry, Material=colour)
curve_3 = Curve(scale_4.Geometry)

# ---- group: generate path / generate waypoints
curve_4 = Curve(curve_3)
initial_brush_height = Slider(-252, range=-300..300)
brush_height_change = Slider(2, range=0..100)
distance_2 = Slider(25, range=0..100)
list_length = ListLength(List=curve_4)
unit_z = UnitZ(Factor=initial_brush_height)
move_3 = Move(Geometry=curve_4, Motion=unit_z)  # -> Geometry, Transform
range = Range(Domain=brush_height_change, Steps=list_length)
unit_z_2 = UnitZ(Factor=range)
move_4 = Move(Geometry=move_3.Geometry, Motion=unit_z_2)  # -> Geometry, Transform
divide_distance = DivideDistance(Curve=move_4.Geometry, Distance=distance_2)  # -> Points, Tangents, Parameters

# ---- group: generate path
engage_retract = Slider(36, range=0..100)
ink_well_2 = Point(ink_well)
move_5 = Move(Geometry=ink_well_2, Motion=unit_z)  # -> Geometry, Transform

# ---- group: generate path / engage with start points
unit_z_3 = UnitZ(Factor=engage_retract)
list_item_2 = ListItem(List=divide_distance.Points, Index="0", Wrap=True)
move_6 = Move(Geometry=list_item_2, Motion=unit_z_3)  # -> Geometry, Transform
insert_items = InsertItems(List=divide_distance.Points, Item=move_6.Geometry, Indices="0", Wrap=True)

# ---- group: generate path / retract from end points
list_length_2 = ListLength(List=insert_items)
unit_z_4 = UnitZ(Factor=engage_retract)
list_item_3 = ListItem(List=insert_items, Index=expr("x-1", list_length_2), Wrap=True)
move_7 = Move(Geometry=list_item_3, Motion=unit_z_4)  # -> Geometry, Transform
insert_items_2 = InsertItems(List=insert_items, Item=move_7.Geometry, Indices=list_length_2, Wrap=True)

# ----
unit_z_5 = UnitZ(Factor=engage_retract)

# ---- group: save program
# output
# stream
c_script = CSharpScript()  # -> out, here
# ---------- c_script: C# usings ----------
using System.IO;
# ---------- c_script: C# ----------
    string targetFolder = "";

    GH_Document gh_d = owner.OnPingDocument();
    if (gh_d.IsFilePathDefined)
    {
      string ghFilePath = gh_d.FilePath;
      targetFolder = Path.GetDirectoryName(ghFilePath);
    }
    else
    {
      Print("No local folder found, please save your file locally.");
    }

    here = targetFolder;
# ---------- end c_script ----------

# ---- group: stream program via machina bridge
connect_to_bridge = BooleanToggle(False)
send_program = Button()
connect = Connect(URL="ws://127.0.0.1:6999/Bridge", Name="Grasshopper", Connect=connect_to_bridge)  # -> Status, Bridge
listen = Listen(Bridge=connect.Bridge, Autoupdate=True, Interval=66)
panel_5 = Panel(connect.Status)
actionexecuted = ActionExecuted(BridgeMessage=listen)  # -> LastAction, ActionTCP, ActionAxes, ActionExternalAxes, PendingActions, PendingActionsOnDevice
panel_6 = Panel(actionexecuted.PendingActions)
panel_7 = Panel(actionexecuted.LastAction)
data_recorder = DataRecorder(actionexecuted.ActionTCP, DataLimit=-10, RecordData=True)
plane = Plane(data_recorder)

# ---- group: generate path / dip in inkwell
ink_well_3 = Point(move_5.Geometry)
vector_2pt_3 = Vector2Pt(PointA=move_7.Geometry, PointB=ink_well_3, Unitize=False)  # -> Vector, Length
unit_z_6 = UnitZ(Factor=engage_retract)
move_8 = Move(Geometry=move_7.Geometry, Motion=vector_2pt_3.Vector)  # -> Geometry, Transform
negative = Negative(Value=unit_z_5)
move_9 = Move(Geometry=move_8.Geometry, Motion=unit_z_6)  # -> Geometry, Transform
insert_items_3 = InsertItems(List=insert_items_2, Item=move_9.Geometry, Indices=expr("x+1", list_length_2), Wrap=True)

# ----
move_10 = Move(Geometry=move_9.Geometry, Motion=negative)  # -> Geometry, Transform

# ---- group: generate path / dip in inkwell (continued)
insert_items_4 = InsertItems(List=insert_items_3, Item=move_10.Geometry, Indices=expr("x+2", list_length_2), Wrap=True)
move_11 = Move(Geometry=move_10.Geometry, Motion=unit_z_5)  # -> Geometry, Transform
insert_items_5 = InsertItems(List=insert_items_4, Item=move_11.Geometry, Indices=expr("x+3", list_length_2), Wrap=True)

# ---- group: generate path / transform to planes
pl = ConstructPlane(Origin=flatten(insert_items_5), XAxis="-1,0,0", YAxis=Vector(0, 1, 0))
transformto = TransformTo(Plane=pl, Relative=False)  # -> flatten(Action)

# ---- group: merge actions
# program
merge = Merge(Data1=motionmode, Data2=speedto, Data3=transformto, Data4=wait, Data5=speedto_2, Data6=axesto)
panel_8 = Panel(merge)

# ---- group: generate program
compileprogram = CompileProgram(Robot=createrobot, Actions=merge, InLineTargets=Toggle(True), Comments=Toggle(True))

# ---- group: save program (continued)
saveprogram = SaveProgram(Robot=createrobot, RobotProgram=compileprogram, Path=c_script.here)
panel_9 = Panel(saveprogram)

# ---- group: stream program via machina bridge (continued)
send = Send(Bridge=connect.Bridge, Actions=merge, Send=send_program)  # -> Sent, Instructions
panel_10 = Panel(send.Sent)
panel_11 = Panel(send.Instructions)

# ---- group: print program
displayprogram = DisplayProgram(RobotProgram=compileprogram)
panel_12 = Panel(displayprogram)
