# Grasshopper definition machina-ur10e-wandering-vector.gh (Grasshopper 1.0.7)
# plug-ins: Machina, Nursery

# ---- group: create robot system
# using machina
panel = Panel("UR")
# system
panel_2 = Panel("wandering_vector")
# UR10e
# real-time control
# move to point
createrobot = CreateRobot(Name=panel_2, Brand=panel)

# ----
# using nursery
z = Slider(360, range=-1300..1300)
weight = Slider(2, range=0..10)
attenuation = Slider(0, range=0..1)
noise = Slider(0.02, range=0..1)
# wandering vector
x = Slider(500, range=-1300..1300)
y = Slider(0, range=-1300..1300)
distance = Slider(1133, range=0..1300)
rotation = Slider(4.81, range=0..10)
construct_point = ConstructPoint(XCoordinate=x, YCoordinate=y, ZCoordinate=z)
xy_plane = XYPlane(Origin=construct_point)
create_noise_field_element = CreateNoiseFieldElement(
    NoiseLocation=xy_plane,
    Weight=weight,
    MaxDistance=distance,
    Attenuation=attenuation,
    NoiseScale=noise,
    RotationScale=rotation,
    XY=True)
strength = Slider(2, range=0..10)
steps = Slider(1000, range=0..1000)
create_field = CreateField(FieldElements=create_noise_field_element)
xy_plane_2 = XYPlane(Origin=xy_plane)
simulate_field = SimulateField(Planes=xy_plane_2, Field=create_field, SimulationSteps=steps, Strength=strength, Normalize=False)
interpolate = Interpolate(Vertices=simulate_field, Degree=3, Periodic=False, KnotStyle=1)  # -> Curve, Length, Domain
curve = Curve(interpolate.Curve)

# ---- group: starting message
# commands
panel_3 = Panel("move along path")
message = Message(Message=panel_3)

# ---- group: set initial speed
speed = Slider(36, range=0..100)
speedto = SpeedTo(Speed=speed, Relative=False)

# ---- group: set path
curve_2 = Curve(curve)
count = Slider(100, range=0..10000)
perp_frames = PerpFrames(Curve=curve_2, Count=count, Align=True)  # -> Frames, Parameters
deconstruct_plane = DeconstructPlane(Plane=perp_frames.Frames)  # -> Origin, XAxis, YAxis, ZAxis
rotate_3d = Rotate3D(Geometry=perp_frames.Frames, Angle="-0.5 * PI", Center=deconstruct_plane.Origin, Axis=deconstruct_plane.XAxis)  # -> Geometry, Transform
transformto = TransformTo(Plane=rotate_3d.Geometry, Relative=False)  # -> flatten(Action)

# ---- group: wait
time = Slider(1000, range=0..5000)
wait = Wait(Time=time)

# ---- group: set speed
speed_2 = Slider(50, range=0..100)
speedto_2 = SpeedTo(Speed=speed_2, Relative=False)

# ---- group: move home
# set home position
# using joint rotation angles
# in degrees
panel_4 = Panel("0")
axesto = AxesTo(A1=panel_4, A2="-90", A3="-90", A4="-90", A5="90", A6=panel_4, Relative=False)

# ---- group: merge actions
# program
merge = Merge(Data1=message, Data2=speedto, Data4=transformto, Data5=wait, Data6=speedto_2, Data7=axesto)
panel_5 = Panel(merge)

# ----
# MoveJ
motionmode = MotionMode(MotionMode=1)

# ---- group: workspace
# workspace
panel_6 = Panel("400,600,0")
rectangle_2pt = Rectangle2Pt(Plane=PlaneXY(0, 0, 0), PointA=panel_6, PointB="1300,-600,0", Radius=0)  # -> Rectangle, Length
custom_preview = CustomPreview(Geometry=rectangle_2pt.Rectangle, Material=ColourSwatch(SwatchColor=RGB(255, 255, 255)))

# ---- group: paper
rectangle_2pt_2 = Rectangle2Pt(Plane=PlaneXY(0, 0, 0), PointA="500,200,0", PointB="950,-400,0", Radius=0)  # -> Rectangle, Length
custom_preview_2 = CustomPreview(Geometry=rectangle_2pt_2.Rectangle, Material=ColourSwatch(SwatchColor=RGB(209, 209, 209)))

# ---- group: generate program
compileprogram = CompileProgram(Robot=createrobot, Actions=merge, InLineTargets=Toggle(True), Comments=Toggle(True))

# ---- group: save program
# output
# stream
c_script = CSharpScript()  # -> out, here
# ---------- c_script: C# usings ----------
using System.IO;
# ---------- c_script: C# ----------
    string targetFolder = "";

    GH_Document gh_d = owner.OnPingDocument();
    if (gh_d.IsFilePathDefined)
    {
      string ghFilePath = gh_d.FilePath;
      targetFolder = Path.GetDirectoryName(ghFilePath);
    }
    else
    {
      Print("No local folder found, please save your file locally.");
    }

    here = targetFolder;
# ---------- end c_script ----------
saveprogram = SaveProgram(Robot=createrobot, RobotProgram=compileprogram, Path=c_script.here)
panel_7 = Panel(saveprogram)

# ---- group: stream program via machina bridge
connect_to_bridge = BooleanToggle(False)
send_program = Button()
connect = Connect(URL="ws://127.0.0.1:6999/Bridge", Name="Grasshopper", Connect=connect_to_bridge)  # -> Status, Bridge
send = Send(Bridge=connect.Bridge, Actions=merge, Send=send_program)  # -> Sent, Instructions
listen = Listen(Bridge=connect.Bridge, Autoupdate=True, Interval=66)
panel_8 = Panel(connect.Status)
actionexecuted = ActionExecuted(BridgeMessage=listen)  # -> LastAction, ActionTCP, ActionAxes, ActionExternalAxes, PendingActions, PendingActionsOnDevice
panel_9 = Panel(send.Sent)
panel_10 = Panel(send.Instructions)
panel_11 = Panel(actionexecuted.PendingActions)
panel_12 = Panel(actionexecuted.LastAction)
data_recorder = DataRecorder(actionexecuted.ActionTCP, DataLimit=-10, RecordData=True)
plane = Plane(data_recorder)

# ---- group: print program
displayprogram = DisplayProgram(RobotProgram=compileprogram)
panel_13 = Panel(displayprogram)
