# Grasshopper definition robots-ur10e-draw-sine-curves.gh (Grasshopper 1.0.7)
# plug-ins: Robots

# ---- group: robot system
# using the robots plugin
list = ValueList({"UR5e", "UR10e"}, selected="UR10e")
# UR10e
# program and simulation:
# move joint
load_robot_system = LoadRobotSystem(Name=list, Base="0,0,0")

# ---- group: create random sine curves
# sine curves
factor = Slider(1.61, range=0..3)
steps = Slider(10, range=0..10)
count = Slider(6, range=0..10)
seed = Slider(5, range=0..100)
x_scale = Slider(125, range=0..360)
y_scale = Slider(75, range=0..360)
pi = Pi(Factor=factor)
random = Random(Range="0 To 2", Number=count, Seed=seed)
range = Range(Domain=pi, Steps=steps)
multiplication = Multiplication(A=range, B=graft(random))
sine = Sine(Value=multiplication)
construct_point = ConstructPoint(XCoordinate=range, YCoordinate=sine, ZCoordinate=0)
interpolate = Interpolate(Vertices=construct_point, Degree=3, Periodic=False, KnotStyle=1)  # -> Curve, Length, Domain
scale_nu = ScaleNU(Geometry=interpolate.Curve, Plane=PlaneXY(0, 0, 0), ScaleX=x_scale, ScaleY=y_scale, ScaleZ=1)  # -> Geometry, Transform
curve = Curve(flatten(scale_nu.Geometry))

# ---- group: move to starting position
xy_plane = XYPlane(Origin=Point(0, 0, 0))
curve_2 = Curve(curve)
origin = Panel("500,0,-50")
vector_2pt = Vector2Pt(PointA=xy_plane, PointB=origin, Unitize=False)  # -> Vector, Length
move = Move(Geometry=curve_2, Motion=vector_2pt.Vector)  # -> Geometry, Transform
curve_3 = Curve(move.Geometry)

# ---- group: set path
curve_4 = Curve(curve_3)
count_2 = Slider(36, range=0..10000)
perp_frames = PerpFrames(Curve=curve_4, Count=count_2, Align=True)  # -> Frames, Parameters
deconstruct_plane = DeconstructPlane(Plane=perp_frames.Frames)  # -> Origin, XAxis, YAxis, ZAxis
rotate_3d = Rotate3D(Geometry=perp_frames.Frames, Angle="-0.5 * PI", Center=deconstruct_plane.Origin, Axis=deconstruct_plane.XAxis)  # -> Geometry, Transform

# ---- group: tool
create_tool = CreateTool(Name="DefaultGHTool", TCP=PlaneXY(0, 0, 0), Weight=0)  # -> Tool, TCP

# ---- group: create targets
list_2 = ValueList({"Joint", "Linear"}, selected="Joint")
create_target = CreateTarget(Plane=rotate_3d.Geometry, Motion=list_2, Tool=create_tool.Tool, Speed="25.0", Zone="2.0", IsCartesian=True)  # -> flatten(Target)

# ---- group: home position
# set home position using
# joint rotation angles
home_position = Panel("0,-pi/2,-pi/2,-pi/2,pi/2,0")
create_target_2 = CreateTarget(Joints=home_position, Tool=create_tool.Tool, Speed="30.0", Zone="20.0", IsCartesian=False)
insert_items = InsertItems(List=create_target, Item=create_target_2, Indices="0", Wrap=True)

# ---- group: program
create_program = CreateProgram(Name="draw_sine_curves", RobotSystem=load_robot_system, Targets1=insert_items, StepSize=1)  # -> Program, Code, Duration, Warnings, Errors

# ----
robot_program = Panel(create_program.Code)

# ---- group: preview
# simulation
# Right click Program Simulation
# and select 'open controls'
# to preview the tool path
# or move the slider.
number_slider = Slider(1, range=0..1)
program_simulation = ProgramSimulation(Program=create_program.Program, Time=number_slider, Normalized=True)  # -> SystemMeshes, JointRotations, Plane, Index, Time, Program, Errors
simple_trail = SimpleTrail(Program=program_simulation.Program, Length=500, MechanicalGroup=0)
time = Panel(program_simulation.Time)

# ---- group: save program to file
# Enable to save the program to a file.
filepath = Panel("D:\generative-design\robotics\robots\scripts")
save_program = SaveProgram(Program=create_program.Program, Folder=filepath)  # disabled
