# Grasshopper definition robots-ur10e-move.gh (Grasshopper 1.0.7)
# plug-ins: Robots

# ---- group: robot system
# using the robots plugin
list = ValueList({"UR5e", "UR10e"}, selected="UR10e")
# UR10e
# program and simulation:
# move joint
load_robot_system = LoadRobotSystem(Name=list, Base="0,0,0")

# ---- group: tool
create_tool = CreateTool(Name="DefaultGHTool", TCP=PlaneXY(0, 0, 0), Weight=0)  # -> Tool, TCP

# ---- group: target
X = Slider(1000, range=-1300..1300)
Y = Slider(0, range=-1300..1300)
Z = Slider(400, range=0..1300)
construct_point = ConstructPoint(XCoordinate=X, YCoordinate=Y, ZCoordinate=Z)
construct_plane = ConstructPlane(Origin=construct_point, XAxis="-1,0,0", YAxis=Vector(0, 1, 0))
list_2 = ValueList({"Joint", "Linear"}, selected="Joint")
create_target = CreateTarget(Plane=construct_plane, Motion=list_2, Tool=create_tool.Tool, Speed="25.0", Zone="2.0", IsCartesian=True)

# ---- group: home position
# set home position using
# joint rotation angles
home_position = Panel("0,-pi/2,-pi/2,-pi/2,pi/2,0")
create_target_2 = CreateTarget(Joints=home_position, Tool=create_tool.Tool, Speed="30.0", Zone="20.0", IsCartesian=False)
insert_items = InsertItems(List=create_target, Item=create_target_2, Indices="0", Wrap=True)

# ---- group: program
create_program = CreateProgram(Name="move", RobotSystem=load_robot_system, Targets1=insert_items, StepSize=1)  # -> Program, Code, Duration, Warnings, Errors

# ----
robot_program = Panel(create_program.Code)

# ---- group: preview
# simulation
# Right click Program Simulation
# and select 'open controls'
# to preview the tool path
# or move the slider.
number_slider = Slider(1, range=0..1)
program_simulation = ProgramSimulation(Program=create_program.Program, Time=number_slider, Normalized=True)  # -> SystemMeshes, JointRotations, Plane, Index, Time, Program, Errors
simple_trail = SimpleTrail(Program=program_simulation.Program, Length=500, MechanicalGroup=0)
time = Panel(program_simulation.Time)

# ---- group: save program to file
# Enable to save the program to a file.
filepath = Panel("D:\generative-design\robotics\robots\scripts")
save_program = SaveProgram(Program=create_program.Program, Folder=filepath)  # disabled
