# Grasshopper definition ur10e-move.gh (Grasshopper 1.0.7)
# plug-ins: Robots

# ---- group: robot system
list = ValueList({"Bartlett-IRB120", "Bartlett-IRB1600", "Bartlett-KR6", "Bartlett-KR60-A", "Bartlett-KR60-B", "Bartlett-KR500", "Bartlett-KR60 on track", "Bartlett-UR10", "Bartlett-KR60", "Bartlett-TX200", "Bartlett-TX200L", "Bartlett-RX160", "Bartlett-RX160L", "CITA-IRB1600-145 + Turntable", "CITA-IRB1600-145 + IRB140", "CITA-IRB1600-145", "CITA-IRB140", "CITA-UR5e", "UR5e", "UR10e"}, selected="UR10e")
load_robot_system = LoadRobotSystem(Name=list, Base="0,0,240")

# ---- group: tool
# basic move program
create_tool = CreateTool(Name="DefaultGHTool", TCP=PlaneXY(0, 0, 0), Weight=0)  # -> Tool, TCP

# ---- group: target
X = Slider(0, range=-1300..1300)
Y = Slider(-1000, range=-1300..1300)
Z = Slider(240, range=0..1300)
construct_point = ConstructPoint(XCoordinate=X, YCoordinate=Y, ZCoordinate=Z)
construct_plane = ConstructPlane(Origin=construct_point, XAxis="-1,0,0", YAxis=Vector(0, 1, 0))
list_2 = ValueList({"Joint", "Linear"}, selected="Joint")
create_target = CreateTarget(Plane=construct_plane, Motion=list_2, Tool=create_tool.Tool, Speed="25.0", Zone="2.0", IsCartesian=True)

# ---- group: home position
# A home position should be set using joint rotation values.
# This is the only way to unambiguously define a robot pose.
home_position = Panel("pi/2,-pi/2,pi/2,-pi/2,-pi/2,0")
speed_parameter = SpeedParameter("30.0")
zone_parameter = ZoneParameter("20.0")
create_target_2 = CreateTarget(Joints=home_position, Tool=create_tool.Tool, Speed=speed_parameter, Zone=zone_parameter, IsCartesian=False)
insert_items = InsertItems(List=create_target, Item=create_target_2, Indices="0", Wrap=True)

# ---- group: program
create_program = CreateProgram(Name="program", RobotSystem=load_robot_system, Targets1=insert_items, StepSize=1)  # -> Program, Code, Duration, Warnings, Errors

# ----
robot_program = Panel(create_program.Program)

# ---- group: preview
# simulation
# Right click Program Simulation
# and select 'open controls'
# to preview the tool path
# or move the slider.
number_slider = Slider(0, range=0..1)
program_simulation = ProgramSimulation(Program=create_program.Program, Time=number_slider, Normalized=True)  # -> SystemMeshes, JointRotations, Plane, Index, Time, Program, Errors
simple_trail = SimpleTrail(Program=program_simulation.Program, Length=500, MechanicalGroup=0)
time = Panel(program_simulation.Time)

# ---- group: save program to file
# Enable to save the program to a file.
filepath = Panel("D:\generative-design\robotics\robots\scripts")
save_program = SaveProgram(Program=create_program.Program, Folder=filepath)  # disabled
