# Grasshopper definition ur10e.gh (Grasshopper 1.0.7)
# plug-ins: Robots

# ---- group: tool
create_tool = CreateTool(Name="DefaultGHTool", TCP=PlaneXY(0, 0, 0), Weight=0)  # -> Tool, TCP

# ---- group: home position
# A home position should be set using joint rotation values.
# This is the only way to unambiguously define a robot pose.
panel = Panel("30.0")
home_position = Panel("pi/2,-pi/2,pi/2,-pi/2,-pi/2,0")
speed_parameter = SpeedParameter(panel)
zone_parameter = ZoneParameter("20.0")
create_target = CreateTarget(Joints=home_position, Tool=create_tool.Tool, Speed=speed_parameter, Zone=zone_parameter, IsCartesian=False)

# ---- group: robot system
# program &
# simulation
list = ValueList({"Bartlett-IRB120", "Bartlett-IRB1600", "Bartlett-KR6", "Bartlett-KR60-A", "Bartlett-KR60-B", "Bartlett-KR500", "Bartlett-KR60 on track", "Bartlett-UR10", "Bartlett-KR60", "Bartlett-TX200", "Bartlett-TX200L", "Bartlett-RX160", "Bartlett-RX160L", "CITA-IRB1600-145 + Turntable", "CITA-IRB1600-145 + IRB140", "CITA-IRB1600-145", "CITA-IRB140", "CITA-UR5e", "UR5e", "UR10e"}, selected="UR10e")
load_robot_system = LoadRobotSystem(Name=list, Base="0,0,240")

# ---- group: program
create_program = CreateProgram(Name="program", RobotSystem=load_robot_system, Targets1=create_target, StepSize=1)  # -> Program, Code, Duration, Warnings, Errors

# ----
robot_program = Panel(create_program.Program)

# ---- group: preview
# Right click Program Simulation
# and select 'open controls'
# to preview the tool path
# or move the slider.
number_slider = Slider(0, range=0..1)
program_simulation = ProgramSimulation(Program=create_program.Program, Time=number_slider, Normalized=True)  # -> SystemMeshes, JointRotations, Plane, Index, Time, Program, Errors
simple_trail = SimpleTrail(Program=program_simulation.Program, Length=500, MechanicalGroup=0)
time = Panel(program_simulation.Time)

# ---- group: save program to file
# Enable to save the program to a file.
filepath = Panel("D:\generative-design\robotics\robots\scripts")
save_program = SaveProgram(Program=create_program.Program, Folder=filepath)  # disabled
