# Grasshopper definition tool-mount.gh (Grasshopper 1.0.7)
# Copyright: GNU General Public License

# ---- group: plate
# tool mount
# ur10e
radius = Slider(37.5, range=0..100)
thickness = Slider(5, range=0..10)
radius_2 = Slider(25, range=0..100)
radius_3 = Slider(3.2, range=0..10)
radius_4 = Slider(5.7, range=0..10)
unit_z = UnitZ(Factor=thickness)
unit_x = UnitX(Factor=radius_2)
circle = Circle(Plane=PlaneXY(0, 0, 0), Radius=radius)
circle_2 = Circle(Plane=PlaneXY(0, 0, 0), Radius=[radius_3, radius_4])
extrude = Extrude(Base=circle, Direction=unit_z)
move = Move(Geometry=circle_2, Motion=unit_x)  # -> Geometry, Transform
cap_holes = CapHoles(Brep=extrude)
polar_array = PolarArray(Geometry=move.Geometry, Plane=PlaneXY(0, 0, 0), Count="4", Angle=6.283185307)  # -> Geometry, Transform
explode_tree = ExplodeTree(Data=polar_array.Geometry)  # -> Branch0, Branch1
vector = Vector(unit_z)
vector_2 = Vector(vector)
extrude_2 = Extrude(Base=explode_tree.Branch0, Direction=vector)
division = Division(A=vector_2, B="2")
extrude_3 = Extrude(Base=explode_tree.Branch1, Direction=division)
cap_holes_2 = CapHoles(Brep=extrude_2)
cap_holes_3 = CapHoles(Brep=extrude_3)
solid_difference = SolidDifference(BrepsA=cap_holes, BrepsB=flatten([cap_holes_2, cap_holes_3]))
fillet_edge = FilletEdge(Shape=solid_difference, Blend=1, Metric=0, Edges="2", Radii="0.5")

# ---- group: dowel
pin = Slider(3, range=0..10)
pin_length = Slider(4, range=0..10)
circle_3 = Circle(Plane=PlaneXY(0, 0, 0), Radius=pin)
move_2 = Move(Geometry=circle_3, Motion=unit_x)  # -> Geometry, Transform
rotate = Rotate(Geometry=move_2.Geometry, Angle=degrees("45"), Plane=PlaneXY(0, 0, 0))  # -> Geometry, Transform
unit_z_2 = UnitZ(Factor=pin_length)
extrude_4 = Extrude(Base=rotate.Geometry, Direction=unit_z_2)
cap_holes_4 = CapHoles(Brep=extrude_4)
vector_3 = Vector(vector)
move_3 = Move(Geometry=cap_holes_4, Motion=vector_3)  # -> Geometry, Transform
fillet_edge_2 = FilletEdge(Shape=move_3.Geometry, Blend=1, Metric=0, Edges="1", Radii="0.5")

# ----
solid_union = SolidUnion(Breps=[fillet_edge, fillet_edge_2])
custom_preview = CustomPreview(Geometry=solid_union, Material=ColourSwatch(SwatchColor=RGB(209, 209, 209)))
